# Grasshopper definition 0_09_Parts_Catalog.gh (Grasshopper 1.0.7)

# ----
# Press the button to make sure the file is
# updated to latest Wasp version on your pc.
button = Button()
# 0_09_Parts_Catalog
updatefile = Wasp_UpdateFile(UPDATE=button)  # -> LOG; inputs UPDATE: Boolean
# ---------- updatefile: Python ----------
# Wasp: Discrete Design with Grasshopper plug-in (GPL) initiated by Andrea Rossi
# 
# This file is part of Wasp.
# 
# Copyright (c) 2017, Andrea Rossi <a.rossi.andrea@gmail.com>
# Wasp is free software; you can redistribute it and/or modify 
# it under the terms of the GNU General Public License as published 
# by the Free Software Foundation; either version 3 of the License, 
# or (at your option) any later version. 
# 
# Wasp is distributed in the hope that it will be useful,
# but WITHOUT ANY WARRANTY; without even the implied warranty of 
# MERCHANTABILITY or FITNESS FOR A PARTICULAR PURPOSE. See the 
# GNU General Public License for more details.
# 
# You should have received a copy of the GNU General Public License
# along with Wasp; If not, see <http://www.gnu.org/licenses/>.
# 
# @license GPL-3.0 <https://www.gnu.org/licenses/gpl.html>
#
# Significant parts of Wasp have been developed by Andrea Rossi
# as part of research on digital materials and discrete design at:
# DDU Digital Design Unit - Prof. Oliver Tessmann
# Technische Universität Darmstadt


#########################################################################
##                            COMPONENT INFO                           ##
#########################################################################

"""
This component doesn't update the installation. It will only update the file
to your current installation. The components that can't be updated automatically
will be marked and should be replaced manually.
--> WIP Component: might be incomplete or contain bugs <--
-
Provided by Wasp 0.5
Code is adapted from Ladybug file updater (https://github.com/mostaphaRoudsari/ladybug)
    
    Args:
        UPDATE: Set to "True" if you want this component to search through the current Grasshopper file and update all Wasp components.
    Returns:
        LOG: List of updated files.
"""

ghenv.Component.Name = "Wasp_Update File"
ghenv.Component.NickName = 'UpdateFile'
ghenv.Component.Message = 'v0.5.004'
ghenv.Component.IconDisplayMode = ghenv.Component.IconDisplayMode.application
ghenv.Component.Category = "Wasp"
ghenv.Component.SubCategory = "X | Experimental"
try: ghenv.Component.AdditionalHelpFromDocStrings = "1"
except: pass

import Grasshopper
import System
import os
from datetime import datetime
import time


def markComponent(doc, comp, note=None):
    """Add a Group to the component with a note."""
    note = note or "There is a change in input or output. Replace manually with the inserted component!"
    grp = Grasshopper.Kernel.Special.GH_Group()
    grp.CreateAttributes()
    grp.Border = Grasshopper.Kernel.Special.GH_GroupBorder.Blob
    grp.AddObject(comp.InstanceGuid)
    grp.Colour = System.Drawing.Color.IndianRed
    grp.NickName = note
    doc.AddObject(grp, False);    
    return True

def isWaspComponent(component):
    """Return True if a component is part of Wasp."""
    if component.Name.split('_')[0] == "Wasp":
        return True
    return False


def collectGHPythonComponents(document=None):
    """Collect all the GHPython components in file.""" 
    components = []
    document = document or ghenv.Component.OnPingDocument()
    for obj in document.Objects:
        if type(obj) == type(ghenv.Component)and isWaspComponent(obj):
            if obj.Locked:
                continue
            components.append(obj)
    # remove the component itself
    components = tuple(comp for comp in components if comp.InstanceGuid != ghenv.Component.InstanceGuid)
    return components


def parseVersion(version):
    if version[:4] == "VER ":
        version = sum(int(n) * 100 ** i for i, n in enumerate(reversed(version.split("VER ")[1].split("."))))
    else:
        version = sum(int(n) * 100 ** i for i, n in enumerate(reversed(version.split("v")[1].split("."))))
    #print version
    return version


def isNewerVersion(uo, component):
    """Check if user object is newer version of the component."""
    # try to get date and time
    warnType = Grasshopper.Kernel.GH_RuntimeMessageLevel.Warning
    try:
        version = parseVersion(component.Message)
    except Exception:
        warning = 'Failed to parse version from "%s" component.' % component.Name
        ghenv.Component.AddRuntimeMessage(warnType, warning)
        return False    
    
    # get the version from the userobject
    for c, line in enumerate(uo.Code.split('\n')):
        if c > 200:
            warning = 'Failed to parse version from "%s" userobject.' % component.Name
            ghenv.Component.AddRuntimeMessage(warnType, warning)
            return False
        if line.strip().startswith("ghenv.Component.Message"):
            uversion = line.split("=")[1].strip()[:-1]
            try:
                uversion = parseVersion(uversion)
            except Exception:
                warning = 'Failed to parse version from "%s" userobject.' % component.Name
                ghenv.Component.AddRuntimeMessage(warnType, warning)
                return False    
            
            if uversion >= version:
                return True
            else:
                return False


def comparePort(p1, p2):
    """compare two ports and return True if they are equal."""
    if hasattr(p1, 'TypeHint'):
        if p1.Name != p2.Name:
            return False
        elif p1.TypeHint.TypeName != p2.TypeHint.TypeName:
            return False
        elif str(p1.Access) != str(p2.Access):
            return False
        else:
            return True
    else:
        # output
        if p1.Name != p2.Name:
            return False
        else:
            return True        

def comparePorts(c1, c2):
    """Compare ports for two components."""
    for i in xrange(c1.Params.Input.Count):
        if not comparePort(c1.Params.Input[i], c2.Params.Input[i]):
            return True
    
    for i in xrange(c1.Params.Output.Count):
        if not comparePort(c1.Params.Output[i], c2.Params.Output[i]):
            return True
    
    return False

def inputOutputChanged(uo, component):
    """Check if inputs or outputs has changed."""
    if uo.Params.Input.Count != component.Params.Input.Count:
        return True
    elif uo.Params.Output.Count != component.Params.Output.Count:
        return True
    
    return comparePorts(uo, component)


def insertNewUO(uo, component, doc):
    # use component to find the location
    x = component.Attributes.Pivot.X + 30
    y = component.Attributes.Pivot.Y - 20
    
    # insert the new one
    uo.Attributes.Pivot = System.Drawing.PointF(x, y)
    doc.AddObject(uo , False, 0)


def updateComponent(component, uofolder):
    """update component from userobject."""
    fp = os.path.join(uofolder, '%s.ghuser' % component.Name)

    if not os.path.isfile(fp):
        warning = 'Failed to find the userobject for %s' % component.Name
        ghenv.Component.AddRuntimeMessage(Grasshopper.Kernel.GH_RuntimeMessageLevel.Warning, warning)
        return False
    uo = Grasshopper.Kernel.GH_UserObject(fp).InstantiateObject()

    # check the version and the date between component and userobject
    if not isNewerVersion(uo, component):
        return False 

    # it is a newer version
    component.Code = uo.Code
    
    # Define the callback function
    def callBack(document):
        component.ExpireSolution(False)

    # Update the solution
    doc.ScheduleSolution(2,
        Grasshopper.Kernel.GH_Document.GH_ScheduleDelegate(callBack))

    # check if inputs or outputs has changed
    if inputOutputChanged(uo, component):
        insertNewUO(uo, component, doc)
        
        # add a group note to the component
        markComponent(doc, component)
        return 'Cannot update %s. Replace manually.' % component.Name

    return 'Updated %s' % component.Name


if UPDATE:
    # find the component
    uofolder = Grasshopper.Folders.UserObjectFolders[0]
    
    doc = ghenv.Component.OnPingDocument()
    
    # load the initial userobject
    components = collectGHPythonComponents(doc)
    
    report = (updateComponent(comp, uofolder) for comp in components)
    
    LOG = '\n'.join(r for r in report if r)
# ---------- end updatefile ----------

pt = Point([<point referenced from the Rhino model> x5])
crv = Curve([<curve referenced from the Rhino model> x5])
# # Wasp: Discrete Design with Grasshopper plug-in (GPL) initiated by Andrea Rossi
# 
# 
# This file is part of Wasp.
# 
# Copyright (c) 2021, Andrea Rossi <a.rossi.andrea@gmail.com>
# 
# Wasp is free software; you can redistribute it and/or modify it under the terms of the GNU General Public License as published by the Free Software Foundation; either version 3 of the License, or (at your option) any later version.
# 
# Wasp is distributed in the hope that it will be useful, but WITHOUT ANY WARRANTY; without even the implied warranty of MERCHANTABILITY or FITNESS FOR A PARTICULAR PURPOSE. See the GNU General Public License for more details. You should have received a copy of the GNU General Public License
#  along with Wasp; If not, see <http://www.gnu.org/licenses/>.
# 
# license GPL-3.0 <https://www.gnu.org/licenses/gpl.html>
# 
# Significant parts of Wasp have been developed by Andrea Rossi as part of research on digital materials and discrete design at DDU Digital Design Unit - Prof. Oliver Tessmann - Technische Universität Darmstadt
geo = Geometry(<brep referenced from the Rhino model>)
geo_2 = Geometry(<brep referenced from the Rhino model>)
pt_2 = Point([<point referenced from the Rhino model> x3])
crv_2 = Curve([<curve referenced from the Rhino model> x3])
conndir = Wasp_ConnectionFromDirection(GEO=geo, CEN=pt, UP=crv)  # -> CONN, PLN_OUT; inputs CEN: list of Point3d, UP: list of Curve, T: list
# ---------- conndir: Python ----------
# Wasp: Discrete Design with Grasshopper plug-in (GPL) initiated by Andrea Rossi
# 
# This file is part of Wasp.
# 
# Copyright (c) 2017, Andrea Rossi <a.rossi.andrea@gmail.com>
# Wasp is free software; you can redistribute it and/or modify 
# it under the terms of the GNU General Public License as published 
# by the Free Software Foundation; either version 3 of the License, 
# or (at your option) any later version. 
# 
# Wasp is distributed in the hope that it will be useful,
# but WITHOUT ANY WARRANTY; without even the implied warranty of 
# MERCHANTABILITY or FITNESS FOR A PARTICULAR PURPOSE. See the 
# GNU General Public License for more details.
# 
# You should have received a copy of the GNU General Public License
# along with Wasp; If not, see <http://www.gnu.org/licenses/>.
# 
# @license GPL-3.0 <https://www.gnu.org/licenses/gpl.html>
#
# Significant parts of Wasp have been developed by Andrea Rossi
# as part of research on digital materials and discrete design at:
# DDU Digital Design Unit - Prof. Oliver Tessmann
# Technische Universität Darmstadt


#########################################################################
##                            COMPONENT INFO                           ##
#########################################################################

"""
Create a connection on a given part geometry from center and X-asix direction
(Z direction is determined based on the normals of the component geometry)
-
Provided by Wasp 0.5
    Args:
        GEO: Geometry of the part to which the connection belongs
        CEN: Origin of the connection plane
        UP: Line idetifying the X-axis of the connection plane - determines the plane orientation to mantain when transforming
        T: OPTIONAL // Connection type (to be used with Rule Generator component)
    Returns:
        CONN: Connection object
        PLN_OUT: Plane for each connection object (for debugging)
"""

ghenv.Component.Name = "Wasp_Connection From Direction"
ghenv.Component.NickName = 'ConnDir'
ghenv.Component.Message = 'v0.5.004'
ghenv.Component.IconDisplayMode = ghenv.Component.IconDisplayMode.application
ghenv.Component.Category = "Wasp"
ghenv.Component.SubCategory = "1 | Elements"
try: ghenv.Component.AdditionalHelpFromDocStrings = "1"
except: pass


import sys
import Rhino.Geometry as rg
import Grasshopper as gh

## add Wasp install directory to system path
wasp_loaded = False
ghcompfolder = gh.Folders.DefaultAssemblyFolder
if ghcompfolder not in sys.path:
    sys.path.append(ghcompfolder)
try:
    from wasp import __version__
    wasp_loaded = True
except:
    msg = "Cannot import Wasp. Is the wasp folder available in " + ghcompfolder + "?"
    ghenv.Component.AddRuntimeMessage(gh.Kernel.GH_RuntimeMessageLevel.Error, msg)

## if Wasp is installed correctly, load the classes required by the component
if wasp_loaded:
    from wasp.core import Connection
    from wasp import global_tolerance


def main(part_geo, conn_centers, conn_ups, conn_type):
        
    check_data = True
    
    ## check inputs
    if part_geo is None:
        check_data = False
        msg = "No part geometry provided"
        ghenv.Component.AddRuntimeMessage(gh.Kernel.GH_RuntimeMessageLevel.Warning, msg)
    
    if len(conn_centers) != len(conn_ups):
        check_data = False
        msg = "Different amount of centers and up vectors provided"
        ghenv.Component.AddRuntimeMessage(gh.Kernel.GH_RuntimeMessageLevel.Error, msg)
    
    types = []
    if len(conn_type) == 0:
        for i in range(len(conn_centers)):
            types.append("0")
    elif len(conn_type) == 1:
        for i in range(len(conn_centers)):
            types.append(conn_type[0])
    elif len(conn_centers) != len(conn_type):
        check_data = False
        msg = "Different amount of centers and types provided"
        ghenv.Component.AddRuntimeMessage(gh.Kernel.GH_RuntimeMessageLevel.Error, msg)
    else:
        for i in range(len(conn_centers)):
            types.append(conn_type[i])
    
    ## execute main code if all needed inputs are available
    if check_data:
        connections = []
        out_planes = []
        for i in range(len(conn_centers)):
            
            center = conn_centers[i]
            up = conn_ups[i]
            plane = None
            
            up_start = rg.Vector3d(up.PointAtStart)
            up_end = rg.Vector3d(up.PointAtEnd)
            up_vec = rg.Vector3d.Subtract(up_end, up_start)
            
            if type(part_geo) == rg.Brep:
                for face in part_geo.Faces:
                    pt_uv = face.ClosestPoint(center)
                    pt = face.PointAt(pt_uv[1], pt_uv[2])
                    dist = rg.Point3d.DistanceTo(center, pt)
                    if(dist < global_tolerance):
                        normal = face.NormalAt(pt_uv[1], pt_uv[2])
                        plane = rg.Plane(center, normal)
                        x_axis = plane.XAxis
                        angle = rg.Vector3d.VectorAngle(x_axis, up_vec, plane)
                        plane.Rotate(angle, normal)
                        break
            
            elif type(part_geo) == rg.Mesh:
                part_geo.Normals.ComputeNormals()
                mesh_pt = part_geo.ClosestMeshPoint(center, global_tolerance)
                if mesh_pt is not None:
                    normal = part_geo.NormalAt(mesh_pt)
                    plane = rg.Plane(center, normal)
                    x_axis = plane.XAxis
                    angle = rg.Vector3d.VectorAngle(x_axis, up_vec, plane)
                    plane.Rotate(angle, normal)
            
            if plane is None:
                msg = "No valid plane provided for connection %d"%(i)
                ghenv.Component.AddRuntimeMessage(gh.Kernel.GH_RuntimeMessageLevel.Error, msg)
            else:
                conn = Connection(plane, types[i], "", -1)
                connections.append(conn)
                out_planes.append(plane)
        
        return connections, out_planes
    
    else:
        return -1

result = main(GEO, CEN, UP, T)

if result != -1:
    CONN = result[0]
    PLN_OUT = result[1]
# ---------- end conndir ----------
conndir_2 = Wasp_ConnectionFromDirection(GEO=geo_2, CEN=pt_2, UP=crv_2)  # -> CONN, PLN_OUT; inputs CEN: list of Point3d, UP: list of Curve, T: list; same code as conndir
mesh = MeshBrep(
    Brep=geo_2,
    Settings={GridMaxCount=0, GridMinCount=16, JaggedSeams=False, MaxEdgeLength=0, MinEdgeLength=2, MinTolerance=0, Refine=True, RefineAngle=0, RelativeTolerance=0.65, SimplePlanes=True, Tolerance=0})
part = Wasp_BasicPart(NAME="P", GEO=geo, CONN=flatten(conndir.CONN))  # -> PART; inputs GEO: Mesh, CONN: list, ATTR: list
# ---------- part: Python ----------
# Wasp: Discrete Design with Grasshopper plug-in (GPL) initiated by Andrea Rossi
# 
# This file is part of Wasp.
# 
# Copyright (c) 2017, Andrea Rossi <a.rossi.andrea@gmail.com>
# Wasp is free software; you can redistribute it and/or modify 
# it under the terms of the GNU General Public License as published 
# by the Free Software Foundation; either version 3 of the License, 
# or (at your option) any later version. 
# 
# Wasp is distributed in the hope that it will be useful,
# but WITHOUT ANY WARRANTY; without even the implied warranty of 
# MERCHANTABILITY or FITNESS FOR A PARTICULAR PURPOSE. See the 
# GNU General Public License for more details.
# 
# You should have received a copy of the GNU General Public License
# along with Wasp; If not, see <http://www.gnu.org/licenses/>.
# 
# @license GPL-3.0 <https://www.gnu.org/licenses/gpl.html>
#
# Significant parts of Wasp have been developed by Andrea Rossi
# as part of research on digital materials and discrete design at:
# DDU Digital Design Unit - Prof. Oliver Tessmann
# Technische Universität Darmstadt


#########################################################################
##                            COMPONENT INFO                           ##
#########################################################################

"""
Create a basic Wasp Part to be used for aggregation
-
Provided by Wasp 0.5
    Args:
        NAME: Part name
        GEO: Part geometry. It will be converted to mesh - to improve performance, perform the conversion before adding to the part and user a low-poly count
        CONN: Connections list
        COLL: OPTIONAL // Collider geometry (for collision detection). A collider will be automatically generated. For complex parts, automatic generation might not work, and you can add a custom collider geometry here.
        ATTR: OPTIONAL // Part attributes
    Returns:
        PART: Part instance
"""

ghenv.Component.Name = "Wasp_Basic Part"
ghenv.Component.NickName = 'Part'
ghenv.Component.Message = 'v0.5.004'
ghenv.Component.IconDisplayMode = ghenv.Component.IconDisplayMode.application
ghenv.Component.Category = "Wasp"
ghenv.Component.SubCategory = "2 | Parts"
try: ghenv.Component.AdditionalHelpFromDocStrings = "1"
except: pass

import sys
import Rhino.Geometry as rg
import Grasshopper as gh


## add Wasp install directory to system path
wasp_loaded = False
ghcompfolder = gh.Folders.DefaultAssemblyFolder
if ghcompfolder not in sys.path:
    sys.path.append(ghcompfolder)
try:
    from wasp import __version__
    wasp_loaded = True
except:
    msg = "Cannot import Wasp. Is the wasp folder available in " + ghcompfolder + "?"
    ghenv.Component.AddRuntimeMessage(gh.Kernel.GH_RuntimeMessageLevel.Error, msg)

## if Wasp is installed correctly, load the classes required by the component
if wasp_loaded:
    from wasp.core import Part
    from wasp.core import Collider
    from wasp import global_tolerance


def main(part_name, part_geo, connections, collider, attributes):
    
    check_data = True
    
    ## check inputs
    if part_name is None:
        check_data = False
        msg = "No part name provided"
        ghenv.Component.AddRuntimeMessage(gh.Kernel.GH_RuntimeMessageLevel.Warning, msg)
    
    if part_geo is None:
        check_data = False
        msg = "No part geometry provided"
        ghenv.Component.AddRuntimeMessage(gh.Kernel.GH_RuntimeMessageLevel.Warning, msg)
        check_data = False
    
    if collider is None:
        if part_geo is not None:
            collider_geo = part_geo.Duplicate().Offset(global_tolerance)
            collider_intersection = rg.Intersect.Intersection.MeshMeshFast(collider_geo, part_geo)
            if len(collider_intersection) > 0:
                collider_geo = None
                collider_geo = part_geo.Duplicate()
                center = part_geo.GetBoundingBox(True).Center
                scale_plane = rg.Plane(center, rg.Vector3d(1,0,0), rg.Vector3d(0,1,0))
                scale_transform = rg.Transform.Scale(scale_plane, 1-global_tolerance, 1-global_tolerance, 1-global_tolerance)
                collider_geo.Transform(scale_transform)
                collider_intersection = rg.Intersect.Intersection.MeshMeshFast(collider_geo, part_geo)
                if len(collider_intersection) > 0:
                    collider_geo = None
                    msg = "Could not compute a valid collider geometry. Please provide a valid collider in the COLL input."
                    ghenv.Component.AddRuntimeMessage(gh.Kernel.GH_RuntimeMessageLevel.Error, msg)
                    check_data = False
            
            if collider_geo is not None:
                collider = Collider([collider_geo])
            
    else:
        if type(collider) != Collider:
            if type(collider) == rg.Mesh:
                collider = Collider([collider])
            else:
                msg = "Collider geometry must be of type Mesh or WaspCollider."
                ghenv.Component.AddRuntimeMessage(gh.Kernel.GH_RuntimeMessageLevel.Error, msg)
                check_data = False
        
    if collider is not None and collider.faces_count > 1000:
        msg = "The collider has a high faces count. Consider providing a low poly collider to improve performance"
        ghenv.Component.AddRuntimeMessage(gh.Kernel.GH_RuntimeMessageLevel.Warning, msg)
    
    
    if check_data:
        new_part = Part(part_name, part_geo, connections, collider, attributes)
        
        if new_part.dim < global_tolerance*10:
            msg = "The parts you created are very small. You might consider scaling them or decreasing the tolerance of your Rhino file."
            ghenv.Component.AddRuntimeMessage(gh.Kernel.GH_RuntimeMessageLevel.Warning, msg)
        
        return new_part
    else:
        return -1


result = main(NAME, GEO, CONN, COLL, ATTR)

if result != -1:
    PART = result
# ---------- end part ----------
part_2 = Wasp_BasicPart(NAME="C", GEO=mesh, CONN=flatten(conndir_2.CONN))  # -> PART; inputs GEO: Mesh, CONN: list, ATTR: list; same code as part
merge = Merge(Data1=part, Data2=part_2)

# ----
# Part Catalog
# This component allows you to control the number of different Part types in
# an Aggregation. The different inputs allows you to control how this is achieved:
# - LIM defines if the catalog is 'limited" (the aggregation will stop when the given
#   numbers of parts are reached) or "proportional (the aggregation  will place all
#   required parts, and the Catalog values will be used as proportions).
# - AD, when LIM is set to False, allows the Catalog to be "adaptive" (meaning it
#   will adapt the part numbers internally according to the number of placed parts).
#   This allows to have more accurate results in some cases, particularly when using
#   field-driven aggregations.
toggle = BooleanToggle(False)
panel = Panel("""25
45""")
partcat = Wasp_PartsCatalog(PART=flatten(merge), NUM=panel, LIM=toggle, AD=Toggle(False))  # -> CAT; inputs PART: list, NUM: list, LIM: Boolean, AD: Boolean
# ---------- partcat: Python ----------
# Wasp: Discrete Design with Grasshopper plug-in (GPL) initiated by Andrea Rossi
# 
# This file is part of Wasp.
# 
# Copyright (c) 2017, Andrea Rossi <a.rossi.andrea@gmail.com>
# Wasp is free software; you can redistribute it and/or modify 
# it under the terms of the GNU General Public License as published 
# by the Free Software Foundation; either version 3 of the License, 
# or (at your option) any later version. 
# 
# Wasp is distributed in the hope that it will be useful,
# but WITHOUT ANY WARRANTY; without even the implied warranty of 
# MERCHANTABILITY or FITNESS FOR A PARTICULAR PURPOSE. See the 
# GNU General Public License for more details.
# 
# You should have received a copy of the GNU General Public License
# along with Wasp; If not, see <http://www.gnu.org/licenses/>.
# 
# @license GPL-3.0 <https://www.gnu.org/licenses/gpl.html>
#
# Significant parts of Wasp have been developed by Andrea Rossi
# as part of research on digital materials and discrete design at:
# DDU Digital Design Unit - Prof. Oliver Tessmann
# Technische Universität Darmstadt


#########################################################################
##                            COMPONENT INFO                           ##
#########################################################################

"""
Part Catalog. It allows to define a fixed number of each type of part to be used in a stochastic aggregation.
-
Provided by Wasp 0.5
    Args:
        PART: Parts from which to generate a parts catalog
        NUM: Amounts of each part in the catalog
        LIM: OPTIONAL // If True, the catalog will be limited, and aggregation will stop after using the given parts numbers. If False, the given numbers will be used as proportional (False by default)
        AD: OPTIONAL // If True, catalog will be adaptive, and change its internal probabilities according to the aggregation state (False by default). Works only if LIM is set to False.
    Returns:
        CAT: Parts catalog
"""

ghenv.Component.Name = "Wasp_Parts Catalog"
ghenv.Component.NickName = 'PartCat'
ghenv.Component.Message = 'v0.5.004'
ghenv.Component.IconDisplayMode = ghenv.Component.IconDisplayMode.application
ghenv.Component.Category = "Wasp"
ghenv.Component.SubCategory = "2 | Parts"
try: ghenv.Component.AdditionalHelpFromDocStrings = "4"
except: pass

import sys
import scriptcontext as sc
import Grasshopper as gh

## add Wasp install directory to system path
wasp_loaded = False
ghcompfolder = gh.Folders.DefaultAssemblyFolder
if ghcompfolder not in sys.path:
    sys.path.append(ghcompfolder)
try:
    from wasp import __version__
    wasp_loaded = True
except:
    msg = "Cannot import Wasp. Is the wasp folder available in " + ghcompfolder + "?"
    ghenv.Component.AddRuntimeMessage(gh.Kernel.GH_RuntimeMessageLevel.Error, msg)

## if Wasp is installed correctly, load the classes required by the component
if wasp_loaded:
    from wasp.core import PartCatalog

def main(parts, amounts, limited, adaptive):
    
    check_data = True
    
    ##check inputs
    if len(parts) == 0:
        check_data = False
        msg = "No part provided"
        ghenv.Component.AddRuntimeMessage(gh.Kernel.GH_RuntimeMessageLevel.Warning, msg)
    
    if len(amounts) == 0:
        check_data = False
        msg = "No part amounts provided"
        ghenv.Component.AddRuntimeMessage(gh.Kernel.GH_RuntimeMessageLevel.Warning, msg)
    
    elif len(amounts) == 1:
        amount = amounts[0]
        amounts = []
        for part in parts:
            amounts.append(amount)
    
    elif len(amounts) != len(parts):
        check_data = False
        msg = "Different amount of parts and part amounts"
        ghenv.Component.AddRuntimeMessage(gh.Kernel.GH_RuntimeMessageLevel.Error, msg)
    
    if limited is None:
        limited = False
    
    if adaptive is None:
        adaptive = False
    
    if check_data:
        part_names = [part.name for part in parts]
        parts_catalog = PartCatalog(part_names, amounts, _is_limited = limited, _is_adaptive = adaptive)
        return parts_catalog
    else:
        return -1


result = main(PART, NUM, LIM, AD)

if result != -1:
    CAT = result
# ---------- end partcat ----------

rulegen = Wasp_RulesGenerator(PART=merge)  # -> R; inputs PART: list, SELF_P: Boolean, SELF_C: Boolean, TYP: Boolean, GR: list
# ---------- rulegen: Python ----------
# Wasp: Discrete Design with Grasshopper plug-in (GPL) initiated by Andrea Rossi
# 
# This file is part of Wasp.
# 
# Copyright (c) 2017, Andrea Rossi <a.rossi.andrea@gmail.com>
# Wasp is free software; you can redistribute it and/or modify 
# it under the terms of the GNU General Public License as published 
# by the Free Software Foundation; either version 3 of the License, 
# or (at your option) any later version. 
# 
# Wasp is distributed in the hope that it will be useful,
# but WITHOUT ANY WARRANTY; without even the implied warranty of 
# MERCHANTABILITY or FITNESS FOR A PARTICULAR PURPOSE. See the 
# GNU General Public License for more details.
# 
# You should have received a copy of the GNU General Public License
# along with Wasp; If not, see <http://www.gnu.org/licenses/>.
# 
# @license GPL-3.0 <https://www.gnu.org/licenses/gpl.html>
#
# Significant parts of Wasp have been developed by Andrea Rossi
# as part of research on digital materials and discrete design at:
# DDU Digital Design Unit - Prof. Oliver Tessmann
# Technische Universität Darmstadt


#########################################################################
##                            COMPONENT INFO                           ##
#########################################################################

"""
Automated rules generator given a list of parts. It has two separate modes:
- If no grammar is provided in the GR input, the component generates rules between connections of the same type.
- If a grammar is provided, rules are created between connections of different types, according to the specified grammar rules.
-
Provided by Wasp 0.5
    Args:
        PART: Parts from which to generate aggregation rules
        SELF_P: OPTIONAL // Create rules between connections belonging to the same part (True by default)
        SELF_C: OPTIONAL // Create rules between connection with same id (True by default)
        TYP: OPTIONAL // Create rules only between connections of the same type (False by default). Make sure this component is set to False when using Rule Grammars.
        GR: OPTIONAL // Custom connection grammar with format "ConnType">"ConnType"
    Returns:
        R: Generated aggregation rules
"""

ghenv.Component.Name = "Wasp_Rules Generator"
ghenv.Component.NickName = 'RuleGen'
ghenv.Component.Message = 'v0.5.004'
ghenv.Component.IconDisplayMode = ghenv.Component.IconDisplayMode.application
ghenv.Component.Category = "Wasp"
ghenv.Component.SubCategory = "3 | Rules"
try: ghenv.Component.AdditionalHelpFromDocStrings = "2"
except: pass

import sys
import Grasshopper as gh


## add Wasp install directory to system path
wasp_loaded = False
ghcompfolder = gh.Folders.DefaultAssemblyFolder
if ghcompfolder not in sys.path:
    sys.path.append(ghcompfolder)
try:
    from wasp import __version__
    wasp_loaded = True
except:
    msg = "Cannot import Wasp. Is the wasp folder available in " + ghcompfolder + "?"
    ghenv.Component.AddRuntimeMessage(gh.Kernel.GH_RuntimeMessageLevel.Error, msg)

## if Wasp is installed correctly, load the classes required by the component
if wasp_loaded:
    from wasp.core import Rule


def main(parts, self_part, self_connection, use_types, grammar):
    
    check_data = True
    
    ##check inputs
    if len(parts) == 0 or parts is None:
        check_data = False
        msg = "No part provided"
        ghenv.Component.AddRuntimeMessage(gh.Kernel.GH_RuntimeMessageLevel.Warning, msg)
    
    if self_part == None:
        self_part = True
    
    if self_connection == None:
        self_connection = True
    
    if use_types is None:
        use_types = False
    
    if check_data:
        rules = []
        
        if len(grammar) == 0:
            for part in parts:
                for conn in part.connections:
                    for other_part in parts:
                        skip_part = False
                        if self_part == False:
                            if part.name == other_part.name:
                                skip_part = True
                            
                        if skip_part == False:
                            for other_conn in other_part.connections:
                                skip_conn = False
                                if self_connection == False:
                                    if conn.id == other_conn.id:
                                        skip_conn = True
                                
                                if skip_conn == False:
                                    if use_types:
                                        if conn.type == other_conn.type:
                                            r = Rule(part.name, conn.id, other_part.name, other_conn.id)
                                            rules.append(r)
                                    else:
                                        r = Rule(part.name, conn.id, other_part.name, other_conn.id)
                                        rules.append(r)
        else:
            for gr_rule in grammar:
                start_type = gr_rule.split(">")[0]
                end_type = gr_rule.split(">")[1]
                
                for part in parts:
                    for conn in part.connections:
                        if conn.type == start_type:
                            for other_part in parts:
                                skip_part = False
                                if self_part == False:
                                    if part.name == other_part.name:
                                        skip_part = True
                                    
                                if skip_part == False:
                                    for other_conn in other_part.connections:
                                        if other_conn.type == end_type:
                                            skip_conn = False
                                            if self_connection == False:
                                                if conn.id == other_conn.id:
                                                    skip_conn = True
                                            
                                            if skip_conn == False:
                                                r = Rule(part.name, conn.id, other_part.name, other_conn.id)
                                                rules.append(r)
        return [rules]
    else:
        return -1


result = main(PART, SELF_P, SELF_C, TYP, GR)

if result != -1:
    R = result[0]
# ---------- end rulegen ----------
stochasticaggregation = Wasp_StochasticAggregation(PART=flatten(merge), N=Slider(120, range=0..1000), RULES=rulegen, CAT=partcat, RESET=Button())  # -> AGGR, PART_OUT; inputs PART: list, PREV: list, N: Int32, RULES: list, SEED: Int32, MODE: Int32, GC: list, RESET: Boolean
# ---------- stochasticaggregation: Python ----------
# Wasp: Discrete Design with Grasshopper plug-in (GPL) initiated by Andrea Rossi
# 
# This file is part of Wasp.
# 
# Copyright (c) 2017, Andrea Rossi <a.rossi.andrea@gmail.com>
# Wasp is free software; you can redistribute it and/or modify 
# it under the terms of the GNU General Public License as published 
# by the Free Software Foundation; either version 3 of the License, 
# or (at your option) any later version. 
# 
# Wasp is distributed in the hope that it will be useful,
# but WITHOUT ANY WARRANTY; without even the implied warranty of 
# MERCHANTABILITY or FITNESS FOR A PARTICULAR PURPOSE. See the 
# GNU General Public License for more details.
# 
# You should have received a copy of the GNU General Public License
# along with Wasp; If not, see <http://www.gnu.org/licenses/>.
# 
# @license GPL-3.0 <https://www.gnu.org/licenses/gpl.html>
#
# Significant parts of Wasp have been developed by Andrea Rossi
# as part of research on digital materials and discrete design at:
# DDU Digital Design Unit - Prof. Oliver Tessmann
# Technische Universität Darmstadt


#########################################################################
##                            COMPONENT INFO                           ##
#########################################################################

"""
Aggregate the given parts in a stochastic process, selecting parts and rules randomly at every step.
The component works additively, hence increasing the number of parts in an aggregation just adds new parts on the existing ones, without triggering recomputing of the previous element.
-
Provided by Wasp 0.5
    Args:
        PART: Parts to be aggregated (can be more than one)
        PREV: OPTIONAL // Previous aggregated parts. It is possible to input the results of a previous aggregation, or parts transformed with the TransformPart component
        N: Number of parts to be aggregated (does not count parts provided in PREV)
        RULES: Rules for the aggregation
        SEED: OPTIONAL // Random seed. Set this to a fixed number to allow recreating the same aggregation every time you reset.
        COLL: OPTIONAL // Collision detection. By default is active and checks for collisions between the aggregated parts
        CAT: OPTIONAL // Part Catalog (to specify fixed numbers or proportions between part types
        MODE: OPTIONAL // Switches between aggregation modes: 0 = no constraints, 1 = local constraints, 2 = global constraints, 3 = local + global constraints
        GC: OPTIONAL // Global constraints to apply to aggregation
        ID: OPTIONAL // Aggregation ID
        RESET: Recompute the whole aggregation
    Returns:
        PART_OUT: Aggregated parts (includes both PREV input and newly aggregated parts)
"""

ghenv.Component.Name = "Wasp_Stochastic Aggregation"
ghenv.Component.NickName = 'StochasticAggregation'
ghenv.Component.Message = 'v0.5.004'
ghenv.Component.IconDisplayMode = ghenv.Component.IconDisplayMode.application
ghenv.Component.Category = "Wasp"
ghenv.Component.SubCategory = "6 | Aggregation"
try: ghenv.Component.AdditionalHelpFromDocStrings = "1"
except: pass

import sys
import Rhino.Geometry as rg
import Grasshopper as gh


## add Wasp install directory to system path
wasp_loaded = False
ghcompfolder = gh.Folders.DefaultAssemblyFolder
if ghcompfolder not in sys.path:
    sys.path.append(ghcompfolder)
try:
    from wasp import __version__
    wasp_loaded = True
except:
    msg = "Cannot import Wasp. Is the wasp folder available in " + ghcompfolder + "?"
    ghenv.Component.AddRuntimeMessage(gh.Kernel.GH_RuntimeMessageLevel.Error, msg)

## if Wasp is installed correctly, load the classes required by the component
if wasp_loaded:
    from wasp.core import Aggregation


def main(parts, previous_parts, num_parts, rules, seed, catalog, aggregation_mode, global_constraints, aggregation_id, reset, aggregation):
    
    check_data = True
    
    ##check inputs
    if len(parts) == 0:
        check_data = False
        msg = "No parts provided"
        ghenv.Component.AddRuntimeMessage(gh.Kernel.GH_RuntimeMessageLevel.Warning, msg)
    
    if num_parts is None:
        check_data = False
        msg = "Provide number of aggregation iterations"
        ghenv.Component.AddRuntimeMessage(gh.Kernel.GH_RuntimeMessageLevel.Warning, msg)
    else:
        if len(previous_parts) != 0:
            num_parts += len(previous_parts)
    
    if len(rules) == 0:
        check_data = False
        msg = "No rules provided"
        ghenv.Component.AddRuntimeMessage(gh.Kernel.GH_RuntimeMessageLevel.Warning, msg)
    
    use_catalog = False
    if catalog is not None:
        use_catalog = True
    
    if aggregation_mode is None:
        aggregation_mode = 0
    
    if aggregation_id is None:
        aggregation_id = 'myAggregation'
    
    if reset is None:
        reset = False
    
    if check_data:
        ## create aggregation in sticky dict
        if aggregation is None or aggregation == -1 or reset:
            
            ## copy parts to avoid editing the original parts
            parts_copy = []
            for part in parts:
                parts_copy.append(part.copy())
            if use_catalog:
                aggregation = Aggregation(aggregation_id, parts_copy, rules, aggregation_mode, _prev = previous_parts, _global_constraints = global_constraints, _rnd_seed = seed, _catalog = catalog.copy())
            else:
                aggregation = Aggregation(aggregation_id, parts_copy, rules, aggregation_mode, _prev = previous_parts, _global_constraints = global_constraints, _rnd_seed = seed)
        ## handle parameters changes
        #### parts
        if parts != aggregation.parts.values():
            
            ## copy parts to avoid editing the original parts
            parts_copy = []
            for part in parts:
                parts_copy.append(part.copy())
            
            aggregation.reset_base_parts(new_parts = parts_copy)
            aggregation.reset_rules(aggregation.rules)
        
        #### rules
        if rules != aggregation.rules:
            aggregation.rules = rules
            aggregation.reset_base_parts()
            aggregation.reset_rules(aggregation.rules)
        
        #### mode
        if aggregation_mode != aggregation.mode:
            aggregation.mode = aggregation_mode
            aggregation.reset_rules(aggregation.rules)
        
        #### constraints
        if global_constraints != aggregation.global_constraints:
            aggregation.global_constraints = global_constraints
            aggregation.reset_rules(aggregation.rules)
        
        ## add parts to aggregation
        if num_parts > len(aggregation.aggregated_parts):
            error_msg = aggregation.aggregate_rnd(num_parts-len(aggregation.aggregated_parts), use_catalog)
            if error_msg is not None:
                ghenv.Component.AddRuntimeMessage(gh.Kernel.GH_RuntimeMessageLevel.Warning, error_msg)
        
        ## remove parts from aggregation
        elif num_parts < len(aggregation.aggregated_parts):
            aggregation.remove_elements(num_parts)
        
        ## return result
        return aggregation
        
    else:
        return -1


## create aggregation container in global variables dict
if 'aggregation_container' not in globals():
    aggregation_container = None

result = main(PART, PREV, N, RULES, SEED, CAT, MODE, GC, ID, RESET, aggregation_container)

if result != -1:
    aggregation_container = result
    
    AGGR = aggregation_container
    PART_OUT = aggregation_container.aggregated_parts
# ---------- end stochasticaggregation ----------
namefilter = Wasp_FilterPartsByName(PART=stochasticaggregation.PART_OUT, NAME="P")  # -> PART_OUT, MASK; inputs PART: list, NAME: list
# ---------- namefilter: Python ----------
# Wasp: Discrete Design with Grasshopper plug-in (GPL) initiated by Andrea Rossi
# 
# This file is part of Wasp.
# 
# Copyright (c) 2017, Andrea Rossi <a.rossi.andrea@gmail.com>
# Wasp is free software; you can redistribute it and/or modify 
# it under the terms of the GNU General Public License as published 
# by the Free Software Foundation; either version 3 of the License, 
# or (at your option) any later version. 
# 
# Wasp is distributed in the hope that it will be useful,
# but WITHOUT ANY WARRANTY; without even the implied warranty of 
# MERCHANTABILITY or FITNESS FOR A PARTICULAR PURPOSE. See the 
# GNU General Public License for more details.
# 
# You should have received a copy of the GNU General Public License
# along with Wasp; If not, see <http://www.gnu.org/licenses/>.
# 
# @license GPL-3.0 <https://www.gnu.org/licenses/gpl.html>
#
# Significant parts of Wasp have been developed by Andrea Rossi
# as part of research on digital materials and discrete design at:
# DDU Digital Design Unit - Prof. Oliver Tessmann
# Technische Universität Darmstadt


#########################################################################
##                            COMPONENT INFO                           ##
#########################################################################

"""
Filter a list of parts according to part names
-
Provided by Wasp 0.5
    Args:
        PART: Parts to filter
        NAME: Name of the parts to extract
    Returns:
        PART_OUT: Filtered parts
        MASK: Boolean mask for the filtered parts
"""

ghenv.Component.Name = "Wasp_Filter Parts by Name"
ghenv.Component.NickName = 'NameFilter'
ghenv.Component.Message = 'v0.5.004'
ghenv.Component.IconDisplayMode = ghenv.Component.IconDisplayMode.application
ghenv.Component.Category = "Wasp"
ghenv.Component.SubCategory = "2 | Parts"
try: ghenv.Component.AdditionalHelpFromDocStrings = "3"
except: pass


import sys
import Rhino.Geometry as rg
import Grasshopper as gh


## add Wasp install directory to system path
wasp_loaded = False
ghcompfolder = gh.Folders.DefaultAssemblyFolder
if ghcompfolder not in sys.path:
    sys.path.append(ghcompfolder)
try:
    from wasp import __version__
    wasp_loaded = True
except:
    msg = "Cannot import Wasp. Is the wasp folder available in " + ghcompfolder + "?"
    ghenv.Component.AddRuntimeMessage(gh.Kernel.GH_RuntimeMessageLevel.Error, msg)

## if Wasp is installed correctly, load the classes required by the component
if wasp_loaded:
    from wasp.core import Part


## from http://www.chenjingcheng.com/grasshopper-python-datatree-list-conversion/
def listToDataTree(list):
    rl = list
    result = gh.DataTree[object]()
    for i in range(len(rl)):
        temp = []
        for j in range(len(rl[i])):
            temp.append(rl[i][j])
        path = gh.Kernel.Data.GH_Path(i)
        result.AddRange(temp, path)
    return result


def main(parts, names):
        
    check_data = True
    
    ## check inputs
    if len(parts) == 0:
        check_data = False
        msg = "No part provided"
        ghenv.Component.AddRuntimeMessage(gh.Kernel.GH_RuntimeMessageLevel.Warning, msg)
    
    if len(names) == 0:
        check_data = False
        msg = "No part name provided"
        ghenv.Component.AddRuntimeMessage(gh.Kernel.GH_RuntimeMessageLevel.Warning, msg)
    
    ## execute main code if all needed inputs are available
    if check_data:
        
        filtered_parts = []
        cull_patterns = []
        for i in xrange(len(names)):
            filtered_parts.append([])
            cull_patterns.append([])
            for part in parts:
                if part.name == names[i]:
                    filtered_parts[i].append(part)
                    cull_patterns[i].append(True)
                else:
                    cull_patterns[i].append(False)
        return filtered_parts, cull_patterns
        
    else:
        return -1

result = main(PART, NAME)

if result != -1:
    for i in range(len(result[0])):
        if len(result[0][i]) == 0:
            msg = "No part found with name %s" % (NAME[i])
            ghenv.Component.AddRuntimeMessage(gh.Kernel.GH_RuntimeMessageLevel.Warning, msg)
    
    PART_OUT = listToDataTree(result[0])
    MASK = listToDataTree(result[1])
# ---------- end namefilter ----------
namefilter_2 = Wasp_FilterPartsByName(PART=stochasticaggregation.PART_OUT, NAME="C")  # -> PART_OUT, MASK; inputs PART: list, NAME: list; same code as namefilter
partgeo = Wasp_GetPartGeometry(PART=namefilter.PART_OUT)  # -> GEO
# ---------- partgeo: Python ----------
# Wasp: Discrete Design with Grasshopper plug-in (GPL) initiated by Andrea Rossi
# 
# This file is part of Wasp.
# 
# Copyright (c) 2017, Andrea Rossi <a.rossi.andrea@gmail.com>
# Wasp is free software; you can redistribute it and/or modify 
# it under the terms of the GNU General Public License as published 
# by the Free Software Foundation; either version 3 of the License, 
# or (at your option) any later version. 
# 
# Wasp is distributed in the hope that it will be useful,
# but WITHOUT ANY WARRANTY; without even the implied warranty of 
# MERCHANTABILITY or FITNESS FOR A PARTICULAR PURPOSE. See the 
# GNU General Public License for more details.
# 
# You should have received a copy of the GNU General Public License
# along with Wasp; If not, see <http://www.gnu.org/licenses/>.
# 
# @license GPL-3.0 <https://www.gnu.org/licenses/gpl.html>
#
# Significant parts of Wasp have been developed by Andrea Rossi
# as part of research on digital materials and discrete design at:
# DDU Digital Design Unit - Prof. Oliver Tessmann
# Technische Universität Darmstadt


#########################################################################
##                            COMPONENT INFO                           ##
#########################################################################

"""
Extract the geometry of one part (for visualization or further processing).
-
Provided by Wasp 0.5
    Args:
        PART: Part from where to extract the geometry
    Returns:
        GEO: Part geometry
"""

ghenv.Component.Name = "Wasp_Get Part Geometry"
ghenv.Component.NickName = 'PartGeo'
ghenv.Component.Message = 'v0.5.004'
ghenv.Component.IconDisplayMode = ghenv.Component.IconDisplayMode.application
ghenv.Component.Category = "Wasp"
ghenv.Component.SubCategory = "2 | Parts"
try: ghenv.Component.AdditionalHelpFromDocStrings = "3"
except: pass


import sys
import Rhino.Geometry as rg
import Grasshopper as gh


## add Wasp install directory to system path
wasp_loaded = False
ghcompfolder = gh.Folders.DefaultAssemblyFolder
if ghcompfolder not in sys.path:
    sys.path.append(ghcompfolder)
try:
    from wasp import __version__
    wasp_loaded = True
except:
    msg = "Cannot import Wasp. Is the wasp folder available in " + ghcompfolder + "?"
    ghenv.Component.AddRuntimeMessage(gh.Kernel.GH_RuntimeMessageLevel.Error, msg)

## if Wasp is installed correctly, load the classes required by the component
if wasp_loaded:
    pass


def main(part):
        
    check_data = True
    
    ## check inputs
    if part is None:
        check_data = False
        msg = "No or null part provided"
        ghenv.Component.AddRuntimeMessage(gh.Kernel.GH_RuntimeMessageLevel.Warning, msg)
    
    ## execute main code if all needed inputs are available
    if check_data:
        return part.geo
    else:
        return -1

result = main(PART)

if result != -1:
    GEO = result
# ---------- end partgeo ----------
partgeo_2 = Wasp_GetPartGeometry(PART=namefilter_2.PART_OUT)  # -> GEO; same code as partgeo
preview = CustomPreview(Geometry=partgeo, Material=ColourSwatch(SwatchColor=RGB(255, 0, 0)))
preview_2 = CustomPreview(Geometry=partgeo_2, Material=ColourSwatch(SwatchColor=RGB(255, 255, 255)))
