# Grasshopper definition 0_04_Part_Geometry_Replacement_RH5.gh (Grasshopper 0.9.76)
# plug-ins: Python Interpreter, Weaverbird

# ----
# Press the button to make sure the file is
# updated to latest Wasp version on your pc.
button = Button()
# # Wasp: Discrete Design with Grasshopper plug-in (GPL) initiated by Andrea Rossi
# 
# 
# This file is part of Wasp.
# 
# Copyright (c) 2019, Andrea Rossi <a.rossi.andrea@gmail.com>
# 
# Wasp is free software; you can redistribute it and/or modify it under the terms of the GNU General Public License as published by the Free Software Foundation; either version 3 of the License, or (at your option) any later version.
# 
# Wasp is distributed in the hope that it will be useful, but WITHOUT ANY WARRANTY; without even the implied warranty of MERCHANTABILITY or FITNESS FOR A PARTICULAR PURPOSE. See the GNU General Public License for more details. You should have received a copy of the GNU General Public License
#  along with Wasp; If not, see <http://www.gnu.org/licenses/>.
# 
# license GPL-3.0 <https://www.gnu.org/licenses/gpl.html>
# 
# Significant parts of Wasp have been developed by Andrea Rossi as part of research on digital materials and discrete design at DDU Digital Design Unit - Prof. Oliver Tessmann - Technische Universität Darmstadt
# 0_04_Part_Geometry_Replacement
updatefile = Wasp_UpdateFile(UPDATE=button)  # -> LOG; inputs UPDATE: Boolean
# ---------- updatefile: Python ----------
# Wasp: Discrete Design with Grasshopper plug-in (GPL) initiated by Andrea Rossi
# 
# This file is part of Wasp.
# 
# Copyright (c) 2017, Andrea Rossi <a.rossi.andrea@gmail.com>
# Wasp is free software; you can redistribute it and/or modify 
# it under the terms of the GNU General Public License as published 
# by the Free Software Foundation; either version 3 of the License, 
# or (at your option) any later version. 
# 
# Wasp is distributed in the hope that it will be useful,
# but WITHOUT ANY WARRANTY; without even the implied warranty of 
# MERCHANTABILITY or FITNESS FOR A PARTICULAR PURPOSE. See the 
# GNU General Public License for more details.
# 
# You should have received a copy of the GNU General Public License
# along with Wasp; If not, see <http://www.gnu.org/licenses/>.
# 
# @license GPL-3.0 <https://www.gnu.org/licenses/gpl.html>
#
# Significant parts of Wasp have been developed by Andrea Rossi
# as part of research on digital materials and discrete design at:
# DDU Digital Design Unit - Prof. Oliver Tessmann
# Technische Universität Darmstadt


#########################################################################
##                            COMPONENT INFO                           ##
#########################################################################

"""
This component doesn't update the installation. It will only update the file
to your current installation. The components that can't be updated automatically
will be marked and should be replaced manually.
--> WIP Component: might be incomplete or contain bugs <--
-
Provided by Wasp 0.2
Code is adapted from Ladybug file updater (https://github.com/mostaphaRoudsari/ladybug)
    
    Args:
        UP: Set to "True" if you want this component to search through the current Grasshopper file and update Wasp components.
    Returns:
        LOG: List of updated files.
"""

ghenv.Component.Name = "Wasp_Update File"
ghenv.Component.NickName = 'UpdateFile'
ghenv.Component.Message = 'VER 0.2.06'
ghenv.Component.IconDisplayMode = ghenv.Component.IconDisplayMode.application
ghenv.Component.Category = "Wasp"
ghenv.Component.SubCategory = "X | Experimental"
try: ghenv.Component.AdditionalHelpFromDocStrings = "1"
except: pass

import Grasshopper
import System
import os
from datetime import datetime
import time


def markComponent(doc, comp, note=None):
    """Add a Group to the component with a note."""
    note = note or "There is a change in input or output. Replace manually with the inserted component!"
    grp = Grasshopper.Kernel.Special.GH_Group()
    grp.CreateAttributes()
    grp.Border = Grasshopper.Kernel.Special.GH_GroupBorder.Blob
    grp.AddObject(comp.InstanceGuid)
    grp.Colour = System.Drawing.Color.IndianRed
    grp.NickName = note
    doc.AddObject(grp, False);    
    return True

def isWaspComponent(component):
    """Return True if a component is part of Wasp."""
    if component.Name.split('_')[0] == "Wasp":
        return True
    return False


def collectGHPythonComponents(document=None):
    """Collect all the GHPython components in file.""" 
    components = []
    document = document or ghenv.Component.OnPingDocument()
    for obj in document.Objects:
        if type(obj) == type(ghenv.Component)and isWaspComponent(obj):
            if obj.Locked:
                continue
            components.append(obj)
    # remove the component itself
    components = tuple(comp for comp in components if comp.InstanceGuid != ghenv.Component.InstanceGuid)
    return components


def parseVersion(version):
    version = sum(int(n) * 10 ** i for i, n in enumerate(reversed(version.split("VER ")[1].split("."))))
    return version


def isNewerVersion(uo, component):
    """Check if user object is newer version of the component."""
    # try to get date and time
    warnType = Grasshopper.Kernel.GH_RuntimeMessageLevel.Warning
    try:
        version = parseVersion(component.Message)
    except Exception:
        warning = 'Failed to parse version from "%s" component.' % component.Name
        ghenv.Component.AddRuntimeMessage(warnType, warning)
        return False    
    
    # get the version from the userobject
    for c, line in enumerate(uo.Code.split('\n')):
        if c > 200:
            warning = 'Failed to parse version from "%s" userobject.' % component.Name
            ghenv.Component.AddRuntimeMessage(warnType, warning)
            return False
        if line.strip().startswith("ghenv.Component.Message"):
            uversion = line.split("=")[1].strip()[:-1]
            try:
                uversion = parseVersion(uversion)
            except Exception:
                warning = 'Failed to parse version from "%s" userobject.' % component.Name
                ghenv.Component.AddRuntimeMessage(warnType, warning)
                return False    
            
            if uversion >= version:
                return True
            else:
                return False


def comparePort(p1, p2):
    """compare two ports and return True if they are equal."""
    if hasattr(p1, 'TypeHint'):
        if p1.Name != p2.Name:
            return False
        elif p1.TypeHint.TypeName != p2.TypeHint.TypeName:
            return False
        elif str(p1.Access) != str(p2.Access):
            return False
        else:
            return True
    else:
        # output
        if p1.Name != p2.Name:
            return False
        else:
            return True        

def comparePorts(c1, c2):
    """Compare ports for two components."""
    for i in xrange(c1.Params.Input.Count):
        if not comparePort(c1.Params.Input[i], c2.Params.Input[i]):
            return True
    
    for i in xrange(c1.Params.Output.Count):
        if not comparePort(c1.Params.Output[i], c2.Params.Output[i]):
            return True
    
    return False

def inputOutputChanged(uo, component):
    """Check if inputs or outputs has changed."""
    if uo.Params.Input.Count != component.Params.Input.Count:
        return True
    elif uo.Params.Output.Count != component.Params.Output.Count:
        return True
    
    return comparePorts(uo, component)


def insertNewUO(uo, component, doc):
    # use component to find the location
    x = component.Attributes.Pivot.X + 30
    y = component.Attributes.Pivot.Y - 20
    
    # insert the new one
    uo.Attributes.Pivot = System.Drawing.PointF(x, y)
    doc.AddObject(uo , False, 0)


def updateComponent(component, uofolder):
    """update component from userobject."""
    fp = os.path.join(uofolder, '%s.ghuser' % component.Name)

    if not os.path.isfile(fp):
        warning = 'Failed to find the userobject for %s' % component.Name
        ghenv.Component.AddRuntimeMessage(Grasshopper.Kernel.GH_RuntimeMessageLevel.Warning, warning)
        return False
    uo = Grasshopper.Kernel.GH_UserObject(fp).InstantiateObject()

    # check the version and the date between component and userobject
    if not isNewerVersion(uo, component):
        return False 

    # it is a newer version
    component.Code = uo.Code
    
    # Define the callback function
    def callBack(document):
        component.ExpireSolution(False)

    # Update the solution
    doc.ScheduleSolution(2,
        Grasshopper.Kernel.GH_Document.GH_ScheduleDelegate(callBack))

    # check if inputs or outputs has changed
    if inputOutputChanged(uo, component):
        insertNewUO(uo, component, doc)
        
        # add a group note to the component
        markComponent(doc, component)
        return 'Cannot update %s. Replace manually.' % component.Name

    return 'Updated %s' % component.Name


if UPDATE:
    # find the component
    uofolder = Grasshopper.Folders.UserObjectFolders[0]
    
    doc = ghenv.Component.OnPingDocument()
    
    # load the initial userobject
    components = collectGHPythonComponents(doc)
    
    report = (updateComponent(comp, uofolder) for comp in components)
    
    LOG = '\n'.join(r for r in report if r)
# ---------- end updatefile ----------

# ----
# 1. Build Part
# Parts are the building blocks of Wasp.
# The most basic way of initializing a part is to define t he geometry (as brep or mesh),
# and the connection faces (center and orientation - with a line). Parts must be named
# to be identifyed in the aggregation rules.
connections_centers = Point([<point referenced from the Rhino model> x2])
connections_centers_2 = Point([<point referenced from the Rhino model> x3])
connections_x_axis = Curve([<curve referenced from the Rhino model> x2])
part_geometry = Brep(<brep referenced from the Rhino model>)
connections_x_axis_2 = Curve([<curve referenced from the Rhino model> x3])
part_geometry_2 = Brep(<brep referenced from the Rhino model>)
conndir = Wasp_ConnectionFromDirection(GEO=part_geometry_2, CEN=connections_centers_2, UP=connections_x_axis_2)  # -> CONN, PLN_OUT; inputs CEN: list of Point3d, UP: list of Curve, T: list
# ---------- conndir: Python ----------
# Wasp: Discrete Design with Grasshopper plug-in (GPL) initiated by Andrea Rossi
# 
# This file is part of Wasp.
# 
# Copyright (c) 2017, Andrea Rossi <a.rossi.andrea@gmail.com>
# Wasp is free software; you can redistribute it and/or modify 
# it under the terms of the GNU General Public License as published 
# by the Free Software Foundation; either version 3 of the License, 
# or (at your option) any later version. 
# 
# Wasp is distributed in the hope that it will be useful,
# but WITHOUT ANY WARRANTY; without even the implied warranty of 
# MERCHANTABILITY or FITNESS FOR A PARTICULAR PURPOSE. See the 
# GNU General Public License for more details.
# 
# You should have received a copy of the GNU General Public License
# along with Wasp; If not, see <http://www.gnu.org/licenses/>.
# 
# @license GPL-3.0 <https://www.gnu.org/licenses/gpl.html>
#
# Significant parts of Wasp have been developed by Andrea Rossi
# as part of research on digital materials and discrete design at:
# DDU Digital Design Unit - Prof. Oliver Tessmann
# Technische Universität Darmstadt


#########################################################################
##                            COMPONENT INFO                           ##
#########################################################################

"""
Create a connection on a given part geometry from center and X-asix direction
(Z direction is determined based on the normals of the component geometry)
-
Provided by Wasp 0.3
    Args:
        GEO: Geometry of the part to which the connection belongs
        CEN: Origin of the connection plane
        UP: Line idetifying the X-axis of the connection plane - determines the plane orientation to mantain when transforming
        T: OPTIONAL // Connection type (to be used with Rule Generator component)
    Returns:
        CONN: Connection object
        PLN_OUT: Plane for each connection object (for debugging)
"""

ghenv.Component.Name = "Wasp_Connection From Direction"
ghenv.Component.NickName = 'ConnDir'
ghenv.Component.Message = 'VER 0.3.002'
ghenv.Component.IconDisplayMode = ghenv.Component.IconDisplayMode.application
ghenv.Component.Category = "Wasp"
ghenv.Component.SubCategory = "1 | Elements"
try: ghenv.Component.AdditionalHelpFromDocStrings = "1"
except: pass


import sys
import Rhino.Geometry as rg
import Grasshopper as gh

## add Wasp install directory to system path
wasp_loaded = False
ghcompfolder = gh.Folders.DefaultAssemblyFolder
if ghcompfolder not in sys.path:
    sys.path.append(ghcompfolder)
try:
    from wasp import __version__
    wasp_loaded = True
except:
    msg = "Cannot import Wasp. Is the wasp folder available in " + ghcompfolder + "?"
    ghenv.Component.AddRuntimeMessage(gh.Kernel.GH_RuntimeMessageLevel.Error, msg)

## if Wasp is installed correctly, load the classes required by the component
if wasp_loaded:
    from wasp import Connection
    from wasp import global_tolerance


def main(part_geo, conn_centers, conn_ups, conn_type):
        
    check_data = True
    
    ## check inputs
    if part_geo is None:
        check_data = False
        msg = "No part geometry provided"
        ghenv.Component.AddRuntimeMessage(gh.Kernel.GH_RuntimeMessageLevel.Warning, msg)
    
    if len(conn_centers) != len(conn_ups):
        check_data = False
        msg = "Different amount of centers and up vectors provided"
        ghenv.Component.AddRuntimeMessage(gh.Kernel.GH_RuntimeMessageLevel.Error, msg)
    
    types = []
    if len(conn_type) == 0:
        for i in range(len(conn_centers)):
            types.append("0")
    elif len(conn_type) == 1:
        for i in range(len(conn_centers)):
            types.append(conn_type[0])
    elif len(conn_centers) != len(conn_type):
        check_data = False
        msg = "Different amount of centers and types provided"
        ghenv.Component.AddRuntimeMessage(gh.Kernel.GH_RuntimeMessageLevel.Error, msg)
    else:
        for i in range(len(conn_centers)):
            types.append(conn_type[i])
    
    ## execute main code if all needed inputs are available
    if check_data:
        connections = []
        out_planes = []
        for i in range(len(conn_centers)):
            
            center = conn_centers[i]
            up = conn_ups[i]
            plane = None
            
            up_start = rg.Vector3d(up.PointAtStart)
            up_end = rg.Vector3d(up.PointAtEnd)
            up_vec = rg.Vector3d.Subtract(up_end, up_start)
            
            if type(part_geo) == rg.Brep:
                for face in part_geo.Faces:
                    pt_uv = face.ClosestPoint(center)
                    pt = face.PointAt(pt_uv[1], pt_uv[2])
                    dist = rg.Point3d.DistanceTo(center, pt)
                    if(dist < global_tolerance):
                        normal = face.NormalAt(pt_uv[1], pt_uv[2])
                        plane = rg.Plane(center, normal)
                        x_axis = plane.XAxis
                        angle = rg.Vector3d.VectorAngle(x_axis, up_vec, plane)
                        plane.Rotate(angle, normal)
                        break
            
            elif type(part_geo) == rg.Mesh:
                part_geo.Normals.ComputeNormals()
                mesh_pt = part_geo.ClosestMeshPoint(center, global_tolerance)
                if mesh_pt is not None:
                    normal = part_geo.NormalAt(mesh_pt)
                    plane = rg.Plane(center, normal)
                    x_axis = plane.XAxis
                    angle = rg.Vector3d.VectorAngle(x_axis, up_vec, plane)
                    plane.Rotate(angle, normal)
            
            if plane is None:
                msg = "No valid plane provided for connection %d"%(i)
                ghenv.Component.AddRuntimeMessage(gh.Kernel.GH_RuntimeMessageLevel.Error, msg)
            else:
                conn = Connection(plane, types[i], "", -1)
                connections.append(conn)
                out_planes.append(plane)
        
        return connections, out_planes
    
    else:
        return -1

result = main(GEO, CEN, UP, T)

if result != -1:
    CONN = result[0]
    PLN_OUT = result[1]
# ---------- end conndir ----------
conndir_2 = Wasp_ConnectionFromDirection(GEO=part_geometry, CEN=connections_centers, UP=connections_x_axis)  # -> CONN, PLN_OUT; inputs CEN: list of Point3d, UP: list of Curve, T: list; same code as conndir
smesh = SimpleMesh(Brep=part_geometry_2)
smesh_2 = SimpleMesh(Brep=part_geometry)
points = PointList(Points=connections_centers, Size=Slider(2, range=0..10))
points_2 = PointList(Points=connections_centers_2, Size=Slider(2, range=0..10))
part_name = Panel("B")
part_name_2 = Panel("A")
part = Wasp_BasicPart(NAME=part_name, GEO=smesh_2, CONN=flatten(conndir_2.CONN))  # -> PART; inputs GEO: Mesh, CONN: list, ATTR: list
# ---------- part: Python ----------
# Wasp: Discrete Design with Grasshopper plug-in (GPL) initiated by Andrea Rossi
# 
# This file is part of Wasp.
# 
# Copyright (c) 2017, Andrea Rossi <a.rossi.andrea@gmail.com>
# Wasp is free software; you can redistribute it and/or modify 
# it under the terms of the GNU General Public License as published 
# by the Free Software Foundation; either version 3 of the License, 
# or (at your option) any later version. 
# 
# Wasp is distributed in the hope that it will be useful,
# but WITHOUT ANY WARRANTY; without even the implied warranty of 
# MERCHANTABILITY or FITNESS FOR A PARTICULAR PURPOSE. See the 
# GNU General Public License for more details.
# 
# You should have received a copy of the GNU General Public License
# along with Wasp; If not, see <http://www.gnu.org/licenses/>.
# 
# @license GPL-3.0 <https://www.gnu.org/licenses/gpl.html>
#
# Significant parts of Wasp have been developed by Andrea Rossi
# as part of research on digital materials and discrete design at:
# DDU Digital Design Unit - Prof. Oliver Tessmann
# Technische Universität Darmstadt


#########################################################################
##                            COMPONENT INFO                           ##
#########################################################################

"""
Create a basic Wasp Part to be used for aggregation
-
Provided by Wasp 0.3
    Args:
        NAME: Part name
        GEO: Part geometry. It will be converted to mesh - to improve performance, perform the conversion before adding to the part and user a low-poly count
        CONN: Connections list
        COLL: OPTIONAL // Collider geometry (for collision detection). A collider will be automatically generated. For complex parts, automatic generation might not work, and you can add a custom collider geometry here.
        ATTR: OPTIONAL // Part attributes
    Returns:
        PART: Part instance
"""

ghenv.Component.Name = "Wasp_Basic Part"
ghenv.Component.NickName = 'Part'
ghenv.Component.Message = 'VER 0.3.002'
ghenv.Component.IconDisplayMode = ghenv.Component.IconDisplayMode.application
ghenv.Component.Category = "Wasp"
ghenv.Component.SubCategory = "2 | Parts"
try: ghenv.Component.AdditionalHelpFromDocStrings = "1"
except: pass

import sys
import Rhino.Geometry as rg
import Grasshopper as gh


## add Wasp install directory to system path
wasp_loaded = False
ghcompfolder = gh.Folders.DefaultAssemblyFolder
if ghcompfolder not in sys.path:
    sys.path.append(ghcompfolder)
try:
    from wasp import __version__
    wasp_loaded = True
except:
    msg = "Cannot import Wasp. Is the wasp folder available in " + ghcompfolder + "?"
    ghenv.Component.AddRuntimeMessage(gh.Kernel.GH_RuntimeMessageLevel.Error, msg)

## if Wasp is installed correctly, load the classes required by the component
if wasp_loaded:
    from wasp import Part
    from wasp import Collider
    from wasp import global_tolerance


def main(part_name, part_geo, connections, collider, attributes):
    
    check_data = True
    
    ## check inputs
    if part_name is None:
        check_data = False
        msg = "No part name provided"
        ghenv.Component.AddRuntimeMessage(gh.Kernel.GH_RuntimeMessageLevel.Warning, msg)
    
    if part_geo is None:
        check_data = False
        msg = "No part geometry provided"
        ghenv.Component.AddRuntimeMessage(gh.Kernel.GH_RuntimeMessageLevel.Warning, msg)
        check_data = False
    
    if collider is None:
        if part_geo is not None:
            collider_geo = part_geo.Duplicate().Offset(global_tolerance)
            collider_intersection = rg.Intersect.Intersection.MeshMeshFast(collider_geo, part_geo)
            if len(collider_intersection) > 0:
                collider_geo = None
                collider_geo = part_geo.Duplicate()
                center = part_geo.GetBoundingBox(True).Center
                scale_plane = rg.Plane(center, rg.Vector3d(1,0,0), rg.Vector3d(0,1,0))
                scale_transform = rg.Transform.Scale(scale_plane, 1-global_tolerance, 1-global_tolerance, 1-global_tolerance)
                collider_geo.Transform(scale_transform)
                collider_intersection = rg.Intersect.Intersection.MeshMeshFast(collider_geo, part_geo)
                if len(collider_intersection) > 0:
                    collider_geo = None
                    msg = "Could not compute a valid collider geometry. Please provide a valid collider in the COLL input."
                    ghenv.Component.AddRuntimeMessage(gh.Kernel.GH_RuntimeMessageLevel.Error, msg)
                    check_data = False
            
            if collider_geo is not None:
                collider = Collider([collider_geo])
            
    else:
        if type(collider) != Collider:
            if type(collider) == rg.Mesh:
                collider = Collider([collider])
            else:
                msg = "Collider geometry must be of type Mesh or WaspCollider."
                ghenv.Component.AddRuntimeMessage(gh.Kernel.GH_RuntimeMessageLevel.Error, msg)
                check_data = False
        
    if collider is not None and collider.faces_count > 1000:
        msg = "The collider has a high faces count. Consider providing a low poly collider to improve performance"
        ghenv.Component.AddRuntimeMessage(gh.Kernel.GH_RuntimeMessageLevel.Warning, msg)
    
    
    if check_data:
        new_part = Part(part_name, part_geo, connections, collider, attributes)
        
        if new_part.dim < global_tolerance*10:
            msg = "The parts you created are very small. You might consider scaling them or decreasing the tolerance of your Rhino file."
            ghenv.Component.AddRuntimeMessage(gh.Kernel.GH_RuntimeMessageLevel.Warning, msg)
        
        return new_part
    else:
        return -1


result = main(NAME, GEO, CONN, COLL, ATTR)

if result != -1:
    PART = result
# ---------- end part ----------
part_2 = Wasp_BasicPart(NAME=part_name_2, GEO=smesh, CONN=flatten(conndir.CONN))  # -> PART; inputs GEO: Mesh, CONN: list, ATTR: list; same code as part

# ----
# 2. Define aggregation rules
# Rules can be defined ina compact way
# with a text string in the format:
# "Part1|Connection1_Part2|Connection2"
rules = Panel("""A|0_B|0
B|0_A|0
A|1_B|0
B|0_A|1
A|2_B|0
B|0_A|2
A|0_B|1
B|1_A|0
A|1_B|1
B|1_A|1
A|2_B|1
B|1_A|2""")
ruletxt = Wasp_RuleFromText(TXT=rules)  # -> R
# ---------- ruletxt: Python ----------
# Wasp: Discrete Design with Grasshopper plug-in (GPL) initiated by Andrea Rossi
# 
# This file is part of Wasp.
# 
# Copyright (c) 2017, Andrea Rossi <a.rossi.andrea@gmail.com>
# Wasp is free software; you can redistribute it and/or modify 
# it under the terms of the GNU General Public License as published 
# by the Free Software Foundation; either version 3 of the License, 
# or (at your option) any later version. 
# 
# Wasp is distributed in the hope that it will be useful,
# but WITHOUT ANY WARRANTY; without even the implied warranty of 
# MERCHANTABILITY or FITNESS FOR A PARTICULAR PURPOSE. See the 
# GNU General Public License for more details.
# 
# You should have received a copy of the GNU General Public License
# along with Wasp; If not, see <http://www.gnu.org/licenses/>.
# 
# @license GPL-3.0 <https://www.gnu.org/licenses/gpl.html>
#
# Significant parts of Wasp have been developed by Andrea Rossi
# as part of research on digital materials and discrete design at:
# DDU Digital Design Unit - Prof. Oliver Tessmann
# Technische Universität Darmstadt


#########################################################################
##                            COMPONENT INFO                           ##
#########################################################################

"""
Generate an aggregation rule from a text string description
-
Provided by Wasp 0.3
    Args:
        TXT: Text description of the rule with format "Part1|Conn1_Part2|Conn2"
    Returns:
        R: Rule
"""

ghenv.Component.Name = "Wasp_Rule From Text"
ghenv.Component.NickName = 'RuleTxt'
ghenv.Component.Message = 'VER 0.3.002'
ghenv.Component.IconDisplayMode = ghenv.Component.IconDisplayMode.application
ghenv.Component.Category = "Wasp"
ghenv.Component.SubCategory = "3 | Rules"
try: ghenv.Component.AdditionalHelpFromDocStrings = "1"
except: pass

import sys
import Grasshopper as gh


## add Wasp install directory to system path
wasp_loaded = False
ghcompfolder = gh.Folders.DefaultAssemblyFolder
if ghcompfolder not in sys.path:
    sys.path.append(ghcompfolder)
try:
    from wasp import __version__
    wasp_loaded = True
except:
    msg = "Cannot import Wasp. Is the wasp folder available in " + ghcompfolder + "?"
    ghenv.Component.AddRuntimeMessage(gh.Kernel.GH_RuntimeMessageLevel.Error, msg)

## if Wasp is installed correctly, load the classes required by the component
if wasp_loaded:
    from wasp import Rule



def main(text):
    
    check_data = True
    
    ##check inputs
    if text is None:
        check_data = False
        msg = "No text provided"
        ghenv.Component.AddRuntimeMessage(gh.Kernel.GH_RuntimeMessageLevel.Warning, msg)
    
    if check_data:
        
        try:
            rule_parts = text.split("_")
            part1 = str(rule_parts[0].split("|")[0])
            conn1 = int(rule_parts[0].split("|")[1])
            part2 = str(rule_parts[1].split("|")[0])
            conn2 = int(rule_parts[1].split("|")[1])
            
            rule = Rule(part1, conn1, part2, conn2)
            return rule
        except:
            msg = "Text string %s is not formatted correctly"%(text)
            ghenv.Component.AddRuntimeMessage(gh.Kernel.GH_RuntimeMessageLevel.Error, msg)
            return -1
    else:
        return -1


result = main(TXT)

if result != -1:
    R = result
# ---------- end ruletxt ----------

merge = Merge(Data1=part_2, Data2=part)

# ----
# 3. Aggregate!
# Stochastic Aggregation builds an aggregation by randomly selecting one part
# and one rule to be applied at every step. The component adds parts additively
# over the already aggregated parts. If a new aggregation has to be created,
# the RESET button allows to reset the aggregation and restart.
parts_num = Slider(250, range=0..1000)
reset = Button()
stochasticaggregation = Wasp_StochasticAggregation(PART=flatten(merge), N=parts_num, RULES=ruletxt, RESET=reset)  # -> AGGR, PART_OUT; inputs PART: list, PREV: list, N: Int32, RULES: list, MODE: Int32, GC: list, RESET: Boolean
# ---------- stochasticaggregation: Python ----------
# Wasp: Discrete Design with Grasshopper plug-in (GPL) initiated by Andrea Rossi
# 
# This file is part of Wasp.
# 
# Copyright (c) 2017, Andrea Rossi <a.rossi.andrea@gmail.com>
# Wasp is free software; you can redistribute it and/or modify 
# it under the terms of the GNU General Public License as published 
# by the Free Software Foundation; either version 3 of the License, 
# or (at your option) any later version. 
# 
# Wasp is distributed in the hope that it will be useful,
# but WITHOUT ANY WARRANTY; without even the implied warranty of 
# MERCHANTABILITY or FITNESS FOR A PARTICULAR PURPOSE. See the 
# GNU General Public License for more details.
# 
# You should have received a copy of the GNU General Public License
# along with Wasp; If not, see <http://www.gnu.org/licenses/>.
# 
# @license GPL-3.0 <https://www.gnu.org/licenses/gpl.html>
#
# Significant parts of Wasp have been developed by Andrea Rossi
# as part of research on digital materials and discrete design at:
# DDU Digital Design Unit - Prof. Oliver Tessmann
# Technische Universität Darmstadt


#########################################################################
##                            COMPONENT INFO                           ##
#########################################################################

"""
Aggregate the given parts in a stochastic process, selecting parts and rules randomly at every step.
The component works additively, hence increasing the number of parts in an aggregation just adds new parts on the existing ones, without triggering recomputing of the previous element.
-
Provided by Wasp 0.3
    Args:
        PART: Parts to be aggregated (can be more than one)
        PREV: OPTIONAL // Previous aggregated parts. It is possible to input the results of a previous aggregation, or parts transformed with the TransformPart component
        N: Number of parts to be aggregated (does not count parts provided in PREV)
        RULES: Rules for the aggregation
        COLL: OPTIONAL // Collision detection. By default is active and checks for collisions between the aggregated parts
        MODE: OPTIONAL // Switches between aggregation modes: 0 = no constraints, 1 = local constraints, 2 = global constraints, 3 = local + global constraints
        GC: OPTIONAL // Global constraints to apply to aggregation
        ID: OPTIONAL // Aggregation ID
        RESET: Recompute the whole aggregation
    Returns:
        PART_OUT: Aggregated parts (includes both PREV input and newly aggregated parts)
"""

ghenv.Component.Name = "Wasp_Stochastic Aggregation"
ghenv.Component.NickName = 'StochasticAggregation'
ghenv.Component.Message = 'VER 0.3.002'
ghenv.Component.IconDisplayMode = ghenv.Component.IconDisplayMode.application
ghenv.Component.Category = "Wasp"
ghenv.Component.SubCategory = "4 | Aggregation"
try: ghenv.Component.AdditionalHelpFromDocStrings = "2"
except: pass

import sys
import Rhino.Geometry as rg
import Grasshopper as gh


## add Wasp install directory to system path
wasp_loaded = False
ghcompfolder = gh.Folders.DefaultAssemblyFolder
if ghcompfolder not in sys.path:
    sys.path.append(ghcompfolder)
try:
    from wasp import __version__
    wasp_loaded = True
except:
    msg = "Cannot import Wasp. Is the wasp folder available in " + ghcompfolder + "?"
    ghenv.Component.AddRuntimeMessage(gh.Kernel.GH_RuntimeMessageLevel.Error, msg)

## if Wasp is installed correctly, load the classes required by the component
if wasp_loaded:
    from wasp import Aggregation


def main(parts, previous_parts, num_parts, rules, aggregation_mode, global_constraints, aggregation_id, reset, aggregation):
    
    check_data = True
    
    ##check inputs
    if len(parts) == 0:
        check_data = False
        msg = "No parts provided"
        ghenv.Component.AddRuntimeMessage(gh.Kernel.GH_RuntimeMessageLevel.Warning, msg)
    
    if num_parts is None:
        check_data = False
        msg = "Provide number of aggregation iterations"
        ghenv.Component.AddRuntimeMessage(gh.Kernel.GH_RuntimeMessageLevel.Warning, msg)
    else:
        if len(previous_parts) != 0:
            num_parts += len(previous_parts)
    
    if len(rules) == 0:
        check_data = False
        msg = "No rules provided"
        ghenv.Component.AddRuntimeMessage(gh.Kernel.GH_RuntimeMessageLevel.Warning, msg)
    
    if aggregation_mode is None:
        aggregation_mode = 0
    
    if aggregation_id is None:
        aggregation_id = 'myAggregation'
    
    if reset is None:
        reset = False
    
    if check_data:
        
        ## create aggregation in sticky dict
        if aggregation is None or aggregation == -1 or reset:
            
            ## copy parts to avoid editing the original parts
            parts_copy = []
            for part in parts:
                parts_copy.append(part.copy())
            
            aggregation = Aggregation(aggregation_id, parts_copy, rules, aggregation_mode, _prev = previous_parts, _global_constraints = global_constraints)
        
        ## handle parameters changes
        #### parts
        if parts != aggregation.parts.values():
            
            ## copy parts to avoid editing the original parts
            parts_copy = []
            for part in parts:
                parts_copy.append(part.copy())
            
            aggregation.reset_base_parts(new_parts = parts_copy)
            aggregation.reset_rules(aggregation.rules)
        
        #### rules
        if rules != aggregation.rules:
            aggregation.rules = rules
            aggregation.reset_base_parts()
            aggregation.reset_rules(aggregation.rules)
        
        #### mode
        if aggregation_mode != aggregation.mode:
            aggregation.mode = aggregation_mode
            aggregation.reset_rules(aggregation.rules)
        
        #### constraints
        if global_constraints != aggregation.global_constraints:
            aggregation.global_constraints = global_constraints
            aggregation.reset_rules(aggregation.rules)
        
        ## add parts to aggregation
        if num_parts > len(aggregation.aggregated_parts):
            error_msg = aggregation.aggregate_rnd(num_parts-len(aggregation.aggregated_parts))
            if error_msg is not None:
                ghenv.Component.AddRuntimeMessage(gh.Kernel.GH_RuntimeMessageLevel.Warning, error_msg)
        
        ## remove parts from aggregation
        elif num_parts < len(aggregation.aggregated_parts):
            aggregation.remove_elements(num_parts)
        
        ## return result
        return aggregation
        
    else:
        return -1


## create aggregation container in global variables dict
if 'aggregation_container' not in globals():
    aggregation_container = None

result = main(PART, PREV, N, RULES, MODE, GC, ID, RESET, aggregation_container)

if result != -1:
    aggregation_container = result
    
    AGGR = aggregation_container
    PART_OUT = aggregation_container.aggregated_parts
# ---------- end stochasticaggregation ----------

# ---- group: DETAILED_GEOMETRY
part_b_detailed = Brep(<brep referenced from the Rhino model>)

part_a_detailed = Brep(<brep referenced from the Rhino model>)

# ----
# 5. Replace Geometry
# Using the TR output from the DePart component,
# it is possible to replace the basic geometry of
# the part with a different geometry (e.g. higher level
# of detail) without slowing down the aggregation process.
# The MASK output of the NameFilter component provides
# a boolean pattern to separate different part types.
panel = Panel("B")
depart = Wasp_DeconstructPart(PART=stochasticaggregation.PART_OUT)  # -> NAME, ID, GEO, CONN, COLL, TR, PARENT, CHILD, ADD_COLL, ATTR
# ---------- depart: Python ----------
# Wasp: Discrete Design with Grasshopper plug-in (GPL) initiated by Andrea Rossi
# 
# This file is part of Wasp.
# 
# Copyright (c) 2017, Andrea Rossi <a.rossi.andrea@gmail.com>
# Wasp is free software; you can redistribute it and/or modify 
# it under the terms of the GNU General Public License as published 
# by the Free Software Foundation; either version 3 of the License, 
# or (at your option) any later version. 
# 
# Wasp is distributed in the hope that it will be useful,
# but WITHOUT ANY WARRANTY; without even the implied warranty of 
# MERCHANTABILITY or FITNESS FOR A PARTICULAR PURPOSE. See the 
# GNU General Public License for more details.
# 
# You should have received a copy of the GNU General Public License
# along with Wasp; If not, see <http://www.gnu.org/licenses/>.
# 
# @license GPL-3.0 <https://www.gnu.org/licenses/gpl.html>
#
# Significant parts of Wasp have been developed by Andrea Rossi
# as part of research on digital materials and discrete design at:
# DDU Digital Design Unit - Prof. Oliver Tessmann
# Technische Universität Darmstadt


#########################################################################
##                            COMPONENT INFO                           ##
#########################################################################

"""
Extract all information stored in a part. Useful for visualization or for further geometry processing
-
Provided by Wasp 0.3
    Args:
        PART: Parts to deconstruct
    Returns:
        NAME: Name of the part
        ID: Pard ID
        GEO: Geometry of the part (as mesh). If Brep geometry is needed, can be stored in the component as attribute, or obtained by transforming the original geometry with the TR output.
        CONN: Part connections
        COLL: Part collider
        TR: Transformation applied to the part. Can be used to transform other geometries in a similar way (eg. replace a low poly component with a more detailed one)
        PARENT: Parent of the part
        CHILD: Children parts attached to the part
        ADD_COLL: Additional collider applied to the part
        ATTR: Part attributes
"""

ghenv.Component.Name = "Wasp_Deconstruct Part"
ghenv.Component.NickName = 'DePart'
ghenv.Component.Message = 'VER 0.3.002'
ghenv.Component.IconDisplayMode = ghenv.Component.IconDisplayMode.application
ghenv.Component.Category = "Wasp"
ghenv.Component.SubCategory = "2 | Parts"
try: ghenv.Component.AdditionalHelpFromDocStrings = "3"
except: pass

import sys
import Grasshopper as gh


## add Wasp install directory to system path
wasp_loaded = False
ghcompfolder = gh.Folders.DefaultAssemblyFolder
if ghcompfolder not in sys.path:
    sys.path.append(ghcompfolder)
try:
    from wasp import __version__
    wasp_loaded = True
except:
    msg = "Cannot import Wasp. Is the wasp folder available in " + ghcompfolder + "?"
    ghenv.Component.AddRuntimeMessage(gh.Kernel.GH_RuntimeMessageLevel.Error, msg)

## if Wasp is installed correctly, load the classes required by the component
if wasp_loaded:
    from wasp import Aggregation


## from http://www.chenjingcheng.com/grasshopper-python-datatree-list-conversion/
def listToDataTree(list):
    rl = list
    result = gh.DataTree[object]()
    for i in range(len(rl)):
        temp = []
        for j in range(len(rl[i])):
            temp.append(rl[i][j])
        path = gh.Kernel.Data.GH_Path(i)
        result.AddRange(temp, path)
    return result


def main(part):
    
    check_data = True
    
    ##check inputs
    if part is None:
        check_data = False
        msg = "No or null part provided"
        ghenv.Component.AddRuntimeMessage(gh.Kernel.GH_RuntimeMessageLevel.Warning, msg)
    
    if check_data:
        
        data_dict = part.return_part_data()
        
        name = data_dict['name']
        id = data_dict['id']
        geometry = data_dict['geo']
        connections = data_dict['connections']
        collider = data_dict['collider']
        
        transform = None
        if "transform" in data_dict.keys():
            transform = data_dict['transform']
        
        add_collider = None
        if "add_collider" in data_dict.keys():
            add_collider = data_dict['add_collider']
        
        parent = None
        if "parent" in data_dict.keys():
            parents = data_dict['parent']
        
        children = None
        if "children" in data_dict.keys():
            children = data_dict['children']
        
        attributes = None
        if "attributes" in data_dict.keys():
            attributes = data_dict['attributes']
        
        return name, id, geometry, connections, collider, transform, parent, children, add_collider, attributes
    else:
        return -1


result = main(PART)

if result != -1:
    NAME = result[0]
    ID = result[1]
    GEO = result[2]
    CONN = result[3]
    COLL = result[4]
    TR = result[5]
    PARENT = result[6]
    CHILD = result[7]
    ADD_COLL = result[8]
    ATTR = result[9]
# ---------- end depart ----------
namefilter = Wasp_FilterPartsByName(PART=stochasticaggregation.PART_OUT, NAME=panel)  # -> PART_OUT, MASK; inputs PART: list, NAME: list
# ---------- namefilter: Python ----------
# Wasp: Discrete Design with Grasshopper plug-in (GPL) initiated by Andrea Rossi
# 
# This file is part of Wasp.
# 
# Copyright (c) 2017, Andrea Rossi <a.rossi.andrea@gmail.com>
# Wasp is free software; you can redistribute it and/or modify 
# it under the terms of the GNU General Public License as published 
# by the Free Software Foundation; either version 3 of the License, 
# or (at your option) any later version. 
# 
# Wasp is distributed in the hope that it will be useful,
# but WITHOUT ANY WARRANTY; without even the implied warranty of 
# MERCHANTABILITY or FITNESS FOR A PARTICULAR PURPOSE. See the 
# GNU General Public License for more details.
# 
# You should have received a copy of the GNU General Public License
# along with Wasp; If not, see <http://www.gnu.org/licenses/>.
# 
# @license GPL-3.0 <https://www.gnu.org/licenses/gpl.html>
#
# Significant parts of Wasp have been developed by Andrea Rossi
# as part of research on digital materials and discrete design at:
# DDU Digital Design Unit - Prof. Oliver Tessmann
# Technische Universität Darmstadt


#########################################################################
##                            COMPONENT INFO                           ##
#########################################################################

"""
Filter a list of parts according to part names
-
Provided by Wasp 0.3
    Args:
        PART: Parts to filter
        NAME: Name of the parts to extract
    Returns:
        PART_OUT: Filtered parts
        MASK: Boolean mask for the filtered parts
"""

ghenv.Component.Name = "Wasp_Filter Parts by Name"
ghenv.Component.NickName = 'NameFilter'
ghenv.Component.Message = 'VER 0.3.002'
ghenv.Component.IconDisplayMode = ghenv.Component.IconDisplayMode.application
ghenv.Component.Category = "Wasp"
ghenv.Component.SubCategory = "2 | Parts"
try: ghenv.Component.AdditionalHelpFromDocStrings = "3"
except: pass


import sys
import Rhino.Geometry as rg
import Grasshopper as gh


## add Wasp install directory to system path
wasp_loaded = False
ghcompfolder = gh.Folders.DefaultAssemblyFolder
if ghcompfolder not in sys.path:
    sys.path.append(ghcompfolder)
try:
    from wasp import __version__
    wasp_loaded = True
except:
    msg = "Cannot import Wasp. Is the wasp folder available in " + ghcompfolder + "?"
    ghenv.Component.AddRuntimeMessage(gh.Kernel.GH_RuntimeMessageLevel.Error, msg)

## if Wasp is installed correctly, load the classes required by the component
if wasp_loaded:
    from wasp import Part


## from http://www.chenjingcheng.com/grasshopper-python-datatree-list-conversion/
def listToDataTree(list):
    rl = list
    result = gh.DataTree[object]()
    for i in range(len(rl)):
        temp = []
        for j in range(len(rl[i])):
            temp.append(rl[i][j])
        path = gh.Kernel.Data.GH_Path(i)
        result.AddRange(temp, path)
    return result


def main(parts, names):
        
    check_data = True
    
    ## check inputs
    if len(parts) == 0:
        check_data = False
        msg = "No part provided"
        ghenv.Component.AddRuntimeMessage(gh.Kernel.GH_RuntimeMessageLevel.Warning, msg)
    
    if len(names) == 0:
        check_data = False
        msg = "No part name provided"
        ghenv.Component.AddRuntimeMessage(gh.Kernel.GH_RuntimeMessageLevel.Warning, msg)
    
    ## execute main code if all needed inputs are available
    if check_data:
        
        filtered_parts = []
        cull_patterns = []
        for i in xrange(len(names)):
            filtered_parts.append([])
            cull_patterns.append([])
            for part in parts:
                if part.name == names[i]:
                    filtered_parts[i].append(part)
                    cull_patterns[i].append(True)
                else:
                    cull_patterns[i].append(False)
        return filtered_parts, cull_patterns
        
    else:
        return -1

result = main(PART, NAME)

if result != -1:
    for i in range(len(result[0])):
        if len(result[0][i]) == 0:
            msg = "No part found with name %s" % (NAME[i])
            ghenv.Component.AddRuntimeMessage(gh.Kernel.GH_RuntimeMessageLevel.Warning, msg)
    
    PART_OUT = listToDataTree(result[0])
    MASK = listToDataTree(result[1])
# ---------- end namefilter ----------
namefilter_2 = Wasp_FilterPartsByName(PART=stochasticaggregation.PART_OUT, NAME="A")  # -> PART_OUT, MASK; inputs PART: list, NAME: list; same code as namefilter
mesh = MeshBrep(
    Brep=part_b_detailed,
    Settings={GridMaxCount=0, GridMinCount=16, JaggedSeams=False, MaxEdgeLength=0, MinEdgeLength=0.0001, MinTolerance=0, Refine=True, RefineAngle=0, RelativeTolerance=0.65, SimplePlanes=True, Tolerance=0})
mesh_2 = MeshBrep(
    Brep=part_a_detailed,
    Settings={GridMaxCount=0, GridMinCount=16, JaggedSeams=False, MaxEdgeLength=0, MinEdgeLength=0.0001, MinTolerance=0, Refine=True, RefineAngle=0, RelativeTolerance=0.65, SimplePlanes=True, Tolerance=0})
wbcatmullclark = WeaverbirdsCatmullClarkSubdivision(MeshCurves=mesh, Level=Slider(2, range=0..10), SmoothNakedEdges=1)
wbcatmullclark_2 = WeaverbirdsCatmullClarkSubdivision(MeshCurves=mesh_2, Level=Slider(2, range=0..10), SmoothNakedEdges=1)
cull = CullPattern(List=depart.TR, CullPattern=namefilter.MASK)
cull_2 = CullPattern(List=depart.TR, CullPattern=namefilter_2.MASK)
transform = Transform(Geometry=wbcatmullclark, Transform=cull)
transform_2 = Transform(Geometry=wbcatmullclark_2, Transform=cull_2)
preview = CustomPreview(Geometry=transform_2, Shader=ColourSwatch(SwatchColor=RGB(255, 0, 0)))
preview_2 = CustomPreview(Geometry=transform, Shader=ColourSwatch(SwatchColor=RGB(255, 255, 255)))
