# Grasshopper definition 01_Basic_Aggregation.gh (Grasshopper 0.9.76)
# plug-ins: Python Interpreter

# ----
# EXAMPLE_01: Basic Aggregation
# 0. Setup Wasp
# Before using any of Wasp components,
# the SetupWasp component must be run
# to initialize all classes and shared variables
toggle = BooleanToggle(True)
waspsetup = Wasp_Setup(RUN=toggle)  # -> log; inputs RUN: Boolean
# ---------- waspsetup: Python ----------
# Wasp: Discrete Design with Grasshopper plug-in (GPL) initiated by Andrea Rossi
# 
# This file is part of Wasp.
# 
# Copyright (c) 2017, Andrea Rossi <a.rossi.andrea@gmail.com>
# Wasp is free software; you can redistribute it and/or modify 
# it under the terms of the GNU General Public License as published 
# by the Free Software Foundation; either version 3 of the License, 
# or (at your option) any later version. 
# 
# Wasp is distributed in the hope that it will be useful,
# but WITHOUT ANY WARRANTY; without even the implied warranty of 
# MERCHANTABILITY or FITNESS FOR A PARTICULAR PURPOSE. See the 
# GNU General Public License for more details.
# 
# You should have received a copy of the GNU General Public License
# along with Wasp; If not, see <http://www.gnu.org/licenses/>.
# 
# @license GPL-3.0 <https://www.gnu.org/licenses/gpl.html>
#
# Significant parts of Wasp have been developed by Andrea Rossi
# as part of research on digital materials and discrete design at:
# DDU Digital Design Unit - Prof. Oliver Tessmann
# Technische Universität Darmstadt


#########################################################################
##                            COMPONENT INFO                           ##
#########################################################################
"""
This components initialized all classes and variables required by Wasp to run.
You must run this component before starting to work with Wasp, or other components will not work properly.

-
Wasp: Discrete Design with Grasshopper plug-in (GPL) initiated by Andrea Rossi
You should have received a copy of the GNU General Public License
along with Wasp; If not, see <http://www.gnu.org/licenses/>.

@license GPL-3.0 <https://www.gnu.org/licenses/gpl.html>

Source code is available at: xxxxx
-
Provided by Wasp 0.1.0
    Args:
        RUN: Setup all classes and variables required to run Wasp. Set it to True to start building.
    Returns:
        log: log
"""

ghenv.Component.Name = "Wasp_Setup"
ghenv.Component.NickName = 'WaspSetup'
ghenv.Component.Message = 'VER 0.1.0\nDEC_22_2017'
ghenv.Component.IconDisplayMode = ghenv.Component.IconDisplayMode.application
ghenv.Component.Category = "Wasp"
ghenv.Component.SubCategory = "0 | Wasp"
try: ghenv.Component.AdditionalHelpFromDocStrings = "1"
except: pass



#########################################################################
##                               IMPORTS                               ##
#########################################################################
import random as rnd
import math
import scriptcontext as sc
import Rhino.Geometry as rg
import Rhino
import Grasshopper.Kernel as gh

#########################################################################
##                               CLASSES                               ##
#########################################################################

#################################################################### Connection
class Connection(object):
    
    ## constructor
    def __init__(self, plane, type, part, id):
        
        self.pln = plane
        
        flip_pln_Y = rg.Vector3d(plane.YAxis)
        flip_pln_Y.Reverse()
        self.flip_pln = rg.Plane(plane.Origin, plane.XAxis, flip_pln_Y)
        
        self.type = type
        self.part = part
        self.id = id
        
        self.rules_table = []
        self.active_rules = []
    
    ## return a transformed copy of the connection
    def transform(self, trans):
        pln_trans = rg.Plane(self.pln.Origin, self.pln.XAxis, self.pln.YAxis)
        conn_trans = Connection(pln_trans, self.type, self.part, self.id)
        conn_trans.pln.Transform(trans)
        conn_trans.flip_pln.Transform(trans)
        return conn_trans
    
    ## generate the rules-table for the connection
    def generate_rules_table(self, rules):
        count = 0
        self.rules_table = []
        self.active_rules = []
        for rule in rules:
            if rule.part1 == self.part and rule.conn1 == self.id:
                self.rules_table.append(rule)
                self.active_rules.append(count)
                count += 1

#################################################################### Base Component
class Part(object):
    
    ## constructor
    def __init__(self, name, geometry, connections, collider, attributes):
        
        self.name = name
        self.geo = geometry
        
        self.connections = []
        self.active_connections = []
        count = 0
        for conn in connections:
            conn.part = self.name
            conn.id = count
            self.connections.append(conn)
            self.active_connections.append(count)
            count += 1
        
        self.transformation = rg.Transform.Identity
        self.center = self.geo.GetBoundingBox(False).Center
        self.collider = collider
        
        self.children = []
        
        self.attributes = []
        if len(attributes) > 0:
            self.attributes = attributes
        
        self.is_constrained = False
    
    def reset_part(self, rules):
        count = 0
        self.active_connections = []
        for conn in self.connections:
            conn.generate_rules_table(rules)
            self.active_connections.append(count)
            count += 1
    
    def return_part_data(self):
        data_dict = {}
        data_dict['name'] = self.name
        data_dict['geo'] = self.geo
        data_dict['connections'] = self.connections
        data_dict['transform'] = self.transformation
        data_dict['center'] = self.center
        data_dict['children'] = self.children
        data_dict['attributes'] = self.attributes
        return data_dict
    
    ## function to transform part
    def transform(self, trans):
        geo_trans = self.geo.Duplicate()
        geo_trans.Transform(trans)
        
        collider_trans = self.collider.Duplicate()
        collider_trans.Transform(trans)
        
        connections_trans = []
        for conn in self.connections:
            connections_trans.append(conn.transform(trans))
        
        attributes_trans = []
        if len(self.attributes) > 0:
            for attr in self.attributes:
                attributes_trans.append(attr.transform(trans))
        
        part_trans = Part(self.name, geo_trans, connections_trans, collider_trans, attributes_trans)
        part_trans.transformation = trans
        return part_trans
    
    ## return transformed center point
    def transform_center(self, trans):
        center_trans = rg.Point3d(self.center)
        center_trans.Transform(trans)
        return center_trans
    
    ## return transformed collider mesh
    def transform_collider(self, trans):
        collider_trans = self.collider.Duplicate()
        collider_trans.Transform(trans)
        return collider_trans


#################################################################### Constrained Component
class Constrained_Part(Part):
    
    ## constructor
    def __init__(self, name, geometry, connections, collider, attributes, additional_collider, supports):
        
        super(self.__class__, self).__init__(name, geometry, connections, collider, attributes)
        
        self.add_collider = None
        if additional_collider != None:
            self.add_collider = additional_collider
        
        self.supports = []
        if len(supports) > 0:
            self.supports = supports
    
    ## function to transform component
    def transform(self, trans):
        geo_trans = self.geo.Duplicate()
        geo_trans.Transform(trans)
        
        collider_trans = self.collider.Duplicate()
        collider_trans.Transform(trans)
        
        connections_trans = []
        for conn in self.connections:
            connections_trans.append(conn.transform(trans))
        
        attributes_trans = []
        if len(self.attributes) > 0:
            for attr in self.attributes:
                attributes_trans.append(attr.transform(trans))
        
        add_collider_trans = None
        if(self.add_collider != None):
            add_collider_trans = self.add_collider.Duplicate()
            add_collider_trans.Transform(trans)
            
        supports_trans = []
        if len(self.supports) > 0:
            for sup in self.supports:
                sup_trans = sup.transform(trans)
                supports_trans.append(sup_trans)
        
        part_trans = Constrained_Part(self.name, geo_trans, connections_trans, collider_trans, attributes_trans, add_collider_trans, supports_trans)
        part_trans.transformation = trans
        part_trans.is_constrained = True
        return part_trans


#################################################################### Rule
class Rule(object):
    
    def __init__(self, _part1, _conn1, _part2, _conn2, _active = True, GH_Component = None):
        
        self.gh = GH_Component
        
        self.part1 = _part1
        self.conn1 = _conn1
        self.part2 = _part2
        self.conn2 = _conn2
        self.active = _active


#################################################################### Field
class Field(object):
    
    def __init__(self, boundaries, pts, count_vec, resolution, values):
        
        self.resolution = resolution
        
        self.bbox = rg.BoundingBox(pts)
        
        self.x_count = int(count_vec.X)
        self.y_count = int(count_vec.Y)
        self.z_count = int(count_vec.Z)
        
        self.pts = []
        self.vals = []
        pts_count = 0
        
        for z in range(0, self.z_count):
            self.pts.append([])
            self.vals.append([])
            for y in range(0, self.y_count):
                self.pts[z].append([])
                self.vals[z].append([])
                for x in range(0, self.x_count):
                    self.pts[z][y].append(pts[pts_count])
                    if len(boundaries) > 0:
                        inside = False
                        for bou in boundaries:
                            if bou.IsPointInside(pts[pts_count], sc.sticky['model_tolerance'], True) == True:
                                self.vals[z][y].append(values[pts_count])
                                inside = True
                                break
                        if inside == False:
                            self.vals[z][y].append(0.0)
                    else:
                        self.vals[z][y].append(values[pts_count])
                    pts_count += 1
        
        self.highest_pt = self.return_highest_pt()
    
    
    def return_pt_val(self, pt):
        pt_trans = pt - self.bbox.Min
        x = int(math.floor(pt_trans.X/self.resolution))
        y = int(math.floor(pt_trans.Y/self.resolution))
        z = int(math.floor(pt_trans.Z/self.resolution))
        
        value = self.vals[z][y][x]
        return value
    
    def return_highest_pt(self):
        max_val = -1
        highest_pt = None
        
        for z in range(0, self.z_count):
            for y in range(0, self.y_count):
                for x in range(0, self.x_count):
                    value = self.vals[z][y][x]
                    if value > max_val:
                        max_val = value
                        highest_pt = self.pts[z][y][x]
        
        return highest_pt


#################################################################### Attribute
class Attribute(object):
    
    def __init__(self, name, values, transformable):
        
        self.name = name
        self.values = values
        self.transformable = transformable
    
    def transform(self, trans):
        if self.transformable == True:
            values_trans = []
            for val in self.values:
                if type(val) == rg.Point3d:
                    val_trans = rg.Point3d(val)
                else:
                    val_trans = val.Duplicate()
                val_trans.Transform(trans)
                values_trans.append(val_trans)
            attr_trans = Attribute(self.name, values_trans, self.transformable)
        else:
            attr_trans = Attribute(self.name, self.values, self.transformable)
        return attr_trans


#################################################################### Support
class Support(object):
    
    def __init__(self, support_directions):
        
        self.sup_dir = support_directions
    
    def transform(self, trans):
        sup_dir_trans = []
        for dir in self.sup_dir:
            dir_trans = dir.Duplicate()
            dir_trans.Transform(trans)
            sup_dir_trans.append(dir_trans)
        sup_trans = Support(sup_dir_trans)
        return sup_trans


#########################################################################
##                                 WIP                                 ##
#########################################################################

## Aggregation class
## Voxel class
## Graph class

#########################################################################
##                                 RUN                                 ##
#########################################################################

log = []

## add classes to scriptcontext (to make it available to other Gh components)
if RUN:
    
    sc.sticky['Connection'] = Connection
    log.append("Connection class created...")
    sc.sticky['Part'] = Part
    log.append("Part class created...")
    sc.sticky['Constrained_Part'] = Constrained_Part
    log.append("Constrained_Part class created...")
    sc.sticky['Rule'] = Rule
    log.append("Rule class created...")
    sc.sticky['Field'] = Field
    log.append("Field class created...")
    sc.sticky['Attribute'] = Attribute
    log.append("Attribute class created...")
    sc.sticky['Support'] = Support
    log.append("Support class created...")
    
    sc.sticky['model_tolerance'] = Rhino.RhinoDoc.ActiveDoc.ModelAbsoluteTolerance*5
    sc.sticky['WaspSetup'] = 1
    
    log.append("READY TO BUILD!")

else:
    log.append("Set RUN to True to initialize Wasp...")
# ---------- end waspsetup ----------
# # Wasp: Discrete Design with Grasshopper plug-in (GPL) initiated by Andrea Rossi
# 
# 
# This file is part of Wasp.
# 
# Copyright (c) 2017, Andrea Rossi <a.rossi.andrea@gmail.com>
# 
# Wasp is free software; you can redistribute it and/or modify it under the terms of the GNU General Public License as published by the Free Software Foundation; either version 3 of the License, or (at your option) any later version.
# 
# Wasp is distributed in the hope that it will be useful, but WITHOUT ANY WARRANTY; without even the implied warranty of MERCHANTABILITY or FITNESS FOR A PARTICULAR PURPOSE. See the GNU General Public License for more details. You should have received a copy of the GNU General Public License
#  along with Wasp; If not, see <http://www.gnu.org/licenses/>.
# 
# license GPL-3.0 <https://www.gnu.org/licenses/gpl.html>
# 
# Significant parts of Wasp have been developed by Andrea Rossi as part of research on digital materials and discrete design at DDU Digital Design Unit - Prof. Oliver Tessmann - Technische Universität Darmstadt
panel = Panel(waspsetup)

# ----
# 1. Build Part
# Parts are the building blocks of Wasp.
# The most basic way of initializing a part is to define t he geometry (as brep or mesh),
# and the connection faces (center and orientation - with a line). Parts must be named
# to be identifyed in the aggregation rules.
part_geometry = Brep(<brep referenced from the Rhino model>)
connections_centers = Point([<point referenced from the Rhino model> x3])
connections_x_axis = Curve([<curve referenced from the Rhino model> x3])
conndir = Wasp_ConnectionFromDirection(GEO=part_geometry, CEN=connections_centers, UP=connections_x_axis)  # -> CONN, PLN_OUT; inputs GEO: Brep, CEN: list of Point3d, UP: list of Curve, T: list
# ---------- conndir: Python ----------
# Wasp: Discrete Design with Grasshopper plug-in (GPL) initiated by Andrea Rossi
# 
# This file is part of Wasp.
# 
# Copyright (c) 2017, Andrea Rossi <a.rossi.andrea@gmail.com>
# Wasp is free software; you can redistribute it and/or modify 
# it under the terms of the GNU General Public License as published 
# by the Free Software Foundation; either version 3 of the License, 
# or (at your option) any later version. 
# 
# Wasp is distributed in the hope that it will be useful,
# but WITHOUT ANY WARRANTY; without even the implied warranty of 
# MERCHANTABILITY or FITNESS FOR A PARTICULAR PURPOSE. See the 
# GNU General Public License for more details.
# 
# You should have received a copy of the GNU General Public License
# along with Wasp; If not, see <http://www.gnu.org/licenses/>.
# 
# @license GPL-3.0 <https://www.gnu.org/licenses/gpl.html>
#
# Significant parts of Wasp have been developed by Andrea Rossi
# as part of research on digital materials and discrete design at:
# DDU Digital Design Unit - Prof. Oliver Tessmann
# Technische Universität Darmstadt


#########################################################################
##                            COMPONENT INFO                           ##
#########################################################################

"""
Create a connection on a given part geometry from center and X-asix direction
(Z direction is determined based on the normals of the component geometry)
-
Provided by Wasp 0.1.0
    Args:
        GEO: Geometry of the part to which the connection belongs
        CEN: Origin of the connection plane
        UP: Line idetifying the X-axis of the connection plane - determines the plane orientation to mantain when transforming
        T: OPTIONAL // Connection type (to be used with Rule Generator component)
    Returns:
        CONN: Connection object
        PLN_OUT: Plane for each connection object (for debugging)
"""

ghenv.Component.Name = "Wasp_Connection From Direction"
ghenv.Component.NickName = 'ConnDir'
ghenv.Component.Message = 'VER 0.1.0\nDEC_22_2017'
ghenv.Component.IconDisplayMode = ghenv.Component.IconDisplayMode.application
ghenv.Component.Category = "Wasp"
ghenv.Component.SubCategory = "1 | Elements"
try: ghenv.Component.AdditionalHelpFromDocStrings = "1"
except: pass


import scriptcontext as sc
import Rhino.Geometry as rg
import Grasshopper.Kernel as gh

def main(part_geo, conn_centers, conn_ups, conn_type):
    
    ## check if Wasp is setup
    if sc.sticky.has_key('WaspSetup'):
        
        check_data = True
        
        ## check inputs
        if part_geo is None:
            check_data = False
            msg = "No part geometry provided"
            ghenv.Component.AddRuntimeMessage(gh.GH_RuntimeMessageLevel.Warning, msg)
        
        if len(conn_centers) != len(conn_ups):
            check_data = False
            msg = "Different amount of centers and up vectors provided"
            ghenv.Component.AddRuntimeMessage(gh.GH_RuntimeMessageLevel.Error, msg)
        
        types = []
        if len(conn_type) == 0:
            for i in range(len(conn_centers)):
                types.append("0")
        elif len(conn_type) == 1:
            for i in range(len(conn_centers)):
                types.append(conn_type[0])
        elif len(conn_centers) != len(conn_type):
            check_data = False
            msg = "Different amount of centers and types provided"
            ghenv.Component.AddRuntimeMessage(gh.GH_RuntimeMessageLevel.Error, msg)
        else:
            for i in range(len(conn_centers)):
                types.append(conn_type[i])
        
        ## execute main code if all needed inputs are available
        if check_data:
            connections = []
            out_planes = []
            for i in range(len(conn_centers)):
                
                center = conn_centers[i]
                up = conn_ups[i]
                plane = None
                
                up_start = rg.Vector3d(up.PointAtStart)
                up_end = rg.Vector3d(up.PointAtEnd)
                up_vec = rg.Vector3d.Subtract(up_end, up_start)
                
                for face in GEO.Faces:
                    pt_uv = face.ClosestPoint(center)
                    pt = face.PointAt(pt_uv[1], pt_uv[2])
                    dist = rg.Point3d.DistanceTo(center, pt)
                    if(dist < 0.001):
                        normal = face.NormalAt(pt_uv[1], pt_uv[2])
                        plane = rg.Plane(center, normal)
                        x_axis = plane.XAxis
                        angle = rg.Vector3d.VectorAngle(x_axis, up_vec, plane)
                        plane.Rotate(angle, normal)
                        break
                        
                if plane is None:
                    msg = "No valid plane provided for connection %d"%(i)
                    ghenv.Component.AddRuntimeMessage(gh.GH_RuntimeMessageLevel.Error, msg)
                else:
                    conn = sc.sticky['Connection'](plane, types[i], "", -1)
                    connections.append(conn)
                    out_planes.append(plane)
            
            return connections, out_planes
        
        else:
            return -1
            
    
    else:
        ## throw warining
        msg = "You must run the SetupWasp component before starting to build!"
        ghenv.Component.AddRuntimeMessage(gh.GH_RuntimeMessageLevel.Warning, msg)
        return -1


result = main(GEO, CEN, UP, T)

if result != -1:
    CONN = result[0]
    PLN_OUT = result[1]
# ---------- end conndir ----------
points = PointList(Points=connections_centers, Size=Slider(2, range=0..10))
part_name = Panel("HEXA")
part = Wasp_BasicPart(NAME=part_name, GEO=part_geometry, CONN=flatten(conndir.CONN))  # -> PART; inputs GEO: Mesh, CONN: list, COLL: Mesh, ATTR: list
# ---------- part: Python ----------
# Wasp: Discrete Design with Grasshopper plug-in (GPL) initiated by Andrea Rossi
# 
# This file is part of Wasp.
# 
# Copyright (c) 2017, Andrea Rossi <a.rossi.andrea@gmail.com>
# Wasp is free software; you can redistribute it and/or modify 
# it under the terms of the GNU General Public License as published 
# by the Free Software Foundation; either version 3 of the License, 
# or (at your option) any later version. 
# 
# Wasp is distributed in the hope that it will be useful,
# but WITHOUT ANY WARRANTY; without even the implied warranty of 
# MERCHANTABILITY or FITNESS FOR A PARTICULAR PURPOSE. See the 
# GNU General Public License for more details.
# 
# You should have received a copy of the GNU General Public License
# along with Wasp; If not, see <http://www.gnu.org/licenses/>.
# 
# @license GPL-3.0 <https://www.gnu.org/licenses/gpl.html>
#
# Significant parts of Wasp have been developed by Andrea Rossi
# as part of research on digital materials and discrete design at:
# DDU Digital Design Unit - Prof. Oliver Tessmann
# Technische Universität Darmstadt


#########################################################################
##                            COMPONENT INFO                           ##
#########################################################################

"""
Create a basic Wasp Part to be used for aggregation
-
Provided by Wasp 0.1.0
    Args:
        NAME: Part name
        GEO: Part geometry. It will be converted to mesh - to improve performance, perform the conversion before adding to the part and user a low-poly count
        CONN: Connections list
        COLL: OPTIONAL // Collider geometry (for collision detection). A collider will be automatically generated. For complex parts, automatic generation might not work, and you can add a custom collider geometry here.
        ATTR: OPTIONAL // Part attributes
    Returns:
        PART: Part instance
"""

ghenv.Component.Name = "Wasp_Basic Part"
ghenv.Component.NickName = 'Part'
ghenv.Component.Message = 'VER 0.1.0\nDEC_22_2017'
ghenv.Component.IconDisplayMode = ghenv.Component.IconDisplayMode.application
ghenv.Component.Category = "Wasp"
ghenv.Component.SubCategory = "2 | Parts"
try: ghenv.Component.AdditionalHelpFromDocStrings = "3"
except: pass

import scriptcontext as sc
import Rhino.Geometry as rg
import Grasshopper.Kernel as gh


def main(part_name, part_geo, connections, collider, attributes):
    
    ## check if Wasp is setup
    if sc.sticky.has_key('WaspSetup'):
        
        check_data = True
        
        ## check inputs
        if part_name is None:
            part_name = 'P1'
            msg = "Default name 'P1' assigned to part"
            ghenv.Component.AddRuntimeMessage(gh.GH_RuntimeMessageLevel.Remark, msg)
        
        if part_geo is None:
            check_data = False
            msg = "No part geometry provided"
            ghenv.Component.AddRuntimeMessage(gh.GH_RuntimeMessageLevel.Warning, msg)
            check_data = False
        
        if collider is None and part_geo is not None:
            collider = part_geo.Duplicate().Offset(sc.sticky['model_tolerance'])
            collider_intersection = rg.Intersect.Intersection.MeshMeshFast(collider, part_geo)
            if len(collider_intersection) > 0:
                collider = None
                collider = part_geo.Duplicate()
                center = part_geo.GetBoundingBox(True).Center
                scale_plane = rg.Plane(center, rg.Vector3d(1,0,0), rg.Vector3d(0,1,0))
                scale_transform = rg.Transform.Scale(scale_plane, 1-sc.sticky['model_tolerance'], 1-sc.sticky['model_tolerance'], 1-sc.sticky['model_tolerance'])
                collider.Transform(scale_transform)
                collider_intersection = rg.Intersect.Intersection.MeshMeshFast(collider, part_geo)
                if len(collider_intersection) > 0:
                    collider = None
                    msg = "Could not compute a valid collider geometry. Please provide a valid collider in the COLL input."
                    ghenv.Component.AddRuntimeMessage(gh.GH_RuntimeMessageLevel.Error, msg)
                    check_data = False
        
        if collider is not None and collider.Faces.Count > 1000:
            msg = "The computed collider has a high faces count. Consider providing a low poly collider to improve performance"
            ghenv.Component.AddRuntimeMessage(gh.GH_RuntimeMessageLevel.Warning, msg)
        
        
        if check_data:
            new_part = sc.sticky['Part'](part_name, part_geo, connections, collider, attributes)
            return new_part
        else:
            return -1
    
    else:
        ## throw warining
        msg = "You must run the SetupWasp component before starting to build!"
        ghenv.Component.AddRuntimeMessage(gh.GH_RuntimeMessageLevel.Warning, msg)
        return -1


result = main(NAME, GEO, CONN, COLL, ATTR)

if result != -1:
    PART = result
# ---------- end part ----------

# ----
# 2. Define aggregation rules
# Rules define which connection of which part can be
# connected with each other to for the aggregation.
number_slider = Slider(0, range=0..10)
part_name_2 = Panel("HEXA")
rule = Wasp_Rule(P1=part_name_2, C1=Slider(1, range=0..10), P2=part_name_2, C2=Slider(0, range=0..10))  # -> R; inputs C1: Int32, C2: Int32
# ---------- rule: Python ----------
# Wasp: Discrete Design with Grasshopper plug-in (GPL) initiated by Andrea Rossi
# 
# This file is part of Wasp.
# 
# Copyright (c) 2017, Andrea Rossi <a.rossi.andrea@gmail.com>
# Wasp is free software; you can redistribute it and/or modify 
# it under the terms of the GNU General Public License as published 
# by the Free Software Foundation; either version 3 of the License, 
# or (at your option) any later version. 
# 
# Wasp is distributed in the hope that it will be useful,
# but WITHOUT ANY WARRANTY; without even the implied warranty of 
# MERCHANTABILITY or FITNESS FOR A PARTICULAR PURPOSE. See the 
# GNU General Public License for more details.
# 
# You should have received a copy of the GNU General Public License
# along with Wasp; If not, see <http://www.gnu.org/licenses/>.
# 
# @license GPL-3.0 <https://www.gnu.org/licenses/gpl.html>
#
# Significant parts of Wasp have been developed by Andrea Rossi
# as part of research on digital materials and discrete design at:
# DDU Digital Design Unit - Prof. Oliver Tessmann
# Technische Universität Darmstadt


#########################################################################
##                            COMPONENT INFO                           ##
#########################################################################

"""
Generate an aggregation rule from part names and connections ids
-
Provided by Wasp 0.1.0
    Args:
        P1: Name of base part
        C1: Id of base connection
        P2: Name of new part to be aggregated
        C2: Id of new connection
    Returns:
        R: Rule
"""

ghenv.Component.Name = "Wasp_Rule"
ghenv.Component.NickName = 'Rule'
ghenv.Component.Message = 'VER 0.1.0\nDEC_22_2017'
ghenv.Component.IconDisplayMode = ghenv.Component.IconDisplayMode.application
ghenv.Component.Category = "Wasp"
ghenv.Component.SubCategory = "3 | Rules"
try: ghenv.Component.AdditionalHelpFromDocStrings = "2"
except: pass

import scriptcontext as sc
import Grasshopper.Kernel as gh

def main(part1, conn1, part2, conn2):
    
    ## check if Wasp is setup
    if sc.sticky.has_key('WaspSetup'):
        
        check_data = True
        
        ##check inputs
        if part1 is None or conn1 is None or part2 is None or conn2 is None:
            check_data = False
            msg = "Missing data. Please provide data for all inputs."
            ghenv.Component.AddRuntimeMessage(gh.GH_RuntimeMessageLevel.Warning, msg)
        
        if check_data:
            rule = sc.sticky['Rule'](part1, conn1, part2, conn2)
            return rule
        else:
            return -1
    
    else:
        ## throw warining
        msg = "You must run the SetupWasp component before starting to build!"
        ghenv.Component.AddRuntimeMessage(gh.GH_RuntimeMessageLevel.Warning, msg)
        return -1


result = main(P1, C1, P2, C2)

if result != -1:
    R = result


R = sc.sticky['Rule'](P1, C1, P2, C2, GH_Component = ghenv.Component)
# ---------- end rule ----------
rule_2 = Wasp_Rule(P1=part_name_2, C1=number_slider, P2=part_name_2, C2=Slider(1, range=0..10))  # -> R; inputs C1: Int32, C2: Int32; same code as rule
rule_3 = Wasp_Rule(P1=part_name_2, C1=Slider(2, range=0..10), P2=part_name_2, C2=Slider(1, range=0..10))  # -> R; inputs C1: Int32, C2: Int32; same code as rule
merge = Merge(Data1=rule_2, Data2=rule, Data3=rule_3)

# ----
# 3. Aggregate!
# Stochastic Aggregation builds an aggregation by randomly selecting one part
# and one rule to be applied at every step. If COLL is set to True,
# collisions between parts are avoided. The component adds parts additively
# over the already aggregated parts. If a new aggregation has to be created,
# the RESET button allows to reset the aggregation and restart.
parts_num = Slider(50, range=0..1000)
check_collisions = BooleanToggle(True)
reset = Button()
rndaggr = Wasp_StochasticAggregation(PART=flatten(part), N=parts_num, RULES=merge, COLL=check_collisions, RESET=reset)  # -> PART_OUT; inputs PART: list, PREV: list, N: Int32, RULES: list, COLL: Boolean, MODE: Int32, RESET: Boolean
# ---------- rndaggr: Python ----------
# Wasp: Discrete Design with Grasshopper plug-in (GPL) initiated by Andrea Rossi
# 
# This file is part of Wasp.
# 
# Copyright (c) 2017, Andrea Rossi <a.rossi.andrea@gmail.com>
# Wasp is free software; you can redistribute it and/or modify 
# it under the terms of the GNU General Public License as published 
# by the Free Software Foundation; either version 3 of the License, 
# or (at your option) any later version. 
# 
# Wasp is distributed in the hope that it will be useful,
# but WITHOUT ANY WARRANTY; without even the implied warranty of 
# MERCHANTABILITY or FITNESS FOR A PARTICULAR PURPOSE. See the 
# GNU General Public License for more details.
# 
# You should have received a copy of the GNU General Public License
# along with Wasp; If not, see <http://www.gnu.org/licenses/>.
# 
# @license GPL-3.0 <https://www.gnu.org/licenses/gpl.html>
#
# Significant parts of Wasp have been developed by Andrea Rossi
# as part of research on digital materials and discrete design at:
# DDU Digital Design Unit - Prof. Oliver Tessmann
# Technische Universität Darmstadt


#########################################################################
##                            COMPONENT INFO                           ##
#########################################################################

"""
Aggregate the given parts in a stochastic process, selecting parts and rules randomly at every step.
The component works additively, hence increasing the number of parts in an aggregation just adds new parts on the existing ones, without triggering recomputing of the previous element.
-
Provided by Wasp 0.1.0
    Args:
        PART: Parts to be aggregated (can be more than one)
        PREV: Previous aggregated parts. It is possible to input the results of a previous aggregation, or parts transformed with the TransformPart component
        N: Number of parts to be aggregated (does not count parts provided in PREV)
        RULES: Rules for the aggregation
        COLL: OPTIONAL // Collision detection. By default is active and checks for collisions between the aggregated parts
        MODE: OPTIONAL // Switches between aggregation modes: 0 = Basic (Default: only parts collision check), 1 = Constrained (checks all constraints set on the part)
        ID: OPTIONAL // Aggregation ID (to avoid overwriting when having different aggregation components in the same file)
        RESET: Recompute the whole aggregation
    Returns:
        PART_OUT: Aggregated parts (includes both PREV input and newly aggregated parts)
"""

ghenv.Component.Name = "Wasp_Stochastic Aggregation"
ghenv.Component.NickName = 'RndAggr'
ghenv.Component.Message = 'VER 0.1.0\nDEC_22_2017'
ghenv.Component.IconDisplayMode = ghenv.Component.IconDisplayMode.application
ghenv.Component.Category = "Wasp"
ghenv.Component.SubCategory = "4 | Aggregation"
try: ghenv.Component.AdditionalHelpFromDocStrings = "2"
except: pass


import scriptcontext as sc
import Rhino.Geometry as rg
import Grasshopper.Kernel as gh
import random as rnd


def aggregate(aggr_id, aggr_parts, aggr_rules, iter, aggr_coll, aggr_mode):
    count = 0
    loops = 0
    while count < iter:
        loops += 1
        if loops > iter*100:
            break
        ## if no part is present in the aggregation, add first random part
        if len(sc.sticky[aggr_id]) == 0:
            count += 1
            first_part = aggr_parts[rnd.randint(0, len(aggr_parts)-1)]
            for conn in first_part.connections:
                conn.generate_rules_table(aggr_rules)
            sc.sticky[aggr_id].append(first_part)
        
        else:
            next_rule = None
            part_01_id = -1
            conn_01_id = -1
            next_rule_id = -1
            new_rule_attempts = 0
            
            while new_rule_attempts < 1000:
                new_rule_attempts += 1
                part_01_id = rnd.randint(0, len(sc.sticky[aggr_id])-1)
                part_01 = sc.sticky[aggr_id][part_01_id]
                if len(part_01.active_connections) > 0:
                    conn_01_id = part_01.active_connections[rnd.randint(0, len(part_01.active_connections)-1)]
                    conn_01 = part_01.connections[conn_01_id]
                    if len(conn_01.active_rules) > 0:
                        next_rule_id = conn_01.active_rules[rnd.randint(0, len(conn_01.active_rules)-1)]
                        next_rule = conn_01.rules_table[next_rule_id]
                        break
            
            if next_rule == None:
                msg = "aborted after " + str(count) + " iterations"
                ghenv.Component.AddRuntimeMessage(gh.GH_RuntimeMessageLevel.Warning, msg)
                break
            
            next_part = None
            for part in aggr_parts:
                if part.name == next_rule.part2:
                    next_part = part
            
            orientTransform = rg.Transform.PlaneToPlane(next_part.connections[next_rule.conn2].flip_pln, conn_01.pln)
            next_part_center = next_part.transform_center(orientTransform)
            
            ## overlap check
            close_neighbour_check = False
            for ex_part in sc.sticky[aggr_id]:
                dist = ex_part.center.DistanceTo(next_part_center)
                if dist < sc.sticky['model_tolerance']:
                    close_neighbour_check = True
                    break
            
            ## collision check
            collision_check = False
            if aggr_coll == True and close_neighbour_check == False:
                next_part_collider = next_part.transform_collider(orientTransform)
                for ex_part in sc.sticky[aggr_id]:
                    intersections = rg.Intersect.Intersection.MeshMeshFast(ex_part.collider, next_part_collider)
                    if len(intersections) > 0:
                        collision_check = True
                        break
            
            ## constraints check
            add_collision_check = False
            missing_supports_check = False
            if aggr_mode == 1:
                if close_neighbour_check == False and collision_check == False:
                    if next_part.is_constrained:
                        
                        ## additional collider check
                        if next_part.add_collider != None:
                            add_collider = next_part.add_collider.Duplicate()
                            add_collider.Transform(orientTransform)
                            for ex_part in sc.sticky[aggr_id]:
                                intersections = rg.Intersect.Intersection.MeshMeshFast(ex_part.collider, add_collider)
                                if len(intersections) > 0:
                                    add_collision_check = True
                                    break
                        
                        ## supports check
                        if add_collision_check == False:
                            if len(next_part.supports) > 0:
                                for sup in next_part.supports:
                                    missing_supports_check = True
                                    supports_count = 0
                                    for dir in sup.sup_dir:
                                        dir_trans = dir.Duplicate()
                                        dir_trans.Transform(orientTransform)
                                        
                                        for ex_part in sc.sticky[aggr_id]:
                                            if len(rg.Intersect.Intersection.MeshPolyline(ex_part.collider, dir_trans)[0]) > 0:
                                                supports_count += 1
                                                break
                                    if supports_count == len(sup.sup_dir):
                                        missing_supports_check = False
                                        break
            
            if close_neighbour_check == False and collision_check == False and add_collision_check == False and missing_supports_check == False:
                next_part_trans = next_part.transform(orientTransform)
                next_part_trans.reset_part(aggr_rules)
                for i in range(len(next_part_trans.active_connections)):
                    if next_part_trans.active_connections[i] == next_rule.conn2:
                        next_part_trans.active_connections.pop(i)
                        break
                sc.sticky[aggr_id].append(next_part_trans)
                sc.sticky[aggr_id][part_01_id].children.append(next_part_trans)
                for i in range(len(sc.sticky[aggr_id][part_01_id].active_connections)):
                    if sc.sticky[aggr_id][part_01_id].active_connections[i] == conn_01_id:
                        sc.sticky[aggr_id][part_01_id].active_connections.pop(i)
                        break
                count += 1
            else:
               ## remove rules if they cause collisions or overlappings
               for i in range(len(sc.sticky[aggr_id][part_01_id].connections[conn_01_id].active_rules)):
                   if sc.sticky[aggr_id][part_01_id].connections[conn_01_id].active_rules[i] == next_rule_id:
                       sc.sticky[aggr_id][part_01_id].connections[conn_01_id].active_rules.pop(i)
                       break
               ## check if the connection is still active (still active rules available)
               if len(sc.sticky[aggr_id][part_01_id].connections[conn_01_id].active_rules) == 0:
                   for i in range(len(sc.sticky[aggr_id][part_01_id].active_connections)):
                    if sc.sticky[aggr_id][part_01_id].active_connections[i] == conn_01_id:
                        sc.sticky[aggr_id][part_01_id].active_connections.pop(i)
                        break


def main(parts, previous_parts, num_parts, rules, collision, aggregation_mode, aggregation_id, reset):
    
    ## check if Wasp is setup
    if sc.sticky.has_key('WaspSetup'):
        
        check_data = True
        ##check inputs
        if len(parts) == 0:
            check_data = False
            msg = "No parts provided"
            ghenv.Component.AddRuntimeMessage(gh.GH_RuntimeMessageLevel.Warning, msg)
        
        if num_parts is None:
            check_data = False
            msg = "Provide number of aggregation iterations"
            ghenv.Component.AddRuntimeMessage(gh.GH_RuntimeMessageLevel.Warning, msg)
        else:
            if len(previous_parts) != 0:
                num_parts += len(previous_parts)
        
        if len(rules) == 0:
            check_data = False
            msg = "No rules provided"
            ghenv.Component.AddRuntimeMessage(gh.GH_RuntimeMessageLevel.Warning, msg)
        
        if collision is None:
            collision = True
        
        if aggregation_mode is None:
            aggregation_mode = 0
        
        if aggregation_id is None:
            aggregation_id = 'Aggregation'
            msg = "Default name 'Aggregation' assigned"
            ghenv.Component.AddRuntimeMessage(gh.GH_RuntimeMessageLevel.Remark, msg)
        
        if reset is None:
            reset = False
        
        if check_data:
            if sc.sticky.has_key(aggregation_id) == False:
                sc.sticky[aggregation_id] = []
            
            if reset:
                sc.sticky[aggregation_id] = []
                
                for part in parts:
                    part.reset_part(rules)
                
                if len(previous_parts) > 0:
                    for part in previous_parts:
                        part.reset_part(rules)
                        sc.sticky[aggregation_id].append(part)
            
            if num_parts > len(sc.sticky[aggregation_id]):
                aggregate(aggregation_id, parts, rules, num_parts - len(sc.sticky[aggregation_id]), collision, aggregation_mode)
                if len(sc.sticky[aggregation_id]) < num_parts:
                    msg = "Could not place " + str(num_parts - len(sc.sticky[aggregation_id])) + " parts"
                    ghenv.Component.AddRuntimeMessage(gh.GH_RuntimeMessageLevel.Warning, msg)
                    
            
            elif num_parts < len(sc.sticky[aggregation_id]):
                sc.sticky[aggregation_id] = sc.sticky[aggregation_id][:num_parts]
                for part in sc.sticky[aggregation_id]:
                    part.reset_part(rules)
                
                for part in parts:
                    part.reset_part(rules)
            
            return sc.sticky[aggregation_id]
            
        else:
            return -1
    
    else:
        ## throw warining
        msg = "You must run the SetupWasp component before starting to build!"
        ghenv.Component.AddRuntimeMessage(gh.GH_RuntimeMessageLevel.Warning, msg)
        return -1


result = main(PART, PREV, N, RULES, COLL, MODE, ID, RESET)

if result != -1:
    PART_OUT = result
# ---------- end rndaggr ----------

# ----
# 4. Extract Data and Visualize
# Aggregated parts can be exploded in order to
# access the data stored in each part, such as the
# part geometry for visualization purposes.
depart = Wasp_DeconstructPart(PART=rndaggr)  # -> NAME, GEO, CONN, CONN_PLN, TR, CHILD, ATTR; inputs PART: list
# ---------- depart: Python ----------
# Wasp: Discrete Design with Grasshopper plug-in (GPL) initiated by Andrea Rossi
# 
# This file is part of Wasp.
# 
# Copyright (c) 2017, Andrea Rossi <a.rossi.andrea@gmail.com>
# Wasp is free software; you can redistribute it and/or modify 
# it under the terms of the GNU General Public License as published 
# by the Free Software Foundation; either version 3 of the License, 
# or (at your option) any later version. 
# 
# Wasp is distributed in the hope that it will be useful,
# but WITHOUT ANY WARRANTY; without even the implied warranty of 
# MERCHANTABILITY or FITNESS FOR A PARTICULAR PURPOSE. See the 
# GNU General Public License for more details.
# 
# You should have received a copy of the GNU General Public License
# along with Wasp; If not, see <http://www.gnu.org/licenses/>.
# 
# @license GPL-3.0 <https://www.gnu.org/licenses/gpl.html>
#
# Significant parts of Wasp have been developed by Andrea Rossi
# as part of research on digital materials and discrete design at:
# DDU Digital Design Unit - Prof. Oliver Tessmann
# Technische Universität Darmstadt


#########################################################################
##                            COMPONENT INFO                           ##
#########################################################################

"""
Extract all information stored in a part. Useful for visualization or for further geometry processing
-
Provided by Wasp 0.1.0
    Args:
        PART: Parts to deconstruct
    Returns:
        NAME: Name of the part
        GEO: Geometry of the part (as mesh). If Brep geometry is needed, can be stored in the component as attribute, or obtained by transforming the original geometry with the TR output.
        CONN: Part connections
        CONN_PLN: planes for each part connection
        TR: Transformation applied to the part. Can be used to transform other geometries in a similar way (eg. replace a low poly component with a more detailed one)
        CHILD: Children parts attached to the part
        ATTR: Part attributes
"""

ghenv.Component.Name = "Wasp_Deconstruct Part"
ghenv.Component.NickName = 'DePart'
ghenv.Component.Message = 'VER 0.1.0\nDEC_22_2017'
ghenv.Component.IconDisplayMode = ghenv.Component.IconDisplayMode.application
ghenv.Component.Category = "Wasp"
ghenv.Component.SubCategory = "2 | Parts"
try: ghenv.Component.AdditionalHelpFromDocStrings = "3"
except: pass


import scriptcontext as sc
import Grasshopper.Kernel as gh
from Grasshopper import DataTree
from Grasshopper.Kernel.Data import GH_Path


## from http://www.chenjingcheng.com/grasshopper-python-datatree-list-conversion/
def listToDataTree(list):
    rl = list
    result = DataTree[object]()
    for i in range(len(rl)):
        temp = []
        for j in range(len(rl[i])):
            temp.append(rl[i][j])
        path = GH_Path(i)
        result.AddRange(temp, path)
    return result



NAME = []
GEO = []
TR = []
ADD_COLL = []
ATTR = []

conn_list = []
conn_pln_list = []
children_list = []
attributes_list = []

if len(PART) == 0:
    msg = "No part provided"
    ghenv.Component.AddRuntimeMessage(gh.GH_RuntimeMessageLevel.Warning, msg)
elif PART[0] is None:
    msg = "Provided part is null"
    ghenv.Component.AddRuntimeMessage(gh.GH_RuntimeMessageLevel.Warning, msg)
else:
    for comp in PART:
        
        data_dict = comp.return_part_data()
        
        NAME.append(data_dict['name'])
        GEO.append(data_dict['geo'])
        conn_list.append(data_dict['connections'])
        
        conn_pln_list.append([])
        for conn in data_dict['connections']:
            conn_pln_list[len(conn_pln_list)-1].append(conn.pln)
        
        if "transform" in data_dict.keys():
            TR.append(data_dict['transform'])
        
        if "add_collider" in data_dict.keys():
            ADD_COLL.append(data_dict['add_collider'])
        
        if "children" in data_dict.keys():
            children_list.append(data_dict['children'])
        
        if "attributes" in data_dict.keys():
            attributes_list.append(data_dict['attributes'])
        
    
    CONN = listToDataTree(conn_list)
    CONN_PLN = listToDataTree(conn_pln_list)
    CHILD = listToDataTree(children_list)
    ATTR = listToDataTree(attributes_list)
# ---------- end depart ----------
preview = CustomPreview(Geometry=depart.GEO, Shader=ColourSwatch(SwatchColor=RGB(119, 255, 0)))
