# Grasshopper definition Wasp_saveLoadFields.gh (Grasshopper 1.0.7)

geo = Geometry(<brep referenced from the Rhino model>)
pt = Point([<point referenced from the Rhino model> x5])
crv = Curve([<curve referenced from the Rhino model> x5])
geo_2 = Geometry(<brep referenced from the Rhino model>)
conndir = Wasp_ConnectionFromDirection(GEO=geo, CEN=pt, UP=crv)  # -> CONN, PLN_OUT; inputs CEN: list of Point3d, UP: list of Curve, T: list
# ---------- conndir: Python ----------
# Wasp: Discrete Design with Grasshopper plug-in (GPL) initiated by Andrea Rossi
# 
# This file is part of Wasp.
# 
# Copyright (c) 2017, Andrea Rossi <a.rossi.andrea@gmail.com>
# Wasp is free software; you can redistribute it and/or modify 
# it under the terms of the GNU General Public License as published 
# by the Free Software Foundation; either version 3 of the License, 
# or (at your option) any later version. 
# 
# Wasp is distributed in the hope that it will be useful,
# but WITHOUT ANY WARRANTY; without even the implied warranty of 
# MERCHANTABILITY or FITNESS FOR A PARTICULAR PURPOSE. See the 
# GNU General Public License for more details.
# 
# You should have received a copy of the GNU General Public License
# along with Wasp; If not, see <http://www.gnu.org/licenses/>.
# 
# @license GPL-3.0 <https://www.gnu.org/licenses/gpl.html>
#
# Significant parts of Wasp have been developed by Andrea Rossi
# as part of research on digital materials and discrete design at:
# DDU Digital Design Unit - Prof. Oliver Tessmann
# Technische Universität Darmstadt


#########################################################################
##                            COMPONENT INFO                           ##
#########################################################################

"""
Create a connection on a given part geometry from center and X-asix direction
(Z direction is determined based on the normals of the component geometry)
-
Provided by Wasp 0.4
    Args:
        GEO: Geometry of the part to which the connection belongs
        CEN: Origin of the connection plane
        UP: Line idetifying the X-axis of the connection plane - determines the plane orientation to mantain when transforming
        T: OPTIONAL // Connection type (to be used with Rule Generator component)
    Returns:
        CONN: Connection object
        PLN_OUT: Plane for each connection object (for debugging)
"""

ghenv.Component.Name = "Wasp_Connection From Direction"
ghenv.Component.NickName = 'ConnDir'
ghenv.Component.Message = 'VER 0.4.003'
ghenv.Component.IconDisplayMode = ghenv.Component.IconDisplayMode.application
ghenv.Component.Category = "Wasp"
ghenv.Component.SubCategory = "1 | Elements"
try: ghenv.Component.AdditionalHelpFromDocStrings = "1"
except: pass


import sys
import Rhino.Geometry as rg
import Grasshopper as gh

## add Wasp install directory to system path
wasp_loaded = False
ghcompfolder = gh.Folders.DefaultAssemblyFolder
if ghcompfolder not in sys.path:
    sys.path.append(ghcompfolder)
try:
    from wasp import __version__
    wasp_loaded = True
except:
    msg = "Cannot import Wasp. Is the wasp folder available in " + ghcompfolder + "?"
    ghenv.Component.AddRuntimeMessage(gh.Kernel.GH_RuntimeMessageLevel.Error, msg)

## if Wasp is installed correctly, load the classes required by the component
if wasp_loaded:
    from wasp.core import Connection
    from wasp import global_tolerance


def main(part_geo, conn_centers, conn_ups, conn_type):
        
    check_data = True
    
    ## check inputs
    if part_geo is None:
        check_data = False
        msg = "No part geometry provided"
        ghenv.Component.AddRuntimeMessage(gh.Kernel.GH_RuntimeMessageLevel.Warning, msg)
    
    if len(conn_centers) != len(conn_ups):
        check_data = False
        msg = "Different amount of centers and up vectors provided"
        ghenv.Component.AddRuntimeMessage(gh.Kernel.GH_RuntimeMessageLevel.Error, msg)
    
    types = []
    if len(conn_type) == 0:
        for i in range(len(conn_centers)):
            types.append("0")
    elif len(conn_type) == 1:
        for i in range(len(conn_centers)):
            types.append(conn_type[0])
    elif len(conn_centers) != len(conn_type):
        check_data = False
        msg = "Different amount of centers and types provided"
        ghenv.Component.AddRuntimeMessage(gh.Kernel.GH_RuntimeMessageLevel.Error, msg)
    else:
        for i in range(len(conn_centers)):
            types.append(conn_type[i])
    
    ## execute main code if all needed inputs are available
    if check_data:
        connections = []
        out_planes = []
        for i in range(len(conn_centers)):
            
            center = conn_centers[i]
            up = conn_ups[i]
            plane = None
            
            up_start = rg.Vector3d(up.PointAtStart)
            up_end = rg.Vector3d(up.PointAtEnd)
            up_vec = rg.Vector3d.Subtract(up_end, up_start)
            
            if type(part_geo) == rg.Brep:
                for face in part_geo.Faces:
                    pt_uv = face.ClosestPoint(center)
                    pt = face.PointAt(pt_uv[1], pt_uv[2])
                    dist = rg.Point3d.DistanceTo(center, pt)
                    if(dist < global_tolerance):
                        normal = face.NormalAt(pt_uv[1], pt_uv[2])
                        plane = rg.Plane(center, normal)
                        x_axis = plane.XAxis
                        angle = rg.Vector3d.VectorAngle(x_axis, up_vec, plane)
                        plane.Rotate(angle, normal)
                        break
            
            elif type(part_geo) == rg.Mesh:
                part_geo.Normals.ComputeNormals()
                mesh_pt = part_geo.ClosestMeshPoint(center, global_tolerance)
                if mesh_pt is not None:
                    normal = part_geo.NormalAt(mesh_pt)
                    plane = rg.Plane(center, normal)
                    x_axis = plane.XAxis
                    angle = rg.Vector3d.VectorAngle(x_axis, up_vec, plane)
                    plane.Rotate(angle, normal)
            
            if plane is None:
                msg = "No valid plane provided for connection %d"%(i)
                ghenv.Component.AddRuntimeMessage(gh.Kernel.GH_RuntimeMessageLevel.Error, msg)
            else:
                conn = Connection(plane, types[i], "", -1)
                connections.append(conn)
                out_planes.append(plane)
        
        return connections, out_planes
    
    else:
        return -1

result = main(GEO, CEN, UP, T)

if result != -1:
    CONN = result[0]
    PLN_OUT = result[1]
# ---------- end conndir ----------
fieldpts = Wasp_FieldPoints(BOU=geo_2, RES=Slider(5, range=0..10))  # -> E_FIELD, PTS; inputs BOU: list of Mesh
# ---------- fieldpts: Python ----------
# Wasp: Discrete Design with Grasshopper plug-in (GPL) initiated by Andrea Rossi
# 
# This file is part of Wasp.
# 
# Copyright (c) 2017, Andrea Rossi <a.rossi.andrea@gmail.com>
# Wasp is free software; you can redistribute it and/or modify 
# it under the terms of the GNU General Public License as published 
# by the Free Software Foundation; either version 3 of the License, 
# or (at your option) any later version. 
# 
# Wasp is distributed in the hope that it will be useful,
# but WITHOUT ANY WARRANTY; without even the implied warranty of 
# MERCHANTABILITY or FITNESS FOR A PARTICULAR PURPOSE. See the 
# GNU General Public License for more details.
# 
# You should have received a copy of the GNU General Public License
# along with Wasp; If not, see <http://www.gnu.org/licenses/>.
# 
# @license GPL-3.0 <https://www.gnu.org/licenses/gpl.html>
#
# Significant parts of Wasp have been developed by Andrea Rossi
# as part of research on digital materials and discrete design at:
# DDU Digital Design Unit - Prof. Oliver Tessmann
# Technische Universität Darmstadt


#########################################################################
##                            COMPONENT INFO                           ##
#########################################################################

"""
Generate a 3d point grid to be fed to the field component
-
Provided by Wasp 0.4
    Args:
        BOU: List of geometries defining the boundaries of the field. Geometries must be closed breps or meshes.
        RES: Resolution (Dimension of each cell)
    Returns:
        E_FIELD: Empty field. Assign values with the "Wasp_Field" component
        PTS: Field points
"""

ghenv.Component.Name = "Wasp_Field Points"
ghenv.Component.NickName = 'FieldPts'
ghenv.Component.Message = 'VER 0.4.003'
ghenv.Component.IconDisplayMode = ghenv.Component.IconDisplayMode.application
ghenv.Component.Category = "Wasp"
ghenv.Component.SubCategory = "4 | Aggregation"
try: ghenv.Component.AdditionalHelpFromDocStrings = "1"
except: pass


import sys
import Rhino.Geometry as rg
import Grasshopper as gh
import math


## add Wasp install directory to system path
wasp_loaded = False
ghcompfolder = gh.Folders.DefaultAssemblyFolder
if ghcompfolder not in sys.path:
    sys.path.append(ghcompfolder)
try:
    from wasp import __version__
    wasp_loaded = True
except:
    msg = "Cannot import Wasp. Is the wasp folder available in " + ghcompfolder + "?"
    ghenv.Component.AddRuntimeMessage(gh.Kernel.GH_RuntimeMessageLevel.Error, msg)

## if Wasp is installed correctly, load the classes required by the component
if wasp_loaded:
    from wasp.field import Field


def main(boundaries, resolution):
    
    check_data = True
    
    ##check inputs
    if len(boundaries) == 0:
        check_data = False
        msg = "No boundary geometry provided"
        ghenv.Component.AddRuntimeMessage(gh.Kernel.GH_RuntimeMessageLevel.Warning, msg)
    
    if resolution is None and len(boundaries) != 0:
        global_bbox = None
        for geo in boundaries:
            bbox = geo.GetBoundingBox(True)
            
            if global_bbox is None:
                global_bbox = bbox
            else:
                global_bbox.Union(bbox)
        
        x_size = global_bbox.Max.X - global_bbox.Min.X
        resolution = x_size / 10
        
        msg = "No resolution provided. Default resolution set to %d units"%(resolution)
        ghenv.Component.AddRuntimeMessage(gh.Kernel.GH_RuntimeMessageLevel.Warning, msg)
        
    if check_data:
        global_bbox = None
        for geo in boundaries:
            bbox = geo.GetBoundingBox(True)
            
            if global_bbox is None:
                global_bbox = bbox
            else:
                global_bbox.Union(bbox)
        
        x_size = global_bbox.Max.X - global_bbox.Min.X
        x_count = int(math.ceil(x_size / resolution)) + 1
        y_size = global_bbox.Max.Y - global_bbox.Min.Y
        y_count = int(math.ceil(y_size / resolution)) + 1
        z_size = global_bbox.Max.Z - global_bbox.Min.Z
        z_count = int(math.ceil(z_size / resolution)) + 1
        
        count = [x_count, y_count, z_count]
        
        pts = []
        s_pt = global_bbox.Min
        
        for z in range(z_count):
            for y in range(y_count):
                for x in range(x_count):
                    pt = rg.Point3d(s_pt.X + x*resolution, s_pt.Y + y*resolution, s_pt.Z + z*resolution)
                    pts.append(pt)
        
        empty_field = Field(None, pts, count, resolution, boundaries = boundaries)
        return pts, empty_field
        
    else:
        return -1


result = main(BOU, RES)

if result != -1:
    PTS = result[0]
    E_FIELD = result[1]
# ---------- end fieldpts ----------
crv_2 = Curve(<curve referenced from the Rhino model>)
# Wasp Development Logs
# Episode #002 - Save/ Load Fields and Parts Catalog
# [Wasp 0.4.003b]
panel = Panel("P")
part = Wasp_BasicPart(NAME=panel, GEO=geo, CONN=flatten(conndir.CONN))  # -> PART; inputs GEO: Mesh, CONN: list, ATTR: list
# ---------- part: Python ----------
# Wasp: Discrete Design with Grasshopper plug-in (GPL) initiated by Andrea Rossi
# 
# This file is part of Wasp.
# 
# Copyright (c) 2017, Andrea Rossi <a.rossi.andrea@gmail.com>
# Wasp is free software; you can redistribute it and/or modify 
# it under the terms of the GNU General Public License as published 
# by the Free Software Foundation; either version 3 of the License, 
# or (at your option) any later version. 
# 
# Wasp is distributed in the hope that it will be useful,
# but WITHOUT ANY WARRANTY; without even the implied warranty of 
# MERCHANTABILITY or FITNESS FOR A PARTICULAR PURPOSE. See the 
# GNU General Public License for more details.
# 
# You should have received a copy of the GNU General Public License
# along with Wasp; If not, see <http://www.gnu.org/licenses/>.
# 
# @license GPL-3.0 <https://www.gnu.org/licenses/gpl.html>
#
# Significant parts of Wasp have been developed by Andrea Rossi
# as part of research on digital materials and discrete design at:
# DDU Digital Design Unit - Prof. Oliver Tessmann
# Technische Universität Darmstadt


#########################################################################
##                            COMPONENT INFO                           ##
#########################################################################

"""
Create a basic Wasp Part to be used for aggregation
-
Provided by Wasp 0.4
    Args:
        NAME: Part name
        GEO: Part geometry. It will be converted to mesh - to improve performance, perform the conversion before adding to the part and user a low-poly count
        CONN: Connections list
        COLL: OPTIONAL // Collider geometry (for collision detection). A collider will be automatically generated. For complex parts, automatic generation might not work, and you can add a custom collider geometry here.
        ATTR: OPTIONAL // Part attributes
    Returns:
        PART: Part instance
"""

ghenv.Component.Name = "Wasp_Basic Part"
ghenv.Component.NickName = 'Part'
ghenv.Component.Message = 'VER 0.4.003'
ghenv.Component.IconDisplayMode = ghenv.Component.IconDisplayMode.application
ghenv.Component.Category = "Wasp"
ghenv.Component.SubCategory = "2 | Parts"
try: ghenv.Component.AdditionalHelpFromDocStrings = "1"
except: pass

import sys
import Rhino.Geometry as rg
import Grasshopper as gh


## add Wasp install directory to system path
wasp_loaded = False
ghcompfolder = gh.Folders.DefaultAssemblyFolder
if ghcompfolder not in sys.path:
    sys.path.append(ghcompfolder)
try:
    from wasp import __version__
    wasp_loaded = True
except:
    msg = "Cannot import Wasp. Is the wasp folder available in " + ghcompfolder + "?"
    ghenv.Component.AddRuntimeMessage(gh.Kernel.GH_RuntimeMessageLevel.Error, msg)

## if Wasp is installed correctly, load the classes required by the component
if wasp_loaded:
    from wasp.core import Part
    from wasp.core import Collider
    from wasp import global_tolerance


def main(part_name, part_geo, connections, collider, attributes):
    
    check_data = True
    
    ## check inputs
    if part_name is None:
        check_data = False
        msg = "No part name provided"
        ghenv.Component.AddRuntimeMessage(gh.Kernel.GH_RuntimeMessageLevel.Warning, msg)
    
    if part_geo is None:
        check_data = False
        msg = "No part geometry provided"
        ghenv.Component.AddRuntimeMessage(gh.Kernel.GH_RuntimeMessageLevel.Warning, msg)
        check_data = False
    
    if collider is None:
        if part_geo is not None:
            collider_geo = part_geo.Duplicate().Offset(global_tolerance)
            collider_intersection = rg.Intersect.Intersection.MeshMeshFast(collider_geo, part_geo)
            if len(collider_intersection) > 0:
                collider_geo = None
                collider_geo = part_geo.Duplicate()
                center = part_geo.GetBoundingBox(True).Center
                scale_plane = rg.Plane(center, rg.Vector3d(1,0,0), rg.Vector3d(0,1,0))
                scale_transform = rg.Transform.Scale(scale_plane, 1-global_tolerance, 1-global_tolerance, 1-global_tolerance)
                collider_geo.Transform(scale_transform)
                collider_intersection = rg.Intersect.Intersection.MeshMeshFast(collider_geo, part_geo)
                if len(collider_intersection) > 0:
                    collider_geo = None
                    msg = "Could not compute a valid collider geometry. Please provide a valid collider in the COLL input."
                    ghenv.Component.AddRuntimeMessage(gh.Kernel.GH_RuntimeMessageLevel.Error, msg)
                    check_data = False
            
            if collider_geo is not None:
                collider = Collider([collider_geo])
            
    else:
        if type(collider) != Collider:
            if type(collider) == rg.Mesh:
                collider = Collider([collider])
            else:
                msg = "Collider geometry must be of type Mesh or WaspCollider."
                ghenv.Component.AddRuntimeMessage(gh.Kernel.GH_RuntimeMessageLevel.Error, msg)
                check_data = False
        
    if collider is not None and collider.faces_count > 1000:
        msg = "The collider has a high faces count. Consider providing a low poly collider to improve performance"
        ghenv.Component.AddRuntimeMessage(gh.Kernel.GH_RuntimeMessageLevel.Warning, msg)
    
    
    if check_data:
        new_part = Part(part_name, part_geo, connections, collider, attributes)
        
        if new_part.dim < global_tolerance*10:
            msg = "The parts you created are very small. You might consider scaling them or decreasing the tolerance of your Rhino file."
            ghenv.Component.AddRuntimeMessage(gh.Kernel.GH_RuntimeMessageLevel.Warning, msg)
        
        return new_part
    else:
        return -1


result = main(NAME, GEO, CONN, COLL, ATTR)

if result != -1:
    PART = result
# ---------- end part ----------
pull = PullPoint(Point=fieldpts.PTS, Geometry=crv_2, ClosestOnly=True)  # -> ClosestPoint, Distance
bnd = Bounds(Numbers=pull.Distance)
remap = RemapNumbers(Value=pull.Distance, Source=bnd, Target="1 To 0")  # -> Mapped, Clipped
path = FilePath("D:\GoogleDrive\Works\_Wasp_\WaspDevLogs\Wasp_DevLog_002\myField.json")
graph = GraphMapper(
    remap.Mapped,
    x0=0,
    x1=1,
    y0=0,
    y1=1,
    container_name="Bezier",
    cpx=[0, 0.7842696905, 0.8359550834, 1],
    cpy=[0, 0.02272725105, 0.4642857313, 1])
loadfield = Wasp_LoadFieldFromFile(FILE=path)  # -> FIELD; inputs UPDATE: Boolean
# ---------- loadfield: Python ----------
# Wasp: Discrete Design with Grasshopper plug-in (GPL) initiated by Andrea Rossi
# 
# This file is part of Wasp.
# 
# Copyright (c) 2017, Andrea Rossi <a.rossi.andrea@gmail.com>
# Wasp is free software; you can redistribute it and/or modify 
# it under the terms of the GNU General Public License as published 
# by the Free Software Foundation; either version 3 of the License, 
# or (at your option) any later version. 
# 
# Wasp is distributed in the hope that it will be useful,
# but WITHOUT ANY WARRANTY; without even the implied warranty of 
# MERCHANTABILITY or FITNESS FOR A PARTICULAR PURPOSE. See the 
# GNU General Public License for more details.
# 
# You should have received a copy of the GNU General Public License
# along with Wasp; If not, see <http://www.gnu.org/licenses/>.
# 
# @license GPL-3.0 <https://www.gnu.org/licenses/gpl.html>
#
# Significant parts of Wasp have been developed by Andrea Rossi
# as part of research on digital materials and discrete design at:
# DDU Digital Design Unit - Prof. Oliver Tessmann
# Technische Universität Darmstadt


#########################################################################
##                            COMPONENT INFO                           ##
#########################################################################

"""
Loads an aggregation from a previously saved .txt file
-
Provided by Wasp 0.4
    Args:
        FILE: File where the field is saved (.json)
        UPDATE: True to reload the saved file
    Returns:
        FIELD: Imported field
"""

ghenv.Component.Name = "Wasp_Load Field from File"
ghenv.Component.NickName = 'LoadField'
ghenv.Component.Message = 'VER 0.4.003'
ghenv.Component.IconDisplayMode = ghenv.Component.IconDisplayMode.application
ghenv.Component.Category = "Wasp"
ghenv.Component.SubCategory = "4 | Aggregation"
try: ghenv.Component.AdditionalHelpFromDocStrings = "5"
except: pass


import sys
import Grasshopper as gh
import json


## add Wasp install directory to system path
wasp_loaded = False
ghcompfolder = gh.Folders.DefaultAssemblyFolder
if ghcompfolder not in sys.path:
    sys.path.append(ghcompfolder)
try:
    from wasp import __version__
    wasp_loaded = True
except:
    msg = "Cannot import Wasp. Is the wasp folder available in " + ghcompfolder + "?"
    ghenv.Component.AddRuntimeMessage(gh.Kernel.GH_RuntimeMessageLevel.Error, msg)

## if Wasp is installed correctly, load the classes required by the component
if wasp_loaded:
    from wasp.field import Field


def main(file_path, update, field):
        
    check_data = True
    
    ## check inputs
    if file_path is None:
        check_data = False
        msg = "No path provided for the file to load"
        ghenv.Component.AddRuntimeMessage(gh.Kernel.GH_RuntimeMessageLevel.Warning, msg)
    
    ## execute main code if all needed inputs are available
    if check_data:
        
        if field is None or field == -1 or update:
            field_dict = {}
            
            ## load json data
            with open(file_path, "r") as inF:
                txt_data = inF.read()
                field_dict = json.loads(txt_data)
            
            field = Field.from_data(field_dict)
        
        return field
    else:
        return -1

## create field container in global variables dict
if 'field_container' not in globals():
    field_container = None

result = main(FILE, UPDATE, field_container)

if result != -1:
    field_container = result
    FIELD = field_container
# ---------- end loadfield ----------
rulegen = Wasp_RulesGenerator(PART=part)  # -> R; inputs PART: list, SELF_P: Boolean, SELF_C: Boolean, TYP: Boolean, GR: list
# ---------- rulegen: Python ----------
# Wasp: Discrete Design with Grasshopper plug-in (GPL) initiated by Andrea Rossi
# 
# This file is part of Wasp.
# 
# Copyright (c) 2017, Andrea Rossi <a.rossi.andrea@gmail.com>
# Wasp is free software; you can redistribute it and/or modify 
# it under the terms of the GNU General Public License as published 
# by the Free Software Foundation; either version 3 of the License, 
# or (at your option) any later version. 
# 
# Wasp is distributed in the hope that it will be useful,
# but WITHOUT ANY WARRANTY; without even the implied warranty of 
# MERCHANTABILITY or FITNESS FOR A PARTICULAR PURPOSE. See the 
# GNU General Public License for more details.
# 
# You should have received a copy of the GNU General Public License
# along with Wasp; If not, see <http://www.gnu.org/licenses/>.
# 
# @license GPL-3.0 <https://www.gnu.org/licenses/gpl.html>
#
# Significant parts of Wasp have been developed by Andrea Rossi
# as part of research on digital materials and discrete design at:
# DDU Digital Design Unit - Prof. Oliver Tessmann
# Technische Universität Darmstadt


#########################################################################
##                            COMPONENT INFO                           ##
#########################################################################

"""
Automated rules generator given a list of parts. It has two separate modes:
- If no grammar is provided in the GR input, the component generates rules between connections of the same type.
- If a grammar is provided, rules are created between connections of different types, according to the specified grammar rules.
-
Provided by Wasp 0.4
    Args:
        PART: Parts from which to generate aggregation rules
        SELF_P: OPTIONAL // Create rules between connections belonging to the same part (True by default)
        SELF_C: OPTIONAL // Create rules between connection with same id (True by default)
        TYP: OPTIONAL // Create rules only between connections of the same type (False by default). Make sure this component is set to False when using Rule Grammars.
        GR: OPTIONAL // Custom connection grammar with format "ConnType">"ConnType"
    Returns:
        R: Generated aggregation rules
"""

ghenv.Component.Name = "Wasp_Rules Generator"
ghenv.Component.NickName = 'RuleGen'
ghenv.Component.Message = 'VER 0.4.003'
ghenv.Component.IconDisplayMode = ghenv.Component.IconDisplayMode.application
ghenv.Component.Category = "Wasp"
ghenv.Component.SubCategory = "3 | Rules"
try: ghenv.Component.AdditionalHelpFromDocStrings = "2"
except: pass

import sys
import Grasshopper as gh


## add Wasp install directory to system path
wasp_loaded = False
ghcompfolder = gh.Folders.DefaultAssemblyFolder
if ghcompfolder not in sys.path:
    sys.path.append(ghcompfolder)
try:
    from wasp import __version__
    wasp_loaded = True
except:
    msg = "Cannot import Wasp. Is the wasp folder available in " + ghcompfolder + "?"
    ghenv.Component.AddRuntimeMessage(gh.Kernel.GH_RuntimeMessageLevel.Error, msg)

## if Wasp is installed correctly, load the classes required by the component
if wasp_loaded:
    from wasp.core import Rule


def main(parts, self_part, self_connection, use_types, grammar):
    
    check_data = True
    
    ##check inputs
    if len(parts) == 0 or parts is None:
        check_data = False
        msg = "No part provided"
        ghenv.Component.AddRuntimeMessage(gh.Kernel.GH_RuntimeMessageLevel.Warning, msg)
    
    if self_part == None:
        self_part = True
    
    if self_connection == None:
        self_connection = True
    
    if use_types is None:
        use_types = False
    
    if check_data:
        rules = []
        
        if len(grammar) == 0:
            for part in parts:
                for conn in part.connections:
                    for other_part in parts:
                        skip_part = False
                        if self_part == False:
                            if part.name == other_part.name:
                                skip_part = True
                            
                        if skip_part == False:
                            for other_conn in other_part.connections:
                                skip_conn = False
                                if self_connection == False:
                                    if conn.id == other_conn.id:
                                        skip_conn = True
                                
                                if skip_conn == False:
                                    if use_types:
                                        if conn.type == other_conn.type:
                                            r = Rule(part.name, conn.id, other_part.name, other_conn.id)
                                            rules.append(r)
                                    else:
                                        r = Rule(part.name, conn.id, other_part.name, other_conn.id)
                                        rules.append(r)
        else:
            for gr_rule in grammar:
                start_type = gr_rule.split(">")[0]
                end_type = gr_rule.split(">")[1]
                
                for part in parts:
                    for conn in part.connections:
                        if conn.type == start_type:
                            for other_part in parts:
                                skip_part = False
                                if self_part == False:
                                    if part.name == other_part.name:
                                        skip_part = True
                                    
                                if skip_part == False:
                                    for other_conn in other_part.connections:
                                        if other_conn.type == end_type:
                                            skip_conn = False
                                            if self_connection == False:
                                                if conn.id == other_conn.id:
                                                    skip_conn = True
                                            
                                            if skip_conn == False:
                                                r = Rule(part.name, conn.id, other_part.name, other_conn.id)
                                                rules.append(r)
        return [rules]
    else:
        return -1


result = main(PART, SELF_P, SELF_C, TYP, GR)

if result != -1:
    R = result[0]
# ---------- end rulegen ----------
field = Wasp_Field(E_FIELD=fieldpts.E_FIELD, VAL=graph)  # -> FIELD; inputs VAL: list
#   port NAME: OPTIONAL // Field name (needed for multi-field aggregation)
#   port E_FIELD: Empty field where to store values. Created with "Wasp_Field Points" component
# ---------- field: Python ----------
# Wasp: Discrete Design with Grasshopper plug-in (GPL) initiated by Andrea Rossi
# 
# This file is part of Wasp.
# 
# Copyright (c) 2017, Andrea Rossi <a.rossi.andrea@gmail.com>
# Wasp is free software; you can redistribute it and/or modify 
# it under the terms of the GNU General Public License as published 
# by the Free Software Foundation; either version 3 of the License, 
# or (at your option) any later version. 
# 
# Wasp is distributed in the hope that it will be useful,
# but WITHOUT ANY WARRANTY; without even the implied warranty of 
# MERCHANTABILITY or FITNESS FOR A PARTICULAR PURPOSE. See the 
# GNU General Public License for more details.
# 
# You should have received a copy of the GNU General Public License
# along with Wasp; If not, see <http://www.gnu.org/licenses/>.
# 
# @license GPL-3.0 <https://www.gnu.org/licenses/gpl.html>
#
# Significant parts of Wasp have been developed by Andrea Rossi
# as part of research on digital materials and discrete design at:
# DDU Digital Design Unit - Prof. Oliver Tessmann
# Technische Universität Darmstadt


#########################################################################
##                            COMPONENT INFO                           ##
#########################################################################

"""
Generates a scalar field given a grid of points and their relative scalar values
-
Provided by Wasp 0.4
    Args:
        BOU: List of geometries defining the boundaries of the field. Geometries must be closed breps or meshes. All points of the field outside the geometries will be assigned a 0 value
        PTS: 3d point grid (from FieldPts component)
        COUNT: Vector storing cell counts for each axis (from FieldPts component)
        RES: Resolution of cell grid
        VAL: Values to assign to each cell
    Returns:
        FIELD: Field object (to be used to drive the FieldAggr component)
"""

ghenv.Component.Name = "Wasp_Field"
ghenv.Component.NickName = 'Field'
ghenv.Component.Message = 'VER 0.4.003'
ghenv.Component.IconDisplayMode = ghenv.Component.IconDisplayMode.application
ghenv.Component.Category = "Wasp"
ghenv.Component.SubCategory = "4 | Aggregation"
try: ghenv.Component.AdditionalHelpFromDocStrings = "1"
except: pass


import sys
import Rhino.Geometry as rg
import Grasshopper as gh


## add Wasp install directory to system path
wasp_loaded = False
ghcompfolder = gh.Folders.DefaultAssemblyFolder
if ghcompfolder not in sys.path:
    sys.path.append(ghcompfolder)
try:
    from wasp import __version__
    wasp_loaded = True
except:
    msg = "Cannot import Wasp. Is the wasp folder available in " + ghcompfolder + "?"
    ghenv.Component.AddRuntimeMessage(gh.Kernel.GH_RuntimeMessageLevel.Error, msg)

## if Wasp is installed correctly, load the classes required by the component
if wasp_loaded:
    from wasp.field import Field


def main(name, empty_field, values):
    
    check_data = True
    
    ##check inputs
    if name is None:
        name = "field"
    
    if empty_field is None:
        check_data = False
        msg = "No base empty field provided"
        ghenv.Component.AddRuntimeMessage(gh.Kernel.GH_RuntimeMessageLevel.Warning, msg)
    else:
        
        values_count = empty_field.x_count*empty_field.y_count*empty_field.z_count
        
        if len(values) == 0:
            check_data = False
            msg = "No field values provided"
            ghenv.Component.AddRuntimeMessage(gh.Kernel.GH_RuntimeMessageLevel.Warning, msg)
            
        elif values_count != len(values):
            check_data = False
            msg = "Field points and Values lists are not matching. Please provide a number of values matching the number of points in the base field."
            ghenv.Component.AddRuntimeMessage(gh.Kernel.GH_RuntimeMessageLevel.Error, msg)
    
    if check_data:
        count = empty_field.return_count_vec()
        field = Field(name, empty_field.pts, count, empty_field.resolution, values, empty_field.boundaries)
        return field
    else:
        return -1


result = main(NAME, E_FIELD, VAL)

if result != -1:
    FIELD = result
# ---------- end field ----------
fieldaggregation = Wasp_FieldDrivenAggregation(PART=flatten(part), N=Slider(250, range=0..1000), RULES=rulegen, FIELD=loadfield, RESET=Button())  # -> AGGR, PART_OUT; inputs PART: list, PREV: list, N: Int32, RULES: list, FIELD: list, MODE: Int32, GC: list, RESET: Boolean
# ---------- fieldaggregation: Python ----------
# Wasp: Discrete Design with Grasshopper plug-in (GPL) initiated by Andrea Rossi
# 
# This file is part of Wasp.
# 
# Copyright (c) 2017, Andrea Rossi <a.rossi.andrea@gmail.com>
# Wasp is free software; you can redistribute it and/or modify 
# it under the terms of the GNU General Public License as published 
# by the Free Software Foundation; either version 3 of the License, 
# or (at your option) any later version. 
# 
# Wasp is distributed in the hope that it will be useful,
# but WITHOUT ANY WARRANTY; without even the implied warranty of 
# MERCHANTABILITY or FITNESS FOR A PARTICULAR PURPOSE. See the 
# GNU General Public License for more details.
# 
# You should have received a copy of the GNU General Public License
# along with Wasp; If not, see <http://www.gnu.org/licenses/>.
# 
# @license GPL-3.0 <https://www.gnu.org/licenses/gpl.html>
#
# Significant parts of Wasp have been developed by Andrea Rossi
# as part of research on digital materials and discrete design at:
# DDU Digital Design Unit - Prof. Oliver Tessmann
# Technische Universität Darmstadt


#########################################################################
##                            COMPONENT INFO                           ##
#########################################################################

"""
Aggregate the given parts according to a given scalar field. New parts are added following higher values in the field.
The component works additively, hence increasing the number of parts in an aggregation just adds new parts on the existing ones, without triggering recomputing of the previous element
-
Provided by Wasp 0.4
    Args:
        PART: Parts to be aggregated (can be more than one)
        PREV: OPTIONAL // Previous aggregated parts. It is possible to input the results of a previous aggregation, or parts transformed with the TransformPart component
        N: Number of parts to be aggregated (does not count parts provided in PREV)
        RULES: Rules for the aggregation
        FIELD: Scalar field to drive the aggregation (parts will be added following higher values in the field)
        THRES: OPTIONAL // If set, used to define a threshold value above which the placement of next part is accepted. If not set, aggregation will look for part with highest value in the whole field. Setting a low threshold helds less accurate results, but highly speeds up calculations
        COLL: OPTIONAL // Collision detection. By default is active and checks for collisions between the aggregated parts
        MODE: OPTIONAL // Switches between aggregation modes: 0 = no constraints, 1 = local constraints, 2 = global constraints, 3 = local + global constraints
        GC: OPTIONAL // Global constraints to apply to aggregation
        ID: OPTIONAL // Aggregation ID
        RESET: Recompute the whole aggregation
    Returns:
        AGGR: Aggregation object
        PART_OUT: Aggregated parts (includes both PREV input and newly aggregated parts)
"""

ghenv.Component.Name = "Wasp_Field-driven Aggregation"
ghenv.Component.NickName = 'FieldAggregation'
ghenv.Component.Message = "VER 0.4.003"
ghenv.Component.IconDisplayMode = ghenv.Component.IconDisplayMode.application
ghenv.Component.Category = "Wasp"
ghenv.Component.SubCategory = "4 | Aggregation"
try: ghenv.Component.AdditionalHelpFromDocStrings = "2"
except: pass


import sys
import Rhino.Geometry as rg
import Grasshopper as gh


## add Wasp install directory to system path
wasp_loaded = False
ghcompfolder = gh.Folders.DefaultAssemblyFolder
if ghcompfolder not in sys.path:
    sys.path.append(ghcompfolder)
try:
    from wasp import __version__
    wasp_loaded = True
except:
    msg = "Cannot import Wasp. Is the wasp folder available in " + ghcompfolder + "?"
    ghenv.Component.AddRuntimeMessage(gh.Kernel.GH_RuntimeMessageLevel.Error, msg)

## if Wasp is installed correctly, load the classes required by the component
if wasp_loaded:
    from wasp.core import Aggregation


## Main code execution
def main(parts, previous_parts, num_parts, rules, aggregation_mode, global_constraints, aggregation_id, reset, fields, aggregation):
    
    check_data = True
    ##check inputs
    if len(parts) == 0:
        check_data = False
        msg = "No parts provided"
        ghenv.Component.AddRuntimeMessage(gh.Kernel.GH_RuntimeMessageLevel.Warning, msg)
    
    if num_parts is None:
        check_data = False
        msg = "Provide number of aggregation iterations"
        ghenv.Component.AddRuntimeMessage(gh.Kernel.GH_RuntimeMessageLevel.Warning, msg)
    else:
        if len(previous_parts) != 0:
            num_parts += len(previous_parts)
    
    if len(rules) == 0:
        check_data = False
        msg = "No rules provided"
        ghenv.Component.AddRuntimeMessage(gh.Kernel.GH_RuntimeMessageLevel.Warning, msg)
    
    if aggregation_mode is None:
        aggregation_mode = 0
    
    if aggregation_id is None:
        aggregation_id = 'myFieldAggregation'
    
    if reset is None:
        reset = False
    
    if len(fields) == 0:
        check_data = False
        msg = "Provide a valid scalar field"
        ghenv.Component.AddRuntimeMessage(gh.Kernel.GH_RuntimeMessageLevel.Warning, msg)
    elif len(fields) > 1:
        field_names = [f.name for f in fields]
        for part in parts:
            if part.field is None:
                part.field = fields[0].name
                
            elif part.field not in field_names:
                check_data = False
                msg = "Part " + part.name + " does not have a vaild field name assigned."
                ghenv.Component.AddRuntimeMessage(gh.Kernel.GH_RuntimeMessageLevel.Warning, msg)
    
    if check_data:
        
        ## create aggregation in sticky dict
        if aggregation is None or aggregation == -1 or reset:
            
            ## copy parts to avoid editing the original parts
            parts_copy = []
            for part in parts:
                parts_copy.append(part.copy())
            
            aggregation = Aggregation(aggregation_id, parts_copy, rules, aggregation_mode, _prev = previous_parts, _global_constraints = global_constraints, _field = fields)
        
        ## handle parameters changes
        part_rules_change = False
        #### parts
        if parts != aggregation.parts.values():
            
            ## copy parts to avoid editing the original parts
            parts_copy = []
            for part in parts:
                parts_copy.append(part.copy())
            
            aggregation.reset_base_parts(new_parts = parts_copy)
            aggregation.reset_rules(aggregation.rules)
            part_rules_change = True
        
        #### rules
        if rules != aggregation.rules:
            aggregation.rules = rules
            aggregation.reset_base_parts()
            aggregation.reset_rules(aggregation.rules)
            part_rules_change = True
        
        if part_rules_change:
            aggregation.recompute_aggregation_queue()
        
        #### mode
        if aggregation_mode != aggregation.mode:
            aggregation.mode = aggregation_mode
            aggregation.reset_rules(aggregation.rules)
            aggregation.recompute_aggregation_queue()
        
        #### constraints
        if global_constraints != aggregation.global_constraints:
            aggregation.global_constraints = global_constraints
            aggregation.reset_rules(aggregation.rules)
            aggregation.recompute_aggregation_queue()
        
        ## field (TO DO)
        ##################################
        
        ## add parts to aggregation
        if num_parts > len(aggregation.aggregated_parts):
            #sc.sticky[aggregation_id].aggregate_field(num_parts-sc.sticky[aggregation_id].p_count, field, threshold)
            error_msg = aggregation.aggregate_field(num_parts-len(aggregation.aggregated_parts))
            if error_msg is not None:
                ghenv.Component.AddRuntimeMessage(gh.Kernel.GH_RuntimeMessageLevel.Warning, error_msg)
        
        ## remove parts from aggregation
        elif num_parts < len(aggregation.aggregated_parts):
            aggregation.remove_elements(num_parts)
        
        ## return result
        return aggregation
        
    else:
        return -1

## create aggregation container in global variables dict
if 'aggregation_container' not in globals():
    aggregation_container = None

result = main(PART, PREV, N, RULES, MODE, GC, ID, RESET, FIELD, aggregation_container)

if result != -1:
    aggregation_container = result
    
    AGGR = aggregation_container
    PART_OUT = aggregation_container.aggregated_parts
# ---------- end fieldaggregation ----------
defield = Wasp_DeconstructField(FIELD=loadfield)  # -> NAME, RES, BOU, PTS, VAL, COUNT
# ---------- defield: Python ----------
# Wasp: Discrete Design with Grasshopper plug-in (GPL) initiated by Andrea Rossi
# 
# This file is part of Wasp.
# 
# Copyright (c) 2017, Andrea Rossi <a.rossi.andrea@gmail.com>
# Wasp is free software; you can redistribute it and/or modify 
# it under the terms of the GNU General Public License as published 
# by the Free Software Foundation; either version 3 of the License, 
# or (at your option) any later version. 
# 
# Wasp is distributed in the hope that it will be useful,
# but WITHOUT ANY WARRANTY; without even the implied warranty of 
# MERCHANTABILITY or FITNESS FOR A PARTICULAR PURPOSE. See the 
# GNU General Public License for more details.
# 
# You should have received a copy of the GNU General Public License
# along with Wasp; If not, see <http://www.gnu.org/licenses/>.
# 
# @license GPL-3.0 <https://www.gnu.org/licenses/gpl.html>
#
# Significant parts of Wasp have been developed by Andrea Rossi
# as part of research on digital materials and discrete design at:
# DDU Digital Design Unit - Prof. Oliver Tessmann
# Technische Universität Darmstadt


#########################################################################
##                            COMPONENT INFO                           ##
#########################################################################

"""
Generates a scalar field given a grid of points and their relative scalar values
-
Provided by Wasp 0.4
    Args:
        FIELD: Field to deconstruct
    Returns:
        NAME: Field name
        RES: Field resolution
        BOU: Field boundaries
        PTS: Field points
        VAL: Field values
        COUNT: Points count on x,y,z axes
"""

ghenv.Component.Name = "Wasp_Deconstruct Field"
ghenv.Component.NickName = 'DeField'
ghenv.Component.Message = 'VER 0.4.003'
ghenv.Component.IconDisplayMode = ghenv.Component.IconDisplayMode.application
ghenv.Component.Category = "Wasp"
ghenv.Component.SubCategory = "4 | Aggregation"
try: ghenv.Component.AdditionalHelpFromDocStrings = "1"
except: pass


import sys
import Rhino.Geometry as rg
import Grasshopper as gh


## add Wasp install directory to system path
wasp_loaded = False
ghcompfolder = gh.Folders.DefaultAssemblyFolder
if ghcompfolder not in sys.path:
    sys.path.append(ghcompfolder)
try:
    from wasp import __version__
    wasp_loaded = True
except:
    msg = "Cannot import Wasp. Is the wasp folder available in " + ghcompfolder + "?"
    ghenv.Component.AddRuntimeMessage(gh.Kernel.GH_RuntimeMessageLevel.Error, msg)

## if Wasp is installed correctly, load the classes required by the component
if wasp_loaded:
    pass


def main(field):
    
    check_data = True
    
    ##check inputs
    if field is None:
        check_data = False
        msg = "No field provided"
        ghenv.Component.AddRuntimeMessage(gh.Kernel.GH_RuntimeMessageLevel.Warning, msg)
    
    if check_data:
        return field.name, field.resolution, field.boundaries, field.pts, field.return_values_list(), rg.Vector3d(field.x_count, field.y_count, field.z_count)
    else:
        return -1


result = main(FIELD)

if result != -1:
    NAME = result[0]
    RES = result[1]
    BOU = result[2]
    PTS = result[3]
    VAL = result[4]
    COUNT = result[5]
# ---------- end defield ----------
partgeo = Wasp_GetPartGeometry(PART=fieldaggregation.PART_OUT)  # -> GEO
# ---------- partgeo: Python ----------
# Wasp: Discrete Design with Grasshopper plug-in (GPL) initiated by Andrea Rossi
# 
# This file is part of Wasp.
# 
# Copyright (c) 2017, Andrea Rossi <a.rossi.andrea@gmail.com>
# Wasp is free software; you can redistribute it and/or modify 
# it under the terms of the GNU General Public License as published 
# by the Free Software Foundation; either version 3 of the License, 
# or (at your option) any later version. 
# 
# Wasp is distributed in the hope that it will be useful,
# but WITHOUT ANY WARRANTY; without even the implied warranty of 
# MERCHANTABILITY or FITNESS FOR A PARTICULAR PURPOSE. See the 
# GNU General Public License for more details.
# 
# You should have received a copy of the GNU General Public License
# along with Wasp; If not, see <http://www.gnu.org/licenses/>.
# 
# @license GPL-3.0 <https://www.gnu.org/licenses/gpl.html>
#
# Significant parts of Wasp have been developed by Andrea Rossi
# as part of research on digital materials and discrete design at:
# DDU Digital Design Unit - Prof. Oliver Tessmann
# Technische Universität Darmstadt


#########################################################################
##                            COMPONENT INFO                           ##
#########################################################################

"""
Extract the geometry of one part (for visualization or further processing).
-
Provided by Wasp 0.4
    Args:
        PART: Part from where to extract the geometry
    Returns:
        GEO: Part geometry
"""

ghenv.Component.Name = "Wasp_Get Part Geometry"
ghenv.Component.NickName = 'PartGeo'
ghenv.Component.Message = 'VER 0.4.003'
ghenv.Component.IconDisplayMode = ghenv.Component.IconDisplayMode.application
ghenv.Component.Category = "Wasp"
ghenv.Component.SubCategory = "2 | Parts"
try: ghenv.Component.AdditionalHelpFromDocStrings = "3"
except: pass


import sys
import Rhino.Geometry as rg
import Grasshopper as gh


## add Wasp install directory to system path
wasp_loaded = False
ghcompfolder = gh.Folders.DefaultAssemblyFolder
if ghcompfolder not in sys.path:
    sys.path.append(ghcompfolder)
try:
    from wasp import __version__
    wasp_loaded = True
except:
    msg = "Cannot import Wasp. Is the wasp folder available in " + ghcompfolder + "?"
    ghenv.Component.AddRuntimeMessage(gh.Kernel.GH_RuntimeMessageLevel.Error, msg)

## if Wasp is installed correctly, load the classes required by the component
if wasp_loaded:
    pass


def main(part):
        
    check_data = True
    
    ## check inputs
    if part is None:
        check_data = False
        msg = "No or null part provided"
        ghenv.Component.AddRuntimeMessage(gh.Kernel.GH_RuntimeMessageLevel.Warning, msg)
    
    ## execute main code if all needed inputs are available
    if check_data:
        return part.geo
    else:
        return -1

result = main(PART)

if result != -1:
    GEO = result
# ---------- end partgeo ----------
gradient = Gradient(LowerLimit=0, UpperLimit=1, Parameter=defield.VAL, stops=[0: RGB(0, 128, 0), 0.5: RGB(255, 255, 0), 1: RGB(255, 0, 0)])
preview = CustomPreview(Geometry=defield.PTS, Material=gradient)
savefield = Wasp_SaveFieldToFile(FIELD=field, PATH="D:\GoogleDrive\Works\_Wasp_\WaspDevLogs\Wasp_DevLog_002", NAME="myField", SAVE=Button())  # -> TXT, FILE
# ---------- savefield: Python ----------
# Wasp: Discrete Design with Grasshopper plug-in (GPL) initiated by Andrea Rossi
# 
# This file is part of Wasp.
# 
# Copyright (c) 2017, Andrea Rossi <a.rossi.andrea@gmail.com>
# Wasp is free software; you can redistribute it and/or modify 
# it under the terms of the GNU General Public License as published 
# by the Free Software Foundation; either version 3 of the License, 
# or (at your option) any later version. 
# 
# Wasp is distributed in the hope that it will be useful,
# but WITHOUT ANY WARRANTY; without even the implied warranty of 
# MERCHANTABILITY or FITNESS FOR A PARTICULAR PURPOSE. See the 
# GNU General Public License for more details.
# 
# You should have received a copy of the GNU General Public License
# along with Wasp; If not, see <http://www.gnu.org/licenses/>.
# 
# @license GPL-3.0 <https://www.gnu.org/licenses/gpl.html>
#
# Significant parts of Wasp have been developed by Andrea Rossi
# as part of research on digital materials and discrete design at:
# DDU Digital Design Unit - Prof. Oliver Tessmann
# Technische Universität Darmstadt


#########################################################################
##                            COMPONENT INFO                           ##
#########################################################################

"""
Saves current status of an aggregation to a .json file.
-
Provided by Wasp 0.4
    Args:
        FIELD: Field to save
        PATH: Path where to save the aggregation
        NAME: Name of the exported file
        SAVE: True to export
    Returns:
        TXT: Text representation of the aggregation
"""

ghenv.Component.Name = "Wasp_Save Field to File"
ghenv.Component.NickName = 'SaveField'
ghenv.Component.Message = 'VER 0.4.003'
ghenv.Component.IconDisplayMode = ghenv.Component.IconDisplayMode.application
ghenv.Component.Category = "Wasp"
ghenv.Component.SubCategory = "4 | Aggregation"
try: ghenv.Component.AdditionalHelpFromDocStrings = "5"
except: pass


import sys
import os
import Rhino.Geometry as rg
import Grasshopper as gh
import json


## add Wasp install directory to system path
wasp_loaded = False
ghcompfolder = gh.Folders.DefaultAssemblyFolder
if ghcompfolder not in sys.path:
    sys.path.append(ghcompfolder)
try:
    from wasp import __version__
    wasp_loaded = True
except:
    msg = "Cannot import Wasp. Is the wasp folder available in " + ghcompfolder + "?"
    ghenv.Component.AddRuntimeMessage(gh.Kernel.GH_RuntimeMessageLevel.Error, msg)

## if Wasp is installed correctly, load the classes required by the component
if wasp_loaded:
    from wasp.field import Field


def main(field, path, filename, save):
        
    check_data = True
    
    ## check inputs
    if field is None:
        check_data = False
        msg = "No field provided"
        ghenv.Component.AddRuntimeMessage(gh.Kernel.GH_RuntimeMessageLevel.Warning, msg)
    
    if path is None:
        check_data = False
        msg = "No path provided"
        ghenv.Component.AddRuntimeMessage(gh.Kernel.GH_RuntimeMessageLevel.Warning, msg)
    
    if filename is None:
        check_data = False
        msg = "No filename provided"
        ghenv.Component.AddRuntimeMessage(gh.Kernel.GH_RuntimeMessageLevel.Warning, msg)
    
    if save is None:
        save = False
    
    ## execute main code if all needed inputs are available
    if check_data:
        
        field_dict = field.to_data()
        full_path = os.path.join(path, filename + ".json")
        
        if save:
            with open(full_path, "w") as outF:
                json.dump(field_dict, outF)
        
        return json.dumps(field_dict), full_path
    else:
        return -1

result = main(FIELD, PATH, NAME, SAVE)

if result != -1:
    TXT = result[0]
    FILE = result[1]
# ---------- end savefield ----------
