# Grasshopper definition 4_01_TopOpt_Field_Millipede_RH5.gh (Grasshopper 0.9.76)
# plug-ins: Python Interpreter, Millipede

# ----
# Press the button to make sure the file is
# updated to latest Wasp version on your pc.
button = Button()
# # Wasp: Discrete Design with Grasshopper plug-in (GPL) initiated by Andrea Rossi
# 
# 
# This file is part of Wasp.
# 
# Copyright (c) 2019, Andrea Rossi <a.rossi.andrea@gmail.com>
# 
# Wasp is free software; you can redistribute it and/or modify it under the terms of the GNU General Public License as published by the Free Software Foundation; either version 3 of the License, or (at your option) any later version.
# 
# Wasp is distributed in the hope that it will be useful, but WITHOUT ANY WARRANTY; without even the implied warranty of MERCHANTABILITY or FITNESS FOR A PARTICULAR PURPOSE. See the GNU General Public License for more details. You should have received a copy of the GNU General Public License
#  along with Wasp; If not, see <http://www.gnu.org/licenses/>.
# 
# license GPL-3.0 <https://www.gnu.org/licenses/gpl.html>
# 
# Significant parts of Wasp have been developed by Andrea Rossi as part of research on digital materials and discrete design at DDU Digital Design Unit - Prof. Oliver Tessmann - Technische Universität Darmstadt
# 4_01_TopOpt_Field_Millipede
updatefile = Wasp_UpdateFile(UPDATE=button)  # -> LOG; inputs UPDATE: Boolean
# ---------- updatefile: Python ----------
# Wasp: Discrete Design with Grasshopper plug-in (GPL) initiated by Andrea Rossi
# 
# This file is part of Wasp.
# 
# Copyright (c) 2017, Andrea Rossi <a.rossi.andrea@gmail.com>
# Wasp is free software; you can redistribute it and/or modify 
# it under the terms of the GNU General Public License as published 
# by the Free Software Foundation; either version 3 of the License, 
# or (at your option) any later version. 
# 
# Wasp is distributed in the hope that it will be useful,
# but WITHOUT ANY WARRANTY; without even the implied warranty of 
# MERCHANTABILITY or FITNESS FOR A PARTICULAR PURPOSE. See the 
# GNU General Public License for more details.
# 
# You should have received a copy of the GNU General Public License
# along with Wasp; If not, see <http://www.gnu.org/licenses/>.
# 
# @license GPL-3.0 <https://www.gnu.org/licenses/gpl.html>
#
# Significant parts of Wasp have been developed by Andrea Rossi
# as part of research on digital materials and discrete design at:
# DDU Digital Design Unit - Prof. Oliver Tessmann
# Technische Universität Darmstadt


#########################################################################
##                            COMPONENT INFO                           ##
#########################################################################

"""
This component doesn't update the installation. It will only update the file
to your current installation. The components that can't be updated automatically
will be marked and should be replaced manually.
--> WIP Component: might be incomplete or contain bugs <--
-
Provided by Wasp 0.2
Code is adapted from Ladybug file updater (https://github.com/mostaphaRoudsari/ladybug)
    
    Args:
        UP: Set to "True" if you want this component to search through the current Grasshopper file and update Wasp components.
    Returns:
        LOG: List of updated files.
"""

ghenv.Component.Name = "Wasp_Update File"
ghenv.Component.NickName = 'UpdateFile'
ghenv.Component.Message = 'VER 0.2.06'
ghenv.Component.IconDisplayMode = ghenv.Component.IconDisplayMode.application
ghenv.Component.Category = "Wasp"
ghenv.Component.SubCategory = "X | Experimental"
try: ghenv.Component.AdditionalHelpFromDocStrings = "1"
except: pass

import Grasshopper
import System
import os
from datetime import datetime
import time


def markComponent(doc, comp, note=None):
    """Add a Group to the component with a note."""
    note = note or "There is a change in input or output. Replace manually with the inserted component!"
    grp = Grasshopper.Kernel.Special.GH_Group()
    grp.CreateAttributes()
    grp.Border = Grasshopper.Kernel.Special.GH_GroupBorder.Blob
    grp.AddObject(comp.InstanceGuid)
    grp.Colour = System.Drawing.Color.IndianRed
    grp.NickName = note
    doc.AddObject(grp, False);    
    return True

def isWaspComponent(component):
    """Return True if a component is part of Wasp."""
    if component.Name.split('_')[0] == "Wasp":
        return True
    return False


def collectGHPythonComponents(document=None):
    """Collect all the GHPython components in file.""" 
    components = []
    document = document or ghenv.Component.OnPingDocument()
    for obj in document.Objects:
        if type(obj) == type(ghenv.Component)and isWaspComponent(obj):
            if obj.Locked:
                continue
            components.append(obj)
    # remove the component itself
    components = tuple(comp for comp in components if comp.InstanceGuid != ghenv.Component.InstanceGuid)
    return components


def parseVersion(version):
    version = sum(int(n) * 10 ** i for i, n in enumerate(reversed(version.split("VER ")[1].split("."))))
    return version


def isNewerVersion(uo, component):
    """Check if user object is newer version of the component."""
    # try to get date and time
    warnType = Grasshopper.Kernel.GH_RuntimeMessageLevel.Warning
    try:
        version = parseVersion(component.Message)
    except Exception:
        warning = 'Failed to parse version from "%s" component.' % component.Name
        ghenv.Component.AddRuntimeMessage(warnType, warning)
        return False    
    
    # get the version from the userobject
    for c, line in enumerate(uo.Code.split('\n')):
        if c > 200:
            warning = 'Failed to parse version from "%s" userobject.' % component.Name
            ghenv.Component.AddRuntimeMessage(warnType, warning)
            return False
        if line.strip().startswith("ghenv.Component.Message"):
            uversion = line.split("=")[1].strip()[:-1]
            try:
                uversion = parseVersion(uversion)
            except Exception:
                warning = 'Failed to parse version from "%s" userobject.' % component.Name
                ghenv.Component.AddRuntimeMessage(warnType, warning)
                return False    
            
            if uversion >= version:
                return True
            else:
                return False


def comparePort(p1, p2):
    """compare two ports and return True if they are equal."""
    if hasattr(p1, 'TypeHint'):
        if p1.Name != p2.Name:
            return False
        elif p1.TypeHint.TypeName != p2.TypeHint.TypeName:
            return False
        elif str(p1.Access) != str(p2.Access):
            return False
        else:
            return True
    else:
        # output
        if p1.Name != p2.Name:
            return False
        else:
            return True        

def comparePorts(c1, c2):
    """Compare ports for two components."""
    for i in xrange(c1.Params.Input.Count):
        if not comparePort(c1.Params.Input[i], c2.Params.Input[i]):
            return True
    
    for i in xrange(c1.Params.Output.Count):
        if not comparePort(c1.Params.Output[i], c2.Params.Output[i]):
            return True
    
    return False

def inputOutputChanged(uo, component):
    """Check if inputs or outputs has changed."""
    if uo.Params.Input.Count != component.Params.Input.Count:
        return True
    elif uo.Params.Output.Count != component.Params.Output.Count:
        return True
    
    return comparePorts(uo, component)


def insertNewUO(uo, component, doc):
    # use component to find the location
    x = component.Attributes.Pivot.X + 30
    y = component.Attributes.Pivot.Y - 20
    
    # insert the new one
    uo.Attributes.Pivot = System.Drawing.PointF(x, y)
    doc.AddObject(uo , False, 0)


def updateComponent(component, uofolder):
    """update component from userobject."""
    fp = os.path.join(uofolder, '%s.ghuser' % component.Name)

    if not os.path.isfile(fp):
        warning = 'Failed to find the userobject for %s' % component.Name
        ghenv.Component.AddRuntimeMessage(Grasshopper.Kernel.GH_RuntimeMessageLevel.Warning, warning)
        return False
    uo = Grasshopper.Kernel.GH_UserObject(fp).InstantiateObject()

    # check the version and the date between component and userobject
    if not isNewerVersion(uo, component):
        return False 

    # it is a newer version
    component.Code = uo.Code
    
    # Define the callback function
    def callBack(document):
        component.ExpireSolution(False)

    # Update the solution
    doc.ScheduleSolution(2,
        Grasshopper.Kernel.GH_Document.GH_ScheduleDelegate(callBack))

    # check if inputs or outputs has changed
    if inputOutputChanged(uo, component):
        insertNewUO(uo, component, doc)
        
        # add a group note to the component
        markComponent(doc, component)
        return 'Cannot update %s. Replace manually.' % component.Name

    return 'Updated %s' % component.Name


if UPDATE:
    # find the component
    uofolder = Grasshopper.Folders.UserObjectFolders[0]
    
    doc = ghenv.Component.OnPingDocument()
    
    # load the initial userobject
    components = collectGHPythonComponents(doc)
    
    report = (updateComponent(comp, uofolder) for comp in components)
    
    LOG = '\n'.join(r for r in report if r)
# ---------- end updatefile ----------

# ---- group: Boundary
brep = Brep(<brep referenced from the Rhino model>)

# ---- group: LOADS
brep_2 = Brep(<brep referenced from the Rhino model>)

# ---- group: SUPPORTS
brep_3 = Brep([<brep referenced from the Rhino model> x2])

# ----
# 1a. Build Part
# Parts are the building blocks of Wasp.
# The most basic way of initializing a part is to define t he geometry (as brep or mesh),
# and the connection faces (center and orientation - with a line). Parts must be named
# to be identifyed in the aggregation rules.
connections_centers = Point([<point referenced from the Rhino model> x14])
connections_x_axis = Curve([<curve referenced from the Rhino model> x14])
part_geometry = Brep(<brep referenced from the Rhino model>)
conndir = Wasp_ConnectionFromDirection(GEO=part_geometry, CEN=connections_centers, UP=connections_x_axis)  # -> CONN, PLN_OUT; inputs CEN: list of Point3d, UP: list of Curve, T: list
# ---------- conndir: Python ----------
# Wasp: Discrete Design with Grasshopper plug-in (GPL) initiated by Andrea Rossi
# 
# This file is part of Wasp.
# 
# Copyright (c) 2017, Andrea Rossi <a.rossi.andrea@gmail.com>
# Wasp is free software; you can redistribute it and/or modify 
# it under the terms of the GNU General Public License as published 
# by the Free Software Foundation; either version 3 of the License, 
# or (at your option) any later version. 
# 
# Wasp is distributed in the hope that it will be useful,
# but WITHOUT ANY WARRANTY; without even the implied warranty of 
# MERCHANTABILITY or FITNESS FOR A PARTICULAR PURPOSE. See the 
# GNU General Public License for more details.
# 
# You should have received a copy of the GNU General Public License
# along with Wasp; If not, see <http://www.gnu.org/licenses/>.
# 
# @license GPL-3.0 <https://www.gnu.org/licenses/gpl.html>
#
# Significant parts of Wasp have been developed by Andrea Rossi
# as part of research on digital materials and discrete design at:
# DDU Digital Design Unit - Prof. Oliver Tessmann
# Technische Universität Darmstadt


#########################################################################
##                            COMPONENT INFO                           ##
#########################################################################

"""
Create a connection on a given part geometry from center and X-asix direction
(Z direction is determined based on the normals of the component geometry)
-
Provided by Wasp 0.3
    Args:
        GEO: Geometry of the part to which the connection belongs
        CEN: Origin of the connection plane
        UP: Line idetifying the X-axis of the connection plane - determines the plane orientation to mantain when transforming
        T: OPTIONAL // Connection type (to be used with Rule Generator component)
    Returns:
        CONN: Connection object
        PLN_OUT: Plane for each connection object (for debugging)
"""

ghenv.Component.Name = "Wasp_Connection From Direction"
ghenv.Component.NickName = 'ConnDir'
ghenv.Component.Message = 'VER 0.3.002'
ghenv.Component.IconDisplayMode = ghenv.Component.IconDisplayMode.application
ghenv.Component.Category = "Wasp"
ghenv.Component.SubCategory = "1 | Elements"
try: ghenv.Component.AdditionalHelpFromDocStrings = "1"
except: pass


import sys
import Rhino.Geometry as rg
import Grasshopper as gh

## add Wasp install directory to system path
wasp_loaded = False
ghcompfolder = gh.Folders.DefaultAssemblyFolder
if ghcompfolder not in sys.path:
    sys.path.append(ghcompfolder)
try:
    from wasp import __version__
    wasp_loaded = True
except:
    msg = "Cannot import Wasp. Is the wasp folder available in " + ghcompfolder + "?"
    ghenv.Component.AddRuntimeMessage(gh.Kernel.GH_RuntimeMessageLevel.Error, msg)

## if Wasp is installed correctly, load the classes required by the component
if wasp_loaded:
    from wasp import Connection
    from wasp import global_tolerance


def main(part_geo, conn_centers, conn_ups, conn_type):
        
    check_data = True
    
    ## check inputs
    if part_geo is None:
        check_data = False
        msg = "No part geometry provided"
        ghenv.Component.AddRuntimeMessage(gh.Kernel.GH_RuntimeMessageLevel.Warning, msg)
    
    if len(conn_centers) != len(conn_ups):
        check_data = False
        msg = "Different amount of centers and up vectors provided"
        ghenv.Component.AddRuntimeMessage(gh.Kernel.GH_RuntimeMessageLevel.Error, msg)
    
    types = []
    if len(conn_type) == 0:
        for i in range(len(conn_centers)):
            types.append("0")
    elif len(conn_type) == 1:
        for i in range(len(conn_centers)):
            types.append(conn_type[0])
    elif len(conn_centers) != len(conn_type):
        check_data = False
        msg = "Different amount of centers and types provided"
        ghenv.Component.AddRuntimeMessage(gh.Kernel.GH_RuntimeMessageLevel.Error, msg)
    else:
        for i in range(len(conn_centers)):
            types.append(conn_type[i])
    
    ## execute main code if all needed inputs are available
    if check_data:
        connections = []
        out_planes = []
        for i in range(len(conn_centers)):
            
            center = conn_centers[i]
            up = conn_ups[i]
            plane = None
            
            up_start = rg.Vector3d(up.PointAtStart)
            up_end = rg.Vector3d(up.PointAtEnd)
            up_vec = rg.Vector3d.Subtract(up_end, up_start)
            
            if type(part_geo) == rg.Brep:
                for face in part_geo.Faces:
                    pt_uv = face.ClosestPoint(center)
                    pt = face.PointAt(pt_uv[1], pt_uv[2])
                    dist = rg.Point3d.DistanceTo(center, pt)
                    if(dist < global_tolerance):
                        normal = face.NormalAt(pt_uv[1], pt_uv[2])
                        plane = rg.Plane(center, normal)
                        x_axis = plane.XAxis
                        angle = rg.Vector3d.VectorAngle(x_axis, up_vec, plane)
                        plane.Rotate(angle, normal)
                        break
            
            elif type(part_geo) == rg.Mesh:
                part_geo.Normals.ComputeNormals()
                mesh_pt = part_geo.ClosestMeshPoint(center, global_tolerance)
                if mesh_pt is not None:
                    normal = part_geo.NormalAt(mesh_pt)
                    plane = rg.Plane(center, normal)
                    x_axis = plane.XAxis
                    angle = rg.Vector3d.VectorAngle(x_axis, up_vec, plane)
                    plane.Rotate(angle, normal)
            
            if plane is None:
                msg = "No valid plane provided for connection %d"%(i)
                ghenv.Component.AddRuntimeMessage(gh.Kernel.GH_RuntimeMessageLevel.Error, msg)
            else:
                conn = Connection(plane, types[i], "", -1)
                connections.append(conn)
                out_planes.append(plane)
        
        return connections, out_planes
    
    else:
        return -1

result = main(GEO, CEN, UP, T)

if result != -1:
    CONN = result[0]
    PLN_OUT = result[1]
# ---------- end conndir ----------
points = PointList(Points=connections_centers, Size=Slider(2, range=0..10))
part_name = Panel("OCTA")
part = Wasp_BasicPart(NAME=part_name, GEO=part_geometry, CONN=flatten(conndir.CONN))  # -> PART; inputs GEO: Mesh, CONN: list, ATTR: list
# ---------- part: Python ----------
# Wasp: Discrete Design with Grasshopper plug-in (GPL) initiated by Andrea Rossi
# 
# This file is part of Wasp.
# 
# Copyright (c) 2017, Andrea Rossi <a.rossi.andrea@gmail.com>
# Wasp is free software; you can redistribute it and/or modify 
# it under the terms of the GNU General Public License as published 
# by the Free Software Foundation; either version 3 of the License, 
# or (at your option) any later version. 
# 
# Wasp is distributed in the hope that it will be useful,
# but WITHOUT ANY WARRANTY; without even the implied warranty of 
# MERCHANTABILITY or FITNESS FOR A PARTICULAR PURPOSE. See the 
# GNU General Public License for more details.
# 
# You should have received a copy of the GNU General Public License
# along with Wasp; If not, see <http://www.gnu.org/licenses/>.
# 
# @license GPL-3.0 <https://www.gnu.org/licenses/gpl.html>
#
# Significant parts of Wasp have been developed by Andrea Rossi
# as part of research on digital materials and discrete design at:
# DDU Digital Design Unit - Prof. Oliver Tessmann
# Technische Universität Darmstadt


#########################################################################
##                            COMPONENT INFO                           ##
#########################################################################

"""
Create a basic Wasp Part to be used for aggregation
-
Provided by Wasp 0.3
    Args:
        NAME: Part name
        GEO: Part geometry. It will be converted to mesh - to improve performance, perform the conversion before adding to the part and user a low-poly count
        CONN: Connections list
        COLL: OPTIONAL // Collider geometry (for collision detection). A collider will be automatically generated. For complex parts, automatic generation might not work, and you can add a custom collider geometry here.
        ATTR: OPTIONAL // Part attributes
    Returns:
        PART: Part instance
"""

ghenv.Component.Name = "Wasp_Basic Part"
ghenv.Component.NickName = 'Part'
ghenv.Component.Message = 'VER 0.3.002'
ghenv.Component.IconDisplayMode = ghenv.Component.IconDisplayMode.application
ghenv.Component.Category = "Wasp"
ghenv.Component.SubCategory = "2 | Parts"
try: ghenv.Component.AdditionalHelpFromDocStrings = "1"
except: pass

import sys
import Rhino.Geometry as rg
import Grasshopper as gh


## add Wasp install directory to system path
wasp_loaded = False
ghcompfolder = gh.Folders.DefaultAssemblyFolder
if ghcompfolder not in sys.path:
    sys.path.append(ghcompfolder)
try:
    from wasp import __version__
    wasp_loaded = True
except:
    msg = "Cannot import Wasp. Is the wasp folder available in " + ghcompfolder + "?"
    ghenv.Component.AddRuntimeMessage(gh.Kernel.GH_RuntimeMessageLevel.Error, msg)

## if Wasp is installed correctly, load the classes required by the component
if wasp_loaded:
    from wasp import Part
    from wasp import Collider
    from wasp import global_tolerance


def main(part_name, part_geo, connections, collider, attributes):
    
    check_data = True
    
    ## check inputs
    if part_name is None:
        check_data = False
        msg = "No part name provided"
        ghenv.Component.AddRuntimeMessage(gh.Kernel.GH_RuntimeMessageLevel.Warning, msg)
    
    if part_geo is None:
        check_data = False
        msg = "No part geometry provided"
        ghenv.Component.AddRuntimeMessage(gh.Kernel.GH_RuntimeMessageLevel.Warning, msg)
        check_data = False
    
    if collider is None:
        if part_geo is not None:
            collider_geo = part_geo.Duplicate().Offset(global_tolerance)
            collider_intersection = rg.Intersect.Intersection.MeshMeshFast(collider_geo, part_geo)
            if len(collider_intersection) > 0:
                collider_geo = None
                collider_geo = part_geo.Duplicate()
                center = part_geo.GetBoundingBox(True).Center
                scale_plane = rg.Plane(center, rg.Vector3d(1,0,0), rg.Vector3d(0,1,0))
                scale_transform = rg.Transform.Scale(scale_plane, 1-global_tolerance, 1-global_tolerance, 1-global_tolerance)
                collider_geo.Transform(scale_transform)
                collider_intersection = rg.Intersect.Intersection.MeshMeshFast(collider_geo, part_geo)
                if len(collider_intersection) > 0:
                    collider_geo = None
                    msg = "Could not compute a valid collider geometry. Please provide a valid collider in the COLL input."
                    ghenv.Component.AddRuntimeMessage(gh.Kernel.GH_RuntimeMessageLevel.Error, msg)
                    check_data = False
            
            if collider_geo is not None:
                collider = Collider([collider_geo])
            
    else:
        if type(collider) != Collider:
            if type(collider) == rg.Mesh:
                collider = Collider([collider])
            else:
                msg = "Collider geometry must be of type Mesh or WaspCollider."
                ghenv.Component.AddRuntimeMessage(gh.Kernel.GH_RuntimeMessageLevel.Error, msg)
                check_data = False
        
    if collider is not None and collider.faces_count > 1000:
        msg = "The collider has a high faces count. Consider providing a low poly collider to improve performance"
        ghenv.Component.AddRuntimeMessage(gh.Kernel.GH_RuntimeMessageLevel.Warning, msg)
    
    
    if check_data:
        new_part = Part(part_name, part_geo, connections, collider, attributes)
        
        if new_part.dim < global_tolerance*10:
            msg = "The parts you created are very small. You might consider scaling them or decreasing the tolerance of your Rhino file."
            ghenv.Component.AddRuntimeMessage(gh.Kernel.GH_RuntimeMessageLevel.Warning, msg)
        
        return new_part
    else:
        return -1


result = main(NAME, GEO, CONN, COLL, ATTR)

if result != -1:
    PART = result
# ---------- end part ----------

# ----
# 2. Define aggregation rules
# Rules can be defined ina compact way
# with a text string in the format:
# "Part1|Connection1_Part2|Connection2"
octa_octa = Panel("""OCTA|0_OCTA|6
OCTA|6_OCTA|0
OCTA|1_OCTA|7
OCTA|7_OCTA|1
OCTA|2_OCTA|4
OCTA|4_OCTA|2
OCTA|3_OCTA|5
OCTA|5_OCTA|3""")
ruletxt = Wasp_RuleFromText(TXT=octa_octa)  # -> R
# ---------- ruletxt: Python ----------
# Wasp: Discrete Design with Grasshopper plug-in (GPL) initiated by Andrea Rossi
# 
# This file is part of Wasp.
# 
# Copyright (c) 2017, Andrea Rossi <a.rossi.andrea@gmail.com>
# Wasp is free software; you can redistribute it and/or modify 
# it under the terms of the GNU General Public License as published 
# by the Free Software Foundation; either version 3 of the License, 
# or (at your option) any later version. 
# 
# Wasp is distributed in the hope that it will be useful,
# but WITHOUT ANY WARRANTY; without even the implied warranty of 
# MERCHANTABILITY or FITNESS FOR A PARTICULAR PURPOSE. See the 
# GNU General Public License for more details.
# 
# You should have received a copy of the GNU General Public License
# along with Wasp; If not, see <http://www.gnu.org/licenses/>.
# 
# @license GPL-3.0 <https://www.gnu.org/licenses/gpl.html>
#
# Significant parts of Wasp have been developed by Andrea Rossi
# as part of research on digital materials and discrete design at:
# DDU Digital Design Unit - Prof. Oliver Tessmann
# Technische Universität Darmstadt


#########################################################################
##                            COMPONENT INFO                           ##
#########################################################################

"""
Generate an aggregation rule from a text string description
-
Provided by Wasp 0.3
    Args:
        TXT: Text description of the rule with format "Part1|Conn1_Part2|Conn2"
    Returns:
        R: Rule
"""

ghenv.Component.Name = "Wasp_Rule From Text"
ghenv.Component.NickName = 'RuleTxt'
ghenv.Component.Message = 'VER 0.3.002'
ghenv.Component.IconDisplayMode = ghenv.Component.IconDisplayMode.application
ghenv.Component.Category = "Wasp"
ghenv.Component.SubCategory = "3 | Rules"
try: ghenv.Component.AdditionalHelpFromDocStrings = "1"
except: pass

import sys
import Grasshopper as gh


## add Wasp install directory to system path
wasp_loaded = False
ghcompfolder = gh.Folders.DefaultAssemblyFolder
if ghcompfolder not in sys.path:
    sys.path.append(ghcompfolder)
try:
    from wasp import __version__
    wasp_loaded = True
except:
    msg = "Cannot import Wasp. Is the wasp folder available in " + ghcompfolder + "?"
    ghenv.Component.AddRuntimeMessage(gh.Kernel.GH_RuntimeMessageLevel.Error, msg)

## if Wasp is installed correctly, load the classes required by the component
if wasp_loaded:
    from wasp import Rule



def main(text):
    
    check_data = True
    
    ##check inputs
    if text is None:
        check_data = False
        msg = "No text provided"
        ghenv.Component.AddRuntimeMessage(gh.Kernel.GH_RuntimeMessageLevel.Warning, msg)
    
    if check_data:
        
        try:
            rule_parts = text.split("_")
            part1 = str(rule_parts[0].split("|")[0])
            conn1 = int(rule_parts[0].split("|")[1])
            part2 = str(rule_parts[1].split("|")[0])
            conn2 = int(rule_parts[1].split("|")[1])
            
            rule = Rule(part1, conn1, part2, conn2)
            return rule
        except:
            msg = "Text string %s is not formatted correctly"%(text)
            ghenv.Component.AddRuntimeMessage(gh.Kernel.GH_RuntimeMessageLevel.Error, msg)
            return -1
    else:
        return -1


result = main(TXT)

if result != -1:
    R = result
# ---------- end ruletxt ----------

load = _3DLoadRegion(Boundary=brep_2, Load=Vector(0, 0, -1))
boundary = _3DBoundaryRegion(Boundary=brep, IsVoid=False)
support = _3DSupportRegion(Boundary=brep_3, SupportType=63, AmendExistingSupports=True)
number_slider = Slider(15, range=0..100)
topostruct_3d = Topostruct3DModel(ModelComponents=[boundary, load, support], XResolution=number_slider)  # -> FEModel, CellCentres, CellSize
topostruct_3d_solver = Topostruct3DSolver(
    FEModel=topostruct_3d.FEModel,
    SelfWeightCoefficient=0,
    OptimisationIterations=Slider(10, range=0..100),
    Smoothing=0.1,
    Penalization=3,
    TargetDensity=Slider(0.25, range=0..1),
    MinimumDensity=0.001,
    DeleteThreshold=0.5,
    PeriodicX=False,
    PeriodicY=False,
    PeriodicZ=False,
    LoadCase=0,
    AllCases=True)  # -> FEModel, MaxDeflection
_3d_cell_results = _3DCellResults(FEModel=topostruct_3d_solver.FEModel)  # -> PrincipalStressPlanes, PrincipalStresses, VonMisesStress, Density
_3d_iso_mesh = _3DIsoMesh(FEModel=topostruct_3d_solver.FEModel, Deflection=0, IsoContourValue=Slider(0.5, range=0..1), ColorMode=0)

debox = DeconstructBox(Box=brep)  # -> Plane, X, Y, Z
dedomain = DeconstructDomain(Domain=debox.X)  # -> Start, End
subtraction = Subtraction(A=number_slider, B="1")
subtraction_2 = Subtraction(A=dedomain.End, B=dedomain.Start)
division = Division(A=subtraction_2, B=subtraction)
fieldpts = Wasp_FieldPoints(BOU=brep, RES=division)  # -> E_FIELD, PTS; inputs BOU: list of Mesh
# ---------- fieldpts: Python ----------
# Wasp: Discrete Design with Grasshopper plug-in (GPL) initiated by Andrea Rossi
# 
# This file is part of Wasp.
# 
# Copyright (c) 2017, Andrea Rossi <a.rossi.andrea@gmail.com>
# Wasp is free software; you can redistribute it and/or modify 
# it under the terms of the GNU General Public License as published 
# by the Free Software Foundation; either version 3 of the License, 
# or (at your option) any later version. 
# 
# Wasp is distributed in the hope that it will be useful,
# but WITHOUT ANY WARRANTY; without even the implied warranty of 
# MERCHANTABILITY or FITNESS FOR A PARTICULAR PURPOSE. See the 
# GNU General Public License for more details.
# 
# You should have received a copy of the GNU General Public License
# along with Wasp; If not, see <http://www.gnu.org/licenses/>.
# 
# @license GPL-3.0 <https://www.gnu.org/licenses/gpl.html>
#
# Significant parts of Wasp have been developed by Andrea Rossi
# as part of research on digital materials and discrete design at:
# DDU Digital Design Unit - Prof. Oliver Tessmann
# Technische Universität Darmstadt


#########################################################################
##                            COMPONENT INFO                           ##
#########################################################################

"""
Generate a 3d point grid to be fed to the field component
-
Provided by Wasp 0.3
    Args:
        BOU: List of geometries defining the boundaries of the field. Geometries must be closed breps or meshes.
        RES: Resolution (Dimension of each cell)
    Returns:
        E_FIELD: Empty field. Assign values with the "Wasp_Field" component
        PTS: Field points
"""

ghenv.Component.Name = "Wasp_Field Points"
ghenv.Component.NickName = 'FieldPts'
ghenv.Component.Message = 'VER 0.3.002'
ghenv.Component.IconDisplayMode = ghenv.Component.IconDisplayMode.application
ghenv.Component.Category = "Wasp"
ghenv.Component.SubCategory = "4 | Aggregation"
try: ghenv.Component.AdditionalHelpFromDocStrings = "1"
except: pass


import sys
import Rhino.Geometry as rg
import Grasshopper as gh
import math


## add Wasp install directory to system path
wasp_loaded = False
ghcompfolder = gh.Folders.DefaultAssemblyFolder
if ghcompfolder not in sys.path:
    sys.path.append(ghcompfolder)
try:
    from wasp import __version__
    wasp_loaded = True
except:
    msg = "Cannot import Wasp. Is the wasp folder available in " + ghcompfolder + "?"
    ghenv.Component.AddRuntimeMessage(gh.Kernel.GH_RuntimeMessageLevel.Error, msg)

## if Wasp is installed correctly, load the classes required by the component
if wasp_loaded:
    from wasp import Field


def main(boundaries, resolution):
    
    check_data = True
    
    ##check inputs
    if len(boundaries) == 0:
        check_data = False
        msg = "No boundary geometry provided"
        ghenv.Component.AddRuntimeMessage(gh.Kernel.GH_RuntimeMessageLevel.Warning, msg)
    
    if resolution is None and len(boundaries) != 0:
        global_bbox = None
        for geo in boundaries:
            bbox = geo.GetBoundingBox(True)
            
            if global_bbox is None:
                global_bbox = bbox
            else:
                global_bbox.Union(bbox)
        
        x_size = global_bbox.Max.X - global_bbox.Min.X
        resolution = x_size / 10
        
        msg = "No resolution provided. Default resolution set to %d units"%(resolution)
        ghenv.Component.AddRuntimeMessage(gh.Kernel.GH_RuntimeMessageLevel.Warning, msg)
        
    if check_data:
        global_bbox = None
        for geo in boundaries:
            bbox = geo.GetBoundingBox(True)
            
            if global_bbox is None:
                global_bbox = bbox
            else:
                global_bbox.Union(bbox)
        
        x_size = global_bbox.Max.X - global_bbox.Min.X
        x_count = int(math.ceil(x_size / resolution)) + 1
        y_size = global_bbox.Max.Y - global_bbox.Min.Y
        y_count = int(math.ceil(y_size / resolution)) + 1
        z_size = global_bbox.Max.Z - global_bbox.Min.Z
        z_count = int(math.ceil(z_size / resolution)) + 1
        
        count_vec = rg.Vector3d(x_count, y_count, z_count)
        
        pts = []
        s_pt = global_bbox.Min
        
        for z in range(z_count):
            for y in range(y_count):
                for x in range(x_count):
                    pt = rg.Point3d(s_pt.X + x*resolution, s_pt.Y + y*resolution, s_pt.Z + z*resolution)
                    pts.append(pt)
        
        empty_field = Field(None, boundaries, pts, count_vec, resolution)
        return pts, empty_field
        
    else:
        return -1


result = main(BOU, RES)

if result != -1:
    PTS = result[0]
    E_FIELD = result[1]
# ---------- end fieldpts ----------
field = Wasp_Field(NAME="myField", E_FIELD=fieldpts.E_FIELD, VAL=_3d_cell_results.Density)  # -> FIELD; inputs VAL: list
#   port NAME: OPTIONAL // Field name (needed for multi-field aggregation)
#   port E_FIELD: Empty field where to store values. Created with "Wasp_Field Points" component
# ---------- field: Python ----------
# Wasp: Discrete Design with Grasshopper plug-in (GPL) initiated by Andrea Rossi
# 
# This file is part of Wasp.
# 
# Copyright (c) 2017, Andrea Rossi <a.rossi.andrea@gmail.com>
# Wasp is free software; you can redistribute it and/or modify 
# it under the terms of the GNU General Public License as published 
# by the Free Software Foundation; either version 3 of the License, 
# or (at your option) any later version. 
# 
# Wasp is distributed in the hope that it will be useful,
# but WITHOUT ANY WARRANTY; without even the implied warranty of 
# MERCHANTABILITY or FITNESS FOR A PARTICULAR PURPOSE. See the 
# GNU General Public License for more details.
# 
# You should have received a copy of the GNU General Public License
# along with Wasp; If not, see <http://www.gnu.org/licenses/>.
# 
# @license GPL-3.0 <https://www.gnu.org/licenses/gpl.html>
#
# Significant parts of Wasp have been developed by Andrea Rossi
# as part of research on digital materials and discrete design at:
# DDU Digital Design Unit - Prof. Oliver Tessmann
# Technische Universität Darmstadt


#########################################################################
##                            COMPONENT INFO                           ##
#########################################################################

"""
Generates a scalar field given a grid of points and their relative scalar values
-
Provided by Wasp 0.3
    Args:
        BOU: List of geometries defining the boundaries of the field. Geometries must be closed breps or meshes. All points of the field outside the geometries will be assigned a 0 value
        PTS: 3d point grid (from FieldPts component)
        COUNT: Vector storing cell counts for each axis (from FieldPts component)
        RES: Resolution of cell grid
        VAL: Values to assign to each cell
    Returns:
        FIELD: Field object (to be used to drive the FieldAggr component)
"""

ghenv.Component.Name = "Wasp_Field"
ghenv.Component.NickName = 'Field'
ghenv.Component.Message = 'VER 0.3.002'
ghenv.Component.IconDisplayMode = ghenv.Component.IconDisplayMode.application
ghenv.Component.Category = "Wasp"
ghenv.Component.SubCategory = "4 | Aggregation"
try: ghenv.Component.AdditionalHelpFromDocStrings = "1"
except: pass


import sys
import Rhino.Geometry as rg
import Grasshopper as gh


## add Wasp install directory to system path
wasp_loaded = False
ghcompfolder = gh.Folders.DefaultAssemblyFolder
if ghcompfolder not in sys.path:
    sys.path.append(ghcompfolder)
try:
    from wasp import __version__
    wasp_loaded = True
except:
    msg = "Cannot import Wasp. Is the wasp folder available in " + ghcompfolder + "?"
    ghenv.Component.AddRuntimeMessage(gh.Kernel.GH_RuntimeMessageLevel.Error, msg)

## if Wasp is installed correctly, load the classes required by the component
if wasp_loaded:
    from wasp import Field


def main(name, empty_field, values):
    
    check_data = True
    
    ##check inputs
    if name is None:
        name = "field"
    
    if empty_field is None:
        check_data = False
        msg = "No base empty field provided"
        ghenv.Component.AddRuntimeMessage(gh.Kernel.GH_RuntimeMessageLevel.Warning, msg)
    else:
        
        values_count = empty_field.x_count*empty_field.y_count*empty_field.z_count
        
        if len(values) == 0:
            check_data = False
            msg = "No field values provided"
            ghenv.Component.AddRuntimeMessage(gh.Kernel.GH_RuntimeMessageLevel.Warning, msg)
            
        elif values_count != len(values):
            check_data = False
            msg = "Field points and Values lists are not matching. Please provide a number of values matching the number of points in the base field."
            ghenv.Component.AddRuntimeMessage(gh.Kernel.GH_RuntimeMessageLevel.Error, msg)
    
    if check_data:
        count_vec = rg.Vector3d(empty_field.x_count, empty_field.y_count, empty_field.z_count)
        field = Field(name, empty_field.boundaries, empty_field.pts, count_vec, empty_field.resolution, values)
        return field
    else:
        return -1


result = main(NAME, E_FIELD, VAL)

if result != -1:
    FIELD = result
# ---------- end field ----------

faceb = FaceBoundaries(Mesh=_3d_iso_mesh)

preview = CustomPreview(Geometry=faceb, Material=ColourSwatch(SwatchColor=RGB(0, 0, 0)))

# ----
# Visualize Field
defield = Wasp_DeconstructField(FIELD=field)  # -> NAME, RES, BOU, PTS, VAL, COUNT
# ---------- defield: Python ----------
# Wasp: Discrete Design with Grasshopper plug-in (GPL) initiated by Andrea Rossi
# 
# This file is part of Wasp.
# 
# Copyright (c) 2017, Andrea Rossi <a.rossi.andrea@gmail.com>
# Wasp is free software; you can redistribute it and/or modify 
# it under the terms of the GNU General Public License as published 
# by the Free Software Foundation; either version 3 of the License, 
# or (at your option) any later version. 
# 
# Wasp is distributed in the hope that it will be useful,
# but WITHOUT ANY WARRANTY; without even the implied warranty of 
# MERCHANTABILITY or FITNESS FOR A PARTICULAR PURPOSE. See the 
# GNU General Public License for more details.
# 
# You should have received a copy of the GNU General Public License
# along with Wasp; If not, see <http://www.gnu.org/licenses/>.
# 
# @license GPL-3.0 <https://www.gnu.org/licenses/gpl.html>
#
# Significant parts of Wasp have been developed by Andrea Rossi
# as part of research on digital materials and discrete design at:
# DDU Digital Design Unit - Prof. Oliver Tessmann
# Technische Universität Darmstadt


#########################################################################
##                            COMPONENT INFO                           ##
#########################################################################

"""
Generates a scalar field given a grid of points and their relative scalar values
-
Provided by Wasp 0.3
    Args:
        FIELD: Field to deconstruct
    Returns:
        NAME: Field name
        RES: Field resolution
        BOU: Field boundaries
        PTS: Field points
        VAL: Field values
        COUNT: Points count on x,y,z axes
"""

ghenv.Component.Name = "Wasp_Deconstruct Field"
ghenv.Component.NickName = 'DeField'
ghenv.Component.Message = 'VER 0.3.002'
ghenv.Component.IconDisplayMode = ghenv.Component.IconDisplayMode.application
ghenv.Component.Category = "Wasp"
ghenv.Component.SubCategory = "4 | Aggregation"
try: ghenv.Component.AdditionalHelpFromDocStrings = "1"
except: pass


import sys
import Rhino.Geometry as rg
import Grasshopper as gh


## add Wasp install directory to system path
wasp_loaded = False
ghcompfolder = gh.Folders.DefaultAssemblyFolder
if ghcompfolder not in sys.path:
    sys.path.append(ghcompfolder)
try:
    from wasp import __version__
    wasp_loaded = True
except:
    msg = "Cannot import Wasp. Is the wasp folder available in " + ghcompfolder + "?"
    ghenv.Component.AddRuntimeMessage(gh.Kernel.GH_RuntimeMessageLevel.Error, msg)

## if Wasp is installed correctly, load the classes required by the component
if wasp_loaded:
    pass


def main(field):
    
    check_data = True
    
    ##check inputs
    if field is None:
        check_data = False
        msg = "No field provided"
        ghenv.Component.AddRuntimeMessage(gh.Kernel.GH_RuntimeMessageLevel.Warning, msg)
    
    if check_data:
        return field.name, field.resolution, field.boundaries, field.pts, field.return_values_list(), rg.Vector3d(field.x_count, field.y_count, field.z_count)
    else:
        return -1


result = main(FIELD)

if result != -1:
    NAME = result[0]
    RES = result[1]
    BOU = result[2]
    PTS = result[3]
    VAL = result[4]
    COUNT = result[5]
# ---------- end defield ----------
gradient = Gradient(LowerLimit=0, UpperLimit=1, Parameter=defield.VAL, stops=[0: RGB(0, 128, 0), 0.5: RGB(255, 255, 0), 1: RGB(255, 0, 0)])
fieldiso = Wasp_FieldIsolines(FIELD=field, PLN=Slider(0, range=0..2), T=graft(Slider(0.551, range=0..1)), ISO=Slider(0.466, range=0..1))  # -> CRV
# ---------- fieldiso: Python ----------
# Wasp: Discrete Design with Grasshopper plug-in (GPL) initiated by Andrea Rossi
# 
# This file is part of Wasp.
# 
# Copyright (c) 2017, Andrea Rossi <a.rossi.andrea@gmail.com>
# Wasp is free software; you can redistribute it and/or modify 
# it under the terms of the GNU General Public License as published 
# by the Free Software Foundation; either version 3 of the License, 
# or (at your option) any later version. 
# 
# Wasp is distributed in the hope that it will be useful,
# but WITHOUT ANY WARRANTY; without even the implied warranty of 
# MERCHANTABILITY or FITNESS FOR A PARTICULAR PURPOSE. See the 
# GNU General Public License for more details.
# 
# You should have received a copy of the GNU General Public License
# along with Wasp; If not, see <http://www.gnu.org/licenses/>.
# 
# @license GPL-3.0 <https://www.gnu.org/licenses/gpl.html>
#
# Significant parts of Wasp have been developed by Andrea Rossi
# as part of research on digital materials and discrete design at:
# DDU Digital Design Unit - Prof. Oliver Tessmann
# Technische Universität Darmstadt


#########################################################################
##                            COMPONENT INFO                           ##
#########################################################################

"""
Draws isolines across a field object
--> WIP Component: might be incomplete or contain bugs! <--
-
Provided by Wasp 0.3
    Args:
        FIELD: Field object to extract isolines from
        PLN: Plane for isolines extraction (0: XY Plane, 1: YZ Plane, 2: XZ Plane)
        T: Z parameter where to extract isolines
        ISO: Isolevel of the curves
    Returns:
        CRV: Isocurves
"""

ghenv.Component.Name = "Wasp_Field Isolines"
ghenv.Component.NickName = 'FieldIso'
ghenv.Component.Message = 'VER 0.3.002'
ghenv.Component.IconDisplayMode = ghenv.Component.IconDisplayMode.application
ghenv.Component.Category = "Wasp"
ghenv.Component.SubCategory =  "4 | Aggregation"
try: ghenv.Component.AdditionalHelpFromDocStrings = "1"
except: pass


import sys
import Rhino.Geometry as rg
import Grasshopper as gh
import math


## add Wasp install directory to system path
wasp_loaded = False
ghcompfolder = gh.Folders.DefaultAssemblyFolder
if ghcompfolder not in sys.path:
    sys.path.append(ghcompfolder)
try:
    from wasp import __version__
    wasp_loaded = True
except:
    msg = "Cannot import Wasp. Is the wasp folder available in " + ghcompfolder + "?"
    ghenv.Component.AddRuntimeMessage(gh.Kernel.GH_RuntimeMessageLevel.Error, msg)

## if Wasp is installed correctly, load the classes required by the component
if wasp_loaded:
    pass



def main(field, plane, t, iso):
    contour_lookup = {"0000":-1, "0001":[[(0,0.5),(0.5,1)]], "0010":[[(0.5,1),(1,0.5)]], "0011":[[(0,0.5),(1,0.5)]],
                      "0100":[[(0.5,0),(1,0.5)]], "0101":[[(0,0.5),(0.5,0)], [(0.5,1),(1,0.5)]], "0110":[[(0.5,0),(0.5,1)]], "0111":[[(0,0.5),(0.5,0)]],
                      "1000":[[(0,0.5),(0.5,0)]], "1001":[[(0.5,0),(0.5,1)]], "1010":[[(0,0.5),(0.5,1)], [(0.5,0),(1,0.5)]], "1011":[[(0.5,0),(1,0.5)]],
                      "1100":[[(0,0.5),(1,0.5)]], "1101":[[(0.5,1),(1,0.5)]], "1110":[[(0,0.5),(0.5,1)]], "1111":-1}
    
    check_data = True
    
    ##check inputs
    if field is None:
        check_data = False
        msg = "No field provided"
        ghenv.Component.AddRuntimeMessage(gh.Kernel.GH_RuntimeMessageLevel.Warning, msg)
    
    if plane is None:
        plane = 0
    
    if t is None:
        check_data = False
        msg = "No parameter provided"
        ghenv.Component.AddRuntimeMessage(gh.Kernel.GH_RuntimeMessageLevel.Warning, msg)
    
    if iso is None:
        check_data = False
        msg = "No isolevel provided"
        ghenv.Component.AddRuntimeMessage(gh.Kernel.GH_RuntimeMessageLevel.Warning, msg)
    
    if check_data:
        binary_matrix = []
        contour_cases = []
        contours = []
        
        #XY Plane contouring
        if plane == 0:
            ## THRESHOLDING
            z = int(math.floor(field.z_count*t))
            if z == field.z_count:
                z -= 1
            
            for y in range(field.y_count):
                binary_matrix.append([])
                for x in range(field.x_count):
                    if field.vals[z][y][x] < iso:
                        binary_matrix[y].append("0")
                    else:
                        binary_matrix[y].append("1")
            
            ## CASES DEFINITION
            for y in range(0, field.y_count-1):
                contour_cases.append([])
                for x in range(0, field.x_count-1):
                    c_case = ""
                    c_case += binary_matrix[y][x]
                    c_case += binary_matrix[y][x+1]
                    c_case += binary_matrix[y+1][x+1]
                    c_case += binary_matrix[y+1][x]
                    contour_cases[y].append(c_case)
            
            ## CONTOURS GENERATION
            res = field.resolution
            base_pt = rg.Point3d(field.bbox.Min.X, field.bbox.Min.Y, field.bbox.Min.Z + z*res)
            
            
            for y in range(0, field.y_count-1):
                for x in range(0, field.x_count-1):
                    c_case = contour_cases[y][x]
                    c_shape = contour_lookup[c_case]
                    if c_shape != -1:
                        for shape in c_shape:
                            c_start = rg.Point3d(base_pt.X + x*res + res*shape[0][0], base_pt.Y + y*res + res*shape[0][1], base_pt.Z)
                            c_end = rg.Point3d(base_pt.X + x*res + res*shape[1][0], base_pt.Y + y*res + res*shape[1][1], base_pt.Z)
                            contour = rg.Line(c_start, c_end).ToNurbsCurve()
                            contours.append(contour)
        
        #YZ Plane contouring
        elif plane == 1:
            ## THRESHOLDING
            x = int(math.floor(field.x_count*t))
            if x == field.x_count:
                x -= 1
            
            for z in range(field.z_count):
                binary_matrix.append([])
                for y in range(field.y_count):
                    if field.vals[z][y][x] < iso:
                        binary_matrix[z].append("0")
                    else:
                        binary_matrix[z].append("1")
            
            ## CASES DEFINITION
            for z in range(0, field.z_count-1):
                contour_cases.append([])
                for y in range(0, field.y_count-1):
                    c_case = ""
                    c_case += binary_matrix[z][y]
                    c_case += binary_matrix[z][y+1]
                    c_case += binary_matrix[z+1][y+1]
                    c_case += binary_matrix[z+1][y]
                    contour_cases[z].append(c_case)
            
            ## CONTOURS GENERATION
            res = field.resolution
            base_pt = rg.Point3d(field.bbox.Min.X + x*res, field.bbox.Min.Y, field.bbox.Min.Z)
            
            for z in range(0, field.z_count-1):
                for y in range(0, field.y_count-1):
                    c_case = contour_cases[z][y]
                    c_shape = contour_lookup[c_case]
                    if c_shape != -1:
                        for shape in c_shape:
                            c_start = rg.Point3d(base_pt.X, base_pt.Y + y*res + res*shape[0][0], base_pt.Z + z*res + res*shape[0][1])
                            c_end = rg.Point3d(base_pt.X, base_pt.Y + y*res + res*shape[1][0], base_pt.Z+ z*res + res*shape[1][1])
                            contour = rg.Line(c_start, c_end).ToNurbsCurve()
                            contours.append(contour)
        
        #XZ Plane contouring
        elif plane == 2:
            ## THRESHOLDING
            y = int(math.floor(field.y_count*t))
            if y == field.y_count:
                y -= 1
            
            for z in range(field.z_count):
                binary_matrix.append([])
                for x in range(field.x_count):
                    if field.vals[z][y][x] < iso:
                        binary_matrix[z].append("0")
                    else:
                        binary_matrix[z].append("1")
            
            ## CASES DEFINITION
            for z in range(0, field.z_count-1):
                contour_cases.append([])
                for x in range(0, field.x_count-1):
                    c_case = ""
                    c_case += binary_matrix[z][x]
                    c_case += binary_matrix[z][x+1]
                    c_case += binary_matrix[z+1][x+1]
                    c_case += binary_matrix[z+1][x]
                    contour_cases[z].append(c_case)
            
            ## CONTOURS GENERATION
            res = field.resolution
            base_pt = rg.Point3d(field.bbox.Min.X, field.bbox.Min.Y + y*res, field.bbox.Min.Z)
            
            for z in range(0, field.z_count-1):
                for x in range(0, field.x_count-1):
                    c_case = contour_cases[z][x]
                    c_shape = contour_lookup[c_case]
                    if c_shape != -1:
                        for shape in c_shape:
                            c_start = rg.Point3d(base_pt.X + x*res + res*shape[0][0], base_pt.Y, base_pt.Z + z*res + res*shape[0][1])
                            c_end = rg.Point3d(base_pt.X + x*res + res*shape[1][0], base_pt.Y, base_pt.Z  + z*res + res*shape[1][1])
                            contour = rg.Line(c_start, c_end).ToNurbsCurve()
                            contours.append(contour)
        
        return rg.Curve.JoinCurves(contours)
    else:
        return -1

result = main(FIELD, PLN, T, ISO)

if result != -1:
    CRV = result
# ---------- end fieldiso ----------
preview_2 = CustomPreview(Geometry=defield.PTS, Shader=gradient)

# ----
# 4. Aggregate!
# Field Aggregation adds at every step one part that is the closest to
# the highest reachable value point in the field. If COLL is set to True,
# collisions between parts are avoided. The component adds parts additively
# over the already aggregated parts. If a new aggregation has to be created,
# the RESET button allows to reset the aggregation and restart.
# 
# NEW: the THRES input allows to set a threshold value for the aggregation,
# which allows to define what is an acceptable value in the field for placing a part.
# Lower threshold values increase speed, but lead to a less accurate
# field reconstruction.
parts_num = Slider(1750, range=0..5000)
reset = Button()
fieldaggregation = Wasp_FieldDrivenAggregation(PART=flatten(part), N=parts_num, RULES=ruletxt, FIELD=field, RESET=reset)  # -> AGGR, PART_OUT; inputs PART: list, PREV: list, N: Int32, RULES: list, FIELD: list, MODE: Int32, GC: list, RESET: Boolean
# ---------- fieldaggregation: Python ----------
# Wasp: Discrete Design with Grasshopper plug-in (GPL) initiated by Andrea Rossi
# 
# This file is part of Wasp.
# 
# Copyright (c) 2017, Andrea Rossi <a.rossi.andrea@gmail.com>
# Wasp is free software; you can redistribute it and/or modify 
# it under the terms of the GNU General Public License as published 
# by the Free Software Foundation; either version 3 of the License, 
# or (at your option) any later version. 
# 
# Wasp is distributed in the hope that it will be useful,
# but WITHOUT ANY WARRANTY; without even the implied warranty of 
# MERCHANTABILITY or FITNESS FOR A PARTICULAR PURPOSE. See the 
# GNU General Public License for more details.
# 
# You should have received a copy of the GNU General Public License
# along with Wasp; If not, see <http://www.gnu.org/licenses/>.
# 
# @license GPL-3.0 <https://www.gnu.org/licenses/gpl.html>
#
# Significant parts of Wasp have been developed by Andrea Rossi
# as part of research on digital materials and discrete design at:
# DDU Digital Design Unit - Prof. Oliver Tessmann
# Technische Universität Darmstadt


#########################################################################
##                            COMPONENT INFO                           ##
#########################################################################

"""
Aggregate the given parts according to a given scalar field. New parts are added following higher values in the field.
The component works additively, hence increasing the number of parts in an aggregation just adds new parts on the existing ones, without triggering recomputing of the previous element
-
Provided by Wasp 0.3
    Args:
        PART: Parts to be aggregated (can be more than one)
        PREV: OPTIONAL // Previous aggregated parts. It is possible to input the results of a previous aggregation, or parts transformed with the TransformPart component
        N: Number of parts to be aggregated (does not count parts provided in PREV)
        RULES: Rules for the aggregation
        FIELD: Scalar field to drive the aggregation (parts will be added following higher values in the field)
        THRES: OPTIONAL // If set, used to define a threshold value above which the placement of next part is accepted. If not set, aggregation will look for part with highest value in the whole field. Setting a low threshold helds less accurate results, but highly speeds up calculations
        COLL: OPTIONAL // Collision detection. By default is active and checks for collisions between the aggregated parts
        MODE: OPTIONAL // Switches between aggregation modes: 0 = no constraints, 1 = local constraints, 2 = global constraints, 3 = local + global constraints
        GC: OPTIONAL // Global constraints to apply to aggregation
        ID: OPTIONAL // Aggregation ID
        RESET: Recompute the whole aggregation
    Returns:
        AGGR: Aggregation object
        PART_OUT: Aggregated parts (includes both PREV input and newly aggregated parts)
"""

ghenv.Component.Name = "Wasp_Field-driven Aggregation"
ghenv.Component.NickName = 'FieldAggregation'
ghenv.Component.Message = "VER 0.3.002"
ghenv.Component.IconDisplayMode = ghenv.Component.IconDisplayMode.application
ghenv.Component.Category = "Wasp"
ghenv.Component.SubCategory = "4 | Aggregation"
try: ghenv.Component.AdditionalHelpFromDocStrings = "2"
except: pass


import sys
import Rhino.Geometry as rg
import Grasshopper as gh


## add Wasp install directory to system path
wasp_loaded = False
ghcompfolder = gh.Folders.DefaultAssemblyFolder
if ghcompfolder not in sys.path:
    sys.path.append(ghcompfolder)
try:
    from wasp import __version__
    wasp_loaded = True
except:
    msg = "Cannot import Wasp. Is the wasp folder available in " + ghcompfolder + "?"
    ghenv.Component.AddRuntimeMessage(gh.Kernel.GH_RuntimeMessageLevel.Error, msg)

## if Wasp is installed correctly, load the classes required by the component
if wasp_loaded:
    from wasp import Aggregation


## Main code execution
def main(parts, previous_parts, num_parts, rules, aggregation_mode, global_constraints, aggregation_id, reset, fields, aggregation):
    
    check_data = True
    ##check inputs
    if len(parts) == 0:
        check_data = False
        msg = "No parts provided"
        ghenv.Component.AddRuntimeMessage(gh.Kernel.GH_RuntimeMessageLevel.Warning, msg)
    
    if num_parts is None:
        check_data = False
        msg = "Provide number of aggregation iterations"
        ghenv.Component.AddRuntimeMessage(gh.Kernel.GH_RuntimeMessageLevel.Warning, msg)
    else:
        if len(previous_parts) != 0:
            num_parts += len(previous_parts)
    
    if len(rules) == 0:
        check_data = False
        msg = "No rules provided"
        ghenv.Component.AddRuntimeMessage(gh.Kernel.GH_RuntimeMessageLevel.Warning, msg)
    
    if aggregation_mode is None:
        aggregation_mode = 0
    
    if aggregation_id is None:
        aggregation_id = 'myFieldAggregation'
    
    if reset is None:
        reset = False
    
    if len(fields) == 0:
        check_data = False
        msg = "Provide a valid scalar field"
        ghenv.Component.AddRuntimeMessage(gh.Kernel.GH_RuntimeMessageLevel.Warning, msg)
    elif len(fields) > 1:
        field_names = [f.name for f in fields]
        for part in parts:
            if part.field is None:
                part.field = fields[0].name
                
            elif part.field not in field_names:
                check_data = False
                msg = "Part " + part.name + " does not have a vaild field name assigned."
                ghenv.Component.AddRuntimeMessage(gh.Kernel.GH_RuntimeMessageLevel.Warning, msg)
    
    if check_data:
        
        ## create aggregation in sticky dict
        if aggregation is None or aggregation == -1 or reset:
            
            ## copy parts to avoid editing the original parts
            parts_copy = []
            for part in parts:
                parts_copy.append(part.copy())
            
            aggregation = Aggregation(aggregation_id, parts_copy, rules, aggregation_mode, _prev = previous_parts, _global_constraints = global_constraints, _field = fields)
        
        ## handle parameters changes
        part_rules_change = False
        #### parts
        if parts != aggregation.parts.values():
            
            ## copy parts to avoid editing the original parts
            parts_copy = []
            for part in parts:
                parts_copy.append(part.copy())
            
            aggregation.reset_base_parts(new_parts = parts_copy)
            aggregation.reset_rules(aggregation.rules)
            part_rules_change = True
        
        #### rules
        if rules != aggregation.rules:
            aggregation.rules = rules
            aggregation.reset_base_parts()
            aggregation.reset_rules(aggregation.rules)
            part_rules_change = True
        
        if part_rules_change:
            aggregation.recompute_aggregation_queue()
        
        #### mode
        if aggregation_mode != aggregation.mode:
            aggregation.mode = aggregation_mode
            aggregation.reset_rules(aggregation.rules)
            aggregation.recompute_aggregation_queue()
        
        #### constraints
        if global_constraints != aggregation.global_constraints:
            aggregation.global_constraints = global_constraints
            aggregation.reset_rules(aggregation.rules)
            aggregation.recompute_aggregation_queue()
        
        ## field (TO DO)
        ##################################
        
        ## add parts to aggregation
        if num_parts > len(aggregation.aggregated_parts):
            #sc.sticky[aggregation_id].aggregate_field(num_parts-sc.sticky[aggregation_id].p_count, field, threshold)
            error_msg = aggregation.aggregate_field(num_parts-len(aggregation.aggregated_parts))
            if error_msg is not None:
                ghenv.Component.AddRuntimeMessage(gh.Kernel.GH_RuntimeMessageLevel.Warning, error_msg)
        
        ## remove parts from aggregation
        elif num_parts < len(aggregation.aggregated_parts):
            aggregation.remove_elements(num_parts)
        
        ## return result
        return aggregation
        
    else:
        return -1

## create aggregation container in global variables dict
if 'aggregation_container' not in globals():
    aggregation_container = None

result = main(PART, PREV, N, RULES, MODE, GC, ID, RESET, FIELD, aggregation_container)

if result != -1:
    aggregation_container = result
    
    AGGR = aggregation_container
    PART_OUT = aggregation_container.aggregated_parts
# ---------- end fieldaggregation ----------

# ----
# 5. Extract Data and Visualize
# Aggregated parts can be exploded in order to access
# the data stored in each part, such as the part geometry
# for visualization purposes.
partgeo = Wasp_GetPartGeometry(PART=fieldaggregation.PART_OUT)  # -> GEO
# ---------- partgeo: Python ----------
# Wasp: Discrete Design with Grasshopper plug-in (GPL) initiated by Andrea Rossi
# 
# This file is part of Wasp.
# 
# Copyright (c) 2017, Andrea Rossi <a.rossi.andrea@gmail.com>
# Wasp is free software; you can redistribute it and/or modify 
# it under the terms of the GNU General Public License as published 
# by the Free Software Foundation; either version 3 of the License, 
# or (at your option) any later version. 
# 
# Wasp is distributed in the hope that it will be useful,
# but WITHOUT ANY WARRANTY; without even the implied warranty of 
# MERCHANTABILITY or FITNESS FOR A PARTICULAR PURPOSE. See the 
# GNU General Public License for more details.
# 
# You should have received a copy of the GNU General Public License
# along with Wasp; If not, see <http://www.gnu.org/licenses/>.
# 
# @license GPL-3.0 <https://www.gnu.org/licenses/gpl.html>
#
# Significant parts of Wasp have been developed by Andrea Rossi
# as part of research on digital materials and discrete design at:
# DDU Digital Design Unit - Prof. Oliver Tessmann
# Technische Universität Darmstadt


#########################################################################
##                            COMPONENT INFO                           ##
#########################################################################

"""
Extract the geometry of one part (for visualization or further processing).
-
Provided by Wasp 0.3
    Args:
        PART: Part from where to extract the geometry
    Returns:
        GEO: Part geometry
"""

ghenv.Component.Name = "Wasp_Get Part Geometry"
ghenv.Component.NickName = 'PartGeo'
ghenv.Component.Message = 'VER 0.3.002'
ghenv.Component.IconDisplayMode = ghenv.Component.IconDisplayMode.application
ghenv.Component.Category = "Wasp"
ghenv.Component.SubCategory = "2 | Parts"
try: ghenv.Component.AdditionalHelpFromDocStrings = "3"
except: pass


import sys
import Rhino.Geometry as rg
import Grasshopper as gh


## add Wasp install directory to system path
wasp_loaded = False
ghcompfolder = gh.Folders.DefaultAssemblyFolder
if ghcompfolder not in sys.path:
    sys.path.append(ghcompfolder)
try:
    from wasp import __version__
    wasp_loaded = True
except:
    msg = "Cannot import Wasp. Is the wasp folder available in " + ghcompfolder + "?"
    ghenv.Component.AddRuntimeMessage(gh.Kernel.GH_RuntimeMessageLevel.Error, msg)

## if Wasp is installed correctly, load the classes required by the component
if wasp_loaded:
    pass


def main(part):
        
    check_data = True
    
    ## check inputs
    if part is None:
        check_data = False
        msg = "No or null part provided"
        ghenv.Component.AddRuntimeMessage(gh.Kernel.GH_RuntimeMessageLevel.Warning, msg)
    
    ## execute main code if all needed inputs are available
    if check_data:
        return part.geo
    else:
        return -1

result = main(PART)

if result != -1:
    GEO = result
# ---------- end partgeo ----------
preview_3 = CustomPreview(Geometry=partgeo, Material=ColourSwatch(SwatchColor=RGB(255, 225, 0)))
