# Grasshopper definition 02_Multi_Part_Aggregation.gh (Grasshopper 1.0.7)

# ----
# 1. Build Part
# Parts are the building blocks of Wasp.
# The most basic way of initializing a part is to define t he geometry (as brep or mesh),
# and the connection faces (center and orientation - with a line). Parts must be named
# to be identifyed in the aggregation rules.
connections_centers = Point([<point referenced from the Rhino model> x9])
connections_centers_2 = Point([<point referenced from the Rhino model> x4])
connections_x_axis = Curve([<curve referenced from the Rhino model> x9])
part_geometry = Brep(<brep referenced from the Rhino model>)
connections_x_axis_2 = Curve([<curve referenced from the Rhino model> x4])
# # Wasp: Discrete Design with Grasshopper plug-in (GPL) initiated by Andrea Rossi
# 
# 
# This file is part of Wasp.
# 
# Copyright (c) 2017, Andrea Rossi <a.rossi.andrea@gmail.com>
# 
# Wasp is free software; you can redistribute it and/or modify it under the terms of the GNU General Public License as published by the Free Software Foundation; either version 3 of the License, or (at your option) any later version.
# 
# Wasp is distributed in the hope that it will be useful, but WITHOUT ANY WARRANTY; without even the implied warranty of MERCHANTABILITY or FITNESS FOR A PARTICULAR PURPOSE. See the GNU General Public License for more details. You should have received a copy of the GNU General Public License
#  along with Wasp; If not, see <http://www.gnu.org/licenses/>.
# 
# license GPL-3.0 <https://www.gnu.org/licenses/gpl.html>
# 
# Significant parts of Wasp have been developed by Andrea Rossi as part of research on digital materials and discrete design at DDU Digital Design Unit - Prof. Oliver Tessmann - Technische Universität Darmstadt
# EXAMPLE_02: Multiple Part Types Aggregation
part_geometry_2 = Brep(<brep referenced from the Rhino model>)
conndir = Wasp_ConnectionFromDirection(GEO=part_geometry, CEN=connections_centers, UP=connections_x_axis)  # -> CONN, PLN_OUT; inputs GEO: Brep, CEN: list of Point3d, UP: list of Curve, T: list
# ---------- conndir: Python ----------
# Wasp: Discrete Design with Grasshopper plug-in (GPL) initiated by Andrea Rossi
# 
# This file is part of Wasp.
# 
# Copyright (c) 2017, Andrea Rossi <a.rossi.andrea@gmail.com>
# Wasp is free software; you can redistribute it and/or modify 
# it under the terms of the GNU General Public License as published 
# by the Free Software Foundation; either version 3 of the License, 
# or (at your option) any later version. 
# 
# Wasp is distributed in the hope that it will be useful,
# but WITHOUT ANY WARRANTY; without even the implied warranty of 
# MERCHANTABILITY or FITNESS FOR A PARTICULAR PURPOSE. See the 
# GNU General Public License for more details.
# 
# You should have received a copy of the GNU General Public License
# along with Wasp; If not, see <http://www.gnu.org/licenses/>.
# 
# @license GPL-3.0 <https://www.gnu.org/licenses/gpl.html>
#
# Significant parts of Wasp have been developed by Andrea Rossi
# as part of research on digital materials and discrete design at:
# DDU Digital Design Unit - Prof. Oliver Tessmann
# Technische Universität Darmstadt


#########################################################################
##                            COMPONENT INFO                           ##
#########################################################################

"""
Create a connection on a given part geometry from center and X-asix direction
(Z direction is determined based on the normals of the component geometry)
-
Provided by Wasp 0.1.0
    Args:
        GEO: Geometry of the part to which the connection belongs
        CEN: Origin of the connection plane
        UP: Line idetifying the X-axis of the connection plane - determines the plane orientation to mantain when transforming
        T: OPTIONAL // Connection type (to be used with Rule Generator component)
    Returns:
        CONN: Connection object
        PLN_OUT: Plane for each connection object (for debugging)
"""

ghenv.Component.Name = "Wasp_Connection From Direction"
ghenv.Component.NickName = 'ConnDir'
ghenv.Component.Message = 'VER 0.2.1'
ghenv.Component.IconDisplayMode = ghenv.Component.IconDisplayMode.application
ghenv.Component.Category = "Wasp"
ghenv.Component.SubCategory = "1 | Elements"
try: ghenv.Component.AdditionalHelpFromDocStrings = "1"
except: pass


import sys
import scriptcontext as sc
import Rhino.Geometry as rg
import Grasshopper as gh

## add Wasp install directory to system path
ghcompfolder = gh.Folders.DefaultAssemblyFolder
wasp_path = ghcompfolder + "Wasp"
if wasp_path not in sys.path:
    sys.path.append(wasp_path)
try:
    import wasp
except:
    msg = "Cannot import Wasp. Is the wasp.py module installed in " + wasp_path + "?"
    ghenv.Component.AddRuntimeMessage(gh.Kernel.GH_RuntimeMessageLevel.Error, msg)


def main(part_geo, conn_centers, conn_ups, conn_type):
        
    check_data = True
    
    ## check inputs
    if part_geo is None:
        check_data = False
        msg = "No part geometry provided"
        ghenv.Component.AddRuntimeMessage(gh.Kernel.GH_RuntimeMessageLevel.Warning, msg)
    
    if len(conn_centers) != len(conn_ups):
        check_data = False
        msg = "Different amount of centers and up vectors provided"
        ghenv.Component.AddRuntimeMessage(gh.Kernel.GH_RuntimeMessageLevel.Error, msg)
    
    types = []
    if len(conn_type) == 0:
        for i in range(len(conn_centers)):
            types.append("0")
    elif len(conn_type) == 1:
        for i in range(len(conn_centers)):
            types.append(conn_type[0])
    elif len(conn_centers) != len(conn_type):
        check_data = False
        msg = "Different amount of centers and types provided"
        ghenv.Component.AddRuntimeMessage(gh.Kernel.GH_RuntimeMessageLevel.Error, msg)
    else:
        for i in range(len(conn_centers)):
            types.append(conn_type[i])
    
    ## execute main code if all needed inputs are available
    if check_data:
        connections = []
        out_planes = []
        for i in range(len(conn_centers)):
            
            center = conn_centers[i]
            up = conn_ups[i]
            plane = None
            
            up_start = rg.Vector3d(up.PointAtStart)
            up_end = rg.Vector3d(up.PointAtEnd)
            up_vec = rg.Vector3d.Subtract(up_end, up_start)
            
            for face in GEO.Faces:
                pt_uv = face.ClosestPoint(center)
                pt = face.PointAt(pt_uv[1], pt_uv[2])
                dist = rg.Point3d.DistanceTo(center, pt)
                if(dist < wasp.global_tolerance):
                    normal = face.NormalAt(pt_uv[1], pt_uv[2])
                    plane = rg.Plane(center, normal)
                    x_axis = plane.XAxis
                    angle = rg.Vector3d.VectorAngle(x_axis, up_vec, plane)
                    plane.Rotate(angle, normal)
                    break
                    
            if plane is None:
                msg = "No valid plane provided for connection %d"%(i)
                ghenv.Component.AddRuntimeMessage(gh.Kernel.GH_RuntimeMessageLevel.Error, msg)
            else:
                conn = wasp.Connection(plane, types[i], "", -1)
                connections.append(conn)
                out_planes.append(plane)
        
        return connections, out_planes
    
    else:
        return -1

result = main(GEO, CEN, UP, T)

if result != -1:
    CONN = result[0]
    PLN_OUT = result[1]
# ---------- end conndir ----------
conndir_2 = Wasp_ConnectionFromDirection(GEO=part_geometry_2, CEN=connections_centers_2, UP=connections_x_axis_2)  # -> CONN, PLN_OUT; inputs GEO: Brep, CEN: list of Point3d, UP: list of Curve, T: list; same code as conndir
points = PointList(Points=connections_centers, Size=Slider(2, range=0..10))
points_2 = PointList(Points=connections_centers_2, Size=Slider(2, range=0..10))
part_name = Panel("T")
part_name_2 = Panel("P")
part = Wasp_BasicPart(NAME=part_name, GEO=part_geometry_2, CONN=flatten(conndir_2.CONN))  # -> PART; inputs GEO: Mesh, CONN: list, COLL: Mesh, ATTR: list
# ---------- part: Python ----------
# Wasp: Discrete Design with Grasshopper plug-in (GPL) initiated by Andrea Rossi
# 
# This file is part of Wasp.
# 
# Copyright (c) 2017, Andrea Rossi <a.rossi.andrea@gmail.com>
# Wasp is free software; you can redistribute it and/or modify 
# it under the terms of the GNU General Public License as published 
# by the Free Software Foundation; either version 3 of the License, 
# or (at your option) any later version. 
# 
# Wasp is distributed in the hope that it will be useful,
# but WITHOUT ANY WARRANTY; without even the implied warranty of 
# MERCHANTABILITY or FITNESS FOR A PARTICULAR PURPOSE. See the 
# GNU General Public License for more details.
# 
# You should have received a copy of the GNU General Public License
# along with Wasp; If not, see <http://www.gnu.org/licenses/>.
# 
# @license GPL-3.0 <https://www.gnu.org/licenses/gpl.html>
#
# Significant parts of Wasp have been developed by Andrea Rossi
# as part of research on digital materials and discrete design at:
# DDU Digital Design Unit - Prof. Oliver Tessmann
# Technische Universität Darmstadt


#########################################################################
##                            COMPONENT INFO                           ##
#########################################################################

"""
Create a basic Wasp Part to be used for aggregation
-
Provided by Wasp 0.1.0
    Args:
        NAME: Part name
        GEO: Part geometry. It will be converted to mesh - to improve performance, perform the conversion before adding to the part and user a low-poly count
        CONN: Connections list
        COLL: OPTIONAL // Collider geometry (for collision detection). A collider will be automatically generated. For complex parts, automatic generation might not work, and you can add a custom collider geometry here.
        ATTR: OPTIONAL // Part attributes
    Returns:
        PART: Part instance
"""

ghenv.Component.Name = "Wasp_Basic Part"
ghenv.Component.NickName = 'Part'
ghenv.Component.Message = 'VER 0.2.1'
ghenv.Component.IconDisplayMode = ghenv.Component.IconDisplayMode.application
ghenv.Component.Category = "Wasp"
ghenv.Component.SubCategory = "2 | Parts"
try: ghenv.Component.AdditionalHelpFromDocStrings = "3"
except: pass

import sys
import scriptcontext as sc
import Rhino.Geometry as rg
import Grasshopper as gh

## add Wasp install directory to system path
ghcompfolder = gh.Folders.DefaultAssemblyFolder
wasp_path = ghcompfolder + "Wasp"
if wasp_path not in sys.path:
    sys.path.append(wasp_path)
try:
    import wasp
except:
    msg = "Cannot import Wasp. Is the wasp.py module installed in " + wasp_path + "?"
    ghenv.Component.AddRuntimeMessage(gh.Kernel.GH_RuntimeMessageLevel.Error, msg)


def main(part_name, part_geo, connections, collider_geo, attributes):
    
    check_data = True
    
    ## check inputs
    if part_name is None:
        check_data = False
        msg = "No part name provided"
        ghenv.Component.AddRuntimeMessage(gh.Kernel.GH_RuntimeMessageLevel.Warning, msg)
    
    if part_geo is None:
        check_data = False
        msg = "No part geometry provided"
        ghenv.Component.AddRuntimeMessage(gh.Kernel.GH_RuntimeMessageLevel.Warning, msg)
        check_data = False
    
    if collider_geo is None and part_geo is not None:
        collider_geo = part_geo.Duplicate().Offset(wasp.global_tolerance)
        collider_intersection = rg.Intersect.Intersection.MeshMeshFast(collider_geo, part_geo)
        if len(collider_intersection) > 0:
            collider_geo = None
            collider_geo = part_geo.Duplicate()
            center = part_geo.GetBoundingBox(True).Center
            scale_plane = rg.Plane(center, rg.Vector3d(1,0,0), rg.Vector3d(0,1,0))
            scale_transform = rg.Transform.Scale(scale_plane, 1-wasp.global_tolerance, 1-wasp.global_tolerance, 1-wasp.global_tolerance)
            collider_geo.Transform(scale_transform)
            collider_intersection = rg.Intersect.Intersection.MeshMeshFast(collider_geo, part_geo)
            if len(collider_intersection) > 0:
                collider_geo = None
                msg = "Could not compute a valid collider geometry. Please provide a valid collider in the COLL input."
                ghenv.Component.AddRuntimeMessage(gh.Kernel.GH_RuntimeMessageLevel.Error, msg)
                check_data = False
    
    if collider_geo is not None and collider_geo.Faces.Count > 1000:
        msg = "The computed collider has a high faces count. Consider providing a low poly collider to improve performance"
        ghenv.Component.AddRuntimeMessage(gh.Kernel.GH_RuntimeMessageLevel.Warning, msg)
    
    
    if check_data:
        ## create collider
        collider = wasp.Collider([collider_geo])
        
        new_part = wasp.Part(part_name, part_geo, connections, collider, attributes)
        return new_part
    else:
        return -1


result = main(NAME, GEO, CONN, COLL, ATTR)

if result != -1:
    PART = result
# ---------- end part ----------
part_2 = Wasp_BasicPart(NAME=part_name_2, GEO=part_geometry, CONN=flatten(conndir.CONN))  # -> PART; inputs GEO: Mesh, CONN: list, COLL: Mesh, ATTR: list; same code as part

# ----
# 2. Define aggregation rules
# Rules can be defined ina compact way
# with a text string in the format:
# "Part1|Connection1_Part2|Connection2"
t_p = Panel("""T|2_P|1
T|3_P|0""")
p_p = Panel("""P|2_P|6
P|5_P|6
P|3_P|7
P|8_P|2
P|4_P|3""")
p_t = Panel("""P|0_T|0
P|1_T|1""")
ruletxt = Wasp_RuleFromText(TXT=p_p)  # -> R
# ---------- ruletxt: Python ----------
# Wasp: Discrete Design with Grasshopper plug-in (GPL) initiated by Andrea Rossi
# 
# This file is part of Wasp.
# 
# Copyright (c) 2017, Andrea Rossi <a.rossi.andrea@gmail.com>
# Wasp is free software; you can redistribute it and/or modify 
# it under the terms of the GNU General Public License as published 
# by the Free Software Foundation; either version 3 of the License, 
# or (at your option) any later version. 
# 
# Wasp is distributed in the hope that it will be useful,
# but WITHOUT ANY WARRANTY; without even the implied warranty of 
# MERCHANTABILITY or FITNESS FOR A PARTICULAR PURPOSE. See the 
# GNU General Public License for more details.
# 
# You should have received a copy of the GNU General Public License
# along with Wasp; If not, see <http://www.gnu.org/licenses/>.
# 
# @license GPL-3.0 <https://www.gnu.org/licenses/gpl.html>
#
# Significant parts of Wasp have been developed by Andrea Rossi
# as part of research on digital materials and discrete design at:
# DDU Digital Design Unit - Prof. Oliver Tessmann
# Technische Universität Darmstadt


#########################################################################
##                            COMPONENT INFO                           ##
#########################################################################

"""
Generate an aggregation rule from a text string description
-
Provided by Wasp 0.1.0
    Args:
        TXT: Text description of the rule with format "Part1|Conn1_Part2|Conn2"
    Returns:
        R: Rule
"""

ghenv.Component.Name = "Wasp_Rule From Text"
ghenv.Component.NickName = 'RuleTxt'
ghenv.Component.Message = 'VER 0.2.1'
ghenv.Component.IconDisplayMode = ghenv.Component.IconDisplayMode.application
ghenv.Component.Category = "Wasp"
ghenv.Component.SubCategory = "3 | Rules"
try: ghenv.Component.AdditionalHelpFromDocStrings = "2"
except: pass

import sys
import scriptcontext as sc
import Grasshopper as gh

## add Wasp install directory to system path
ghcompfolder = gh.Folders.DefaultAssemblyFolder
wasp_path = ghcompfolder + "Wasp"
if wasp_path not in sys.path:
    sys.path.append(wasp_path)
try:
    import wasp
except:
    msg = "Cannot import Wasp. Is the wasp.py module installed in " + wasp_path + "?"
    ghenv.Component.AddRuntimeMessage(gh.Kernel.GH_RuntimeMessageLevel.Error, msg)



def main(text):
    
    check_data = True
    
    ##check inputs
    if text is None:
        check_data = False
        msg = "No text provided"
        ghenv.Component.AddRuntimeMessage(gh.Kernel.GH_RuntimeMessageLevel.Warning, msg)
    
    if check_data:
        
        try:
            rule_parts = text.split("_")
            part1 = str(rule_parts[0].split("|")[0])
            conn1 = int(rule_parts[0].split("|")[1])
            part2 = str(rule_parts[1].split("|")[0])
            conn2 = int(rule_parts[1].split("|")[1])
            
            rule = wasp.Rule(part1, conn1, part2, conn2)
            return rule
        except:
            msg = "Text string %s is not formatted correctly"%(text)
            ghenv.Component.AddRuntimeMessage(gh.Kernel.GH_RuntimeMessageLevel.Error, msg)
            return -1
    else:
        return -1


result = main(TXT)

if result != -1:
    R = result
# ---------- end ruletxt ----------
ruletxt_2 = Wasp_RuleFromText(TXT=p_t)  # -> R; same code as ruletxt
ruletxt_3 = Wasp_RuleFromText(TXT=t_p)  # -> R; same code as ruletxt
merge = Merge(Data1=flatten(ruletxt))

merge_2 = Merge(Data1=part, Data2=part_2)

# ----
# 3. Aggregate!
# Stochastic Aggregation builds an aggregation by randomly selecting one part
# and one rule to be applied at every step. If COLL is set to True,
# collisions between parts are avoided. The component adds parts additively
# over the already aggregated parts. If a new aggregation has to be created,
# the RESET button allows to reset the aggregation and restart.
parts_num = Slider(100, range=0..1000)
reset = Button()
rndaggr = Wasp_StochasticAggregation(PART=flatten(merge_2), N=parts_num, RULES=merge, RESET=reset)  # -> AGGR, PART_OUT; inputs PART: list, PREV: list, N: Int32, RULES: list, MODE: Int32, GC: list, RESET: Boolean
# ---------- rndaggr: Python ----------
# Wasp: Discrete Design with Grasshopper plug-in (GPL) initiated by Andrea Rossi
# 
# This file is part of Wasp.
# 
# Copyright (c) 2017, Andrea Rossi <a.rossi.andrea@gmail.com>
# Wasp is free software; you can redistribute it and/or modify 
# it under the terms of the GNU General Public License as published 
# by the Free Software Foundation; either version 3 of the License, 
# or (at your option) any later version. 
# 
# Wasp is distributed in the hope that it will be useful,
# but WITHOUT ANY WARRANTY; without even the implied warranty of 
# MERCHANTABILITY or FITNESS FOR A PARTICULAR PURPOSE. See the 
# GNU General Public License for more details.
# 
# You should have received a copy of the GNU General Public License
# along with Wasp; If not, see <http://www.gnu.org/licenses/>.
# 
# @license GPL-3.0 <https://www.gnu.org/licenses/gpl.html>
#
# Significant parts of Wasp have been developed by Andrea Rossi
# as part of research on digital materials and discrete design at:
# DDU Digital Design Unit - Prof. Oliver Tessmann
# Technische Universität Darmstadt


#########################################################################
##                            COMPONENT INFO                           ##
#########################################################################

"""
Aggregate the given parts in a stochastic process, selecting parts and rules randomly at every step.
The component works additively, hence increasing the number of parts in an aggregation just adds new parts on the existing ones, without triggering recomputing of the previous element.
-
Provided by Wasp 0.1.0
    Args:
        PART: Parts to be aggregated (can be more than one)
        PREV: Previous aggregated parts. It is possible to input the results of a previous aggregation, or parts transformed with the TransformPart component
        N: Number of parts to be aggregated (does not count parts provided in PREV)
        RULES: Rules for the aggregation
        COLL: OPTIONAL // Collision detection. By default is active and checks for collisions between the aggregated parts
        MODE: OPTIONAL // Switches between aggregation modes: 0 = Basic (Default: only parts collision check), 1 = Constrained (checks all constraints set on the part)
        GC: Global constraints to apply to aggregation
        ID: OPTIONAL // Aggregation ID (to avoid overwriting when having different aggregation components in the same file)
        RESET: Recompute the whole aggregation
    Returns:
        PART_OUT: Aggregated parts (includes both PREV input and newly aggregated parts)
"""

ghenv.Component.Name = "Wasp_Stochastic Aggregation"
ghenv.Component.NickName = 'RndAggr'
ghenv.Component.Message = 'VER 0.2.1'
ghenv.Component.IconDisplayMode = ghenv.Component.IconDisplayMode.application
ghenv.Component.Category = "Wasp"
ghenv.Component.SubCategory = "4 | Aggregation"
try: ghenv.Component.AdditionalHelpFromDocStrings = "2"
except: pass

import sys
import scriptcontext as sc
import Rhino.Geometry as rg
import Grasshopper as gh
import random as rnd

## add Wasp install directory to system path
ghcompfolder = gh.Folders.DefaultAssemblyFolder
wasp_path = ghcompfolder + "Wasp"
if wasp_path not in sys.path:
    sys.path.append(wasp_path)
try:
    import wasp
except:
    msg = "Cannot import Wasp. Is the wasp.py module installed in " + wasp_path + "?"
    ghenv.Component.AddRuntimeMessage(gh.Kernel.GH_RuntimeMessageLevel.Error, msg)


def main(parts, previous_parts, num_parts, rules, aggregation_mode, global_constraints, aggregation_id, reset):
    
    check_data = True
    
    ##check inputs
    if len(parts) == 0:
        check_data = False
        msg = "No parts provided"
        ghenv.Component.AddRuntimeMessage(gh.Kernel.GH_RuntimeMessageLevel.Warning, msg)
    
    if num_parts is None:
        check_data = False
        msg = "Provide number of aggregation iterations"
        ghenv.Component.AddRuntimeMessage(gh.Kernel.GH_RuntimeMessageLevel.Warning, msg)
    else:
        if len(previous_parts) != 0:
            num_parts += len(previous_parts)
    
    if len(rules) == 0:
        check_data = False
        msg = "No rules provided"
        ghenv.Component.AddRuntimeMessage(gh.Kernel.GH_RuntimeMessageLevel.Warning, msg)
    
    if aggregation_mode is None:
        aggregation_mode = 0
    
    if aggregation_id is None:
        aggregation_id = 'myAggregation'
        msg = "Default name 'myAggregation' assigned"
        ghenv.Component.AddRuntimeMessage(gh.Kernel.GH_RuntimeMessageLevel.Remark, msg)
    
    if reset is None:
        reset = False
    
    if check_data:
        ############################################## FIX: check rules directly from aggregation
        ## store rules in sticky dict
        if sc.sticky.has_key('rules') == False:
            sc.sticky['rules'] = rules
        
        ## if rules changed, reset parts and recompute rule tables
        if rules != sc.sticky['rules']:
            for part in parts:
                part.reset_part(rules)
            sc.sticky['rules'] = rules
            if sc.sticky.has_key(aggregation_id):
                sc.sticky[aggregation_id].reset_rules(rules)
        
        ## create aggregation in sticky dict
        if sc.sticky.has_key(aggregation_id) == False:
            sc.sticky[aggregation_id] = wasp.Aggregation(aggregation_id, parts, sc.sticky['rules'], aggregation_mode, _prev = previous_parts, _global_constraints = global_constraints)
        
        if reset:
            sc.sticky[aggregation_id] = wasp.Aggregation(aggregation_id, parts, sc.sticky['rules'], aggregation_mode, _prev = previous_parts, _global_constraints = global_constraints)
        
        if num_parts > sc.sticky[aggregation_id].p_count:
            sc.sticky[aggregation_id].aggregate_rnd(num_parts-sc.sticky[aggregation_id].p_count)
        
        elif num_parts < sc.sticky[aggregation_id].p_count:
            sc.sticky[aggregation_id].remove_elements(num_parts)
            
        return sc.sticky[aggregation_id]
        
    else:
        return -1

result = main(PART, PREV, N, RULES, MODE, GC, ID, RESET)

if result != -1:
    AGGR = result
    PART_OUT = result.aggregated_parts
# ---------- end rndaggr ----------

# ----
# 5. Extract Data and Visualize
# Aggregated parts can be exploded in order to access
# the data stored in each part, such as the part geometry
# for visualization purposes.
# By using the part name, it is possible to dispatch different
# part types and process them in different ways (eg. color).
depart = Wasp_DeconstructPart(PART=rndaggr.PART_OUT)  # -> NAME, ID, GEO, CONN, CONN_PLN, TR, PARENT, CHILD, ADD_COLL, ATTR; inputs PART: list
# ---------- depart: Python ----------
# Wasp: Discrete Design with Grasshopper plug-in (GPL) initiated by Andrea Rossi
# 
# This file is part of Wasp.
# 
# Copyright (c) 2017, Andrea Rossi <a.rossi.andrea@gmail.com>
# Wasp is free software; you can redistribute it and/or modify 
# it under the terms of the GNU General Public License as published 
# by the Free Software Foundation; either version 3 of the License, 
# or (at your option) any later version. 
# 
# Wasp is distributed in the hope that it will be useful,
# but WITHOUT ANY WARRANTY; without even the implied warranty of 
# MERCHANTABILITY or FITNESS FOR A PARTICULAR PURPOSE. See the 
# GNU General Public License for more details.
# 
# You should have received a copy of the GNU General Public License
# along with Wasp; If not, see <http://www.gnu.org/licenses/>.
# 
# @license GPL-3.0 <https://www.gnu.org/licenses/gpl.html>
#
# Significant parts of Wasp have been developed by Andrea Rossi
# as part of research on digital materials and discrete design at:
# DDU Digital Design Unit - Prof. Oliver Tessmann
# Technische Universität Darmstadt


#########################################################################
##                            COMPONENT INFO                           ##
#########################################################################

"""
Extract all information stored in a part. Useful for visualization or for further geometry processing
-
Provided by Wasp 0.1.0
    Args:
        PART: Parts to deconstruct
    Returns:
        NAME: Name of the part
        GEO: Geometry of the part (as mesh). If Brep geometry is needed, can be stored in the component as attribute, or obtained by transforming the original geometry with the TR output.
        CONN: Part connections
        CONN_PLN: planes for each part connection
        TR: Transformation applied to the part. Can be used to transform other geometries in a similar way (eg. replace a low poly component with a more detailed one)
        PARENT: Parent of the part
        CHILD: Children parts attached to the part
        ATTR: Part attributes
"""

ghenv.Component.Name = "Wasp_Deconstruct Part"
ghenv.Component.NickName = 'DePart'
ghenv.Component.Message = 'VER 0.2.1'
ghenv.Component.IconDisplayMode = ghenv.Component.IconDisplayMode.application
ghenv.Component.Category = "Wasp"
ghenv.Component.SubCategory = "2 | Parts"
try: ghenv.Component.AdditionalHelpFromDocStrings = "3"
except: pass

import sys
import scriptcontext as sc
import Grasshopper as gh

## add Wasp install directory to system path
ghcompfolder = gh.Folders.DefaultAssemblyFolder
wasp_path = ghcompfolder + "Wasp"
if wasp_path not in sys.path:
    sys.path.append(wasp_path)
try:
    import wasp
except:
    msg = "Cannot import Wasp. Is the wasp.py module installed in " + wasp_path + "?"
    ghenv.Component.AddRuntimeMessage(gh.Kernel.GH_RuntimeMessageLevel.Error, msg)


## from http://www.chenjingcheng.com/grasshopper-python-datatree-list-conversion/
def listToDataTree(list):
    rl = list
    result = gh.DataTree[object]()
    for i in range(len(rl)):
        temp = []
        for j in range(len(rl[i])):
            temp.append(rl[i][j])
        path = gh.Kernel.Data.GH_Path(i)
        result.AddRange(temp, path)
    return result


def main(parts):
    
    check_data = True
    
    ##check inputs
    if len(parts) == 0:
        check_data = False
        msg = "No parts provided"
        ghenv.Component.AddRuntimeMessage(gh.Kernel.GH_RuntimeMessageLevel.Warning, msg)
    
    if check_data:
        
        names = []
        ids = []
        geometries = []
        transforms = []
        add_colliders = []
        parents = []
        
        conn_list = []
        conn_pln_list = []
        children_list = []
        attributes_list = []
        
        for part in parts:
            data_dict = part.return_part_data()
            names.append(data_dict['name'])
            ids.append(data_dict['id'])
            geometries.append(data_dict['geo'])
            conn_list.append(data_dict['connections'])
            
            conn_pln_list.append([])
            for conn in data_dict['connections']:
                conn_pln_list[len(conn_pln_list)-1].append(conn.pln)
            
            if "transform" in data_dict.keys():
                transforms.append(data_dict['transform'])
            
            if "add_collider" in data_dict.keys():
                add_colliders.append(data_dict['add_collider'])
            
            if "parent" in data_dict.keys():
                parents.append(data_dict['parent'])
            
            if "children" in data_dict.keys():
                children_list.append(data_dict['children'])
            
            if "attributes" in data_dict.keys():
                attributes_list.append(data_dict['attributes'])
        
        connections = listToDataTree(conn_list)
        connection_planes = listToDataTree(conn_pln_list)
        children = listToDataTree(children_list)
        attributes = listToDataTree(attributes_list)
        
        return names, ids, geometries, transforms, add_colliders, connections, connection_planes, parents, children, attributes
    else:
        return -1


result = main(PART)

if result != -1:
    NAME = result[0]
    ID = result[1]
    GEO = result[2]
    TR = result[3]
    ADD_COLL = result[4]
    CONN = result[5]
    CONN_PLN = result[6]
    PARENT = result[7]
    CHILD = result[8]
    ATTR = result[9]
# ---------- end depart ----------
tmatch = MatchText(Text=depart.NAME, Pattern="T", Case=True)
tmatch_2 = MatchText(Text=depart.NAME, Pattern="P", Case=True)
cull = CullPattern(List=depart.GEO, CullPattern=tmatch)
cull_2 = CullPattern(List=depart.GEO, CullPattern=tmatch_2)
preview = CustomPreview(Geometry=cull, Shader=ColourSwatch(SwatchColor=RGB(255, 247, 0)))
preview_2 = CustomPreview(Geometry=cull_2, Shader=ColourSwatch(SwatchColor=RGB(81, 255, 0)))
