# Grasshopper definition 08_Constrained_Aggregation.gh (Grasshopper 1.0.7)

# ----
# EXAMPLE_08: Constrained Aggregation
# 0. Setup Wasp
# Before using any of Wasp components,
# the SetupWasp component must be run
# to initialize all classes and shared variables
# 1. Build Part
# Parts are the building blocks of Wasp.
# The most basic way of initializing a part is to define t he geometry (as brep or mesh),
# and the connection faces (center and orientation - with a line). Parts must be named
# to be identifyed in the aggregation rules.
toggle = BooleanToggle(True)
waspsetup = Wasp_Setup(RUN=toggle)  # -> log; inputs RUN: Boolean
# ---------- waspsetup: Python ----------
# Wasp: Discrete Design with Grasshopper plug-in (GPL) initiated by Andrea Rossi
# 
# This file is part of Wasp.
# 
# Copyright (c) 2017, Andrea Rossi <a.rossi.andrea@gmail.com>
# Wasp is free software; you can redistribute it and/or modify 
# it under the terms of the GNU General Public License as published 
# by the Free Software Foundation; either version 3 of the License, 
# or (at your option) any later version. 
# 
# Wasp is distributed in the hope that it will be useful,
# but WITHOUT ANY WARRANTY; without even the implied warranty of 
# MERCHANTABILITY or FITNESS FOR A PARTICULAR PURPOSE. See the 
# GNU General Public License for more details.
# 
# You should have received a copy of the GNU General Public License
# along with Wasp; If not, see <http://www.gnu.org/licenses/>.
# 
# @license GPL-3.0 <https://www.gnu.org/licenses/gpl.html>
#
# Significant parts of Wasp have been developed by Andrea Rossi
# as part of research on digital materials and discrete design at:
# DDU Digital Design Unit - Prof. Oliver Tessmann
# Technische Universität Darmstadt


#########################################################################
##                            COMPONENT INFO                           ##
#########################################################################
"""
This components initialized all classes and variables required by Wasp to run.
You must run this component before starting to work with Wasp, or other components will not work properly.

-
Wasp: Discrete Design with Grasshopper plug-in (GPL) initiated by Andrea Rossi
You should have received a copy of the GNU General Public License
along with Wasp; If not, see <http://www.gnu.org/licenses/>.

@license GPL-3.0 <https://www.gnu.org/licenses/gpl.html>

Source code is available at: xxxxx
-
Provided by Wasp 0.1.0
    Args:
        RUN: Setup all classes and variables required to run Wasp. Set it to True to start building.
    Returns:
        log: log
"""

ghenv.Component.Name = "Wasp_Setup"
ghenv.Component.NickName = 'WaspSetup'
ghenv.Component.Message = 'VER 0.1.0\nDEC_22_2017'
ghenv.Component.IconDisplayMode = ghenv.Component.IconDisplayMode.application
ghenv.Component.Category = "Wasp"
ghenv.Component.SubCategory = "0 | Wasp"
try: ghenv.Component.AdditionalHelpFromDocStrings = "1"
except: pass



#########################################################################
##                               IMPORTS                               ##
#########################################################################
import random as rnd
import math
import scriptcontext as sc
import Rhino.Geometry as rg
import Rhino
import Grasshopper.Kernel as gh

#########################################################################
##                               CLASSES                               ##
#########################################################################

#################################################################### Connection
class Connection(object):
    
    ## constructor
    def __init__(self, plane, type, part, id):
        
        self.pln = plane
        
        flip_pln_Y = rg.Vector3d(plane.YAxis)
        flip_pln_Y.Reverse()
        self.flip_pln = rg.Plane(plane.Origin, plane.XAxis, flip_pln_Y)
        
        self.type = type
        self.part = part
        self.id = id
        
        self.rules_table = []
        self.active_rules = []
    
    ## return a transformed copy of the connection
    def transform(self, trans):
        pln_trans = rg.Plane(self.pln.Origin, self.pln.XAxis, self.pln.YAxis)
        conn_trans = Connection(pln_trans, self.type, self.part, self.id)
        conn_trans.pln.Transform(trans)
        conn_trans.flip_pln.Transform(trans)
        return conn_trans
    
    ## generate the rules-table for the connection
    def generate_rules_table(self, rules):
        count = 0
        self.rules_table = []
        self.active_rules = []
        for rule in rules:
            if rule.part1 == self.part and rule.conn1 == self.id:
                self.rules_table.append(rule)
                self.active_rules.append(count)
                count += 1

#################################################################### Base Component
class Part(object):
    
    ## constructor
    def __init__(self, name, geometry, connections, collider, attributes):
        
        self.name = name
        self.geo = geometry
        
        self.connections = []
        self.active_connections = []
        count = 0
        for conn in connections:
            conn.part = self.name
            conn.id = count
            self.connections.append(conn)
            self.active_connections.append(count)
            count += 1
        
        self.transformation = rg.Transform.Identity
        self.center = self.geo.GetBoundingBox(False).Center
        self.collider = collider
        
        self.children = []
        
        self.attributes = []
        if len(attributes) > 0:
            self.attributes = attributes
        
        self.is_constrained = False
    
    def reset_part(self, rules):
        count = 0
        self.active_connections = []
        for conn in self.connections:
            conn.generate_rules_table(rules)
            self.active_connections.append(count)
            count += 1
    
    def return_part_data(self):
        data_dict = {}
        data_dict['name'] = self.name
        data_dict['geo'] = self.geo
        data_dict['connections'] = self.connections
        data_dict['transform'] = self.transformation
        data_dict['center'] = self.center
        data_dict['children'] = self.children
        data_dict['attributes'] = self.attributes
        return data_dict
    
    ## function to transform part
    def transform(self, trans):
        geo_trans = self.geo.Duplicate()
        geo_trans.Transform(trans)
        
        collider_trans = self.collider.Duplicate()
        collider_trans.Transform(trans)
        
        connections_trans = []
        for conn in self.connections:
            connections_trans.append(conn.transform(trans))
        
        attributes_trans = []
        if len(self.attributes) > 0:
            for attr in self.attributes:
                attributes_trans.append(attr.transform(trans))
        
        part_trans = Part(self.name, geo_trans, connections_trans, collider_trans, attributes_trans)
        part_trans.transformation = trans
        return part_trans
    
    ## return transformed center point
    def transform_center(self, trans):
        center_trans = rg.Point3d(self.center)
        center_trans.Transform(trans)
        return center_trans
    
    ## return transformed collider mesh
    def transform_collider(self, trans):
        collider_trans = self.collider.Duplicate()
        collider_trans.Transform(trans)
        return collider_trans


#################################################################### Constrained Component
class Constrained_Part(Part):
    
    ## constructor
    def __init__(self, name, geometry, connections, collider, attributes, additional_collider, supports):
        
        super(self.__class__, self).__init__(name, geometry, connections, collider, attributes)
        
        self.add_collider = None
        if additional_collider != None:
            self.add_collider = additional_collider
        
        self.supports = []
        if len(supports) > 0:
            self.supports = supports
    
    ## function to transform component
    def transform(self, trans):
        geo_trans = self.geo.Duplicate()
        geo_trans.Transform(trans)
        
        collider_trans = self.collider.Duplicate()
        collider_trans.Transform(trans)
        
        connections_trans = []
        for conn in self.connections:
            connections_trans.append(conn.transform(trans))
        
        attributes_trans = []
        if len(self.attributes) > 0:
            for attr in self.attributes:
                attributes_trans.append(attr.transform(trans))
        
        add_collider_trans = None
        if(self.add_collider != None):
            add_collider_trans = self.add_collider.Duplicate()
            add_collider_trans.Transform(trans)
            
        supports_trans = []
        if len(self.supports) > 0:
            for sup in self.supports:
                sup_trans = sup.transform(trans)
                supports_trans.append(sup_trans)
        
        part_trans = Constrained_Part(self.name, geo_trans, connections_trans, collider_trans, attributes_trans, add_collider_trans, supports_trans)
        part_trans.transformation = trans
        part_trans.is_constrained = True
        return part_trans


#################################################################### Rule
class Rule(object):
    
    def __init__(self, _part1, _conn1, _part2, _conn2, _active = True, GH_Component = None):
        
        self.gh = GH_Component
        
        self.part1 = _part1
        self.conn1 = _conn1
        self.part2 = _part2
        self.conn2 = _conn2
        self.active = _active


#################################################################### Field
class Field(object):
    
    def __init__(self, boundaries, pts, count_vec, resolution, values):
        
        self.resolution = resolution
        
        self.bbox = rg.BoundingBox(pts)
        
        self.x_count = int(count_vec.X)
        self.y_count = int(count_vec.Y)
        self.z_count = int(count_vec.Z)
        
        self.pts = []
        self.vals = []
        pts_count = 0
        
        for z in range(0, self.z_count):
            self.pts.append([])
            self.vals.append([])
            for y in range(0, self.y_count):
                self.pts[z].append([])
                self.vals[z].append([])
                for x in range(0, self.x_count):
                    self.pts[z][y].append(pts[pts_count])
                    if len(boundaries) > 0:
                        inside = False
                        for bou in boundaries:
                            if bou.IsPointInside(pts[pts_count], sc.sticky['model_tolerance'], True) == True:
                                self.vals[z][y].append(values[pts_count])
                                inside = True
                                break
                        if inside == False:
                            self.vals[z][y].append(0.0)
                    else:
                        self.vals[z][y].append(values[pts_count])
                    pts_count += 1
        
        self.highest_pt = self.return_highest_pt()
    
    
    def return_pt_val(self, pt):
        pt_trans = pt - self.bbox.Min
        x = int(math.floor(pt_trans.X/self.resolution))
        y = int(math.floor(pt_trans.Y/self.resolution))
        z = int(math.floor(pt_trans.Z/self.resolution))
        
        value = self.vals[z][y][x]
        return value
    
    def return_highest_pt(self):
        max_val = -1
        highest_pt = None
        
        for z in range(0, self.z_count):
            for y in range(0, self.y_count):
                for x in range(0, self.x_count):
                    value = self.vals[z][y][x]
                    if value > max_val:
                        max_val = value
                        highest_pt = self.pts[z][y][x]
        
        return highest_pt


#################################################################### Attribute
class Attribute(object):
    
    def __init__(self, name, values, transformable):
        
        self.name = name
        self.values = values
        self.transformable = transformable
    
    def transform(self, trans):
        if self.transformable == True:
            values_trans = []
            for val in self.values:
                if type(val) == rg.Point3d:
                    val_trans = rg.Point3d(val)
                else:
                    val_trans = val.Duplicate()
                val_trans.Transform(trans)
                values_trans.append(val_trans)
            attr_trans = Attribute(self.name, values_trans, self.transformable)
        else:
            attr_trans = Attribute(self.name, self.values, self.transformable)
        return attr_trans


#################################################################### Support
class Support(object):
    
    def __init__(self, support_directions):
        
        self.sup_dir = support_directions
    
    def transform(self, trans):
        sup_dir_trans = []
        for dir in self.sup_dir:
            dir_trans = dir.Duplicate()
            dir_trans.Transform(trans)
            sup_dir_trans.append(dir_trans)
        sup_trans = Support(sup_dir_trans)
        return sup_trans


#########################################################################
##                                 WIP                                 ##
#########################################################################

## Aggregation class
## Voxel class
## Graph class

#########################################################################
##                                 RUN                                 ##
#########################################################################

log = []

## add classes to scriptcontext (to make it available to other Gh components)
if RUN:
    
    sc.sticky['Connection'] = Connection
    log.append("Connection class created...")
    sc.sticky['Part'] = Part
    log.append("Part class created...")
    sc.sticky['Constrained_Part'] = Constrained_Part
    log.append("Constrained_Part class created...")
    sc.sticky['Rule'] = Rule
    log.append("Rule class created...")
    sc.sticky['Field'] = Field
    log.append("Field class created...")
    sc.sticky['Attribute'] = Attribute
    log.append("Attribute class created...")
    sc.sticky['Support'] = Support
    log.append("Support class created...")
    
    sc.sticky['model_tolerance'] = Rhino.RhinoDoc.ActiveDoc.ModelAbsoluteTolerance*5
    sc.sticky['WaspSetup'] = 1
    
    log.append("READY TO BUILD!")

else:
    log.append("Set RUN to True to initialize Wasp...")
# ---------- end waspsetup ----------
# # Wasp: Discrete Design with Grasshopper plug-in (GPL) initiated by Andrea Rossi
# 
# 
# This file is part of Wasp.
# 
# Copyright (c) 2017, Andrea Rossi <a.rossi.andrea@gmail.com>
# 
# Wasp is free software; you can redistribute it and/or modify it under the terms of the GNU General Public License as published by the Free Software Foundation; either version 3 of the License, or (at your option) any later version.
# 
# Wasp is distributed in the hope that it will be useful, but WITHOUT ANY WARRANTY; without even the implied warranty of MERCHANTABILITY or FITNESS FOR A PARTICULAR PURPOSE. See the GNU General Public License for more details. You should have received a copy of the GNU General Public License
#  along with Wasp; If not, see <http://www.gnu.org/licenses/>.
# 
# license GPL-3.0 <https://www.gnu.org/licenses/gpl.html>
# 
# Significant parts of Wasp have been developed by Andrea Rossi as part of research on digital materials and discrete design at DDU Digital Design Unit - Prof. Oliver Tessmann - Technische Universität Darmstadt
panel = Panel(waspsetup)

crv = Curve([<curve referenced from the Rhino model> x10])
part_geometry = Brep(<brep referenced from the Rhino model>)
connections_centers = Point([<point referenced from the Rhino model> x10])
connections_x_axis = Curve([<curve referenced from the Rhino model> x10])
connections_centers_2 = Point([<point referenced from the Rhino model> x10])
connections_x_axis_2 = Curve([<curve referenced from the Rhino model> x10])
item = ListItem(List=crv, Index=0, Wrap=False)  # -> Item, Item1, Item2, Item3, Item4, Item5, Item6, Item7, Item8, Item9
part_geometry_2 = Brep(part_geometry)
conndir = Wasp_ConnectionFromDirection(GEO=part_geometry, CEN=connections_centers_2, UP=connections_x_axis_2, T="TOP")  # -> CONN, PLN_OUT; inputs GEO: Brep, CEN: list of Point3d, UP: list of Curve, T: list
# ---------- conndir: Python ----------
# Wasp: Discrete Design with Grasshopper plug-in (GPL) initiated by Andrea Rossi
# 
# This file is part of Wasp.
# 
# Copyright (c) 2017, Andrea Rossi <a.rossi.andrea@gmail.com>
# Wasp is free software; you can redistribute it and/or modify 
# it under the terms of the GNU General Public License as published 
# by the Free Software Foundation; either version 3 of the License, 
# or (at your option) any later version. 
# 
# Wasp is distributed in the hope that it will be useful,
# but WITHOUT ANY WARRANTY; without even the implied warranty of 
# MERCHANTABILITY or FITNESS FOR A PARTICULAR PURPOSE. See the 
# GNU General Public License for more details.
# 
# You should have received a copy of the GNU General Public License
# along with Wasp; If not, see <http://www.gnu.org/licenses/>.
# 
# @license GPL-3.0 <https://www.gnu.org/licenses/gpl.html>
#
# Significant parts of Wasp have been developed by Andrea Rossi
# as part of research on digital materials and discrete design at:
# DDU Digital Design Unit - Prof. Oliver Tessmann
# Technische Universität Darmstadt


#########################################################################
##                            COMPONENT INFO                           ##
#########################################################################

"""
Create a connection on a given part geometry from center and X-asix direction
(Z direction is determined based on the normals of the component geometry)
-
Provided by Wasp 0.2
    Args:
        GEO: Geometry of the part to which the connection belongs
        CEN: Origin of the connection plane
        UP: Line idetifying the X-axis of the connection plane - determines the plane orientation to mantain when transforming
        T: OPTIONAL // Connection type (to be used with Rule Generator component)
    Returns:
        CONN: Connection object
        PLN_OUT: Plane for each connection object (for debugging)
"""

ghenv.Component.Name = "Wasp_Connection From Direction"
ghenv.Component.NickName = 'ConnDir'
ghenv.Component.Message = 'VER 0.2.3'
ghenv.Component.IconDisplayMode = ghenv.Component.IconDisplayMode.application
ghenv.Component.Category = "Wasp"
ghenv.Component.SubCategory = "1 | Elements"
try: ghenv.Component.AdditionalHelpFromDocStrings = "1"
except: pass


import sys
import scriptcontext as sc
import Rhino.Geometry as rg
import Grasshopper as gh

## add Wasp install directory to system path
ghcompfolder = gh.Folders.DefaultAssemblyFolder
wasp_path = ghcompfolder + "Wasp"
if wasp_path not in sys.path:
    sys.path.append(wasp_path)
try:
    import wasp
except:
    msg = "Cannot import Wasp. Is the wasp.py module installed in " + wasp_path + "?"
    ghenv.Component.AddRuntimeMessage(gh.Kernel.GH_RuntimeMessageLevel.Error, msg)


def main(part_geo, conn_centers, conn_ups, conn_type):
        
    check_data = True
    
    ## check inputs
    if part_geo is None:
        check_data = False
        msg = "No part geometry provided"
        ghenv.Component.AddRuntimeMessage(gh.Kernel.GH_RuntimeMessageLevel.Warning, msg)
    
    if len(conn_centers) != len(conn_ups):
        check_data = False
        msg = "Different amount of centers and up vectors provided"
        ghenv.Component.AddRuntimeMessage(gh.Kernel.GH_RuntimeMessageLevel.Error, msg)
    
    types = []
    if len(conn_type) == 0:
        for i in range(len(conn_centers)):
            types.append("0")
    elif len(conn_type) == 1:
        for i in range(len(conn_centers)):
            types.append(conn_type[0])
    elif len(conn_centers) != len(conn_type):
        check_data = False
        msg = "Different amount of centers and types provided"
        ghenv.Component.AddRuntimeMessage(gh.Kernel.GH_RuntimeMessageLevel.Error, msg)
    else:
        for i in range(len(conn_centers)):
            types.append(conn_type[i])
    
    ## execute main code if all needed inputs are available
    if check_data:
        connections = []
        out_planes = []
        for i in range(len(conn_centers)):
            
            center = conn_centers[i]
            up = conn_ups[i]
            plane = None
            
            up_start = rg.Vector3d(up.PointAtStart)
            up_end = rg.Vector3d(up.PointAtEnd)
            up_vec = rg.Vector3d.Subtract(up_end, up_start)
            
            for face in GEO.Faces:
                pt_uv = face.ClosestPoint(center)
                pt = face.PointAt(pt_uv[1], pt_uv[2])
                dist = rg.Point3d.DistanceTo(center, pt)
                if(dist < wasp.global_tolerance):
                    normal = face.NormalAt(pt_uv[1], pt_uv[2])
                    plane = rg.Plane(center, normal)
                    x_axis = plane.XAxis
                    angle = rg.Vector3d.VectorAngle(x_axis, up_vec, plane)
                    plane.Rotate(angle, normal)
                    break
                    
            if plane is None:
                msg = "No valid plane provided for connection %d"%(i)
                ghenv.Component.AddRuntimeMessage(gh.Kernel.GH_RuntimeMessageLevel.Error, msg)
            else:
                conn = wasp.Connection(plane, types[i], "", -1)
                connections.append(conn)
                out_planes.append(plane)
        
        return connections, out_planes
    
    else:
        return -1

result = main(GEO, CEN, UP, T)

if result != -1:
    CONN = result[0]
    PLN_OUT = result[1]
# ---------- end conndir ----------
conndir_2 = Wasp_ConnectionFromDirection(GEO=part_geometry, CEN=connections_centers, UP=connections_x_axis, T="BOTTOM")  # -> CONN, PLN_OUT; inputs GEO: Brep, CEN: list of Point3d, UP: list of Curve, T: list; same code as conndir
support = Wasp_Support(DIR=[item.Item1, item.Item4], GEO=part_geometry_2)  # -> SUP; inputs DIR: list of Curve, GEO: Mesh
# ---------- support: Python ----------
# Wasp: Discrete Design with Grasshopper plug-in (GPL) initiated by Andrea Rossi
# 
# This file is part of Wasp.
# 
# Copyright (c) 2017, Andrea Rossi <a.rossi.andrea@gmail.com>
# Wasp is free software; you can redistribute it and/or modify 
# it under the terms of the GNU General Public License as published 
# by the Free Software Foundation; either version 3 of the License, 
# or (at your option) any later version. 
# 
# Wasp is distributed in the hope that it will be useful,
# but WITHOUT ANY WARRANTY; without even the implied warranty of 
# MERCHANTABILITY or FITNESS FOR A PARTICULAR PURPOSE. See the 
# GNU General Public License for more details.
# 
# You should have received a copy of the GNU General Public License
# along with Wasp; If not, see <http://www.gnu.org/licenses/>.
# 
# @license GPL-3.0 <https://www.gnu.org/licenses/gpl.html>
#
# Significant parts of Wasp have been developed by Andrea Rossi
# as part of research on digital materials and discrete design at:
# DDU Digital Design Unit - Prof. Oliver Tessmann
# Technische Universität Darmstadt


#########################################################################
##                            COMPONENT INFO                           ##
#########################################################################

"""
Support definition for constrained parts.
Each set of lines defining support locations can be set
-
Provided by Wasp 0.2
    Args:
        DIR: Directions of the support locations as lines
        GEO: OPTIONAL // Geometry of the part the support belongs to (useful for checking if the supports are correctly placed)
    Returns:
        SUP: Support instance
"""

ghenv.Component.Name = "Wasp_Support"
ghenv.Component.NickName = 'Support'
ghenv.Component.Message = 'VER 0.2.3'
ghenv.Component.IconDisplayMode = ghenv.Component.IconDisplayMode.application
ghenv.Component.Category = "Wasp"
ghenv.Component.SubCategory = "1 | Elements"
try: ghenv.Component.AdditionalHelpFromDocStrings = "3"
except: pass


import sys
import scriptcontext as sc
import Rhino.Geometry as rg
import Grasshopper as gh

## add Wasp install directory to system path
ghcompfolder = gh.Folders.DefaultAssemblyFolder
wasp_path = ghcompfolder + "Wasp"
if wasp_path not in sys.path:
    sys.path.append(wasp_path)
try:
    import wasp
except:
    msg = "Cannot import Wasp. Is the wasp.py module installed in " + wasp_path + "?"
    ghenv.Component.AddRuntimeMessage(gh.Kernel.GH_RuntimeMessageLevel.Error, msg)


def main(sup_dir, part_geo):
    
    check_data = True
    
    ##check inputs
    support_lines = []
    if len(sup_dir) == 0:
        check_data = False
        msg = "Please provide a valid list of lines as support directions"
        ghenv.Component.AddRuntimeMessage(gh.Kernel.GH_RuntimeMessageLevel.Warning, msg)
    else:
        for sup in sup_dir:
            start = sup.PointAtStart
            end = sup.PointAtEnd
            sup_ln = rg.Line(start, end)
            support_lines.append(sup_ln)
    
    if part_geo is not None:
        for i in range(len(support_lines)):
            intersection = rg.Intersect.Intersection.MeshLine(part_geo, support_lines[i])
            if len(intersection[0]) == 0:
                msg = "Support direction " + str(i) + " does not intersect with the part geometry. Please verify this is intended."
                ghenv.Component.AddRuntimeMessage(gh.Kernel.GH_RuntimeMessageLevel.Warning, msg)
    
    if check_data:
        support = wasp.Support(DIR)
        return support
    else:
        return -1


result = main(DIR, GEO)

if result != -1:
    SUP = result
# ---------- end support ----------
support_2 = Wasp_Support(DIR=[item.Item3, item.Item6], GEO=part_geometry_2)  # -> SUP; inputs DIR: list of Curve, GEO: Mesh; same code as support
support_3 = Wasp_Support(DIR=item.Item9, GEO=part_geometry_2)  # -> SUP; inputs DIR: list of Curve, GEO: Mesh; same code as support
support_4 = Wasp_Support(DIR=[item.Item7, item.Item5], GEO=part_geometry_2)  # -> SUP; inputs DIR: list of Curve, GEO: Mesh; same code as support
support_5 = Wasp_Support(DIR=[item.Item8, item.Item2, item.Item], GEO=part_geometry_2)  # -> SUP; inputs DIR: list of Curve, GEO: Mesh; same code as support
part_name = Panel("T")
merge = Merge(Data1=support, Data2=support_2, Data3=support_3, Data4=support_4, Data5=support_5)
merge_2 = Merge(Data1=conndir_2.CONN, Data2=conndir.CONN)
advpart = Wasp_AdvancedPart(NAME=part_name, GEO=part_geometry, CONN=flatten(merge_2), SUP=merge)  # -> PART; inputs GEO: Mesh, CONN: list, COLL: Mesh, HI: list, ATTR: list, SUP: list
# ---------- advpart: Python ----------
# Wasp: Discrete Design with Grasshopper plug-in (GPL) initiated by Andrea Rossi
# 
# This file is part of Wasp.
# 
# Copyright (c) 2017, Andrea Rossi <a.rossi.andrea@gmail.com>
# Wasp is free software; you can redistribute it and/or modify 
# it under the terms of the GNU General Public License as published 
# by the Free Software Foundation; either version 3 of the License, 
# or (at your option) any later version. 
# 
# Wasp is distributed in the hope that it will be useful,
# but WITHOUT ANY WARRANTY; without even the implied warranty of 
# MERCHANTABILITY or FITNESS FOR A PARTICULAR PURPOSE. See the 
# GNU General Public License for more details.
# 
# You should have received a copy of the GNU General Public License
# along with Wasp; If not, see <http://www.gnu.org/licenses/>.
# 
# @license GPL-3.0 <https://www.gnu.org/licenses/gpl.html>
#
# Significant parts of Wasp have been developed by Andrea Rossi
# as part of research on digital materials and discrete design at:
# DDU Digital Design Unit - Prof. Oliver Tessmann
# Technische Universität Darmstadt


#########################################################################
##                            COMPONENT INFO                           ##
#########################################################################

"""
Create a Wasp Part with additional constraints (supports, additional colliders)
-
Provided by Wasp 0.2
    Args:
        NAME: Part name
        GEO: Part geometry. It will be converted to mesh - to improve performance, perform the conversion before adding to the part and user a low-poly count
        CONN: Connections list
        COLL: OPTIONAL // Collider geometry (for collision detection). A collider will be automatically generated. For complex parts, automatic generation might not work, and you can add a custom collider geometry here.
        FIELD: OPTIONAL // Field to associate with the part for Field-Driven Aggegation (Needed only when using multiple fields within one aggregation)
        HI: OPTIONAL // Hierarchy: List of parts composing the part at a lower heriarchical level in the aggregation
        ATTR: OPTIONAL // Part attributes
        E_COLL: OPTIONAL // Additional collider geometry (e.g. assembly tool), to be checked in Constrained mode
        SUP: OPTIONAL // Required supports for part placement, to be checked in Constrained mode
    Returns:
        PART: Part instance
"""

ghenv.Component.Name = "Wasp_Advanced Part"
ghenv.Component.NickName = 'AdvPart'
ghenv.Component.Message = 'VER 0.2.3'
ghenv.Component.IconDisplayMode = ghenv.Component.IconDisplayMode.application
ghenv.Component.Category = "Wasp"
ghenv.Component.SubCategory = "2 | Parts"
try: ghenv.Component.AdditionalHelpFromDocStrings = "1"
except: pass

import sys
import scriptcontext as sc
import Rhino.Geometry as rg
import Grasshopper as gh

## add Wasp install directory to system path
ghcompfolder = gh.Folders.DefaultAssemblyFolder
wasp_path = ghcompfolder + "Wasp"
if wasp_path not in sys.path:
    sys.path.append(wasp_path)
try:
    import wasp
except:
    msg = "Cannot import Wasp. Is the wasp.py module installed in " + wasp_path + "?"
    ghenv.Component.AddRuntimeMessage(gh.Kernel.GH_RuntimeMessageLevel.Error, msg)


def main(part_name, part_geo, connections, collider_geo, field_name, sub_parts, attributes, add_collider, supports):
    
    check_data = True
    
    ## check inputs
    if part_name is None:
        check_data = False
        msg = "No part name provided"
        ghenv.Component.AddRuntimeMessage(gh.Kernel.GH_RuntimeMessageLevel.Warning, msg)
    
    if part_geo is None:
        check_data = False
        msg = "No part geometry provided"
        ghenv.Component.AddRuntimeMessage(gh.Kernel.GH_RuntimeMessageLevel.Warning, msg)
        check_data = False
    
    ## compute collider, if no custom collider is provided
    if collider_geo is None and part_geo is not None:
        collider_geo = part_geo.Duplicate().Offset(wasp.global_tolerance)
        collider_intersection = rg.Intersect.Intersection.MeshMeshFast(collider_geo, part_geo)
        if len(collider_intersection) > 0:
            collider_geo = None
            collider_geo = part_geo.Duplicate()
            center = part_geo.GetBoundingBox(True).Center
            scale_plane = rg.Plane(center, rg.Vector3d(1,0,0), rg.Vector3d(0,1,0))
            scale_transform = rg.Transform.Scale(scale_plane, 1-wasp.global_tolerance, 1-wasp.global_tolerance, 1-wasp.global_tolerance)
            collider_geo.Transform(scale_transform)
            collider_intersection = rg.Intersect.Intersection.MeshMeshFast(collider_geo, part_geo)
            if len(collider_intersection) > 0:
                collider_geo = None
                msg = "Could not compute a valid collider geometry. Please provide a valid collider in the COLL input."
                ghenv.Component.AddRuntimeMessage(gh.Kernel.GH_RuntimeMessageLevel.Error, msg)
                check_data = False
    
    if collider_geo is not None and collider_geo.Faces.Count > 1000:
        msg = "The computed collider has a high faces count. Consider providing a low poly collider to improve performance"
        ghenv.Component.AddRuntimeMessage(gh.Kernel.GH_RuntimeMessageLevel.Warning, msg)
    
    if check_data:
        ## create collider
        collider = wasp.Collider([collider_geo])
        
        if add_collider is not None and type(add_collider) != wasp.Collider:
            add_collider = wasp.Collider([add_collider])
        
        ## create part instance
        new_part = wasp.AdvancedPart(part_name, part_geo, connections, collider, attributes, add_collider, supports, field=field_name, sub_parts=sub_parts)
        new_part.is_constrained = True
        return new_part
    else:
        return -1


result = main(NAME, GEO, CONN, COLL, FIELD, HI, ATTR, E_COLL, SUP)

if result != -1:
    PART = result
# ---------- end advpart ----------
rulegen = Wasp_RulesGenerator(PART=advpart, GR="TOP>BOTTOM")  # -> R; inputs PART: list, SELF_P: Boolean, SELF_C: Boolean, TYP: Boolean, GR: list
# ---------- rulegen: Python ----------
# Wasp: Discrete Design with Grasshopper plug-in (GPL) initiated by Andrea Rossi
# 
# This file is part of Wasp.
# 
# Copyright (c) 2017, Andrea Rossi <a.rossi.andrea@gmail.com>
# Wasp is free software; you can redistribute it and/or modify 
# it under the terms of the GNU General Public License as published 
# by the Free Software Foundation; either version 3 of the License, 
# or (at your option) any later version. 
# 
# Wasp is distributed in the hope that it will be useful,
# but WITHOUT ANY WARRANTY; without even the implied warranty of 
# MERCHANTABILITY or FITNESS FOR A PARTICULAR PURPOSE. See the 
# GNU General Public License for more details.
# 
# You should have received a copy of the GNU General Public License
# along with Wasp; If not, see <http://www.gnu.org/licenses/>.
# 
# @license GPL-3.0 <https://www.gnu.org/licenses/gpl.html>
#
# Significant parts of Wasp have been developed by Andrea Rossi
# as part of research on digital materials and discrete design at:
# DDU Digital Design Unit - Prof. Oliver Tessmann
# Technische Universität Darmstadt


#########################################################################
##                            COMPONENT INFO                           ##
#########################################################################

"""
Automated rules generator given a list of parts. It has two separate modes:
- If no grammar is provided in the GR input, the component generates rules between connections of the same type.
- If a grammar is provided, rules are created between connections of different types, according to the specified grammar rules.
-
Provided by Wasp 0.2
    Args:
        PART: Parts from which to generate aggregation rules
        SELF_P: OPTIONAL // Create rules between connections belonging to the same part (True by default)
        SELF_C: OPTIONAL // Create rules between connection with same id (True by default)
        TYP: OPTIONAL // Create rules only between connections of the same type (False by default)
        GR: OPTIONAL // Custom connection grammar with format "ConnType">"ConnType"
    Returns:
        R: Generated aggregation rules
"""

ghenv.Component.Name = "Wasp_Rules Generator"
ghenv.Component.NickName = 'RuleGen'
ghenv.Component.Message = 'VER 0.2.3'
ghenv.Component.IconDisplayMode = ghenv.Component.IconDisplayMode.application
ghenv.Component.Category = "Wasp"
ghenv.Component.SubCategory = "3 | Rules"
try: ghenv.Component.AdditionalHelpFromDocStrings = "2"
except: pass

import sys
import scriptcontext as sc
import Grasshopper as gh

## add Wasp install directory to system path
ghcompfolder = gh.Folders.DefaultAssemblyFolder
wasp_path = ghcompfolder + "Wasp"
if wasp_path not in sys.path:
    sys.path.append(wasp_path)
try:
    import wasp
except:
    msg = "Cannot import Wasp. Is the wasp.py module installed in " + wasp_path + "?"
    ghenv.Component.AddRuntimeMessage(gh.Kernel.GH_RuntimeMessageLevel.Error, msg)


def main(parts, self_part, self_connection, use_types, grammar):
    
    check_data = True
    
    ##check inputs
    if len(parts) == 0 or parts is None:
        check_data = False
        msg = "No part provided"
        ghenv.Component.AddRuntimeMessage(gh.Kernel.GH_RuntimeMessageLevel.Warning, msg)
    
    if self_part == None:
        self_part = True
    
    if self_connection == None:
        self_connection = True
    
    if use_types is None:
        use_types = False
    
    if check_data:
        rules = []
        
        if len(grammar) == 0:
            for part in parts:
                for conn in part.connections:
                    for other_part in parts:
                        skip_part = False
                        if self_part == False:
                            if part.name == other_part.name:
                                skip_part = True
                            
                        if skip_part == False:
                            for other_conn in other_part.connections:
                                skip_conn = False
                                if self_connection == False:
                                    if conn.id == other_conn.id:
                                        skip_conn = True
                                
                                if skip_conn == False:
                                    if use_types:
                                        if conn.type == other_conn.type:
                                            r = wasp.Rule(part.name, conn.id, other_part.name, other_conn.id)
                                            rules.append(r)
                                    else:
                                        r = wasp.Rule(part.name, conn.id, other_part.name, other_conn.id)
                                        rules.append(r)
        else:
            for gr_rule in grammar:
                start_type = gr_rule.split(">")[0]
                end_type = gr_rule.split(">")[1]
                
                for part in parts:
                    for conn in part.connections:
                        if conn.type == start_type:
                            for other_part in parts:
                                skip_part = False
                                if self_part == False:
                                    if part.name == other_part.name:
                                        skip_part = True
                                    
                                if skip_part == False:
                                    for other_conn in other_part.connections:
                                        if other_conn.type == end_type:
                                            skip_conn = False
                                            if self_connection == False:
                                                if conn.id == other_conn.id:
                                                    skip_conn = True
                                            
                                            if skip_conn == False:
                                                r = wasp.Rule(part.name, conn.id, other_part.name, other_conn.id)
                                                rules.append(r)
        return [rules]
    else:
        return -1


result = main(PART, SELF_P, SELF_C, TYP, GR)

if result != -1:
    R = result[0]
# ---------- end rulegen ----------
t_p = Panel("""T|2_P|1
T|3_P|0""")
# 2. Define aggregation rules
# Rules can be defined ina compact way
# with a text string in the format:
# "Part1|Connection1_Part2|Connection2"
p_p = Panel("""P|2_P|6
P|5_P|6
P|3_P|7
P|8_P|2
P|4_P|3""")
p_t = Panel("""P|0_T|0
P|1_T|1""")
# 3. Aggregate!
# Stochastic Aggregation builds an aggregation by randomly selecting one part
# and one rule to be applied at every step. If COLL is set to True,
# collisions between parts are avoided. The component adds parts additively
# over the already aggregated parts. If a new aggregation has to be created,
# the RESET button allows to reset the aggregation and restart.
parts_num = Slider(100, range=0..1000)
mode = ValueList({"BASIC": 0, "CONSTRAINED": 1}, selected="CONSTRAINED")
ruletxt = Wasp_RuleFromText(TXT=t_p)  # -> R
# ---------- ruletxt: Python ----------
# Wasp: Discrete Design with Grasshopper plug-in (GPL) initiated by Andrea Rossi
# 
# This file is part of Wasp.
# 
# Copyright (c) 2017, Andrea Rossi <a.rossi.andrea@gmail.com>
# Wasp is free software; you can redistribute it and/or modify 
# it under the terms of the GNU General Public License as published 
# by the Free Software Foundation; either version 3 of the License, 
# or (at your option) any later version. 
# 
# Wasp is distributed in the hope that it will be useful,
# but WITHOUT ANY WARRANTY; without even the implied warranty of 
# MERCHANTABILITY or FITNESS FOR A PARTICULAR PURPOSE. See the 
# GNU General Public License for more details.
# 
# You should have received a copy of the GNU General Public License
# along with Wasp; If not, see <http://www.gnu.org/licenses/>.
# 
# @license GPL-3.0 <https://www.gnu.org/licenses/gpl.html>
#
# Significant parts of Wasp have been developed by Andrea Rossi
# as part of research on digital materials and discrete design at:
# DDU Digital Design Unit - Prof. Oliver Tessmann
# Technische Universität Darmstadt


#########################################################################
##                            COMPONENT INFO                           ##
#########################################################################

"""
Generate an aggregation rule from a text string description
-
Provided by Wasp 0.2
    Args:
        TXT: Text description of the rule with format "Part1|Conn1_Part2|Conn2"
    Returns:
        R: Rule
"""

ghenv.Component.Name = "Wasp_Rule From Text"
ghenv.Component.NickName = 'RuleTxt'
ghenv.Component.Message = 'VER 0.2.3'
ghenv.Component.IconDisplayMode = ghenv.Component.IconDisplayMode.application
ghenv.Component.Category = "Wasp"
ghenv.Component.SubCategory = "3 | Rules"
try: ghenv.Component.AdditionalHelpFromDocStrings = "1"
except: pass

import sys
import scriptcontext as sc
import Grasshopper as gh

## add Wasp install directory to system path
ghcompfolder = gh.Folders.DefaultAssemblyFolder
wasp_path = ghcompfolder + "Wasp"
if wasp_path not in sys.path:
    sys.path.append(wasp_path)
try:
    import wasp
except:
    msg = "Cannot import Wasp. Is the wasp.py module installed in " + wasp_path + "?"
    ghenv.Component.AddRuntimeMessage(gh.Kernel.GH_RuntimeMessageLevel.Error, msg)



def main(text):
    
    check_data = True
    
    ##check inputs
    if text is None:
        check_data = False
        msg = "No text provided"
        ghenv.Component.AddRuntimeMessage(gh.Kernel.GH_RuntimeMessageLevel.Warning, msg)
    
    if check_data:
        
        try:
            rule_parts = text.split("_")
            part1 = str(rule_parts[0].split("|")[0])
            conn1 = int(rule_parts[0].split("|")[1])
            part2 = str(rule_parts[1].split("|")[0])
            conn2 = int(rule_parts[1].split("|")[1])
            
            rule = wasp.Rule(part1, conn1, part2, conn2)
            return rule
        except:
            msg = "Text string %s is not formatted correctly"%(text)
            ghenv.Component.AddRuntimeMessage(gh.Kernel.GH_RuntimeMessageLevel.Error, msg)
            return -1
    else:
        return -1


result = main(TXT)

if result != -1:
    R = result
# ---------- end ruletxt ----------
ruletxt_2 = Wasp_RuleFromText(TXT=p_p)  # -> R; same code as ruletxt
ruletxt_3 = Wasp_RuleFromText(TXT=p_t)  # -> R; same code as ruletxt
reset = Button()
merge_3 = Merge(Data1=flatten(ruletxt_2), Data2=flatten(ruletxt_3), Data3=flatten(ruletxt))
stochasticaggregation = Wasp_StochasticAggregation(PART=flatten(advpart), N=parts_num, RULES=rulegen, MODE=mode, RESET=reset)  # -> AGGR, PART_OUT; inputs PART: list, PREV: list, N: Int32, RULES: list, MODE: Int32, GC: list, RESET: Boolean
# ---------- stochasticaggregation: Python ----------
# Wasp: Discrete Design with Grasshopper plug-in (GPL) initiated by Andrea Rossi
# 
# This file is part of Wasp.
# 
# Copyright (c) 2017, Andrea Rossi <a.rossi.andrea@gmail.com>
# Wasp is free software; you can redistribute it and/or modify 
# it under the terms of the GNU General Public License as published 
# by the Free Software Foundation; either version 3 of the License, 
# or (at your option) any later version. 
# 
# Wasp is distributed in the hope that it will be useful,
# but WITHOUT ANY WARRANTY; without even the implied warranty of 
# MERCHANTABILITY or FITNESS FOR A PARTICULAR PURPOSE. See the 
# GNU General Public License for more details.
# 
# You should have received a copy of the GNU General Public License
# along with Wasp; If not, see <http://www.gnu.org/licenses/>.
# 
# @license GPL-3.0 <https://www.gnu.org/licenses/gpl.html>
#
# Significant parts of Wasp have been developed by Andrea Rossi
# as part of research on digital materials and discrete design at:
# DDU Digital Design Unit - Prof. Oliver Tessmann
# Technische Universität Darmstadt


#########################################################################
##                            COMPONENT INFO                           ##
#########################################################################

"""
Aggregate the given parts in a stochastic process, selecting parts and rules randomly at every step.
The component works additively, hence increasing the number of parts in an aggregation just adds new parts on the existing ones, without triggering recomputing of the previous element.
-
Provided by Wasp 0.2
    Args:
        PART: Parts to be aggregated (can be more than one)
        PREV: OPTIONAL // Previous aggregated parts. It is possible to input the results of a previous aggregation, or parts transformed with the TransformPart component
        N: Number of parts to be aggregated (does not count parts provided in PREV)
        RULES: Rules for the aggregation
        COLL: OPTIONAL // Collision detection. By default is active and checks for collisions between the aggregated parts
        MODE: OPTIONAL // Switches between aggregation modes: 0 = no constraints, 1 = local constraints, 2 = global constraints, 3 = local + global constraints
        GC: OPTIONAL // Global constraints to apply to aggregation
        ID: OPTIONAL // Aggregation ID (to avoid overwriting when having different aggregation components in the same file)
        RESET: Recompute the whole aggregation
    Returns:
        PART_OUT: Aggregated parts (includes both PREV input and newly aggregated parts)
"""

ghenv.Component.Name = "Wasp_Stochastic Aggregation"
ghenv.Component.NickName = 'StochasticAggregation'
ghenv.Component.Message = 'VER 0.2.3'
ghenv.Component.IconDisplayMode = ghenv.Component.IconDisplayMode.application
ghenv.Component.Category = "Wasp"
ghenv.Component.SubCategory = "4 | Aggregation"
try: ghenv.Component.AdditionalHelpFromDocStrings = "2"
except: pass

import sys
import scriptcontext as sc
import Rhino.Geometry as rg
import Grasshopper as gh
import random as rnd

## add Wasp install directory to system path
ghcompfolder = gh.Folders.DefaultAssemblyFolder
wasp_path = ghcompfolder + "Wasp"
if wasp_path not in sys.path:
    sys.path.append(wasp_path)
try:
    import wasp
except:
    msg = "Cannot import Wasp. Is the wasp.py module installed in " + wasp_path + "?"
    ghenv.Component.AddRuntimeMessage(gh.Kernel.GH_RuntimeMessageLevel.Error, msg)


def main(parts, previous_parts, num_parts, rules, aggregation_mode, global_constraints, aggregation_id, reset):
    
    check_data = True
    
    ##check inputs
    if len(parts) == 0:
        check_data = False
        msg = "No parts provided"
        ghenv.Component.AddRuntimeMessage(gh.Kernel.GH_RuntimeMessageLevel.Warning, msg)
    
    if num_parts is None:
        check_data = False
        msg = "Provide number of aggregation iterations"
        ghenv.Component.AddRuntimeMessage(gh.Kernel.GH_RuntimeMessageLevel.Warning, msg)
    else:
        if len(previous_parts) != 0:
            num_parts += len(previous_parts)
    
    if len(rules) == 0:
        check_data = False
        msg = "No rules provided"
        ghenv.Component.AddRuntimeMessage(gh.Kernel.GH_RuntimeMessageLevel.Warning, msg)
    
    if aggregation_mode is None:
        aggregation_mode = 0
    
    if aggregation_id is None:
        aggregation_id = 'myAggregation'
    
    if reset is None:
        reset = False
    
    if check_data:
        
        ## create aggregation in sticky dict
        if sc.sticky.has_key(aggregation_id) == False:
            sc.sticky[aggregation_id] = wasp.Aggregation(aggregation_id, parts, rules, aggregation_mode, _prev = previous_parts, _global_constraints = global_constraints)
        
        ## reset aggregation - TO DO: create a reset() function rather than recreate the whole aggregation
        if reset:
            sc.sticky[aggregation_id] = wasp.Aggregation(aggregation_id, parts, rules, aggregation_mode, _prev = previous_parts, _global_constraints = global_constraints)
        
        ## handle parameters changes
        #### parts
        if parts != sc.sticky[aggregation_id].parts.values():
            sc.sticky[aggregation_id].reset_base_parts(new_parts = parts)
            sc.sticky[aggregation_id].reset_rules(rules)
        
        #### rules
        if rules != sc.sticky[aggregation_id].rules:
            for part in parts:
                part.reset_part(rules)
            sc.sticky[aggregation_id].rules = rules
            sc.sticky[aggregation_id].reset_rules(rules)
        
        #### mode
        if aggregation_mode != sc.sticky[aggregation_id].mode:
            sc.sticky[aggregation_id].mode = aggregation_mode
        
        #### constraints
        if global_constraints != sc.sticky[aggregation_id].global_constraints:
            sc.sticky[aggregation_id].global_constraints = global_constraints
        
        ## add parts to aggregation
        if num_parts > len(sc.sticky[aggregation_id].aggregated_parts):
            error_msg = sc.sticky[aggregation_id].aggregate_rnd(num_parts-len(sc.sticky[aggregation_id].aggregated_parts))
            if error_msg is not None:
                ghenv.Component.AddRuntimeMessage(gh.Kernel.GH_RuntimeMessageLevel.Warning, error_msg)
        
        ## remove parts from aggregation
        elif num_parts < len(sc.sticky[aggregation_id].aggregated_parts):
            sc.sticky[aggregation_id].remove_elements(num_parts)
        
        ## return result
        return sc.sticky[aggregation_id]
        
    else:
        return -1

result = main(PART, PREV, N, RULES, MODE, GC, ID, RESET)

if result != -1:
    AGGR = result
    PART_OUT = result.aggregated_parts
# ---------- end stochasticaggregation ----------
depart = Wasp_DeconstructPart()  # -> NAME, GEO, CONN, CONN_PLN, TR, CHILD, ATTR; inputs PART: list
# ---------- depart: Python ----------
# Wasp: Discrete Design with Grasshopper plug-in (GPL) initiated by Andrea Rossi
# 
# This file is part of Wasp.
# 
# Copyright (c) 2017, Andrea Rossi <a.rossi.andrea@gmail.com>
# Wasp is free software; you can redistribute it and/or modify 
# it under the terms of the GNU General Public License as published 
# by the Free Software Foundation; either version 3 of the License, 
# or (at your option) any later version. 
# 
# Wasp is distributed in the hope that it will be useful,
# but WITHOUT ANY WARRANTY; without even the implied warranty of 
# MERCHANTABILITY or FITNESS FOR A PARTICULAR PURPOSE. See the 
# GNU General Public License for more details.
# 
# You should have received a copy of the GNU General Public License
# along with Wasp; If not, see <http://www.gnu.org/licenses/>.
# 
# @license GPL-3.0 <https://www.gnu.org/licenses/gpl.html>
#
# Significant parts of Wasp have been developed by Andrea Rossi
# as part of research on digital materials and discrete design at:
# DDU Digital Design Unit - Prof. Oliver Tessmann
# Technische Universität Darmstadt


#########################################################################
##                            COMPONENT INFO                           ##
#########################################################################

"""
Extract all information stored in a part. Useful for visualization or for further geometry processing
-
Provided by Wasp 0.1.0
    Args:
        PART: Parts to deconstruct
    Returns:
        NAME: Name of the part
        GEO: Geometry of the part (as mesh). If Brep geometry is needed, can be stored in the component as attribute, or obtained by transforming the original geometry with the TR output.
        CONN: Part connections
        CONN_PLN: planes for each part connection
        TR: Transformation applied to the part. Can be used to transform other geometries in a similar way (eg. replace a low poly component with a more detailed one)
        CHILD: Children parts attached to the part
        ATTR: Part attributes
"""

ghenv.Component.Name = "Wasp_Deconstruct Part"
ghenv.Component.NickName = 'DePart'
ghenv.Component.Message = 'VER 0.1.0\nDEC_22_2017'
ghenv.Component.IconDisplayMode = ghenv.Component.IconDisplayMode.application
ghenv.Component.Category = "Wasp"
ghenv.Component.SubCategory = "2 | Parts"
try: ghenv.Component.AdditionalHelpFromDocStrings = "3"
except: pass


import scriptcontext as sc
import Grasshopper.Kernel as gh
from Grasshopper import DataTree
from Grasshopper.Kernel.Data import GH_Path


## from http://www.chenjingcheng.com/grasshopper-python-datatree-list-conversion/
def listToDataTree(list):
    rl = list
    result = DataTree[object]()
    for i in range(len(rl)):
        temp = []
        for j in range(len(rl[i])):
            temp.append(rl[i][j])
        path = GH_Path(i)
        result.AddRange(temp, path)
    return result



NAME = []
GEO = []
TR = []
ADD_COLL = []
ATTR = []

conn_list = []
conn_pln_list = []
children_list = []
attributes_list = []

if len(PART) == 0:
    msg = "No part provided"
    ghenv.Component.AddRuntimeMessage(gh.GH_RuntimeMessageLevel.Warning, msg)
elif PART[0] is None:
    msg = "Provided part is null"
    ghenv.Component.AddRuntimeMessage(gh.GH_RuntimeMessageLevel.Warning, msg)
else:
    for comp in PART:
        
        data_dict = comp.return_part_data()
        
        NAME.append(data_dict['name'])
        GEO.append(data_dict['geo'])
        conn_list.append(data_dict['connections'])
        
        conn_pln_list.append([])
        for conn in data_dict['connections']:
            conn_pln_list[len(conn_pln_list)-1].append(conn.pln)
        
        if "transform" in data_dict.keys():
            TR.append(data_dict['transform'])
        
        if "add_collider" in data_dict.keys():
            ADD_COLL.append(data_dict['add_collider'])
        
        if "children" in data_dict.keys():
            children_list.append(data_dict['children'])
        
        if "attributes" in data_dict.keys():
            attributes_list.append(data_dict['attributes'])
        
    
    CONN = listToDataTree(conn_list)
    CONN_PLN = listToDataTree(conn_pln_list)
    CHILD = listToDataTree(children_list)
    ATTR = listToDataTree(attributes_list)
# ---------- end depart ----------
# 5. Extract Data and Visualize
# Aggregated parts can be exploded in order to access
# the data stored in each part, such as the part geometry
# for visualization purposes.
# By using the part name, it is possible to dispatch different
# part types and process them in different ways (eg. color).
panel_2 = Panel("P")
tmatch = MatchText(Text=depart.NAME, Pattern=panel_2, Case=True)
dispatch = Dispatch(List=depart.GEO, DispatchPattern=tmatch)  # -> ListA, ListB
preview = CustomPreview(Geometry=dispatch.ListA, Shader=ColourSwatch(SwatchColor=RGB(81, 255, 0)))
preview_2 = CustomPreview(Geometry=dispatch.ListB, Shader=ColourSwatch(SwatchColor=RGB(255, 247, 0)))
