# Grasshopper definition xx_Field_FollowLine_0_0_04.gh (Grasshopper 0.9.76)
# plug-ins: Python Interpreter

curve_path = Curve(<curve referenced from the Rhino model>)
brep = Brep(<brep referenced from the Rhino model>)
crv = Curve([<curve referenced from the Rhino model> x8])
pt = Point([<point referenced from the Rhino model> x8])
waspsetup = Wasp_Setup(RUN=Toggle(True))  # -> log; inputs RUN: Boolean
# ---------- waspsetup: Python ----------
# Wasp: Discrete Design with Grasshopper plug-in (GPL) initiated by Andrea Rossi
# 
# This file is part of Wasp.
# 
# Copyright (c) 2017, Andrea Rossi <a.rossi.andrea@gmail.com>
# Wasp is free software; you can redistribute it and/or modify 
# it under the terms of the GNU General Public License as published 
# by the Free Software Foundation; either version 3 of the License, 
# or (at your option) any later version. 
# 
# Wasp is distributed in the hope that it will be useful,
# but WITHOUT ANY WARRANTY; without even the implied warranty of 
# MERCHANTABILITY or FITNESS FOR A PARTICULAR PURPOSE. See the 
# GNU General Public License for more details.
# 
# You should have received a copy of the GNU General Public License
# along with Wasp; If not, see <http://www.gnu.org/licenses/>.
# 
# @license GPL-3.0 <https://www.gnu.org/licenses/gpl.html>
#
# Significant parts of Wasp have been developed by Andrea Rossi
# as part of research on digital materials and discrete design at:
# DDU Digital Design Unit - Prof. Oliver Tessmann
# Technische Universität Darmstadt


#########################################################################
##                            COMPONENT INFO                           ##
#########################################################################
"""
This components initialized all classes and variables required by Wasp to run.
You must run this component before starting to work with Wasp, or other components will not work properly.

-
Wasp: Discrete Design with Grasshopper plug-in (GPL) initiated by Andrea Rossi
You should have received a copy of the GNU General Public License
along with Wasp; If not, see <http://www.gnu.org/licenses/>.

@license GPL-3.0 <https://www.gnu.org/licenses/gpl.html>

Source code is available at: xxxxx
-
Provided by Wasp 0.0.04
    Args:
        RUN: Setup all classes and variables required to run Wasp. Set it to True to start building.
    Returns:
        log: log
"""

ghenv.Component.Name = "Wasp_Setup"
ghenv.Component.NickName = 'WaspSetup'
ghenv.Component.Message = 'VER 0.0.04\nNOV_11_2017'
ghenv.Component.IconDisplayMode = ghenv.Component.IconDisplayMode.application
ghenv.Component.Category = "Wasp"
ghenv.Component.SubCategory = "0 | Wasp"
try: ghenv.Component.AdditionalHelpFromDocStrings = "1"
except: pass



#########################################################################
##                               IMPORTS                               ##
#########################################################################
import random as rnd
import math
import scriptcontext as sc
#import rhinoscriptsyntax as rs
import Rhino.Geometry as rg
import Rhino
import Grasshopper.Kernel as gh

#########################################################################
##                               CLASSES                               ##
#########################################################################

#################################################################### Connection
class Connection(object):
    
    ## constructor
    def __init__(self, plane, type, part, id):
        
        self.pln = plane
        
        #flip_pln_Y = rs.VectorReverse(plane.YAxis)
        flip_pln_Y = rg.Vector3d(plane.YAxis)
        flip_pln_Y.Reverse()
        
        #self.flip_pln = rs.PlaneFromFrame(plane.Origin, plane.XAxis, flip_pln_Y)
        self.flip_pln = rg.Plane(plane.Origin, plane.XAxis, flip_pln_Y)
        
        self.type = type
        self.part = part
        self.id = id
        
        self.rules_table = []
        self.active_rules = []
    
    ## return a transformed copy of the connection
    def transform(self, trans):
        #pln_trans = rs.PlaneFromFrame(self.pln.Origin, self.pln.XAxis, self.pln.YAxis)
        pln_trans = rg.Plane(self.pln.Origin, self.pln.XAxis, self.pln.YAxis)
        conn_trans = Connection(pln_trans, self.type, self.part, self.id)
        conn_trans.pln.Transform(trans)
        conn_trans.flip_pln.Transform(trans)
        return conn_trans
    
    ## generate the rules-table for the connection
    def generate_rules_table(self, rules):
        count = 0
        self.rules_table = []
        self.active_rules = []
        for rule in rules:
            if rule.part1 == self.part and rule.conn1 == self.id:
                self.rules_table.append(rule)
                self.active_rules.append(count)
                count += 1

#################################################################### Base Component
class Part(object):
    
    ## constructor
    def __init__(self, name, geometry, connections, collider, attributes):
        
        self.name = name
        self.geo = geometry
        
        self.connections = []
        self.active_connections = []
        count = 0
        for conn in connections:
            conn.part = self.name
            conn.id = count
            self.connections.append(conn)
            self.active_connections.append(count)
            count += 1
        
        self.transformation = rg.Transform.Identity
        self.center = self.geo.GetBoundingBox(False).Center
        self.collider = collider
        
        self.tolerance = sc.sticky['model_tolerance']
        self.children = []
        
        self.attributes = []
        if len(attributes) > 0:
            self.attributes = attributes
        
        self.is_constrained = False
    
    def reset_part(self, rules):
        count = 0
        self.active_connections = []
        for conn in self.connections:
            conn.generate_rules_table(rules)
            self.active_connections.append(count)
            count += 1
    
    def return_part_data(self):
        data_dict = {}
        data_dict['name'] = self.name
        data_dict['geo'] = self.geo
        data_dict['connections'] = self.connections
        data_dict['transform'] = self.transformation
        data_dict['center'] = self.center
        data_dict['children'] = self.children
        data_dict['attributes'] = self.attributes
        return data_dict
    
    ## function to transform part
    def transform(self, trans):
        geo_trans = self.geo.Duplicate()
        geo_trans.Transform(trans)
        
        collider_trans = self.collider.Duplicate()
        collider_trans.Transform(trans)
        
        connections_trans = []
        for conn in self.connections:
            connections_trans.append(conn.transform(trans))
        
        attributes_trans = []
        if len(self.attributes) > 0:
            for attr in self.attributes:
                attributes_trans.append(attr.transform(trans))
        
        part_trans = Part(self.name, geo_trans, connections_trans, collider_trans, attributes_trans)
        part_trans.transformation = trans
        return part_trans
    
    ## return transformed center point
    def transform_center(self, trans):
        center_trans = rg.Point3d(self.center)
        center_trans.Transform(trans)
        return center_trans
    
    ## return transformed collider mesh
    def transform_collider(self, trans):
        collider_trans = self.collider.Duplicate()
        collider_trans.Transform(trans)
        return collider_trans


#################################################################### Constrained Component
class Constrained_Part(Part):
    
    ## constructor
    def __init__(self, name, geometry, connections, collider, attributes, additional_collider, supports):
        
        super(self.__class__, self).__init__(name, geometry, connections, collider, attributes)
        
        self.add_collider = None
        if additional_collider != None:
            self.add_collider = additional_collider
        
        self.supports = []
        if len(supports) > 0:
            self.supports = supports
    
    ## function to transform component
    def transform(self, trans):
        geo_trans = self.geo.Duplicate()
        geo_trans.Transform(trans)
        
        collider_trans = self.collider.Duplicate()
        collider_trans.Transform(trans)
        
        connections_trans = []
        for conn in self.connections:
            connections_trans.append(conn.transform(trans))
        
        attributes_trans = []
        if len(self.attributes) > 0:
            for attr in self.attributes:
                attributes_trans.append(attr.transform(trans))
        
        add_collider_trans = None
        if(self.add_collider != None):
            add_collider_trans = self.add_collider.Duplicate()
            add_collider_trans.Transform(trans)
            
        supports_trans = []
        if len(self.supports) > 0:
            for sup in self.supports:
                sup_trans = sup.transform(trans)
                supports_trans.append(sup_trans)
        
        part_trans = Constrained_Part(self.name, geo_trans, connections_trans, collider_trans, attributes_trans, add_collider_trans, supports_trans)
        part_trans.transformation = trans
        part_trans.is_constrained = True
        return part_trans


#################################################################### Rule
class Rule(object):
    
    def __init__(self, _part1, _conn1, _part2, _conn2, _active = True, GH_Component = None):
        
        self.gh = GH_Component
        
        self.part1 = _part1
        self.conn1 = _conn1
        self.part2 = _part2
        self.conn2 = _conn2
        self.active = _active


#################################################################### Field
class Field(object):
    
    def __init__(self, boundaries, pts, count_vec, resolution, values):
        
        self.resolution = resolution
        
        self.bbox = rg.BoundingBox(pts)
        
        self.x_count = int(count_vec.X)
        self.y_count = int(count_vec.Y)
        self.z_count = int(count_vec.Z)
        
        self.pts = []
        self.vals = []
        pts_count = 0
        
        for z in range(0, self.z_count):
            self.pts.append([])
            self.vals.append([])
            for y in range(0, self.y_count):
                self.pts[z].append([])
                self.vals[z].append([])
                for x in range(0, self.x_count):
                    self.pts[z][y].append(pts[pts_count])
                    if len(boundaries) > 0:
                        inside = False
                        for bou in boundaries:
                            if bou.IsPointInside(pts[pts_count], sc.sticky['model_tolerance'], True) == True:
                                self.vals[z][y].append(values[pts_count])
                                inside = True
                                break
                        if inside == False:
                            self.vals[z][y].append(0.0)
                    else:
                        self.vals[z][y].append(values[pts_count])
                    pts_count += 1
        
        self.highest_pt = self.return_highest_pt()
    
    
    def return_pt_val(self, pt):
        pt_trans = pt - self.bbox.Min
        x = int(math.floor(pt_trans.X/self.resolution))
        y = int(math.floor(pt_trans.Y/self.resolution))
        z = int(math.floor(pt_trans.Z/self.resolution))
        
        value = self.vals[z][y][x]
        return value
    
    def return_highest_pt(self):
        max_val = -1
        highest_pt = None
        
        for z in range(0, self.z_count):
            for y in range(0, self.y_count):
                for x in range(0, self.x_count):
                    value = self.vals[z][y][x]
                    if value > max_val:
                        max_val = value
                        highest_pt = self.pts[z][y][x]
        
        return highest_pt


#################################################################### Attribute
class Attribute(object):
    
    def __init__(self, name, values, transformable):
        
        self.name = name
        self.values = values
        self.transformable = transformable
    
    def transform(self, trans):
        if self.transformable == True:
            values_trans = []
            for val in self.values:
                if type(val) == rg.Point3d:
                    val_trans = rg.Point3d(val)
                else:
                    val_trans = val.Duplicate()
                val_trans.Transform(trans)
                values_trans.append(val_trans)
            attr_trans = Attribute(self.name, values_trans, self.transformable)
        else:
            attr_trans = Attribute(self.name, self.values, self.transformable)
        return attr_trans


#########################################################################
##                                 WIP                                 ##
#########################################################################

class Support(object):
    
    def __init__(self, support_directions):
        
        self.sup_dir = support_directions
    
    def is_intersecting(self, mesh):
        pass
    
    def transform(self, trans):
        sup_dir_trans = []
        for dir in self.sup_dir:
            dir_trans = dir.Duplicate()
            dir_trans.Transform(trans)
            sup_dir_trans.append(dir_trans)
        sup_trans = Support(sup_dir_trans)
        return sup_trans





#########################################################################
##                                 RUN                                 ##
#########################################################################

log = []

## add classes to scriptcontext (to make it available to other Gh components)
if RUN:
    
    sc.sticky['Connection'] = Connection
    log.append("Connection class created...")
    sc.sticky['Part'] = Part
    log.append("Part class created...")
    sc.sticky['Constrained_Part'] = Constrained_Part
    log.append("Constrained_Part class created...")
    sc.sticky['Rule'] = Rule
    log.append("Rule class created...")
    sc.sticky['Field'] = Field
    log.append("Field class created...")
    sc.sticky['Attribute'] = Attribute
    log.append("Attribute class created...")
    sc.sticky['Support'] = Support
    log.append("Support class created...")
    
    sc.sticky['model_tolerance'] = Rhino.RhinoDoc.ActiveDoc.ModelAbsoluteTolerance*5
    sc.sticky['WaspSetup'] = 1
    
    log.append("READY TO BUILD!")

else:
    log.append("Set RUN to True to initialize Wasp...")
# ---------- end waspsetup ----------
points = PointList(Points=pt, Size=Slider(1, range=0..1))

# ----
# Adding the brep geometry as attribute
# allows to carry it with the aggregation
toggle = BooleanToggle(True)
attribute = Wasp_Attribute(ID="baseGeo", VAL=brep, TR=toggle)  # -> ATTR; inputs VAL: list, TR: Boolean
# ---------- attribute: Python ----------
# Wasp: Discrete Design with Grasshopper plug-in (GPL) initiated by Andrea Rossi
# 
# This file is part of Wasp.
# 
# Copyright (c) 2017, Andrea Rossi <a.rossi.andrea@gmail.com>
# Wasp is free software; you can redistribute it and/or modify 
# it under the terms of the GNU General Public License as published 
# by the Free Software Foundation; either version 3 of the License, 
# or (at your option) any later version. 
# 
# Wasp is distributed in the hope that it will be useful,
# but WITHOUT ANY WARRANTY; without even the implied warranty of 
# MERCHANTABILITY or FITNESS FOR A PARTICULAR PURPOSE. See the 
# GNU General Public License for more details.
# 
# You should have received a copy of the GNU General Public License
# along with Wasp; If not, see <http://www.gnu.org/licenses/>.
# 
# @license GPL-3.0 <https://www.gnu.org/licenses/gpl.html>
#
# Significant parts of Wasp have been developed by Andrea Rossi
# as part of research on digital materials and discrete design at:
# DDU Digital Design Unit - Prof. Oliver Tessmann
# Technische Universität Darmstadt


#########################################################################
##                            COMPONENT INFO                           ##
#########################################################################

"""
Attribute to be attached to a part.
Could be geometry or any other kind of data (eg. text, numeric variables, color…).
If Geometry, Transformable must be set to True to mantain the geometry attached to the part during aggregation.
-
Provided by Wasp 0.0.03
    Args:
        ID: Name of the attribute
        VAL: Value of the attribute (any type of Gh-compatible data possible)
        TR: Transformable. Set it to True for Geometry, False for other types of data
    Returns:
        ATTR: Attribute instance to attach to a component
"""

ghenv.Component.Name = "Wasp_Attribute"
ghenv.Component.NickName = 'Attribute'
ghenv.Component.Message = 'VER 0.0.03\nSEP_17_2017'
ghenv.Component.IconDisplayMode = ghenv.Component.IconDisplayMode.application
ghenv.Component.Category = "Wasp"
ghenv.Component.SubCategory = "0 | Wasp"
try: ghenv.Component.AdditionalHelpFromDocStrings = "2"
except: pass

import scriptcontext as sc
import Rhino.Geometry as rg
import Grasshopper.Kernel as gh

def main(id, values, transformable = False):
    
    ## check if Wasp is setup
    if sc.sticky.has_key('WaspSetup'):
        
        check_data = True
        
        ##check inputs
        if id is None:
            id = 'ATTR_01'
            msg = "Default name 'ATTR_01' assigned to attribute"
            ghenv.Component.AddRuntimeMessage(gh.GH_RuntimeMessageLevel.Warning, msg)
        
        if len(values) == 0:
            check_data = False
            msg = "Please provide values for the attribute"
            ghenv.Component.AddRuntimeMessage(gh.GH_RuntimeMessageLevel.Warning, msg)
        
        if transformable is None:
            msg = "Transformable set to False by default"
            ghenv.Component.AddRuntimeMessage(gh.GH_RuntimeMessageLevel.Warning, msg)
        
        if transformable == True:
            val_count = 0
            for i in range(len(values)):
                try:
                    values[i].Transform(rg.Transform.Identity)
                except:
                    check_data = False
                    msg = "Value %d is not transformable"%(i)
                    ghenv.Component.AddRuntimeMessage(gh.GH_RuntimeMessageLevel.Error, msg)
        
        if check_data:
            attribute = sc.sticky['Attribute'](id, values, transformable)
            return attribute
        else:
            return -1
    
    else:
        ## throw warining
        msg = "You must run the SetupWasp component before starting to build!"
        ghenv.Component.AddRuntimeMessage(gh.GH_RuntimeMessageLevel.Warning, msg)
        return -1


result = main(ID, VAL, TR)

if result != -1:
    ATTR = result
# ---------- end attribute ----------

# ----
# Curve-based field
bbox = BoundingBox(Content=curve_path, Plane=PlaneXY(0, 0, 0))  # -> Box, Box_2
volume = Volume(Geometry=bbox.Box)  # -> Volume, Centroid
number_slider = Slider(2, range=0..10)
scale_nu = ScaleNU(
    Geometry=bbox.Box,
    Plane=volume.Centroid,
    ScaleX=Slider(1.25, range=0..10),
    ScaleY=Slider(1.25, range=0..10),
    ScaleZ=Slider(1.5, range=0..10))  # -> Geometry, Transform
fieldpts = Wasp_FieldPoints(BOU=scale_nu.Geometry, RES=number_slider)  # -> PTS, COUNT, BOX; inputs BOU: list of GeometryBase
# ---------- fieldpts: Python ----------
# Wasp: Discrete Design with Grasshopper plug-in (GPL) initiated by Andrea Rossi
# 
# This file is part of Wasp.
# 
# Copyright (c) 2017, Andrea Rossi <a.rossi.andrea@gmail.com>
# Wasp is free software; you can redistribute it and/or modify 
# it under the terms of the GNU General Public License as published 
# by the Free Software Foundation; either version 3 of the License, 
# or (at your option) any later version. 
# 
# Wasp is distributed in the hope that it will be useful,
# but WITHOUT ANY WARRANTY; without even the implied warranty of 
# MERCHANTABILITY or FITNESS FOR A PARTICULAR PURPOSE. See the 
# GNU General Public License for more details.
# 
# You should have received a copy of the GNU General Public License
# along with Wasp; If not, see <http://www.gnu.org/licenses/>.
# 
# @license GPL-3.0 <https://www.gnu.org/licenses/gpl.html>
#
# Significant parts of Wasp have been developed by Andrea Rossi
# as part of research on digital materials and discrete design at:
# DDU Digital Design Unit - Prof. Oliver Tessmann
# Technische Universität Darmstadt


#########################################################################
##                            COMPONENT INFO                           ##
#########################################################################

"""
Generate a 3d point grid to be fed to the field component
-
Provided by Wasp 0.0.03
    Args:
        BOU: List of geometries defining the boundaries of the field. Geometries must be closed breps or meshes.
        RES: Resolution (Dimension of each cell)
    Returns:
        PTS: Points for field
        COUNT: Cell counts in x, y and z directions
"""

ghenv.Component.Name = "Wasp_Field Points"
ghenv.Component.NickName = 'FieldPts'
ghenv.Component.Message = 'VER 0.0.03\nSEP_17_2017'
ghenv.Component.IconDisplayMode = ghenv.Component.IconDisplayMode.application
ghenv.Component.Category = "Wasp"
ghenv.Component.SubCategory = "0 | Wasp"
try: ghenv.Component.AdditionalHelpFromDocStrings = "4"
except: pass

import scriptcontext as sc
import Rhino.Geometry as rg
import Grasshopper.Kernel as gh
import math


def main(boundaries, resolution):
    
    ## check if Wasp is setup
    if sc.sticky.has_key('WaspSetup'):
        
        check_data = True
        
        ##check inputs
        if len(boundaries) == 0:
            check_data = False
            msg = "No boundary geometry provided"
            ghenv.Component.AddRuntimeMessage(gh.GH_RuntimeMessageLevel.Warning, msg)
        
        if resolution is None and len(boundaries) != 0:
            global_bbox = None
            for geo in boundaries:
                bbox = geo.GetBoundingBox(True)
                
                if global_bbox is None:
                    global_bbox = bbox
                else:
                    global_bbox.Union(bbox)
            
            x_size = global_bbox.Max.X - global_bbox.Min.X
            resolution = int(x_size / 10)
            
            msg = "No resolution provided. Default resolution set to %d"%(resolution)
            ghenv.Component.AddRuntimeMessage(gh.GH_RuntimeMessageLevel.Warning, msg)
            
        if check_data:
            global_bbox = None
            for geo in boundaries:
                bbox = geo.GetBoundingBox(True)
                
                if global_bbox is None:
                    global_bbox = bbox
                else:
                    global_bbox.Union(bbox)
            print global_bbox
            x_size = global_bbox.Max.X - global_bbox.Min.X
            x_count = int(math.ceil(x_size / resolution)) + 1
            y_size = global_bbox.Max.Y - global_bbox.Min.Y
            y_count = int(math.ceil(y_size / resolution)) + 1
            z_size = global_bbox.Max.Z - global_bbox.Min.Z
            z_count = int(math.ceil(z_size / resolution)) + 1
            
            count_vec = rg.Vector3d(x_count, y_count, z_count)
            
            pts = []
            s_pt = global_bbox.Min
            
            for z in range(z_count):
                for y in range(y_count):
                    for x in range(x_count):
                        pt = rg.Point3d(s_pt.X + x*resolution, s_pt.Y + y*resolution, s_pt.Z + z*resolution)
                        pts.append(pt)
            return pts, count_vec
            
        else:
            return -1
    
    else:
        ## throw warining
        msg = "You must run the SetupWasp component before starting to build!"
        ghenv.Component.AddRuntimeMessage(gh.GH_RuntimeMessageLevel.Warning, msg)
        return -1


result = main(BOU, RES)

if result != -1:
    PTS = result[0]
    COUNT = result[1]
# ---------- end fieldpts ----------
pt_2 = Point(fieldpts.PTS)
crv_cp = CurveClosestPoint(Point=pt_2, Curve=curve_path)  # -> Point, Parameter, Distance
bnd = Bounds(Numbers=crv_cp.Distance)
remap = RemapNumbers(Value=crv_cp.Distance, Source=bnd, Target=Domain(0, 1))  # -> Mapped, Clipped
graph = GraphMapper(remap.Mapped, x0=0, x1=1, y0=0, y1=1, container_name="Bezier", cpx=[0, 0, 0.4736814499, 1], cpy=[1, 0.5187824965, 0, 0])
field = Wasp_Field(BOU=scale_nu.Geometry, PTS=fieldpts.PTS, COUNT=fieldpts.COUNT, RES=number_slider, VAL=graph)  # -> FIELD; inputs BOU: list of GeometryBase, PTS: list of Point3d, COUNT: Vector3d, VAL: list
# ---------- field: Python ----------
# Wasp: Discrete Design with Grasshopper plug-in (GPL) initiated by Andrea Rossi
# 
# This file is part of Wasp.
# 
# Copyright (c) 2017, Andrea Rossi <a.rossi.andrea@gmail.com>
# Wasp is free software; you can redistribute it and/or modify 
# it under the terms of the GNU General Public License as published 
# by the Free Software Foundation; either version 3 of the License, 
# or (at your option) any later version. 
# 
# Wasp is distributed in the hope that it will be useful,
# but WITHOUT ANY WARRANTY; without even the implied warranty of 
# MERCHANTABILITY or FITNESS FOR A PARTICULAR PURPOSE. See the 
# GNU General Public License for more details.
# 
# You should have received a copy of the GNU General Public License
# along with Wasp; If not, see <http://www.gnu.org/licenses/>.
# 
# @license GPL-3.0 <https://www.gnu.org/licenses/gpl.html>
#
# Significant parts of Wasp have been developed by Andrea Rossi
# as part of research on digital materials and discrete design at:
# DDU Digital Design Unit - Prof. Oliver Tessmann
# Technische Universität Darmstadt


#########################################################################
##                            COMPONENT INFO                           ##
#########################################################################

"""
Generates a scalar field given a grid of points and their relative scalar values
-
Provided by Wasp 0.0.03
    Args:
        BOU: List of geometries defining the boundaries of the field. Geometries must be closed breps or meshes. All points of the field outside the geometries will be assigned a 0 value
        PTS: 3d point grid (from FieldPts component)
        COUNT: Vector storing cell counts for each axis (from FieldPts component)
        RES: Resolution of cell grid
        VAL: Values to assign to each cell
    Returns:
        FIELD: Field object (to be used to drive the FieldAggr component)
"""

ghenv.Component.Name = "Wasp_Field"
ghenv.Component.NickName = 'Field'
ghenv.Component.Message = 'VER 0.0.03\nSEP_17_2017'
ghenv.Component.IconDisplayMode = ghenv.Component.IconDisplayMode.application
ghenv.Component.Category = "Wasp"
ghenv.Component.SubCategory = "0 | Wasp"
try: ghenv.Component.AdditionalHelpFromDocStrings = "4"
except: pass

import scriptcontext as sc
import Rhino.Geometry as rg
import Grasshopper.Kernel as gh


def main(boundaries, pts, count, resolution, values):
    
    ## check if Wasp is setup
    if sc.sticky.has_key('WaspSetup'):
        
        check_data = True
        
        ##check inputs
        if len(boundaries) == 0:
            boundaries.append(rg.BoundingBox(pts).ToBrep())
            msg = "No boundary provided. Boundary set to point grid bounding box"
            ghenv.Component.AddRuntimeMessage(gh.GH_RuntimeMessageLevel.Warning, msg)
        
        if len(pts) == 0:
            check_data = False
            msg = "No point grid provided"
            ghenv.Component.AddRuntimeMessage(gh.GH_RuntimeMessageLevel.Warning, msg)
            
        elif len(values) == 0:
            check_data = False
            msg = "No value provided"
            ghenv.Component.AddRuntimeMessage(gh.GH_RuntimeMessageLevel.Warning, msg)
            
        elif len(pts) != len(values):
            check_data = False
            msg = "Points and Values lists are not matching. Please provide two lists with same number of elements"
            ghenv.Component.AddRuntimeMessage(gh.GH_RuntimeMessageLevel.Error, msg)
        
        if count is None:
            check_data = False
            msg = "No axis count provided"
            ghenv.Component.AddRuntimeMessage(gh.GH_RuntimeMessageLevel.Warning, msg)
        
        if resolution is None and check_data == True:
            resolution = pts[0].DistanceTo(pts[1])
            msg = "No resolution provided. Calculated resolution is %0.2f"%(resolution)
            ghenv.Component.AddRuntimeMessage(gh.GH_RuntimeMessageLevel.Warning, msg)
        
        if check_data:
            field = sc.sticky['Field'](boundaries, pts, count, resolution, values)
            return field
        else:
            return -1
    
    else:
        ## throw warining
        msg = "You must run the SetupWasp component before starting to build!"
        ghenv.Component.AddRuntimeMessage(gh.GH_RuntimeMessageLevel.Warning, msg)
        return -1


result = main(BOU, PTS, COUNT, RES, VAL)

if result != -1:
    FIELD = result
# ---------- end field ----------

conndir = Wasp_ConnectionFromDirection(GEO=brep, CEN=pt, UP=crv)  # -> CONN, PLN_OUT; inputs GEO: Brep, CEN: list of Point3d, UP: list of Curve, T: list
# ---------- conndir: Python ----------
# Wasp: Discrete Design with Grasshopper plug-in (GPL) initiated by Andrea Rossi
# 
# This file is part of Wasp.
# 
# Copyright (c) 2017, Andrea Rossi <a.rossi.andrea@gmail.com>
# Wasp is free software; you can redistribute it and/or modify 
# it under the terms of the GNU General Public License as published 
# by the Free Software Foundation; either version 3 of the License, 
# or (at your option) any later version. 
# 
# Wasp is distributed in the hope that it will be useful,
# but WITHOUT ANY WARRANTY; without even the implied warranty of 
# MERCHANTABILITY or FITNESS FOR A PARTICULAR PURPOSE. See the 
# GNU General Public License for more details.
# 
# You should have received a copy of the GNU General Public License
# along with Wasp; If not, see <http://www.gnu.org/licenses/>.
# 
# @license GPL-3.0 <https://www.gnu.org/licenses/gpl.html>
#
# Significant parts of Wasp have been developed by Andrea Rossi
# as part of research on digital materials and discrete design at:
# DDU Digital Design Unit - Prof. Oliver Tessmann
# Technische Universität Darmstadt


#########################################################################
##                            COMPONENT INFO                           ##
#########################################################################

"""
Create a connection on a given part geometry from center and X-asix direction
(Z direction is determined based on the normals of the component geometry)
-
Provided by Wasp 0.0.04
    Args:
        GEO: Geometry of the part to which the connection belongs
        CEN: Origin of the connection plane
        UP: Line idetifying the X-axis of the connection plane - determines the plane orientation to mantain when transforming
        T: OPTIONAL // Connection type (to be used with Rule Generator component)
    Returns:
        CONN: Connection object
        PLN_OUT: Plane for each connection object (for debugging)
"""

ghenv.Component.Name = "Wasp_Connection From Direction"
ghenv.Component.NickName = 'ConnDir'
ghenv.Component.Message = 'VER 0.0.04\nNOV_14_2017'
ghenv.Component.IconDisplayMode = ghenv.Component.IconDisplayMode.application
ghenv.Component.Category = "Wasp"
ghenv.Component.SubCategory = "0 | Wasp"
try: ghenv.Component.AdditionalHelpFromDocStrings = "2"
except: pass


import scriptcontext as sc
import Rhino.Geometry as rg
import Grasshopper.Kernel as gh

def main(part_geo, conn_centers, conn_ups, conn_type):
    
    ## check if Wasp is setup
    if sc.sticky.has_key('WaspSetup'):
        
        check_data = True
        
        ## check inputs
        if part_geo is None:
            check_data = False
            msg = "No part geometry provided"
            ghenv.Component.AddRuntimeMessage(gh.GH_RuntimeMessageLevel.Warning, msg)
        
        if len(conn_centers) != len(conn_ups):
            check_data = False
            msg = "Different amount of centers and up vectors provided"
            ghenv.Component.AddRuntimeMessage(gh.GH_RuntimeMessageLevel.Error, msg)
        
        types = []
        if len(conn_type) == 0:
            for i in range(len(conn_centers)):
                types.append("00")
        elif len(conn_type) == 1:
            for i in range(len(conn_centers)):
                types.append(conn_type[0])
        elif len(conn_centers) != len(conn_type):
            check_data = False
            msg = "Different amount of centers and types provided"
            ghenv.Component.AddRuntimeMessage(gh.GH_RuntimeMessageLevel.Error, msg)
        else:
            for i in range(len(conn_centers)):
                types.append(conn_type[i])
        
        ## execute main code if all needed inputs are available
        if check_data:
            connections = []
            out_planes = []
            for i in range(len(conn_centers)):
                
                center = conn_centers[i]
                up = conn_ups[i]
                plane = None
                
                up_start = rg.Vector3d(up.PointAtStart)
                up_end = rg.Vector3d(up.PointAtEnd)
                up_vec = rg.Vector3d.Subtract(up_end, up_start)
                
                for face in GEO.Faces:
                    pt_uv = face.ClosestPoint(center)
                    pt = face.PointAt(pt_uv[1], pt_uv[2])
                    dist = rg.Point3d.DistanceTo(center, pt)
                    if(dist < 0.001):
                        normal = face.NormalAt(pt_uv[1], pt_uv[2])
                        plane = rg.Plane(center, normal)
                        x_axis = plane.XAxis
                        angle = rg.Vector3d.VectorAngle(x_axis, up_vec, plane)
                        plane.Rotate(angle, normal)
                        break
                        
                if plane is None:
                    msg = "No valid plane provided for connection %d"%(i)
                    ghenv.Component.AddRuntimeMessage(gh.GH_RuntimeMessageLevel.Error, msg)
                else:
                    conn = sc.sticky['Connection'](plane, types[i], "", -1)
                    connections.append(conn)
                    out_planes.append(plane)
            
            return connections, out_planes
        
        else:
            return -1
            
    
    else:
        ## throw warining
        msg = "You must run the SetupWasp component before starting to build!"
        ghenv.Component.AddRuntimeMessage(gh.GH_RuntimeMessageLevel.Warning, msg)
        return -1


result = main(GEO, CEN, UP, T)

if result != -1:
    CONN = result[0]
    PLN_OUT = result[1]
# ---------- end conndir ----------
part = Wasp_BasicPart(NAME="P", GEO=brep, CONN=flatten(conndir.CONN), ATTR=attribute)  # -> PART; inputs GEO: Mesh, CONN: list, COLL: Mesh, ATTR: list
# ---------- part: Python ----------
# Wasp: Discrete Design with Grasshopper plug-in (GPL) initiated by Andrea Rossi
# 
# This file is part of Wasp.
# 
# Copyright (c) 2017, Andrea Rossi <a.rossi.andrea@gmail.com>
# Wasp is free software; you can redistribute it and/or modify 
# it under the terms of the GNU General Public License as published 
# by the Free Software Foundation; either version 3 of the License, 
# or (at your option) any later version. 
# 
# Wasp is distributed in the hope that it will be useful,
# but WITHOUT ANY WARRANTY; without even the implied warranty of 
# MERCHANTABILITY or FITNESS FOR A PARTICULAR PURPOSE. See the 
# GNU General Public License for more details.
# 
# You should have received a copy of the GNU General Public License
# along with Wasp; If not, see <http://www.gnu.org/licenses/>.
# 
# @license GPL-3.0 <https://www.gnu.org/licenses/gpl.html>
#
# Significant parts of Wasp have been developed by Andrea Rossi
# as part of research on digital materials and discrete design at:
# DDU Digital Design Unit - Prof. Oliver Tessmann
# Technische Universität Darmstadt


#########################################################################
##                            COMPONENT INFO                           ##
#########################################################################

"""
Create a basic Wasp Part to be used for aggregation
-
Provided by Wasp 0.0.03
    Args:
        NAME: Part name
        GEO: Part geometry. It will be converted to mesh - to improve performance, perform the conversion before adding to the part and user a low-poly count
        CONN: Connections list
        COLL: OPTIONAL // Collider geometry (for collision detection). A collider will be automatically generated. For complex parts, automatic generation might not work, and you can add a custom collider geometry here.
        ATTR: OPTIONAL // Part attributes
    Returns:
        PART: Part instance
"""

ghenv.Component.Name = "Wasp_Basic Part"
ghenv.Component.NickName = 'Part'
ghenv.Component.Message = 'VER 0.0.03\nSEP_17_2017'
ghenv.Component.IconDisplayMode = ghenv.Component.IconDisplayMode.application
ghenv.Component.Category = "Wasp"
ghenv.Component.SubCategory = "0 | Wasp"
try: ghenv.Component.AdditionalHelpFromDocStrings = "3"
except: pass

import scriptcontext as sc
import Rhino.Geometry as rg
import Grasshopper.Kernel as gh


def main(part_name, part_geo, connections, collider, attributes):
    
    ## check if Wasp is setup
    if sc.sticky.has_key('WaspSetup'):
        
        check_data = True
        
        ## check inputs
        if part_name is None:
            part_name = 'P1'
            msg = "Default name 'P1' assigned to part"
            ghenv.Component.AddRuntimeMessage(gh.GH_RuntimeMessageLevel.Warning, msg)
        
        if part_geo is None:
            check_data = False
            msg = "No part geometry provided"
            ghenv.Component.AddRuntimeMessage(gh.GH_RuntimeMessageLevel.Warning, msg)
            check_data = False
        
        if collider is None and part_geo is not None:
            collider = part_geo.Duplicate().Offset(sc.sticky['model_tolerance'])
            collider_intersection = rg.Intersect.Intersection.MeshMeshFast(collider, part_geo)
            if len(collider_intersection) > 0:
                collider = None
                collider = part_geo.Duplicate()
                center = part_geo.GetBoundingBox(True).Center
                scale_plane = rg.Plane(center, rg.Vector3d(1,0,0), rg.Vector3d(0,1,0))
                scale_transform = rg.Transform.Scale(scale_plane, 1-sc.sticky['model_tolerance'], 1-sc.sticky['model_tolerance'], 1-sc.sticky['model_tolerance'])
                collider.Transform(scale_transform)
                collider_intersection = rg.Intersect.Intersection.MeshMeshFast(collider, part_geo)
                if len(collider_intersection) > 0:
                    collider = None
                    msg = "Could not compute a valid collider geometry. Please provide a valid collider in the COLL input."
                    ghenv.Component.AddRuntimeMessage(gh.GH_RuntimeMessageLevel.Error, msg)
                    check_data = False
        
        if collider is not None and collider.Faces.Count > 1000:
            msg = "The computed collider has a high faces count. Consider providing a low poly collider to improve performance"
            ghenv.Component.AddRuntimeMessage(gh.GH_RuntimeMessageLevel.Warning, msg)
        
        
        if check_data:
            new_part = sc.sticky['Part'](part_name, part_geo, connections, collider, attributes)
            return new_part
        else:
            return -1
    
    else:
        ## throw warining
        msg = "You must run the SetupWasp component before starting to build!"
        ghenv.Component.AddRuntimeMessage(gh.GH_RuntimeMessageLevel.Warning, msg)
        return -1


result = main(NAME, GEO, CONN, COLL, ATTR)

if result != -1:
    PART = result
# ---------- end part ----------
rulegen = Wasp_RulesGenerator(PART=part)  # -> R; inputs PART: list, SELF_P: Boolean, SELF_C: Boolean
# ---------- rulegen: Python ----------
# Wasp: Discrete Design with Grasshopper plug-in (GPL) initiated by Andrea Rossi
# 
# This file is part of Wasp.
# 
# Copyright (c) 2017, Andrea Rossi <a.rossi.andrea@gmail.com>
# Wasp is free software; you can redistribute it and/or modify 
# it under the terms of the GNU General Public License as published 
# by the Free Software Foundation; either version 3 of the License, 
# or (at your option) any later version. 
# 
# Wasp is distributed in the hope that it will be useful,
# but WITHOUT ANY WARRANTY; without even the implied warranty of 
# MERCHANTABILITY or FITNESS FOR A PARTICULAR PURPOSE. See the 
# GNU General Public License for more details.
# 
# You should have received a copy of the GNU General Public License
# along with Wasp; If not, see <http://www.gnu.org/licenses/>.
# 
# @license GPL-3.0 <https://www.gnu.org/licenses/gpl.html>
#
# Significant parts of Wasp have been developed by Andrea Rossi
# as part of research on digital materials and discrete design at:
# DDU Digital Design Unit - Prof. Oliver Tessmann
# Technische Universität Darmstadt


#########################################################################
##                            COMPONENT INFO                           ##
#########################################################################

"""
Extract information from a Connection.
-
Provided by Wasp 0.0.04
    Args:
        PART: Parts from which to generate aggregation rules
        SELF_P: OPTIONAL // Create rules between connections belonging to the same part (True by default)
        SELF_C: OPTIONAL // Create rules between connection with same id (True by default)
    Returns:
        R: Generated aggregation rules
"""

ghenv.Component.Name = "Wasp_Rules Generator"
ghenv.Component.NickName = 'RuleGen'
ghenv.Component.Message = 'VER 0.0.04\nNOV_14_2017'
ghenv.Component.IconDisplayMode = ghenv.Component.IconDisplayMode.application
ghenv.Component.Category = "Wasp"
ghenv.Component.SubCategory = "0 | Wasp"
try: ghenv.Component.AdditionalHelpFromDocStrings = "2"
except: pass

import scriptcontext as sc
import Grasshopper.Kernel as gh

def main(parts, self_part, self_connection):
    ## check if Wasp is setup
    if sc.sticky.has_key('WaspSetup'):
        
        check_data = True
        
        ##check inputs
        if len(parts) == 0 or parts is None:
            check_data = False
            msg = "No part provided"
            ghenv.Component.AddRuntimeMessage(gh.GH_RuntimeMessageLevel.Warning, msg)
        
        if self_part == None:
            self_part = True
        
        if self_connection == None:
            self_connection = True
        
        if check_data:
            rules = []
            
            for part in parts:
                for conn in part.connections:
                    for other_part in parts:
                        skip_part = False
                        if self_part == False:
                            if part.name == other_part.name:
                                skip_part = True
                            
                        if skip_part == False:
                            for other_conn in other_part.connections:
                                skip_conn = False
                                if self_connection == False:
                                    if conn.id == other_conn.id:
                                        skip_conn = True
                                
                                if skip_conn == False:
                                    if conn.type == other_conn.type:
                                        r = sc.sticky['Rule'](part.name, conn.id, other_part.name, other_conn.id)
                                        rules.append(r)
            
            return [rules]
        else:
            return -1
    
    else:
        ## throw warining
        msg = "You must run the SetupWasp component before starting to build!"
        ghenv.Component.AddRuntimeMessage(gh.GH_RuntimeMessageLevel.Warning, msg)
        return -1



result = main(PART, SELF_P, SELF_C)

if result != -1:
    R = result[0]
# ---------- end rulegen ----------
gradient = Gradient(LowerLimit=0, UpperLimit=1, Parameter=graph, stops=[0: RGB(0, 128, 0), 0.5: RGB(255, 255, 0), 1: RGB(255, 0, 0)])

# ---- group: CONVERT TO PYTHON
fieldslice = Wasp_b01_ViewFieldSlice(
    field=field,
    pln=Slider(1, range=0..2),
    t=Slider(0.571, range=0..1),
    N=10,
    viewpoints=Toggle(False),
    viewcurves=Toggle(True))

# ----
preview = CustomPreview(Geometry=pt_2, Shader=gradient)
fieldaggregation = Wasp_FieldDrivenAggregation(
    PART=flatten(part),
    N=Slider(100, range=0..1000),
    RULES=rulegen,
    FIELD=field,
    THRES=Slider(0.9, range=0..1),
    RESET=Button())  # -> PART_OUT; inputs PART: list, PREV: list, N: Int32, RULES: list, COLL: Boolean, MODE: Int32, RESET: Boolean
# ---------- fieldaggregation: Python ----------
# Wasp: Discrete Design with Grasshopper plug-in (GPL) initiated by Andrea Rossi
# 
# This file is part of Wasp.
# 
# Copyright (c) 2017, Andrea Rossi <a.rossi.andrea@gmail.com>
# Wasp is free software; you can redistribute it and/or modify 
# it under the terms of the GNU General Public License as published 
# by the Free Software Foundation; either version 3 of the License, 
# or (at your option) any later version. 
# 
# Wasp is distributed in the hope that it will be useful,
# but WITHOUT ANY WARRANTY; without even the implied warranty of 
# MERCHANTABILITY or FITNESS FOR A PARTICULAR PURPOSE. See the 
# GNU General Public License for more details.
# 
# You should have received a copy of the GNU General Public License
# along with Wasp; If not, see <http://www.gnu.org/licenses/>.
# 
# @license GPL-3.0 <https://www.gnu.org/licenses/gpl.html>
#
# Significant parts of Wasp have been developed by Andrea Rossi
# as part of research on digital materials and discrete design at:
# DDU Digital Design Unit - Prof. Oliver Tessmann
# Technische Universität Darmstadt


#########################################################################
##                            COMPONENT INFO                           ##
#########################################################################

"""
Aggregate the given parts according to a given scalar field. New parts are added following higher values in the field.
The component works additively, hence increasing the number of parts in an aggregation just adds new parts on the existing ones, without triggering recomputing of the previous element
-
Provided by Wasp 0.0.04
    Args:
        PART: Parts to be aggregated (can be more than one)
        PREV: Previous aggregated parts. It is possible to input the results of a previous aggregation, or parts transformed with the TransformPart component
        N: Number of parts to be aggregated (does not count parts provided in PREV)
        RULES: Rules for the aggregation
        FIELD: Scalar field to drive the aggregation (parts will be added following higher values in the field)
        THRES: OPTIONAL // If set, used to define a threshold value above which the placement of next part is accepted. If not set, aggregation will look for part with highest value in the whole field. Setting a low threshold helds less accurate results, but highly speeds up calculations
        COLL: OPTIONAL // Collision detection. By default is active and checks for collisions between the aggregated parts
        ID: OPTIONAL // Aggregation ID (to avoid overwriting when having different aggregation components in the same file)
        RESET: Recompute the whole aggregation
    Returns:
        PART_OUT: Aggregated parts (includes both PREV input and newly aggregated parts)
"""

ghenv.Component.Name = "Wasp_Field-driven Aggregation"
ghenv.Component.NickName = 'FieldAggregation'
ghenv.Component.Message = 'VER 0.0.04\nNOV_19_2017'
ghenv.Component.IconDisplayMode = ghenv.Component.IconDisplayMode.application
ghenv.Component.Category = "Wasp"
ghenv.Component.SubCategory = "0 | Wasp"
try: ghenv.Component.AdditionalHelpFromDocStrings = "5"
except: pass


import scriptcontext as sc
import Rhino.Geometry as rg
import Grasshopper.Kernel as gh
import random as rnd
import math
import copy


## find the rule that creates a component as closest as possible to the target surface
def findBestRule(aggr_id, aggr_parts, aggr_field, thres, aggr_coll):
    max_val = 0
    best_rule = None
    best_conn = None
    best_conn_id = -1
    
    for i in range(len(sc.sticky[aggr_id])):
        part_01 = sc.sticky[aggr_id][i]
        for i2 in range(len(part_01.active_connections)-1, -1, -1):
            conn_01_id = part_01.active_connections[i2]
            conn_01 = part_01.connections[conn_01_id]
            for i3 in range(len(conn_01.active_rules)-1, -1, -1):
                rule_id = conn_01.active_rules[i3]
                rule = conn_01.rules_table[rule_id]
                
                next_part = None
                for part in aggr_parts:
                    if part.name == rule.part2:
                        next_part = part
                        break
                        
                next_center = rg.Point3d(next_part.center)
                orientTransform = rg.Transform.PlaneToPlane(next_part.connections[rule.conn2].flip_pln, conn_01.pln)
                next_center.Transform(orientTransform)
                
                if aggr_field.bbox.Contains(next_center) == True:
                    current_target_val = aggr_field.return_pt_val(next_center)
                    if current_target_val > max_val:
                        close_neighbour_check = False
                        for ex_part in sc.sticky[aggr_id]:
                            dist = ex_part.center.DistanceTo(next_center)
                            if dist < sc.sticky['model_tolerance']:
                                close_neighbour_check = True
                                break
                        
                        collision_check = False
                        if aggr_coll == True and close_neighbour_check == False:
                            next_part_collider = next_part.transform_collider(orientTransform)
                            for ex_part in sc.sticky[aggr_id]:
                                if len(rg.Intersect.Intersection.MeshMeshFast(ex_part.collider, next_part_collider)) > 0:
                                    collision_check = True
                                    break
                        
                        if close_neighbour_check == False and collision_check == False:
                            max_val = current_target_val
                            best_rule = rule
                            best_conn = conn_01
                            best_part_id = i
                            best_conn_id = conn_01_id
                            
                            if thres is not None and max_val > thres:
                                break
                            
                        else:
                            ## remove rules if they cause collisions or overlappings
                            for i4 in range(len(sc.sticky[aggr_id][i].connections[conn_01_id].active_rules)):
                               if sc.sticky[aggr_id][i].connections[conn_01_id].active_rules[i4] == rule_id:
                                   sc.sticky[aggr_id][i].connections[conn_01_id].active_rules.pop(i4)
                                   break
                            ## check if the connection is still active (still active rules available)
                            if len(sc.sticky[aggr_id][i].connections[conn_01_id].active_rules) == 0:
                               for i4 in range(len(sc.sticky[aggr_id][i].active_connections)):
                                if sc.sticky[aggr_id][i].active_connections[i4] == conn_01_id:
                                    sc.sticky[aggr_id][i].active_connections.pop(i4)
                                    break
            if thres is not None and max_val > thres:
                break
        if thres is not None and max_val > thres:
            break
    
    if best_rule is not None:
        return best_conn, best_part_id, best_conn_id, best_rule.part2, best_rule.conn2, best_rule
    else:
        return -1, -1, -1, -1, -1, -1



def aggregate_field(aggr_id, aggr_parts, aggr_rules, aggr_field, aggr_threshold, aggr_coll, iter):
    count = 0
    loops = 0
    while count < iter:
        ## if no part is present in the aggregation, add first random part
        if len(sc.sticky[aggr_id]) == 0:
            count += 1
            first_part = aggr_parts[rnd.randint(0, len(aggr_parts)-1)]
            
            start_point = aggr_field.highest_pt
            mov_vec = rg.Vector3d.Subtract(rg.Vector3d(start_point), rg.Vector3d(first_part.center))
            move_transform = rg.Transform.Translation(mov_vec.X, mov_vec.Y, mov_vec.Z)
            first_part_trans = first_part.transform(move_transform)
            
            for conn in first_part_trans.connections:
                conn.generate_rules_table(aggr_rules)
            
            sc.sticky[aggr_id].append(first_part_trans)
        
        else:
            ## select part-rule couple creating next part in the highest point of field
            conn_01, part_01_id, conn_01_id, next_part_name, next_conn_id, next_rule = findBestRule(aggr_id, aggr_parts, aggr_field, aggr_threshold, aggr_coll)
            
            if conn_01_id == -1:
                msg = "aborted after " + str(count) + " iterations"
                ghenv.Component.AddRuntimeMessage(gh.GH_RuntimeMessageLevel.Warning, msg)
                break
            
            next_part = None
            for part in aggr_parts:
                if part.name == next_part_name:
                    next_part = part
            
            orientTransform = rg.Transform.PlaneToPlane(next_part.connections[next_conn_id].flip_pln, conn_01.pln)
            next_part_center = next_part.transform_center(orientTransform)
            
            next_part_trans = next_part.transform(orientTransform)
            next_part_trans.reset_part(aggr_rules)
            for i in range(len(next_part_trans.active_connections)):
                if next_part_trans.active_connections[i] == next_rule.conn2:
                    next_part_trans.active_connections.pop(i)
                    break
            sc.sticky[aggr_id].append(next_part_trans)
            
            count += 1
            if count == iter:
                print "successfully completed all " + str(count) + " iterations"



def main(parts, previous_parts, num_parts, rules, field, threshold, collision, aggregation_id, reset):
    
    ## check if Wasp is setup
    if sc.sticky.has_key('WaspSetup'):
        
        check_data = True
        ##check inputs
        if len(parts) == 0:
            check_data = False
            msg = "No parts provided"
            ghenv.Component.AddRuntimeMessage(gh.GH_RuntimeMessageLevel.Warning, msg)
        
        if num_parts is None:
            check_data = False
            msg = "Provide number of aggregation iterations"
            ghenv.Component.AddRuntimeMessage(gh.GH_RuntimeMessageLevel.Warning, msg)
        else:
            if len(previous_parts) != 0:
                num_parts += len(previous_parts)
        
        if len(rules) == 0:
            check_data = False
            msg = "No rules provided"
            ghenv.Component.AddRuntimeMessage(gh.GH_RuntimeMessageLevel.Warning, msg)
        
        if field is None:
            check_data = False
            msg = "Provide a valid scalar field"
            ghenv.Component.AddRuntimeMessage(gh.GH_RuntimeMessageLevel.Warning, msg)
        
        if collision is None:
            collision = True
        
        if aggregation_id is None:
            aggregation_id = 'Aggregation'
        
        if reset is None:
            reset = False
        
        if check_data:
            if sc.sticky.has_key(aggregation_id) == False:
                sc.sticky[aggregation_id] = []
            
            if reset:
                sc.sticky[aggregation_id] = []
                
                for part in parts:
                    part.reset_part(rules)
                
                if len(previous_parts) > 0:
                    for part in previous_parts:
                        part.reset_part(rules)
                        sc.sticky[aggregation_id].append(part)
            
            if num_parts > len(sc.sticky[aggregation_id]):
                aggregate_field(aggregation_id, parts, rules, field, threshold, collision, num_parts - len(sc.sticky[aggregation_id]))
            
            elif num_parts < len(sc.sticky[aggregation_id]):
                sc.sticky[aggregation_id] = sc.sticky[aggregation_id][:num_parts]
                for part in sc.sticky[aggregation_id]:
                    part.reset_part(rules)
                
                for part in parts:
                    part.reset_part(rules)
            
            return sc.sticky[aggregation_id]
            
        else:
            return -1
    
    else:
        ## throw warining
        msg = "You must run the SetupWasp component before starting to build!"
        ghenv.Component.AddRuntimeMessage(gh.GH_RuntimeMessageLevel.Warning, msg)
        return -1


result = main(PART, PREV, N, RULES, FIELD, THRES, COLL, ID, RESET)

if result != -1:
    PART_OUT = result
# ---------- end fieldaggregation ----------
depart = Wasp_DeconstructPart(PART=fieldaggregation)  # -> NAME, GEO, CONN, CONN_PLN, TR, CHILD, ATTR; inputs PART: list
# ---------- depart: Python ----------
# Wasp: Discrete Design with Grasshopper plug-in (GPL) initiated by Andrea Rossi
# 
# This file is part of Wasp.
# 
# Copyright (c) 2017, Andrea Rossi <a.rossi.andrea@gmail.com>
# Wasp is free software; you can redistribute it and/or modify 
# it under the terms of the GNU General Public License as published 
# by the Free Software Foundation; either version 3 of the License, 
# or (at your option) any later version. 
# 
# Wasp is distributed in the hope that it will be useful,
# but WITHOUT ANY WARRANTY; without even the implied warranty of 
# MERCHANTABILITY or FITNESS FOR A PARTICULAR PURPOSE. See the 
# GNU General Public License for more details.
# 
# You should have received a copy of the GNU General Public License
# along with Wasp; If not, see <http://www.gnu.org/licenses/>.
# 
# @license GPL-3.0 <https://www.gnu.org/licenses/gpl.html>
#
# Significant parts of Wasp have been developed by Andrea Rossi
# as part of research on digital materials and discrete design at:
# DDU Digital Design Unit - Prof. Oliver Tessmann
# Technische Universität Darmstadt


#########################################################################
##                            COMPONENT INFO                           ##
#########################################################################

"""
Extract all information stored in a part. Useful for visualization or for further geometry processing
-
Provided by Wasp 0.0.03
    Args:
        PART: Parts to deconstruct
    Returns:
        NAME: Name of the part
        GEO: Geometry of the part (as mesh). If Brep geometry is needed, can be stored in the component as attribute, or obtained by transforming the original geometry with the TR output.
        CONN: Part connections
        CONN_PLN: planes for each part connection
        TR: Transformation applied to the part. Can be used to transform other geometries in a similar way (eg. replace a low poly component with a more detailed one)
        CHILD: Children parts attached to the part
        ATTR: Part attributes
"""

ghenv.Component.Name = "Wasp_Deconstruct Part"
ghenv.Component.NickName = 'DePart'
ghenv.Component.Message = 'VER 0.0.03\nSEP_17_2017'
ghenv.Component.IconDisplayMode = ghenv.Component.IconDisplayMode.application
ghenv.Component.Category = "Wasp"
ghenv.Component.SubCategory = "0 | Wasp"
try: ghenv.Component.AdditionalHelpFromDocStrings = "3"
except: pass


import scriptcontext as sc
import Grasshopper.Kernel as gh
from Grasshopper import DataTree
from Grasshopper.Kernel.Data import GH_Path


## from http://www.chenjingcheng.com/grasshopper-python-datatree-list-conversion/
def listToDataTree(list):
    rl = list
    result = DataTree[object]()
    for i in range(len(rl)):
        temp = []
        for j in range(len(rl[i])):
            temp.append(rl[i][j])
        path = GH_Path(i)
        result.AddRange(temp, path)
    return result



NAME = []
GEO = []
TR = []
ADD_COLL = []
ATTR = []

conn_list = []
conn_pln_list = []
children_list = []
attributes_list = []
print PART
if len(PART) == 0:
    msg = "No part provided"
    ghenv.Component.AddRuntimeMessage(gh.GH_RuntimeMessageLevel.Warning, msg)
elif PART[0] is None:
    msg = "Provided part is null"
    ghenv.Component.AddRuntimeMessage(gh.GH_RuntimeMessageLevel.Warning, msg)
else:
    for comp in PART:
        
        data_dict = comp.return_part_data()
        
        NAME.append(data_dict['name'])
        GEO.append(data_dict['geo'])
        conn_list.append(data_dict['connections'])
        
        conn_pln_list.append([])
        for conn in data_dict['connections']:
            conn_pln_list[len(conn_pln_list)-1].append(conn.pln)
        
        if "transform" in data_dict.keys():
            TR.append(data_dict['transform'])
        
        if "add_collider" in data_dict.keys():
            ADD_COLL.append(data_dict['add_collider'])
        
        if "children" in data_dict.keys():
            children_list.append(data_dict['children'])
        
        if "attributes" in data_dict.keys():
            attributes_list.append(data_dict['attributes'])
        
    
    CONN = listToDataTree(conn_list)
    CONN_PLN = listToDataTree(conn_pln_list)
    CHILD = listToDataTree(children_list)
    ATTR = listToDataTree(attributes_list)
# ---------- end depart ----------

# ----
# Extracting the attribute containing
# the base brep geometry
panel = Panel("baseGeo")
getattr = Wasp_GetAttributeByName(ATTR=depart.ATTR, ID=panel)  # -> VAL; inputs ATTR: list
# ---------- getattr: Python ----------
# Wasp: Discrete Design with Grasshopper plug-in (GPL) initiated by Andrea Rossi
# 
# This file is part of Wasp.
# 
# Copyright (c) 2017, Andrea Rossi <a.rossi.andrea@gmail.com>
# Wasp is free software; you can redistribute it and/or modify 
# it under the terms of the GNU General Public License as published 
# by the Free Software Foundation; either version 3 of the License, 
# or (at your option) any later version. 
# 
# Wasp is distributed in the hope that it will be useful,
# but WITHOUT ANY WARRANTY; without even the implied warranty of 
# MERCHANTABILITY or FITNESS FOR A PARTICULAR PURPOSE. See the 
# GNU General Public License for more details.
# 
# You should have received a copy of the GNU General Public License
# along with Wasp; If not, see <http://www.gnu.org/licenses/>.
# 
# @license GPL-3.0 <https://www.gnu.org/licenses/gpl.html>
#
# Significant parts of Wasp have been developed by Andrea Rossi
# as part of research on digital materials and discrete design at:
# DDU Digital Design Unit - Prof. Oliver Tessmann
# Technische Universität Darmstadt


#########################################################################
##                            COMPONENT INFO                           ##
#########################################################################

"""
Extract values stored in an atrribute
-
Provided by Wasp 0.0.04
    Args:
        ATTR: Attributes list to search
        ID: Name of the attribute to extract
    Returns:
        VAL: Value stored in the requested attribute
"""

ghenv.Component.Name = "Wasp_Get Attribute by Name"
ghenv.Component.NickName = 'GetAttr'
ghenv.Component.Message = 'VER 0.0.04\nNOV_16_2017'
ghenv.Component.IconDisplayMode = ghenv.Component.IconDisplayMode.application
ghenv.Component.Category = "Wasp"
ghenv.Component.SubCategory = "0 | Wasp"
try: ghenv.Component.AdditionalHelpFromDocStrings = "2"
except: pass


if ATTR is None:
    msg = "No attribute provided"
    ghenv.Component.AddRuntimeMessage(gh.GH_RuntimeMessageLevel.Warning, msg)
else:
    VAL = []
    for attr in ATTR:
        if attr.name == ID:
            VAL = attr.values
# ---------- end getattr ----------

preview_2 = CustomPreview(
    Geometry=depart.GEO,
    Shader={ambient=RGB(0, 0, 0), diffuse=RGB(255, 105, 180), emission=RGB(76, 32, 54), shine=0.5, specular=RGB(255, 255, 255), transparency=0})
transformed_breps = Brep(getattr)

# ==== cluster Wasp_b01_ViewFieldSlice
N = ClusterInput()
field = ClusterInput()
pln = ClusterInput()
t = ClusterInput()
fieldsize = PythonScript(FIELD=field)  # -> X_COUNT, Y_COUNT, Z_COUNT
# ---------- fieldsize: Python ----------
X_COUNT = FIELD.x_count
Y_COUNT = FIELD.y_count
Z_COUNT = FIELD.z_count
# ---------- end fieldsize ----------
fieldslice = PythonScript(FIELD=field, PLN=pln, t=t)  # -> out, PTS, VALS
# ---------- fieldslice: Python ----------
import Rhino
import math

PTS = []
VALS = []

t = min(t,0.999)

if PLN == 0:
    slice_id = int(math.floor(FIELD.z_count*t))
    
    for y in range(0, FIELD.y_count):
        for x in range(0, FIELD.x_count):
            PTS.append(FIELD.pts[slice_id][y][x])
            VALS.append(FIELD.vals[slice_id][y][x])
    
elif PLN == 1:
    slice_id = int(math.floor(FIELD.y_count*t))
    for z in range(0, FIELD.z_count):
        for x in range(0, FIELD.x_count):
            PTS.append(FIELD.pts[z][slice_id][x])
            VALS.append(FIELD.vals[z][slice_id][x])
    
elif PLN == 2:
    slice_id = int(math.floor(FIELD.x_count*t))
    for z in range(0, FIELD.z_count):
        for y in range(0, FIELD.y_count):
            PTS.append(FIELD.pts[z][y][slice_id])
            VALS.append(FIELD.vals[z][y][slice_id])
# ---------- end fieldslice ----------
xy = XYPlane(Origin=Point(0, 0, 0))
xz = XZPlane(Origin=Point(0, 0, 0))
yz = YZPlane(Origin=Point(0, 0, 0))
range = Range(Domain=Domain(0, 1), Steps=N)
filter = StreamFilter(Gate=pln, Stream0=fieldsize.Y_COUNT, Stream1=fieldsize.Z_COUNT, Stream2=fieldsize.Z_COUNT)
filter_2 = StreamFilter(Gate=pln, Stream0=xy, Stream1=xz, Stream2=yz)
deplane = DeconstructPlane(Plane=filter_2)  # -> Origin, XAxis, YAxis, ZAxis
amp = Amplitude(Vector=deplane.ZAxis, Amplitude=fieldslice.VALS)
move = Move(Geometry=fieldslice.PTS, Motion=amp)  # -> Geometry, Transform
srfgrid = SurfaceFromPoints(Points=move.Geometry, UCount=filter, Interpolate=False)
bbox = BoundingBox(Content=srfgrid, Plane=filter_2)  # -> Box, Box_2
debrep = DeconstructBrep(Brep=bbox.Box)  # -> Faces, Edges, Vertices
gradient = Gradient(LowerLimit=0, UpperLimit=1, Parameter=range, stops=[0: RGB(0, 128, 0), 0.5: RGB(255, 255, 0), 1: RGB(255, 0, 0)])
# EXTRA - WORK IN PROGRESS
gradient_2 = Gradient(
    LowerLimit=0,
    UpperLimit=1,
    Parameter=fieldslice.VALS,
    stops=[0: RGB(0, 128, 0), 0.5: RGB(255, 255, 0), 1: RGB(255, 0, 0)])
item = ListItem(List=debrep.Vertices, Index=0, Wrap=True)
pl_origin = PlaneOrigin(Base=filter_2, Origin=item)
amp_2 = Amplitude(Vector=deplane.ZAxis, Amplitude=range)
move_2 = Move(Geometry=pl_origin, Motion=amp_2)  # -> Geometry, Transform
sec = BrepPlane(Brep=srfgrid, Plane=move_2.Geometry)  # -> Curves, Points
viewpoints = ClusterInput()
viewcurves = ClusterInput()
filter_3 = StreamFilter(Gate=viewpoints, Stream1=fieldslice.PTS)
filter_4 = StreamFilter(Gate=viewcurves, Stream1=sec.Curves)
preview = CustomPreview(Geometry=filter_3, Shader=gradient_2)
preview_2 = CustomPreview(Geometry=filter_4, Shader=graft(gradient))
