# Grasshopper definition 180619_WASP_Dev.gh (Grasshopper 1.0.5)
# plug-ins: MeshEdit Components, Human

support_points = Curve([<curve referenced from the Rhino model> x6])
boundary = Brep([<brep referenced from the Rhino model> x2])
conn_center = Point([<point referenced from the Rhino model> x12])
comp_geo = Brep(<brep referenced from the Rhino model>)
conn_up = Curve([<curve referenced from the Rhino model> x12])
conn_center_2 = Point([<point referenced from the Rhino model> x6])
wspexport = Wsp_ExportUserObjects(UO=flatten("*"), VER="0.2.0", DIR="D:\Wasp", RUN=Toggle(False), REPLACE=Toggle(False))  # -> out, a; inputs UO: list, RUN: Boolean, REPLACE: Boolean
# ---------- wspexport: Python ----------
#########################################################################
##                            COMPONENT INFO                           ##
#########################################################################

"""
Description + license here
-
Provided by Wasp 0.0.02
    Args:
        UO: Description...
        DIR: Description...
        RUN: Description...
    Returns:
        log: log
"""

ghenv.Component.Name = "Wsp_Export User Objects"
ghenv.Component.NickName = 'WspExport'
ghenv.Component.Message = 'VER 0.0.03\nSEP_18_2017'
ghenv.Component.IconDisplayMode = ghenv.Component.IconDisplayMode.name
ghenv.Component.Category = ""
ghenv.Component.SubCategory = ""
try: ghenv.Component.AdditionalHelpFromDocStrings = "1"
except: pass



#########################################################################
##                               IMPORTS                               ##
#########################################################################
import Grasshopper.Folders as folders
import Grasshopper.Kernel as gh
import scriptcontext as sc
import shutil
import os
import uuid

UOFolder = folders.UserObjectFolders[0]
cs = gh.GH_ComponentServer()

exposureDict = {0 : ghenv.Component.Exposure.dropdown,
                1 : ghenv.Component.Exposure.primary,
                2 : ghenv.Component.Exposure.secondary,
                3 : ghenv.Component.Exposure.tertiary,
                4 : ghenv.Component.Exposure.quarternary,
                5 : ghenv.Component.Exposure.quinary,
                6 : ghenv.Component.Exposure.senary,
                7 : ghenv.Component.Exposure.septenary
                }


def exportToUserObject(component, targetFolder):
    targetFolder = os.path.join(targetFolder, "userObjects")
    if not os.path.isdir(targetFolder): os.mkdir(targetFolder)
    
    # check if the userObject is already existed in the folder
    try:
        filePath = os.path.join(UOFolder, component.Name + ".ghuser")
        currentUO = gh.GH_UserObject(filePath)
    except:
        # the userobject is not there so just create it
        currentUO = None
    
    if currentUO!=None:
        if not component.Category == "Maths":
            removeNicely = cs.RemoveCachedObject(filePath)
            if not removeNicely: os.remove(filePath)
        else:
            # there is already a newer version so just copy that to the folder instead
            # and return
            dstFullPath = os.path.join(targetFolder, component.Name + ".ghuser")
            shutil.copy2(filePath, dstFullPath)
            return
    
    # create the new userObject in Grasshopper folder
    uo = gh.GH_UserObject()
    uo.Icon = component.Icon_24x24
    
    try: uo.Exposure = exposureDict[int(component.AdditionalHelpFromDocStrings)]
    except:
        try:
            compCode = component.Code
            # this is so dirty
            exposureNumber = compCode.split("ghenv.Component.AdditionalHelpFromDocStrings")[1].split("\n")[0].replace("=", "").replace('"', "").strip()
            uo.Exposure = exposureDict[int(exposureNumber)]
            
        except:
            uo.Exposure = exposureDict[int(1)]
    
    uo.BaseGuid = component.ComponentGuid
    uo.Description.Name = component.Name
    uo.Description.Description = component.Description
    
    # if user hasn't identified the category then put it into honeybee as an unknown!
    if component.Category == "Maths":
        uo.Description.Category = "Honeybee"
    else:
        uo.Description.Category = component.Category
        
    if component.SubCategory == "Script":
        uo.Description.SubCategory = "UnknownBees"
    else:
        uo.Description.SubCategory = component.SubCategory
    
    uo.CreateDefaultPath(True)
    uo.SetDataFromObject(component)
    uo.SaveToFile()
    
    # copy the component over
    dstFullPath = os.path.join(targetFolder, component.Name + ".ghuser")
    shutil.copy2(filePath, dstFullPath)
    
    gh.GH_ComponentServer.UpdateRibbonUI()
    
    print "UserObject successfully added to: "

def exportToFile(component, targetFolder, replace, version = None):
    
    targetFolder = os.path.join(targetFolder, "src")
    if not os.path.isdir(targetFolder): os.mkdir(targetFolder)
    
    if component.Name.find("Wasp")>=0:
        print component.Name
        if component.Locked == False:
            if version is None or (component.Message.find(version)>=0 and version is not None):
                fileName = component.Name + ".py"
                
                # code inside the component
                code = component.Code
                
                # check if the file already exist
                if replace == False:
                    if os.path.isfile(os.path.join(targetFolder, fileName)):
                        return False
                
                with open(os.path.join(targetFolder, fileName), "w") as pyoutf:
                    if isinstance(code, unicode):
                        code = code.encode('ascii','ignore').replace("\r", "")
                    pyoutf.write(code)
                
                print "Exported " + fileName + " to: " + os.path.join(targetFolder, fileName)
                return True

def getListOfConnectedComponents(componentInputParamIndex = 0, onlyGHPython = True):
    # this function is edited version of Guilio's code from here:
    # [github link]
    components = []
    
    param = ghenv.Component.Params.Input[componentInputParamIndex]
    sources = param.Sources
    if sources.Count == 0: return components
    
    for source in sources:
        attr = source.Attributes
        if (attr is None) or (attr.GetTopLevel is None):
            pass
        else:
            component = attr.GetTopLevel.DocObject
    
    if component == None or (onlyGHPython and type(component) != type(ghenv.Component)):
            #collect only python components
            pass
    else:
        components.append(component)
    
    return components

def getAllTheComponents(onlyGHPython = True):
    components = []
    
    document = ghenv.Component.OnPingDocument()
    
    for component in document.Objects:
        if onlyGHPython and type(component)!= type(ghenv.Component):
            pass
        else:
            components.append(component)
    
    return components


def main(components, current_version, targetFolder, replace_files):
    if not os.path.isdir(targetFolder): os.mkdir(targetFolder)
        
    if components[0] == "*":
        ghComps = getAllTheComponents()
    else:
        ghComps = getListOfConnectedComponents()
    
    if len(ghComps)== 0: return "Found 0 components!"
    
    for ghComp in ghComps:
        fileExported = exportToFile(ghComp, targetFolder, replace_files, version = current_version)
        if fileExported:
            exportToUserObject(ghComp, targetFolder)


if RUN and len(UO)!=0 and DIR!=None:
    msg = main(UO, VER, DIR, REPLACE)
    ghenv.Component.AddRuntimeMessage(gh.GH_RuntimeMessageLevel.Warning, msg)
else:
    print "At the minimum one of the components are missing!"
# ---------- end wspexport ----------
xy = XYPlane(Origin=Point(0, 0, 0))
comp_geo_2 = Brep(<brep referenced from the Rhino model>)
conn_up_2 = Curve([<curve referenced from the Rhino model> x6])
brep = Brep([<brep referenced from the Rhino model> x2])
custom_mesh_settings = SettingsCustom(
    StitchSeams=True,
    SimplePlanes=False,
    Refine=True,
    MinCount=16,
    MaxCount=400,
    AspectRatio=20,
    MaxDistance=0,
    MaxAngle=20,
    MinEdge=0,
    MaxEdge=0)
custom_mesh_settings_2 = SettingsCustom(
    StitchSeams=True,
    SimplePlanes=False,
    Refine=True,
    MinCount=16,
    MaxCount=400,
    AspectRatio=20,
    MaxDistance=0,
    MaxAngle=20,
    MinEdge=0,
    MaxEdge=0)
cell_size = Slider(20, range=0..100)

# ---- group: OK
waspsetup = Wasp_Setup(RUN=Toggle(True))  # -> log; inputs RUN: Boolean
# ---------- waspsetup: Python ----------
# Wasp: Discrete Design with Grasshopper plug-in (GPL) initiated by Andrea Rossi
# 
# This file is part of Wasp.
# 
# Copyright (c) 2017, Andrea Rossi <a.rossi.andrea@gmail.com>
# Wasp is free software; you can redistribute it and/or modify 
# it under the terms of the GNU General Public License as published 
# by the Free Software Foundation; either version 3 of the License, 
# or (at your option) any later version. 
# 
# Wasp is distributed in the hope that it will be useful,
# but WITHOUT ANY WARRANTY; without even the implied warranty of 
# MERCHANTABILITY or FITNESS FOR A PARTICULAR PURPOSE. See the 
# GNU General Public License for more details.
# 
# You should have received a copy of the GNU General Public License
# along with Wasp; If not, see <http://www.gnu.org/licenses/>.
# 
# @license GPL-3.0 <https://www.gnu.org/licenses/gpl.html>
#
# Significant parts of Wasp have been developed by Andrea Rossi
# as part of research on digital materials and discrete design at:
# DDU Digital Design Unit - Prof. Oliver Tessmann
# Technische Universität Darmstadt


#########################################################################
##                            COMPONENT INFO                           ##
#########################################################################
"""
This components initialized all classes and variables required by Wasp to run.
You must run this component before starting to work with Wasp, or other components will not work properly.

-
Wasp: Discrete Design with Grasshopper plug-in (GPL) initiated by Andrea Rossi
You should have received a copy of the GNU General Public License
along with Wasp; If not, see <http://www.gnu.org/licenses/>.

@license GPL-3.0 <https://www.gnu.org/licenses/gpl.html>

Source code is available at: https://github.com/ar0551/Wasp
-
Provided by Wasp 0.1.0
    Args:
        RUN: Setup all classes and variables required to run Wasp. Set it to True to start building.
    Returns:
        log: log
"""

ghenv.Component.Name = "Wasp_Setup"
ghenv.Component.NickName = 'WaspSetup'
ghenv.Component.Message = 'VER 0.2.0'
ghenv.Component.IconDisplayMode = ghenv.Component.IconDisplayMode.application
ghenv.Component.Category = "Wasp"
ghenv.Component.SubCategory = "0 | Wasp"
try: ghenv.Component.AdditionalHelpFromDocStrings = "1"
except: pass



#########################################################################
##                               IMPORTS                               ##
#########################################################################
import random as rnd
import math
import bisect as bs
import scriptcontext as sc
import Rhino.Geometry as rg
import Rhino
import Grasshopper.Kernel as gh

#########################################################################
##                               CLASSES                               ##
#########################################################################

#################################################################### Connection
class Connection(object):
    
    ## constructor
    def __init__(self, plane, type, part, id):
        
        self.pln = plane
        
        flip_pln_Y = rg.Vector3d(plane.YAxis)
        flip_pln_Y.Reverse()
        self.flip_pln = rg.Plane(plane.Origin, plane.XAxis, flip_pln_Y)
        
        self.type = type
        self.part = part
        self.id = id
        
        self.rules_table = []
        self.active_rules = []
    
    ## return a transformed copy of the connection
    def transform(self, trans):
        pln_trans = rg.Plane(self.pln.Origin, self.pln.XAxis, self.pln.YAxis)
        conn_trans = Connection(pln_trans, self.type, self.part, self.id)
        conn_trans.pln.Transform(trans)
        conn_trans.flip_pln.Transform(trans)
        return conn_trans
    
    ## generate the rules-table for the connection
    def generate_rules_table(self, rules):
        count = 0
        self.rules_table = []
        self.active_rules = []
        for rule in rules:
            if rule.part1 == self.part and rule.conn1 == self.id:
                self.rules_table.append(rule)
                self.active_rules.append(count)
                count += 1

#################################################################### Base Part
class Part(object):
    
    ## constructor
    def __init__(self, name, geometry, connections, collider, attributes, dim=None, id=None, field=None):
        
        self.name = name
        self.id = id
        self.geo = geometry
        
        self.field = field
        
        self.connections = []
        self.active_connections = []
        count = 0
        for conn in connections:
            conn.part = self.name
            conn.id = count
            self.connections.append(conn)
            self.active_connections.append(count)
            count += 1
        
        self.transformation = rg.Transform.Identity
        self.center = self.geo.GetBoundingBox(False).Center
        self.collider = collider
        
        ##part size
        if dim is not None:
            self.dim = dim
        else:
            max_collider_dist = None
            for v in self.collider.Vertices:
                dist = self.center.DistanceTo(v)
                if dist > max_collider_dist or max_collider_dist is None:
                    max_collider_dist = dist
            
            self.dim = max_collider_dist
        
        self.children = []
        
        self.attributes = []
        if len(attributes) > 0:
            self.attributes = attributes
        
        self.is_constrained = False
    
    def reset_part(self, rules):
        count = 0
        self.active_connections = []
        for conn in self.connections:
            conn.generate_rules_table(rules)
            self.active_connections.append(count)
            count += 1
    
    def return_part_data(self):
        data_dict = {}
        data_dict['name'] = self.name
        data_dict['geo'] = self.geo
        data_dict['connections'] = self.connections
        data_dict['transform'] = self.transformation
        data_dict['center'] = self.center
        data_dict['children'] = self.children
        data_dict['attributes'] = self.attributes
        return data_dict
    
    ## function to transform part
    def transform(self, trans):
        geo_trans = self.geo.Duplicate()
        geo_trans.Transform(trans)
        
        collider_trans = self.collider.Duplicate()
        collider_trans.Transform(trans)
        
        connections_trans = []
        for conn in self.connections:
            connections_trans.append(conn.transform(trans))
        
        attributes_trans = []
        if len(self.attributes) > 0:
            for attr in self.attributes:
                attributes_trans.append(attr.transform(trans))
        
        part_trans = Part(self.name, geo_trans, connections_trans, collider_trans, attributes_trans, dim=self.dim, id=self.id, field=self.field)
        part_trans.transformation = trans
        return part_trans
    
    ## return transformed center point
    def transform_center(self, trans):
        center_trans = rg.Point3d(self.center)
        center_trans.Transform(trans)
        return center_trans
    
    ## return transformed collider mesh
    def transform_collider(self, trans):
        collider_trans = self.collider.Duplicate()
        collider_trans.Transform(trans)
        return collider_trans


#################################################################### Constrained Part
class Constrained_Part(Part):
    
    ## constructor
    def __init__(self, name, geometry, connections, collider, attributes, additional_collider, supports, dim = None, id=None, field=None, sub_parts=[]):
        
        super(self.__class__, self).__init__(name, geometry, connections, collider, attributes, dim=dim, id=id, field=field)
        
        self.add_collider = None
        if additional_collider != None:
            self.add_collider = additional_collider
        
        self.supports = []
        if len(supports) > 0:
            self.supports = supports
        
        self.sub_parts = sub_parts
    
    ## function to transform component
    def transform(self, trans, transform_sub_parts=False):
        geo_trans = self.geo.Duplicate()
        geo_trans.Transform(trans)
        
        collider_trans = self.collider.Duplicate()
        collider_trans.Transform(trans)
        
        connections_trans = []
        for conn in self.connections:
            connections_trans.append(conn.transform(trans))
        
        attributes_trans = []
        if len(self.attributes) > 0:
            for attr in self.attributes:
                attributes_trans.append(attr.transform(trans))
        
        add_collider_trans = None
        if(self.add_collider != None):
            add_collider_trans = self.add_collider.Duplicate()
            add_collider_trans.Transform(trans)
            
        supports_trans = []
        if len(self.supports) > 0:
            for sup in self.supports:
                sup_trans = sup.transform(trans)
                supports_trans.append(sup_trans)
        
        
        if transform_sub_parts:
            sub_parts_trans = []
            for sp in self.sub_parts:
                sp_trans = sp.transform(trans, transform_sub_parts=True)
                sub_parts_trans.append(sp_trans)
            part_trans = Constrained_Part(self.name, geo_trans, connections_trans, collider_trans, attributes_trans, add_collider_trans, supports_trans, dim=self.dim, id=self.id, field=self.field, sub_parts=sub_parts_trans)
            part_trans.transformation = trans
            part_trans.is_constrained = True
            return part_trans
        
        else:
            part_trans = Constrained_Part(self.name, geo_trans, connections_trans, collider_trans, attributes_trans, add_collider_trans, supports_trans, dim=self.dim, id=self.id, field=self.field, sub_parts=self.sub_parts)
            part_trans.transformation = trans
            part_trans.is_constrained = True
            return part_trans


#################################################################### Rule
class Rule(object):
    
    def __init__(self, _part1, _conn1, _part2, _conn2, _active = True):
        self.part1 = _part1
        self.conn1 = _conn1
        self.part2 = _part2
        self.conn2 = _conn2
        self.active = _active


#################################################################### Field
class Field(object):
    
    def __init__(self, name, boundaries, pts, count_vec, resolution, values):
        
        self.name = name
        self.resolution = resolution
        
        self.bbox = rg.BoundingBox(pts)
        
        self.x_count = int(count_vec.X)
        self.y_count = int(count_vec.Y)
        self.z_count = int(count_vec.Z)
        
        #self.pts = []
        self.vals = []
        pts_count = 0
        
        self.is_tensor_field = False
        try:
            v = values[0][2]
            self.is_tensor_field = True
        except:
            pass
        
        for z in range(0, self.z_count):
            #self.pts.append([])
            self.vals.append([])
            for y in range(0, self.y_count):
                #self.pts[z].append([])
                self.vals[z].append([])
                for x in range(0, self.x_count):
                    #self.pts[z][y].append(pts[pts_count])
                    if len(boundaries) > 0:
                        inside = False
                        for bou in boundaries:
                            if bou.IsPointInside(pts[pts_count], sc.sticky['model_tolerance'], True) == True:
                                self.vals[z][y].append(values[pts_count])
                                inside = True
                                break
                        if inside == False:
                            if self.is_tensor_field:
                                self.vals[z][y].append(rg.Vector3d(0,0,0))
                            else:
                                self.vals[z][y].append(0.0)
                    else:
                        self.vals[z][y].append(values[pts_count])
                    pts_count += 1
        
        self.highest_pt = self.return_highest_pt()
    
    
    def return_pt_val(self, pt):
        pt_trans = pt - self.bbox.Min
        x = int(math.floor(pt_trans.X/self.resolution))
        y = int(math.floor(pt_trans.Y/self.resolution))
        z = int(math.floor(pt_trans.Z/self.resolution))
        
        value = self.vals[z][y][x]
        return value
    
    def return_highest_pt(self, constraints = None):
        max_val = -1
        max_coords = None
        
        for z in range(0, self.z_count):
            for y in range(0, self.y_count):
                for x in range(0, self.x_count):
                    value = self.vals[z][y][x]
                    if self.is_tensor_field:
                        if value.Length > max_val:
                            if constraints is not None:
                                constraint_check = False
                                pt = rg.Point3d(x*self.resolution, y*self.resolution, z*self.resolution)
                                pt += self.bbox.Min
                                for constraint in constraints:
                                    if constraint.type == 'plane':
                                        if constraint.check(pt) == False:
                                            constraint_check = True
                                            break
                                        
                                    elif constraint.type == 'mesh_collider':
                                        if constraint.inside:
                                            if constraint.check_inside(part_collider, part_center) == False:
                                                constraint_check = True
                                                break
                                if constraint_check == False:
                                    max_val = value.Length
                                    max_coords = (x,y,z)
                            else:
                                max_val = value.Length
                                max_coords = (x,y,z)
                    else:
                        if value > max_val:
                            if constraints is not None:
                                constraint_check = False
                                pt = rg.Point3d(x*self.resolution, y*self.resolution, z*self.resolution)
                                pt += self.bbox.Min
                                for constraint in constraints:
                                    if constraint.type == 'plane':
                                        if constraint.check(pt) == False:
                                            constraint_check = True
                                            break
                                        
                                    elif constraint.type == 'mesh_collider':
                                        if constraint.inside:
                                            if constraint.check_inside_only(pt) == False:
                                                constraint_check = True
                                                break
                                if constraint_check == False:
                                    max_val = value
                                    max_coords = (x,y,z)
                            else:
                                max_val = value
                                max_coords = (x,y,z)
        
        highest_pt = rg.Point3d(max_coords[0]*self.resolution, max_coords[1]*self.resolution, max_coords[2]*self.resolution)
        highest_pt = highest_pt + self.bbox.Min
        
        return highest_pt


#################################################################### Attribute
class Attribute(object):
    
    def __init__(self, name, values, transformable):
        
        self.name = name
        self.values = values
        self.transformable = transformable
    
    def transform(self, trans):
        if self.transformable == True:
            values_trans = []
            for val in self.values:
                val_trans = None
                if type(val) == rg.Point3d:
                    val_trans = rg.Point3d(val)
                elif type(val) == rg.Plane:
                    val_trans = rg.Plane(val)
                else:
                    val_trans = val.Duplicate()
                val_trans.Transform(trans)
                values_trans.append(val_trans)
            attr_trans = Attribute(self.name, values_trans, self.transformable)
        else:
            attr_trans = Attribute(self.name, self.values, self.transformable)
        return attr_trans


#################################################################### Support
class Support(object):
    
    def __init__(self, support_directions):
        self.sup_dir = support_directions
    
    def transform(self, trans):
        sup_dir_trans = []
        for dir in self.sup_dir:
            dir = dir.ToNurbsCurve()
            start_trans = dir.PointAtStart
            end_trans = dir.PointAtEnd
            start_trans.Transform(trans)
            end_trans.Transform(trans)
            dir_trans = rg.Line(start_trans, end_trans)
            sup_dir_trans.append(dir_trans)
        sup_trans = Support(sup_dir_trans)
        return sup_trans


#########################################################################
##                                 WIP                                 ##
#########################################################################

## Aggregation class
class Aggregation(object):
    
    ## class constructor
    def __init__(self, _name, _parts, _rules, _mode, _prev = [], _coll_check = True, _field = [], _global_constraints = []):
        
        ## basic parameters
        self.name = _name
        
        self.parts = {}
        for part in _parts:
            self.parts[part.name] = part
        
        self.rules = _rules
        self.reset_parts()
        
        self.mode = _mode
        self.coll_check = _coll_check
        
        ## fields
        self.multiple_fields = False
        if len(_field) == 0 or _field is None:
            self.field = None
        elif len(_field) == 1:
            self.field = _field[0]
        else:
            self.field = {}
            for f in _field:
                self.field[f.name] = f
            self.multiple_fields = True
        
        ## lists
        self.aggregated_parts = []
        self.p_count = 0
        
        ## temp list to store possible colliders to newly added parts
        self.possible_collisions = []
        
        ## aggregation queue, storing sorted possible next states in the form (part, f_val)
        self.aggregation_queue = []
        self.queue_values = []
        self.queue_count = 0
        
        ## previous aggregated parts
        self.prev_num = 0
        if len(_prev) > 0:
            self.prev_num = len(_prev)
            for prev_p in _prev:
                prev_p.reset_part(self.rules)
                self.aggregated_parts.append(prev_p)
                if self.field is not None:
                    self.compute_next_w_field(prev_p, self.p_count)
                self.p_count += 1
        
        ## WIP
        self.collision_shapes = []
        self.graph = None
        
        self.global_constraints = _global_constraints
    
    
    ## reset entire aggregation (NOT WORKING)
    def reset(self):
        self.aggregated_parts = []
        self.p_count = 0
        self.aggregation_queue = []
        self.queue_values = []
        self.queue_count = 0
        
        self.reset_parts()
        
        if prev is not None:
            for prev_p in prev:
                prev_p.reset_part(self.rules)
                self.aggregated_parts.append(prev_p)
                
                if self.field is not None:
                    self.compute_next_w_field(prev_p, self.p_count)
                
                self.p_count += 1
    
    ## reset all base parts
    def reset_parts(self):
        for p_key in self.parts:
            self.parts[p_key].reset_part(self.rules)
    
    ## reset rules and regenerate rule tables for each part
    def reset_rules(self, rules):
        if rules != self.rules:
            self.rules = rules
            self.reset_parts()
    
    ## trim aggregated parts list to a specific length
    def remove_elements(self, num):
        self.aggregated_parts = self.aggregated_parts[:num]
        
        self.aggregation_queue = []
        self.queue_values = []
        self.queue_count = 0
        
        for part in self.aggregated_parts:
            part.reset_part(self.rules)
            if self.field is not None:
                self.compute_next_w_field(part, self.p_count)
            
        self.p_count -= (self.p_count - num)
    
    #### constraints check
    
    ## overlap // part-part collision check
    def collision_check(self, part, trans):
        part_center = part.transform_center(trans)
        
        ## overlap check
        coll_count = 0
        for ex_part in self.aggregated_parts:
            dist = ex_part.center.DistanceTo(part_center)
            if dist < sc.sticky['model_tolerance']:
                return True
            elif dist < ex_part.dim + part.dim:
                self.possible_collisions.append(coll_count)
            coll_count += 1
        
        ## collision check
        if self.coll_check == True:
            part_collider = part.transform_collider(trans)
            for id in self.possible_collisions:
                if len(rg.Intersect.Intersection.MeshMeshFast(self.aggregated_parts[id].collider, part_collider)) > 0:
                    return True
        return False
    
    ## additional collider check
    def additional_collider_check(self, part, trans):
        if part.add_collider != None:
            add_collider = part.add_collider.Duplicate()
            add_collider.Transform(trans)
            for ex_part in self.aggregated_parts:
                intersections = rg.Intersect.Intersection.MeshMeshFast(ex_part.collider, add_collider)
                if len(intersections) > 0:
                    return True
        return False
    
    ## support check
    def missing_supports_check(self, part, trans):
        if len(part.supports) > 0:
            for sup in part.supports:
                supports_count = 0
                sup_trans = sup.transform(trans)
                for dir in sup_trans.sup_dir:
                    for id in self.possible_collisions:
                        if len(rg.Intersect.Intersection.MeshLine(self.aggregated_parts[id].collider, dir)[0]) > 0:
                            supports_count += 1
                            break
                if supports_count == len(sup_trans.sup_dir):
                    return False
            return True
        else:
            return False
    
    ## global constraints check
    def global_constraints_check(self, part, trans):
        for constraint in self.global_constraints:
            if constraint.type == 'plane':
                part_center = part.transform_center(trans)
                if constraint.check(part_center) == False:
                    return True
                
            elif constraint.type == 'mesh_collider':
                part_collider = part.transform_collider(trans)
                if constraint.inside == False:
                    if constraint.check(part_collider) == False:
                        return True
                else:
                    part_center = part.transform_center(trans)
                    if constraint.check_inside(part_collider, part_center) == False:
                        return True
        return False
    
    
    ## sequential aggregation with Graph Grammar
    def aggregate_sequence(self, graph_rules):
        
        for rule in graph_rules:
                
            if len(self.aggregated_parts) == 0:
                aggr_rule = rule.split(">")[0]
                rule_parts = aggr_rule.split("_")
                part1 = str(rule_parts[0].split("|")[0])
                conn1 = int(rule_parts[0].split("|")[1])
                part2 = str(rule_parts[1].split("|")[0])
                conn2 = int(rule_parts[1].split("|")[1])
                
                rule_ids = rule.split(">")[1].split("_")
                
                first_part = self.parts[part1]
                first_part_trans = first_part.transform(rg.Transform.Identity)
                first_part_trans.id = rule_ids[0]
                
                
                next_part = self.parts[part2]
                
                orientTransform = rg.Transform.PlaneToPlane(next_part.connections[conn2].flip_pln, first_part.connections[conn1].pln)
                
                next_part_trans = next_part.transform(orientTransform)
                next_part_trans.id = rule_ids[1]
                
                self.aggregated_parts.append(first_part_trans)
                self.aggregated_parts.append(next_part_trans)
                
                first_part_trans.children.append(next_part_trans)
            
            else:
                aggr_rule = rule.split(">")[0]
                rule_parts = aggr_rule.split("_")
                part1_id = str(rule_parts[0].split("|")[0])
                conn1 = int(rule_parts[0].split("|")[1])
                part2 = str(rule_parts[1].split("|")[0])
                conn2 = int(rule_parts[1].split("|")[1])
                
                rule_ids = rule.split(">")[1].split("_")
                
                first_part = None
                for part in self.aggregated_parts:
                    if part.id == part1_id:
                        first_part = part
                        break
                if first_part is not None:
                    first_part.id = rule_ids[0]
                    next_part = self.parts[part2]
                    
                    orientTransform = rg.Transform.PlaneToPlane(next_part.connections[conn2].flip_pln, first_part.connections[conn1].pln)
                    next_part_trans = next_part.transform(orientTransform)
                    next_part_trans.id = rule_ids[1]
                    self.aggregated_parts.append(next_part_trans)
                    first_part.children.append(next_part_trans)
                else:
                    pass ## implement error handling
    
    
    ## stochastic aggregation (BASIC)
    def aggregate_rnd(self, num):
        added = 0
        loops = 0
        while added < num:
            loops += 1
            if loops > num*100:
                break
            ## if no part is present in the aggregation, add first random part
            if self.p_count == 0:
                first_part = self.parts[rnd.choice(self.parts.keys())]
                first_part_trans = first_part.transform(rg.Transform.Identity)
                for conn in first_part_trans.connections:
                    conn.generate_rules_table(self.rules)
                first_part_trans.id = 0
                self.aggregated_parts.append(first_part_trans)
                added += 1
                self.p_count += 1
            ## otherwise add new random part
            else:
                next_rule = None
                part_01_id = -1
                conn_01_id = -1
                next_rule_id = -1
                new_rule_attempts = 0
                
                while new_rule_attempts < 1000:
                    new_rule_attempts += 1
                    part_01_id = rnd.randint(0,self.p_count-1)
                    part_01 = self.aggregated_parts[part_01_id]
                    if len(part_01.active_connections) > 0:
                        conn_01_id = part_01.active_connections[rnd.randint(0, len(part_01.active_connections)-1)]
                        conn_01 = part_01.connections[conn_01_id]
                        if len(conn_01.active_rules) > 0:
                            next_rule_id = conn_01.active_rules[rnd.randint(0, len(conn_01.active_rules)-1)]
                            next_rule = conn_01.rules_table[next_rule_id]
                            break
                ### TO FIX >>> Give feedback when desired number of parts is not reached
                """
                if next_rule == None:
                    msg = "aborted after " + str(count) + " iterations"
                    ghenv.Component.AddRuntimeMessage(gh.GH_RuntimeMessageLevel.Warning, msg)
                    break
                """
                if next_rule is not None:
                    next_part = self.parts[next_rule.part2]
                    orientTransform = rg.Transform.PlaneToPlane(next_part.connections[next_rule.conn2].flip_pln, conn_01.pln)
                    
                    ## boolean checks for all constraints
                    coll_check = False
                    add_coll_check = False
                    missing_sup_check = False
                    global_const_check = False
                    
                    ## collision check
                    self.possible_collisions = []
                    coll_check = self.collision_check(next_part, orientTransform)
                    
                    ## constraints check
                    if self.mode == 1: ## only local constraints mode
                        if coll_check == False and next_part.is_constrained:
                            add_coll_check = self.additional_collider_check(next_part, orientTransform)
                            if add_coll_check == False:
                               missing_sup_check = self.missing_supports_check(next_part, orientTransform)
                    
                    elif self.mode == 2: ## onyl global constraints mode
                        if coll_check == False and len(self.global_constraints) > 0:
                            global_const_check = self.global_constraints_check(next_part, orientTransform)
                    
                    elif self.mode == 3: ## local+global constraints mode
                        if coll_check == False:
                            if len(self.global_constraints) > 0:
                                global_const_check = self.global_constraints_check(next_part, orientTransform)
                            if global_const_check == False and next_part.is_constrained:
                                add_coll_check = self.additional_collider_check(next_part, orientTransform)
                                if add_coll_check == False:
                                   missing_sup_check = self.missing_supports_check(next_part, orientTransform)
                    
                    
                    if coll_check == False and add_coll_check == False and missing_sup_check == False and global_const_check == False:
                        next_part_trans = next_part.transform(orientTransform)
                        next_part_trans.reset_part(self.rules)
                        for i in range(len(next_part_trans.active_connections)):
                            if next_part_trans.active_connections[i] == next_rule.conn2:
                                next_part_trans.active_connections.pop(i)
                                break
                        next_part_trans.id = self.p_count
                        self.aggregated_parts.append(next_part_trans)
                        self.aggregated_parts[part_01_id].children.append(next_part_trans)
                        for i in range(len(self.aggregated_parts[part_01_id].active_connections)):
                            if self.aggregated_parts[part_01_id].active_connections[i] == conn_01_id:
                                self.aggregated_parts[part_01_id].active_connections.pop(i)
                                break
                        added += 1
                        self.p_count += 1
                    ## TO FIX --> do not remove rules when only caused by missing supports
                    else:
                       ## remove rules if they cause collisions or overlappings
                       for i in range(len(self.aggregated_parts[part_01_id].connections[conn_01_id].active_rules)):
                           if self.aggregated_parts[part_01_id].connections[conn_01_id].active_rules[i] == next_rule_id:
                               self.aggregated_parts[part_01_id].connections[conn_01_id].active_rules.pop(i)
                               break
                       ## check if the connection is still active (still active rules available)
                       if len(self.aggregated_parts[part_01_id].connections[conn_01_id].active_rules) == 0:
                           for i in range(len(self.aggregated_parts[part_01_id].active_connections)):
                            if self.aggregated_parts[part_01_id].active_connections[i] == conn_01_id:
                                self.aggregated_parts[part_01_id].active_connections.pop(i)
                                break
    
    ##
    def compute_next_w_field(self, part, part_id):
        
        for i in xrange(len(part.active_connections)-1, -1, -1):
            conn_id = part.active_connections[i]
            conn = part.connections[conn_id]
            for i2 in xrange(len(conn.active_rules)-1, -1, -1):
                rule_id = conn.active_rules[i2]
                rule = conn.rules_table[rule_id]
                
                next_part = self.parts[rule.part2]
                
                next_center = rg.Point3d(next_part.center)
                orientTransform = rg.Transform.PlaneToPlane(next_part.connections[rule.conn2].flip_pln, conn.pln)
                next_center.Transform(orientTransform)
                
                if self.multiple_fields:
                    f_name = next_part.field
                    if self.field[f_name].bbox.Contains(next_center) == True:
                        field_val = self.field[f_name].return_pt_val(next_center)
                        
                        queue_index = bs.bisect_left(self.queue_values, field_val)
                        queue_entry = (next_part.name, part_id, orientTransform)
                        
                        self.queue_values.insert(queue_index, field_val)
                        self.aggregation_queue.insert(queue_index, queue_entry)
                        self.queue_count += 1
                    
                else:
                    if self.field.bbox.Contains(next_center) == True:
                        field_val = self.field.return_pt_val(next_center)
                        
                        queue_index = bs.bisect_left(self.queue_values, field_val)
                        queue_entry = (next_part.name, part_id, orientTransform)
                        
                        self.queue_values.insert(queue_index, field_val)
                        self.aggregation_queue.insert(queue_index, queue_entry)
                        self.queue_count += 1
    
    
    ## Field-driven aggregation with aggregation queue
    def aggregate_field(self, num):
        
        added = 0
        loops = 0
        while added < num:
            ## avoid endless loops
            loops += 1
            if loops > num*100:
                break
            
            ## if no part is present in the aggregation, add first random part
            if self.p_count == 0 and self.prev_num == 0:
                
                first_part = self.parts[rnd.choice(self.parts.keys())]
                
                start_point = None
                if self.multiple_fields:
                    f_name = first_part.field
                    if (self.mode == 2 or self.mode == 3) and len(self.global_constraints) > 0:
                        start_point = self.field[f_name].return_highest_pt(constraints=self.global_constraints)
                    else:
                       start_point = self.field[f_name].highest_pt
                else:
                    if (self.mode == 2 or self.mode == 3) and len(self.global_constraints) > 0:
                        start_point = self.field.return_highest_pt(constraints=self.global_constraints)
                    else:
                       start_point = self.field.highest_pt
                
                mov_vec = rg.Vector3d.Subtract(rg.Vector3d(start_point), rg.Vector3d(first_part.center))
                move_transform = rg.Transform.Translation(mov_vec.X, mov_vec.Y, mov_vec.Z)
                first_part_trans = first_part.transform(move_transform)
                
                for conn in first_part_trans.connections:
                    conn.generate_rules_table(self.rules)
                
                first_part_trans.id = 0
                self.aggregated_parts.append(first_part_trans)
                
                ## compute all possible next parts and append to list
                self.compute_next_w_field(first_part_trans, self.p_count)
                added += 1
                self.p_count += 1
            
            else:
                if self.queue_count == 0:
                    break
                
                next_data = self.aggregation_queue[self.queue_count-1]
                next_part = self.parts[next_data[0]]
                next_center = rg.Point3d(next_part.center)
                orientTransform = next_data[2]
                
                ## boolean checks for all constraints
                coll_check = False
                add_coll_check = False
                missing_sup_check = False
                global_const_check = False
                
                ## collision check
                self.possible_collisions = []
                coll_check = self.collision_check(next_part, orientTransform)
                
                ## constraints check
                if self.mode == 1: ## only local constraints mode
                    if coll_check == False and next_part.is_constrained:
                        add_coll_check = self.additional_collider_check(next_part, orientTransform)
                        if add_coll_check == False:
                           missing_sup_check = self.missing_supports_check(next_part, orientTransform)
                
                elif self.mode == 2: ## onyl global constraints mode
                    if coll_check == False and len(self.global_constraints) > 0:
                        global_const_check = self.global_constraints_check(next_part, orientTransform)
                
                elif self.mode == 3: ## local+global constraints mode
                    if coll_check == False:
                        if len(self.global_constraints) > 0:
                            global_const_check = self.global_constraints_check(next_part, orientTransform)
                        if global_const_check == False and next_part.is_constrained:
                            add_coll_check = self.additional_collider_check(next_part, orientTransform)
                            if add_coll_check == False:
                               missing_sup_check = self.missing_supports_check(next_part, orientTransform)
                
                
                if coll_check == False and add_coll_check == False and missing_sup_check == False and global_const_check == False:
                    next_part_trans = next_part.transform(orientTransform)
                    next_part_trans.reset_part(self.rules)
                    
                    for conn in next_part_trans.connections:
                        conn.generate_rules_table(self.rules)
                    
                    next_part_trans.id = self.p_count
                    self.aggregated_parts.append(next_part_trans)
                    
                    
                    ## compute all possible next parts and append to list
                    self.compute_next_w_field(next_part_trans, self.p_count)
                    added += 1
                    self.p_count += 1
                
                self.aggregation_queue.pop()
                self.queue_values.pop()
                self.queue_count -=1


## Global Constraint classes
class Plane_Constraint(object):
    
    def __init__(self, _plane, _positive = True):
        self.type = 'plane'
        self.plane = _plane
        self.positive = _positive
        
    def check(self, pt):
        mapped_pt = self.plane.RemapToPlaneSpace(pt)[1]
        
        if self.positive:
            if mapped_pt.Z > 0:
                return True
        else:
            if mapped_pt.Z < 0:
                return True
        
        return False

class Mesh_Constraint(object):
    
    def __init__(self, _geo, _inside):
        self.type = 'mesh_collider'
        self.geo = _geo
        self.inside = _inside
    
    def check(self, mesh):
        if len(rg.Intersect.Intersection.MeshMeshFast(self.geo, mesh)) > 0:
            return False
        return True
    
    def check_inside(self, mesh, pt):
        if len(rg.Intersect.Intersection.MeshMeshFast(self.geo, mesh)) > 0:
            return False
        
        if self.geo.IsPointInside(pt, 0.001, False):
            return False
        
        return True
    
    def check_inside_only(self, pt):
        if self.geo.IsPointInside(pt, 0.001, False):
            return False
        return True




## Voxel class
## Graph class

#########################################################################
##                                 RUN                                 ##
#########################################################################

log = []

## add classes to scriptcontext (to make it available to other Gh components)
if RUN:
    
    sc.sticky['Connection'] = Connection
    log.append("Connection class created...")
    sc.sticky['Part'] = Part
    log.append("Part class created...")
    sc.sticky['Constrained_Part'] = Constrained_Part
    log.append("Constrained_Part class created...")
    sc.sticky['Rule'] = Rule
    log.append("Rule class created...")
    sc.sticky['Field'] = Field
    log.append("Field class created...")
    sc.sticky['Attribute'] = Attribute
    log.append("Attribute class created...")
    sc.sticky['Support'] = Support
    log.append("Support class created...")
    sc.sticky['Aggregation'] = Aggregation
    log.append("Aggregation class created...")
    
    ## global constraints
    sc.sticky['Plane_Constraint'] = Plane_Constraint
    sc.sticky['Mesh_Constraint'] = Mesh_Constraint
    ##
    log.append("All global constraints classes created...")
    
    
    sc.sticky['model_tolerance'] = Rhino.RhinoDoc.ActiveDoc.ModelAbsoluteTolerance*5
    sc.sticky['WaspSetup'] = 1
    
    log.append("READY TO BUILD!")

else:
    log.append("Set RUN to True to initialize Wasp...")
# ---------- end waspsetup ----------

# ----
item = ListItem(List=support_points, Index=0, Wrap=invert(True))  # -> Item, Item1, Item2, Item3, Item4, Item5
attribute = Wasp_Attribute(ID="my_plane", VAL=xy, TR=Toggle(True))  # -> ATTR; inputs VAL: list, TR: Boolean
# ---------- attribute: Python ----------
# Wasp: Discrete Design with Grasshopper plug-in (GPL) initiated by Andrea Rossi
# 
# This file is part of Wasp.
# 
# Copyright (c) 2017, Andrea Rossi <a.rossi.andrea@gmail.com>
# Wasp is free software; you can redistribute it and/or modify 
# it under the terms of the GNU General Public License as published 
# by the Free Software Foundation; either version 3 of the License, 
# or (at your option) any later version. 
# 
# Wasp is distributed in the hope that it will be useful,
# but WITHOUT ANY WARRANTY; without even the implied warranty of 
# MERCHANTABILITY or FITNESS FOR A PARTICULAR PURPOSE. See the 
# GNU General Public License for more details.
# 
# You should have received a copy of the GNU General Public License
# along with Wasp; If not, see <http://www.gnu.org/licenses/>.
# 
# @license GPL-3.0 <https://www.gnu.org/licenses/gpl.html>
#
# Significant parts of Wasp have been developed by Andrea Rossi
# as part of research on digital materials and discrete design at:
# DDU Digital Design Unit - Prof. Oliver Tessmann
# Technische Universität Darmstadt


#########################################################################
##                            COMPONENT INFO                           ##
#########################################################################

"""
Attribute to be attached to a part.
Could be geometry or any other kind of data (eg. text, numeric variables, color…).
If Geometry, Transformable must be set to True to mantain the geometry attached to the part during aggregation.
-
Provided by Wasp 0.1.0
    Args:
        ID: Name of the attribute
        VAL: Value of the attribute (any type of Gh-compatible data possible)
        TR: Transformable. Set it to True for Geometry, False for other types of data
    Returns:
        ATTR: Attribute instance to attach to a component
"""

ghenv.Component.Name = "Wasp_Attribute"
ghenv.Component.NickName = 'Attribute'
ghenv.Component.Message = 'VER 0.1.0\nDEC_22_2017'
ghenv.Component.IconDisplayMode = ghenv.Component.IconDisplayMode.application
ghenv.Component.Category = "Wasp"
ghenv.Component.SubCategory = "1 | Elements"
try: ghenv.Component.AdditionalHelpFromDocStrings = "2"
except: pass

import scriptcontext as sc
import Rhino.Geometry as rg
import Grasshopper.Kernel as gh

def main(id, values, transformable = False):
    
    ## check if Wasp is setup
    if sc.sticky.has_key('WaspSetup'):
        
        check_data = True
        
        ##check inputs
        if id is None:
            id = 'ATTR_01'
            msg = "Default name 'ATTR_01' assigned to attribute"
            ghenv.Component.AddRuntimeMessage(gh.GH_RuntimeMessageLevel.Remark, msg)
        
        if len(values) == 0:
            check_data = False
            msg = "Please provide values for the attribute"
            ghenv.Component.AddRuntimeMessage(gh.GH_RuntimeMessageLevel.Warning, msg)
        
        if transformable is None:
            msg = "Transformable set to False by default"
            ghenv.Component.AddRuntimeMessage(gh.GH_RuntimeMessageLevel.Remark, msg)
        
        if transformable == True:
            val_count = 0
            for i in range(len(values)):
                try:
                    values[i].Transform(rg.Transform.Identity)
                except:
                    check_data = False
                    msg = "Value %d is not transformable"%(i)
                    ghenv.Component.AddRuntimeMessage(gh.GH_RuntimeMessageLevel.Error, msg)
        
        if check_data:
            attribute = sc.sticky['Attribute'](id, values, transformable)
            return attribute
        else:
            return -1
    
    else:
        ## throw warining
        msg = "You must run the SetupWasp component before starting to build!"
        ghenv.Component.AddRuntimeMessage(gh.GH_RuntimeMessageLevel.Warning, msg)
        return -1


result = main(ID, VAL, TR)

if result != -1:
    ATTR = result
# ---------- end attribute ----------

# ---- group: OK
attribute_2 = Wasp_Attribute(ID="connectors", VAL=brep, TR=Toggle(True))  # -> ATTR; inputs VAL: list, TR: Boolean; same code as attribute
attribute_3 = Wasp_Attribute(ID="color", VAL=ColourSwatch(SwatchColor=RGB(0, 64, 255)), TR=Toggle(False))  # -> ATTR; inputs VAL: list, TR: Boolean; same code as attribute

# ----
panel = Panel(wspexport.a)

# ---- group: OK
conndir = Wasp_ConnectionFromDirection(GEO=comp_geo, CEN=conn_center, UP=conn_up)  # -> CONN, PLN_OUT; inputs GEO: Brep, CEN: list of Point3d, UP: list of Curve, T: list
# ---------- conndir: Python ----------
# Wasp: Discrete Design with Grasshopper plug-in (GPL) initiated by Andrea Rossi
# 
# This file is part of Wasp.
# 
# Copyright (c) 2017, Andrea Rossi <a.rossi.andrea@gmail.com>
# Wasp is free software; you can redistribute it and/or modify 
# it under the terms of the GNU General Public License as published 
# by the Free Software Foundation; either version 3 of the License, 
# or (at your option) any later version. 
# 
# Wasp is distributed in the hope that it will be useful,
# but WITHOUT ANY WARRANTY; without even the implied warranty of 
# MERCHANTABILITY or FITNESS FOR A PARTICULAR PURPOSE. See the 
# GNU General Public License for more details.
# 
# You should have received a copy of the GNU General Public License
# along with Wasp; If not, see <http://www.gnu.org/licenses/>.
# 
# @license GPL-3.0 <https://www.gnu.org/licenses/gpl.html>
#
# Significant parts of Wasp have been developed by Andrea Rossi
# as part of research on digital materials and discrete design at:
# DDU Digital Design Unit - Prof. Oliver Tessmann
# Technische Universität Darmstadt


#########################################################################
##                            COMPONENT INFO                           ##
#########################################################################

"""
Create a connection on a given part geometry from center and X-asix direction
(Z direction is determined based on the normals of the component geometry)
-
Provided by Wasp 0.1.0
    Args:
        GEO: Geometry of the part to which the connection belongs
        CEN: Origin of the connection plane
        UP: Line idetifying the X-axis of the connection plane - determines the plane orientation to mantain when transforming
        T: OPTIONAL // Connection type (to be used with Rule Generator component)
    Returns:
        CONN: Connection object
        PLN_OUT: Plane for each connection object (for debugging)
"""

ghenv.Component.Name = "Wasp_Connection From Direction"
ghenv.Component.NickName = 'ConnDir'
ghenv.Component.Message = 'VER 0.1.0\nDEC_22_2017'
ghenv.Component.IconDisplayMode = ghenv.Component.IconDisplayMode.application
ghenv.Component.Category = "Wasp"
ghenv.Component.SubCategory = "1 | Elements"
try: ghenv.Component.AdditionalHelpFromDocStrings = "1"
except: pass


import scriptcontext as sc
import Rhino.Geometry as rg
import Grasshopper.Kernel as gh

def main(part_geo, conn_centers, conn_ups, conn_type):
    
    ## check if Wasp is setup
    if sc.sticky.has_key('WaspSetup'):
        
        check_data = True
        
        ## check inputs
        if part_geo is None:
            check_data = False
            msg = "No part geometry provided"
            ghenv.Component.AddRuntimeMessage(gh.GH_RuntimeMessageLevel.Warning, msg)
        
        if len(conn_centers) != len(conn_ups):
            check_data = False
            msg = "Different amount of centers and up vectors provided"
            ghenv.Component.AddRuntimeMessage(gh.GH_RuntimeMessageLevel.Error, msg)
        
        types = []
        if len(conn_type) == 0:
            for i in range(len(conn_centers)):
                types.append("0")
        elif len(conn_type) == 1:
            for i in range(len(conn_centers)):
                types.append(conn_type[0])
        elif len(conn_centers) != len(conn_type):
            check_data = False
            msg = "Different amount of centers and types provided"
            ghenv.Component.AddRuntimeMessage(gh.GH_RuntimeMessageLevel.Error, msg)
        else:
            for i in range(len(conn_centers)):
                types.append(conn_type[i])
        
        ## execute main code if all needed inputs are available
        if check_data:
            connections = []
            out_planes = []
            for i in range(len(conn_centers)):
                
                center = conn_centers[i]
                up = conn_ups[i]
                plane = None
                
                up_start = rg.Vector3d(up.PointAtStart)
                up_end = rg.Vector3d(up.PointAtEnd)
                up_vec = rg.Vector3d.Subtract(up_end, up_start)
                
                for face in GEO.Faces:
                    pt_uv = face.ClosestPoint(center)
                    pt = face.PointAt(pt_uv[1], pt_uv[2])
                    dist = rg.Point3d.DistanceTo(center, pt)
                    if(dist < 0.001):
                        normal = face.NormalAt(pt_uv[1], pt_uv[2])
                        plane = rg.Plane(center, normal)
                        x_axis = plane.XAxis
                        angle = rg.Vector3d.VectorAngle(x_axis, up_vec, plane)
                        plane.Rotate(angle, normal)
                        break
                        
                if plane is None:
                    msg = "No valid plane provided for connection %d"%(i)
                    ghenv.Component.AddRuntimeMessage(gh.GH_RuntimeMessageLevel.Error, msg)
                else:
                    conn = sc.sticky['Connection'](plane, types[i], "", -1)
                    connections.append(conn)
                    out_planes.append(plane)
            
            return connections, out_planes
        
        else:
            return -1
            
    
    else:
        ## throw warining
        msg = "You must run the SetupWasp component before starting to build!"
        ghenv.Component.AddRuntimeMessage(gh.GH_RuntimeMessageLevel.Warning, msg)
        return -1


result = main(GEO, CEN, UP, T)

if result != -1:
    CONN = result[0]
    PLN_OUT = result[1]
# ---------- end conndir ----------

# ----
points = PointList(Points=conn_center, Size=Slider(2, range=0..10))
smesh = SimpleMesh(Brep=comp_geo)
conndir_2 = Wasp_ConnectionFromDirection(GEO=comp_geo_2, CEN=conn_center_2, UP=conn_up_2)  # -> CONN, PLN_OUT; inputs GEO: Brep, CEN: list of Point3d, UP: list of Curve, T: list; same code as conndir
panel_2 = Panel(waspsetup)
conn_center_3 = Point([<point referenced from the Rhino model> x6])
smesh_2 = SimpleMesh(Brep=comp_geo_2)
comp_geo_3 = Brep(<brep referenced from the Rhino model>)
conn_up_3 = Curve([<curve referenced from the Rhino model> x6])
conn_center_4 = Point([<point referenced from the Rhino model> x6])
comp_geo_4 = Brep(<brep referenced from the Rhino model>)

# ---- group: OK
fieldpts = Wasp_FieldPoints(BOU=boundary, RES=cell_size)  # -> PTS, COUNT; inputs BOU: list of GeometryBase
# ---------- fieldpts: Python ----------
# Wasp: Discrete Design with Grasshopper plug-in (GPL) initiated by Andrea Rossi
# 
# This file is part of Wasp.
# 
# Copyright (c) 2017, Andrea Rossi <a.rossi.andrea@gmail.com>
# Wasp is free software; you can redistribute it and/or modify 
# it under the terms of the GNU General Public License as published 
# by the Free Software Foundation; either version 3 of the License, 
# or (at your option) any later version. 
# 
# Wasp is distributed in the hope that it will be useful,
# but WITHOUT ANY WARRANTY; without even the implied warranty of 
# MERCHANTABILITY or FITNESS FOR A PARTICULAR PURPOSE. See the 
# GNU General Public License for more details.
# 
# You should have received a copy of the GNU General Public License
# along with Wasp; If not, see <http://www.gnu.org/licenses/>.
# 
# @license GPL-3.0 <https://www.gnu.org/licenses/gpl.html>
#
# Significant parts of Wasp have been developed by Andrea Rossi
# as part of research on digital materials and discrete design at:
# DDU Digital Design Unit - Prof. Oliver Tessmann
# Technische Universität Darmstadt


#########################################################################
##                            COMPONENT INFO                           ##
#########################################################################

"""
Generate a 3d point grid to be fed to the field component
-
Provided by Wasp 0.1.0
    Args:
        BOU: List of geometries defining the boundaries of the field. Geometries must be closed breps or meshes.
        RES: Resolution (Dimension of each cell)
    Returns:
        PTS: Points for field
        COUNT: Cell counts in x, y and z directions
"""

ghenv.Component.Name = "Wasp_Field Points"
ghenv.Component.NickName = 'FieldPts'
ghenv.Component.Message = 'VER 0.1.0\nDEC_22_2017'
ghenv.Component.IconDisplayMode = ghenv.Component.IconDisplayMode.application
ghenv.Component.Category = "Wasp"
ghenv.Component.SubCategory = "4 | Aggregation"
try: ghenv.Component.AdditionalHelpFromDocStrings = "1"
except: pass

import scriptcontext as sc
import Rhino.Geometry as rg
import Grasshopper.Kernel as gh
import math


def main(boundaries, resolution):
    
    ## check if Wasp is setup
    if sc.sticky.has_key('WaspSetup'):
        
        check_data = True
        
        ##check inputs
        if len(boundaries) == 0:
            check_data = False
            msg = "No boundary geometry provided"
            ghenv.Component.AddRuntimeMessage(gh.GH_RuntimeMessageLevel.Warning, msg)
        
        if resolution is None and len(boundaries) != 0:
            global_bbox = None
            for geo in boundaries:
                bbox = geo.GetBoundingBox(True)
                
                if global_bbox is None:
                    global_bbox = bbox
                else:
                    global_bbox.Union(bbox)
            
            x_size = global_bbox.Max.X - global_bbox.Min.X
            resolution = int(x_size / 10)
            
            msg = "No resolution provided. Default resolution set to %d units"%(resolution)
            ghenv.Component.AddRuntimeMessage(gh.GH_RuntimeMessageLevel.Warning, msg)
            
        if check_data:
            global_bbox = None
            for geo in boundaries:
                bbox = geo.GetBoundingBox(True)
                
                if global_bbox is None:
                    global_bbox = bbox
                else:
                    global_bbox.Union(bbox)
            
            x_size = global_bbox.Max.X - global_bbox.Min.X
            x_count = int(math.ceil(x_size / resolution)) + 1
            y_size = global_bbox.Max.Y - global_bbox.Min.Y
            y_count = int(math.ceil(y_size / resolution)) + 1
            z_size = global_bbox.Max.Z - global_bbox.Min.Z
            z_count = int(math.ceil(z_size / resolution)) + 1
            
            count_vec = rg.Vector3d(x_count, y_count, z_count)
            
            pts = []
            s_pt = global_bbox.Min
            
            for z in range(z_count):
                for y in range(y_count):
                    for x in range(x_count):
                        pt = rg.Point3d(s_pt.X + x*resolution, s_pt.Y + y*resolution, s_pt.Z + z*resolution)
                        pts.append(pt)
            return pts, count_vec
            
        else:
            return -1
    
    else:
        ## throw warining
        msg = "You must run the SetupWasp component before starting to build!"
        ghenv.Component.AddRuntimeMessage(gh.GH_RuntimeMessageLevel.Warning, msg)
        return -1


result = main(BOU, RES)

if result != -1:
    PTS = result[0]
    COUNT = result[1]
# ---------- end fieldpts ----------

# ----
# WIP
pt = Point(fieldpts.PTS)
bbox = BoundingBox(Content=pt, Plane=PlaneXY(0, 0, 0), UnionBox=True)  # -> Box, Box_2
number_slider = Slider(291, range=0..1000)
pop3d = Populate3D(Region=bbox.Box, Count=Slider(12, range=0..100), Seed=1)
box = DomainBox(Base=pop3d, X=number_slider, Y=number_slider, Z=number_slider)
brepsinc = PointInBreps(Brep=box, Point=graft(pt), Strict=False)  # -> flatten(Inside), Index
dispatch = Dispatch(List=pt, DispatchPattern=brepsinc.Inside)  # -> ListA, ListB
vec = VectorXYZ(XComponent=Slider(1, range=0..1), YComponent=Slider(0, range=0..1), ZComponent=Slider(0, range=0..1))  # -> Vector, Length
vec_2 = VectorXYZ(XComponent=Slider(1, range=0..1), YComponent=Slider(1, range=0..1), ZComponent=Slider(1, range=0..1))  # -> Vector, Length
lng = ListLength(List=dispatch.ListA)
lng_2 = ListLength(List=dispatch.ListB)
repeat = RepeatData(Data=vec_2.Vector, Length=lng)
repeat_2 = RepeatData(Data=vec.Vector, Length=lng_2)
weave = Weave(Pattern=brepsinc.Inside, Stream0=repeat_2, Stream1=repeat, NullGaps=False)
vdis = VectorDisplay(Anchor=pt, Vector=weave)
tfield = Wsp_TensorField(BOU=boundary, PTS=fieldpts.PTS, COUNT=fieldpts.COUNT, RES=cell_size, VAL=weave)  # -> FIELD; inputs BOU: list of GeometryBase, PTS: list of Point3d, COUNT: Vector3d, VAL: list of Vector3d
# ---------- tfield: Python ----------
# Wasp: Discrete Design with Grasshopper plug-in (GPL) initiated by Andrea Rossi
# 
# This file is part of Wasp.
# 
# Copyright (c) 2017, Andrea Rossi <a.rossi.andrea@gmail.com>
# Wasp is free software; you can redistribute it and/or modify 
# it under the terms of the GNU General Public License as published 
# by the Free Software Foundation; either version 3 of the License, 
# or (at your option) any later version. 
# 
# Wasp is distributed in the hope that it will be useful,
# but WITHOUT ANY WARRANTY; without even the implied warranty of 
# MERCHANTABILITY or FITNESS FOR A PARTICULAR PURPOSE. See the 
# GNU General Public License for more details.
# 
# You should have received a copy of the GNU General Public License
# along with Wasp; If not, see <http://www.gnu.org/licenses/>.
# 
# @license GPL-3.0 <https://www.gnu.org/licenses/gpl.html>
#
# Significant parts of Wasp have been developed by Andrea Rossi
# as part of research on digital materials and discrete design at:
# DDU Digital Design Unit - Prof. Oliver Tessmann
# Technische Universität Darmstadt


#########################################################################
##                            COMPONENT INFO                           ##
#########################################################################

"""
Generates a tensor field given a grid of points and their relative tensors
-
Provided by Wasp 0.1.0
    Args:
        BOU: List of geometries defining the boundaries of the field. Geometries must be closed breps or meshes. All points of the field outside the geometries will be assigned a 0 value
        PTS: 3d point grid (from FieldPts component)
        COUNT: Vector storing cell counts for each axis (from FieldPts component)
        RES: Resolution of cell grid
        VAL: Tensor vectors to assign to each cell
    Returns:
        FIELD: Field object (to be used to drive the TensorFieldAggregation component)
"""

ghenv.Component.Name = "Wsp_Tensor Field"
ghenv.Component.NickName = 'TField'
ghenv.Component.Message = 'VER 0.1.0\nDEC_22_2017'
ghenv.Component.IconDisplayMode = ghenv.Component.IconDisplayMode.application
ghenv.Component.Category = "Wasp"
ghenv.Component.SubCategory = "X | Experimental"
try: ghenv.Component.AdditionalHelpFromDocStrings = "3"
except: pass

import scriptcontext as sc
import Rhino.Geometry as rg
import Grasshopper.Kernel as gh


def main(boundaries, pts, count, resolution, values):
    
    ## check if Wasp is setup
    if sc.sticky.has_key('WaspSetup'):
        
        check_data = True
        
        ##check inputs
        if len(boundaries) == 0:
            boundaries.append(rg.BoundingBox(pts).ToBrep())
            msg = "No boundary provided. Boundary set to point grid bounding box"
            ghenv.Component.AddRuntimeMessage(gh.GH_RuntimeMessageLevel.Remark, msg)
        
        if len(pts) == 0:
            check_data = False
            msg = "No point grid provided"
            ghenv.Component.AddRuntimeMessage(gh.GH_RuntimeMessageLevel.Warning, msg)
            
        elif len(values) == 0:
            check_data = False
            msg = "No field tensors provided"
            ghenv.Component.AddRuntimeMessage(gh.GH_RuntimeMessageLevel.Warning, msg)
            
        elif len(pts) != len(values):
            check_data = False
            msg = "Points and Values lists are not matching. Please provide two lists with same number of elements"
            ghenv.Component.AddRuntimeMessage(gh.GH_RuntimeMessageLevel.Error, msg)
        
        if count is None:
            check_data = False
            msg = "No axis count provided"
            ghenv.Component.AddRuntimeMessage(gh.GH_RuntimeMessageLevel.Warning, msg)
        
        try:
            test_v = values[0][2]
        except:
            check_data = False
            msg = "Values are not valid vectors"
            ghenv.Component.AddRuntimeMessage(gh.GH_RuntimeMessageLevel.Warning, msg)
        
        if resolution is None and check_data == True:
            resolution = pts[0].DistanceTo(pts[1])
            msg = "No resolution provided. Calculated resolution is %0.2f"%(resolution)
            ghenv.Component.AddRuntimeMessage(gh.GH_RuntimeMessageLevel.Remark, msg)
        
        if check_data:
            field = sc.sticky['Field'](boundaries, pts, count, resolution, values)
            return field
        else:
            return -1
    
    else:
        ## throw warining
        msg = "You must run the SetupWasp component before starting to build!"
        ghenv.Component.AddRuntimeMessage(gh.GH_RuntimeMessageLevel.Warning, msg)
        return -1


result = main(BOU, PTS, COUNT, RES, VAL)

if result != -1:
    FIELD = result
# ---------- end tfield ----------
number_slider_2 = Slider(500, range=0..10000)
wasp_aggregation_mode = ValueList({"BASIC": 0, "CONSTRAINED": 1}, selected="BASIC")
fieldn = Slider(25, range=0..1000)

conn_up_4 = Curve([<curve referenced from the Rhino model> x6])
support = Wasp_Support(DIR=[item.Item, item.Item2], GEO=comp_geo)  # -> SUP; inputs DIR: list of Curve, GEO: Mesh
# ---------- support: Python ----------
# Wasp: Discrete Design with Grasshopper plug-in (GPL) initiated by Andrea Rossi
# 
# This file is part of Wasp.
# 
# Copyright (c) 2017, Andrea Rossi <a.rossi.andrea@gmail.com>
# Wasp is free software; you can redistribute it and/or modify 
# it under the terms of the GNU General Public License as published 
# by the Free Software Foundation; either version 3 of the License, 
# or (at your option) any later version. 
# 
# Wasp is distributed in the hope that it will be useful,
# but WITHOUT ANY WARRANTY; without even the implied warranty of 
# MERCHANTABILITY or FITNESS FOR A PARTICULAR PURPOSE. See the 
# GNU General Public License for more details.
# 
# You should have received a copy of the GNU General Public License
# along with Wasp; If not, see <http://www.gnu.org/licenses/>.
# 
# @license GPL-3.0 <https://www.gnu.org/licenses/gpl.html>
#
# Significant parts of Wasp have been developed by Andrea Rossi
# as part of research on digital materials and discrete design at:
# DDU Digital Design Unit - Prof. Oliver Tessmann
# Technische Universität Darmstadt


#########################################################################
##                            COMPONENT INFO                           ##
#########################################################################

"""
Support definition for constrained parts.
Each set of lines defining support locations can be set
-
Provided by Wasp 0.1.0
    Args:
        DIR: Directions of the support locations as lines
        GEO: OPTIONAL // Geometry of the part the support belongs to
    Returns:
        SUP: Support element
"""

ghenv.Component.Name = "Wasp_Support"
ghenv.Component.NickName = 'Support'
ghenv.Component.Message = 'VER 0.1.1\nMAR_06_2018'
ghenv.Component.IconDisplayMode = ghenv.Component.IconDisplayMode.application
ghenv.Component.Category = "Wasp"
ghenv.Component.SubCategory = "1 | Elements"
try: ghenv.Component.AdditionalHelpFromDocStrings = "3"
except: pass


import scriptcontext as sc
import Rhino.Geometry as rg
import Grasshopper.Kernel as gh


def main(sup_dir, part_geo):
    
    ## check if Wasp is setup
    if sc.sticky.has_key('WaspSetup'):
        
        check_data = True
        
        ##check inputs
        support_lines = []
        if len(sup_dir) == 0:
            check_data = False
            msg = "Please provide a valid list of lines as support directions"
            ghenv.Component.AddRuntimeMessage(gh.GH_RuntimeMessageLevel.Warning, msg)
        else:
            for sup in sup_dir:
                start = sup.PointAtStart
                end = sup.PointAtEnd
                sup_ln = rg.Line(start, end)
                support_lines.append(sup_ln)
        
        if part_geo is not None:
            for i in range(len(support_lines)):
                intersection = rg.Intersect.Intersection.MeshLine(part_geo, support_lines[i])
                if len(intersection[0]) == 0:
                    msg = "Support direction " + str(i) + " does not intersect with the part geometry. Please verify this is intended."
                    ghenv.Component.AddRuntimeMessage(gh.GH_RuntimeMessageLevel.Warning, msg)
        else:
            msg = "No part geometry provided. Correct position of supports cannot be verified."
            ghenv.Component.AddRuntimeMessage(gh.GH_RuntimeMessageLevel.Remark, msg)
        
        if check_data:
            support = sc.sticky['Support'](DIR)
            return support
        else:
            return -1
    
    else:
        ## throw warining
        msg = "You must run the SetupWasp component before starting to build!"
        ghenv.Component.AddRuntimeMessage(gh.GH_RuntimeMessageLevel.Warning, msg)
        return -1


result = main(DIR, GEO)

if result != -1:
    SUP = result
# ---------- end support ----------
support_2 = Wasp_Support(DIR=[item.Item5, item.Item1], GEO=comp_geo)  # -> SUP; inputs DIR: list of Curve, GEO: Mesh; same code as support
support_3 = Wasp_Support(DIR=[item.Item2, item.Item4], GEO=comp_geo)  # -> SUP; inputs DIR: list of Curve, GEO: Mesh; same code as support
support_4 = Wasp_Support(DIR=[item.Item3, item.Item4], GEO=comp_geo)  # -> SUP; inputs DIR: list of Curve, GEO: Mesh; disabled; same code as support
merge = Merge(Data1=attribute_2, Data2=attribute_3, Data3=attribute)
number_slider_3 = Slider(5, range=0..100)
split = SplitList(List=conndir.PLN_OUT, Index=Slider(6, range=0..10))  # -> ListA, ListB
split_2 = SplitList(List=conndir_2.PLN_OUT, Index=Slider(3, range=0..10))  # -> ListA, ListB
conndir_3 = Wasp_ConnectionFromDirection(GEO=comp_geo_3, CEN=conn_center_3, UP=conn_up_3)  # -> CONN, PLN_OUT; inputs GEO: Brep, CEN: list of Point3d, UP: list of Curve, T: list; same code as conndir
conndir_4 = Wasp_ConnectionFromDirection(GEO=comp_geo_4, CEN=conn_center_4, UP=conn_up_4)  # -> CONN, PLN_OUT; inputs GEO: Brep, CEN: list of Point3d, UP: list of Curve, T: list; same code as conndir
points_2 = PointList(Points=conn_center_3, Size=Slider(1, range=0..10))

bbox_2 = BoundingBox(Content=fieldpts.PTS, Plane=PlaneXY(0, 0, 0), UnionBox=True)  # -> Box, Box_2
pop3d_2 = Populate3D(Region=bbox_2.Box, Count=Slider(7, range=0..100), Seed=1)
pull = PullPoint(Point=fieldpts.PTS, Geometry=pop3d_2, ClosestOnly=True)  # -> ClosestPoint, Distance
bnd = Bounds(Numbers=pull.Distance)
remap = RemapNumbers(Value=pull.Distance, Source=bnd, Target="1 To 0")  # -> Mapped, Clipped
graph = GraphMapper(remap.Mapped, x0=0, x1=1, y0=0, y1=1, container_name="Gaussian", factor=0.06945979595, mean=0.5, sdev=0.02776241302)
gradient = Gradient(LowerLimit=0, UpperLimit=1, Parameter=graph, stops=[0: RGB(0, 128, 0), 0.5: RGB(255, 255, 0), 1: RGB(255, 0, 0)])

points_3 = PointList(Points=conn_center_4, Size=Slider(1, range=0..10))
bbox_3 = BoundingBox(Content=comp_geo, Plane=PlaneXY(0, 0, 0))  # -> Box, Box_2
merge_2 = Merge(Data1=support, Data2=support_2, Data3=support_3, Data4=support_4)
arranged_parts = Geometry([<brep referenced from the Rhino model> x7])
mesh = MeshBrep(Brep=comp_geo_3, Settings=custom_mesh_settings)
mesh_2 = MeshBrep(Brep=comp_geo_4, Settings=custom_mesh_settings_2)

# ---- group: OK
connpln = Wasp_ConnectionFromPlane(PLN=split.ListA, T="TOP")  # -> CONN, PLN_OUT; inputs PLN: list of Plane, T: list
# ---------- connpln: Python ----------
# Wasp: Discrete Design with Grasshopper plug-in (GPL) initiated by Andrea Rossi
# 
# This file is part of Wasp.
# 
# Copyright (c) 2017, Andrea Rossi <a.rossi.andrea@gmail.com>
# Wasp is free software; you can redistribute it and/or modify 
# it under the terms of the GNU General Public License as published 
# by the Free Software Foundation; either version 3 of the License, 
# or (at your option) any later version. 
# 
# Wasp is distributed in the hope that it will be useful,
# but WITHOUT ANY WARRANTY; without even the implied warranty of 
# MERCHANTABILITY or FITNESS FOR A PARTICULAR PURPOSE. See the 
# GNU General Public License for more details.
# 
# You should have received a copy of the GNU General Public License
# along with Wasp; If not, see <http://www.gnu.org/licenses/>.
# 
# @license GPL-3.0 <https://www.gnu.org/licenses/gpl.html>
#
# Significant parts of Wasp have been developed by Andrea Rossi
# as part of research on digital materials and discrete design at:
# DDU Digital Design Unit - Prof. Oliver Tessmann
# Technische Universität Darmstadt


#########################################################################
##                            COMPONENT INFO                           ##
#########################################################################

"""
Create a connection from a given plane.
It can create connections which cause collisions and overlapping of components
-
Provided by Wasp 0.1.0
    Args:
        PLN: Connection plane
        T: OPTIONAL // Connection type (to be used with Rule Generator component)
    Returns:
        CONN: Connection object
        PLN_OUT: Connection plane (for debugging)
"""

ghenv.Component.Name = "Wasp_Connection From Plane"
ghenv.Component.NickName = 'ConnPln'
ghenv.Component.Message = 'VER 0.1.0\nDEC_22_2017'
ghenv.Component.IconDisplayMode = ghenv.Component.IconDisplayMode.application
ghenv.Component.Category = "Wasp"
ghenv.Component.SubCategory = "1 | Elements"
try: ghenv.Component.AdditionalHelpFromDocStrings = "1"
except: pass


import scriptcontext as sc
import Rhino.Geometry as rg
import Grasshopper.Kernel as gh

def main(conn_planes, conn_type):
    
    ## check if Wasp is setup
    if sc.sticky.has_key('WaspSetup'):
        
        check_data = True
        
        ##check inputs
        types = []
        if len(conn_type) == 0:
            for i in range(len(conn_planes)):
                types.append("00")
        elif len(conn_type) == 1:
            for i in range(len(conn_planes)):
                types.append(conn_type[0])
        elif len(conn_planes) != len(conn_type):
            check_data = False
            msg = "Different amount of planes and types provided"
            ghenv.Component.AddRuntimeMessage(gh.GH_RuntimeMessageLevel.Error, msg)
        else:
            for i in range(len(conn_planes)):
                types.append(conn_type[i])
        
        
        if check_data:
            connections = []
            out_planes = []
            for i in range(len(conn_planes)):
                plane = conn_planes[i]
                if plane is None:
                    msg = "No valid plane provided for connection %d"%(i)
                    ghenv.Component.AddRuntimeMessage(gh.GH_RuntimeMessageLevel.Error, msg)
                else:
                    conn = sc.sticky['Connection'](plane, types[i], "", -1)
                    connections.append(conn)
                    out_planes.append(plane)
            
            return connections, out_planes
        
        else:
            return -1
    
    else:
        ## throw warining
        msg = "You must run the SetupWasp component before starting to build!"
        ghenv.Component.AddRuntimeMessage(gh.GH_RuntimeMessageLevel.Warning, msg)
        return -1


result = main(PLN, T)

if result != -1:
    CONN = result[0]
    PLN_OUT = result[1]
# ---------- end connpln ----------
connpln_2 = Wasp_ConnectionFromPlane(PLN=split.ListB, T="BOTTOM")  # -> CONN, PLN_OUT; inputs PLN: list of Plane, T: list; same code as connpln

# ----
bbox_4 = BoundingBox(Content=fieldpts.PTS, Plane=PlaneXY(0, 0, 0), UnionBox=True)  # -> Box, Box_2
pop3d_3 = Populate3D(Region=bbox_4.Box, Count=Slider(7, range=0..100), Seed=Slider(125, range=0..1000))
pull_2 = PullPoint(Point=fieldpts.PTS, Geometry=pop3d_3, ClosestOnly=True)  # -> ClosestPoint, Distance
bnd_2 = Bounds(Numbers=pull_2.Distance)
remap_2 = RemapNumbers(Value=pull_2.Distance, Source=bnd_2, Target="1 To 0")  # -> Mapped, Clipped
graph_2 = GraphMapper(remap_2.Mapped, x0=0, x1=1, y0=0, y1=1, container_name="Gaussian", factor=0.1919475794, mean=0.5, sdev=0.0768045783)
gradient_2 = Gradient(LowerLimit=0, UpperLimit=1, Parameter=graph_2, stops=[0: RGB(0, 128, 0), 0.5: RGB(255, 255, 0), 1: RGB(255, 0, 0)])

connpln_3 = Wasp_ConnectionFromPlane(PLN=split_2.ListA, T="TOP")  # -> CONN, PLN_OUT; inputs PLN: list of Plane, T: list; same code as connpln
connpln_4 = Wasp_ConnectionFromPlane(PLN=split_2.ListB, T="BOTTOM")  # -> CONN, PLN_OUT; inputs PLN: list of Plane, T: list; same code as connpln
tool_collider = Brep(<brep referenced from the Rhino model>)
mbox = MeshBox(Base=bbox_3.Box, XCount=number_slider_3, YCount=number_slider_3, ZCount=number_slider_3)

bbox_5 = BoundingBox(Content=boundary, Plane=PlaneXY(0, 0, 0), UnionBox=True)  # -> Box, Box_2
debrep = DeconstructBrep(Brep=bbox_5.Box)  # -> Faces, Edges, Vertices
Z = UnitZ(Factor=Slider(200, range=0..1000))
item_2 = ListItem(List=debrep.Faces, Index=Slider(4, range=0..10), Wrap=True)
move = Move(Geometry=item_2, Motion=Z)  # -> Geometry, Transform
pop2d = Populate2D(Region=move.Geometry, Count=Slider(250, range=0..500), Seed=1)
brepsinc_2 = PointInBreps(Brep=boundary, Point=pop2d, Strict=False)  # -> Inside, Index
cull = CullPattern(List=pop2d, CullPattern=brepsinc_2.Inside)
bbox_6 = BoundingBox(Content=comp_geo, Plane=PlaneXY(0, 0, 0))  # -> Box, Box_2
eval = Evaluate(F="round(x/mul)*mul", x=cull, mul=Slider(10, range=0..10))
volume = Volume(Geometry=bbox_6.Box)  # -> Volume, Centroid
vec2pt = Vector2Pt(PointA=volume.Centroid, PointB=eval, Unitize=False)  # -> Vector, Length
move_2 = Move(Motion=vec2pt.Vector)  # -> Geometry, Transform

volume_2 = Volume(Geometry=arranged_parts)  # -> Volume, Centroid
volume_3 = Volume(Geometry=comp_geo_4)  # -> Volume, Centroid
item_3 = ListItem(List=conn_center_3, Index=Slider(1, range=0..1), Wrap=True)  # -> Item, Item1, Item2
merge_3 = Merge(Data1=connpln.CONN, Data2=connpln_2.CONN)
merge_4 = Merge(Data1=connpln_3.CONN, Data2=connpln_4.CONN)
vec2pt_2 = Vector2Pt(PointA=volume_3.Centroid, PointB=volume_2.Centroid, Unitize=False)  # -> Vector, Length
series = Series(Start=0, Step=1, Count=Slider(6, range=0..10))
vec2pt_3 = Vector2Pt(PointA=item_3.Item2, PointB=item_3.Item, Unitize=False)  # -> Vector, Length

# ---- group: OK
part = Wasp_BasicPart(NAME="L", GEO=smesh, CONN=flatten(merge_3))  # -> PART; inputs GEO: Mesh, CONN: list, COLL: Mesh, ATTR: list
# ---------- part: Python ----------
# Wasp: Discrete Design with Grasshopper plug-in (GPL) initiated by Andrea Rossi
# 
# This file is part of Wasp.
# 
# Copyright (c) 2017, Andrea Rossi <a.rossi.andrea@gmail.com>
# Wasp is free software; you can redistribute it and/or modify 
# it under the terms of the GNU General Public License as published 
# by the Free Software Foundation; either version 3 of the License, 
# or (at your option) any later version. 
# 
# Wasp is distributed in the hope that it will be useful,
# but WITHOUT ANY WARRANTY; without even the implied warranty of 
# MERCHANTABILITY or FITNESS FOR A PARTICULAR PURPOSE. See the 
# GNU General Public License for more details.
# 
# You should have received a copy of the GNU General Public License
# along with Wasp; If not, see <http://www.gnu.org/licenses/>.
# 
# @license GPL-3.0 <https://www.gnu.org/licenses/gpl.html>
#
# Significant parts of Wasp have been developed by Andrea Rossi
# as part of research on digital materials and discrete design at:
# DDU Digital Design Unit - Prof. Oliver Tessmann
# Technische Universität Darmstadt


#########################################################################
##                            COMPONENT INFO                           ##
#########################################################################

"""
Create a basic Wasp Part to be used for aggregation
-
Provided by Wasp 0.1.0
    Args:
        NAME: Part name
        GEO: Part geometry. It will be converted to mesh - to improve performance, perform the conversion before adding to the part and user a low-poly count
        CONN: Connections list
        COLL: OPTIONAL // Collider geometry (for collision detection). A collider will be automatically generated. For complex parts, automatic generation might not work, and you can add a custom collider geometry here.
        ATTR: OPTIONAL // Part attributes
    Returns:
        PART: Part instance
"""

ghenv.Component.Name = "Wasp_Basic Part"
ghenv.Component.NickName = 'Part'
ghenv.Component.Message = 'VER 0.1.0\nDEC_22_2017'
ghenv.Component.IconDisplayMode = ghenv.Component.IconDisplayMode.application
ghenv.Component.Category = "Wasp"
ghenv.Component.SubCategory = "2 | Parts"
try: ghenv.Component.AdditionalHelpFromDocStrings = "3"
except: pass

import scriptcontext as sc
import Rhino.Geometry as rg
import Grasshopper.Kernel as gh


def main(part_name, part_geo, connections, collider, attributes):
    
    ## check if Wasp is setup
    if sc.sticky.has_key('WaspSetup'):
        
        check_data = True
        
        ## check inputs
        if part_name is None:
            part_name = 'P1'
            msg = "Default name 'P1' assigned to part"
            ghenv.Component.AddRuntimeMessage(gh.GH_RuntimeMessageLevel.Remark, msg)
        
        if part_geo is None:
            check_data = False
            msg = "No part geometry provided"
            ghenv.Component.AddRuntimeMessage(gh.GH_RuntimeMessageLevel.Warning, msg)
            check_data = False
        
        if collider is None and part_geo is not None:
            collider = part_geo.Duplicate().Offset(sc.sticky['model_tolerance'])
            collider_intersection = rg.Intersect.Intersection.MeshMeshFast(collider, part_geo)
            if len(collider_intersection) > 0:
                collider = None
                collider = part_geo.Duplicate()
                center = part_geo.GetBoundingBox(True).Center
                scale_plane = rg.Plane(center, rg.Vector3d(1,0,0), rg.Vector3d(0,1,0))
                scale_transform = rg.Transform.Scale(scale_plane, 1-sc.sticky['model_tolerance'], 1-sc.sticky['model_tolerance'], 1-sc.sticky['model_tolerance'])
                collider.Transform(scale_transform)
                collider_intersection = rg.Intersect.Intersection.MeshMeshFast(collider, part_geo)
                if len(collider_intersection) > 0:
                    collider = None
                    msg = "Could not compute a valid collider geometry. Please provide a valid collider in the COLL input."
                    ghenv.Component.AddRuntimeMessage(gh.GH_RuntimeMessageLevel.Error, msg)
                    check_data = False
        
        if collider is not None and collider.Faces.Count > 1000:
            msg = "The computed collider has a high faces count. Consider providing a low poly collider to improve performance"
            ghenv.Component.AddRuntimeMessage(gh.GH_RuntimeMessageLevel.Warning, msg)
        
        
        if check_data:
            new_part = sc.sticky['Part'](part_name, part_geo, connections, collider, attributes)
            return new_part
        else:
            return -1
    
    else:
        ## throw warining
        msg = "You must run the SetupWasp component before starting to build!"
        ghenv.Component.AddRuntimeMessage(gh.GH_RuntimeMessageLevel.Warning, msg)
        return -1


result = main(NAME, GEO, CONN, COLL, ATTR)

if result != -1:
    PART = result
# ---------- end part ----------
# ----
move_3 = Move(Motion=vec2pt_2.Vector)  # -> Geometry, Transform

# ---- group: OK
deconn = Wasp_DeconstructConnection(CONN=merge_3)  # -> PLN, ID, PART, T
# ---------- deconn: Python ----------
# Wasp: Discrete Design with Grasshopper plug-in (GPL) initiated by Andrea Rossi
# 
# This file is part of Wasp.
# 
# Copyright (c) 2017, Andrea Rossi <a.rossi.andrea@gmail.com>
# Wasp is free software; you can redistribute it and/or modify 
# it under the terms of the GNU General Public License as published 
# by the Free Software Foundation; either version 3 of the License, 
# or (at your option) any later version. 
# 
# Wasp is distributed in the hope that it will be useful,
# but WITHOUT ANY WARRANTY; without even the implied warranty of 
# MERCHANTABILITY or FITNESS FOR A PARTICULAR PURPOSE. See the 
# GNU General Public License for more details.
# 
# You should have received a copy of the GNU General Public License
# along with Wasp; If not, see <http://www.gnu.org/licenses/>.
# 
# @license GPL-3.0 <https://www.gnu.org/licenses/gpl.html>
#
# Significant parts of Wasp have been developed by Andrea Rossi
# as part of research on digital materials and discrete design at:
# DDU Digital Design Unit - Prof. Oliver Tessmann
# Technische Universität Darmstadt


#########################################################################
##                            COMPONENT INFO                           ##
#########################################################################

"""
Extract information from a Connection.
-
Provided by Wasp 0.1.0
    Args:
        CONN: Connection to deconstruct
    Returns:
        PLN: Connection plane
        ID: Connection ID
        PART: Part to which the connection belongs to
        T: Connection type
"""

ghenv.Component.Name = "Wasp_Deconstruct Connection"
ghenv.Component.NickName = 'DeConn'
ghenv.Component.Message = 'VER 0.1.0\nDEC_22_2017'
ghenv.Component.IconDisplayMode = ghenv.Component.IconDisplayMode.application
ghenv.Component.Category = "Wasp"
ghenv.Component.SubCategory = "1 | Elements"
try: ghenv.Component.AdditionalHelpFromDocStrings = "1"
except: pass


import scriptcontext as sc
import Rhino.Geometry as rg
import Grasshopper.Kernel as gh

def main(connection):
    
    ## check if Wasp is setup
    if sc.sticky.has_key('WaspSetup'):
        
        check_data = True
        
        ##check inputs
        if connection is None:
            check_data = False
            msg = "No connection provided"
            ghenv.Component.AddRuntimeMessage(gh.GH_RuntimeMessageLevel.Warning, msg)
        
        if check_data:
            return connection.pln, connection.id, connection.part, connection.type
        
        else:
            return -1
    
    else:
        ## throw warining
        msg = "You must run the SetupWasp component before starting to build!"
        ghenv.Component.AddRuntimeMessage(gh.GH_RuntimeMessageLevel.Warning, msg)
        return -1


result = main(CONN)

if result != -1:
    PLN = result[0]
    ID = result[1]
    PART = result[2]
    T = result[3]
# ---------- end deconn ----------

constrpart = Wasp_ConstrainedPart(NAME="S", GEO=smesh_2, CONN=flatten(merge_4), FIELD="f_02")  # -> PART; inputs GEO: Mesh, CONN: list, COLL: Mesh, ATTR: list, E_COLL: Mesh, SUP: list
# ---------- constrpart: Python ----------
# Wasp: Discrete Design with Grasshopper plug-in (GPL) initiated by Andrea Rossi
# 
# This file is part of Wasp.
# 
# Copyright (c) 2017, Andrea Rossi <a.rossi.andrea@gmail.com>
# Wasp is free software; you can redistribute it and/or modify 
# it under the terms of the GNU General Public License as published 
# by the Free Software Foundation; either version 3 of the License, 
# or (at your option) any later version. 
# 
# Wasp is distributed in the hope that it will be useful,
# but WITHOUT ANY WARRANTY; without even the implied warranty of 
# MERCHANTABILITY or FITNESS FOR A PARTICULAR PURPOSE. See the 
# GNU General Public License for more details.
# 
# You should have received a copy of the GNU General Public License
# along with Wasp; If not, see <http://www.gnu.org/licenses/>.
# 
# @license GPL-3.0 <https://www.gnu.org/licenses/gpl.html>
#
# Significant parts of Wasp have been developed by Andrea Rossi
# as part of research on digital materials and discrete design at:
# DDU Digital Design Unit - Prof. Oliver Tessmann
# Technische Universität Darmstadt


#########################################################################
##                            COMPONENT INFO                           ##
#########################################################################

"""
Create a Wasp Part with additional constraints (supports, additional colliders)
-
Provided by Wasp 0.1.0
    Args:
        NAME: Part name
        GEO: Part geometry. It will be converted to mesh - to improve performance, perform the conversion before adding to the part and user a low-poly count
        CONN: Connections list
        COLL: OPTIONAL // Collider geometry (for collision detection). A collider will be automatically generated. For complex parts, automatic generation might not work, and you can add a custom collider geometry here.
        ATTR: OPTIONAL // Part attributes
        E_COLL: OPTIONAL // Additional collider geometry (e.g. assembly tool), to be checked in Constrained mode
        SUP: OPTIONAL // Required supports for part placement, to be checked in Constrained mode
    Returns:
        PART: Part instance
"""

ghenv.Component.Name = "Wasp_Constrained Part"
ghenv.Component.NickName = 'ConstrPart'
ghenv.Component.Message = 'VER 0.1.1\nMAR_06_2018'
ghenv.Component.IconDisplayMode = ghenv.Component.IconDisplayMode.application
ghenv.Component.Category = "Wasp"
ghenv.Component.SubCategory = "2 | Parts"
try: ghenv.Component.AdditionalHelpFromDocStrings = "3"
except: pass

import scriptcontext as sc
import Rhino.Geometry as rg
import Grasshopper.Kernel as gh


def main(part_name, part_geo, connections, collider, field_name, attributes, add_collider, supports):
    
    ## check if Wasp is setup
    if sc.sticky.has_key('WaspSetup'):
        
        check_data = True
        
        ## check inputs
        if part_name is None:
            part_name = 'P1'
            msg = "Default name 'P1' assigned to part"
            ghenv.Component.AddRuntimeMessage(gh.GH_RuntimeMessageLevel.Remark, msg)
        
        if part_geo is None:
            check_data = False
            msg = "No part geometry provided"
            ghenv.Component.AddRuntimeMessage(gh.GH_RuntimeMessageLevel.Warning, msg)
            check_data = False
        
        if collider is None and part_geo is not None:
            collider = part_geo.Duplicate().Offset(sc.sticky['model_tolerance'])
            collider_intersection = rg.Intersect.Intersection.MeshMeshFast(collider, part_geo)
            if len(collider_intersection) > 0:
                collider = None
                collider = part_geo.Duplicate()
                center = part_geo.GetBoundingBox(True).Center
                scale_plane = rg.Plane(center, rg.Vector3d(1,0,0), rg.Vector3d(0,1,0))
                scale_transform = rg.Transform.Scale(scale_plane, 1-sc.sticky['model_tolerance'], 1-sc.sticky['model_tolerance'], 1-sc.sticky['model_tolerance'])
                collider.Transform(scale_transform)
                collider_intersection = rg.Intersect.Intersection.MeshMeshFast(collider, part_geo)
                if len(collider_intersection) > 0:
                    collider = None
                    msg = "Could not compute a valid collider geometry. Please provide a valid collider in the COLL input."
                    ghenv.Component.AddRuntimeMessage(gh.GH_RuntimeMessageLevel.Error, msg)
                    check_data = False
        
        if collider is not None and collider.Faces.Count > 1000:
            msg = "The computed collider has a high faces count. Consider providing a low poly collider to improve performance"
            ghenv.Component.AddRuntimeMessage(gh.GH_RuntimeMessageLevel.Warning, msg)
        
        if add_collider is None and len(supports) == 0:
            msg = "No information provided for Constrained mode. You might want to use the Basic Part component for better performance"
            ghenv.Component.AddRuntimeMessage(gh.GH_RuntimeMessageLevel.Remark, msg)
        
        
        if check_data:
            new_part = sc.sticky['Constrained_Part'](part_name, part_geo, connections, collider, attributes, add_collider, supports, field=field_name)
            new_part.is_constrained = True
            return [new_part]
        else:
            return -1
    
    else:
        ## throw warining
        msg = "You must run the SetupWasp component before starting to build!"
        ghenv.Component.AddRuntimeMessage(gh.GH_RuntimeMessageLevel.Warning, msg)
        return -1


result = main(NAME, GEO, CONN, COLL, FIELD, ATTR, E_COLL, SUP)

if result != -1:
    PART = result[0]
# ---------- end constrpart ----------

# ----
multiplication = Multiplication(A=vec2pt_3.Vector, B=series)
tag = TextTag3D(Location=deconn.PLN, Text=deconn.ID, Size=Slider(2, range=0..10), Justification=7)
move_4 = Move(Motion=multiplication)  # -> Geometry, Transform
constrpart_2 = Wasp_ConstrainedPart(NAME="SP", GEO=mesh_2, CONN=flatten(conndir_4.CONN))  # -> PART; inputs GEO: Mesh, CONN: list, COLL: Mesh, HI: list, ATTR: list, E_COLL: Mesh, SUP: list
# ---------- constrpart_2: Python ----------
# Wasp: Discrete Design with Grasshopper plug-in (GPL) initiated by Andrea Rossi
# 
# This file is part of Wasp.
# 
# Copyright (c) 2017, Andrea Rossi <a.rossi.andrea@gmail.com>
# Wasp is free software; you can redistribute it and/or modify 
# it under the terms of the GNU General Public License as published 
# by the Free Software Foundation; either version 3 of the License, 
# or (at your option) any later version. 
# 
# Wasp is distributed in the hope that it will be useful,
# but WITHOUT ANY WARRANTY; without even the implied warranty of 
# MERCHANTABILITY or FITNESS FOR A PARTICULAR PURPOSE. See the 
# GNU General Public License for more details.
# 
# You should have received a copy of the GNU General Public License
# along with Wasp; If not, see <http://www.gnu.org/licenses/>.
# 
# @license GPL-3.0 <https://www.gnu.org/licenses/gpl.html>
#
# Significant parts of Wasp have been developed by Andrea Rossi
# as part of research on digital materials and discrete design at:
# DDU Digital Design Unit - Prof. Oliver Tessmann
# Technische Universität Darmstadt


#########################################################################
##                            COMPONENT INFO                           ##
#########################################################################

"""
Create a Wasp Part with additional constraints (supports, additional colliders)
-
Provided by Wasp 0.1.0
    Args:
        NAME: Part name
        GEO: Part geometry. It will be converted to mesh - to improve performance, perform the conversion before adding to the part and user a low-poly count
        CONN: Connections list
        COLL: OPTIONAL // Collider geometry (for collision detection). A collider will be automatically generated. For complex parts, automatic generation might not work, and you can add a custom collider geometry here.
        ATTR: OPTIONAL // Part attributes
        E_COLL: OPTIONAL // Additional collider geometry (e.g. assembly tool), to be checked in Constrained mode
        SUP: OPTIONAL // Required supports for part placement, to be checked in Constrained mode
    Returns:
        PART: Part instance
"""

ghenv.Component.Name = "Wasp_Constrained Part"
ghenv.Component.NickName = 'ConstrPart'
ghenv.Component.Message = 'VER 0.2.0'
ghenv.Component.IconDisplayMode = ghenv.Component.IconDisplayMode.application
ghenv.Component.Category = "Wasp"
ghenv.Component.SubCategory = "2 | Parts"
try: ghenv.Component.AdditionalHelpFromDocStrings = "3"
except: pass

import scriptcontext as sc
import Rhino.Geometry as rg
import Grasshopper.Kernel as gh


def main(part_name, part_geo, connections, collider, field_name, sub_parts, attributes, add_collider, supports):
    
    ## check if Wasp is setup
    if sc.sticky.has_key('WaspSetup'):
        
        check_data = True
        
        ## check inputs
        if part_name is None:
            part_name = 'P1'
            msg = "Default name 'P1' assigned to part"
            ghenv.Component.AddRuntimeMessage(gh.GH_RuntimeMessageLevel.Remark, msg)
        
        if part_geo is None:
            check_data = False
            msg = "No part geometry provided"
            ghenv.Component.AddRuntimeMessage(gh.GH_RuntimeMessageLevel.Warning, msg)
            check_data = False
        
        if collider is None and part_geo is not None:
            collider = part_geo.Duplicate().Offset(sc.sticky['model_tolerance'])
            collider_intersection = rg.Intersect.Intersection.MeshMeshFast(collider, part_geo)
            if len(collider_intersection) > 0:
                collider = None
                collider = part_geo.Duplicate()
                center = part_geo.GetBoundingBox(True).Center
                scale_plane = rg.Plane(center, rg.Vector3d(1,0,0), rg.Vector3d(0,1,0))
                scale_transform = rg.Transform.Scale(scale_plane, 1-sc.sticky['model_tolerance'], 1-sc.sticky['model_tolerance'], 1-sc.sticky['model_tolerance'])
                collider.Transform(scale_transform)
                collider_intersection = rg.Intersect.Intersection.MeshMeshFast(collider, part_geo)
                if len(collider_intersection) > 0:
                    collider = None
                    msg = "Could not compute a valid collider geometry. Please provide a valid collider in the COLL input."
                    ghenv.Component.AddRuntimeMessage(gh.GH_RuntimeMessageLevel.Error, msg)
                    check_data = False
        
        if collider is not None and collider.Faces.Count > 1000:
            msg = "The computed collider has a high faces count. Consider providing a low poly collider to improve performance"
            ghenv.Component.AddRuntimeMessage(gh.GH_RuntimeMessageLevel.Warning, msg)
        
        if add_collider is None and len(supports) == 0:
            msg = "No information provided for Constrained mode. You might want to use the Basic Part component for better performance"
            ghenv.Component.AddRuntimeMessage(gh.GH_RuntimeMessageLevel.Remark, msg)
        
        
        if check_data:
            new_part = sc.sticky['Constrained_Part'](part_name, part_geo, connections, collider, attributes, add_collider, supports, field=field_name, sub_parts=sub_parts)
            new_part.is_constrained = True
            return [new_part]
        else:
            return -1
    
    else:
        ## throw warining
        msg = "You must run the SetupWasp component before starting to build!"
        ghenv.Component.AddRuntimeMessage(gh.GH_RuntimeMessageLevel.Warning, msg)
        return -1


result = main(NAME, GEO, CONN, COLL, FIELD, HI, ATTR, E_COLL, SUP)

if result != -1:
    PART = result[0]
# ---------- end constrpart_2 ----------
parttr = Wasp_TransformPart(PART=constrpart_2, TR=move_3.Transform)  # -> PART_OUT
# ---------- parttr: Python ----------
# Wasp: Discrete Design with Grasshopper plug-in (GPL) initiated by Andrea Rossi
# 
# This file is part of Wasp.
# 
# Copyright (c) 2017, Andrea Rossi <a.rossi.andrea@gmail.com>
# Wasp is free software; you can redistribute it and/or modify 
# it under the terms of the GNU General Public License as published 
# by the Free Software Foundation; either version 3 of the License, 
# or (at your option) any later version. 
# 
# Wasp is distributed in the hope that it will be useful,
# but WITHOUT ANY WARRANTY; without even the implied warranty of 
# MERCHANTABILITY or FITNESS FOR A PARTICULAR PURPOSE. See the 
# GNU General Public License for more details.
# 
# You should have received a copy of the GNU General Public License
# along with Wasp; If not, see <http://www.gnu.org/licenses/>.
# 
# @license GPL-3.0 <https://www.gnu.org/licenses/gpl.html>
#
# Significant parts of Wasp have been developed by Andrea Rossi
# as part of research on digital materials and discrete design at:
# DDU Digital Design Unit - Prof. Oliver Tessmann
# Technische Universität Darmstadt


#########################################################################
##                            COMPONENT INFO                           ##
#########################################################################

"""
Applies a geometric transformation to an existing part, returning a transformed copy.
Can be used with any Transform component from Grasshopper.
Create a Transform component without inputting any geometry and plug the X output to the TR input.
-
Provided by Wasp 0.1.0
    Args:
        PART: Part to be transformed
        TR: Transformation
    Returns:
        PART_OUT: Transformed part
"""

ghenv.Component.Name = "Wasp_Transform Part"
ghenv.Component.NickName = 'PartTr'
ghenv.Component.Message = 'VER 0.2.0'
ghenv.Component.IconDisplayMode = ghenv.Component.IconDisplayMode.application
ghenv.Component.Category = "Wasp"
ghenv.Component.SubCategory = "2 | Parts"
try: ghenv.Component.AdditionalHelpFromDocStrings = "3"
except: pass


import scriptcontext as sc
import Grasshopper.Kernel as gh

def main(part, transform):
    
    ## check if Wasp is setup
    if sc.sticky.has_key('WaspSetup'):
        
        check_data = True
        
        ##check inputs
        if part is None:
            check_data = False
            msg = "Please provide a valid part to be transformed"
            ghenv.Component.AddRuntimeMessage(gh.GH_RuntimeMessageLevel.Warning, msg)
        
        if transform is None:
            check_data = False
            msg = "Please provide a valid transformation"
            ghenv.Component.AddRuntimeMessage(gh.GH_RuntimeMessageLevel.Warning, msg)
        
        if check_data:
            part_trans = part.transform(transform, transform_sub_parts=True)
            part_trans.transformation = transform
            return part_trans
        else:
            return -1
    
    else:
        ## throw warining
        msg = "You must run the SetupWasp component before starting to build!"
        ghenv.Component.AddRuntimeMessage(gh.GH_RuntimeMessageLevel.Warning, msg)
        return -1


result = main(PART, TR)

if result != -1:
    PART_OUT = result
# ---------- end parttr ----------
constrpart_3 = Wasp_ConstrainedPart(NAME="CR", GEO=mesh, CONN=flatten(conndir_3.CONN), HI=parttr)  # -> PART; inputs GEO: Mesh, CONN: list, COLL: Mesh, HI: list, ATTR: list, E_COLL: Mesh, SUP: list; same code as constrpart_2
panel_3 = Panel("TOP>BOTTOM")
panel_4 = Panel("""TOP>BOTTOM
BOTTOM>TOP""")
panel_5 = Panel("BOTTOM>TOP")
panel_6 = Panel("""L|0_L|6
L|2_L|4
L|1_L|11
L|5_L|3
L|2_L|7
L|4_L|9
L|6_L|0
L|4_L|2
L|11_L|1
L|3_L|5
L|7_L|2
L|9_L|4""")
parttr_2 = Wasp_TransformPart(PART=constrpart_3, TR=move_4.Transform)  # -> PART_OUT; same code as parttr

# ---- group: OK
constrpart_4 = Wasp_ConstrainedPart(NAME="L", GEO=mbox, CONN=flatten(merge_3), FIELD="f_01", HI=parttr_2, E_COLL=tool_collider, SUP=merge_2)  # -> PART; inputs GEO: Mesh, CONN: list, COLL: Mesh, HI: list, ATTR: list, E_COLL: Mesh, SUP: list; same code as constrpart_2

# ----
parttr_3 = Wasp_TransformPart(PART=constrpart_4, TR=move_2.Transform)  # -> PART_OUT; same code as parttr
merge_5 = Merge(Data1=constrpart_4)  # -> flatten(Result)
depart = Wasp_DeconstructPart(PART=parttr)  # -> NAME, GEO, CONN, CONN_PLN, TR, CHILD, ATTR; inputs PART: list
# ---------- depart: Python ----------
# Wasp: Discrete Design with Grasshopper plug-in (GPL) initiated by Andrea Rossi
# 
# This file is part of Wasp.
# 
# Copyright (c) 2017, Andrea Rossi <a.rossi.andrea@gmail.com>
# Wasp is free software; you can redistribute it and/or modify 
# it under the terms of the GNU General Public License as published 
# by the Free Software Foundation; either version 3 of the License, 
# or (at your option) any later version. 
# 
# Wasp is distributed in the hope that it will be useful,
# but WITHOUT ANY WARRANTY; without even the implied warranty of 
# MERCHANTABILITY or FITNESS FOR A PARTICULAR PURPOSE. See the 
# GNU General Public License for more details.
# 
# You should have received a copy of the GNU General Public License
# along with Wasp; If not, see <http://www.gnu.org/licenses/>.
# 
# @license GPL-3.0 <https://www.gnu.org/licenses/gpl.html>
#
# Significant parts of Wasp have been developed by Andrea Rossi
# as part of research on digital materials and discrete design at:
# DDU Digital Design Unit - Prof. Oliver Tessmann
# Technische Universität Darmstadt


#########################################################################
##                            COMPONENT INFO                           ##
#########################################################################

"""
Extract all information stored in a part. Useful for visualization or for further geometry processing
-
Provided by Wasp 0.1.0
    Args:
        PART: Parts to deconstruct
    Returns:
        NAME: Name of the part
        GEO: Geometry of the part (as mesh). If Brep geometry is needed, can be stored in the component as attribute, or obtained by transforming the original geometry with the TR output.
        CONN: Part connections
        CONN_PLN: planes for each part connection
        TR: Transformation applied to the part. Can be used to transform other geometries in a similar way (eg. replace a low poly component with a more detailed one)
        CHILD: Children parts attached to the part
        ATTR: Part attributes
"""

ghenv.Component.Name = "Wasp_Deconstruct Part"
ghenv.Component.NickName = 'DePart'
ghenv.Component.Message = 'VER 0.1.0\nDEC_22_2017'
ghenv.Component.IconDisplayMode = ghenv.Component.IconDisplayMode.application
ghenv.Component.Category = "Wasp"
ghenv.Component.SubCategory = "2 | Parts"
try: ghenv.Component.AdditionalHelpFromDocStrings = "3"
except: pass


import scriptcontext as sc
import Grasshopper.Kernel as gh
from Grasshopper import DataTree
from Grasshopper.Kernel.Data import GH_Path


## from http://www.chenjingcheng.com/grasshopper-python-datatree-list-conversion/
def listToDataTree(list):
    rl = list
    result = DataTree[object]()
    for i in range(len(rl)):
        temp = []
        for j in range(len(rl[i])):
            temp.append(rl[i][j])
        path = GH_Path(i)
        result.AddRange(temp, path)
    return result



NAME = []
GEO = []
TR = []
ADD_COLL = []
ATTR = []

conn_list = []
conn_pln_list = []
children_list = []
attributes_list = []

if len(PART) == 0:
    msg = "No part provided"
    ghenv.Component.AddRuntimeMessage(gh.GH_RuntimeMessageLevel.Warning, msg)
elif PART[0] is None:
    msg = "Provided part is null"
    ghenv.Component.AddRuntimeMessage(gh.GH_RuntimeMessageLevel.Warning, msg)
else:
    for comp in PART:
        
        data_dict = comp.return_part_data()
        
        NAME.append(data_dict['name'])
        GEO.append(data_dict['geo'])
        conn_list.append(data_dict['connections'])
        
        conn_pln_list.append([])
        for conn in data_dict['connections']:
            conn_pln_list[len(conn_pln_list)-1].append(conn.pln)
        
        if "transform" in data_dict.keys():
            TR.append(data_dict['transform'])
        
        if "add_collider" in data_dict.keys():
            ADD_COLL.append(data_dict['add_collider'])
        
        if "children" in data_dict.keys():
            children_list.append(data_dict['children'])
        
        if "attributes" in data_dict.keys():
            attributes_list.append(data_dict['attributes'])
        
    
    CONN = listToDataTree(conn_list)
    CONN_PLN = listToDataTree(conn_pln_list)
    CHILD = listToDataTree(children_list)
    ATTR = listToDataTree(attributes_list)
# ---------- end depart ----------

# ---- group: OK
rulegen = Wasp_RulesGenerator(PART=merge_5, SELF_P=Toggle(True), SELF_C=Toggle(True), GR=panel_4)  # -> R; inputs PART: list, SELF_P: Boolean, SELF_C: Boolean, GR: list
# ---------- rulegen: Python ----------
# Wasp: Discrete Design with Grasshopper plug-in (GPL) initiated by Andrea Rossi
# 
# This file is part of Wasp.
# 
# Copyright (c) 2017, Andrea Rossi <a.rossi.andrea@gmail.com>
# Wasp is free software; you can redistribute it and/or modify 
# it under the terms of the GNU General Public License as published 
# by the Free Software Foundation; either version 3 of the License, 
# or (at your option) any later version. 
# 
# Wasp is distributed in the hope that it will be useful,
# but WITHOUT ANY WARRANTY; without even the implied warranty of 
# MERCHANTABILITY or FITNESS FOR A PARTICULAR PURPOSE. See the 
# GNU General Public License for more details.
# 
# You should have received a copy of the GNU General Public License
# along with Wasp; If not, see <http://www.gnu.org/licenses/>.
# 
# @license GPL-3.0 <https://www.gnu.org/licenses/gpl.html>
#
# Significant parts of Wasp have been developed by Andrea Rossi
# as part of research on digital materials and discrete design at:
# DDU Digital Design Unit - Prof. Oliver Tessmann
# Technische Universität Darmstadt


#########################################################################
##                            COMPONENT INFO                           ##
#########################################################################

"""
Automated rules generator given a list of parts. It has two separate modes:
- If no grammar is provided in the GR input, the component generates rules between connections of the same type.
- If a grammar is provided, rules are created between connections of different types, according to the specified grammar rules.
-
Provided by Wasp 0.1.0
    Args:
        PART: Parts from which to generate aggregation rules
        SELF_P: OPTIONAL // Create rules between connections belonging to the same part (True by default)
        SELF_C: OPTIONAL // Create rules between connection with same id (True by default)
        GR: OPTIONAL // Custom connection grammar with format "ConnType">"ConnType"
    Returns:
        R: Generated aggregation rules
"""

ghenv.Component.Name = "Wasp_Rules Generator"
ghenv.Component.NickName = 'RuleGen'
ghenv.Component.Message = 'VER 0.1.0\nDEC_22_2017'
ghenv.Component.IconDisplayMode = ghenv.Component.IconDisplayMode.application
ghenv.Component.Category = "Wasp"
ghenv.Component.SubCategory = "3 | Rules"
try: ghenv.Component.AdditionalHelpFromDocStrings = "2"
except: pass

import scriptcontext as sc
import Grasshopper.Kernel as gh

def main(parts, self_part, self_connection, grammar):
    ## check if Wasp is setup
    if sc.sticky.has_key('WaspSetup'):
        
        check_data = True
        
        ##check inputs
        if len(parts) == 0 or parts is None:
            check_data = False
            msg = "No part provided"
            ghenv.Component.AddRuntimeMessage(gh.GH_RuntimeMessageLevel.Warning, msg)
        
        if self_part == None:
            self_part = True
        
        if self_connection == None:
            self_connection = True
        
        if check_data:
            rules = []
            
            if len(grammar) == 0:
                for part in parts:
                    for conn in part.connections:
                        for other_part in parts:
                            skip_part = False
                            if self_part == False:
                                if part.name == other_part.name:
                                    skip_part = True
                                
                            if skip_part == False:
                                for other_conn in other_part.connections:
                                    skip_conn = False
                                    if self_connection == False:
                                        if conn.id == other_conn.id:
                                            skip_conn = True
                                    
                                    if skip_conn == False:
                                        if conn.type == other_conn.type:
                                            r = sc.sticky['Rule'](part.name, conn.id, other_part.name, other_conn.id)
                                            rules.append(r)
            else:
                for gr_rule in grammar:
                    start_type = gr_rule.split(">")[0]
                    end_type = gr_rule.split(">")[1]
                    
                    for part in parts:
                        for conn in part.connections:
                            if conn.type == start_type:
                                for other_part in parts:
                                    skip_part = False
                                    if self_part == False:
                                        if part.name == other_part.name:
                                            skip_part = True
                                        
                                    if skip_part == False:
                                        for other_conn in other_part.connections:
                                            if other_conn.type == end_type:
                                                skip_conn = False
                                                if self_connection == False:
                                                    if conn.id == other_conn.id:
                                                        skip_conn = True
                                                
                                                if skip_conn == False:
                                                    r = sc.sticky['Rule'](part.name, conn.id, other_part.name, other_conn.id)
                                                    rules.append(r)
                    
                    
            return [rules]
        else:
            return -1
    
    else:
        ## throw warining
        msg = "You must run the SetupWasp component before starting to build!"
        ghenv.Component.AddRuntimeMessage(gh.GH_RuntimeMessageLevel.Warning, msg)
        return -1



result = main(PART, SELF_P, SELF_C, GR)

if result != -1:
    R = result[0]
# ---------- end rulegen ----------

rule = Wasp_Rule(P1="L", C1=Slider(3, range=0..10), P2="L", C2=Slider(7, range=0..10))  # -> R; inputs C1: Int32, C2: Int32
# ---------- rule: Python ----------
# Wasp: Discrete Design with Grasshopper plug-in (GPL) initiated by Andrea Rossi
# 
# This file is part of Wasp.
# 
# Copyright (c) 2017, Andrea Rossi <a.rossi.andrea@gmail.com>
# Wasp is free software; you can redistribute it and/or modify 
# it under the terms of the GNU General Public License as published 
# by the Free Software Foundation; either version 3 of the License, 
# or (at your option) any later version. 
# 
# Wasp is distributed in the hope that it will be useful,
# but WITHOUT ANY WARRANTY; without even the implied warranty of 
# MERCHANTABILITY or FITNESS FOR A PARTICULAR PURPOSE. See the 
# GNU General Public License for more details.
# 
# You should have received a copy of the GNU General Public License
# along with Wasp; If not, see <http://www.gnu.org/licenses/>.
# 
# @license GPL-3.0 <https://www.gnu.org/licenses/gpl.html>
#
# Significant parts of Wasp have been developed by Andrea Rossi
# as part of research on digital materials and discrete design at:
# DDU Digital Design Unit - Prof. Oliver Tessmann
# Technische Universität Darmstadt


#########################################################################
##                            COMPONENT INFO                           ##
#########################################################################

"""
Generate an aggregation rule from part names and connections ids
-
Provided by Wasp 0.1.0
    Args:
        P1: Name of base part
        C1: Id of base connection
        P2: Name of new part to be aggregated
        C2: Id of new connection
    Returns:
        R: Rule
"""

ghenv.Component.Name = "Wasp_Rule"
ghenv.Component.NickName = 'Rule'
ghenv.Component.Message = 'VER 0.2.0'
ghenv.Component.IconDisplayMode = ghenv.Component.IconDisplayMode.application
ghenv.Component.Category = "Wasp"
ghenv.Component.SubCategory = "3 | Rules"
try: ghenv.Component.AdditionalHelpFromDocStrings = "2"
except: pass

import scriptcontext as sc
import Grasshopper.Kernel as gh

def main(part1, conn1, part2, conn2):
    
    ## check if Wasp is setup
    if sc.sticky.has_key('WaspSetup'):
        
        check_data = True
        
        ##check inputs
        if part1 is None or conn1 is None or part2 is None or conn2 is None:
            check_data = False
            msg = "Missing data. Please provide data for all inputs."
            ghenv.Component.AddRuntimeMessage(gh.GH_RuntimeMessageLevel.Warning, msg)
        
        if check_data:
            rule = sc.sticky['Rule'](part1, conn1, part2, conn2)
            return rule
        else:
            return -1
    
    else:
        ## throw warining
        msg = "You must run the SetupWasp component before starting to build!"
        ghenv.Component.AddRuntimeMessage(gh.GH_RuntimeMessageLevel.Warning, msg)
        return -1


result = main(P1, C1, P2, C2)

if result != -1:
    R = result
# ---------- end rule ----------

ruletxt = Wasp_RuleFromText(TXT=panel_6)  # -> R
# ---------- ruletxt: Python ----------
# Wasp: Discrete Design with Grasshopper plug-in (GPL) initiated by Andrea Rossi
# 
# This file is part of Wasp.
# 
# Copyright (c) 2017, Andrea Rossi <a.rossi.andrea@gmail.com>
# Wasp is free software; you can redistribute it and/or modify 
# it under the terms of the GNU General Public License as published 
# by the Free Software Foundation; either version 3 of the License, 
# or (at your option) any later version. 
# 
# Wasp is distributed in the hope that it will be useful,
# but WITHOUT ANY WARRANTY; without even the implied warranty of 
# MERCHANTABILITY or FITNESS FOR A PARTICULAR PURPOSE. See the 
# GNU General Public License for more details.
# 
# You should have received a copy of the GNU General Public License
# along with Wasp; If not, see <http://www.gnu.org/licenses/>.
# 
# @license GPL-3.0 <https://www.gnu.org/licenses/gpl.html>
#
# Significant parts of Wasp have been developed by Andrea Rossi
# as part of research on digital materials and discrete design at:
# DDU Digital Design Unit - Prof. Oliver Tessmann
# Technische Universität Darmstadt


#########################################################################
##                            COMPONENT INFO                           ##
#########################################################################

"""
Generate an aggregation rule from a text string description
-
Provided by Wasp 0.1.0
    Args:
        TXT: Text description of the rule with format "Part1|Conn1_Part2|Conn2"
    Returns:
        R: Rule
"""

ghenv.Component.Name = "Wasp_Rule From Text"
ghenv.Component.NickName = 'RuleTxt'
ghenv.Component.Message = 'VER 0.1.0\nDEC_22_2017'
ghenv.Component.IconDisplayMode = ghenv.Component.IconDisplayMode.application
ghenv.Component.Category = "Wasp"
ghenv.Component.SubCategory = "3 | Rules"
try: ghenv.Component.AdditionalHelpFromDocStrings = "2"
except: pass

import scriptcontext as sc
import Grasshopper.Kernel as gh

def main(text):
    
    ## check if Wasp is setup
    if sc.sticky.has_key('WaspSetup'):
        
        check_data = True
        
        ##check inputs
        if text is None:
            check_data = False
            msg = "No text provided"
            ghenv.Component.AddRuntimeMessage(gh.GH_RuntimeMessageLevel.Warning, msg)
        
        if check_data:
            
            try:
                rule_parts = text.split("_")
                part1 = str(rule_parts[0].split("|")[0])
                conn1 = int(rule_parts[0].split("|")[1])
                part2 = str(rule_parts[1].split("|")[0])
                conn2 = int(rule_parts[1].split("|")[1])
                
                rule = sc.sticky['Rule'](part1, conn1, part2, conn2)
                return rule
            except:
                msg = "Text string %s is not formatted correctly"%(text)
                ghenv.Component.AddRuntimeMessage(gh.GH_RuntimeMessageLevel.Error, msg)
                return -1
        else:
            return -1
    
    else:
        ## throw warining
        msg = "You must run the SetupWasp component before starting to build!"
        ghenv.Component.AddRuntimeMessage(gh.GH_RuntimeMessageLevel.Warning, msg)
        return -1


result = main(TXT)

if result != -1:
    R = result
# ---------- end ruletxt ----------

# ----
constraints = ValueList({"NONE": 0, "LOCAL": 1, "GLOBAL": 2, "LOCAL + GLOBAL": 3}, selected="NONE")  # disabled
rulegen_2 = Wasp_RulesGenerator(PART=constrpart_3)  # -> R; inputs PART: list, SELF_P: Boolean, SELF_C: Boolean, GR: list; same code as rulegen
constraints_2 = ValueList({"NONE": 0, "LOCAL": 1, "GLOBAL": 2, "LOCAL + GLOBAL": 3}, selected="NONE")  # disabled

# ---- group: OK
derule = Wasp_DeconstructRule(R=rulegen)  # -> P1, C1, P2, C2, TXT
# ---------- derule: Python ----------
# Wasp: Discrete Design with Grasshopper plug-in (GPL) initiated by Andrea Rossi
# 
# This file is part of Wasp.
# 
# Copyright (c) 2017, Andrea Rossi <a.rossi.andrea@gmail.com>
# Wasp is free software; you can redistribute it and/or modify 
# it under the terms of the GNU General Public License as published 
# by the Free Software Foundation; either version 3 of the License, 
# or (at your option) any later version. 
# 
# Wasp is distributed in the hope that it will be useful,
# but WITHOUT ANY WARRANTY; without even the implied warranty of 
# MERCHANTABILITY or FITNESS FOR A PARTICULAR PURPOSE. See the 
# GNU General Public License for more details.
# 
# You should have received a copy of the GNU General Public License
# along with Wasp; If not, see <http://www.gnu.org/licenses/>.
# 
# @license GPL-3.0 <https://www.gnu.org/licenses/gpl.html>
#
# Significant parts of Wasp have been developed by Andrea Rossi
# as part of research on digital materials and discrete design at:
# DDU Digital Design Unit - Prof. Oliver Tessmann
# Technische Universität Darmstadt


#########################################################################
##                            COMPONENT INFO                           ##
#########################################################################

"""
Extract information from a rule instance.
-
Provided by Wasp 0.1.0
    Args:
        R: Rule
    Returns:
        P1: Name of base part
        C1: Id of base connection
        P2: Name of new part to be aggregated
        C2: Id of new connection
        TXT: Text representation of rule
"""

ghenv.Component.Name = "Wasp_Deconstruct Rule"
ghenv.Component.NickName = 'DeRule'
ghenv.Component.Message = 'VER 0.1.0\nDEC_22_2017'
ghenv.Component.IconDisplayMode = ghenv.Component.IconDisplayMode.application
ghenv.Component.Category = "Wasp"
ghenv.Component.SubCategory = "3 | Rules"
try: ghenv.Component.AdditionalHelpFromDocStrings = "2"
except: pass

import scriptcontext as sc
import Grasshopper.Kernel as gh

def main(rule):
    
    ## check if Wasp is setup
    if sc.sticky.has_key('WaspSetup'):
        
        check_data = True
        
        ##check inputs
        if rule is None:
            check_data = False
            msg = "No rule provided"
            ghenv.Component.AddRuntimeMessage(gh.GH_RuntimeMessageLevel.Warning, msg)
        
        if check_data:
            p1 = rule.part1
            c1 = rule.conn1
            p2 = rule.part2
            c2 = rule.conn2
            rule_txt = "%s|%s_%s|%s"%(p1,c1,p2,c2)
            
            return p1, c1, p2, c2, rule_txt
        else:
            return -1
    
    else:
        ## throw warining
        msg = "You must run the SetupWasp component before starting to build!"
        ghenv.Component.AddRuntimeMessage(gh.GH_RuntimeMessageLevel.Warning, msg)
        return -1


result = main(R)

if result != -1:
    P1 = result[0]
    C1 = result[1]
    P2 = result[2]
    C2 = result[3]
    TXT = result[4]


R = sc.sticky['Rule'](P1, C1, P2, C2)
# ---------- end derule ----------

# ----
rulegen_3 = Wasp_RulesGenerator(PART=constrpart_2)  # -> R; inputs PART: list, SELF_P: Boolean, SELF_C: Boolean, GR: list; disabled; same code as rulegen
merge_6 = Merge(Data1=ruletxt, Data2=rule)
number_slider_4 = Slider(250, range=0..10000)  # disabled
geo = Geometry(depart.GEO)  # disabled
number_slider_5 = Slider(50, range=0..10000)  # disabled
number_slider_6 = Slider(300, range=0..1000)
panel_7 = Panel("myAggr2")  # disabled
panel_8 = Panel(derule.TXT)
panel_9 = Panel("myAggr3")  # disabled
button = Button()  # disabled
button_2 = Button()  # disabled
preview = CustomPreview(Geometry=fieldpts.PTS, Shader=gradient)
preview_2 = CustomPreview(Geometry=fieldpts.PTS, Shader=gradient_2)

# ---- group: OK
field = Wasp_Field(NAME="f_01", BOU=boundary, PTS=fieldpts.PTS, COUNT=fieldpts.COUNT, RES=cell_size, VAL=graph)  # -> FIELD; inputs BOU: list of GeometryBase, PTS: list of Point3d, COUNT: Vector3d, VAL: list
# ---------- field: Python ----------
# Wasp: Discrete Design with Grasshopper plug-in (GPL) initiated by Andrea Rossi
# 
# This file is part of Wasp.
# 
# Copyright (c) 2017, Andrea Rossi <a.rossi.andrea@gmail.com>
# Wasp is free software; you can redistribute it and/or modify 
# it under the terms of the GNU General Public License as published 
# by the Free Software Foundation; either version 3 of the License, 
# or (at your option) any later version. 
# 
# Wasp is distributed in the hope that it will be useful,
# but WITHOUT ANY WARRANTY; without even the implied warranty of 
# MERCHANTABILITY or FITNESS FOR A PARTICULAR PURPOSE. See the 
# GNU General Public License for more details.
# 
# You should have received a copy of the GNU General Public License
# along with Wasp; If not, see <http://www.gnu.org/licenses/>.
# 
# @license GPL-3.0 <https://www.gnu.org/licenses/gpl.html>
#
# Significant parts of Wasp have been developed by Andrea Rossi
# as part of research on digital materials and discrete design at:
# DDU Digital Design Unit - Prof. Oliver Tessmann
# Technische Universität Darmstadt


#########################################################################
##                            COMPONENT INFO                           ##
#########################################################################

"""
Generates a scalar field given a grid of points and their relative scalar values
-
Provided by Wasp 0.1.0
    Args:
        BOU: List of geometries defining the boundaries of the field. Geometries must be closed breps or meshes. All points of the field outside the geometries will be assigned a 0 value
        PTS: 3d point grid (from FieldPts component)
        COUNT: Vector storing cell counts for each axis (from FieldPts component)
        RES: Resolution of cell grid
        VAL: Values to assign to each cell
    Returns:
        FIELD: Field object (to be used to drive the FieldAggr component)
"""

ghenv.Component.Name = "Wasp_Field"
ghenv.Component.NickName = 'Field'
ghenv.Component.Message = 'VER 0.2.0'
ghenv.Component.IconDisplayMode = ghenv.Component.IconDisplayMode.application
ghenv.Component.Category = "Wasp"
ghenv.Component.SubCategory = "4 | Aggregation"
try: ghenv.Component.AdditionalHelpFromDocStrings = "1"
except: pass

import scriptcontext as sc
import Rhino.Geometry as rg
import Grasshopper.Kernel as gh


def main(name, boundaries, pts, count, resolution, values):
    
    ## check if Wasp is setup
    if sc.sticky.has_key('WaspSetup'):
        
        check_data = True
        
        ##check inputs
        if name is None:
            name = "myField"
            msg = "Default field name set to 'myField'"
            ghenv.Component.AddRuntimeMessage(gh.GH_RuntimeMessageLevel.Remark, msg)
        
        if len(boundaries) == 0:
            boundaries.append(rg.BoundingBox(pts).ToBrep())
            msg = "No boundary provided. Boundary set to point grid bounding box"
            ghenv.Component.AddRuntimeMessage(gh.GH_RuntimeMessageLevel.Remark, msg)
        
        if len(pts) == 0:
            check_data = False
            msg = "No point grid provided"
            ghenv.Component.AddRuntimeMessage(gh.GH_RuntimeMessageLevel.Warning, msg)
            
        elif len(values) == 0:
            check_data = False
            msg = "No field values provided"
            ghenv.Component.AddRuntimeMessage(gh.GH_RuntimeMessageLevel.Warning, msg)
            
        elif len(pts) != len(values):
            check_data = False
            msg = "Points and Values lists are not matching. Please provide two lists with same number of elements"
            ghenv.Component.AddRuntimeMessage(gh.GH_RuntimeMessageLevel.Error, msg)
        
        if count is None:
            check_data = False
            msg = "No axis count provided"
            ghenv.Component.AddRuntimeMessage(gh.GH_RuntimeMessageLevel.Warning, msg)
        
        if resolution is None and check_data == True:
            resolution = pts[0].DistanceTo(pts[1])
            msg = "No resolution provided. Calculated resolution is %0.2f"%(resolution)
            ghenv.Component.AddRuntimeMessage(gh.GH_RuntimeMessageLevel.Remark, msg)
        
        if check_data:
            field = sc.sticky['Field'](name, boundaries, pts, count, resolution, values)
            return field
        else:
            return -1
    
    else:
        ## throw warining
        msg = "You must run the SetupWasp component before starting to build!"
        ghenv.Component.AddRuntimeMessage(gh.GH_RuntimeMessageLevel.Warning, msg)
        return -1


result = main(NAME, BOU, PTS, COUNT, RES, VAL)

if result != -1:
    FIELD = result
# ---------- end field ----------

field_2 = Wasp_Field(NAME="f_02", BOU=boundary, PTS=fieldpts.PTS, COUNT=fieldpts.COUNT, RES=cell_size, VAL=graph_2)  # -> FIELD; inputs BOU: list of GeometryBase, PTS: list of Point3d, COUNT: Vector3d, VAL: list; same code as field

# ---- group: NEW
rndaggr = Wasp_StochasticAggregation(PART=flatten(constrpart_3), N=number_slider_4, RULES=rulegen_2, MODE=constraints, ID=panel_7, RESET=button)  # -> PART_OUT; inputs PART: list, PREV: list, N: Int32, RULES: list, MODE: Int32, GC: list, RESET: Boolean; disabled
# ---------- rndaggr: Python ----------
# Wasp: Discrete Design with Grasshopper plug-in (GPL) initiated by Andrea Rossi
# 
# This file is part of Wasp.
# 
# Copyright (c) 2017, Andrea Rossi <a.rossi.andrea@gmail.com>
# Wasp is free software; you can redistribute it and/or modify 
# it under the terms of the GNU General Public License as published 
# by the Free Software Foundation; either version 3 of the License, 
# or (at your option) any later version. 
# 
# Wasp is distributed in the hope that it will be useful,
# but WITHOUT ANY WARRANTY; without even the implied warranty of 
# MERCHANTABILITY or FITNESS FOR A PARTICULAR PURPOSE. See the 
# GNU General Public License for more details.
# 
# You should have received a copy of the GNU General Public License
# along with Wasp; If not, see <http://www.gnu.org/licenses/>.
# 
# @license GPL-3.0 <https://www.gnu.org/licenses/gpl.html>
#
# Significant parts of Wasp have been developed by Andrea Rossi
# as part of research on digital materials and discrete design at:
# DDU Digital Design Unit - Prof. Oliver Tessmann
# Technische Universität Darmstadt


#########################################################################
##                            COMPONENT INFO                           ##
#########################################################################

"""
Aggregate the given parts in a stochastic process, selecting parts and rules randomly at every step.
The component works additively, hence increasing the number of parts in an aggregation just adds new parts on the existing ones, without triggering recomputing of the previous element.
-
Provided by Wasp 0.1.0
    Args:
        PART: Parts to be aggregated (can be more than one)
        PREV: Previous aggregated parts. It is possible to input the results of a previous aggregation, or parts transformed with the TransformPart component
        N: Number of parts to be aggregated (does not count parts provided in PREV)
        RULES: Rules for the aggregation
        COLL: OPTIONAL // Collision detection. By default is active and checks for collisions between the aggregated parts
        MODE: OPTIONAL // Switches between aggregation modes: 0 = Basic (Default: only parts collision check), 1 = Constrained (checks all constraints set on the part)
        GC: Global constraints to apply to aggregation
        ID: OPTIONAL // Aggregation ID (to avoid overwriting when having different aggregation components in the same file)
        RESET: Recompute the whole aggregation
    Returns:
        PART_OUT: Aggregated parts (includes both PREV input and newly aggregated parts)
"""

ghenv.Component.Name = "Wasp_Stochastic Aggregation"
ghenv.Component.NickName = 'RndAggr'
ghenv.Component.Message = 'VER 0.2.0'
ghenv.Component.IconDisplayMode = ghenv.Component.IconDisplayMode.application
ghenv.Component.Category = "Wasp"
ghenv.Component.SubCategory = "4 | Aggregation"
try: ghenv.Component.AdditionalHelpFromDocStrings = "2"
except: pass


import scriptcontext as sc
import Rhino.Geometry as rg
import Grasshopper.Kernel as gh
import random as rnd


def main(parts, previous_parts, num_parts, rules, aggregation_mode, global_constraints, aggregation_id, reset):
    
    ## check if Wasp is setup
    if sc.sticky.has_key('WaspSetup'):
        
        check_data = True
        
        ##check inputs
        if len(parts) == 0:
            check_data = False
            msg = "No parts provided"
            ghenv.Component.AddRuntimeMessage(gh.GH_RuntimeMessageLevel.Warning, msg)
        
        if num_parts is None:
            check_data = False
            msg = "Provide number of aggregation iterations"
            ghenv.Component.AddRuntimeMessage(gh.GH_RuntimeMessageLevel.Warning, msg)
        else:
            if len(previous_parts) != 0:
                num_parts += len(previous_parts)
        
        if len(rules) == 0:
            check_data = False
            msg = "No rules provided"
            ghenv.Component.AddRuntimeMessage(gh.GH_RuntimeMessageLevel.Warning, msg)
        
        if aggregation_mode is None:
            aggregation_mode = 0
        
        if aggregation_id is None:
            aggregation_id = 'myAggregation'
            msg = "Default name 'myAggregation' assigned"
            ghenv.Component.AddRuntimeMessage(gh.GH_RuntimeMessageLevel.Remark, msg)
        
        if reset is None:
            reset = False
        
        if check_data:
            ## store rules in sticky dict
            if sc.sticky.has_key('rules') == False:
                sc.sticky['rules'] = rules
            
            ## if rules changed, reset parts and recompute rule tables
            if rules != sc.sticky['rules']:
                for part in parts:
                    part.reset_part(rules)
                sc.sticky['rules'] = rules
                if sc.sticky.has_key(aggregation_id):
                    sc.sticky[aggregation_id].reset_rules(rules)
            
            ## create aggregation in sticky dict
            if sc.sticky.has_key(aggregation_id) == False:
                sc.sticky[aggregation_id] = sc.sticky['Aggregation'](aggregation_id, parts, sc.sticky['rules'], aggregation_mode, _prev = previous_parts, _global_constraints = global_constraints)
            
            if reset:
                sc.sticky[aggregation_id] = sc.sticky['Aggregation'](aggregation_id, parts, sc.sticky['rules'], aggregation_mode, _prev = previous_parts, _global_constraints = global_constraints)
            
            if num_parts > sc.sticky[aggregation_id].p_count:
                sc.sticky[aggregation_id].aggregate_rnd(num_parts-sc.sticky[aggregation_id].p_count)
            
            elif num_parts < sc.sticky[aggregation_id].p_count:
                sc.sticky[aggregation_id].remove_elements(num_parts)
                
            return sc.sticky[aggregation_id].aggregated_parts
            
        else:
            return -1
    
    else:
        ## throw warining
        msg = "You must run the SetupWasp component before starting to build!"
        ghenv.Component.AddRuntimeMessage(gh.GH_RuntimeMessageLevel.Warning, msg)
        return -1


result = main(PART, PREV, N, RULES, MODE, GC, ID, RESET)

if result != -1:
    PART_OUT = result
# ---------- end rndaggr ----------

rndaggr_2 = Wasp_StochasticAggregation(PART=flatten(constrpart_2), N=number_slider_5, RULES=rulegen_3, MODE=constraints_2, ID=panel_9, RESET=button_2)  # -> PART_OUT; inputs PART: list, PREV: list, N: Int32, RULES: list, MODE: Int32, GC: list, RESET: Boolean; disabled; same code as rndaggr

# ----
brep_2 = Brep(<brep referenced from the Rhino model>)
dom = ConstructDomain(DomainStart=expr("-x", number_slider_6), DomainEnd=number_slider_6)

# ---- group: OK
fieldaggregation = Wsp_FieldDrivenAggregation(
    PART=flatten(merge_5),
    N=fieldn,
    RULES=ruletxt,
    FIELD=field,
    THRES=Slider(0.95, range=0..1),
    MODE=wasp_aggregation_mode,
    ID="myFieldAggregation",
    RESET=Button())  # -> PART_OUT; inputs PART: list, PREV: list, N: Int32, RULES: list, COLL: Boolean, MODE: Int32, RESET: Boolean
# ---------- fieldaggregation: Python ----------
# Wasp: Discrete Design with Grasshopper plug-in (GPL) initiated by Andrea Rossi
# 
# This file is part of Wasp.
# 
# Copyright (c) 2017, Andrea Rossi <a.rossi.andrea@gmail.com>
# Wasp is free software; you can redistribute it and/or modify 
# it under the terms of the GNU General Public License as published 
# by the Free Software Foundation; either version 3 of the License, 
# or (at your option) any later version. 
# 
# Wasp is distributed in the hope that it will be useful,
# but WITHOUT ANY WARRANTY; without even the implied warranty of 
# MERCHANTABILITY or FITNESS FOR A PARTICULAR PURPOSE. See the 
# GNU General Public License for more details.
# 
# You should have received a copy of the GNU General Public License
# along with Wasp; If not, see <http://www.gnu.org/licenses/>.
# 
# @license GPL-3.0 <https://www.gnu.org/licenses/gpl.html>
#
# Significant parts of Wasp have been developed by Andrea Rossi
# as part of research on digital materials and discrete design at:
# DDU Digital Design Unit - Prof. Oliver Tessmann
# Technische Universität Darmstadt


#########################################################################
##                            COMPONENT INFO                           ##
#########################################################################

"""
Aggregate the given parts according to a given scalar field. New parts are added following higher values in the field.
The component works additively, hence increasing the number of parts in an aggregation just adds new parts on the existing ones, without triggering recomputing of the previous element
-
Provided by Wasp 0.1.0
    Args:
        PART: Parts to be aggregated (can be more than one)
        PREV: Previous aggregated parts. It is possible to input the results of a previous aggregation, or parts transformed with the TransformPart component
        N: Number of parts to be aggregated (does not count parts provided in PREV)
        RULES: Rules for the aggregation
        FIELD: Scalar field to drive the aggregation (parts will be added following higher values in the field)
        THRES: OPTIONAL // If set, used to define a threshold value above which the placement of next part is accepted. If not set, aggregation will look for part with highest value in the whole field. Setting a low threshold helds less accurate results, but highly speeds up calculations
        COLL: OPTIONAL // Collision detection. By default is active and checks for collisions between the aggregated parts
        MODE: OPTIONAL // Switches between aggregation modes: 0 = Basic (Default: only parts collision check), 1 = Constrained (checks all constraints set on the part)
        ID: OPTIONAL // Aggregation ID (to avoid overwriting when having different aggregation components in the same file)
        RESET: Recompute the whole aggregation
    Returns:
        PART_OUT: Aggregated parts (includes both PREV input and newly aggregated parts)
"""

ghenv.Component.Name = "Wsp_Field-driven Aggregation"
ghenv.Component.NickName = 'FieldAggregation'
ghenv.Component.Message = 'VER 0.1.0\nDEC_22_2017'
ghenv.Component.IconDisplayMode = ghenv.Component.IconDisplayMode.application
ghenv.Component.Category = "Wasp"
ghenv.Component.SubCategory = "4 | Aggregation"
try: ghenv.Component.AdditionalHelpFromDocStrings = "2"
except: pass


import scriptcontext as sc
import Rhino.Geometry as rg
import Grasshopper.Kernel as gh
import random as rnd
import math
import copy


## find the rule that creates a component as closest as possible to the target surface
def findBestRule(aggr_id, aggr_parts, aggr_field, thres, aggr_coll, aggr_mode):
    max_val = None
    best_rule = None
    best_conn = None
    best_conn_id = -1
    
    for i in range(len(sc.sticky[aggr_id])):
        part_01 = sc.sticky[aggr_id][i]
        for i2 in range(len(part_01.active_connections)-1, -1, -1):
            conn_01_id = part_01.active_connections[i2]
            conn_01 = part_01.connections[conn_01_id]
            for i3 in range(len(conn_01.active_rules)-1, -1, -1):
                rule_id = conn_01.active_rules[i3]
                rule = conn_01.rules_table[rule_id]
                
                next_part = None
                for part in aggr_parts:
                    if part.name == rule.part2:
                        next_part = part
                        break
                
                next_center = rg.Point3d(next_part.center)
                orientTransform = rg.Transform.PlaneToPlane(next_part.connections[rule.conn2].flip_pln, conn_01.pln)
                next_center.Transform(orientTransform)
                    
                if aggr_field.bbox.Contains(next_center) == True:
                    current_target_val = aggr_field.return_pt_val(next_center)
                
                    if current_target_val > max_val or max_val == None:
                        
                        if next_center is None:
                            next_center = rg.Point3d(next_part.center)
                            orientTransform = rg.Transform.PlaneToPlane(next_part.connections[rule.conn2].flip_pln, conn_01.pln)
                            next_center.Transform(orientTransform)
                        
                        ## overlap check
                        close_neighbour_check = False
                        for ex_part in sc.sticky[aggr_id]:
                            dist = ex_part.center.DistanceTo(next_center)
                            if dist < sc.sticky['model_tolerance']:
                                close_neighbour_check = True
                                break
                        
                        ## collision check
                        collision_check = False
                        if aggr_coll == True and close_neighbour_check == False:
                            next_part_collider = next_part.transform_collider(orientTransform)
                            for ex_part in sc.sticky[aggr_id]:
                                if len(rg.Intersect.Intersection.MeshMeshFast(ex_part.collider, next_part_collider)) > 0:
                                    collision_check = True
                                    break
                        
                        ## constraints check
                        add_collision_check = False
                        missing_supports_check = False
                        if aggr_mode == 1:
                            if close_neighbour_check == False and collision_check == False:
                                if next_part.is_constrained:
                                    
                                    ## additional collider check
                                    if next_part.add_collider != None:
                                        add_collider = next_part.add_collider.Duplicate()
                                        add_collider.Transform(orientTransform)
                                        for ex_part in sc.sticky[aggr_id]:
                                            intersections = rg.Intersect.Intersection.MeshMeshFast(ex_part.collider, add_collider)
                                            if len(intersections) > 0:
                                                add_collision_check = True
                                                break
                                    
                                    ## supports check
                                    if add_collision_check == False:
                                        if len(next_part.supports) > 0:
                                            for sup in next_part.supports:
                                                missing_supports_check = True
                                                supports_count = 0
                                                for dir in sup.sup_dir:
                                                    dir_trans = dir.Duplicate()
                                                    dir_trans.Transform(orientTransform)
                                                    
                                                    for ex_part in sc.sticky[aggr_id]:
                                                        if len(rg.Intersect.Intersection.MeshPolyline(ex_part.collider, dir_trans)[0]) > 0:
                                                            supports_count += 1
                                                            break
                                                if supports_count == len(sup.sup_dir):
                                                    missing_supports_check = False
                                                    break
                        
                        
                        if close_neighbour_check == False and collision_check == False and add_collision_check == False and missing_supports_check == False:
                            max_val = current_target_val
                            best_rule = rule
                            best_conn = conn_01
                            best_part_id = i
                            best_conn_id = conn_01_id
                            
                            if thres is not None and max_val > thres:
                                break
                            
                        elif missing_supports_check == False:
                            ## remove rules if they cause collisions or overlappings
                            for i4 in range(len(sc.sticky[aggr_id][i].connections[conn_01_id].active_rules)):
                               if sc.sticky[aggr_id][i].connections[conn_01_id].active_rules[i4] == rule_id:
                                   sc.sticky[aggr_id][i].connections[conn_01_id].active_rules.pop(i4)
                                   break
                            ## check if the connection is still active (still active rules available)
                            if len(sc.sticky[aggr_id][i].connections[conn_01_id].active_rules) == 0:
                               for i4 in range(len(sc.sticky[aggr_id][i].active_connections)):
                                if sc.sticky[aggr_id][i].active_connections[i4] == conn_01_id:
                                    sc.sticky[aggr_id][i].active_connections.pop(i4)
                                    break
            if thres is not None and max_val > thres:
                break
        if thres is not None and max_val > thres:
            break
    
    if best_rule is not None:
        return best_conn, best_part_id, best_conn_id, best_rule.part2, best_rule.conn2, best_rule
    else:
        return -1, -1, -1, -1, -1, -1



def aggregate_field(aggr_id, aggr_parts, aggr_rules, aggr_field, aggr_threshold, iter, aggr_coll, aggr_mode):
    count = 0
    loops = 0
    while count < iter:
        ## avoid endless loops
        loops += 1
        if loops > iter*100:
            break
        
        ## if no part is present in the aggregation, add first random part
        if len(sc.sticky[aggr_id]) == 0:
            count += 1
            first_part = aggr_parts[rnd.randint(0, len(aggr_parts)-1)]
            
            start_point = aggr_field.highest_pt
            mov_vec = rg.Vector3d.Subtract(rg.Vector3d(start_point), rg.Vector3d(first_part.center))
            move_transform = rg.Transform.Translation(mov_vec.X, mov_vec.Y, mov_vec.Z)
            first_part_trans = first_part.transform(move_transform)
            
            for conn in first_part_trans.connections:
                conn.generate_rules_table(aggr_rules)
            
            sc.sticky[aggr_id].append(first_part_trans)
        
        else:
            ## select part-rule couple creating next part in the highest point of field
            conn_01, part_01_id, conn_01_id, next_part_name, next_conn_id, next_rule = findBestRule(aggr_id, aggr_parts, aggr_field, aggr_threshold, aggr_coll, aggr_mode)
            
            if conn_01_id == -1:
                msg = "aborted after " + str(count) + " iterations"
                ghenv.Component.AddRuntimeMessage(gh.GH_RuntimeMessageLevel.Warning, msg)
                break
            
            next_part = None
            for part in aggr_parts:
                if part.name == next_part_name:
                    next_part = part
            
            orientTransform = rg.Transform.PlaneToPlane(next_part.connections[next_conn_id].flip_pln, conn_01.pln)
            next_part_center = next_part.transform_center(orientTransform)
            
            next_part_trans = next_part.transform(orientTransform)
            next_part_trans.reset_part(aggr_rules)
            for i in range(len(next_part_trans.active_connections)):
                if next_part_trans.active_connections[i] == next_rule.conn2:
                    next_part_trans.active_connections.pop(i)
                    break
            sc.sticky[aggr_id].append(next_part_trans)
            
            count += 1


## Main code execution
def main(parts, previous_parts, num_parts, rules, field, threshold, collision, aggregation_mode, aggregation_id, reset):
    
    ## check if Wasp is setup
    if sc.sticky.has_key('WaspSetup'):
        
        check_data = True
        ##check inputs
        if len(parts) == 0:
            check_data = False
            msg = "No parts provided"
            ghenv.Component.AddRuntimeMessage(gh.GH_RuntimeMessageLevel.Warning, msg)
        
        if num_parts is None:
            check_data = False
            msg = "Provide number of aggregation iterations"
            ghenv.Component.AddRuntimeMessage(gh.GH_RuntimeMessageLevel.Warning, msg)
        else:
            if len(previous_parts) != 0:
                num_parts += len(previous_parts)
        
        if len(rules) == 0:
            check_data = False
            msg = "No rules provided"
            ghenv.Component.AddRuntimeMessage(gh.GH_RuntimeMessageLevel.Warning, msg)
        
        if field is None:
            check_data = False
            msg = "Provide a valid scalar field"
            ghenv.Component.AddRuntimeMessage(gh.GH_RuntimeMessageLevel.Warning, msg)
        
        if collision is None:
            collision = True
        
        if aggregation_id is None:
            aggregation_id = 'Aggregation'
            msg = "Default name 'Aggregation' assigned"
            ghenv.Component.AddRuntimeMessage(gh.GH_RuntimeMessageLevel.Remark, msg)
        
        if reset is None:
            reset = False
        
        if check_data:
            if sc.sticky.has_key(aggregation_id) == False:
                sc.sticky[aggregation_id] = []
            
            if reset:
                sc.sticky[aggregation_id] = []
                
                for part in parts:
                    part.reset_part(rules)
                
                if len(previous_parts) > 0:
                    for part in previous_parts:
                        part.reset_part(rules)
                        sc.sticky[aggregation_id].append(part)
            
            if num_parts > len(sc.sticky[aggregation_id]):
                aggregate_field(aggregation_id, parts, rules, field, threshold, num_parts - len(sc.sticky[aggregation_id]), collision, aggregation_mode)
                if len(sc.sticky[aggregation_id]) < num_parts:
                    msg = "Could not place " + str(num_parts - len(sc.sticky[aggregation_id])) + " parts"
                    ghenv.Component.AddRuntimeMessage(gh.GH_RuntimeMessageLevel.Warning, msg)
            
            elif num_parts < len(sc.sticky[aggregation_id]):
                sc.sticky[aggregation_id] = sc.sticky[aggregation_id][:num_parts]
                for part in sc.sticky[aggregation_id]:
                    part.reset_part(rules)
                
                for part in parts:
                    part.reset_part(rules)
            
            return sc.sticky[aggregation_id]
            
        else:
            return -1
    
    else:
        ## throw warining
        msg = "You must run the SetupWasp component before starting to build!"
        ghenv.Component.AddRuntimeMessage(gh.GH_RuntimeMessageLevel.Warning, msg)
        return -1


result = main(PART, PREV, N, RULES, FIELD, THRES, COLL, MODE, ID, RESET)

if result != -1:
    PART_OUT = result
# ---------- end fieldaggregation ----------

# ----
number_slider_7 = Slider(1, range=0..10)  # disabled
mesh_3 = MeshBrep(
    Brep=brep_2,
    Settings={GridMaxCount=0, GridMinCount=16, JaggedSeams=False, MaxEdgeLength=0, MinEdgeLength=0.0001, MinTolerance=0, Refine=True, RefineAngle=0, RelativeTolerance=0.65, SimplePlanes=True, Tolerance=0})
xz = XZPlane(Origin=Point(0, 0, 0))
yz = YZPlane(Origin=Point(0, 0, 0))
range = Range(Domain=Domain(0, 1), Steps=Slider(40, range=0..100))
faceb = FaceBoundaries(Mesh=mesh_3)
subset = SubList(List=reverse(rndaggr_2), Domain=number_slider_5, Wrap=True)  # -> List, Index; disabled
planeconst = Wasp_PlaneConstraint(PLN=yz, POS=Toggle(True))  # -> PC; inputs PLN: Plane, POS: Boolean
# ---------- planeconst: Python ----------
# Wasp: Discrete Design with Grasshopper plug-in (GPL) initiated by Andrea Rossi
# 
# This file is part of Wasp.
# 
# Copyright (c) 2017, Andrea Rossi <a.rossi.andrea@gmail.com>
# Wasp is free software; you can redistribute it and/or modify 
# it under the terms of the GNU General Public License as published 
# by the Free Software Foundation; either version 3 of the License, 
# or (at your option) any later version. 
# 
# Wasp is distributed in the hope that it will be useful,
# but WITHOUT ANY WARRANTY; without even the implied warranty of 
# MERCHANTABILITY or FITNESS FOR A PARTICULAR PURPOSE. See the 
# GNU General Public License for more details.
# 
# You should have received a copy of the GNU General Public License
# along with Wasp; If not, see <http://www.gnu.org/licenses/>.
# 
# @license GPL-3.0 <https://www.gnu.org/licenses/gpl.html>
#
# Significant parts of Wasp have been developed by Andrea Rossi
# as part of research on digital materials and discrete design at:
# DDU Digital Design Unit - Prof. Oliver Tessmann
# Technische Universität Darmstadt


#########################################################################
##                            COMPONENT INFO                           ##
#########################################################################

"""
Plane global constraint
-
Provided by Wasp 0.2.0
    Args:
        PLN: Plane to use as constraints
        POS: If True, parts are placed only on the positive Z side of the plane. If False, parts are placed only on the positive Z side of the plane
    Returns:
        PC: Plane constraint
"""

ghenv.Component.Name = "Wasp_Plane Constraint"
ghenv.Component.NickName = 'PlaneConst'
ghenv.Component.Message = "VER 0.2.0"
ghenv.Component.IconDisplayMode = ghenv.Component.IconDisplayMode.application
ghenv.Component.Category = "Wasp"
ghenv.Component.SubCategory = "X | Experimental"
try: ghenv.Component.AdditionalHelpFromDocStrings = "1"
except: pass


import scriptcontext as sc
import Rhino.Geometry as rg
import Grasshopper.Kernel as gh
import random as rnd
import math
import copy


## Main code execution
def main(plane, positive):
    
    ## check if Wasp is setup
    if sc.sticky.has_key('WaspSetup'):
        
        check_data = True
        ##check inputs
        if plane is None:
            check_data = False
            msg = "Provide a valid plane"
            ghenv.Component.AddRuntimeMessage(gh.GH_RuntimeMessageLevel.Warning, msg)
        
        if positive is None:
            positive = True
            msg = "Default plane direction set to +Z"
            ghenv.Component.AddRuntimeMessage(gh.GH_RuntimeMessageLevel.Remark, msg)
        
        if check_data:
            plane_constraint = sc.sticky['Plane_Constraint'](plane, positive)
            return plane_constraint
            
        else:
            return -1
    
    else:
        ## throw warining
        msg = "You must run the SetupWasp component before starting to build!"
        ghenv.Component.AddRuntimeMessage(gh.GH_RuntimeMessageLevel.Warning, msg)
        return -1


result = main(PLN, POS)

if result != -1:
    PC = result
# ---------- end planeconst ----------
meshconst = Wasp_MeshConstraint(GEO=mesh_3, IN=Toggle(True))  # -> GC; inputs GEO: Mesh
#   port GEO: Plane to use as constraints
# ---------- meshconst: Python ----------
# Wasp: Discrete Design with Grasshopper plug-in (GPL) initiated by Andrea Rossi
# 
# This file is part of Wasp.
# 
# Copyright (c) 2017, Andrea Rossi <a.rossi.andrea@gmail.com>
# Wasp is free software; you can redistribute it and/or modify 
# it under the terms of the GNU General Public License as published 
# by the Free Software Foundation; either version 3 of the License, 
# or (at your option) any later version. 
# 
# Wasp is distributed in the hope that it will be useful,
# but WITHOUT ANY WARRANTY; without even the implied warranty of 
# MERCHANTABILITY or FITNESS FOR A PARTICULAR PURPOSE. See the 
# GNU General Public License for more details.
# 
# You should have received a copy of the GNU General Public License
# along with Wasp; If not, see <http://www.gnu.org/licenses/>.
# 
# @license GPL-3.0 <https://www.gnu.org/licenses/gpl.html>
#
# Significant parts of Wasp have been developed by Andrea Rossi
# as part of research on digital materials and discrete design at:
# DDU Digital Design Unit - Prof. Oliver Tessmann
# Technische Universität Darmstadt


#########################################################################
##                            COMPONENT INFO                           ##
#########################################################################

"""
Mesh collision global constraint
-
Provided by Wasp 0.2.0
    Args:
        GEOMETRY: Geometry of the collision shape
        IN: Check only for intersections (False) or also for inclusion (True)
    Returns:
        GC: Mesh constraint
"""

ghenv.Component.Name = "Wasp_Mesh Constraint"
ghenv.Component.NickName = 'MeshConst'
ghenv.Component.Message = "VER 0.2.0"
ghenv.Component.IconDisplayMode = ghenv.Component.IconDisplayMode.application
ghenv.Component.Category = "Wasp"
ghenv.Component.SubCategory = "X | Experimental"
try: ghenv.Component.AdditionalHelpFromDocStrings = "1"
except: pass


import scriptcontext as sc
import Rhino.Geometry as rg
import Grasshopper.Kernel as gh
import random as rnd
import math
import copy


## Main code execution
def main(geometry, inside):
    
    ## check if Wasp is setup
    if sc.sticky.has_key('WaspSetup'):
        
        check_data = True
        ##check inputs
        if geometry is None:
            check_data = False
            msg = "Provide a valid geometry"
            ghenv.Component.AddRuntimeMessage(gh.GH_RuntimeMessageLevel.Warning, msg)
        
        if inside is None:
            inside == False
        elif inside == True:
            naked_edges = geometry.GetNakedEdges()
            if naked_edges is not None:
                check_data = False
                msg = "The geometry is not closed!"
                ghenv.Component.AddRuntimeMessage(gh.GH_RuntimeMessageLevel.Warning, msg)
        
        
        if check_data:
            geo_constraint = sc.sticky['Mesh_Constraint'](geometry, inside)
            return geo_constraint
            
        else:
            return -1
    
    else:
        ## throw warining
        msg = "You must run the SetupWasp component before starting to build!"
        ghenv.Component.AddRuntimeMessage(gh.GH_RuntimeMessageLevel.Warning, msg)
        return -1


result = main(GEO, IN)

if result != -1:
    GC = result
# ---------- end meshconst ----------
planeconst_2 = Wasp_PlaneConstraint(PLN=xz, POS=Toggle(False))  # -> PC; inputs PLN: Plane, POS: Boolean; same code as planeconst
planesrf = PlaneSurface(Plane=xz, XSize=dom, YSize=dom)
planesrf_2 = PlaneSurface(Plane=yz, XSize=dom, YSize=dom)
pt_2 = ConstructPoint(XCoordinate=range, YCoordinate=range, ZCoordinate=range)
merge_7 = Merge(Data1=field, Data2=field_2)
depart_2 = Wasp_DeconstructPart(PART=subset.List)  # -> NAME, GEO, CONN, CONN_PLN, TR, CHILD, ATTR; inputs PART: list; disabled; same code as depart
parthie = Wasp_PartsHierarchy(PART=rndaggr, LEVEL=number_slider_7)  # -> SUB_P; inputs PART: list; disabled
# ---------- parthie: Python ----------
# Wasp: Discrete Design with Grasshopper plug-in (GPL) initiated by Andrea Rossi
# 
# This file is part of Wasp.
# 
# Copyright (c) 2017, Andrea Rossi <a.rossi.andrea@gmail.com>
# Wasp is free software; you can redistribute it and/or modify 
# it under the terms of the GNU General Public License as published 
# by the Free Software Foundation; either version 3 of the License, 
# or (at your option) any later version. 
# 
# Wasp is distributed in the hope that it will be useful,
# but WITHOUT ANY WARRANTY; without even the implied warranty of 
# MERCHANTABILITY or FITNESS FOR A PARTICULAR PURPOSE. See the 
# GNU General Public License for more details.
# 
# You should have received a copy of the GNU General Public License
# along with Wasp; If not, see <http://www.gnu.org/licenses/>.
# 
# @license GPL-3.0 <https://www.gnu.org/licenses/gpl.html>
#
# Significant parts of Wasp have been developed by Andrea Rossi
# as part of research on digital materials and discrete design at:
# DDU Digital Design Unit - Prof. Oliver Tessmann
# Technische Universität Darmstadt


#########################################################################
##                            COMPONENT INFO                           ##
#########################################################################

"""
Access sub-parts stored at different aggregation hierarchy levels
-
Provided by Wasp 0.1.0
    Args:
        PART: Parts
        LEVEL: ...
    Returns:
        SUB_P: Parts at the selected hierarchy level
"""

ghenv.Component.Name = "Wasp_Parts Hierarchy"
ghenv.Component.NickName = 'PartHie'
ghenv.Component.Message = 'VER 0.2.0'
ghenv.Component.IconDisplayMode = ghenv.Component.IconDisplayMode.application
ghenv.Component.Category = "Wasp"
ghenv.Component.SubCategory = "X | Experimental"
try: ghenv.Component.AdditionalHelpFromDocStrings = "2"
except: pass


import scriptcontext as sc
import Rhino.Geometry as rg
import Grasshopper.Kernel as gh
import random as rnd

def main(parts, hierarchy_level):
    
    ## check if Wasp is setup
    if sc.sticky.has_key('WaspSetup'):
        
        check_data = True
        
        ##check inputs
        if len(parts) == 0:
            check_data = False
            msg = "No parts provided"
            ghenv.Component.AddRuntimeMessage(gh.GH_RuntimeMessageLevel.Warning, msg)
        
        if hierarchy_level is None:
            hierarchy_level = 0
        
        if check_data:
            current_parts = parts
            sub_parts = []
            
            current_level = 0
            
            if hierarchy_level == 0:
                return parts
            else:
                while current_level < hierarchy_level:
                    current_level += 1
                    
                    for part in current_parts:
                        if len(part.sub_parts) > 0:
                            for sp in part.sub_parts:
                                sp_trans = sp.transform(part.transformation)
                                sub_parts.append(sp_trans)
                        else:
                            msg = "The selected hierarchy level does not exist in the provided parts"
                            ghenv.Component.AddRuntimeMessage(gh.GH_RuntimeMessageLevel.Warning, msg)
                            return parts
                    
                    current_parts = []
                    for sp in sub_parts:
                        current_parts.append(sp)
                    sub_parts = []
                    
                
                return current_parts
        else:
            return -1
    
    else:
        ## throw warining
        msg = "You must run the SetupWasp component before starting to build!"
        ghenv.Component.AddRuntimeMessage(gh.GH_RuntimeMessageLevel.Warning, msg)
        return -1

result = main(PART, LEVEL)

if result != -1:
    SUB_P = result
# ---------- end parthie ----------
subset_2 = SubList(List=reverse(rndaggr), Domain=number_slider_4, Wrap=True)  # -> List, Index; disabled
merge_8 = Merge(Data1=meshconst, Data2=planeconst, Data3=planeconst_2)
iso = IsoCurve(Surface=reparameterize(planesrf), UVPoint=pt_2)  # -> UIsocurve, VIsocurve
iso_2 = IsoCurve(Surface=reparameterize(planesrf_2), UVPoint=pt_2)  # -> UIsocurve, VIsocurve
wasp_aggregation_mode_2 = ValueList({"BASIC": 0, "CONSTRAINED": 1}, selected="BASIC")  # disabled
wasp_aggregation_mode_3 = ValueList({"BASIC": 0, "CONSTRAINED": 1}, selected="CONSTRAINED")  # disabled
constraints_3 = ValueList({"NONE": 0, "LOCAL": 1, "GLOBAL": 2, "LOCAL + GLOBAL": 3}, selected="NONE")
constraints_4 = ValueList({"NONE": 0, "LOCAL": 1, "GLOBAL": 2, "LOCAL + GLOBAL": 3}, selected="NONE")
swatch = ColourSwatch(SwatchColor=RGB(211, 227, 148))  # disabled
number_slider_8 = Slider(1, range=0..1)  # disabled
fieldn_2 = Slider(100, range=0..1000)  # disabled
panel_10 = Panel("myFieldAggregation")  # disabled
fieldn_3 = Slider(50, range=0..10000)
number_slider_9 = Slider(500, range=0..10000)  # disabled
toggle = BooleanToggle(True)  # disabled
button_3 = Button()  # disabled
preview_3 = CustomPreview(Geometry=depart_2.GEO, Material=swatch)  # disabled
depart_3 = Wasp_DeconstructPart(PART=subset_2.List)  # -> NAME, GEO, CONN, CONN_PLN, TR, CHILD, ATTR; inputs PART: list; disabled; same code as depart
panel_11 = Panel("myAggregation")  # disabled

panel_12 = Panel("mySequence")  # disabled
panel_13 = Panel("""L|1_L|6>a_b
a|4_L|10>a_c
a|3_S|4>c_d
d|2_L|7>d_e
e|4_L|7>e_f""")  # disabled
button_4 = Button()  # disabled
graphaggr = Wasp_GraphGrammarAggregation(PART=flatten(merge_5), RULE_S=panel_13, ID=panel_12, RESET=button_4)  # -> PART_OUT; inputs PART: list, PREV: list, RULE_S: list, RESET: Boolean; disabled
# ---------- graphaggr: Python ----------
# Wasp: Discrete Design with Grasshopper plug-in (GPL) initiated by Andrea Rossi
# 
# This file is part of Wasp.
# 
# Copyright (c) 2017, Andrea Rossi <a.rossi.andrea@gmail.com>
# Wasp is free software; you can redistribute it and/or modify 
# it under the terms of the GNU General Public License as published 
# by the Free Software Foundation; either version 3 of the License, 
# or (at your option) any later version. 
# 
# Wasp is distributed in the hope that it will be useful,
# but WITHOUT ANY WARRANTY; without even the implied warranty of 
# MERCHANTABILITY or FITNESS FOR A PARTICULAR PURPOSE. See the 
# GNU General Public License for more details.
# 
# You should have received a copy of the GNU General Public License
# along with Wasp; If not, see <http://www.gnu.org/licenses/>.
# 
# @license GPL-3.0 <https://www.gnu.org/licenses/gpl.html>
#
# Significant parts of Wasp have been developed by Andrea Rossi
# as part of research on digital materials and discrete design at:
# DDU Digital Design Unit - Prof. Oliver Tessmann
# Technische Universität Darmstadt
        
        
#########################################################################
##                            COMPONENT INFO                           ##
#########################################################################
        
"""
Aggregate the given parts in a stochastic process, selecting parts and rules randomly at every step.
The component works additively, hence increasing the number of parts in an aggregation just adds new parts on the existing ones, without triggering recomputing of the previous element.
-
Provided by Wasp 0.1.0
    Args:
        PART: Parts to be aggregated (can be more than one)
        PREV: Previous aggregated parts. It is possible to input the results of a previous aggregation, or parts transformed with the TransformPart component
        RULES: Rules for the aggregation
        ID: OPTIONAL // Aggregation ID (to avoid overwriting when having different aggregation components in the same file)
    Returns:
        PART_OUT: Aggregated parts (includes both PREV input and newly aggregated parts)
"""
        
ghenv.Component.Name = "Wasp_Graph-Grammar Aggregation"
ghenv.Component.NickName = 'GraphAggr'
ghenv.Component.Message = 'VER 0.2.0'
ghenv.Component.IconDisplayMode = ghenv.Component.IconDisplayMode.application
ghenv.Component.Category = "Wasp"
ghenv.Component.SubCategory = "4 | Aggregation"
try: ghenv.Component.AdditionalHelpFromDocStrings = "2"
except: pass
        
        
import scriptcontext as sc
import Rhino.Geometry as rg
import Grasshopper.Kernel as gh
import random as rnd
        
        
def main(parts, rules_sequence, aggregation_id, reset):
            
    ## check if Wasp is setup
    if sc.sticky.has_key('WaspSetup'):
                
        check_data = True
        ##check inputs
        if len(parts) == 0:
            check_data = False
            msg = "No parts provided"
            ghenv.Component.AddRuntimeMessage(gh.GH_RuntimeMessageLevel.Warning, msg)
                
        if len(rules_sequence) == 0:
            check_data = False
            msg = "No rules sequence provided"
            ghenv.Component.AddRuntimeMessage(gh.GH_RuntimeMessageLevel.Warning, msg)
                
        if aggregation_id is None:
            aggregation_id = 'Aggregation'
            msg = "Default name 'Aggregation' assigned"
            ghenv.Component.AddRuntimeMessage(gh.GH_RuntimeMessageLevel.Remark, msg)
                
        if check_data:
                    
            if sc.sticky.has_key(aggregation_id) == False:
                sc.sticky[aggregation_id] = sc.sticky['Aggregation'](aggregation_id, parts, [], 0)
                    
            if reset:
                sc.sticky[aggregation_id] = sc.sticky['Aggregation'](aggregation_id, parts, [], 0)
                    
            else:
                sc.sticky[aggregation_id].aggregate_sequence(rules_sequence)
                    
            return sc.sticky[aggregation_id].aggregated_parts
                
        else:
            return -1
            
    else:
        ## throw warining
        msg = "You must run the SetupWasp component before starting to build!"
        ghenv.Component.AddRuntimeMessage(gh.GH_RuntimeMessageLevel.Warning, msg)
        return -1
        
        
result = main(PART, RULE_S, ID, RESET)
        
if result != -1:
    PART_OUT = result
# ---------- end graphaggr ----------
depart_4 = Wasp_DeconstructPart(PART=graphaggr)  # -> NAME, GEO, CONN, CONN_PLN, TR, CHILD, ATTR; inputs PART: list; disabled; same code as depart

button_5 = Button()  # disabled
fieldiso = Wasp_FieldIsolines(FIELD=field, PLN=Slider(2, range=0..2), T=graft(Slider(0.596, range=0..1)), ISO=Slider(0.685, range=0..1))  # -> CRV
# ---------- fieldiso: Python ----------
# Wasp: Discrete Design with Grasshopper plug-in (GPL) initiated by Andrea Rossi
# 
# This file is part of Wasp.
# 
# Copyright (c) 2017, Andrea Rossi <a.rossi.andrea@gmail.com>
# Wasp is free software; you can redistribute it and/or modify 
# it under the terms of the GNU General Public License as published 
# by the Free Software Foundation; either version 3 of the License, 
# or (at your option) any later version. 
# 
# Wasp is distributed in the hope that it will be useful,
# but WITHOUT ANY WARRANTY; without even the implied warranty of 
# MERCHANTABILITY or FITNESS FOR A PARTICULAR PURPOSE. See the 
# GNU General Public License for more details.
# 
# You should have received a copy of the GNU General Public License
# along with Wasp; If not, see <http://www.gnu.org/licenses/>.
# 
# @license GPL-3.0 <https://www.gnu.org/licenses/gpl.html>
#
# Significant parts of Wasp have been developed by Andrea Rossi
# as part of research on digital materials and discrete design at:
# DDU Digital Design Unit - Prof. Oliver Tessmann
# Technische Universität Darmstadt


#########################################################################
##                            COMPONENT INFO                           ##
#########################################################################

"""
Draws isolines across a field object
--> WIP Component: might be incomplete or contain bugs! <--
-
Provided by Wasp 0.1.0
    Args:
        FIELD: Field object to extract isolines from
        PLN: Plane for isolines extraction (0: XY Plane, 1: YZ Plane, 2: XZ Plane)
        t: Z parameter where to extract isolines
        ISO: Isolevel of the curves
    Returns:
        CRV: Isocurves
"""

ghenv.Component.Name = "Wasp_Field Isolines"
ghenv.Component.NickName = 'FieldIso'
ghenv.Component.Message = 'VER 0.1.1\nMAR_06_2018'
ghenv.Component.IconDisplayMode = ghenv.Component.IconDisplayMode.application
ghenv.Component.Category = "Wasp"
ghenv.Component.SubCategory =  "4 | Aggregation"
try: ghenv.Component.AdditionalHelpFromDocStrings = "1"
except: pass


import scriptcontext as sc
import Rhino.Geometry as rg
import Grasshopper.Kernel as gh
import math



def main(field, plane, t, iso):
    contour_lookup = {"0000":-1, "0001":[[(0,0.5),(0.5,1)]], "0010":[[(0.5,1),(1,0.5)]], "0011":[[(0,0.5),(1,0.5)]],
                      "0100":[[(0.5,0),(1,0.5)]], "0101":[[(0,0.5),(0.5,0)], [(0.5,1),(1,0.5)]], "0110":[[(0.5,0),(0.5,1)]], "0111":[[(0,0.5),(0.5,0)]],
                      "1000":[[(0,0.5),(0.5,0)]], "1001":[[(0.5,0),(0.5,1)]], "1010":[[(0,0.5),(0.5,1)], [(0.5,0),(1,0.5)]], "1011":[[(0.5,0),(1,0.5)]],
                      "1100":[[(0,0.5),(1,0.5)]], "1101":[[(0.5,1),(1,0.5)]], "1110":[[(0,0.5),(0.5,1)]], "1111":-1}
    
    binary_matrix = []
    contour_cases = []
    contours = []
    
    #XY Plane contouring
    if plane == 0:
        ## THRESHOLDING
        z = int(math.floor(field.z_count*t))
        if z == field.z_count:
            z -= 1
        
        for y in range(field.y_count):
            binary_matrix.append([])
            for x in range(field.x_count):
                if field.vals[z][y][x] < iso:
                    binary_matrix[y].append("0")
                else:
                    binary_matrix[y].append("1")
        
        ## CASES DEFINITION
        for y in range(0, field.y_count-1):
            contour_cases.append([])
            for x in range(0, field.x_count-1):
                c_case = ""
                c_case += binary_matrix[y][x]
                c_case += binary_matrix[y][x+1]
                c_case += binary_matrix[y+1][x+1]
                c_case += binary_matrix[y+1][x]
                contour_cases[y].append(c_case)
        
        ## CONTOURS GENERATION
        base_pt = field.pts[z][0][0]
        res = field.resolution
        
        for y in range(0, field.y_count-1):
            for x in range(0, field.x_count-1):
                c_case = contour_cases[y][x]
                c_shape = contour_lookup[c_case]
                if c_shape != -1:
                    for shape in c_shape:
                        c_start = rg.Point3d(base_pt.X + x*res + res*shape[0][0], base_pt.Y + y*res + res*shape[0][1], base_pt.Z)
                        c_end = rg.Point3d(base_pt.X + x*res + res*shape[1][0], base_pt.Y + y*res + res*shape[1][1], base_pt.Z)
                        contour = rg.Line(c_start, c_end).ToNurbsCurve()
                        contours.append(contour)
    
    #YZ Plane contouring
    elif plane == 1:
        ## THRESHOLDING
        x = int(math.floor(field.x_count*t))
        if x == field.x_count:
            x -= 1
        
        for z in range(field.z_count):
            binary_matrix.append([])
            for y in range(field.y_count):
                if field.vals[z][y][x] < iso:
                    binary_matrix[z].append("0")
                else:
                    binary_matrix[z].append("1")
        
        ## CASES DEFINITION
        for z in range(0, field.z_count-1):
            contour_cases.append([])
            for y in range(0, field.y_count-1):
                c_case = ""
                c_case += binary_matrix[z][y]
                c_case += binary_matrix[z][y+1]
                c_case += binary_matrix[z+1][y+1]
                c_case += binary_matrix[z+1][y]
                contour_cases[z].append(c_case)
        
        ## CONTOURS GENERATION
        base_pt = field.pts[0][0][x]
        res = field.resolution
        
        for z in range(0, field.z_count-1):
            for y in range(0, field.y_count-1):
                c_case = contour_cases[z][y]
                c_shape = contour_lookup[c_case]
                if c_shape != -1:
                    for shape in c_shape:
                        c_start = rg.Point3d(base_pt.X, base_pt.Y + y*res + res*shape[0][0], base_pt.Z + z*res + res*shape[0][1])
                        c_end = rg.Point3d(base_pt.X, base_pt.Y + y*res + res*shape[1][0], base_pt.Z+ z*res + res*shape[1][1])
                        contour = rg.Line(c_start, c_end).ToNurbsCurve()
                        contours.append(contour)
    
    #XZ Plane contouring
    elif plane == 2:
        ## THRESHOLDING
        y = int(math.floor(field.y_count*t))
        if y == field.y_count:
            y -= 1
        
        for z in range(field.z_count):
            binary_matrix.append([])
            for x in range(field.x_count):
                if field.vals[z][y][x] < iso:
                    binary_matrix[z].append("0")
                else:
                    binary_matrix[z].append("1")
        
        ## CASES DEFINITION
        for z in range(0, field.z_count-1):
            contour_cases.append([])
            for x in range(0, field.x_count-1):
                c_case = ""
                c_case += binary_matrix[z][x]
                c_case += binary_matrix[z][x+1]
                c_case += binary_matrix[z+1][x+1]
                c_case += binary_matrix[z+1][x]
                contour_cases[z].append(c_case)
        
        ## CONTOURS GENERATION
        base_pt = field.pts[0][y][0]
        res = field.resolution
        
        for z in range(0, field.z_count-1):
            for x in range(0, field.x_count-1):
                c_case = contour_cases[z][x]
                c_shape = contour_lookup[c_case]
                if c_shape != -1:
                    for shape in c_shape:
                        c_start = rg.Point3d(base_pt.X + x*res + res*shape[0][0], base_pt.Y, base_pt.Z + z*res + res*shape[0][1])
                        c_end = rg.Point3d(base_pt.X + x*res + res*shape[1][0], base_pt.Y, base_pt.Z  + z*res + res*shape[1][1])
                        contour = rg.Line(c_start, c_end).ToNurbsCurve()
                        contours.append(contour)
    
    return rg.Curve.JoinCurves(contours)



CRV = main(FIELD, PLN, T, ISO)
# ---------- end fieldiso ----------
swatch_2 = ColourSwatch(SwatchColor=RGB(164, 227, 30))  # disabled

# ---- group: NEW
rndaggr_3 = Wasp_StochasticAggregation(
    PART=flatten(merge_5),
    PREV=parttr_3,
    N=Slider(100, range=0..10000),
    RULES=rulegen,
    MODE=constraints_4,
    GC=merge_8,
    ID="myAggr",
    RESET=Button())  # -> PART_OUT; inputs PART: list, PREV: list, N: Int32, RULES: list, MODE: Int32, GC: list, RESET: Boolean; same code as rndaggr

# ---- group: OLD
rndaggr_4 = Wasp_StochasticAggregation(
    PART=flatten(merge_5),
    PREV=parttr_3,
    N=number_slider_9,
    RULES=rulegen,
    MODE=wasp_aggregation_mode_3,
    ID=panel_11,
    RESET=button_5)  # -> PART_OUT; inputs PART: list, PREV: list, N: Int32, RULES: list, COLL: Boolean, MODE: Int32, RESET: Boolean; disabled
# ---------- rndaggr_4: Python ----------
# Wasp: Discrete Design with Grasshopper plug-in (GPL) initiated by Andrea Rossi
# 
# This file is part of Wasp.
# 
# Copyright (c) 2017, Andrea Rossi <a.rossi.andrea@gmail.com>
# Wasp is free software; you can redistribute it and/or modify 
# it under the terms of the GNU General Public License as published 
# by the Free Software Foundation; either version 3 of the License, 
# or (at your option) any later version. 
# 
# Wasp is distributed in the hope that it will be useful,
# but WITHOUT ANY WARRANTY; without even the implied warranty of 
# MERCHANTABILITY or FITNESS FOR A PARTICULAR PURPOSE. See the 
# GNU General Public License for more details.
# 
# You should have received a copy of the GNU General Public License
# along with Wasp; If not, see <http://www.gnu.org/licenses/>.
# 
# @license GPL-3.0 <https://www.gnu.org/licenses/gpl.html>
#
# Significant parts of Wasp have been developed by Andrea Rossi
# as part of research on digital materials and discrete design at:
# DDU Digital Design Unit - Prof. Oliver Tessmann
# Technische Universität Darmstadt


#########################################################################
##                            COMPONENT INFO                           ##
#########################################################################

"""
Aggregate the given parts in a stochastic process, selecting parts and rules randomly at every step.
The component works additively, hence increasing the number of parts in an aggregation just adds new parts on the existing ones, without triggering recomputing of the previous element.
-
Provided by Wasp 0.1.0
    Args:
        PART: Parts to be aggregated (can be more than one)
        PREV: Previous aggregated parts. It is possible to input the results of a previous aggregation, or parts transformed with the TransformPart component
        N: Number of parts to be aggregated (does not count parts provided in PREV)
        RULES: Rules for the aggregation
        COLL: OPTIONAL // Collision detection. By default is active and checks for collisions between the aggregated parts
        MODE: OPTIONAL // Switches between aggregation modes: 0 = Basic (Default: only parts collision check), 1 = Constrained (checks all constraints set on the part)
        ID: OPTIONAL // Aggregation ID (to avoid overwriting when having different aggregation components in the same file)
        RESET: Recompute the whole aggregation
    Returns:
        PART_OUT: Aggregated parts (includes both PREV input and newly aggregated parts)
"""

ghenv.Component.Name = "Wasp_Stochastic Aggregation"
ghenv.Component.NickName = 'RndAggr'
ghenv.Component.Message = 'VER 0.1.1\nMAR_06_2018'
ghenv.Component.IconDisplayMode = ghenv.Component.IconDisplayMode.application
ghenv.Component.Category = "Wasp"
ghenv.Component.SubCategory = "4 | Aggregation"
try: ghenv.Component.AdditionalHelpFromDocStrings = "2"
except: pass


import scriptcontext as sc
import Rhino.Geometry as rg
import Grasshopper.Kernel as gh
import random as rnd


def aggregate(aggr_id, aggr_parts, aggr_rules, iter, aggr_coll, aggr_mode):
    count = 0
    loops = 0
    while count < iter:
        loops += 1
        if loops > iter*100:
            break
        ## if no part is present in the aggregation, add first random part
        if len(sc.sticky[aggr_id]) == 0:
            count += 1
            first_part = aggr_parts[rnd.randint(0, len(aggr_parts)-1)]
            for conn in first_part.connections:
                conn.generate_rules_table(aggr_rules)
            sc.sticky[aggr_id].append(first_part)
        
        else:
            next_rule = None
            part_01_id = -1
            conn_01_id = -1
            next_rule_id = -1
            new_rule_attempts = 0
            
            while new_rule_attempts < 1000:
                new_rule_attempts += 1
                part_01_id = rnd.randint(0, len(sc.sticky[aggr_id])-1)
                part_01 = sc.sticky[aggr_id][part_01_id]
                if len(part_01.active_connections) > 0:
                    conn_01_id = part_01.active_connections[rnd.randint(0, len(part_01.active_connections)-1)]
                    conn_01 = part_01.connections[conn_01_id]
                    if len(conn_01.active_rules) > 0:
                        next_rule_id = conn_01.active_rules[rnd.randint(0, len(conn_01.active_rules)-1)]
                        next_rule = conn_01.rules_table[next_rule_id]
                        break
            
            if next_rule == None:
                msg = "aborted after " + str(count) + " iterations"
                ghenv.Component.AddRuntimeMessage(gh.GH_RuntimeMessageLevel.Warning, msg)
                break
            
            next_part = None
            for part in aggr_parts:
                if part.name == next_rule.part2:
                    next_part = part
            
            orientTransform = rg.Transform.PlaneToPlane(next_part.connections[next_rule.conn2].flip_pln, conn_01.pln)
            next_part_center = next_part.transform_center(orientTransform)
            
            ## overlap check
            close_neighbour_check = False
            for ex_part in sc.sticky[aggr_id]:
                dist = ex_part.center.DistanceTo(next_part_center)
                if dist < sc.sticky['model_tolerance']:
                    close_neighbour_check = True
                    break
            
            ## collision check
            collision_check = False
            if aggr_coll == True and close_neighbour_check == False:
                next_part_collider = next_part.transform_collider(orientTransform)
                for ex_part in sc.sticky[aggr_id]:
                    intersections = rg.Intersect.Intersection.MeshMeshFast(ex_part.collider, next_part_collider)
                    if len(intersections) > 0:
                        collision_check = True
                        break
            
            ## constraints check
            add_collision_check = False
            missing_supports_check = False
            if aggr_mode == 1:
                if close_neighbour_check == False and collision_check == False:
                    if next_part.is_constrained:
                        
                        ## additional collider check
                        if next_part.add_collider != None:
                            add_collider = next_part.add_collider.Duplicate()
                            add_collider.Transform(orientTransform)
                            for ex_part in sc.sticky[aggr_id]:
                                intersections = rg.Intersect.Intersection.MeshMeshFast(ex_part.collider, add_collider)
                                if len(intersections) > 0:
                                    add_collision_check = True
                                    break
                        
                        ## supports check
                        if add_collision_check == False:
                            if len(next_part.supports) > 0:
                                for sup in next_part.supports:
                                    missing_supports_check = True
                                    supports_count = 0
                                    sup_trans = sup.transform(orientTransform)
                                    for dir in sup_trans.sup_dir:
                                        for ex_part in sc.sticky[aggr_id]:
                                            if len(rg.Intersect.Intersection.MeshLine(ex_part.collider, dir)[0]) > 0:
                                                supports_count += 1
                                                break
                                    if supports_count == len(sup_trans.sup_dir):
                                        missing_supports_check = False
                                        break
            
            if close_neighbour_check == False and collision_check == False and add_collision_check == False and missing_supports_check == False:
                next_part_trans = next_part.transform(orientTransform)
                next_part_trans.reset_part(aggr_rules)
                for i in range(len(next_part_trans.active_connections)):
                    if next_part_trans.active_connections[i] == next_rule.conn2:
                        next_part_trans.active_connections.pop(i)
                        break
                sc.sticky[aggr_id].append(next_part_trans)
                sc.sticky[aggr_id][part_01_id].children.append(next_part_trans)
                for i in range(len(sc.sticky[aggr_id][part_01_id].active_connections)):
                    if sc.sticky[aggr_id][part_01_id].active_connections[i] == conn_01_id:
                        sc.sticky[aggr_id][part_01_id].active_connections.pop(i)
                        break
                count += 1
            else:
               ## remove rules if they cause collisions or overlappings
               for i in range(len(sc.sticky[aggr_id][part_01_id].connections[conn_01_id].active_rules)):
                   if sc.sticky[aggr_id][part_01_id].connections[conn_01_id].active_rules[i] == next_rule_id:
                       sc.sticky[aggr_id][part_01_id].connections[conn_01_id].active_rules.pop(i)
                       break
               ## check if the connection is still active (still active rules available)
               if len(sc.sticky[aggr_id][part_01_id].connections[conn_01_id].active_rules) == 0:
                   for i in range(len(sc.sticky[aggr_id][part_01_id].active_connections)):
                    if sc.sticky[aggr_id][part_01_id].active_connections[i] == conn_01_id:
                        sc.sticky[aggr_id][part_01_id].active_connections.pop(i)
                        break


def main(parts, previous_parts, num_parts, rules, collision, aggregation_mode, aggregation_id, reset):
    
    ## check if Wasp is setup
    if sc.sticky.has_key('WaspSetup'):
        
        check_data = True
        ##check inputs
        if len(parts) == 0:
            check_data = False
            msg = "No parts provided"
            ghenv.Component.AddRuntimeMessage(gh.GH_RuntimeMessageLevel.Warning, msg)
        
        if num_parts is None:
            check_data = False
            msg = "Provide number of aggregation iterations"
            ghenv.Component.AddRuntimeMessage(gh.GH_RuntimeMessageLevel.Warning, msg)
        else:
            if len(previous_parts) != 0:
                num_parts += len(previous_parts)
        
        if len(rules) == 0:
            check_data = False
            msg = "No rules provided"
            ghenv.Component.AddRuntimeMessage(gh.GH_RuntimeMessageLevel.Warning, msg)
        
        if collision is None:
            collision = True
        
        if aggregation_mode is None:
            aggregation_mode = 0
        
        if aggregation_id is None:
            aggregation_id = 'Aggregation'
            msg = "Default name 'Aggregation' assigned"
            ghenv.Component.AddRuntimeMessage(gh.GH_RuntimeMessageLevel.Remark, msg)
        
        if reset is None:
            reset = False
        
        if check_data:
            if sc.sticky.has_key(aggregation_id) == False:
                sc.sticky[aggregation_id] = []
            
            if sc.sticky.has_key('rules') == False:
                sc.sticky['rules'] = rules
            
            if rules != sc.sticky['rules']:
                for part in parts:
                    part.reset_part(rules)
                sc.sticky['rules'] = rules
            
            
            if reset:
                sc.sticky[aggregation_id] = []
                
                for part in parts:
                    part.reset_part(rules)
                
                if len(previous_parts) > 0:
                    for part in previous_parts:
                        part.reset_part(rules)
                        sc.sticky[aggregation_id].append(part)
            
            if num_parts > len(sc.sticky[aggregation_id]):
                aggregate(aggregation_id, parts, rules, num_parts - len(sc.sticky[aggregation_id]), collision, aggregation_mode)
                if len(sc.sticky[aggregation_id]) < num_parts:
                    msg = "Could not place " + str(num_parts - len(sc.sticky[aggregation_id])) + " parts"
                    ghenv.Component.AddRuntimeMessage(gh.GH_RuntimeMessageLevel.Warning, msg)
                    
            
            elif num_parts < len(sc.sticky[aggregation_id]):
                sc.sticky[aggregation_id] = sc.sticky[aggregation_id][:num_parts]
                for part in sc.sticky[aggregation_id]:
                    part.reset_part(rules)
                
                for part in parts:
                    part.reset_part(rules)
            
            return sc.sticky[aggregation_id]
            
        else:
            return -1
    
    else:
        ## throw warining
        msg = "You must run the SetupWasp component before starting to build!"
        ghenv.Component.AddRuntimeMessage(gh.GH_RuntimeMessageLevel.Warning, msg)
        return -1


result = main(PART, PREV, N, RULES, COLL, MODE, ID, RESET)

if result != -1:
    PART_OUT = result
# ---------- end rndaggr_4 ----------

# ---- group: I / 0 WIP
waspsave = Wasp_SaveToFile(AGGR=rndaggr_4, PATH="D:\Wasp\devFiles\", NAME="myAggr_01", SAVE=Button())  # -> TXT; inputs AGGR: list
# ---------- waspsave: Python ----------
# Wasp: Discrete Design with Grasshopper plug-in (GPL) initiated by Andrea Rossi
# 
# This file is part of Wasp.
# 
# Copyright (c) 2017, Andrea Rossi <a.rossi.andrea@gmail.com>
# Wasp is free software; you can redistribute it and/or modify 
# it under the terms of the GNU General Public License as published 
# by the Free Software Foundation; either version 3 of the License, 
# or (at your option) any later version. 
# 
# Wasp is distributed in the hope that it will be useful,
# but WITHOUT ANY WARRANTY; without even the implied warranty of 
# MERCHANTABILITY or FITNESS FOR A PARTICULAR PURPOSE. See the 
# GNU General Public License for more details.
# 
# You should have received a copy of the GNU General Public License
# along with Wasp; If not, see <http://www.gnu.org/licenses/>.
# 
# @license GPL-3.0 <https://www.gnu.org/licenses/gpl.html>
#
# Significant parts of Wasp have been developed by Andrea Rossi
# as part of research on digital materials and discrete design at:
# DDU Digital Design Unit - Prof. Oliver Tessmann
# Technische Universität Darmstadt


#########################################################################
##                            COMPONENT INFO                           ##
#########################################################################

"""
Saves an aggregation to a .txt file to be loaded for further work
--> WIP Component: might be incomplete or contain bugs! <--
-
Provided by Wasp 0.1.0
    Args:
        AGGR: Aggregation to save
        PATH: Path where to save the aggregation
        NAME: Name of the exported file
        SAVE: True to export
    Returns:
        TXT: Text representation of the aggregation
"""

ghenv.Component.Name = "Wasp_Save to File"
ghenv.Component.NickName = 'WaspSave'
ghenv.Component.Message = 'VER 0.1.0\nDEC_22_2017'
ghenv.Component.IconDisplayMode = ghenv.Component.IconDisplayMode.application
ghenv.Component.Category = "Wasp"
ghenv.Component.SubCategory = "X | Experimental"
try: ghenv.Component.AdditionalHelpFromDocStrings = "1"
except: pass

import scriptcontext as sc
import Rhino.Geometry as rg
import Grasshopper.Kernel as gh


TXT = ""

for part in AGGR:
    
    str_data = ""
    
    str_data += part.name + "\n"
    
    str_a_conn = ""
    for a_conn in part.active_connections:
        str_a_conn += str(a_conn) + ";"
    str_data += str_a_conn + "\n" 
    
    str_transform = ""
    str_transform += str(part.transformation.M00) + ";"
    str_transform += str(part.transformation.M01) + ";"
    str_transform += str(part.transformation.M02) + ";"
    str_transform += str(part.transformation.M03) + ";"
    str_transform += str(part.transformation.M10) + ";"
    str_transform += str(part.transformation.M11) + ";"
    str_transform += str(part.transformation.M12) + ";"
    str_transform += str(part.transformation.M13) + ";"
    str_transform += str(part.transformation.M20) + ";"
    str_transform += str(part.transformation.M21) + ";"
    str_transform += str(part.transformation.M22) + ";"
    str_transform += str(part.transformation.M23) + ";"
    str_transform += str(part.transformation.M30) + ";"
    str_transform += str(part.transformation.M31) + ";"
    str_transform += str(part.transformation.M32) + ";"
    str_transform += str(part.transformation.M33) + ";"
    str_data += str_transform + "\n"
    
    str_data += str(part.is_constrained) + "\n"
    
    TXT += str_data + "---\n"

if SAVE:
    file_name = PATH + "\\" + NAME + ".txt"
    with open(file_name, "w") as outF:
        outF.write(TXT)
# ---------- end waspsave ----------
waspload = Wasp_LoadFromFile(PART=merge_5, FILE="D:\Wasp\devFiles\myAggr_01.txt")  # -> PART_OUT; inputs PART: list
# ---------- waspload: Python ----------
# Wasp: Discrete Design with Grasshopper plug-in (GPL) initiated by Andrea Rossi
# 
# This file is part of Wasp.
# 
# Copyright (c) 2017, Andrea Rossi <a.rossi.andrea@gmail.com>
# Wasp is free software; you can redistribute it and/or modify 
# it under the terms of the GNU General Public License as published 
# by the Free Software Foundation; either version 3 of the License, 
# or (at your option) any later version. 
# 
# Wasp is distributed in the hope that it will be useful,
# but WITHOUT ANY WARRANTY; without even the implied warranty of 
# MERCHANTABILITY or FITNESS FOR A PARTICULAR PURPOSE. See the 
# GNU General Public License for more details.
# 
# You should have received a copy of the GNU General Public License
# along with Wasp; If not, see <http://www.gnu.org/licenses/>.
# 
# @license GPL-3.0 <https://www.gnu.org/licenses/gpl.html>
#
# Significant parts of Wasp have been developed by Andrea Rossi
# as part of research on digital materials and discrete design at:
# DDU Digital Design Unit - Prof. Oliver Tessmann
# Technische Universität Darmstadt


#########################################################################
##                            COMPONENT INFO                           ##
#########################################################################

"""
Loads an aggregation from a previously saved .txt file
--> WIP Component: might be incomplete or contain bugs! <--
-
Provided by Wasp 0.0.04
    Args:
        PART: Parts definition for the aggregation
        FILE: File where the aggregation is saved (.txt)
    Returns:
        PART_OUT: Imported aggregation parts
"""

ghenv.Component.Name = "Wasp_Load from File"
ghenv.Component.NickName = 'WaspLoad'
ghenv.Component.Message = 'VER 0.1.0\nDEC_22_2017'
ghenv.Component.IconDisplayMode = ghenv.Component.IconDisplayMode.application
ghenv.Component.Category = "Wasp"
ghenv.Component.SubCategory = "X | Experimental"
try: ghenv.Component.AdditionalHelpFromDocStrings = "1"
except: pass

import scriptcontext as sc
import Rhino.Geometry as rg
import Grasshopper.Kernel as gh


PART_OUT = []

txt_data = []


if FILE is not None:
    with open(FILE, "r") as inF:
        txt_data = inF.read().split("---\n")
else:
    msg = "No file provided"
    ghenv.Component.AddRuntimeMessage(gh.GH_RuntimeMessageLevel.Warning, msg)

if len(txt_data) > 0:
    for txt in txt_data:
        try:
            data = txt.split("\n")
            
            ## part name
            name = data[0]
            
            ## part active connections
            active_conn = []
            aconn_data = data[1].split(";")
            for ac in aconn_data:
                try:
                    aconn_id = int(ac)
                    active_conn.append(aconn_id)
                except:
                    pass
            
            ## part transform
            trans = rg.Transform(0)
            tranform_data = data[2].split(";")
            
            trans.M00 = float(tranform_data[0])
            trans.M01 = float(tranform_data[1])
            trans.M02 = float(tranform_data[2])
            trans.M03 = float(tranform_data[3])
            trans.M10 = float(tranform_data[4])
            trans.M11 = float(tranform_data[5])
            trans.M12 = float(tranform_data[6])
            trans.M13 = float(tranform_data[7])
            trans.M20 = float(tranform_data[8])
            trans.M21 = float(tranform_data[9])
            trans.M22 = float(tranform_data[10])
            trans.M23 = float(tranform_data[11])
            trans.M30 = float(tranform_data[12])
            trans.M31 = float(tranform_data[13])
            trans.M32 = float(tranform_data[14])
            trans.M33 = float(tranform_data[15])
            
            constrained = bool(data[3])
            
            new_part = None
            for part in PART:
                if part.name == name:
                    new_part = part.transform(trans)
                    break
            
            if new_part is not None:
                new_part.active_connections = active_conn
                new_part.is_constrained = constrained
                
                PART_OUT.append(new_part)
        except:
            pass
# ---------- end waspload ----------

# ---- group: NEW
fieldaggregation_2 = Wasp_FieldDrivenAggregation(
    PART=flatten(merge_5),
    N=fieldn_3,
    RULES=rulegen,
    FIELD=merge_7,
    MODE=constraints_3,
    GC=merge_8,
    ID="myFieldAggregation2",
    RESET=Button())  # -> PART_OUT; inputs PART: list, PREV: list, N: Int32, RULES: list, FIELD: list, MODE: Int32, GC: list, RESET: Boolean
# ---------- fieldaggregation_2: Python ----------
# Wasp: Discrete Design with Grasshopper plug-in (GPL) initiated by Andrea Rossi
# 
# This file is part of Wasp.
# 
# Copyright (c) 2017, Andrea Rossi <a.rossi.andrea@gmail.com>
# Wasp is free software; you can redistribute it and/or modify 
# it under the terms of the GNU General Public License as published 
# by the Free Software Foundation; either version 3 of the License, 
# or (at your option) any later version. 
# 
# Wasp is distributed in the hope that it will be useful,
# but WITHOUT ANY WARRANTY; without even the implied warranty of 
# MERCHANTABILITY or FITNESS FOR A PARTICULAR PURPOSE. See the 
# GNU General Public License for more details.
# 
# You should have received a copy of the GNU General Public License
# along with Wasp; If not, see <http://www.gnu.org/licenses/>.
# 
# @license GPL-3.0 <https://www.gnu.org/licenses/gpl.html>
#
# Significant parts of Wasp have been developed by Andrea Rossi
# as part of research on digital materials and discrete design at:
# DDU Digital Design Unit - Prof. Oliver Tessmann
# Technische Universität Darmstadt


#########################################################################
##                            COMPONENT INFO                           ##
#########################################################################

"""
Aggregate the given parts according to a given scalar field. New parts are added following higher values in the field.
The component works additively, hence increasing the number of parts in an aggregation just adds new parts on the existing ones, without triggering recomputing of the previous element
-
Provided by Wasp 0.2.0
    Args:
        PART: Parts to be aggregated (can be more than one)
        PREV: Previous aggregated parts. It is possible to input the results of a previous aggregation, or parts transformed with the TransformPart component
        N: Number of parts to be aggregated (does not count parts provided in PREV)
        RULES: Rules for the aggregation
        FIELD: Scalar field to drive the aggregation (parts will be added following higher values in the field)
        THRES: OPTIONAL // If set, used to define a threshold value above which the placement of next part is accepted. If not set, aggregation will look for part with highest value in the whole field. Setting a low threshold helds less accurate results, but highly speeds up calculations
        COLL: OPTIONAL // Collision detection. By default is active and checks for collisions between the aggregated parts
        MODE: OPTIONAL // Switches between aggregation modes: 0 = Basic (Default: only parts collision check), 1 = Constrained (checks all constraints set on the part)
        ID: OPTIONAL // Aggregation ID (to avoid overwriting when having different aggregation components in the same file)
        RESET: Recompute the whole aggregation
    Returns:
        PART_OUT: Aggregated parts (includes both PREV input and newly aggregated parts)
"""

ghenv.Component.Name = "Wasp_Field-driven Aggregation"
ghenv.Component.NickName = 'FieldAggregation'
ghenv.Component.Message = "VER 0.2.0"
ghenv.Component.IconDisplayMode = ghenv.Component.IconDisplayMode.application
ghenv.Component.Category = "Wasp"
ghenv.Component.SubCategory = "4 | Aggregation"
try: ghenv.Component.AdditionalHelpFromDocStrings = "2"
except: pass


import scriptcontext as sc
import Rhino.Geometry as rg
import Grasshopper.Kernel as gh
import random as rnd
import math
import copy


## Main code execution
def main(parts, previous_parts, num_parts, rules, aggregation_mode, global_constraints, aggregation_id, reset, fields):
    
    ## check if Wasp is setup
    if sc.sticky.has_key('WaspSetup'):
        
        check_data = True
        ##check inputs
        if len(parts) == 0:
            check_data = False
            msg = "No parts provided"
            ghenv.Component.AddRuntimeMessage(gh.GH_RuntimeMessageLevel.Warning, msg)
        
        if num_parts is None:
            check_data = False
            msg = "Provide number of aggregation iterations"
            ghenv.Component.AddRuntimeMessage(gh.GH_RuntimeMessageLevel.Warning, msg)
        else:
            if len(previous_parts) != 0:
                num_parts += len(previous_parts)
        
        if len(rules) == 0:
            check_data = False
            msg = "No rules provided"
            ghenv.Component.AddRuntimeMessage(gh.GH_RuntimeMessageLevel.Warning, msg)
        
        if aggregation_mode is None:
            aggregation_mode = 0
        
        if aggregation_id is None:
            aggregation_id = 'myFieldAggregation'
            msg = "Default name 'myFieldAggregation' assigned"
            ghenv.Component.AddRuntimeMessage(gh.GH_RuntimeMessageLevel.Remark, msg)
        
        if reset is None:
            reset = False
        
        if len(fields) == 0:
            check_data = False
            msg = "Provide a valid scalar field"
            ghenv.Component.AddRuntimeMessage(gh.GH_RuntimeMessageLevel.Warning, msg)
        elif len(fields) > 1:
            field_names = [f.name for f in fields]
            for part in parts:
                if part.field is None or part.field not in field_names:
                    check_data = False
                    msg = "Part " + part.name + " does not have a vaild field name assigned. This is necessary for multi-fields aggregations."
                    ghenv.Component.AddRuntimeMessage(gh.GH_RuntimeMessageLevel.Warning, msg)
        
        if check_data:
            ## store rules in sticky dict
            if sc.sticky.has_key('rules') == False:
                sc.sticky['rules'] = rules
            
            ## if rules changed, reset parts and recompute rule tables
            if rules != sc.sticky['rules']:
                for part in parts:
                    part.reset_part(rules)
                sc.sticky['rules'] = rules
                if sc.sticky.has_key(aggregation_id):
                    sc.sticky[aggregation_id].reset_rules(rules)
            
            ## create aggregation in sticky dict
            if sc.sticky.has_key(aggregation_id) == False:
                sc.sticky[aggregation_id] = sc.sticky['Aggregation'](aggregation_id, parts, sc.sticky['rules'], aggregation_mode, _prev = previous_parts, _global_constraints = global_constraints, _field = fields)
            
            ## reset aggregation
            if reset:
                sc.sticky[aggregation_id] = sc.sticky['Aggregation'](aggregation_id, parts, sc.sticky['rules'], aggregation_mode, _prev = previous_parts, _global_constraints = global_constraints, _field = fields)
            
            if num_parts > sc.sticky[aggregation_id].p_count:
                #sc.sticky[aggregation_id].aggregate_field(num_parts-sc.sticky[aggregation_id].p_count, field, threshold)
                sc.sticky[aggregation_id].aggregate_field(num_parts-sc.sticky[aggregation_id].p_count)
                
                """
                if len(sc.sticky[aggregation_id]) < num_parts:
                    msg = "Could not place " + str(num_parts - len(sc.sticky[aggregation_id])) + " parts"
                    ghenv.Component.AddRuntimeMessage(gh.GH_RuntimeMessageLevel.Warning, msg)
                """
            elif num_parts < sc.sticky[aggregation_id].p_count:
                
                sc.sticky[aggregation_id].remove_elements(num_parts)
            
            return sc.sticky[aggregation_id].aggregated_parts
            
        else:
            return -1
    
    else:
        ## throw warining
        msg = "You must run the SetupWasp component before starting to build!"
        ghenv.Component.AddRuntimeMessage(gh.GH_RuntimeMessageLevel.Warning, msg)
        return -1


result = main(PART, PREV, N, RULES, MODE, GC, ID, RESET, FIELD)

if result != -1:
    PART_OUT = result
# ---------- end fieldaggregation_2 ----------

# ---- group: OLD
fieldaggregation_3 = Wasp_FieldDrivenAggregation(
    PART=flatten(merge_5),
    PREV=parttr_3,
    N=fieldn_2,
    RULES=rulegen,
    FIELD=field,
    THRES=number_slider_8,
    MODE=wasp_aggregation_mode_2,
    ID=panel_10,
    RESET=button_3)  # -> PART_OUT; inputs PART: list, PREV: list, N: Int32, RULES: list, COLL: Boolean, MODE: Int32, RESET: Boolean; disabled
# ---------- fieldaggregation_3: Python ----------
# Wasp: Discrete Design with Grasshopper plug-in (GPL) initiated by Andrea Rossi
# 
# This file is part of Wasp.
# 
# Copyright (c) 2017, Andrea Rossi <a.rossi.andrea@gmail.com>
# Wasp is free software; you can redistribute it and/or modify 
# it under the terms of the GNU General Public License as published 
# by the Free Software Foundation; either version 3 of the License, 
# or (at your option) any later version. 
# 
# Wasp is distributed in the hope that it will be useful,
# but WITHOUT ANY WARRANTY; without even the implied warranty of 
# MERCHANTABILITY or FITNESS FOR A PARTICULAR PURPOSE. See the 
# GNU General Public License for more details.
# 
# You should have received a copy of the GNU General Public License
# along with Wasp; If not, see <http://www.gnu.org/licenses/>.
# 
# @license GPL-3.0 <https://www.gnu.org/licenses/gpl.html>
#
# Significant parts of Wasp have been developed by Andrea Rossi
# as part of research on digital materials and discrete design at:
# DDU Digital Design Unit - Prof. Oliver Tessmann
# Technische Universität Darmstadt


#########################################################################
##                            COMPONENT INFO                           ##
#########################################################################

"""
Aggregate the given parts according to a given scalar field. New parts are added following higher values in the field.
The component works additively, hence increasing the number of parts in an aggregation just adds new parts on the existing ones, without triggering recomputing of the previous element
-
Provided by Wasp 0.1.0
    Args:
        PART: Parts to be aggregated (can be more than one)
        PREV: Previous aggregated parts. It is possible to input the results of a previous aggregation, or parts transformed with the TransformPart component
        N: Number of parts to be aggregated (does not count parts provided in PREV)
        RULES: Rules for the aggregation
        FIELD: Scalar field to drive the aggregation (parts will be added following higher values in the field)
        THRES: OPTIONAL // If set, used to define a threshold value above which the placement of next part is accepted. If not set, aggregation will look for part with highest value in the whole field. Setting a low threshold helds less accurate results, but highly speeds up calculations
        COLL: OPTIONAL // Collision detection. By default is active and checks for collisions between the aggregated parts
        MODE: OPTIONAL // Switches between aggregation modes: 0 = Basic (Default: only parts collision check), 1 = Constrained (checks all constraints set on the part)
        ID: OPTIONAL // Aggregation ID (to avoid overwriting when having different aggregation components in the same file)
        RESET: Recompute the whole aggregation
    Returns:
        PART_OUT: Aggregated parts (includes both PREV input and newly aggregated parts)
"""

ghenv.Component.Name = "Wasp_Field-driven Aggregation"
ghenv.Component.NickName = 'FieldAggregation'
ghenv.Component.Message = 'VER 0.1.1\nMAR_06_2018'
ghenv.Component.IconDisplayMode = ghenv.Component.IconDisplayMode.application
ghenv.Component.Category = "Wasp"
ghenv.Component.SubCategory = "4 | Aggregation"
try: ghenv.Component.AdditionalHelpFromDocStrings = "2"
except: pass


import scriptcontext as sc
import Rhino.Geometry as rg
import Grasshopper.Kernel as gh
import random as rnd
import math
import copy


## find the rule that creates a component as closest as possible to the target surface
def findBestRule(aggr_id, aggr_parts, aggr_field, thres, aggr_coll, aggr_mode):
    max_val = None
    best_rule = None
    best_conn = None
    best_conn_id = -1
    
    for i in xrange(len(sc.sticky[aggr_id])):
        part_01 = sc.sticky[aggr_id][i]
        for i2 in xrange(len(part_01.active_connections)-1, -1, -1):
            conn_01_id = part_01.active_connections[i2]
            conn_01 = part_01.connections[conn_01_id]
            for i3 in xrange(len(conn_01.active_rules)-1, -1, -1):
                rule_id = conn_01.active_rules[i3]
                rule = conn_01.rules_table[rule_id]
                
                next_part = None
                for part in aggr_parts:
                    if part.name == rule.part2:
                        next_part = part
                        break
                
                next_center = rg.Point3d(next_part.center)
                orientTransform = rg.Transform.PlaneToPlane(next_part.connections[rule.conn2].flip_pln, conn_01.pln)
                next_center.Transform(orientTransform)
                    
                if aggr_field.bbox.Contains(next_center) == True:
                    current_target_val = aggr_field.return_pt_val(next_center)
                
                    if current_target_val > max_val or max_val == None:
                        
                        ## overlap check
                        close_neighbour_check = False
                        for ex_part in sc.sticky[aggr_id]:
                            dist = ex_part.center.DistanceTo(next_center)
                            if dist < sc.sticky['model_tolerance']:
                                close_neighbour_check = True
                                break
                        
                        ## collision check
                        collision_check = False
                        if aggr_coll == True and close_neighbour_check == False:
                            next_part_collider = next_part.transform_collider(orientTransform)
                            for ex_part in sc.sticky[aggr_id]:
                                if len(rg.Intersect.Intersection.MeshMeshFast(ex_part.collider, next_part_collider)) > 0:
                                    collision_check = True
                                    break
                        
                        ## constraints check
                        add_collision_check = False
                        missing_supports_check = False
                        if aggr_mode == 1:
                            if close_neighbour_check == False and collision_check == False:
                                if next_part.is_constrained:
                                    
                                    ## additional collider check
                                    if next_part.add_collider != None:
                                        add_collider = next_part.add_collider.Duplicate()
                                        add_collider.Transform(orientTransform)
                                        for ex_part in sc.sticky[aggr_id]:
                                            intersections = rg.Intersect.Intersection.MeshMeshFast(ex_part.collider, add_collider)
                                            if len(intersections) > 0:
                                                add_collision_check = True
                                                break
                                    
                                    ## supports check
                                    if add_collision_check == False:
                                        if len(next_part.supports) > 0:
                                            for sup in next_part.supports:
                                                missing_supports_check = True
                                                supports_count = 0
                                                sup_trans = sup.transform(orientTransform)
                                                for dir in sup_trans.sup_dir:
                                                    for ex_part in sc.sticky[aggr_id]:
                                                        if len(rg.Intersect.Intersection.MeshLine(ex_part.collider, dir)[0]) > 0:
                                                            supports_count += 1
                                                            break
                                                if supports_count == len(sup.sup_dir):
                                                    missing_supports_check = False
                                                    break
                        
                        
                        if close_neighbour_check == False and collision_check == False and add_collision_check == False and missing_supports_check == False:
                            max_val = current_target_val
                            best_rule = rule
                            best_conn = conn_01
                            best_part_id = i
                            best_conn_id = conn_01_id
                            
                            if thres is not None and max_val > thres:
                                break
                            
                        elif missing_supports_check == False:
                            ## remove rules if they cause collisions or overlappings
                            for i4 in range(len(sc.sticky[aggr_id][i].connections[conn_01_id].active_rules)):
                               if sc.sticky[aggr_id][i].connections[conn_01_id].active_rules[i4] == rule_id:
                                   sc.sticky[aggr_id][i].connections[conn_01_id].active_rules.pop(i4)
                                   break
                            ## check if the connection is still active (still active rules available)
                            if len(sc.sticky[aggr_id][i].connections[conn_01_id].active_rules) == 0:
                               for i4 in range(len(sc.sticky[aggr_id][i].active_connections)):
                                if sc.sticky[aggr_id][i].active_connections[i4] == conn_01_id:
                                    sc.sticky[aggr_id][i].active_connections.pop(i4)
                                    break
            if thres is not None and max_val > thres:
                break
        if thres is not None and max_val > thres:
            break
    
    if best_rule is not None:
        return best_conn, best_part_id, best_conn_id, best_rule.part2, best_rule.conn2, best_rule
    else:
        return -1, -1, -1, -1, -1, -1



def aggregate_field(aggr_id, aggr_parts, aggr_rules, aggr_field, aggr_threshold, iter, aggr_coll, aggr_mode):
    count = 0
    loops = 0
    while count < iter:
        ## avoid endless loops
        loops += 1
        if loops > iter*100:
            break
        
        ## if no part is present in the aggregation, add first random part
        if len(sc.sticky[aggr_id]) == 0:
            count += 1
            first_part = aggr_parts[rnd.randint(0, len(aggr_parts)-1)]
            
            start_point = aggr_field.highest_pt
            mov_vec = rg.Vector3d.Subtract(rg.Vector3d(start_point), rg.Vector3d(first_part.center))
            move_transform = rg.Transform.Translation(mov_vec.X, mov_vec.Y, mov_vec.Z)
            first_part_trans = first_part.transform(move_transform)
            
            for conn in first_part_trans.connections:
                conn.generate_rules_table(aggr_rules)
            
            sc.sticky[aggr_id].append(first_part_trans)
        
        else:
            ## select part-rule couple creating next part in the highest point of field
            conn_01, part_01_id, conn_01_id, next_part_name, next_conn_id, next_rule = findBestRule(aggr_id, aggr_parts, aggr_field, aggr_threshold, aggr_coll, aggr_mode)
            
            if conn_01_id == -1:
                msg = "aborted after " + str(count) + " iterations"
                ghenv.Component.AddRuntimeMessage(gh.GH_RuntimeMessageLevel.Warning, msg)
                break
            
            next_part = None
            for part in aggr_parts:
                if part.name == next_part_name:
                    next_part = part
            
            orientTransform = rg.Transform.PlaneToPlane(next_part.connections[next_conn_id].flip_pln, conn_01.pln)
            next_part_center = next_part.transform_center(orientTransform)
            
            next_part_trans = next_part.transform(orientTransform)
            next_part_trans.reset_part(aggr_rules)
            for i in range(len(next_part_trans.active_connections)):
                if next_part_trans.active_connections[i] == next_rule.conn2:
                    next_part_trans.active_connections.pop(i)
                    break
            sc.sticky[aggr_id].append(next_part_trans)
            
            count += 1


## Main code execution
def main(parts, previous_parts, num_parts, rules, field, threshold, collision, aggregation_mode, aggregation_id, reset):
    
    ## check if Wasp is setup
    if sc.sticky.has_key('WaspSetup'):
        
        check_data = True
        ##check inputs
        if len(parts) == 0:
            check_data = False
            msg = "No parts provided"
            ghenv.Component.AddRuntimeMessage(gh.GH_RuntimeMessageLevel.Warning, msg)
        
        if num_parts is None:
            check_data = False
            msg = "Provide number of aggregation iterations"
            ghenv.Component.AddRuntimeMessage(gh.GH_RuntimeMessageLevel.Warning, msg)
        else:
            if len(previous_parts) != 0:
                num_parts += len(previous_parts)
        
        if len(rules) == 0:
            check_data = False
            msg = "No rules provided"
            ghenv.Component.AddRuntimeMessage(gh.GH_RuntimeMessageLevel.Warning, msg)
        
        if field is None:
            check_data = False
            msg = "Provide a valid scalar field"
            ghenv.Component.AddRuntimeMessage(gh.GH_RuntimeMessageLevel.Warning, msg)
        
        if collision is None:
            collision = True
        
        if aggregation_id is None:
            aggregation_id = 'Aggregation'
            msg = "Default name 'Aggregation' assigned"
            ghenv.Component.AddRuntimeMessage(gh.GH_RuntimeMessageLevel.Remark, msg)
        
        if reset is None:
            reset = False
        
        if check_data:
            if sc.sticky.has_key(aggregation_id) == False:
                sc.sticky[aggregation_id] = []
            
            if sc.sticky.has_key('rules') == False:
                sc.sticky['rules'] = rules
            
            if rules != sc.sticky['rules']:
                for part in parts:
                    part.reset_part(rules)
                sc.sticky['rules'] = rules
            
            
            if reset:
                sc.sticky[aggregation_id] = []
                
                for part in parts:
                    part.reset_part(rules)
                
                if len(previous_parts) > 0:
                    for part in previous_parts:
                        part.reset_part(rules)
                        sc.sticky[aggregation_id].append(part)
            
            if num_parts > len(sc.sticky[aggregation_id]):
                aggregate_field(aggregation_id, parts, rules, field, threshold, num_parts - len(sc.sticky[aggregation_id]), collision, aggregation_mode)
                if len(sc.sticky[aggregation_id]) < num_parts:
                    msg = "Could not place " + str(num_parts - len(sc.sticky[aggregation_id])) + " parts"
                    ghenv.Component.AddRuntimeMessage(gh.GH_RuntimeMessageLevel.Warning, msg)
            
            elif num_parts < len(sc.sticky[aggregation_id]):
                sc.sticky[aggregation_id] = sc.sticky[aggregation_id][:num_parts]
                for part in sc.sticky[aggregation_id]:
                    part.reset_part(rules)
                
                for part in parts:
                    part.reset_part(rules)
            
            return sc.sticky[aggregation_id]
            
        else:
            return -1
    
    else:
        ## throw warining
        msg = "You must run the SetupWasp component before starting to build!"
        ghenv.Component.AddRuntimeMessage(gh.GH_RuntimeMessageLevel.Warning, msg)
        return -1


result = main(PART, PREV, N, RULES, FIELD, THRES, COLL, MODE, ID, RESET)

if result != -1:
    PART_OUT = result
# ---------- end fieldaggregation_3 ----------

# ----
preview_4 = CustomPreview(Geometry=depart_3.GEO, Material=swatch_2)  # disabled
preview_5 = CustomPreview(Geometry=fieldiso, Shader=graft(ColourSwatch(SwatchColor=RGB(255, 0, 0))))
depart_5 = Wasp_DeconstructPart(PART=depart_4.CHILD)  # -> NAME, GEO, CONN, CONN_PLN, TR, CHILD, ATTR; inputs PART: list; disabled; same code as depart
volume_4 = MeshVolume(Mesh=depart_5.GEO)  # -> Volume, Centroid; disabled
volume_5 = MeshVolume(Mesh=depart_4.GEO)  # -> Volume, Centroid; disabled
parthie_2 = Wasp_PartsHierarchy(PART=fieldaggregation_2, LEVEL=Slider(0, range=0..10))  # -> SUB_P; inputs PART: list, LEVEL: Int32
# ---------- parthie_2: Python ----------
# Wasp: Discrete Design with Grasshopper plug-in (GPL) initiated by Andrea Rossi
# 
# This file is part of Wasp.
# 
# Copyright (c) 2017, Andrea Rossi <a.rossi.andrea@gmail.com>
# Wasp is free software; you can redistribute it and/or modify 
# it under the terms of the GNU General Public License as published 
# by the Free Software Foundation; either version 3 of the License, 
# or (at your option) any later version. 
# 
# Wasp is distributed in the hope that it will be useful,
# but WITHOUT ANY WARRANTY; without even the implied warranty of 
# MERCHANTABILITY or FITNESS FOR A PARTICULAR PURPOSE. See the 
# GNU General Public License for more details.
# 
# You should have received a copy of the GNU General Public License
# along with Wasp; If not, see <http://www.gnu.org/licenses/>.
# 
# @license GPL-3.0 <https://www.gnu.org/licenses/gpl.html>
#
# Significant parts of Wasp have been developed by Andrea Rossi
# as part of research on digital materials and discrete design at:
# DDU Digital Design Unit - Prof. Oliver Tessmann
# Technische Universität Darmstadt


#########################################################################
##                            COMPONENT INFO                           ##
#########################################################################

"""
Access sub-parts stored at different aggregation hierarchy levels
-
Provided by Wasp 0.1.0
    Args:
        PART: Parts
        LEVEL: ...
    Returns:
        SUB_P: Parts at the selected hierarchy level
"""

ghenv.Component.Name = "Wasp_Parts Hierarchy"
ghenv.Component.NickName = 'PartHie'
ghenv.Component.Message = 'VER 0.2.0'
ghenv.Component.IconDisplayMode = ghenv.Component.IconDisplayMode.application
ghenv.Component.Category = "Wasp"
ghenv.Component.SubCategory = "X | Experimental"
try: ghenv.Component.AdditionalHelpFromDocStrings = "2"
except: pass


import scriptcontext as sc
import Rhino.Geometry as rg
import Grasshopper.Kernel as gh
import random as rnd

def main(parts, hierarchy_level):
    
    ## check if Wasp is setup
    if sc.sticky.has_key('WaspSetup'):
        
        check_data = True
        
        ##check inputs
        if len(parts) == 0:
            check_data = False
            msg = "No parts provided"
            ghenv.Component.AddRuntimeMessage(gh.GH_RuntimeMessageLevel.Warning, msg)
        
        if check_data:
            current_parts = parts
            sub_parts = []
            current_level = 0
            current_levels = []
            if len(hierarchy_level) == 1:
                current_levels.append(0)
            else:
                for part in parts:
                    current_levels.append(0)
            
            if hierarchy_level == 0:
                return parts
            else:
                while current_level < hierarchy_level:
                    current_level += 1
                    
                    for part in current_parts:
                        if len(part.sub_parts) > 0:
                            for sp in part.sub_parts:
                                sp_trans = sp.transform(part.transformation)
                                sub_parts.append(sp_trans)
                        else:
                            msg = "The selected hierarchy level does not exist in the provided parts"
                            ghenv.Component.AddRuntimeMessage(gh.GH_RuntimeMessageLevel.Warning, msg)
                            return parts
                    
                    current_parts = []
                    for sp in sub_parts:
                        current_parts.append(sp)
                    sub_parts = []
                    
                
                return current_parts
        else:
            return -1
    
    else:
        ## throw warining
        msg = "You must run the SetupWasp component before starting to build!"
        ghenv.Component.AddRuntimeMessage(gh.GH_RuntimeMessageLevel.Warning, msg)
        return -1

result = main(PART, LEVEL)

if result != -1:
    SUB_P = result
# ---------- end parthie_2 ----------
ln = Line(StartPoint=graft(volume_5.Centroid), EndPoint=volume_4.Centroid)  # disabled

# ---- group: OK (might need fix)
depart_6 = Wasp_DeconstructPart(PART=fieldaggregation_2)  # -> NAME, GEO, CONN, CONN_PLN, TR, CHILD, ATTR; inputs PART: list; same code as depart

# ----
depart_7 = Wasp_DeconstructPart(PART=fieldaggregation_2)  # -> NAME, GEO, CONN, CONN_PLN, TR, CHILD, ATTR; inputs PART: list; same code as depart
faceb_2 = FaceBoundaries(Mesh=depart_7.GEO)
mesh_4 = Mesh(depart_6.GEO)
tmatch = MatchText(Text=depart_6.NAME, Pattern="L", Case=True)
dispatch_2 = Dispatch(List=depart_6.GEO, DispatchPattern=tmatch)  # -> ListA, ListB
lng_3 = ListLength(List=mesh_4)
mesh_5 = Mesh(mesh_4)
random = Random(Range=Domain(0, 1), Number=lng_3, Seed=2)
gradient_3 = Gradient(
    LowerLimit=0,
    UpperLimit=1,
    Parameter=random,
    stops=[0: RGB(0, 98, 0), 0.25: RGB(81, 175, 17), 0.5: RGB(159, 198, 146), 0.75: RGB(170, 235, 41), 1: RGB(221, 255, 53)])
mesh_6 = Mesh(dispatch_2.ListB)
lng_4 = ListLength(List=dispatch_2.ListB)

# ---- group: OK
deattr = Wasp_DeconstructAttribute(ATTR=depart_6.ATTR)  # -> ID, VAL
# ---------- deattr: Python ----------
# Wasp: Discrete Design with Grasshopper plug-in (GPL) initiated by Andrea Rossi
# 
# This file is part of Wasp.
# 
# Copyright (c) 2017, Andrea Rossi <a.rossi.andrea@gmail.com>
# Wasp is free software; you can redistribute it and/or modify 
# it under the terms of the GNU General Public License as published 
# by the Free Software Foundation; either version 3 of the License, 
# or (at your option) any later version. 
# 
# Wasp is distributed in the hope that it will be useful,
# but WITHOUT ANY WARRANTY; without even the implied warranty of 
# MERCHANTABILITY or FITNESS FOR A PARTICULAR PURPOSE. See the 
# GNU General Public License for more details.
# 
# You should have received a copy of the GNU General Public License
# along with Wasp; If not, see <http://www.gnu.org/licenses/>.
# 
# @license GPL-3.0 <https://www.gnu.org/licenses/gpl.html>
#
# Significant parts of Wasp have been developed by Andrea Rossi
# as part of research on digital materials and discrete design at:
# DDU Digital Design Unit - Prof. Oliver Tessmann
# Technische Universität Darmstadt


#########################################################################
##                            COMPONENT INFO                           ##
#########################################################################

"""
Extract values stored in an atrribute
-
Provided by Wasp 0.1.0
    Args:
        ATTR: Attribute to deconstruct
    Returns:
        ID: Name of the attribute
        VAL: Value stored in the attribute
"""

ghenv.Component.Name = "Wasp_Deconstruct Attribute"
ghenv.Component.NickName = 'DeAttr'
ghenv.Component.Message = 'VER 0.1.0\nDEC_22_2017'
ghenv.Component.IconDisplayMode = ghenv.Component.IconDisplayMode.application
ghenv.Component.Category = "Wasp"
ghenv.Component.SubCategory = "1 | Elements"
try: ghenv.Component.AdditionalHelpFromDocStrings = "2"
except: pass


import Grasshopper.Kernel as gh

if ATTR is None:
    msg = "No attribute provided"
    ghenv.Component.AddRuntimeMessage(gh.GH_RuntimeMessageLevel.Warning, msg)
else:
    ID = ATTR.name
    VAL = ATTR.values
# ---------- end deattr ----------

getattr = Wasp_GetAttributeByName(ATTR=depart_6.ATTR, ID="connectors")  # -> VAL; inputs ATTR: list
# ---------- getattr: Python ----------
# Wasp: Discrete Design with Grasshopper plug-in (GPL) initiated by Andrea Rossi
# 
# This file is part of Wasp.
# 
# Copyright (c) 2017, Andrea Rossi <a.rossi.andrea@gmail.com>
# Wasp is free software; you can redistribute it and/or modify 
# it under the terms of the GNU General Public License as published 
# by the Free Software Foundation; either version 3 of the License, 
# or (at your option) any later version. 
# 
# Wasp is distributed in the hope that it will be useful,
# but WITHOUT ANY WARRANTY; without even the implied warranty of 
# MERCHANTABILITY or FITNESS FOR A PARTICULAR PURPOSE. See the 
# GNU General Public License for more details.
# 
# You should have received a copy of the GNU General Public License
# along with Wasp; If not, see <http://www.gnu.org/licenses/>.
# 
# @license GPL-3.0 <https://www.gnu.org/licenses/gpl.html>
#
# Significant parts of Wasp have been developed by Andrea Rossi
# as part of research on digital materials and discrete design at:
# DDU Digital Design Unit - Prof. Oliver Tessmann
# Technische Universität Darmstadt


#########################################################################
##                            COMPONENT INFO                           ##
#########################################################################

"""
Extract values stored in an atrribute with the given name.
-
Provided by Wasp 0.1.0
    Args:
        ATTR: Attributes list to search
        ID: Name of the attribute to extract
    Returns:
        VAL: Value stored in the requested attribute
"""

ghenv.Component.Name = "Wasp_Get Attribute by Name"
ghenv.Component.NickName = 'GetAttr'
ghenv.Component.Message = 'VER 0.1.0\nDEC_22_2017'
ghenv.Component.IconDisplayMode = ghenv.Component.IconDisplayMode.application
ghenv.Component.Category = "Wasp"
ghenv.Component.SubCategory = "1 | Elements"
try: ghenv.Component.AdditionalHelpFromDocStrings = "2"
except: pass

import Grasshopper.Kernel as gh

if len(ATTR) == 0:
    msg = "No attribute provided"
    ghenv.Component.AddRuntimeMessage(gh.GH_RuntimeMessageLevel.Warning, msg)
elif ID is None:
    msg = "No id provided"
    ghenv.Component.AddRuntimeMessage(gh.GH_RuntimeMessageLevel.Warning, msg)
else:
    VAL = []
    for attr in ATTR:
        if attr.name == ID:
            VAL = attr.values
# ---------- end getattr ----------

# ----
random_2 = Random(Range=Domain(0, 1), Number=lng_4, Seed=2)
preview_6 = CustomPreview(Geometry=deattr.VAL, Shader=ColourSwatch(SwatchColor=RGB(128, 128, 128)))
brep_3 = Brep(getattr)
depart_8 = Wasp_DeconstructPart(PART=depart_6.CHILD)  # -> NAME, GEO, CONN, CONN_PLN, TR, CHILD, ATTR; inputs PART: list; same code as depart
volume_6 = MeshVolume(Mesh=depart_8.GEO)  # -> Volume, Centroid
volume_7 = MeshVolume(Mesh=mesh_5)  # -> Volume, Centroid
argb = SplitARGB(Colour=gradient_3)  # -> Alpha, Red, Green, Blue
argb_2 = SplitARGB()  # -> Alpha, Red, Green, Blue
ln_2 = Line(StartPoint=graft(volume_7.Centroid), EndPoint=volume_6.Centroid)
frgb = ColourRGBF(Alpha=Slider(1, range=0..1), Red=argb.Red, Green=argb.Green, Blue=argb.Blue)
frgb_2 = ColourRGBF(Alpha=1, Red=argb_2.Red, Green=argb_2.Green, Blue=argb_2.Blue)
bbox_7 = BoundingBox(Content=mesh_5, Plane=PlaneXY(0, 0, 0))  # -> Box, Box_2; disabled
bbox_8 = BoundingBox(Content=mesh_6, Plane=PlaneXY(0, 0, 0))  # -> Box, Box_2; disabled
preview_7 = CustomPreview(Geometry=mesh_5, Shader=flatten(ColourSwatch(SwatchColor=RGB(40, 140, 0))))
preview_8 = CustomPreview(Geometry=mesh_6, Shader=flatten(frgb_2))
wires = BrepWireframe(Brep=bbox_7.Box, Density=-1)  # disabled
wires_2 = BrepWireframe(Brep=bbox_8.Box, Density=-1)  # disabled
previewlw = CustomPreviewLineweights(Geometry=ln_2, Shader=ColourSwatch(SwatchColor=RGB(255, 255, 255)), Thickness=Slider(2, range=0..10), Absolute=False)
