# Grasshopper definition Constraints_Test.gh (Grasshopper 1.0.7)

# ----
# Press the button to make sure the file is
# updated to latest Wasp version on your pc.
button = Button()
# # Wasp: Discrete Design with Grasshopper plug-in (GPL) initiated by Andrea Rossi
# 
# 
# This file is part of Wasp.
# 
# Copyright (c) 2019, Andrea Rossi <a.rossi.andrea@gmail.com>
# 
# Wasp is free software; you can redistribute it and/or modify it under the terms of the GNU General Public License as published by the Free Software Foundation; either version 3 of the License, or (at your option) any later version.
# 
# Wasp is distributed in the hope that it will be useful, but WITHOUT ANY WARRANTY; without even the implied warranty of MERCHANTABILITY or FITNESS FOR A PARTICULAR PURPOSE. See the GNU General Public License for more details. You should have received a copy of the GNU General Public License
#  along with Wasp; If not, see <http://www.gnu.org/licenses/>.
# 
# license GPL-3.0 <https://www.gnu.org/licenses/gpl.html>
# 
# Significant parts of Wasp have been developed by Andrea Rossi as part of research on digital materials and discrete design at DDU Digital Design Unit - Prof. Oliver Tessmann - Technische Universität Darmstadt
# 04_1_Local_Constraints_Supports
updatefile = Wasp_UpdateFile(UPDATE=button)  # -> LOG; inputs UPDATE: Boolean
# ---------- updatefile: Python ----------
# Wasp: Discrete Design with Grasshopper plug-in (GPL) initiated by Andrea Rossi
# 
# This file is part of Wasp.
# 
# Copyright (c) 2017, Andrea Rossi <a.rossi.andrea@gmail.com>
# Wasp is free software; you can redistribute it and/or modify 
# it under the terms of the GNU General Public License as published 
# by the Free Software Foundation; either version 3 of the License, 
# or (at your option) any later version. 
# 
# Wasp is distributed in the hope that it will be useful,
# but WITHOUT ANY WARRANTY; without even the implied warranty of 
# MERCHANTABILITY or FITNESS FOR A PARTICULAR PURPOSE. See the 
# GNU General Public License for more details.
# 
# You should have received a copy of the GNU General Public License
# along with Wasp; If not, see <http://www.gnu.org/licenses/>.
# 
# @license GPL-3.0 <https://www.gnu.org/licenses/gpl.html>
#
# Significant parts of Wasp have been developed by Andrea Rossi
# as part of research on digital materials and discrete design at:
# DDU Digital Design Unit - Prof. Oliver Tessmann
# Technische Universität Darmstadt


#########################################################################
##                            COMPONENT INFO                           ##
#########################################################################

"""
This component doesn't update the installation. It will only update the file
to your current installation. The components that can't be updated automatically
will be marked and should be replaced manually.
--> WIP Component: might be incomplete or contain bugs <--
-
Provided by Wasp 0.2
Code is adapted from Ladybug file updater (https://github.com/mostaphaRoudsari/ladybug)
    
    Args:
        UP: Set to "True" if you want this component to search through the current Grasshopper file and update Wasp components.
    Returns:
        LOG: List of updated files.
"""

ghenv.Component.Name = "Wasp_Update File"
ghenv.Component.NickName = 'UpdateFile'
ghenv.Component.Message = 'VER 0.2.06'
ghenv.Component.IconDisplayMode = ghenv.Component.IconDisplayMode.application
ghenv.Component.Category = "Wasp"
ghenv.Component.SubCategory = "X | Experimental"
try: ghenv.Component.AdditionalHelpFromDocStrings = "1"
except: pass

import Grasshopper
import System
import os
from datetime import datetime
import time


def markComponent(doc, comp, note=None):
    """Add a Group to the component with a note."""
    note = note or "There is a change in input or output. Replace manually with the inserted component!"
    grp = Grasshopper.Kernel.Special.GH_Group()
    grp.CreateAttributes()
    grp.Border = Grasshopper.Kernel.Special.GH_GroupBorder.Blob
    grp.AddObject(comp.InstanceGuid)
    grp.Colour = System.Drawing.Color.IndianRed
    grp.NickName = note
    doc.AddObject(grp, False);    
    return True

def isWaspComponent(component):
    """Return True if a component is part of Wasp."""
    if component.Name.split('_')[0] == "Wasp":
        return True
    return False


def collectGHPythonComponents(document=None):
    """Collect all the GHPython components in file.""" 
    components = []
    document = document or ghenv.Component.OnPingDocument()
    for obj in document.Objects:
        if type(obj) == type(ghenv.Component)and isWaspComponent(obj):
            if obj.Locked:
                continue
            components.append(obj)
    # remove the component itself
    components = tuple(comp for comp in components if comp.InstanceGuid != ghenv.Component.InstanceGuid)
    return components


def parseVersion(version):
    version = sum(int(n) * 10 ** i for i, n in enumerate(reversed(version.split("VER ")[1].split("."))))
    return version


def isNewerVersion(uo, component):
    """Check if user object is newer version of the component."""
    # try to get date and time
    warnType = Grasshopper.Kernel.GH_RuntimeMessageLevel.Warning
    try:
        version = parseVersion(component.Message)
    except Exception:
        warning = 'Failed to parse version from "%s" component.' % component.Name
        ghenv.Component.AddRuntimeMessage(warnType, warning)
        return False    
    
    # get the version from the userobject
    for c, line in enumerate(uo.Code.split('\n')):
        if c > 200:
            warning = 'Failed to parse version from "%s" userobject.' % component.Name
            ghenv.Component.AddRuntimeMessage(warnType, warning)
            return False
        if line.strip().startswith("ghenv.Component.Message"):
            uversion = line.split("=")[1].strip()[:-1]
            try:
                uversion = parseVersion(uversion)
            except Exception:
                warning = 'Failed to parse version from "%s" userobject.' % component.Name
                ghenv.Component.AddRuntimeMessage(warnType, warning)
                return False    
            
            if uversion >= version:
                return True
            else:
                return False


def comparePort(p1, p2):
    """compare two ports and return True if they are equal."""
    if hasattr(p1, 'TypeHint'):
        if p1.Name != p2.Name:
            return False
        elif p1.TypeHint.TypeName != p2.TypeHint.TypeName:
            return False
        elif str(p1.Access) != str(p2.Access):
            return False
        else:
            return True
    else:
        # output
        if p1.Name != p2.Name:
            return False
        else:
            return True        

def comparePorts(c1, c2):
    """Compare ports for two components."""
    for i in xrange(c1.Params.Input.Count):
        if not comparePort(c1.Params.Input[i], c2.Params.Input[i]):
            return True
    
    for i in xrange(c1.Params.Output.Count):
        if not comparePort(c1.Params.Output[i], c2.Params.Output[i]):
            return True
    
    return False

def inputOutputChanged(uo, component):
    """Check if inputs or outputs has changed."""
    if uo.Params.Input.Count != component.Params.Input.Count:
        return True
    elif uo.Params.Output.Count != component.Params.Output.Count:
        return True
    
    return comparePorts(uo, component)


def insertNewUO(uo, component, doc):
    # use component to find the location
    x = component.Attributes.Pivot.X + 30
    y = component.Attributes.Pivot.Y - 20
    
    # insert the new one
    uo.Attributes.Pivot = System.Drawing.PointF(x, y)
    doc.AddObject(uo , False, 0)


def updateComponent(component, uofolder):
    """update component from userobject."""
    fp = os.path.join(uofolder, '%s.ghuser' % component.Name)

    if not os.path.isfile(fp):
        warning = 'Failed to find the userobject for %s' % component.Name
        ghenv.Component.AddRuntimeMessage(Grasshopper.Kernel.GH_RuntimeMessageLevel.Warning, warning)
        return False
    uo = Grasshopper.Kernel.GH_UserObject(fp).InstantiateObject()

    # check the version and the date between component and userobject
    if not isNewerVersion(uo, component):
        return False 

    # it is a newer version
    component.Code = uo.Code
    
    # Define the callback function
    def callBack(document):
        component.ExpireSolution(False)

    # Update the solution
    doc.ScheduleSolution(2,
        Grasshopper.Kernel.GH_Document.GH_ScheduleDelegate(callBack))

    # check if inputs or outputs has changed
    if inputOutputChanged(uo, component):
        insertNewUO(uo, component, doc)
        
        # add a group note to the component
        markComponent(doc, component)
        return 'Cannot update %s. Replace manually.' % component.Name

    return 'Updated %s' % component.Name


if UPDATE:
    # find the component
    uofolder = Grasshopper.Folders.UserObjectFolders[0]
    
    doc = ghenv.Component.OnPingDocument()
    
    # load the initial userobject
    components = collectGHPythonComponents(doc)
    
    report = (updateComponent(comp, uofolder) for comp in components)
    
    LOG = '\n'.join(r for r in report if r)
# ---------- end updatefile ----------

pt = ConstructPoint(XCoordinate=Slider(72, range=0..1000), YCoordinate=0, ZCoordinate=0)
yz = YZPlane(Origin=pt)
planeconst = Wasp_PlaneConstraint(PLN=yz, POS=Toggle(True), SOFT=Toggle(False))  # -> PC; inputs PLN: Plane, POS: Boolean, SOFT: Boolean
# ---------- planeconst: Python ----------
# Wasp: Discrete Design with Grasshopper plug-in (GPL) initiated by Andrea Rossi
# 
# This file is part of Wasp.
# 
# Copyright (c) 2017, Andrea Rossi <a.rossi.andrea@gmail.com>
# Wasp is free software; you can redistribute it and/or modify 
# it under the terms of the GNU General Public License as published 
# by the Free Software Foundation; either version 3 of the License, 
# or (at your option) any later version. 
# 
# Wasp is distributed in the hope that it will be useful,
# but WITHOUT ANY WARRANTY; without even the implied warranty of 
# MERCHANTABILITY or FITNESS FOR A PARTICULAR PURPOSE. See the 
# GNU General Public License for more details.
# 
# You should have received a copy of the GNU General Public License
# along with Wasp; If not, see <http://www.gnu.org/licenses/>.
# 
# @license GPL-3.0 <https://www.gnu.org/licenses/gpl.html>
#
# Significant parts of Wasp have been developed by Andrea Rossi
# as part of research on digital materials and discrete design at:
# DDU Digital Design Unit - Prof. Oliver Tessmann
# Technische Universität Darmstadt


#########################################################################
##                            COMPONENT INFO                           ##
#########################################################################

"""
Plane global constraint
-
Provided by Wasp 0.3
    Args:
        PLN: Plane to use as constraints
        POS: OPTIONAL // True to place parts on the positive direction of the Z axis, False for the negative direction (True by default)
        SOFT: OPTIONAL // True to check only the part center point, False to check also for geometry intersection (True by default)
    Returns:
        PC: Plane constraint
"""

ghenv.Component.Name = "Wasp_Plane Constraint"
ghenv.Component.NickName = 'PlaneConst'
ghenv.Component.Message = "VER 0.3.001"
ghenv.Component.IconDisplayMode = ghenv.Component.IconDisplayMode.application
ghenv.Component.Category = "Wasp"
ghenv.Component.SubCategory = "4 | Aggregation"
try: ghenv.Component.AdditionalHelpFromDocStrings = "3"
except: pass

import sys
import Rhino.Geometry as rg
import Grasshopper as gh

## add Wasp install directory to system path
wasp_loaded = False
ghcompfolder = gh.Folders.DefaultAssemblyFolder
if ghcompfolder not in sys.path:
    sys.path.append(ghcompfolder)
try:
    from wasp import __version__
    wasp_loaded = True
except:
    msg = "Cannot import Wasp. Is the wasp folder available in " + ghcompfolder + "?"
    ghenv.Component.AddRuntimeMessage(gh.Kernel.GH_RuntimeMessageLevel.Error, msg)

## if Wasp is installed correctly, load the classes required by the component
if wasp_loaded:
    from wasp import Plane_Constraint


## Main code execution
def main(plane, positive, soft_constraint):
    
    check_data = True
    ##check inputs
    if plane is None:
        check_data = False
        msg = "Provide a valid plane"
        ghenv.Component.AddRuntimeMessage(gh.Kernel.GH_RuntimeMessageLevel.Warning, msg)
    
    if positive is None:
        positive = True
    
    if soft_constraint is None:
        soft_constraint = True
    
    if check_data:
        plane_constraint = Plane_Constraint(plane, _positive = positive, _soft = soft_constraint)
        return plane_constraint
        
    else:
        return -1


result = main(PLN, POS, SOFT)

if result != -1:
    PC = result
# ---------- end planeconst ----------

# ----
# AGGREGATION BASE
# In order to seed the aggregation with a "base", the TransformPart
# component is used to randomly scatter a number of parts on the
# XY plane.
number_slider = Slider(75, range=0..100)
random = Random(Range=Slider(50, range=0..100), Number=number_slider, Seed=2, Integers=True)
number_slider_2 = Slider(5, range=0..10)
jitter = Jitter(List=random, Jitter=1, Seed=2)  # -> Values, Indices
multiplication = Multiplication(A=random, B=number_slider_2)
multiplication_2 = Multiplication(A=jitter.Values, B=number_slider_2)
vec = VectorXYZ(XComponent=multiplication, YComponent=multiplication_2, ZComponent=0)  # -> Vector, Length
move = Move(Motion=vec.Vector)  # -> Geometry, Transform

# ----
# ADVANCED PART
# Using an AdvancedPart, it is possible to also define custom
# support groups, points which need to be supported at the same
# time to allow the placement of the part.
panel = Panel("BOTTOM")
connections_centers = Point([<point referenced from the Rhino model> x10])
connections_centers_2 = Point([<point referenced from the Rhino model> x10])
connections_x_axis = Curve([<curve referenced from the Rhino model> x10])
connections_x_axis_2 = Curve([<curve referenced from the Rhino model> x10])
part_geometry = Brep(<brep referenced from the Rhino model>)
conndir = Wasp_ConnectionFromDirection(GEO=part_geometry, CEN=connections_centers, UP=connections_x_axis, T=panel)  # -> CONN, PLN_OUT; inputs CEN: list of Point3d, UP: list of Curve, T: list
# ---------- conndir: Python ----------
# Wasp: Discrete Design with Grasshopper plug-in (GPL) initiated by Andrea Rossi
# 
# This file is part of Wasp.
# 
# Copyright (c) 2017, Andrea Rossi <a.rossi.andrea@gmail.com>
# Wasp is free software; you can redistribute it and/or modify 
# it under the terms of the GNU General Public License as published 
# by the Free Software Foundation; either version 3 of the License, 
# or (at your option) any later version. 
# 
# Wasp is distributed in the hope that it will be useful,
# but WITHOUT ANY WARRANTY; without even the implied warranty of 
# MERCHANTABILITY or FITNESS FOR A PARTICULAR PURPOSE. See the 
# GNU General Public License for more details.
# 
# You should have received a copy of the GNU General Public License
# along with Wasp; If not, see <http://www.gnu.org/licenses/>.
# 
# @license GPL-3.0 <https://www.gnu.org/licenses/gpl.html>
#
# Significant parts of Wasp have been developed by Andrea Rossi
# as part of research on digital materials and discrete design at:
# DDU Digital Design Unit - Prof. Oliver Tessmann
# Technische Universität Darmstadt


#########################################################################
##                            COMPONENT INFO                           ##
#########################################################################

"""
Create a connection on a given part geometry from center and X-asix direction
(Z direction is determined based on the normals of the component geometry)
-
Provided by Wasp 0.3
    Args:
        GEO: Geometry of the part to which the connection belongs
        CEN: Origin of the connection plane
        UP: Line idetifying the X-axis of the connection plane - determines the plane orientation to mantain when transforming
        T: OPTIONAL // Connection type (to be used with Rule Generator component)
    Returns:
        CONN: Connection object
        PLN_OUT: Plane for each connection object (for debugging)
"""

ghenv.Component.Name = "Wasp_Connection From Direction"
ghenv.Component.NickName = 'ConnDir'
ghenv.Component.Message = 'VER 0.3.001'
ghenv.Component.IconDisplayMode = ghenv.Component.IconDisplayMode.application
ghenv.Component.Category = "Wasp"
ghenv.Component.SubCategory = "1 | Elements"
try: ghenv.Component.AdditionalHelpFromDocStrings = "1"
except: pass


import sys
import Rhino.Geometry as rg
import Grasshopper as gh

## add Wasp install directory to system path
wasp_loaded = False
ghcompfolder = gh.Folders.DefaultAssemblyFolder
if ghcompfolder not in sys.path:
    sys.path.append(ghcompfolder)
try:
    from wasp import __version__
    wasp_loaded = True
except:
    msg = "Cannot import Wasp. Is the wasp folder available in " + ghcompfolder + "?"
    ghenv.Component.AddRuntimeMessage(gh.Kernel.GH_RuntimeMessageLevel.Error, msg)

## if Wasp is installed correctly, load the classes required by the component
if wasp_loaded:
    from wasp import Connection
    from wasp import global_tolerance


def main(part_geo, conn_centers, conn_ups, conn_type):
        
    check_data = True
    
    ## check inputs
    if part_geo is None:
        check_data = False
        msg = "No part geometry provided"
        ghenv.Component.AddRuntimeMessage(gh.Kernel.GH_RuntimeMessageLevel.Warning, msg)
    
    if len(conn_centers) != len(conn_ups):
        check_data = False
        msg = "Different amount of centers and up vectors provided"
        ghenv.Component.AddRuntimeMessage(gh.Kernel.GH_RuntimeMessageLevel.Error, msg)
    
    types = []
    if len(conn_type) == 0:
        for i in range(len(conn_centers)):
            types.append("0")
    elif len(conn_type) == 1:
        for i in range(len(conn_centers)):
            types.append(conn_type[0])
    elif len(conn_centers) != len(conn_type):
        check_data = False
        msg = "Different amount of centers and types provided"
        ghenv.Component.AddRuntimeMessage(gh.Kernel.GH_RuntimeMessageLevel.Error, msg)
    else:
        for i in range(len(conn_centers)):
            types.append(conn_type[i])
    
    ## execute main code if all needed inputs are available
    if check_data:
        connections = []
        out_planes = []
        for i in range(len(conn_centers)):
            
            center = conn_centers[i]
            up = conn_ups[i]
            plane = None
            
            up_start = rg.Vector3d(up.PointAtStart)
            up_end = rg.Vector3d(up.PointAtEnd)
            up_vec = rg.Vector3d.Subtract(up_end, up_start)
            
            if type(part_geo) == rg.Brep:
                for face in part_geo.Faces:
                    pt_uv = face.ClosestPoint(center)
                    pt = face.PointAt(pt_uv[1], pt_uv[2])
                    dist = rg.Point3d.DistanceTo(center, pt)
                    if(dist < global_tolerance):
                        normal = face.NormalAt(pt_uv[1], pt_uv[2])
                        plane = rg.Plane(center, normal)
                        x_axis = plane.XAxis
                        angle = rg.Vector3d.VectorAngle(x_axis, up_vec, plane)
                        plane.Rotate(angle, normal)
                        break
            
            elif type(part_geo) == rg.Mesh:
                part_geo.Normals.ComputeNormals()
                mesh_pt = part_geo.ClosestMeshPoint(center, global_tolerance)
                if mesh_pt is not None:
                    normal = part_geo.NormalAt(mesh_pt)
                    plane = rg.Plane(center, normal)
                    x_axis = plane.XAxis
                    angle = rg.Vector3d.VectorAngle(x_axis, up_vec, plane)
                    plane.Rotate(angle, normal)
            
            if plane is None:
                msg = "No valid plane provided for connection %d"%(i)
                ghenv.Component.AddRuntimeMessage(gh.Kernel.GH_RuntimeMessageLevel.Error, msg)
            else:
                conn = Connection(plane, types[i], "", -1)
                connections.append(conn)
                out_planes.append(plane)
        
        return connections, out_planes
    
    else:
        return -1

result = main(GEO, CEN, UP, T)

if result != -1:
    CONN = result[0]
    PLN_OUT = result[1]
# ---------- end conndir ----------
conndir_2 = Wasp_ConnectionFromDirection(GEO=part_geometry, CEN=connections_centers_2, UP=connections_x_axis_2, T="TOP")  # -> CONN, PLN_OUT; inputs CEN: list of Point3d, UP: list of Curve, T: list; same code as conndir
part_name = Panel("T")
merge = Merge(Data1=conndir.CONN, Data2=conndir_2.CONN)

# ----
# SUPPORTS
# In order to specify custom support conditions to be checked during aggregation
# (e.g., minimum 2 points supported, or just the center point), it is possible to use
# the Support component to define group of points to be supported.
# In order to specify a support direction, a line segment intersecting the Part geometry
# is used.
crv = Curve([<curve referenced from the Rhino model> x10])
part_geometry_2 = Brep(part_geometry)
item = ListItem(List=crv, Index=0, Wrap=False)  # -> Item, Item1, Item2, Item3, Item4, Item5, Item6, Item7, Item8, Item9
support = Wasp_Support(DIR=[item.Item1, item.Item4], GEO=part_geometry_2)  # -> SUP; inputs DIR: list of Curve, GEO: Mesh
# ---------- support: Python ----------
# Wasp: Discrete Design with Grasshopper plug-in (GPL) initiated by Andrea Rossi
# 
# This file is part of Wasp.
# 
# Copyright (c) 2017, Andrea Rossi <a.rossi.andrea@gmail.com>
# Wasp is free software; you can redistribute it and/or modify 
# it under the terms of the GNU General Public License as published 
# by the Free Software Foundation; either version 3 of the License, 
# or (at your option) any later version. 
# 
# Wasp is distributed in the hope that it will be useful,
# but WITHOUT ANY WARRANTY; without even the implied warranty of 
# MERCHANTABILITY or FITNESS FOR A PARTICULAR PURPOSE. See the 
# GNU General Public License for more details.
# 
# You should have received a copy of the GNU General Public License
# along with Wasp; If not, see <http://www.gnu.org/licenses/>.
# 
# @license GPL-3.0 <https://www.gnu.org/licenses/gpl.html>
#
# Significant parts of Wasp have been developed by Andrea Rossi
# as part of research on digital materials and discrete design at:
# DDU Digital Design Unit - Prof. Oliver Tessmann
# Technische Universität Darmstadt


#########################################################################
##                            COMPONENT INFO                           ##
#########################################################################

"""
Support definition for constrained parts.
Each set of lines defining support locations can be set
-
Provided by Wasp 0.3
    Args:
        DIR: Directions of the support locations as lines
        GEO: OPTIONAL // Geometry of the part the support belongs to (useful for checking if the supports are correctly placed)
    Returns:
        SUP: Support instance
"""

ghenv.Component.Name = "Wasp_Support"
ghenv.Component.NickName = 'Support'
ghenv.Component.Message = 'VER 0.3.001'
ghenv.Component.IconDisplayMode = ghenv.Component.IconDisplayMode.application
ghenv.Component.Category = "Wasp"
ghenv.Component.SubCategory = "1 | Elements"
try: ghenv.Component.AdditionalHelpFromDocStrings = "3"
except: pass


import sys
import Rhino.Geometry as rg
import Grasshopper as gh


## add Wasp install directory to system path
wasp_loaded = False
ghcompfolder = gh.Folders.DefaultAssemblyFolder
if ghcompfolder not in sys.path:
    sys.path.append(ghcompfolder)
try:
    from wasp import __version__
    wasp_loaded = True
except:
    msg = "Cannot import Wasp. Is the wasp folder available in " + ghcompfolder + "?"
    ghenv.Component.AddRuntimeMessage(gh.Kernel.GH_RuntimeMessageLevel.Error, msg)

## if Wasp is installed correctly, load the classes required by the component
if wasp_loaded:
    from wasp import Support


def main(sup_dir, part_geo):
    
    check_data = True
    
    ##check inputs
    support_lines = []
    if len(sup_dir) == 0:
        check_data = False
        msg = "Please provide a valid list of lines as support directions"
        ghenv.Component.AddRuntimeMessage(gh.Kernel.GH_RuntimeMessageLevel.Warning, msg)
    else:
        for sup in sup_dir:
            start = sup.PointAtStart
            end = sup.PointAtEnd
            sup_ln = rg.Line(start, end)
            support_lines.append(sup_ln)
    
    if part_geo is not None:
        for i in range(len(support_lines)):
            intersection = rg.Intersect.Intersection.MeshLine(part_geo, support_lines[i])
            if len(intersection[0]) == 0:
                msg = "Support direction " + str(i) + " does not intersect with the part geometry. Please verify this is intended."
                ghenv.Component.AddRuntimeMessage(gh.Kernel.GH_RuntimeMessageLevel.Warning, msg)
    
    if check_data:
        support = Support(DIR)
        return support
    else:
        return -1


result = main(DIR, GEO)

if result != -1:
    SUP = result
# ---------- end support ----------
support_2 = Wasp_Support(DIR=[item.Item3, item.Item6], GEO=part_geometry_2)  # -> SUP; inputs DIR: list of Curve, GEO: Mesh; same code as support
support_3 = Wasp_Support(DIR=[item.Item7, item.Item5], GEO=part_geometry_2)  # -> SUP; inputs DIR: list of Curve, GEO: Mesh; same code as support
support_4 = Wasp_Support(DIR=[item.Item8, item.Item2, item.Item], GEO=part_geometry_2)  # -> SUP; inputs DIR: list of Curve, GEO: Mesh; same code as support
merge_2 = Merge(Data1=support, Data2=support_2, Data3=support_3, Data4=support_4)

advpart = Wasp_AdvancedPart(NAME=part_name, GEO=part_geometry, CONN=flatten(merge), SUP=merge_2)  # -> PART; inputs GEO: Mesh, CONN: list, HI: list, ATTR: list, SUP: list
# ---------- advpart: Python ----------
# Wasp: Discrete Design with Grasshopper plug-in (GPL) initiated by Andrea Rossi
# 
# This file is part of Wasp.
# 
# Copyright (c) 2017, Andrea Rossi <a.rossi.andrea@gmail.com>
# Wasp is free software; you can redistribute it and/or modify 
# it under the terms of the GNU General Public License as published 
# by the Free Software Foundation; either version 3 of the License, 
# or (at your option) any later version. 
# 
# Wasp is distributed in the hope that it will be useful,
# but WITHOUT ANY WARRANTY; without even the implied warranty of 
# MERCHANTABILITY or FITNESS FOR A PARTICULAR PURPOSE. See the 
# GNU General Public License for more details.
# 
# You should have received a copy of the GNU General Public License
# along with Wasp; If not, see <http://www.gnu.org/licenses/>.
# 
# @license GPL-3.0 <https://www.gnu.org/licenses/gpl.html>
#
# Significant parts of Wasp have been developed by Andrea Rossi
# as part of research on digital materials and discrete design at:
# DDU Digital Design Unit - Prof. Oliver Tessmann
# Technische Universität Darmstadt


#########################################################################
##                            COMPONENT INFO                           ##
#########################################################################

"""
Create a Wasp Part with additional constraints (supports, additional colliders)
-
Provided by Wasp 0.3
    Args:
        NAME: Part name
        GEO: Part geometry. It will be converted to mesh - to improve performance, perform the conversion before adding to the part and user a low-poly count
        CONN: Connections list
        COLL: OPTIONAL // Collider geometry (for collision detection). A collider will be automatically generated. For complex parts, automatic generation might not work, and you can add a custom collider geometry here.
        FIELD: OPTIONAL // Field to associate with the part for Field-Driven Aggegation (Needed only when using multiple fields within one aggregation)
        HI: OPTIONAL // Hierarchy: List of parts composing the part at a lower heriarchical level in the aggregation
        ATTR: OPTIONAL // Part attributes
        E_COLL: OPTIONAL // Additional collider geometry (e.g. assembly tool), to be checked in Constrained mode
        SUP: OPTIONAL // Required supports for part placement, to be checked in Constrained mode
    Returns:
        PART: Part instance
"""

ghenv.Component.Name = "Wasp_Advanced Part"
ghenv.Component.NickName = 'AdvPart'
ghenv.Component.Message = 'VER 0.3.002'
ghenv.Component.IconDisplayMode = ghenv.Component.IconDisplayMode.application
ghenv.Component.Category = "Wasp"
ghenv.Component.SubCategory = "2 | Parts"
try: ghenv.Component.AdditionalHelpFromDocStrings = "1"
except: pass

import sys
import Rhino.Geometry as rg
import Grasshopper as gh


## add Wasp install directory to system path
wasp_loaded = False
ghcompfolder = gh.Folders.DefaultAssemblyFolder
if ghcompfolder not in sys.path:
    sys.path.append(ghcompfolder)
try:
    from wasp import __version__
    wasp_loaded = True
except:
    msg = "Cannot import Wasp. Is the wasp folder available in " + ghcompfolder + "?"
    ghenv.Component.AddRuntimeMessage(gh.Kernel.GH_RuntimeMessageLevel.Error, msg)

## if Wasp is installed correctly, load the classes required by the component
if wasp_loaded:
    from wasp import AdvancedPart
    from wasp import Collider
    from wasp import global_tolerance


def main(part_name, part_geo, connections, collider, field_name, sub_parts, attributes, add_collider, supports):
    
    check_data = True
    
    ## check inputs
    if part_name is None:
        check_data = False
        msg = "No part name provided"
        ghenv.Component.AddRuntimeMessage(gh.Kernel.GH_RuntimeMessageLevel.Warning, msg)
    
    if part_geo is None:
        check_data = False
        msg = "No part geometry provided"
        ghenv.Component.AddRuntimeMessage(gh.Kernel.GH_RuntimeMessageLevel.Warning, msg)
        check_data = False
    
    ## compute collider, if no custom collider is provided
    if collider is None:
        if part_geo is not None:
            collider_geo = part_geo.Duplicate().Offset(global_tolerance)
            collider_intersection = rg.Intersect.Intersection.MeshMeshFast(collider_geo, part_geo)
            if len(collider_intersection) > 0:
                collider_geo = None
                collider_geo = part_geo.Duplicate()
                center = part_geo.GetBoundingBox(True).Center
                scale_plane = rg.Plane(center, rg.Vector3d(1,0,0), rg.Vector3d(0,1,0))
                scale_transform = rg.Transform.Scale(scale_plane, 1-global_tolerance, 1-global_tolerance, 1-global_tolerance)
                collider_geo.Transform(scale_transform)
                collider_intersection = rg.Intersect.Intersection.MeshMeshFast(collider_geo, part_geo)
                if len(collider_intersection) > 0:
                    collider_geo = None
                    msg = "Could not compute a valid collider geometry. Please provide a valid collider in the COLL input."
                    ghenv.Component.AddRuntimeMessage(gh.Kernel.GH_RuntimeMessageLevel.Error, msg)
                    check_data = False
            
            if collider_geo is not None:
                collider = Collider([collider_geo])
    
    else:
        if type(collider) != Collider:
            if type(collider) == rg.Mesh:
                collider = Collider([collider])
            else:
                msg = "Collider geometry must be of type Mesh or WaspCollider."
                ghenv.Component.AddRuntimeMessage(gh.Kernel.GH_RuntimeMessageLevel.Error, msg)
                check_data = False
        
    if collider is not None and collider.faces_count > 1000:
        msg = "The collider has a high faces count. Consider providing a low poly collider to improve performance"
        ghenv.Component.AddRuntimeMessage(gh.Kernel.GH_RuntimeMessageLevel.Warning, msg)
    
    
    if check_data:
        if add_collider is not None and type(add_collider) != Collider:
            add_collider = Collider([add_collider])
        
        ## create part instance
        new_part = AdvancedPart(part_name, part_geo, connections, collider, attributes, add_collider, supports, field=field_name, sub_parts=sub_parts)
        
        if new_part.dim < global_tolerance*10:
            msg = "The parts you created are very small. You might consider scaling them or decreasing the tolerance of your Rhino file."
            ghenv.Component.AddRuntimeMessage(gh.Kernel.GH_RuntimeMessageLevel.Warning, msg)
        
        return new_part
    else:
        return -1


result = main(NAME, GEO, CONN, COLL, FIELD, HI, ATTR, E_COLL, SUP)

if result != -1:
    PART = result
# ---------- end advpart ----------

parttr = Wasp_TransformPart(PART=advpart, TR=move.Transform)  # -> PART_OUT
# ---------- parttr: Python ----------
# Wasp: Discrete Design with Grasshopper plug-in (GPL) initiated by Andrea Rossi
# 
# This file is part of Wasp.
# 
# Copyright (c) 2017, Andrea Rossi <a.rossi.andrea@gmail.com>
# Wasp is free software; you can redistribute it and/or modify 
# it under the terms of the GNU General Public License as published 
# by the Free Software Foundation; either version 3 of the License, 
# or (at your option) any later version. 
# 
# Wasp is distributed in the hope that it will be useful,
# but WITHOUT ANY WARRANTY; without even the implied warranty of 
# MERCHANTABILITY or FITNESS FOR A PARTICULAR PURPOSE. See the 
# GNU General Public License for more details.
# 
# You should have received a copy of the GNU General Public License
# along with Wasp; If not, see <http://www.gnu.org/licenses/>.
# 
# @license GPL-3.0 <https://www.gnu.org/licenses/gpl.html>
#
# Significant parts of Wasp have been developed by Andrea Rossi
# as part of research on digital materials and discrete design at:
# DDU Digital Design Unit - Prof. Oliver Tessmann
# Technische Universität Darmstadt


#########################################################################
##                            COMPONENT INFO                           ##
#########################################################################

"""
Applies a geometric transformation to an existing part, returning a transformed copy.
Can be used with any Transform component from Grasshopper.
Create a Transform component without inputting any geometry and plug the X output to the TR input.
-
Provided by Wasp 0.3
    Args:
        PART: Part to be transformed
        TR: Transformation
    Returns:
        PART_OUT: Transformed part
"""

ghenv.Component.Name = "Wasp_Transform Part"
ghenv.Component.NickName = 'PartTr'
ghenv.Component.Message = 'VER 0.3.001'
ghenv.Component.IconDisplayMode = ghenv.Component.IconDisplayMode.application
ghenv.Component.Category = "Wasp"
ghenv.Component.SubCategory = "2 | Parts"
try: ghenv.Component.AdditionalHelpFromDocStrings = "2"
except: pass

import sys
import Grasshopper as gh
import math


## add Wasp install directory to system path
wasp_loaded = False
ghcompfolder = gh.Folders.DefaultAssemblyFolder
if ghcompfolder not in sys.path:
    sys.path.append(ghcompfolder)
try:
    from wasp import __version__
    wasp_loaded = True
except:
    msg = "Cannot import Wasp. Is the wasp folder available in " + ghcompfolder + "?"
    ghenv.Component.AddRuntimeMessage(gh.Kernel.GH_RuntimeMessageLevel.Error, msg)

## if Wasp is installed correctly, load the classes required by the component
if wasp_loaded:
    from wasp import Part


def main(part, transform):
    
    check_data = True
    
    ##check inputs
    if part is None:
        check_data = False
        msg = "Please provide a valid part to be transformed"
        ghenv.Component.AddRuntimeMessage(gh.Kernel.GH_RuntimeMessageLevel.Warning, msg)
    
    if transform is None:
        check_data = False
        msg = "Please provide a valid transformation"
        ghenv.Component.AddRuntimeMessage(gh.Kernel.GH_RuntimeMessageLevel.Warning, msg)
    
    if check_data:
        ## transform part
        part_trans = part.transform(transform)
        
        ## flip part if negative scaling occurs
        if transform.M00 * transform.M11 * transform.M22 < 0:
            ## geometry
            part_trans.geo.Flip(True, True, True)
            ## connections
            for conn in part_trans.connections:
                pass
                conn.pln.Flip()
                conn.pln.Rotate(math.pi/2, conn.pln.ZAxis)
            ## collider
            for geo in part_trans.collider.geometry:
                geo.Flip(True, True, True)
        
        return part_trans
    else:
        return -1


result = main(PART, TR)

if result != -1:
    PART_OUT = result
# ---------- end parttr ----------

rulegen = Wasp_RulesGenerator(PART=advpart, GR="TOP>BOTTOM")  # -> R; inputs PART: list, SELF_P: Boolean, SELF_C: Boolean, TYP: Boolean, GR: list
# ---------- rulegen: Python ----------
# Wasp: Discrete Design with Grasshopper plug-in (GPL) initiated by Andrea Rossi
# 
# This file is part of Wasp.
# 
# Copyright (c) 2017, Andrea Rossi <a.rossi.andrea@gmail.com>
# Wasp is free software; you can redistribute it and/or modify 
# it under the terms of the GNU General Public License as published 
# by the Free Software Foundation; either version 3 of the License, 
# or (at your option) any later version. 
# 
# Wasp is distributed in the hope that it will be useful,
# but WITHOUT ANY WARRANTY; without even the implied warranty of 
# MERCHANTABILITY or FITNESS FOR A PARTICULAR PURPOSE. See the 
# GNU General Public License for more details.
# 
# You should have received a copy of the GNU General Public License
# along with Wasp; If not, see <http://www.gnu.org/licenses/>.
# 
# @license GPL-3.0 <https://www.gnu.org/licenses/gpl.html>
#
# Significant parts of Wasp have been developed by Andrea Rossi
# as part of research on digital materials and discrete design at:
# DDU Digital Design Unit - Prof. Oliver Tessmann
# Technische Universität Darmstadt


#########################################################################
##                            COMPONENT INFO                           ##
#########################################################################

"""
Automated rules generator given a list of parts. It has two separate modes:
- If no grammar is provided in the GR input, the component generates rules between connections of the same type.
- If a grammar is provided, rules are created between connections of different types, according to the specified grammar rules.
-
Provided by Wasp 0.3
    Args:
        PART: Parts from which to generate aggregation rules
        SELF_P: OPTIONAL // Create rules between connections belonging to the same part (True by default)
        SELF_C: OPTIONAL // Create rules between connection with same id (True by default)
        TYP: OPTIONAL // Create rules only between connections of the same type (False by default). Make sure this component is set to False when using Rule Grammars.
        GR: OPTIONAL // Custom connection grammar with format "ConnType">"ConnType"
    Returns:
        R: Generated aggregation rules
"""

ghenv.Component.Name = "Wasp_Rules Generator"
ghenv.Component.NickName = 'RuleGen'
ghenv.Component.Message = 'VER 0.3.001'
ghenv.Component.IconDisplayMode = ghenv.Component.IconDisplayMode.application
ghenv.Component.Category = "Wasp"
ghenv.Component.SubCategory = "3 | Rules"
try: ghenv.Component.AdditionalHelpFromDocStrings = "2"
except: pass

import sys
import Grasshopper as gh


## add Wasp install directory to system path
wasp_loaded = False
ghcompfolder = gh.Folders.DefaultAssemblyFolder
if ghcompfolder not in sys.path:
    sys.path.append(ghcompfolder)
try:
    from wasp import __version__
    wasp_loaded = True
except:
    msg = "Cannot import Wasp. Is the wasp folder available in " + ghcompfolder + "?"
    ghenv.Component.AddRuntimeMessage(gh.Kernel.GH_RuntimeMessageLevel.Error, msg)

## if Wasp is installed correctly, load the classes required by the component
if wasp_loaded:
    from wasp import Rule


def main(parts, self_part, self_connection, use_types, grammar):
    
    check_data = True
    
    ##check inputs
    if len(parts) == 0 or parts is None:
        check_data = False
        msg = "No part provided"
        ghenv.Component.AddRuntimeMessage(gh.Kernel.GH_RuntimeMessageLevel.Warning, msg)
    
    if self_part == None:
        self_part = True
    
    if self_connection == None:
        self_connection = True
    
    if use_types is None:
        use_types = False
    
    if check_data:
        rules = []
        
        if len(grammar) == 0:
            for part in parts:
                for conn in part.connections:
                    for other_part in parts:
                        skip_part = False
                        if self_part == False:
                            if part.name == other_part.name:
                                skip_part = True
                            
                        if skip_part == False:
                            for other_conn in other_part.connections:
                                skip_conn = False
                                if self_connection == False:
                                    if conn.id == other_conn.id:
                                        skip_conn = True
                                
                                if skip_conn == False:
                                    if use_types:
                                        if conn.type == other_conn.type:
                                            r = Rule(part.name, conn.id, other_part.name, other_conn.id)
                                            rules.append(r)
                                    else:
                                        r = Rule(part.name, conn.id, other_part.name, other_conn.id)
                                        rules.append(r)
        else:
            for gr_rule in grammar:
                start_type = gr_rule.split(">")[0]
                end_type = gr_rule.split(">")[1]
                
                for part in parts:
                    for conn in part.connections:
                        if conn.type == start_type:
                            for other_part in parts:
                                skip_part = False
                                if self_part == False:
                                    if part.name == other_part.name:
                                        skip_part = True
                                    
                                if skip_part == False:
                                    for other_conn in other_part.connections:
                                        if other_conn.type == end_type:
                                            skip_conn = False
                                            if self_connection == False:
                                                if conn.id == other_conn.id:
                                                    skip_conn = True
                                            
                                            if skip_conn == False:
                                                r = Rule(part.name, conn.id, other_part.name, other_conn.id)
                                                rules.append(r)
        return [rules]
    else:
        return -1


result = main(PART, SELF_P, SELF_C, TYP, GR)

if result != -1:
    R = result[0]
# ---------- end rulegen ----------

# ----
# CONSTRAINTS MODE
# Setting constraints mode to 1 activates
# the check for Local Constraints
constraints = ValueList({"NO": 0, "LOCAL": 1, "GLOBAL": 2, "LOCAL + GLOBAL": 3}, selected="LOCAL + GLOBAL")
parts_num = Slider(600, range=0..1000)
reset = Button()
stochasticaggregation = Wasp_StochasticAggregation(PART=flatten(advpart), PREV=parttr, N=parts_num, RULES=rulegen, MODE=constraints, GC=planeconst, RESET=reset)  # -> AGGR, PART_OUT; inputs PART: list, PREV: list, N: Int32, RULES: list, MODE: Int32, GC: list, RESET: Boolean
# ---------- stochasticaggregation: Python ----------
# Wasp: Discrete Design with Grasshopper plug-in (GPL) initiated by Andrea Rossi
# 
# This file is part of Wasp.
# 
# Copyright (c) 2017, Andrea Rossi <a.rossi.andrea@gmail.com>
# Wasp is free software; you can redistribute it and/or modify 
# it under the terms of the GNU General Public License as published 
# by the Free Software Foundation; either version 3 of the License, 
# or (at your option) any later version. 
# 
# Wasp is distributed in the hope that it will be useful,
# but WITHOUT ANY WARRANTY; without even the implied warranty of 
# MERCHANTABILITY or FITNESS FOR A PARTICULAR PURPOSE. See the 
# GNU General Public License for more details.
# 
# You should have received a copy of the GNU General Public License
# along with Wasp; If not, see <http://www.gnu.org/licenses/>.
# 
# @license GPL-3.0 <https://www.gnu.org/licenses/gpl.html>
#
# Significant parts of Wasp have been developed by Andrea Rossi
# as part of research on digital materials and discrete design at:
# DDU Digital Design Unit - Prof. Oliver Tessmann
# Technische Universität Darmstadt


#########################################################################
##                            COMPONENT INFO                           ##
#########################################################################

"""
Aggregate the given parts in a stochastic process, selecting parts and rules randomly at every step.
The component works additively, hence increasing the number of parts in an aggregation just adds new parts on the existing ones, without triggering recomputing of the previous element.
-
Provided by Wasp 0.3
    Args:
        PART: Parts to be aggregated (can be more than one)
        PREV: OPTIONAL // Previous aggregated parts. It is possible to input the results of a previous aggregation, or parts transformed with the TransformPart component
        N: Number of parts to be aggregated (does not count parts provided in PREV)
        RULES: Rules for the aggregation
        COLL: OPTIONAL // Collision detection. By default is active and checks for collisions between the aggregated parts
        MODE: OPTIONAL // Switches between aggregation modes: 0 = no constraints, 1 = local constraints, 2 = global constraints, 3 = local + global constraints
        GC: OPTIONAL // Global constraints to apply to aggregation
        ID: OPTIONAL // Aggregation ID
        RESET: Recompute the whole aggregation
    Returns:
        PART_OUT: Aggregated parts (includes both PREV input and newly aggregated parts)
"""

ghenv.Component.Name = "Wasp_Stochastic Aggregation"
ghenv.Component.NickName = 'StochasticAggregation'
ghenv.Component.Message = 'VER 0.3.001'
ghenv.Component.IconDisplayMode = ghenv.Component.IconDisplayMode.application
ghenv.Component.Category = "Wasp"
ghenv.Component.SubCategory = "4 | Aggregation"
try: ghenv.Component.AdditionalHelpFromDocStrings = "2"
except: pass

import sys
import Rhino.Geometry as rg
import Grasshopper as gh


## add Wasp install directory to system path
wasp_loaded = False
ghcompfolder = gh.Folders.DefaultAssemblyFolder
if ghcompfolder not in sys.path:
    sys.path.append(ghcompfolder)
try:
    from wasp import __version__
    wasp_loaded = True
except:
    msg = "Cannot import Wasp. Is the wasp folder available in " + ghcompfolder + "?"
    ghenv.Component.AddRuntimeMessage(gh.Kernel.GH_RuntimeMessageLevel.Error, msg)

## if Wasp is installed correctly, load the classes required by the component
if wasp_loaded:
    from wasp import Aggregation


def main(parts, previous_parts, num_parts, rules, aggregation_mode, global_constraints, aggregation_id, reset, aggregation):
    
    check_data = True
    
    ##check inputs
    if len(parts) == 0:
        check_data = False
        msg = "No parts provided"
        ghenv.Component.AddRuntimeMessage(gh.Kernel.GH_RuntimeMessageLevel.Warning, msg)
    
    if num_parts is None:
        check_data = False
        msg = "Provide number of aggregation iterations"
        ghenv.Component.AddRuntimeMessage(gh.Kernel.GH_RuntimeMessageLevel.Warning, msg)
    else:
        if len(previous_parts) != 0:
            num_parts += len(previous_parts)
    
    if len(rules) == 0:
        check_data = False
        msg = "No rules provided"
        ghenv.Component.AddRuntimeMessage(gh.Kernel.GH_RuntimeMessageLevel.Warning, msg)
    
    if aggregation_mode is None:
        aggregation_mode = 0
    
    if aggregation_id is None:
        aggregation_id = 'myAggregation'
    
    if reset is None:
        reset = False
    
    if check_data:
        
        ## create aggregation in sticky dict
        if aggregation is None or aggregation == -1 or reset:
            
            ## copy parts to avoid editing the original parts
            parts_copy = []
            for part in parts:
                parts_copy.append(part.copy())
            
            aggregation = Aggregation(aggregation_id, parts_copy, rules, aggregation_mode, _prev = previous_parts, _global_constraints = global_constraints)
        
        ## handle parameters changes
        #### parts
        if parts != aggregation.parts.values():
            
            ## copy parts to avoid editing the original parts
            parts_copy = []
            for part in parts:
                parts_copy.append(part.copy())
            
            aggregation.reset_base_parts(new_parts = parts_copy)
            aggregation.reset_rules(aggregation.rules)
        
        #### rules
        if rules != aggregation.rules:
            aggregation.rules = rules
            aggregation.reset_base_parts()
            aggregation.reset_rules(aggregation.rules)
        
        #### mode
        if aggregation_mode != aggregation.mode:
            aggregation.mode = aggregation_mode
            aggregation.reset_rules(aggregation.rules)
        
        #### constraints
        if global_constraints != aggregation.global_constraints:
            aggregation.global_constraints = global_constraints
            aggregation.reset_rules(aggregation.rules)
        
        ## add parts to aggregation
        if num_parts > len(aggregation.aggregated_parts):
            error_msg = aggregation.aggregate_rnd(num_parts-len(aggregation.aggregated_parts))
            if error_msg is not None:
                ghenv.Component.AddRuntimeMessage(gh.Kernel.GH_RuntimeMessageLevel.Warning, error_msg)
        
        ## remove parts from aggregation
        elif num_parts < len(aggregation.aggregated_parts):
            aggregation.remove_elements(num_parts)
        
        ## return result
        return aggregation
        
    else:
        return -1


## create aggregation container in global variables dict
if 'aggregation_container' not in globals():
    aggregation_container = None

result = main(PART, PREV, N, RULES, MODE, GC, ID, RESET, aggregation_container)

if result != -1:
    aggregation_container = result
    
    AGGR = aggregation_container
    PART_OUT = aggregation_container.aggregated_parts
# ---------- end stochasticaggregation ----------

python = GhPythonScript(x=stochasticaggregation.AGGR)  # -> out, a
# ---------- python: Python ----------
print len(x.global_constraints)
# ---------- end python ----------

partgeo = Wasp_GetPartGeometry(PART=stochasticaggregation.PART_OUT)  # -> GEO
# ---------- partgeo: Python ----------
# Wasp: Discrete Design with Grasshopper plug-in (GPL) initiated by Andrea Rossi
# 
# This file is part of Wasp.
# 
# Copyright (c) 2017, Andrea Rossi <a.rossi.andrea@gmail.com>
# Wasp is free software; you can redistribute it and/or modify 
# it under the terms of the GNU General Public License as published 
# by the Free Software Foundation; either version 3 of the License, 
# or (at your option) any later version. 
# 
# Wasp is distributed in the hope that it will be useful,
# but WITHOUT ANY WARRANTY; without even the implied warranty of 
# MERCHANTABILITY or FITNESS FOR A PARTICULAR PURPOSE. See the 
# GNU General Public License for more details.
# 
# You should have received a copy of the GNU General Public License
# along with Wasp; If not, see <http://www.gnu.org/licenses/>.
# 
# @license GPL-3.0 <https://www.gnu.org/licenses/gpl.html>
#
# Significant parts of Wasp have been developed by Andrea Rossi
# as part of research on digital materials and discrete design at:
# DDU Digital Design Unit - Prof. Oliver Tessmann
# Technische Universität Darmstadt


#########################################################################
##                            COMPONENT INFO                           ##
#########################################################################

"""
Extract the geometry of one part (for visualization or further processing).
-
Provided by Wasp 0.3
    Args:
        PART: Part from where to extract the geometry
    Returns:
        GEO: Part geometry
"""

ghenv.Component.Name = "Wasp_Get Part Geometry"
ghenv.Component.NickName = 'PartGeo'
ghenv.Component.Message = 'VER 0.3.001'
ghenv.Component.IconDisplayMode = ghenv.Component.IconDisplayMode.application
ghenv.Component.Category = "Wasp"
ghenv.Component.SubCategory = "2 | Parts"
try: ghenv.Component.AdditionalHelpFromDocStrings = "3"
except: pass


import sys
import Rhino.Geometry as rg
import Grasshopper as gh


## add Wasp install directory to system path
wasp_loaded = False
ghcompfolder = gh.Folders.DefaultAssemblyFolder
if ghcompfolder not in sys.path:
    sys.path.append(ghcompfolder)
try:
    from wasp import __version__
    wasp_loaded = True
except:
    msg = "Cannot import Wasp. Is the wasp folder available in " + ghcompfolder + "?"
    ghenv.Component.AddRuntimeMessage(gh.Kernel.GH_RuntimeMessageLevel.Error, msg)

## if Wasp is installed correctly, load the classes required by the component
if wasp_loaded:
    pass


def main(part):
        
    check_data = True
    
    ## check inputs
    if part is None:
        check_data = False
        msg = "No or null part provided"
        ghenv.Component.AddRuntimeMessage(gh.Kernel.GH_RuntimeMessageLevel.Warning, msg)
    
    ## execute main code if all needed inputs are available
    if check_data:
        return part.geo
    else:
        return -1

result = main(PART)

if result != -1:
    GEO = result
# ---------- end partgeo ----------
lng = ListLength(List=partgeo)
random_2 = Random(Range=Domain(0, 1), Number=lng, Seed=2)
gradient = Gradient(LowerLimit=0, UpperLimit=1, Parameter=random_2, stops=[0.15: RGB(72, 201, 28), 0.85: RGB(177, 255, 69)])
preview = CustomPreview(Geometry=partgeo, Shader=gradient)
