# Grasshopper definition 210209_WASP_Dev.gh (Grasshopper 1.0.7)

xy = XYPlane(Origin=Point(0, 0, 0))
prot = RotatePlane(Plane=xy, Angle=degrees(Slider(0, range=0..100)))
deplane = DeconstructPlane(Plane=prot)  # -> Origin, XAxis, YAxis, ZAxis
rot3d = Rotate3D(Geometry=prot, Angle=degrees(Slider(0, range=0..100)), Center=deplane.Origin, Axis=deplane.XAxis)  # -> Geometry, Transform
boundary = Brep([<brep referenced from the Rhino model> x2])
conn_up = Curve([<curve referenced from the Rhino model> x12])
cell_size = Slider(25, range=0..100)
comp_geo = Brep(<brep referenced from the Rhino model>)
conn_center = Point([<point referenced from the Rhino model> x12])
points = PointList(Points=conn_center, Size=Slider(2, range=0..10))
custom_mesh_settings = SettingsCustom(
    StitchSeams=True,
    SimplePlanes=False,
    Refine=True,
    MinCount=16,
    MaxCount=400,
    AspectRatio=20,
    MaxDistance=0,
    MaxAngle=20,
    MinEdge=0,
    MaxEdge=0)
custom_mesh_settings_2 = SettingsCustom(
    StitchSeams=True,
    SimplePlanes=False,
    Refine=True,
    MinCount=16,
    MaxCount=400,
    AspectRatio=20,
    MaxDistance=0,
    MaxAngle=20,
    MinEdge=0,
    MaxEdge=0)
replacecode = Wsp_ReplaceCodeString(UO=flatten("*"), OLD_CODE="Provided by Wasp 0.3", NEW_CODE="Provided by Wasp 0.4", RUN=Button())  # inputs UO: list, RUN: Boolean
# ---------- replacecode: Python ----------
#########################################################################
##                            COMPONENT INFO                           ##
#########################################################################

"""
Description + license here
-
Provided by Wasp 0.0.02
    Args:
        UO: Description...
        DIR: Description...
        RUN: Description...
    Returns:
        log: log
"""

ghenv.Component.Name = "Wsp_Replace Code String"
ghenv.Component.NickName = 'ReplaceCode'
ghenv.Component.Message = 'VER 0.2.07'
ghenv.Component.IconDisplayMode = ghenv.Component.IconDisplayMode.name
ghenv.Component.Category = ""
ghenv.Component.SubCategory = ""
try: ghenv.Component.AdditionalHelpFromDocStrings = "1"
except: pass



#########################################################################
##                               IMPORTS                               ##
#########################################################################
import Grasshopper.Folders as folders
import Grasshopper.Kernel as gh
import scriptcontext as sc


def getListOfConnectedComponents(componentInputParamIndex = 0, onlyGHPython = True):
    # this function is edited version of Guilio's code from here:
    # [github link]
    components = []
    
    param = ghenv.Component.Params.Input[componentInputParamIndex]
    sources = param.Sources
    if sources.Count == 0: return components
    
    for source in sources:
        attr = source.Attributes
        if (attr is None) or (attr.GetTopLevel is None):
            pass
        else:
            component = attr.GetTopLevel.DocObject
    
    if component == None or (onlyGHPython and type(component) != type(ghenv.Component)):
            #collect only python components
            pass
    else:
        components.append(component)
    
    return components

def getAllTheComponents(document, onlyGHPython = True):
    components = []
    
    for component in document.Objects:
        if onlyGHPython and type(component)!= type(ghenv.Component):
            pass
        else:
            components.append(component)
    
    return components


def updateComponentVersion(component, old_code_string, new_code_string):
    
    doc = ghenv.Component.OnPingDocument()
    
    current_code = component.Code
    new_code = current_code.replace(old_code_string, new_code_string, 1)
    component.Code = new_code
    
    def callBack(document):
        component.ExpireSolution(False)

    # Update the solution
    doc.ScheduleSolution(2, gh.GH_Document.GH_ScheduleDelegate(callBack))
    
    
    
    

def main(components, old, new):
    
    doc = ghenv.Component.OnPingDocument()
    
    if components[0] == "*":
        ghComps = getAllTheComponents(doc)
    else:
        ghComps = getListOfConnectedComponents()
    
    if len(ghComps)== 0: return "Found 0 components!"
    
    for ghComp in ghComps:
        if ghComp.Name.startswith("Wasp"):
            updateComponentVersion(ghComp, old, new)



if RUN and len(UO)!=0:
    msg = main(UO, OLD_CODE, NEW_CODE)
    ghenv.Component.AddRuntimeMessage(gh.GH_RuntimeMessageLevel.Warning, msg)
else:
    print "At the minimum one of the components are missing!"
# ---------- end replacecode ----------
wspexport = Wsp_ExportUserObjects(UO=flatten("*"), VER="0.4.014", DIR="D:\Github\Wasp", RUN=Toggle(False), REPLACE=Toggle(False))  # -> out, a; inputs UO: list, RUN: Boolean, REPLACE: Boolean
# ---------- wspexport: Python ----------
#########################################################################
##                            COMPONENT INFO                           ##
#########################################################################

"""
Description + license here
-
Provided by Wasp 0.0.02
    Args:
        UO: Description...
        DIR: Description...
        RUN: Description...
    Returns:
        log: log
"""

ghenv.Component.Name = "Wsp_Export User Objects"
ghenv.Component.NickName = 'WspExport'
ghenv.Component.Message = 'VER 0.0.03\nSEP_18_2017'
ghenv.Component.IconDisplayMode = ghenv.Component.IconDisplayMode.name
ghenv.Component.Category = ""
ghenv.Component.SubCategory = ""
try: ghenv.Component.AdditionalHelpFromDocStrings = "1"
except: pass



#########################################################################
##                               IMPORTS                               ##
#########################################################################
import Grasshopper.Folders as folders
import Grasshopper.Kernel as gh
import scriptcontext as sc
import shutil
import os
import uuid

UOFolder = folders.UserObjectFolders[0]
cs = gh.GH_ComponentServer()

exposureDict = {0 : ghenv.Component.Exposure.dropdown,
                1 : ghenv.Component.Exposure.primary,
                2 : ghenv.Component.Exposure.secondary,
                3 : ghenv.Component.Exposure.tertiary,
                4 : ghenv.Component.Exposure.quarternary,
                5 : ghenv.Component.Exposure.quinary,
                6 : ghenv.Component.Exposure.senary,
                7 : ghenv.Component.Exposure.septenary
                }


def exportToUserObject(component, targetFolder):
    targetFolder = os.path.join(targetFolder, "userObjects")
    if not os.path.isdir(targetFolder): os.mkdir(targetFolder)
    
    # check if the userObject is already existed in the folder
    try:
        filePath = os.path.join(UOFolder, component.Name + ".ghuser")
        currentUO = gh.GH_UserObject(filePath)
    except:
        # the userobject is not there so just create it
        currentUO = None
    
    if currentUO!=None:
        if not component.Category == "Maths":
            removeNicely = cs.RemoveCachedObject(filePath)
            if not removeNicely: os.remove(filePath)
        else:
            # there is already a newer version so just copy that to the folder instead
            # and return
            dstFullPath = os.path.join(targetFolder, component.Name + ".ghuser")
            shutil.copy2(filePath, dstFullPath)
            return
    
    # create the new userObject in Grasshopper folder
    uo = gh.GH_UserObject()
    uo.Icon = component.Icon_24x24
    
    try: uo.Exposure = exposureDict[int(component.AdditionalHelpFromDocStrings)]
    except:
        try:
            compCode = component.Code
            # this is so dirty
            exposureNumber = compCode.split("ghenv.Component.AdditionalHelpFromDocStrings")[1].split("\n")[0].replace("=", "").replace('"', "").strip()
            uo.Exposure = exposureDict[int(exposureNumber)]
            
        except:
            uo.Exposure = exposureDict[int(1)]
    
    uo.BaseGuid = component.ComponentGuid
    uo.Description.Name = component.Name
    uo.Description.Description = component.Description
    
    # if user hasn't identified the category then put it into honeybee as an unknown!
    uo.Description.Category = component.Category
    uo.Description.SubCategory = component.SubCategory
    
    uo.CreateDefaultPath(True)
    uo.SetDataFromObject(component)
    uo.SaveToFile()
    
    # copy the component over
    dstFullPath = os.path.join(targetFolder, component.Name + ".ghuser")
    shutil.copy2(filePath, dstFullPath)
    
    gh.GH_ComponentServer.UpdateRibbonUI()
    
    print "UserObject successfully added to: "

def exportToFile(component, targetFolder, replace, version = None):
    
    targetFolder = os.path.join(targetFolder, "src\\ghComp")
    if not os.path.isdir(targetFolder): os.mkdir(targetFolder)
    
    if component.Name.find("Wasp")>=0:
        print component.Name
        if component.Locked == False:
            if version is None or (component.Message.find(version)>=0 and version is not None):
                fileName = component.Name + ".py"
                
                # code inside the component
                code = component.Code
                
                # check if the file already exist
                if replace == False:
                    if os.path.isfile(os.path.join(targetFolder, fileName)):
                        return False
                
                with open(os.path.join(targetFolder, fileName), "w") as pyoutf:
                    if isinstance(code, unicode):
                        code = code.encode('ascii','ignore').replace("\r", "")
                    pyoutf.write(code)
                
                print "Exported " + fileName + " to: " + os.path.join(targetFolder, fileName)
                return True

def getListOfConnectedComponents(componentInputParamIndex = 0, onlyGHPython = True):
    # this function is edited version of Guilio's code from here:
    # [github link]
    components = []
    
    param = ghenv.Component.Params.Input[componentInputParamIndex]
    sources = param.Sources
    if sources.Count == 0: return components
    
    for source in sources:
        attr = source.Attributes
        if (attr is None) or (attr.GetTopLevel is None):
            pass
        else:
            component = attr.GetTopLevel.DocObject
    
    if component == None or (onlyGHPython and type(component) != type(ghenv.Component)):
            #collect only python components
            pass
    else:
        components.append(component)
    
    return components

def getAllTheComponents(onlyGHPython = True):
    components = []
    
    document = ghenv.Component.OnPingDocument()
    
    for component in document.Objects:
        if onlyGHPython and type(component)!= type(ghenv.Component):
            pass
        else:
            components.append(component)
    
    return components


def main(components, current_version, targetFolder, replace_files):
    if not os.path.isdir(targetFolder): os.mkdir(targetFolder)
        
    if components[0] == "*":
        ghComps = getAllTheComponents()
    else:
        ghComps = getListOfConnectedComponents()
    
    if len(ghComps)== 0: return "Found 0 components!"
    
    for ghComp in ghComps:
        fileExported = exportToFile(ghComp, targetFolder, replace_files, version = current_version)
        if fileExported:
            exportToUserObject(ghComp, targetFolder)


if RUN and len(UO)!=0 and DIR!=None:
    msg = main(UO, VER, DIR, REPLACE)
    ghenv.Component.AddRuntimeMessage(gh.GH_RuntimeMessageLevel.Warning, msg)
else:
    print "At the minimum one of the components are missing!"
# ---------- end wspexport ----------
verupdate = Wsp_UpdateVersionNumber(UO=flatten("*"), VER="0.4.012", NEW_VER="0.4.013", RUN=Button())  # inputs UO: list, RUN: Boolean
# ---------- verupdate: Python ----------
#########################################################################
##                            COMPONENT INFO                           ##
#########################################################################

"""
Description + license here
-
Provided by Wasp 0.0.02
    Args:
        UO: Description...
        DIR: Description...
        RUN: Description...
    Returns:
        log: log
"""

ghenv.Component.Name = "Wsp_Update Version Number"
ghenv.Component.NickName = 'VerUpdate'
ghenv.Component.Message = 'VER 0.2.07'
ghenv.Component.IconDisplayMode = ghenv.Component.IconDisplayMode.name
ghenv.Component.Category = ""
ghenv.Component.SubCategory = ""
try: ghenv.Component.AdditionalHelpFromDocStrings = "1"
except: pass



#########################################################################
##                               IMPORTS                               ##
#########################################################################
import Grasshopper.Folders as folders
import Grasshopper.Kernel as gh
import scriptcontext as sc


def getListOfConnectedComponents(componentInputParamIndex = 0, onlyGHPython = True):
    # this function is edited version of Guilio's code from here:
    # [github link]
    components = []
    
    param = ghenv.Component.Params.Input[componentInputParamIndex]
    sources = param.Sources
    if sources.Count == 0: return components
    
    for source in sources:
        attr = source.Attributes
        if (attr is None) or (attr.GetTopLevel is None):
            pass
        else:
            component = attr.GetTopLevel.DocObject
    
    if component == None or (onlyGHPython and type(component) != type(ghenv.Component)):
            #collect only python components
            pass
    else:
        components.append(component)
    
    return components

def getAllTheComponents(document, onlyGHPython = True):
    components = []
    
    for component in document.Objects:
        if onlyGHPython and type(component)!= type(ghenv.Component):
            pass
        else:
            components.append(component)
    
    return components


def updateComponentVersion(component, old_v, new_v):
    
    doc = ghenv.Component.OnPingDocument()
    
    current_code = component.Code
    new_code = current_code.replace("VER " + old_v, "VER " + new_v, 1)
    component.Code = new_code
    
    def callBack(document):
        component.ExpireSolution(False)

    # Update the solution
    doc.ScheduleSolution(2, gh.GH_Document.GH_ScheduleDelegate(callBack))
    
    
    
    

def main(components, current_version, new_version):
    
    doc = ghenv.Component.OnPingDocument()
    
    if components[0] == "*":
        ghComps = getAllTheComponents(doc)
    else:
        ghComps = getListOfConnectedComponents()
    
    if len(ghComps)== 0: return "Found 0 components!"
    
    for ghComp in ghComps:
        if ghComp.Name.startswith("Wasp"):
            updateComponentVersion(ghComp, current_version, new_version)
            
            
            
        


if RUN and len(UO)!=0:
    msg = main(UO, VER, NEW_VER)
    ghenv.Component.AddRuntimeMessage(gh.GH_RuntimeMessageLevel.Warning, msg)
else:
    print "At the minimum one of the components are missing!"
# ---------- end verupdate ----------
updatefile = Wasp_UpdateFile(UPDATE=Button())  # -> LOG; inputs UPDATE: Boolean
# ---------- updatefile: Python ----------
# Wasp: Discrete Design with Grasshopper plug-in (GPL) initiated by Andrea Rossi
# 
# This file is part of Wasp.
# 
# Copyright (c) 2017, Andrea Rossi <a.rossi.andrea@gmail.com>
# Wasp is free software; you can redistribute it and/or modify 
# it under the terms of the GNU General Public License as published 
# by the Free Software Foundation; either version 3 of the License, 
# or (at your option) any later version. 
# 
# Wasp is distributed in the hope that it will be useful,
# but WITHOUT ANY WARRANTY; without even the implied warranty of 
# MERCHANTABILITY or FITNESS FOR A PARTICULAR PURPOSE. See the 
# GNU General Public License for more details.
# 
# You should have received a copy of the GNU General Public License
# along with Wasp; If not, see <http://www.gnu.org/licenses/>.
# 
# @license GPL-3.0 <https://www.gnu.org/licenses/gpl.html>
#
# Significant parts of Wasp have been developed by Andrea Rossi
# as part of research on digital materials and discrete design at:
# DDU Digital Design Unit - Prof. Oliver Tessmann
# Technische Universität Darmstadt


#########################################################################
##                            COMPONENT INFO                           ##
#########################################################################

"""
This component doesn't update the installation. It will only update the file
to your current installation. The components that can't be updated automatically
will be marked and should be replaced manually.
--> WIP Component: might be incomplete or contain bugs <--
-
Provided by Wasp 0.4
Code is adapted from Ladybug file updater (https://github.com/mostaphaRoudsari/ladybug)
    
    Args:
        UPDATE: Set to "True" if you want this component to search through the current Grasshopper file and update all Wasp components.
    Returns:
        LOG: List of updated files.
"""

ghenv.Component.Name = "Wasp_Update File"
ghenv.Component.NickName = 'UpdateFile'
ghenv.Component.Message = 'VER 0.4.013'
ghenv.Component.IconDisplayMode = ghenv.Component.IconDisplayMode.application
ghenv.Component.Category = "Wasp"
ghenv.Component.SubCategory = "X | Experimental"
try: ghenv.Component.AdditionalHelpFromDocStrings = "1"
except: pass

import Grasshopper
import System
import os
from datetime import datetime
import time


def markComponent(doc, comp, note=None):
    """Add a Group to the component with a note."""
    note = note or "There is a change in input or output. Replace manually with the inserted component!"
    grp = Grasshopper.Kernel.Special.GH_Group()
    grp.CreateAttributes()
    grp.Border = Grasshopper.Kernel.Special.GH_GroupBorder.Blob
    grp.AddObject(comp.InstanceGuid)
    grp.Colour = System.Drawing.Color.IndianRed
    grp.NickName = note
    doc.AddObject(grp, False);    
    return True

def isWaspComponent(component):
    """Return True if a component is part of Wasp."""
    if component.Name.split('_')[0] == "Wasp":
        return True
    return False


def collectGHPythonComponents(document=None):
    """Collect all the GHPython components in file.""" 
    components = []
    document = document or ghenv.Component.OnPingDocument()
    for obj in document.Objects:
        if type(obj) == type(ghenv.Component)and isWaspComponent(obj):
            if obj.Locked:
                continue
            components.append(obj)
    # remove the component itself
    components = tuple(comp for comp in components if comp.InstanceGuid != ghenv.Component.InstanceGuid)
    return components


def parseVersion(version):
    version = sum(int(n) * 10 ** i for i, n in enumerate(reversed(version.split("VER ")[1].split("."))))
    return version


def isNewerVersion(uo, component):
    """Check if user object is newer version of the component."""
    # try to get date and time
    warnType = Grasshopper.Kernel.GH_RuntimeMessageLevel.Warning
    try:
        version = parseVersion(component.Message)
    except Exception:
        warning = 'Failed to parse version from "%s" component.' % component.Name
        ghenv.Component.AddRuntimeMessage(warnType, warning)
        return False    
    
    # get the version from the userobject
    for c, line in enumerate(uo.Code.split('\n')):
        if c > 200:
            warning = 'Failed to parse version from "%s" userobject.' % component.Name
            ghenv.Component.AddRuntimeMessage(warnType, warning)
            return False
        if line.strip().startswith("ghenv.Component.Message"):
            uversion = line.split("=")[1].strip()[:-1]
            try:
                uversion = parseVersion(uversion)
            except Exception:
                warning = 'Failed to parse version from "%s" userobject.' % component.Name
                ghenv.Component.AddRuntimeMessage(warnType, warning)
                return False    
            
            if uversion >= version:
                return True
            else:
                return False


def comparePort(p1, p2):
    """compare two ports and return True if they are equal."""
    if hasattr(p1, 'TypeHint'):
        if p1.Name != p2.Name:
            return False
        elif p1.TypeHint.TypeName != p2.TypeHint.TypeName:
            return False
        elif str(p1.Access) != str(p2.Access):
            return False
        else:
            return True
    else:
        # output
        if p1.Name != p2.Name:
            return False
        else:
            return True        

def comparePorts(c1, c2):
    """Compare ports for two components."""
    for i in xrange(c1.Params.Input.Count):
        if not comparePort(c1.Params.Input[i], c2.Params.Input[i]):
            return True
    
    for i in xrange(c1.Params.Output.Count):
        if not comparePort(c1.Params.Output[i], c2.Params.Output[i]):
            return True
    
    return False

def inputOutputChanged(uo, component):
    """Check if inputs or outputs has changed."""
    if uo.Params.Input.Count != component.Params.Input.Count:
        return True
    elif uo.Params.Output.Count != component.Params.Output.Count:
        return True
    
    return comparePorts(uo, component)


def insertNewUO(uo, component, doc):
    # use component to find the location
    x = component.Attributes.Pivot.X + 30
    y = component.Attributes.Pivot.Y - 20
    
    # insert the new one
    uo.Attributes.Pivot = System.Drawing.PointF(x, y)
    doc.AddObject(uo , False, 0)


def updateComponent(component, uofolder):
    """update component from userobject."""
    fp = os.path.join(uofolder, '%s.ghuser' % component.Name)

    if not os.path.isfile(fp):
        warning = 'Failed to find the userobject for %s' % component.Name
        ghenv.Component.AddRuntimeMessage(Grasshopper.Kernel.GH_RuntimeMessageLevel.Warning, warning)
        return False
    uo = Grasshopper.Kernel.GH_UserObject(fp).InstantiateObject()

    # check the version and the date between component and userobject
    if not isNewerVersion(uo, component):
        return False 

    # it is a newer version
    component.Code = uo.Code
    
    # Define the callback function
    def callBack(document):
        component.ExpireSolution(False)

    # Update the solution
    doc.ScheduleSolution(2,
        Grasshopper.Kernel.GH_Document.GH_ScheduleDelegate(callBack))

    # check if inputs or outputs has changed
    if inputOutputChanged(uo, component):
        insertNewUO(uo, component, doc)
        
        # add a group note to the component
        markComponent(doc, component)
        return 'Cannot update %s. Replace manually.' % component.Name

    return 'Updated %s' % component.Name


if UPDATE:
    # find the component
    uofolder = Grasshopper.Folders.UserObjectFolders[0]
    
    doc = ghenv.Component.OnPingDocument()
    
    # load the initial userobject
    components = collectGHPythonComponents(doc)
    
    report = (updateComponent(comp, uofolder) for comp in components)
    
    LOG = '\n'.join(r for r in report if r)
# ---------- end updatefile ----------
smesh = SimpleMesh(Brep=comp_geo)
bbox = BoundingBox(Content=boundary, Plane=PlaneXY(0, 0, 0), UnionBox=True)  # -> Box, Box_2
points_2 = PointList(Points=conn_center, Size=Slider(2, range=0..10))
panel = Panel(wspexport.a)
panel_2 = Panel(updatefile)
comp_geo_2 = Brep(<brep referenced from the Rhino model>)
conn_up_2 = Curve([<curve referenced from the Rhino model> x6])
conn_center_2 = Point([<point referenced from the Rhino model> x6])
comp_geo_3 = Brep(<brep referenced from the Rhino model>)
conn_up_3 = Curve([<curve referenced from the Rhino model> x6])
conn_center_3 = Point([<point referenced from the Rhino model> x6])
number_slider = Slider(1, range=0..100)
fieldpts = Wasp_FieldPoints(BOU=bbox.Box, RES=cell_size, PLN=rot3d.Geometry)  # -> E_FIELD, PTS; inputs BOU: list of Mesh, PLN: Plane
# ---------- fieldpts: Python ----------
# Wasp: Discrete Design with Grasshopper plug-in (GPL) initiated by Andrea Rossi
# 
# This file is part of Wasp.
# 
# Copyright (c) 2017, Andrea Rossi <a.rossi.andrea@gmail.com>
# Wasp is free software; you can redistribute it and/or modify 
# it under the terms of the GNU General Public License as published 
# by the Free Software Foundation; either version 3 of the License, 
# or (at your option) any later version. 
# 
# Wasp is distributed in the hope that it will be useful,
# but WITHOUT ANY WARRANTY; without even the implied warranty of 
# MERCHANTABILITY or FITNESS FOR A PARTICULAR PURPOSE. See the 
# GNU General Public License for more details.
# 
# You should have received a copy of the GNU General Public License
# along with Wasp; If not, see <http://www.gnu.org/licenses/>.
# 
# @license GPL-3.0 <https://www.gnu.org/licenses/gpl.html>
#
# Significant parts of Wasp have been developed by Andrea Rossi
# as part of research on digital materials and discrete design at:
# DDU Digital Design Unit - Prof. Oliver Tessmann
# Technische Universität Darmstadt


#########################################################################
##                            COMPONENT INFO                           ##
#########################################################################

"""
Generate a 3d point grid to be fed to the field component
-
Provided by Wasp 0.4
    Args:
        BOU: List of geometries defining the boundaries of the field. Geometries must be closed breps or meshes.
        RES: Resolution (Dimension of each cell)
        PLN: OPTIONAL // Field base plane (WorldXY by default)
    Returns:
        E_FIELD: Empty field. Assign values with the "Wasp_Field" component
        PTS: Field points
"""

ghenv.Component.Name = "Wasp_Field Points"
ghenv.Component.NickName = 'FieldPts'
ghenv.Component.Message = 'VER 0.4.013'
ghenv.Component.IconDisplayMode = ghenv.Component.IconDisplayMode.application
ghenv.Component.Category = "Wasp"
ghenv.Component.SubCategory = "5 | Fields"
try: ghenv.Component.AdditionalHelpFromDocStrings = "1"
except: pass


import sys
import Rhino.Geometry as rg
import Grasshopper as gh
import math


## add Wasp install directory to system path
wasp_loaded = False
ghcompfolder = gh.Folders.DefaultAssemblyFolder
if ghcompfolder not in sys.path:
    sys.path.append(ghcompfolder)
try:
    from wasp import __version__
    wasp_loaded = True
except:
    msg = "Cannot import Wasp. Is the wasp folder available in " + ghcompfolder + "?"
    ghenv.Component.AddRuntimeMessage(gh.Kernel.GH_RuntimeMessageLevel.Error, msg)

## if Wasp is installed correctly, load the classes required by the component
if wasp_loaded:
    from wasp.field import Field


def main(boundaries, resolution, base_plane):
    
    check_data = True
    
    ##check inputs
    if len(boundaries) == 0:
        check_data = False
        msg = "No boundary geometry provided"
        ghenv.Component.AddRuntimeMessage(gh.Kernel.GH_RuntimeMessageLevel.Warning, msg)
    
    if base_plane is None:
        base_plane = rg.Plane.WorldXY
    
    if resolution is None and len(boundaries) != 0:
        global_bbox = None
        for geo in boundaries:
            if global_bbox is None:
                global_bbox = rg.Box(base_plane, geo)
            else:
                new_box = rg.Box(base_plane, geo)
                for corner in new_box.GetCorners():
                    global_bbox.Union(corner)
        
        x_size = global_bbox.X.Max - global_bbox.X.Min
        
        resolution = x_size / 10
        
        msg = "No resolution provided. Default resolution set to %d units"%(resolution)
        ghenv.Component.AddRuntimeMessage(gh.Kernel.GH_RuntimeMessageLevel.Warning, msg)
        
    if check_data:
        global_bbox = None
        for geo in boundaries:
            bbox = geo.GetBoundingBox(True)
            
            if global_bbox is None:
                global_bbox = bbox
            else:
                global_bbox.Union(bbox)
        
        x_size = global_bbox.Max.X - global_bbox.Min.X
        x_count = int(math.ceil(x_size / resolution)) + 1
        y_size = global_bbox.Max.Y - global_bbox.Min.Y
        y_count = int(math.ceil(y_size / resolution)) + 1
        z_size = global_bbox.Max.Z - global_bbox.Min.Z
        z_count = int(math.ceil(z_size / resolution)) + 1
        
        count = [x_count, y_count, z_count]
        
        pts = []
        s_pt = global_bbox.Min
        
        for z in range(z_count):
            for y in range(y_count):
                for x in range(x_count):
                    pt = rg.Point3d(s_pt.X + x*resolution, s_pt.Y + y*resolution, s_pt.Z + z*resolution)
                    pts.append(pt)
        
        #empty_field = Field(None, pts, count, resolution, boundaries = boundaries)
        empty_field = Field.from_boundaries(boundaries, resolution, _plane = base_plane)
        return empty_field.pts, empty_field
        
    else:
        return -1


result = main(BOU, RES, PLN)

if result != -1:
    PTS = result[0]
    E_FIELD = result[1]
# ---------- end fieldpts ----------

# ----
# WIP
pt = Point(fieldpts.PTS)  # disabled
number_slider_2 = Slider(12, range=0..100)  # disabled
bbox_2 = BoundingBox(Content=pt, Plane=PlaneXY(0, 0, 0), UnionBox=True)  # -> Box, Box_2; disabled
number_slider_3 = Slider(291, range=0..1000)  # disabled
pop3d = Populate3D(Region=bbox_2.Box, Count=number_slider_2, Seed=1)  # disabled
box = DomainBox(Base=pop3d, X=number_slider_3, Y=number_slider_3, Z=number_slider_3)  # disabled
brepsinc = PointInBreps(Brep=box, Point=graft(pt), Strict=False)  # -> flatten(Inside), Index; disabled
number_slider_4 = Slider(1, range=0..1)  # disabled
number_slider_5 = Slider(1, range=0..1)  # disabled
number_slider_6 = Slider(1, range=0..1)  # disabled
number_slider_7 = Slider(1, range=0..1)  # disabled
number_slider_8 = Slider(0, range=0..1)  # disabled
number_slider_9 = Slider(0, range=0..1)  # disabled
dispatch = Dispatch(List=pt, DispatchPattern=brepsinc.Inside)  # -> ListA, ListB; disabled
vec = VectorXYZ(XComponent=number_slider_7, YComponent=number_slider_8, ZComponent=number_slider_9)  # -> Vector, Length; disabled
vec_2 = VectorXYZ(XComponent=number_slider_4, YComponent=number_slider_5, ZComponent=number_slider_6)  # -> Vector, Length; disabled
lng = ListLength(List=dispatch.ListA)  # disabled
lng_2 = ListLength(List=dispatch.ListB)  # disabled
repeat = RepeatData(Data=vec_2.Vector, Length=lng)  # disabled
repeat_2 = RepeatData(Data=vec.Vector, Length=lng_2)  # disabled
weave = Weave(Pattern=brepsinc.Inside, Stream0=repeat_2, Stream1=repeat, NullGaps=False)  # disabled
vdis = VectorDisplay(Anchor=pt, Vector=weave)  # disabled
tfield = Wsp_TensorField(BOU=boundary, PTS=fieldpts.PTS, RES=cell_size, VAL=weave)  # -> FIELD; inputs BOU: list of GeometryBase, PTS: list of Point3d, COUNT: Vector3d, VAL: list of Vector3d; disabled
# ---------- tfield: Python ----------
# Wasp: Discrete Design with Grasshopper plug-in (GPL) initiated by Andrea Rossi
# 
# This file is part of Wasp.
# 
# Copyright (c) 2017, Andrea Rossi <a.rossi.andrea@gmail.com>
# Wasp is free software; you can redistribute it and/or modify 
# it under the terms of the GNU General Public License as published 
# by the Free Software Foundation; either version 3 of the License, 
# or (at your option) any later version. 
# 
# Wasp is distributed in the hope that it will be useful,
# but WITHOUT ANY WARRANTY; without even the implied warranty of 
# MERCHANTABILITY or FITNESS FOR A PARTICULAR PURPOSE. See the 
# GNU General Public License for more details.
# 
# You should have received a copy of the GNU General Public License
# along with Wasp; If not, see <http://www.gnu.org/licenses/>.
# 
# @license GPL-3.0 <https://www.gnu.org/licenses/gpl.html>
#
# Significant parts of Wasp have been developed by Andrea Rossi
# as part of research on digital materials and discrete design at:
# DDU Digital Design Unit - Prof. Oliver Tessmann
# Technische Universität Darmstadt


#########################################################################
##                            COMPONENT INFO                           ##
#########################################################################

"""
Generates a tensor field given a grid of points and their relative tensors
-
Provided by Wasp 0.1.0
    Args:
        BOU: List of geometries defining the boundaries of the field. Geometries must be closed breps or meshes. All points of the field outside the geometries will be assigned a 0 value
        PTS: 3d point grid (from FieldPts component)
        COUNT: Vector storing cell counts for each axis (from FieldPts component)
        RES: Resolution of cell grid
        VAL: Tensor vectors to assign to each cell
    Returns:
        FIELD: Field object (to be used to drive the TensorFieldAggregation component)
"""

ghenv.Component.Name = "Wsp_Tensor Field"
ghenv.Component.NickName = 'TField'
ghenv.Component.Message = 'VER 0.1.0\nDEC_22_2017'
ghenv.Component.IconDisplayMode = ghenv.Component.IconDisplayMode.application
ghenv.Component.Category = "Wasp"
ghenv.Component.SubCategory = "X | Experimental"
try: ghenv.Component.AdditionalHelpFromDocStrings = "3"
except: pass

import scriptcontext as sc
import Rhino.Geometry as rg
import Grasshopper.Kernel as gh


def main(boundaries, pts, count, resolution, values):
    
    ## check if Wasp is setup
    if sc.sticky.has_key('WaspSetup'):
        
        check_data = True
        
        ##check inputs
        if len(boundaries) == 0:
            boundaries.append(rg.BoundingBox(pts).ToBrep())
            msg = "No boundary provided. Boundary set to point grid bounding box"
            ghenv.Component.AddRuntimeMessage(gh.GH_RuntimeMessageLevel.Remark, msg)
        
        if len(pts) == 0:
            check_data = False
            msg = "No point grid provided"
            ghenv.Component.AddRuntimeMessage(gh.GH_RuntimeMessageLevel.Warning, msg)
            
        elif len(values) == 0:
            check_data = False
            msg = "No field tensors provided"
            ghenv.Component.AddRuntimeMessage(gh.GH_RuntimeMessageLevel.Warning, msg)
            
        elif len(pts) != len(values):
            check_data = False
            msg = "Points and Values lists are not matching. Please provide two lists with same number of elements"
            ghenv.Component.AddRuntimeMessage(gh.GH_RuntimeMessageLevel.Error, msg)
        
        if count is None:
            check_data = False
            msg = "No axis count provided"
            ghenv.Component.AddRuntimeMessage(gh.GH_RuntimeMessageLevel.Warning, msg)
        
        try:
            test_v = values[0][2]
        except:
            check_data = False
            msg = "Values are not valid vectors"
            ghenv.Component.AddRuntimeMessage(gh.GH_RuntimeMessageLevel.Warning, msg)
        
        if resolution is None and check_data == True:
            resolution = pts[0].DistanceTo(pts[1])
            msg = "No resolution provided. Calculated resolution is %0.2f"%(resolution)
            ghenv.Component.AddRuntimeMessage(gh.GH_RuntimeMessageLevel.Remark, msg)
        
        if check_data:
            field = sc.sticky['Field'](boundaries, pts, count, resolution, values)
            return field
        else:
            return -1
    
    else:
        ## throw warining
        msg = "You must run the SetupWasp component before starting to build!"
        ghenv.Component.AddRuntimeMessage(gh.GH_RuntimeMessageLevel.Warning, msg)
        return -1


result = main(BOU, PTS, COUNT, RES, VAL)

if result != -1:
    FIELD = result
# ---------- end tfield ----------
number_slider_10 = Slider(500, range=0..10000)  # disabled
wasp_aggregation_mode = ValueList({"BASIC": 0, "CONSTRAINED": 1}, selected="BASIC")  # disabled
number_slider_11 = Slider(0.95, range=0..1)  # disabled
panel_3 = Panel("myFieldAggregation")  # disabled
fieldn = Slider(25, range=0..1000)  # disabled
button = Button()  # disabled

conndir = Wasp_ConnectionFromDirection(GEO=smesh, CEN=conn_center, UP=conn_up)  # -> CONN, PLN_OUT; inputs CEN: list of Point3d, UP: list of Curve, T: list
# ---------- conndir: Python ----------
# Wasp: Discrete Design with Grasshopper plug-in (GPL) initiated by Andrea Rossi
# 
# This file is part of Wasp.
# 
# Copyright (c) 2017, Andrea Rossi <a.rossi.andrea@gmail.com>
# Wasp is free software; you can redistribute it and/or modify 
# it under the terms of the GNU General Public License as published 
# by the Free Software Foundation; either version 3 of the License, 
# or (at your option) any later version. 
# 
# Wasp is distributed in the hope that it will be useful,
# but WITHOUT ANY WARRANTY; without even the implied warranty of 
# MERCHANTABILITY or FITNESS FOR A PARTICULAR PURPOSE. See the 
# GNU General Public License for more details.
# 
# You should have received a copy of the GNU General Public License
# along with Wasp; If not, see <http://www.gnu.org/licenses/>.
# 
# @license GPL-3.0 <https://www.gnu.org/licenses/gpl.html>
#
# Significant parts of Wasp have been developed by Andrea Rossi
# as part of research on digital materials and discrete design at:
# DDU Digital Design Unit - Prof. Oliver Tessmann
# Technische Universität Darmstadt


#########################################################################
##                            COMPONENT INFO                           ##
#########################################################################

"""
Create a connection on a given part geometry from center and X-asix direction
(Z direction is determined based on the normals of the component geometry)
-
Provided by Wasp 0.4
    Args:
        GEO: Geometry of the part to which the connection belongs
        CEN: Origin of the connection plane
        UP: Line idetifying the X-axis of the connection plane - determines the plane orientation to mantain when transforming
        T: OPTIONAL // Connection type (to be used with Rule Generator component)
    Returns:
        CONN: Connection object
        PLN_OUT: Plane for each connection object (for debugging)
"""

ghenv.Component.Name = "Wasp_Connection From Direction"
ghenv.Component.NickName = 'ConnDir'
ghenv.Component.Message = 'VER 0.4.013'
ghenv.Component.IconDisplayMode = ghenv.Component.IconDisplayMode.application
ghenv.Component.Category = "Wasp"
ghenv.Component.SubCategory = "1 | Elements"
try: ghenv.Component.AdditionalHelpFromDocStrings = "1"
except: pass


import sys
import Rhino.Geometry as rg
import Grasshopper as gh

## add Wasp install directory to system path
wasp_loaded = False
ghcompfolder = gh.Folders.DefaultAssemblyFolder
if ghcompfolder not in sys.path:
    sys.path.append(ghcompfolder)
try:
    from wasp import __version__
    wasp_loaded = True
except:
    msg = "Cannot import Wasp. Is the wasp folder available in " + ghcompfolder + "?"
    ghenv.Component.AddRuntimeMessage(gh.Kernel.GH_RuntimeMessageLevel.Error, msg)

## if Wasp is installed correctly, load the classes required by the component
if wasp_loaded:
    from wasp.core import Connection
    from wasp import global_tolerance


def main(part_geo, conn_centers, conn_ups, conn_type):
        
    check_data = True
    
    ## check inputs
    if part_geo is None:
        check_data = False
        msg = "No part geometry provided"
        ghenv.Component.AddRuntimeMessage(gh.Kernel.GH_RuntimeMessageLevel.Warning, msg)
    
    if len(conn_centers) != len(conn_ups):
        check_data = False
        msg = "Different amount of centers and up vectors provided"
        ghenv.Component.AddRuntimeMessage(gh.Kernel.GH_RuntimeMessageLevel.Error, msg)
    
    types = []
    if len(conn_type) == 0:
        for i in range(len(conn_centers)):
            types.append("0")
    elif len(conn_type) == 1:
        for i in range(len(conn_centers)):
            types.append(conn_type[0])
    elif len(conn_centers) != len(conn_type):
        check_data = False
        msg = "Different amount of centers and types provided"
        ghenv.Component.AddRuntimeMessage(gh.Kernel.GH_RuntimeMessageLevel.Error, msg)
    else:
        for i in range(len(conn_centers)):
            types.append(conn_type[i])
    
    ## execute main code if all needed inputs are available
    if check_data:
        connections = []
        out_planes = []
        for i in range(len(conn_centers)):
            
            center = conn_centers[i]
            up = conn_ups[i]
            plane = None
            
            up_start = rg.Vector3d(up.PointAtStart)
            up_end = rg.Vector3d(up.PointAtEnd)
            up_vec = rg.Vector3d.Subtract(up_end, up_start)
            
            if type(part_geo) == rg.Brep:
                for face in part_geo.Faces:
                    pt_uv = face.ClosestPoint(center)
                    pt = face.PointAt(pt_uv[1], pt_uv[2])
                    dist = rg.Point3d.DistanceTo(center, pt)
                    if(dist < global_tolerance):
                        normal = face.NormalAt(pt_uv[1], pt_uv[2])
                        plane = rg.Plane(center, normal)
                        x_axis = plane.XAxis
                        angle = rg.Vector3d.VectorAngle(x_axis, up_vec, plane)
                        plane.Rotate(angle, normal)
                        break
            
            elif type(part_geo) == rg.Mesh:
                part_geo.Normals.ComputeNormals()
                mesh_pt = part_geo.ClosestMeshPoint(center, global_tolerance)
                if mesh_pt is not None:
                    normal = part_geo.NormalAt(mesh_pt)
                    plane = rg.Plane(center, normal)
                    x_axis = plane.XAxis
                    angle = rg.Vector3d.VectorAngle(x_axis, up_vec, plane)
                    plane.Rotate(angle, normal)
            
            if plane is None:
                msg = "No valid plane provided for connection %d"%(i)
                ghenv.Component.AddRuntimeMessage(gh.Kernel.GH_RuntimeMessageLevel.Error, msg)
            else:
                conn = Connection(plane, types[i], "", -1)
                connections.append(conn)
                out_planes.append(plane)
        
        return connections, out_planes
    
    else:
        return -1

result = main(GEO, CEN, UP, T)

if result != -1:
    CONN = result[0]
    PLN_OUT = result[1]
# ---------- end conndir ----------
support_points = Curve([<curve referenced from the Rhino model> x6])
volume = Volume(Geometry=comp_geo_2)  # -> Volume, Centroid
bbox_3 = BoundingBox(Content=comp_geo, Plane=PlaneXY(0, 0, 0))  # -> Box, Box_2
points_3 = PointList(Points=conn_center_2, Size=Slider(1, range=0..10))
points_4 = PointList(Points=conn_center_3, Size=Slider(1, range=0..10))
number_slider_12 = Slider(1, range=0..1)
mbox = MeshBox(Base=bbox_3.Box, XCount=number_slider, YCount=number_slider, ZCount=number_slider)
panel_4 = Panel("""0
0
0
0
0
1
0
0
1
0
0
0""")
mesh = MeshBrep(Brep=comp_geo_2, Settings=custom_mesh_settings)
vec2pt = Vector2Pt(PointA=volume.Centroid, PointB=conn_center_2, Unitize=False)  # -> Vector, Length

pop3d_2 = Populate3D(Region=bbox.Box, Count=Slider(7, range=0..100), Seed=1)
pull = PullPoint(Point=fieldpts.PTS, Geometry=pop3d_2, ClosestOnly=True)  # -> ClosestPoint, Distance
bnd = Bounds(Numbers=pull.Distance)
remap = RemapNumbers(Value=pull.Distance, Source=bnd, Target="1 To 0")  # -> Mapped, Clipped
graph = GraphMapper(remap.Mapped, x0=0, x1=1, y0=0, y1=1, container_name="Gaussian", factor=0.06945979595, mean=0.5, sdev=0.02776241302)
gradient = Gradient(LowerLimit=0, UpperLimit=1, Parameter=graph, stops=[0: RGB(0, 128, 0), 0.5: RGB(255, 255, 0), 1: RGB(255, 0, 0)])

item = ListItem(List=support_points, Index=0, Wrap=invert(True))  # -> Item, Item1, Item2, Item3, Item4, Item5
mesh_2 = MeshBrep(Brep=comp_geo_3, Settings=custom_mesh_settings_2)

bbox_4 = BoundingBox(Content=fieldpts.PTS, Plane=PlaneXY(0, 0, 0), UnionBox=True)  # -> Box, Box_2
pop3d_3 = Populate3D(Region=bbox_4.Box, Count=Slider(7, range=0..100), Seed=Slider(125, range=0..1000))
pull_2 = PullPoint(Point=fieldpts.PTS, Geometry=pop3d_3, ClosestOnly=True)  # -> ClosestPoint, Distance
bnd_2 = Bounds(Numbers=pull_2.Distance)
remap_2 = RemapNumbers(Value=pull_2.Distance, Source=bnd_2, Target="1 To 0")  # -> Mapped, Clipped
graph_2 = GraphMapper(remap_2.Mapped, x0=0, x1=1, y0=0, y1=1, container_name="Gaussian", factor=0.1919475794, mean=0.5, sdev=0.0768045783)
gradient_2 = Gradient(LowerLimit=0, UpperLimit=1, Parameter=graph_2, stops=[0: RGB(0, 128, 0), 0.5: RGB(255, 255, 0), 1: RGB(255, 0, 0)])

bbox_5 = BoundingBox(Content=boundary, Plane=PlaneXY(0, 0, 0), UnionBox=True)  # -> Box, Box_2
debrep = DeconstructBrep(Brep=bbox_5.Box)  # -> Faces, Edges, Vertices
Z = UnitZ(Factor=Slider(200, range=0..1000))
item_2 = ListItem(List=debrep.Faces, Index=Slider(4, range=0..10), Wrap=True)
move = Move(Geometry=item_2, Motion=Z)  # -> Geometry, Transform
pop2d = Populate2D(Region=move.Geometry, Count=Slider(150, range=0..500), Seed=1)
brepsinc_2 = PointInBreps(Brep=boundary, Point=pop2d, Strict=False)  # -> Inside, Index
cull = CullPattern(List=pop2d, CullPattern=brepsinc_2.Inside)
bbox_6 = BoundingBox(Content=comp_geo, Plane=PlaneXY(0, 0, 0))  # -> Box, Box_2
eval = Evaluate(F="round(x/mul)*mul", x=cull, mul=Slider(10, range=0..10))
volume_2 = Volume(Geometry=bbox_6.Box)  # -> Volume, Centroid
vec2pt_2 = Vector2Pt(PointA=volume_2.Centroid, PointB=eval, Unitize=False)  # -> Vector, Length
move_2 = Move(Motion=vec2pt_2.Vector)  # -> Geometry, Transform

xy_2 = XYPlane(Origin=Point(0, 0, 0))
panel_5 = Panel("""TOP
TOP""")
dom = ConstructDomain(DomainStart=Slider(45, range=-180..180), DomainEnd=Slider(135, range=-180..180))
multiplication = Multiplication(A=vec2pt.Vector, B=2)
split = SplitList(List=conndir.PLN_OUT, Index=Slider(6, range=0..10))  # -> ListA, ListB
crv = Curve(<curve referenced from the Rhino model>)
item_3 = ListItem(List=conndir.CONN, Index=0, Wrap=True)
geo = Geometry([<brep referenced from the Rhino model> x2])
tool_collider = Brep(<brep referenced from the Rhino model>)
brep = Brep([<brep referenced from the Rhino model> x2])
conndir_2 = Wasp_ConnectionFromDirection(GEO=mesh, CEN=conn_center_2, UP=conn_up_2)  # -> CONN, PLN_OUT; inputs CEN: list of Point3d, UP: list of Curve, T: list; same code as conndir
conndir_3 = Wasp_ConnectionFromDirection(GEO=mesh_2, CEN=conn_center_3, UP=conn_up_3)  # -> CONN, PLN_OUT; inputs CEN: list of Point3d, UP: list of Curve, T: list; same code as conndir
item_4 = ListItem(List=conn_center_3, Index=Slider(1, range=0..1), Wrap=True)  # -> Item, Item1, Item2
collider = Wasp_Collider(GEO=tool_collider, MUL=Toggle(False), ALL=Toggle(False), CONN=item_3)  # -> COLL; inputs GEO: list of Mesh, MUL: Boolean, ALL: Boolean, CONN: list
# ---------- collider: Python ----------
# Wasp: Discrete Design with Grasshopper plug-in (GPL) initiated by Andrea Rossi
# 
# This file is part of Wasp.
# 
# Copyright (c) 2017, Andrea Rossi <a.rossi.andrea@gmail.com>
# Wasp is free software; you can redistribute it and/or modify 
# it under the terms of the GNU General Public License as published 
# by the Free Software Foundation; either version 3 of the License, 
# or (at your option) any later version. 
# 
# Wasp is distributed in the hope that it will be useful,
# but WITHOUT ANY WARRANTY; without even the implied warranty of 
# MERCHANTABILITY or FITNESS FOR A PARTICULAR PURPOSE. See the 
# GNU General Public License for more details.
# 
# You should have received a copy of the GNU General Public License
# along with Wasp; If not, see <http://www.gnu.org/licenses/>.
# 
# @license GPL-3.0 <https://www.gnu.org/licenses/gpl.html>
#
# Significant parts of Wasp have been developed by Andrea Rossi
# as part of research on digital materials and discrete design at:
# DDU Digital Design Unit - Prof. Oliver Tessmann
# Technische Universität Darmstadt


#########################################################################
##                            COMPONENT INFO                           ##
#########################################################################

"""
Generate a collider for a given geometry.
-
Provided by Wasp 0.4
    Args:
        GEO: Geometry of the collider(s)
        MUL: OPTIONAL // Set to True if you are using multiple colliders and it is sufficient for one of them not to collide (False by default)
        ALL: OPTIONAL // If MUL is set to True, set to True to check all colliders (False by default, search will stop after finding a valid collider)
        CONN: OPTIONAL // If MUL is set to True, associate a connection to each collider (e.g. a picking position for the tool collider).
    Returns:
        COLL: Collider instance
"""

ghenv.Component.Name = "Wasp_Collider"
ghenv.Component.NickName = 'Collider'
ghenv.Component.Message = 'VER 0.4.013'
ghenv.Component.IconDisplayMode = ghenv.Component.IconDisplayMode.application
ghenv.Component.Category = "Wasp"
ghenv.Component.SubCategory = "1 | Elements"
try: ghenv.Component.AdditionalHelpFromDocStrings = "4"
except: pass

import sys
import Rhino.Geometry as rg
import Grasshopper as gh


## add Wasp install directory to system path
wasp_loaded = False
ghcompfolder = gh.Folders.DefaultAssemblyFolder
if ghcompfolder not in sys.path:
    sys.path.append(ghcompfolder)
try:
    from wasp import __version__
    wasp_loaded = True
except:
    msg = "Cannot import Wasp. Is the wasp folder available in " + ghcompfolder + "?"
    ghenv.Component.AddRuntimeMessage(gh.Kernel.GH_RuntimeMessageLevel.Error, msg)

## if Wasp is installed correctly, load the classes required by the component
if wasp_loaded:
    from wasp.core import Collider


def main(geometry, multiple, check_all, connections):
    
    check_data = True
    
    ##check inputs
    if len(geometry) == 0:
        check_data = False
        msg = "No geometry provided"
        ghenv.Component.AddRuntimeMessage(gh.Kernel.GH_RuntimeMessageLevel.Warning, msg)
    
    if multiple is None:
        multiple = False
    
    if check_all is None:
        check_all = False
    
    if len(connections) > 0 and len(connections) != len(geometry):
        check_data = False
        msg = "Please provide the same amount of collider geometries and connections."
        ghenv.Component.AddRuntimeMessage(gh.Kernel.GH_RuntimeMessageLevel.Warning, msg)
    
    if len(geometry) > 0:
        faces_count = 0
        for geo in geometry:
            faces_count += geo.Faces.Count
        if faces_count > 1000:
            msg = "The given collider has a high faces count. Consider providing a low poly collider to improve performance"
            ghenv.Component.AddRuntimeMessage(gh.Kernel.GH_RuntimeMessageLevel.Warning, msg)
    
    if check_data:
        collider = Collider(geometry, multiple, check_all, connections)
        return collider
    else:
        return -1


result = main(GEO, MUL, ALL, CONN)

if result != -1:
    COLL = result
# ---------- end collider ----------
adjexcconst = Wasp_AdjacencyExclusionConstraint(DIR=[item.Item, item.Item2], PN=panel_5, AE=Toggle(True))  # -> AEC; inputs DIR: list of Curve, PN: list, AE: Boolean
# ---------- adjexcconst: Python ----------
# Wasp: Discrete Design with Grasshopper plug-in (GPL) initiated by Andrea Rossi
# 
# This file is part of Wasp.
# 
# Copyright (c) 2017, Andrea Rossi <a.rossi.andrea@gmail.com>
# Wasp is free software; you can redistribute it and/or modify 
# it under the terms of the GNU General Public License as published 
# by the Free Software Foundation; either version 3 of the License, 
# or (at your option) any later version. 
# 
# Wasp is distributed in the hope that it will be useful,
# but WITHOUT ANY WARRANTY; without even the implied warranty of 
# MERCHANTABILITY or FITNESS FOR A PARTICULAR PURPOSE. See the 
# GNU General Public License for more details.
# 
# You should have received a copy of the GNU General Public License
# along with Wasp; If not, see <http://www.gnu.org/licenses/>.
# 
# @license GPL-3.0 <https://www.gnu.org/licenses/gpl.html>
#
# Significant parts of Wasp have been developed by Andrea Rossi
# as part of research on digital materials and discrete design at:
# DDU Digital Design Unit - Prof. Oliver Tessmann
# Technische Universität Darmstadt


#########################################################################
##                            COMPONENT INFO                           ##
#########################################################################

"""
Part Adjacencies and Exclusions Constraint.
It allows to control if certain connection should be allowed to be in contact with other parts or not.
-
Provided by Wasp 0.4
    Args:
        DIR: Directions of the support locations as lines
        PN: OPTIONAL // If the adjacency/exclusion direction has to be associated to a specific part
        AE: OPTIONAL // Constraint type: True for adjacency, False for exclusion (True by default)
    Returns:
        AEC: Adjacency/Exclusion Constraint instance
"""

ghenv.Component.Name = "Wasp_Adjacency Exclusion Constraint"
ghenv.Component.NickName = 'AdjExcConst'
ghenv.Component.Message = 'VER 0.4.013'
ghenv.Component.IconDisplayMode = ghenv.Component.IconDisplayMode.application
ghenv.Component.Category = "Wasp"
ghenv.Component.SubCategory = "4 | Constraints"
try: ghenv.Component.AdditionalHelpFromDocStrings = "1"
except: pass


import sys
import Rhino.Geometry as rg
import Grasshopper as gh


## add Wasp install directory to system path
wasp_loaded = False
ghcompfolder = gh.Folders.DefaultAssemblyFolder
if ghcompfolder not in sys.path:
    sys.path.append(ghcompfolder)
try:
    from wasp import __version__
    wasp_loaded = True
except:
    msg = "Cannot import Wasp. Is the wasp folder available in " + ghcompfolder + "?"
    ghenv.Component.AddRuntimeMessage(gh.Kernel.GH_RuntimeMessageLevel.Error, msg)

## if Wasp is installed correctly, load the classes required by the component
if wasp_loaded:
    from wasp.core import Adjacency_Constraint


def main(directions, part_names, adjacency_type):
    
    check_data = True
    
    ##check inputs
    direction_lines = []
    if len(directions) == 0:
        check_data = False
        msg = "Please provide a valid list of lines as directions"
        ghenv.Component.AddRuntimeMessage(gh.Kernel.GH_RuntimeMessageLevel.Warning, msg)
    else:
        for d in directions:
            start = d.PointAtStart
            end = d.PointAtEnd
            d_ln = rg.Line(start, end)
            direction_lines.append(d_ln)
    
    if len(part_names) == 0:
        pass
    elif len(directions) != len(part_names):
        check_data = False
        msg = "Please provide an equal number of directions and part names"
        ghenv.Component.AddRuntimeMessage(gh.Kernel.GH_RuntimeMessageLevel.Error, msg)
    
    if adjacency_type is None:
        adjacency_type = True
    
    if check_data:
        adj_constraint = Adjacency_Constraint(direction_lines, adjacency_type, part_names)
        return adj_constraint
    else:
        return -1


result = main(DIR, PN, AE)

if result != -1:
    AEC = result
# ---------- end adjexcconst ----------
adjexcconst_2 = Wasp_OrientationConstraint(DIR=crv, R=dom, PLN=xy_2)  # -> OC; inputs DIR: Vector3d, PLN: Plane
# ---------- adjexcconst_2: Python ----------
# Wasp: Discrete Design with Grasshopper plug-in (GPL) initiated by Andrea Rossi
# 
# This file is part of Wasp.
# 
# Copyright (c) 2017, Andrea Rossi <a.rossi.andrea@gmail.com>
# Wasp is free software; you can redistribute it and/or modify 
# it under the terms of the GNU General Public License as published 
# by the Free Software Foundation; either version 3 of the License, 
# or (at your option) any later version. 
# 
# Wasp is distributed in the hope that it will be useful,
# but WITHOUT ANY WARRANTY; without even the implied warranty of 
# MERCHANTABILITY or FITNESS FOR A PARTICULAR PURPOSE. See the 
# GNU General Public License for more details.
# 
# You should have received a copy of the GNU General Public License
# along with Wasp; If not, see <http://www.gnu.org/licenses/>.
# 
# @license GPL-3.0 <https://www.gnu.org/licenses/gpl.html>
#
# Significant parts of Wasp have been developed by Andrea Rossi
# as part of research on digital materials and discrete design at:
# DDU Digital Design Unit - Prof. Oliver Tessmann
# Technische Universität Darmstadt


#########################################################################
##                            COMPONENT INFO                           ##
#########################################################################

"""
Orientation Constraint.
It allows to control if the part should be placed according to a custom orientation.
-
Provided by Wasp 0.4
    Args:
        DIR: Directions of the part orientation to be tested (as Line or Vector)
        R: Angle range which is allowed for the transformed part
        PLN: OPTIONAL // Plane where to calculate the angle (Default is RhinoXY)
    Returns:
        OC: Orientation Constraint instance
"""

ghenv.Component.Name = "Wasp_Orientation Constraint"
ghenv.Component.NickName = 'AdjExcConst'
ghenv.Component.Message = 'VER 0.4.013'
ghenv.Component.IconDisplayMode = ghenv.Component.IconDisplayMode.application
ghenv.Component.Category = "Wasp"
ghenv.Component.SubCategory = "4 | Constraints"
try: ghenv.Component.AdditionalHelpFromDocStrings = "1"
except: pass


import sys
import Rhino.Geometry as rg
import Grasshopper as gh


## add Wasp install directory to system path
wasp_loaded = False
ghcompfolder = gh.Folders.DefaultAssemblyFolder
if ghcompfolder not in sys.path:
    sys.path.append(ghcompfolder)
try:
    from wasp import __version__
    wasp_loaded = True
except:
    msg = "Cannot import Wasp. Is the wasp folder available in " + ghcompfolder + "?"
    ghenv.Component.AddRuntimeMessage(gh.Kernel.GH_RuntimeMessageLevel.Error, msg)

## if Wasp is installed correctly, load the classes required by the component
if wasp_loaded:
    from wasp.core import Orientation_Constraint


def main(direction, range, base_plane):
    
    check_data = True
    
    ##check inputs
    if direction is None:
        check_data = False
        msg = "Please provide a valid direction line"
        ghenv.Component.AddRuntimeMessage(gh.Kernel.GH_RuntimeMessageLevel.Warning, msg)
    
    if range is None:
        check_data = False
        msg = "Please provide a valid angle interval"
        ghenv.Component.AddRuntimeMessage(gh.Kernel.GH_RuntimeMessageLevel.Warning, msg)
    
    if base_plane is None:
        base_plane = rg.Plane.WorldXY
    
    if check_data:
        orient_constraint = Orientation_Constraint(direction, base_plane, range)
        return orient_constraint
    else:
        return -1


result = main(DIR, R, PLN)

if result != -1:
    OC = result
# ---------- end adjexcconst_2 ----------
deconn = Wasp_DeconstructConnection(CONN=conndir.CONN)  # -> PLN, ID, PART, T
# ---------- deconn: Python ----------
# Wasp: Discrete Design with Grasshopper plug-in (GPL) initiated by Andrea Rossi
# 
# This file is part of Wasp.
# 
# Copyright (c) 2017, Andrea Rossi <a.rossi.andrea@gmail.com>
# Wasp is free software; you can redistribute it and/or modify 
# it under the terms of the GNU General Public License as published 
# by the Free Software Foundation; either version 3 of the License, 
# or (at your option) any later version. 
# 
# Wasp is distributed in the hope that it will be useful,
# but WITHOUT ANY WARRANTY; without even the implied warranty of 
# MERCHANTABILITY or FITNESS FOR A PARTICULAR PURPOSE. See the 
# GNU General Public License for more details.
# 
# You should have received a copy of the GNU General Public License
# along with Wasp; If not, see <http://www.gnu.org/licenses/>.
# 
# @license GPL-3.0 <https://www.gnu.org/licenses/gpl.html>
#
# Significant parts of Wasp have been developed by Andrea Rossi
# as part of research on digital materials and discrete design at:
# DDU Digital Design Unit - Prof. Oliver Tessmann
# Technische Universität Darmstadt


#########################################################################
##                            COMPONENT INFO                           ##
#########################################################################

"""
Extract information from a Connection.
-
Provided by Wasp 0.4
    Args:
        CONN: Connection to deconstruct
    Returns:
        PLN: Connection plane
        ID: Connection ID
        PART: Part to which the connection belongs to
        T: Connection type
"""

ghenv.Component.Name = "Wasp_Deconstruct Connection"
ghenv.Component.NickName = 'DeConn'
ghenv.Component.Message = 'VER 0.4.013'
ghenv.Component.IconDisplayMode = ghenv.Component.IconDisplayMode.application
ghenv.Component.Category = "Wasp"
ghenv.Component.SubCategory = "1 | Elements"
try: ghenv.Component.AdditionalHelpFromDocStrings = "1"
except: pass

import sys
import Rhino.Geometry as rg
import Grasshopper as gh


## add Wasp install directory to system path
wasp_loaded = False
ghcompfolder = gh.Folders.DefaultAssemblyFolder
if ghcompfolder not in sys.path:
    sys.path.append(ghcompfolder)
try:
    from wasp import __version__
    wasp_loaded = True
except:
    msg = "Cannot import Wasp. Is the wasp folder available in " + ghcompfolder + "?"
    ghenv.Component.AddRuntimeMessage(gh.Kernel.GH_RuntimeMessageLevel.Error, msg)

## if Wasp is installed correctly, load the classes required by the component
if wasp_loaded:
    from wasp.core import Connection


def main(connection):
    
    check_data = True
    
    ##check inputs
    if connection is None:
        check_data = False
        msg = "No connection provided"
        ghenv.Component.AddRuntimeMessage(gh.Kernel.GH_RuntimeMessageLevel.Warning, msg)
    
    if check_data:
        return connection.pln, connection.id, connection.part, connection.type
    else:
        return -1


result = main(CONN)

if result != -1:
    PLN = result[0]
    ID = result[1]
    PART = result[2]
    T = result[3]
# ---------- end deconn ----------

attribute = Wasp_Attribute(ID="connectors", VAL=brep, TR=Toggle(True))  # -> ATTR; inputs VAL: list, TR: Boolean
# ---------- attribute: Python ----------
# Wasp: Discrete Design with Grasshopper plug-in (GPL) initiated by Andrea Rossi
# 
# This file is part of Wasp.
# 
# Copyright (c) 2017, Andrea Rossi <a.rossi.andrea@gmail.com>
# Wasp is free software; you can redistribute it and/or modify 
# it under the terms of the GNU General Public License as published 
# by the Free Software Foundation; either version 3 of the License, 
# or (at your option) any later version. 
# 
# Wasp is distributed in the hope that it will be useful,
# but WITHOUT ANY WARRANTY; without even the implied warranty of 
# MERCHANTABILITY or FITNESS FOR A PARTICULAR PURPOSE. See the 
# GNU General Public License for more details.
# 
# You should have received a copy of the GNU General Public License
# along with Wasp; If not, see <http://www.gnu.org/licenses/>.
# 
# @license GPL-3.0 <https://www.gnu.org/licenses/gpl.html>
#
# Significant parts of Wasp have been developed by Andrea Rossi
# as part of research on digital materials and discrete design at:
# DDU Digital Design Unit - Prof. Oliver Tessmann
# Technische Universität Darmstadt


#########################################################################
##                            COMPONENT INFO                           ##
#########################################################################

"""
Attribute to be attached to a part.
Could be geometry or any other kind of data (eg. text, numeric variables, color…).
If Geometry, Transformable must be set to True to mantain the geometry attached to the part during aggregation.
-
Provided by Wasp 0.4
    Args:
        ID: Name of the attribute
        VAL: Value of the attribute (any type of Gh-compatible data possible)
        TR: OPTIONAL // Transformable. Set it to True for Geometry, False for other types of data (False by default)
    Returns:
        ATTR: Attribute instance to attach to a component
"""

ghenv.Component.Name = "Wasp_Attribute"
ghenv.Component.NickName = 'Attribute'
ghenv.Component.Message = 'VER 0.4.013'
ghenv.Component.IconDisplayMode = ghenv.Component.IconDisplayMode.application
ghenv.Component.Category = "Wasp"
ghenv.Component.SubCategory = "1 | Elements"
try: ghenv.Component.AdditionalHelpFromDocStrings = "2"
except: pass

import sys
import Rhino.Geometry as rg
import Grasshopper as gh


## add Wasp install directory to system path
wasp_loaded = False
ghcompfolder = gh.Folders.DefaultAssemblyFolder
if ghcompfolder not in sys.path:
    sys.path.append(ghcompfolder)
try:
    from wasp import __version__
    wasp_loaded = True
except:
    msg = "Cannot import Wasp. Is the wasp folder available in " + ghcompfolder + "?"
    ghenv.Component.AddRuntimeMessage(gh.Kernel.GH_RuntimeMessageLevel.Error, msg)

## if Wasp is installed correctly, load the classes required by the component
if wasp_loaded:
    from wasp.core import Attribute


def main(id, values, transformable):
    
    check_data = True
    
    ##check inputs
    if id is None:
        check_data = False
        msg = "Please provide a name for the attribute"
        ghenv.Component.AddRuntimeMessage(gh.Kernel.GH_RuntimeMessageLevel.Warning, msg)
    
    if len(values) == 0:
        check_data = False
        msg = "Please provide values for the attribute"
        ghenv.Component.AddRuntimeMessage(gh.Kernel.GH_RuntimeMessageLevel.Warning, msg)
    
    if transformable is None:
        transformable = False
    
    if transformable == True:
        val_count = 0
        for i in range(len(values)):
            try:
                values[i].Transform(rg.Transform.Identity)
            except:
                check_data = False
                msg = "Value %d is not transformable"%(i)
                ghenv.Component.AddRuntimeMessage(gh.Kernel.GH_RuntimeMessageLevel.Error, msg)
    
    if check_data:
        attribute = Attribute(id, values, transformable)
        return attribute
    else:
        return -1


result = main(ID, VAL, TR)

if result != -1:
    ATTR = result
# ---------- end attribute ----------
attribute_2 = Wasp_Attribute(ID="color", VAL=ColourSwatch(SwatchColor=RGB(0, 64, 255)), TR=Toggle(False))  # -> ATTR; inputs VAL: list, TR: Boolean; same code as attribute

support = Wasp_Support(DIR=[item.Item, item.Item2], GEO=comp_geo)  # -> SUP; inputs DIR: list of Curve, GEO: Mesh
# ---------- support: Python ----------
# Wasp: Discrete Design with Grasshopper plug-in (GPL) initiated by Andrea Rossi
# 
# This file is part of Wasp.
# 
# Copyright (c) 2017, Andrea Rossi <a.rossi.andrea@gmail.com>
# Wasp is free software; you can redistribute it and/or modify 
# it under the terms of the GNU General Public License as published 
# by the Free Software Foundation; either version 3 of the License, 
# or (at your option) any later version. 
# 
# Wasp is distributed in the hope that it will be useful,
# but WITHOUT ANY WARRANTY; without even the implied warranty of 
# MERCHANTABILITY or FITNESS FOR A PARTICULAR PURPOSE. See the 
# GNU General Public License for more details.
# 
# You should have received a copy of the GNU General Public License
# along with Wasp; If not, see <http://www.gnu.org/licenses/>.
# 
# @license GPL-3.0 <https://www.gnu.org/licenses/gpl.html>
#
# Significant parts of Wasp have been developed by Andrea Rossi
# as part of research on digital materials and discrete design at:
# DDU Digital Design Unit - Prof. Oliver Tessmann
# Technische Universität Darmstadt


#########################################################################
##                            COMPONENT INFO                           ##
#########################################################################

"""
Support definition for constrained parts.
Each set of lines defining support locations can be set
-
Provided by Wasp 0.4
    Args:
        DIR: Directions of the support locations as lines
        GEO: OPTIONAL // Geometry of the part the support belongs to (useful for checking if the supports are correctly placed)
    Returns:
        SUP: Support instance
"""

ghenv.Component.Name = "Wasp_Support"
ghenv.Component.NickName = 'Support'
ghenv.Component.Message = 'VER 0.4.013'
ghenv.Component.IconDisplayMode = ghenv.Component.IconDisplayMode.application
ghenv.Component.Category = "Wasp"
ghenv.Component.SubCategory = "4 | Constraints"
try: ghenv.Component.AdditionalHelpFromDocStrings = "1"
except: pass


import sys
import Rhino.Geometry as rg
import Grasshopper as gh


## add Wasp install directory to system path
wasp_loaded = False
ghcompfolder = gh.Folders.DefaultAssemblyFolder
if ghcompfolder not in sys.path:
    sys.path.append(ghcompfolder)
try:
    from wasp import __version__
    wasp_loaded = True
except:
    msg = "Cannot import Wasp. Is the wasp folder available in " + ghcompfolder + "?"
    ghenv.Component.AddRuntimeMessage(gh.Kernel.GH_RuntimeMessageLevel.Error, msg)

## if Wasp is installed correctly, load the classes required by the component
if wasp_loaded:
    from wasp.core import Support


def main(sup_dir, part_geo):
    
    check_data = True
    
    ##check inputs
    support_lines = []
    if len(sup_dir) == 0:
        check_data = False
        msg = "Please provide a valid list of lines as support directions"
        ghenv.Component.AddRuntimeMessage(gh.Kernel.GH_RuntimeMessageLevel.Warning, msg)
    else:
        for sup in sup_dir:
            start = sup.PointAtStart
            end = sup.PointAtEnd
            sup_ln = rg.Line(start, end)
            support_lines.append(sup_ln)
    
    if part_geo is not None:
        for i in range(len(support_lines)):
            intersection = rg.Intersect.Intersection.MeshLine(part_geo, support_lines[i])
            if len(intersection[0]) == 0:
                msg = "Support direction " + str(i) + " does not intersect with the part geometry. Please verify this is intended."
                ghenv.Component.AddRuntimeMessage(gh.Kernel.GH_RuntimeMessageLevel.Warning, msg)
    
    if check_data:
        support = Support(DIR)
        return support
    else:
        return -1


result = main(DIR, GEO)

if result != -1:
    SUP = result
# ---------- end support ----------
support_2 = Wasp_Support(DIR=[item.Item5, item.Item1], GEO=comp_geo)  # -> SUP; inputs DIR: list of Curve, GEO: Mesh; same code as support
support_3 = Wasp_Support(DIR=[item.Item2, item.Item4], GEO=comp_geo)  # -> SUP; inputs DIR: list of Curve, GEO: Mesh; same code as support
support_4 = Wasp_Support(DIR=[item.Item3, item.Item4], GEO=comp_geo)  # -> SUP; inputs DIR: list of Curve, GEO: Mesh; same code as support

connpln = Wasp_ConnectionFromPlane(PLN=split.ListB, T="BOTTOM")  # -> CONN, PLN_OUT; inputs PLN: list of Plane, T: list
# ---------- connpln: Python ----------
# Wasp: Discrete Design with Grasshopper plug-in (GPL) initiated by Andrea Rossi
# 
# This file is part of Wasp.
# 
# Copyright (c) 2017, Andrea Rossi <a.rossi.andrea@gmail.com>
# Wasp is free software; you can redistribute it and/or modify 
# it under the terms of the GNU General Public License as published 
# by the Free Software Foundation; either version 3 of the License, 
# or (at your option) any later version. 
# 
# Wasp is distributed in the hope that it will be useful,
# but WITHOUT ANY WARRANTY; without even the implied warranty of 
# MERCHANTABILITY or FITNESS FOR A PARTICULAR PURPOSE. See the 
# GNU General Public License for more details.
# 
# You should have received a copy of the GNU General Public License
# along with Wasp; If not, see <http://www.gnu.org/licenses/>.
# 
# @license GPL-3.0 <https://www.gnu.org/licenses/gpl.html>
#
# Significant parts of Wasp have been developed by Andrea Rossi
# as part of research on digital materials and discrete design at:
# DDU Digital Design Unit - Prof. Oliver Tessmann
# Technische Universität Darmstadt


#########################################################################
##                            COMPONENT INFO                           ##
#########################################################################

"""
Create a connection from a given plane.
It can create connections which cause collisions and overlapping of components
-
Provided by Wasp 0.4
    Args:
        PLN: Connection plane
        T: OPTIONAL // Connection type (to be used with Rule Generator component)
    Returns:
        CONN: Connection object
        PLN_OUT: Connection plane (for debugging)
"""

ghenv.Component.Name = "Wasp_Connection From Plane"
ghenv.Component.NickName = 'ConnPln'
ghenv.Component.Message = 'VER 0.4.013'
ghenv.Component.IconDisplayMode = ghenv.Component.IconDisplayMode.application
ghenv.Component.Category = "Wasp"
ghenv.Component.SubCategory = "1 | Elements"
try: ghenv.Component.AdditionalHelpFromDocStrings = "1"
except: pass

import sys
import Rhino.Geometry as rg
import Grasshopper as gh


## add Wasp install directory to system path
wasp_loaded = False
ghcompfolder = gh.Folders.DefaultAssemblyFolder
if ghcompfolder not in sys.path:
    sys.path.append(ghcompfolder)
try:
    from wasp import __version__
    wasp_loaded = True
except:
    msg = "Cannot import Wasp. Is the wasp folder available in " + ghcompfolder + "?"
    ghenv.Component.AddRuntimeMessage(gh.Kernel.GH_RuntimeMessageLevel.Error, msg)

## if Wasp is installed correctly, load the classes required by the component
if wasp_loaded:
    from wasp.core import Connection


def main(conn_planes, conn_type):
        
    check_data = True
    
    ##check inputs
    if len(conn_planes) == 0:
        check_data = False
        msg = "No plane provided"
        ghenv.Component.AddRuntimeMessage(gh.Kernel.GH_RuntimeMessageLevel.Warning, msg)
    
    types = []
    if len(conn_type) == 0:
        for i in range(len(conn_planes)):
            types.append("")
    elif len(conn_type) == 1:
        for i in range(len(conn_planes)):
            types.append(conn_type[0])
    elif len(conn_planes) != len(conn_type):
        check_data = False
        msg = "Different amount of planes and types provided"
        ghenv.Component.AddRuntimeMessage(gh.Kernel.GH_RuntimeMessageLevel.Error, msg)
    else:
        for i in range(len(conn_planes)):
            types.append(conn_type[i])
    
    
    if check_data:
        connections = []
        out_planes = []
        for i in range(len(conn_planes)):
            plane = conn_planes[i]
            if plane is None:
                msg = "No valid plane provided for connection %d"%(i)
                ghenv.Component.AddRuntimeMessage(gh.Kernel.GH_RuntimeMessageLevel.Error, msg)
            else:
                conn = Connection(plane, types[i], "", -1)
                connections.append(conn)
                out_planes.append(plane)
        
        return connections, out_planes
    
    else:
        return -1

result = main(PLN, T)

if result != -1:
    CONN = result[0]
    PLN_OUT = result[1]
# ---------- end connpln ----------
connpln_2 = Wasp_ConnectionFromPlane(PLN=split.ListA, T="TOP")  # -> CONN, PLN_OUT; inputs PLN: list of Plane, T: list; same code as connpln
tag = TextTag3D(Location=deconn.PLN, Text=deconn.ID, Size=Slider(2, range=0..10), Justification=7)
merge = Merge(Data1=connpln_2.CONN, Data2=connpln.CONN)
smartattribute = Wasp_SmartAttribute(ID="smartBlocks", VAL=geo, TR=Toggle(True), CONN=merge, CM=panel_4)  # -> ATTR; inputs VAL: list, TR: Boolean, CONN: list, CM: list of Int32
# ---------- smartattribute: Python ----------
# Wasp: Discrete Design with Grasshopper plug-in (GPL) initiated by Andrea Rossi
# 
# This file is part of Wasp.
# 
# Copyright (c) 2017, Andrea Rossi <a.rossi.andrea@gmail.com>
# Wasp is free software; you can redistribute it and/or modify 
# it under the terms of the GNU General Public License as published 
# by the Free Software Foundation; either version 3 of the License, 
# or (at your option) any later version. 
# 
# Wasp is distributed in the hope that it will be useful,
# but WITHOUT ANY WARRANTY; without even the implied warranty of 
# MERCHANTABILITY or FITNESS FOR A PARTICULAR PURPOSE. See the 
# GNU General Public License for more details.
# 
# You should have received a copy of the GNU General Public License
# along with Wasp; If not, see <http://www.gnu.org/licenses/>.
# 
# @license GPL-3.0 <https://www.gnu.org/licenses/gpl.html>
#
# Significant parts of Wasp have been developed by Andrea Rossi
# as part of research on digital materials and discrete design at:
# DDU Digital Design Unit - Prof. Oliver Tessmann
# Technische Universität Darmstadt


#########################################################################
##                            COMPONENT INFO                           ##
#########################################################################

"""
Smart Attribute to be attached to a part.
Similar to a default Attribute, but adds the possibility of returning the attribute only when a specific connection configuration is met.
-
Provided by Wasp 0.4
    Args:
        ID: Name of the attribute
        VAL: Value of the attribute (any type of Gh-compatible data possible)
        TR: OPTIONAL // Transformable. Set it to True for Geometry, False for other types of data (False by default)
        CONN: Connections controlling the activation of the SmartAttribute instance
        CM: Connection mask, with one value for each connection provided in CONN, describing the required layout (1 for free connection, -1 for occupied connection, 0 for ignored connections)
    Returns:
        ATTR: SmartAttribute instance to attach to a component
"""

ghenv.Component.Name = "Wasp_Smart Attribute"
ghenv.Component.NickName = 'SmartAttribute'
ghenv.Component.Message = 'VER 0.4.013'
ghenv.Component.IconDisplayMode = ghenv.Component.IconDisplayMode.application
ghenv.Component.Category = "Wasp"
ghenv.Component.SubCategory = "1 | Elements"
try: ghenv.Component.AdditionalHelpFromDocStrings = "2"
except: pass

import sys
import Rhino.Geometry as rg
import Grasshopper as gh


## add Wasp install directory to system path
wasp_loaded = False
ghcompfolder = gh.Folders.DefaultAssemblyFolder
if ghcompfolder not in sys.path:
    sys.path.append(ghcompfolder)
try:
    from wasp import __version__
    wasp_loaded = True
except:
    msg = "Cannot import Wasp. Is the wasp folder available in " + ghcompfolder + "?"
    ghenv.Component.AddRuntimeMessage(gh.Kernel.GH_RuntimeMessageLevel.Error, msg)

## if Wasp is installed correctly, load the classes required by the component
if wasp_loaded:
    from wasp.core import SmartAttribute


def main(id, values, transformable, connections, connections_mask):
    
    check_data = True
    
    ##check inputs
    if id is None:
        check_data = False
        msg = "Please provide a name for the attribute"
        ghenv.Component.AddRuntimeMessage(gh.Kernel.GH_RuntimeMessageLevel.Warning, msg)
    
    if len(values) == 0:
        check_data = False
        msg = "Please provide values for the attribute"
        ghenv.Component.AddRuntimeMessage(gh.Kernel.GH_RuntimeMessageLevel.Warning, msg)
    
    if transformable is None:
        transformable = False
    
    if transformable == True:
        val_count = 0
        for i in range(len(values)):
            try:
                values[i].Transform(rg.Transform.Identity)
            except:
                check_data = False
                msg = "Value %d is not transformable"%(i)
                ghenv.Component.AddRuntimeMessage(gh.Kernel.GH_RuntimeMessageLevel.Error, msg)
    
    if len(connections) == 0 or len(connections_mask) == 0:
        msg = "No SmartAttribute data provided. You might consider using a normal Attribute instead"
        ghenv.Component.AddRuntimeMessage(gh.Kernel.GH_RuntimeMessageLevel.Warning, msg)
    
    elif len(connections) != len(connections_mask):
        check_data = False
        msg = "Different number of connections and connection mask values provided"
        ghenv.Component.AddRuntimeMessage(gh.Kernel.GH_RuntimeMessageLevel.Error, msg)
    
    if check_data:
        attribute = SmartAttribute(id, values, transformable, connections, connections_mask)
        return attribute
    else:
        return -1


result = main(ID, VAL, TR, CONN, CM)

if result != -1:
    ATTR = result
# ---------- end smartattribute ----------
merge_2 = Merge(Data1=attribute, Data2=attribute_2, Data3=smartattribute)  # -> flatten(Result)
merge_3 = Merge(Data1=support, Data2=support_2, Data3=support_3, Data4=support_4)
series = Series(Start=0, Step=1, Count=Slider(6, range=0..10))
vec2pt_3 = Vector2Pt(PointA=item_4.Item2, PointB=item_4.Item, Unitize=False)  # -> Vector, Length
multiplication_2 = Multiplication(A=vec2pt_3.Vector, B=series)
part = Wasp_BasicPart(NAME="L2", GEO=smesh, CONN=flatten(merge))  # -> PART; inputs GEO: Mesh, CONN: list, ATTR: list
# ---------- part: Python ----------
# Wasp: Discrete Design with Grasshopper plug-in (GPL) initiated by Andrea Rossi
# 
# This file is part of Wasp.
# 
# Copyright (c) 2017, Andrea Rossi <a.rossi.andrea@gmail.com>
# Wasp is free software; you can redistribute it and/or modify 
# it under the terms of the GNU General Public License as published 
# by the Free Software Foundation; either version 3 of the License, 
# or (at your option) any later version. 
# 
# Wasp is distributed in the hope that it will be useful,
# but WITHOUT ANY WARRANTY; without even the implied warranty of 
# MERCHANTABILITY or FITNESS FOR A PARTICULAR PURPOSE. See the 
# GNU General Public License for more details.
# 
# You should have received a copy of the GNU General Public License
# along with Wasp; If not, see <http://www.gnu.org/licenses/>.
# 
# @license GPL-3.0 <https://www.gnu.org/licenses/gpl.html>
#
# Significant parts of Wasp have been developed by Andrea Rossi
# as part of research on digital materials and discrete design at:
# DDU Digital Design Unit - Prof. Oliver Tessmann
# Technische Universität Darmstadt


#########################################################################
##                            COMPONENT INFO                           ##
#########################################################################

"""
Create a basic Wasp Part to be used for aggregation
-
Provided by Wasp 0.4
    Args:
        NAME: Part name
        GEO: Part geometry. It will be converted to mesh - to improve performance, perform the conversion before adding to the part and user a low-poly count
        CONN: Connections list
        COLL: OPTIONAL // Collider geometry (for collision detection). A collider will be automatically generated. For complex parts, automatic generation might not work, and you can add a custom collider geometry here.
        ATTR: OPTIONAL // Part attributes
    Returns:
        PART: Part instance
"""

ghenv.Component.Name = "Wasp_Basic Part"
ghenv.Component.NickName = 'Part'
ghenv.Component.Message = 'VER 0.4.013'
ghenv.Component.IconDisplayMode = ghenv.Component.IconDisplayMode.application
ghenv.Component.Category = "Wasp"
ghenv.Component.SubCategory = "2 | Parts"
try: ghenv.Component.AdditionalHelpFromDocStrings = "1"
except: pass

import sys
import Rhino.Geometry as rg
import Grasshopper as gh


## add Wasp install directory to system path
wasp_loaded = False
ghcompfolder = gh.Folders.DefaultAssemblyFolder
if ghcompfolder not in sys.path:
    sys.path.append(ghcompfolder)
try:
    from wasp import __version__
    wasp_loaded = True
except:
    msg = "Cannot import Wasp. Is the wasp folder available in " + ghcompfolder + "?"
    ghenv.Component.AddRuntimeMessage(gh.Kernel.GH_RuntimeMessageLevel.Error, msg)

## if Wasp is installed correctly, load the classes required by the component
if wasp_loaded:
    from wasp.core import Part
    from wasp.core import Collider
    from wasp import global_tolerance


def main(part_name, part_geo, connections, collider, attributes):
    
    check_data = True
    
    ## check inputs
    if part_name is None:
        check_data = False
        msg = "No part name provided"
        ghenv.Component.AddRuntimeMessage(gh.Kernel.GH_RuntimeMessageLevel.Warning, msg)
    
    if part_geo is None:
        check_data = False
        msg = "No part geometry provided"
        ghenv.Component.AddRuntimeMessage(gh.Kernel.GH_RuntimeMessageLevel.Warning, msg)
        check_data = False
    
    if collider is None:
        if part_geo is not None:
            collider_geo = part_geo.Duplicate().Offset(global_tolerance)
            collider_intersection = rg.Intersect.Intersection.MeshMeshFast(collider_geo, part_geo)
            if len(collider_intersection) > 0:
                collider_geo = None
                collider_geo = part_geo.Duplicate()
                center = part_geo.GetBoundingBox(True).Center
                scale_plane = rg.Plane(center, rg.Vector3d(1,0,0), rg.Vector3d(0,1,0))
                scale_transform = rg.Transform.Scale(scale_plane, 1-global_tolerance, 1-global_tolerance, 1-global_tolerance)
                collider_geo.Transform(scale_transform)
                collider_intersection = rg.Intersect.Intersection.MeshMeshFast(collider_geo, part_geo)
                if len(collider_intersection) > 0:
                    collider_geo = None
                    msg = "Could not compute a valid collider geometry. Please provide a valid collider in the COLL input."
                    ghenv.Component.AddRuntimeMessage(gh.Kernel.GH_RuntimeMessageLevel.Error, msg)
                    check_data = False
            
            if collider_geo is not None:
                collider = Collider([collider_geo])
            
    else:
        if type(collider) != Collider:
            if type(collider) == rg.Mesh:
                collider = Collider([collider])
            else:
                msg = "Collider geometry must be of type Mesh or WaspCollider."
                ghenv.Component.AddRuntimeMessage(gh.Kernel.GH_RuntimeMessageLevel.Error, msg)
                check_data = False
        
    if collider is not None and collider.faces_count > 1000:
        msg = "The collider has a high faces count. Consider providing a low poly collider to improve performance"
        ghenv.Component.AddRuntimeMessage(gh.Kernel.GH_RuntimeMessageLevel.Warning, msg)
    
    
    if check_data:
        new_part = Part(part_name, part_geo, connections, collider, attributes)
        
        if new_part.dim < global_tolerance*10:
            msg = "The parts you created are very small. You might consider scaling them or decreasing the tolerance of your Rhino file."
            ghenv.Component.AddRuntimeMessage(gh.Kernel.GH_RuntimeMessageLevel.Warning, msg)
        
        return new_part
    else:
        return -1


result = main(NAME, GEO, CONN, COLL, ATTR)

if result != -1:
    PART = result
# ---------- end part ----------
move_3 = Move(Motion=multiplication)  # -> Geometry, Transform
move_4 = Move(Motion=multiplication_2)  # -> Geometry, Transform
advpart = Wasp_AdvancedPart(NAME="B", GEO=mesh, CONN=flatten(conndir_2.CONN), FIELD="f_01")  # -> PART; inputs GEO: Mesh, CONN: list, HI: list, ATTR: list, SUP: list, AEC: list, OC: list
# ---------- advpart: Python ----------
# Wasp: Discrete Design with Grasshopper plug-in (GPL) initiated by Andrea Rossi
# 
# This file is part of Wasp.
# 
# Copyright (c) 2017, Andrea Rossi <a.rossi.andrea@gmail.com>
# Wasp is free software; you can redistribute it and/or modify 
# it under the terms of the GNU General Public License as published 
# by the Free Software Foundation; either version 3 of the License, 
# or (at your option) any later version. 
# 
# Wasp is distributed in the hope that it will be useful,
# but WITHOUT ANY WARRANTY; without even the implied warranty of 
# MERCHANTABILITY or FITNESS FOR A PARTICULAR PURPOSE. See the 
# GNU General Public License for more details.
# 
# You should have received a copy of the GNU General Public License
# along with Wasp; If not, see <http://www.gnu.org/licenses/>.
# 
# @license GPL-3.0 <https://www.gnu.org/licenses/gpl.html>
#
# Significant parts of Wasp have been developed by Andrea Rossi
# as part of research on digital materials and discrete design at:
# DDU Digital Design Unit - Prof. Oliver Tessmann
# Technische Universität Darmstadt


#########################################################################
##                            COMPONENT INFO                           ##
#########################################################################

"""
Create a Wasp Part with additional constraints (supports, additional colliders)
-
Provided by Wasp 0.4
    Args:
        NAME: Part name
        GEO: Part geometry. It will be converted to mesh - to improve performance, perform the conversion before adding to the part and user a low-poly count
        CONN: Connections list
        COLL: OPTIONAL // Collider geometry (for collision detection). A collider will be automatically generated. For complex parts, automatic generation might not work, and you can add a custom collider geometry here.
        FIELD: OPTIONAL // Field to associate with the part for Field-Driven Aggegation (Needed only when using multiple fields within one aggregation)
        HI: OPTIONAL // Hierarchy: List of parts composing the part at a lower heriarchical level in the aggregation
        ATTR: OPTIONAL // Part attributes
        E_COLL: OPTIONAL // Additional collider geometry (e.g. assembly tool), to be checked in Local Constraints mode
        SUP: OPTIONAL // Required supports for part placement, to be checked in Local Constraints mode
        AEC: OPTIONAL // Adjacency/Exclusion constraints, to be checked in Local Constraints mode
        OC: OPTIONAL // Orientation constraints, to be checked in Local Constraints mode
    Returns:
        PART: Part instance
"""

ghenv.Component.Name = "Wasp_Advanced Part"
ghenv.Component.NickName = 'AdvPart'
ghenv.Component.Message = 'VER 0.4.013'
ghenv.Component.IconDisplayMode = ghenv.Component.IconDisplayMode.application
ghenv.Component.Category = "Wasp"
ghenv.Component.SubCategory = "2 | Parts"
try: ghenv.Component.AdditionalHelpFromDocStrings = "1"
except: pass

import sys
import Rhino.Geometry as rg
import Grasshopper as gh


## add Wasp install directory to system path
wasp_loaded = False
ghcompfolder = gh.Folders.DefaultAssemblyFolder
if ghcompfolder not in sys.path:
    sys.path.append(ghcompfolder)
try:
    from wasp import __version__
    wasp_loaded = True
except:
    msg = "Cannot import Wasp. Is the wasp folder available in " + ghcompfolder + "?"
    ghenv.Component.AddRuntimeMessage(gh.Kernel.GH_RuntimeMessageLevel.Error, msg)

## if Wasp is installed correctly, load the classes required by the component
if wasp_loaded:
    from wasp.core import AdvancedPart
    from wasp.core import Collider
    from wasp import global_tolerance


def main(part_name, part_geo, connections, collider, field_name, sub_parts, attributes, add_collider, supports, adj_constraints, orient_constraints):
    
    check_data = True
    
    ## check inputs
    if part_name is None:
        check_data = False
        msg = "No part name provided"
        ghenv.Component.AddRuntimeMessage(gh.Kernel.GH_RuntimeMessageLevel.Warning, msg)
    
    if part_geo is None:
        check_data = False
        msg = "No part geometry provided"
        ghenv.Component.AddRuntimeMessage(gh.Kernel.GH_RuntimeMessageLevel.Warning, msg)
        check_data = False
    
    ## compute collider, if no custom collider is provided
    if collider is None:
        if part_geo is not None:
            collider_geo = part_geo.Duplicate().Offset(global_tolerance)
            collider_intersection = rg.Intersect.Intersection.MeshMeshFast(collider_geo, part_geo)
            if len(collider_intersection) > 0:
                collider_geo = None
                collider_geo = part_geo.Duplicate()
                center = part_geo.GetBoundingBox(True).Center
                scale_plane = rg.Plane(center, rg.Vector3d(1,0,0), rg.Vector3d(0,1,0))
                scale_transform = rg.Transform.Scale(scale_plane, 1-global_tolerance, 1-global_tolerance, 1-global_tolerance)
                collider_geo.Transform(scale_transform)
                collider_intersection = rg.Intersect.Intersection.MeshMeshFast(collider_geo, part_geo)
                if len(collider_intersection) > 0:
                    collider_geo = None
                    msg = "Could not compute a valid collider geometry. Please provide a valid collider in the COLL input."
                    ghenv.Component.AddRuntimeMessage(gh.Kernel.GH_RuntimeMessageLevel.Error, msg)
                    check_data = False
            
            if collider_geo is not None:
                collider = Collider([collider_geo])
    
    else:
        if type(collider) != Collider:
            if type(collider) == rg.Mesh:
                collider = Collider([collider])
            else:
                msg = "Collider geometry must be of type Mesh or WaspCollider."
                ghenv.Component.AddRuntimeMessage(gh.Kernel.GH_RuntimeMessageLevel.Error, msg)
                check_data = False
        
    if collider is not None and collider.faces_count > 1000:
        msg = "The collider has a high faces count. Consider providing a low poly collider to improve performance"
        ghenv.Component.AddRuntimeMessage(gh.Kernel.GH_RuntimeMessageLevel.Warning, msg)
    
    
    if check_data:
        if add_collider is not None and type(add_collider) != Collider:
            add_collider = Collider([add_collider])
        
        ## create part instance
        new_part = AdvancedPart(part_name, part_geo, connections, collider, attributes, add_collider, supports, field=field_name, sub_parts=sub_parts, adjacency_const=adj_constraints, orientation_const=orient_constraints)
        
        if new_part.dim < global_tolerance*10:
            msg = "The parts you created are very small. You might consider scaling them or decreasing the tolerance of your Rhino file."
            ghenv.Component.AddRuntimeMessage(gh.Kernel.GH_RuntimeMessageLevel.Warning, msg)
        
        return new_part
    else:
        return -1


result = main(NAME, GEO, CONN, COLL, FIELD, HI, ATTR, E_COLL, SUP, AEC, OC)

if result != -1:
    PART = result
# ---------- end advpart ----------
parthierarchy = Wasp_AssemblePartHierarchy(PART=advpart, TR=move_3.Transform)  # -> HIE
# ---------- parthierarchy: Python ----------
# Wasp: Discrete Design with Grasshopper plug-in (GPL) initiated by Andrea Rossi
# 
# This file is part of Wasp.
# 
# Copyright (c) 2017, Andrea Rossi <a.rossi.andrea@gmail.com>
# Wasp is free software; you can redistribute it and/or modify 
# it under the terms of the GNU General Public License as published 
# by the Free Software Foundation; either version 3 of the License, 
# or (at your option) any later version. 
# 
# Wasp is distributed in the hope that it will be useful,
# but WITHOUT ANY WARRANTY; without even the implied warranty of 
# MERCHANTABILITY or FITNESS FOR A PARTICULAR PURPOSE. See the 
# GNU General Public License for more details.
# 
# You should have received a copy of the GNU General Public License
# along with Wasp; If not, see <http://www.gnu.org/licenses/>.
# 
# @license GPL-3.0 <https://www.gnu.org/licenses/gpl.html>
#
# Significant parts of Wasp have been developed by Andrea Rossi
# as part of research on digital materials and discrete design at:
# DDU Digital Design Unit - Prof. Oliver Tessmann
# Technische Universität Darmstadt


#########################################################################
##                            COMPONENT INFO                           ##
#########################################################################

"""
Applies a geometric transformation to an existing part, returning a transformed copy.
Can be used with any Transform component from Grasshopper.
Create a Transform component without inputting any geometry and plug the X output to the TR input.
--> WIP Component: might be incomplete or contain bugs <--
-
Provided by Wasp 0.4
    Args:
        PART: Sub-parts to be assembled
        TR: Relative transformation of each sub-part in the higher hierarchy assembly
    Returns:
        HIE: Assembled parts
"""

ghenv.Component.Name = "Wasp_Assemble Part Hierarchy"
ghenv.Component.NickName = 'PartHierarchy'
ghenv.Component.Message = 'VER 0.4.013'
ghenv.Component.IconDisplayMode = ghenv.Component.IconDisplayMode.application
ghenv.Component.Category = "Wasp"
ghenv.Component.SubCategory = "X | Experimental"
try: ghenv.Component.AdditionalHelpFromDocStrings = "3"
except: pass

import sys
import Grasshopper as gh


## add Wasp install directory to system path
wasp_loaded = False
ghcompfolder = gh.Folders.DefaultAssemblyFolder
if ghcompfolder not in sys.path:
    sys.path.append(ghcompfolder)
try:
    from wasp import __version__
    wasp_loaded = True
except:
    msg = "Cannot import Wasp. Is the wasp folder available in " + ghcompfolder + "?"
    ghenv.Component.AddRuntimeMessage(gh.Kernel.GH_RuntimeMessageLevel.Error, msg)

## if Wasp is installed correctly, load the classes required by the component
if wasp_loaded:
    pass


def main(part, transform):
    
    check_data = True
    
    ##check inputs
    if part is None:
        check_data = False
        msg = "Please provide a valid part to be transformed"
        ghenv.Component.AddRuntimeMessage(gh.Kernel.GH_RuntimeMessageLevel.Warning, msg)
    
    if transform is None:
        check_data = False
        msg = "Please provide a valid transformation"
        ghenv.Component.AddRuntimeMessage(gh.Kernel.GH_RuntimeMessageLevel.Warning, msg)
    
    if check_data:
        ## transform part
        part_trans = part.transform(transform, transform_sub_parts = True, sub_level = part.hierarchy_level)
        
        return part_trans
    else:
        return -1


result = main(PART, TR)

if result != -1:
    HIE = result
# ---------- end parthierarchy ----------
advpart_2 = Wasp_AdvancedPart(NAME="CR", GEO=mesh_2, CONN=flatten(conndir_3.CONN), FIELD="f_01", HI=parthierarchy)  # -> PART; inputs GEO: Mesh, CONN: list, HI: list, ATTR: list, SUP: list, AEC: list, OC: list; same code as advpart
parthierarchy_2 = Wasp_AssemblePartHierarchy(PART=advpart_2, TR=move_4.Transform)  # -> HIE; same code as parthierarchy
advpart_3 = Wasp_AdvancedPart(NAME="L", GEO=mbox, CONN=flatten(merge), FIELD="f_01", HI=parthierarchy_2, ATTR=merge_2, E_COLL=collider, SUP=merge_3)  # -> PART; inputs GEO: Mesh, CONN: list, HI: list, ATTR: list, SUP: list, AEC: list, OC: list; same code as advpart
parttr = Wasp_TransformPart(PART=advpart_3, TR=move_2.Transform)  # -> PART_OUT
# ---------- parttr: Python ----------
# Wasp: Discrete Design with Grasshopper plug-in (GPL) initiated by Andrea Rossi
# 
# This file is part of Wasp.
# 
# Copyright (c) 2017, Andrea Rossi <a.rossi.andrea@gmail.com>
# Wasp is free software; you can redistribute it and/or modify 
# it under the terms of the GNU General Public License as published 
# by the Free Software Foundation; either version 3 of the License, 
# or (at your option) any later version. 
# 
# Wasp is distributed in the hope that it will be useful,
# but WITHOUT ANY WARRANTY; without even the implied warranty of 
# MERCHANTABILITY or FITNESS FOR A PARTICULAR PURPOSE. See the 
# GNU General Public License for more details.
# 
# You should have received a copy of the GNU General Public License
# along with Wasp; If not, see <http://www.gnu.org/licenses/>.
# 
# @license GPL-3.0 <https://www.gnu.org/licenses/gpl.html>
#
# Significant parts of Wasp have been developed by Andrea Rossi
# as part of research on digital materials and discrete design at:
# DDU Digital Design Unit - Prof. Oliver Tessmann
# Technische Universität Darmstadt


#########################################################################
##                            COMPONENT INFO                           ##
#########################################################################

"""
Applies a geometric transformation to an existing part, returning a transformed copy.
Can be used with any Transform component from Grasshopper.
Create a Transform component without inputting any geometry and plug the X output to the TR input.
-
Provided by Wasp 0.4
    Args:
        PART: Part to be transformed
        TR: Transformation
    Returns:
        PART_OUT: Transformed part
"""

ghenv.Component.Name = "Wasp_Transform Part"
ghenv.Component.NickName = 'PartTr'
ghenv.Component.Message = 'VER 0.4.013'
ghenv.Component.IconDisplayMode = ghenv.Component.IconDisplayMode.application
ghenv.Component.Category = "Wasp"
ghenv.Component.SubCategory = "2 | Parts"
try: ghenv.Component.AdditionalHelpFromDocStrings = "2"
except: pass

import sys
import Grasshopper as gh
import math


## add Wasp install directory to system path
wasp_loaded = False
ghcompfolder = gh.Folders.DefaultAssemblyFolder
if ghcompfolder not in sys.path:
    sys.path.append(ghcompfolder)
try:
    from wasp import __version__
    wasp_loaded = True
except:
    msg = "Cannot import Wasp. Is the wasp folder available in " + ghcompfolder + "?"
    ghenv.Component.AddRuntimeMessage(gh.Kernel.GH_RuntimeMessageLevel.Error, msg)

## if Wasp is installed correctly, load the classes required by the component
if wasp_loaded:
    from wasp.core import Part


def main(part, transform):
    
    check_data = True
    
    ##check inputs
    if part is None:
        check_data = False
        msg = "Please provide a valid part to be transformed"
        ghenv.Component.AddRuntimeMessage(gh.Kernel.GH_RuntimeMessageLevel.Warning, msg)
    
    if transform is None:
        check_data = False
        msg = "Please provide a valid transformation"
        ghenv.Component.AddRuntimeMessage(gh.Kernel.GH_RuntimeMessageLevel.Warning, msg)
    
    if check_data:
        ## transform part
        part_trans = part.transform(transform)
        
        ## flip part if negative scaling occurs
        if transform.M00 * transform.M11 * transform.M22 < 0:
            ## geometry
            part_trans.geo.Flip(True, True, True)
            ## connections
            for conn in part_trans.connections:
                pass
                conn.pln.Flip()
                conn.pln.Rotate(math.pi/2, conn.pln.ZAxis)
            ## collider
            for geo in part_trans.collider.geometry:
                geo.Flip(True, True, True)
        
        return part_trans
    else:
        return -1


result = main(PART, TR)

if result != -1:
    PART_OUT = result
# ---------- end parttr ----------
larger = LargerThan(FirstNumber=graph, SecondNumber=Slider(0.3, range=0..1))  # -> LargerThan, OrEqualTo
partgeo = Wasp_GetPartGeometry(PART=parthierarchy)  # -> GEO
# ---------- partgeo: Python ----------
# Wasp: Discrete Design with Grasshopper plug-in (GPL) initiated by Andrea Rossi
# 
# This file is part of Wasp.
# 
# Copyright (c) 2017, Andrea Rossi <a.rossi.andrea@gmail.com>
# Wasp is free software; you can redistribute it and/or modify 
# it under the terms of the GNU General Public License as published 
# by the Free Software Foundation; either version 3 of the License, 
# or (at your option) any later version. 
# 
# Wasp is distributed in the hope that it will be useful,
# but WITHOUT ANY WARRANTY; without even the implied warranty of 
# MERCHANTABILITY or FITNESS FOR A PARTICULAR PURPOSE. See the 
# GNU General Public License for more details.
# 
# You should have received a copy of the GNU General Public License
# along with Wasp; If not, see <http://www.gnu.org/licenses/>.
# 
# @license GPL-3.0 <https://www.gnu.org/licenses/gpl.html>
#
# Significant parts of Wasp have been developed by Andrea Rossi
# as part of research on digital materials and discrete design at:
# DDU Digital Design Unit - Prof. Oliver Tessmann
# Technische Universität Darmstadt


#########################################################################
##                            COMPONENT INFO                           ##
#########################################################################

"""
Extract the geometry of one part (for visualization or further processing).
-
Provided by Wasp 0.4
    Args:
        PART: Part from where to extract the geometry
    Returns:
        GEO: Part geometry
"""

ghenv.Component.Name = "Wasp_Get Part Geometry"
ghenv.Component.NickName = 'PartGeo'
ghenv.Component.Message = 'VER 0.4.013'
ghenv.Component.IconDisplayMode = ghenv.Component.IconDisplayMode.application
ghenv.Component.Category = "Wasp"
ghenv.Component.SubCategory = "2 | Parts"
try: ghenv.Component.AdditionalHelpFromDocStrings = "3"
except: pass


import sys
import Rhino.Geometry as rg
import Grasshopper as gh


## add Wasp install directory to system path
wasp_loaded = False
ghcompfolder = gh.Folders.DefaultAssemblyFolder
if ghcompfolder not in sys.path:
    sys.path.append(ghcompfolder)
try:
    from wasp import __version__
    wasp_loaded = True
except:
    msg = "Cannot import Wasp. Is the wasp folder available in " + ghcompfolder + "?"
    ghenv.Component.AddRuntimeMessage(gh.Kernel.GH_RuntimeMessageLevel.Error, msg)

## if Wasp is installed correctly, load the classes required by the component
if wasp_loaded:
    pass


def main(part):
        
    check_data = True
    
    ## check inputs
    if part is None:
        check_data = False
        msg = "No or null part provided"
        ghenv.Component.AddRuntimeMessage(gh.Kernel.GH_RuntimeMessageLevel.Warning, msg)
    
    ## execute main code if all needed inputs are available
    if check_data:
        return part.geo
    else:
        return -1

result = main(PART)

if result != -1:
    GEO = result
# ---------- end partgeo ----------
panel_6 = Panel("""L|0_L|6
L|2_L|4
L|1_L|11
L|5_L|3
L|2_L|7
L|4_L|9
L|6_L|0
L|4_L|2
L|11_L|1
L|3_L|5
L|7_L|2
L|9_L|4""")
merge_4 = Merge(Data1=part, Data2=advpart_3)  # -> flatten(Result)
preview = CustomPreview(Geometry=fieldpts.PTS, Shader=gradient)
pt_2 = ConstructPoint(XCoordinate="-500", YCoordinate=0, ZCoordinate=0)
panel_7 = Panel("TOP>BOTTOM")
panel_8 = Panel("BOTTOM>TOP")
panel_9 = Panel("""TOP>BOTTOM
BOTTOM>TOP""")
ruletxt = Wasp_RuleFromText(TXT=panel_6)  # -> R
# ---------- ruletxt: Python ----------
# Wasp: Discrete Design with Grasshopper plug-in (GPL) initiated by Andrea Rossi
# 
# This file is part of Wasp.
# 
# Copyright (c) 2017, Andrea Rossi <a.rossi.andrea@gmail.com>
# Wasp is free software; you can redistribute it and/or modify 
# it under the terms of the GNU General Public License as published 
# by the Free Software Foundation; either version 3 of the License, 
# or (at your option) any later version. 
# 
# Wasp is distributed in the hope that it will be useful,
# but WITHOUT ANY WARRANTY; without even the implied warranty of 
# MERCHANTABILITY or FITNESS FOR A PARTICULAR PURPOSE. See the 
# GNU General Public License for more details.
# 
# You should have received a copy of the GNU General Public License
# along with Wasp; If not, see <http://www.gnu.org/licenses/>.
# 
# @license GPL-3.0 <https://www.gnu.org/licenses/gpl.html>
#
# Significant parts of Wasp have been developed by Andrea Rossi
# as part of research on digital materials and discrete design at:
# DDU Digital Design Unit - Prof. Oliver Tessmann
# Technische Universität Darmstadt


#########################################################################
##                            COMPONENT INFO                           ##
#########################################################################

"""
Generate an aggregation rule from a text string description
-
Provided by Wasp 0.4
    Args:
        TXT: Text description of the rule with format "Part1|Conn1_Part2|Conn2"
    Returns:
        R: Rule
"""

ghenv.Component.Name = "Wasp_Rule From Text"
ghenv.Component.NickName = 'RuleTxt'
ghenv.Component.Message = 'VER 0.4.013'
ghenv.Component.IconDisplayMode = ghenv.Component.IconDisplayMode.application
ghenv.Component.Category = "Wasp"
ghenv.Component.SubCategory = "3 | Rules"
try: ghenv.Component.AdditionalHelpFromDocStrings = "1"
except: pass

import sys
import Grasshopper as gh


## add Wasp install directory to system path
wasp_loaded = False
ghcompfolder = gh.Folders.DefaultAssemblyFolder
if ghcompfolder not in sys.path:
    sys.path.append(ghcompfolder)
try:
    from wasp import __version__
    wasp_loaded = True
except:
    msg = "Cannot import Wasp. Is the wasp folder available in " + ghcompfolder + "?"
    ghenv.Component.AddRuntimeMessage(gh.Kernel.GH_RuntimeMessageLevel.Error, msg)

## if Wasp is installed correctly, load the classes required by the component
if wasp_loaded:
    from wasp.core import Rule



def main(text):
    
    check_data = True
    
    ##check inputs
    if text is None:
        check_data = False
        msg = "No text provided"
        ghenv.Component.AddRuntimeMessage(gh.Kernel.GH_RuntimeMessageLevel.Warning, msg)
    
    if check_data:
        
        try:
            rule_parts = text.split("_")
            part1 = str(rule_parts[0].split("|")[0])
            conn1 = int(rule_parts[0].split("|")[1])
            part2 = str(rule_parts[1].split("|")[0])
            conn2 = int(rule_parts[1].split("|")[1])
            
            rule = Rule(part1, conn1, part2, conn2)
            return rule
        except:
            msg = "Text string %s is not formatted correctly"%(text)
            ghenv.Component.AddRuntimeMessage(gh.Kernel.GH_RuntimeMessageLevel.Error, msg)
            return -1
    else:
        return -1


result = main(TXT)

if result != -1:
    R = result
# ---------- end ruletxt ----------
rule = Wasp_Rule(P1="L", C1=Slider(3, range=0..10), P2="L", C2=Slider(7, range=0..10))  # -> R; inputs C1: Int32, C2: Int32
# ---------- rule: Python ----------
# Wasp: Discrete Design with Grasshopper plug-in (GPL) initiated by Andrea Rossi
# 
# This file is part of Wasp.
# 
# Copyright (c) 2017, Andrea Rossi <a.rossi.andrea@gmail.com>
# Wasp is free software; you can redistribute it and/or modify 
# it under the terms of the GNU General Public License as published 
# by the Free Software Foundation; either version 3 of the License, 
# or (at your option) any later version. 
# 
# Wasp is distributed in the hope that it will be useful,
# but WITHOUT ANY WARRANTY; without even the implied warranty of 
# MERCHANTABILITY or FITNESS FOR A PARTICULAR PURPOSE. See the 
# GNU General Public License for more details.
# 
# You should have received a copy of the GNU General Public License
# along with Wasp; If not, see <http://www.gnu.org/licenses/>.
# 
# @license GPL-3.0 <https://www.gnu.org/licenses/gpl.html>
#
# Significant parts of Wasp have been developed by Andrea Rossi
# as part of research on digital materials and discrete design at:
# DDU Digital Design Unit - Prof. Oliver Tessmann
# Technische Universität Darmstadt


#########################################################################
##                            COMPONENT INFO                           ##
#########################################################################

"""
Generate an aggregation rule from part names and connections ids
-
Provided by Wasp 0.4
    Args:
        P1: Name of base part
        C1: Id of base connection
        P2: Name of new part to be aggregated
        C2: Id of new connection
    Returns:
        R: Rule
"""

ghenv.Component.Name = "Wasp_Rule"
ghenv.Component.NickName = 'Rule'
ghenv.Component.Message = 'VER 0.4.013'
ghenv.Component.IconDisplayMode = ghenv.Component.IconDisplayMode.application
ghenv.Component.Category = "Wasp"
ghenv.Component.SubCategory = "3 | Rules"
try: ghenv.Component.AdditionalHelpFromDocStrings = "1"
except: pass

import sys
import Grasshopper as gh


## add Wasp install directory to system path
wasp_loaded = False
ghcompfolder = gh.Folders.DefaultAssemblyFolder
if ghcompfolder not in sys.path:
    sys.path.append(ghcompfolder)
try:
    from wasp import __version__
    wasp_loaded = True
except:
    msg = "Cannot import Wasp. Is the wasp folder available in " + ghcompfolder + "?"
    ghenv.Component.AddRuntimeMessage(gh.Kernel.GH_RuntimeMessageLevel.Error, msg)

## if Wasp is installed correctly, load the classes required by the component
if wasp_loaded:
    from wasp.core import Rule


def main(part1, conn1, part2, conn2):
    
    check_data = True
    
    ##check inputs
    if part1 is None or conn1 is None or part2 is None or conn2 is None:
        check_data = False
        msg = "Missing data. Please provide data for all inputs."
        ghenv.Component.AddRuntimeMessage(gh.Kernel.GH_RuntimeMessageLevel.Warning, msg)
    
    if check_data:
        rule = Rule(part1, conn1, part2, conn2)
        return rule
    else:
        return -1


result = main(P1, C1, P2, C2)

if result != -1:
    R = result
# ---------- end rule ----------
preview_2 = CustomPreview(Geometry=fieldpts.PTS, Shader=gradient_2)
field = Wasp_Field(NAME="f_01", E_FIELD=fieldpts.E_FIELD, VAL=graph)  # -> FIELD; inputs VAL: list
#   port NAME: OPTIONAL // Field name (needed for multi-field aggregation)
#   port E_FIELD: Empty field where to store values. Created with "Wasp_Field Points" component
# ---------- field: Python ----------
# Wasp: Discrete Design with Grasshopper plug-in (GPL) initiated by Andrea Rossi
# 
# This file is part of Wasp.
# 
# Copyright (c) 2017, Andrea Rossi <a.rossi.andrea@gmail.com>
# Wasp is free software; you can redistribute it and/or modify 
# it under the terms of the GNU General Public License as published 
# by the Free Software Foundation; either version 3 of the License, 
# or (at your option) any later version. 
# 
# Wasp is distributed in the hope that it will be useful,
# but WITHOUT ANY WARRANTY; without even the implied warranty of 
# MERCHANTABILITY or FITNESS FOR A PARTICULAR PURPOSE. See the 
# GNU General Public License for more details.
# 
# You should have received a copy of the GNU General Public License
# along with Wasp; If not, see <http://www.gnu.org/licenses/>.
# 
# @license GPL-3.0 <https://www.gnu.org/licenses/gpl.html>
#
# Significant parts of Wasp have been developed by Andrea Rossi
# as part of research on digital materials and discrete design at:
# DDU Digital Design Unit - Prof. Oliver Tessmann
# Technische Universität Darmstadt


#########################################################################
##                            COMPONENT INFO                           ##
#########################################################################

"""
Generates a scalar field given a grid of points and their relative scalar values
-
Provided by Wasp 0.4
    Args:
        BOU: List of geometries defining the boundaries of the field. Geometries must be closed breps or meshes. All points of the field outside the geometries will be assigned a 0 value
        PTS: 3d point grid (from FieldPts component)
        COUNT: Vector storing cell counts for each axis (from FieldPts component)
        RES: Resolution of cell grid
        VAL: Values to assign to each cell
    Returns:
        FIELD: Field object (to be used to drive the FieldAggr component)
"""

ghenv.Component.Name = "Wasp_Field"
ghenv.Component.NickName = 'Field'
ghenv.Component.Message = 'VER 0.4.013'
ghenv.Component.IconDisplayMode = ghenv.Component.IconDisplayMode.application
ghenv.Component.Category = "Wasp"
ghenv.Component.SubCategory = "5 | Fields"
try: ghenv.Component.AdditionalHelpFromDocStrings = "1"
except: pass


import sys
import Rhino.Geometry as rg
import Grasshopper as gh


## add Wasp install directory to system path
wasp_loaded = False
ghcompfolder = gh.Folders.DefaultAssemblyFolder
if ghcompfolder not in sys.path:
    sys.path.append(ghcompfolder)
try:
    from wasp import __version__
    wasp_loaded = True
except:
    msg = "Cannot import Wasp. Is the wasp folder available in " + ghcompfolder + "?"
    ghenv.Component.AddRuntimeMessage(gh.Kernel.GH_RuntimeMessageLevel.Error, msg)

## if Wasp is installed correctly, load the classes required by the component
if wasp_loaded:
    from wasp.field import Field


def main(name, empty_field, values):
    
    check_data = True
    
    ##check inputs
    if name is None:
        name = "field"
    
    if empty_field is None:
        check_data = False
        msg = "No base empty field provided"
        ghenv.Component.AddRuntimeMessage(gh.Kernel.GH_RuntimeMessageLevel.Warning, msg)
    else:
        
        values_count = empty_field.x_count*empty_field.y_count*empty_field.z_count
        
        if len(values) == 0:
            check_data = False
            msg = "No field values provided"
            ghenv.Component.AddRuntimeMessage(gh.Kernel.GH_RuntimeMessageLevel.Warning, msg)
            
        elif values_count != len(values):
            check_data = False
            msg = "Field points and Values lists are not matching. Please provide a number of values matching the number of points in the base field."
            ghenv.Component.AddRuntimeMessage(gh.Kernel.GH_RuntimeMessageLevel.Error, msg)
    
    if check_data:
        #count = empty_field.return_count_vec()
        points = [rg.Point3d(v[0], v[1], v[2]) for v in empty_field.return_pts_list()]
        field = Field(name, points, empty_field.return_count_vec(), empty_field.resolution, boundaries = empty_field.boundaries, plane = empty_field.plane)
        field.set_values(values, use_boundaries = True)
        return field
    else:
        return -1


result = main(NAME, E_FIELD, VAL)

if result != -1:
    FIELD = result
# ---------- end field ----------
defield = Wasp_DeconstructField(FIELD=field)  # -> NAME, PTS, COUNT, RES, PLN, VAL, BOU, BB
#   port PLN: Field base plane
#   port BB: Field bounding box (aligned to the base plane)
# ---------- defield: Python ----------
# Wasp: Discrete Design with Grasshopper plug-in (GPL) initiated by Andrea Rossi
# 
# This file is part of Wasp.
# 
# Copyright (c) 2017, Andrea Rossi <a.rossi.andrea@gmail.com>
# Wasp is free software; you can redistribute it and/or modify 
# it under the terms of the GNU General Public License as published 
# by the Free Software Foundation; either version 3 of the License, 
# or (at your option) any later version. 
# 
# Wasp is distributed in the hope that it will be useful,
# but WITHOUT ANY WARRANTY; without even the implied warranty of 
# MERCHANTABILITY or FITNESS FOR A PARTICULAR PURPOSE. See the 
# GNU General Public License for more details.
# 
# You should have received a copy of the GNU General Public License
# along with Wasp; If not, see <http://www.gnu.org/licenses/>.
# 
# @license GPL-3.0 <https://www.gnu.org/licenses/gpl.html>
#
# Significant parts of Wasp have been developed by Andrea Rossi
# as part of research on digital materials and discrete design at:
# DDU Digital Design Unit - Prof. Oliver Tessmann
# Technische Universität Darmstadt


#########################################################################
##                            COMPONENT INFO                           ##
#########################################################################

"""
Generates a scalar field given a grid of points and their relative scalar values
-
Provided by Wasp 0.4
    Args:
        FIELD: Field to deconstruct
    Returns:
        NAME: Field name
        RES: Field resolution
        BOU: Field boundaries
        PTS: Field points
        VAL: Field values
        COUNT: Points count on x,y,z axes
"""

ghenv.Component.Name = "Wasp_Deconstruct Field"
ghenv.Component.NickName = 'DeField'
ghenv.Component.Message = 'VER 0.4.013'
ghenv.Component.IconDisplayMode = ghenv.Component.IconDisplayMode.application
ghenv.Component.Category = "Wasp"
ghenv.Component.SubCategory = "5 | Fields"
try: ghenv.Component.AdditionalHelpFromDocStrings = "1"
except: pass


import sys
import Rhino.Geometry as rg
import Grasshopper as gh


## add Wasp install directory to system path
wasp_loaded = False
ghcompfolder = gh.Folders.DefaultAssemblyFolder
if ghcompfolder not in sys.path:
    sys.path.append(ghcompfolder)
try:
    from wasp import __version__
    wasp_loaded = True
except:
    msg = "Cannot import Wasp. Is the wasp folder available in " + ghcompfolder + "?"
    ghenv.Component.AddRuntimeMessage(gh.Kernel.GH_RuntimeMessageLevel.Error, msg)

## if Wasp is installed correctly, load the classes required by the component
if wasp_loaded:
    pass


def main(field):
    
    check_data = True
    
    ##check inputs
    if field is None:
        check_data = False
        msg = "No field provided"
        ghenv.Component.AddRuntimeMessage(gh.Kernel.GH_RuntimeMessageLevel.Warning, msg)
    
    if check_data:
        count_vec = rg.Vector3d(field.x_count, field.y_count, field.z_count)
        return field.name, field.pts, count_vec, field.resolution, field.plane, field.return_values_list(), field.boundaries, field.bbox
    else:
        return -1


result = main(FIELD)

if result != -1:
    NAME = result[0]
    PTS = result[1]
    COUNT = result[2]
    RES = result[3]
    PLN = result[4]
    VAL = result[5]
    BOU = result[6]
    BB = result[7]
# ---------- end defield ----------
gradient_3 = Gradient(LowerLimit=0, UpperLimit=1, Parameter=defield.VAL, stops=[0: RGB(0, 128, 0), 0.5: RGB(255, 255, 0), 1: RGB(255, 0, 0)])
field_2 = Wasp_Field(NAME="f_02", E_FIELD=fieldpts.E_FIELD, VAL=graph_2)  # -> FIELD; inputs VAL: list; same code as field
xy_3 = XYPlane(Origin=pt_2)
rulegen = Wasp_RulesGenerator(PART=merge_4, SELF_P=Toggle(True), SELF_C=Toggle(False), TYP=Toggle(False), GR=panel_9)  # -> R; inputs PART: list, SELF_P: Boolean, SELF_C: Boolean, TYP: Boolean, GR: list
# ---------- rulegen: Python ----------
# Wasp: Discrete Design with Grasshopper plug-in (GPL) initiated by Andrea Rossi
# 
# This file is part of Wasp.
# 
# Copyright (c) 2017, Andrea Rossi <a.rossi.andrea@gmail.com>
# Wasp is free software; you can redistribute it and/or modify 
# it under the terms of the GNU General Public License as published 
# by the Free Software Foundation; either version 3 of the License, 
# or (at your option) any later version. 
# 
# Wasp is distributed in the hope that it will be useful,
# but WITHOUT ANY WARRANTY; without even the implied warranty of 
# MERCHANTABILITY or FITNESS FOR A PARTICULAR PURPOSE. See the 
# GNU General Public License for more details.
# 
# You should have received a copy of the GNU General Public License
# along with Wasp; If not, see <http://www.gnu.org/licenses/>.
# 
# @license GPL-3.0 <https://www.gnu.org/licenses/gpl.html>
#
# Significant parts of Wasp have been developed by Andrea Rossi
# as part of research on digital materials and discrete design at:
# DDU Digital Design Unit - Prof. Oliver Tessmann
# Technische Universität Darmstadt


#########################################################################
##                            COMPONENT INFO                           ##
#########################################################################

"""
Automated rules generator given a list of parts. It has two separate modes:
- If no grammar is provided in the GR input, the component generates rules between connections of the same type.
- If a grammar is provided, rules are created between connections of different types, according to the specified grammar rules.
-
Provided by Wasp 0.4
    Args:
        PART: Parts from which to generate aggregation rules
        SELF_P: OPTIONAL // Create rules between connections belonging to the same part (True by default)
        SELF_C: OPTIONAL // Create rules between connection with same id (True by default)
        TYP: OPTIONAL // Create rules only between connections of the same type (False by default). Make sure this component is set to False when using Rule Grammars.
        GR: OPTIONAL // Custom connection grammar with format "ConnType">"ConnType"
    Returns:
        R: Generated aggregation rules
"""

ghenv.Component.Name = "Wasp_Rules Generator"
ghenv.Component.NickName = 'RuleGen'
ghenv.Component.Message = 'VER 0.4.013'
ghenv.Component.IconDisplayMode = ghenv.Component.IconDisplayMode.application
ghenv.Component.Category = "Wasp"
ghenv.Component.SubCategory = "3 | Rules"
try: ghenv.Component.AdditionalHelpFromDocStrings = "2"
except: pass

import sys
import Grasshopper as gh


## add Wasp install directory to system path
wasp_loaded = False
ghcompfolder = gh.Folders.DefaultAssemblyFolder
if ghcompfolder not in sys.path:
    sys.path.append(ghcompfolder)
try:
    from wasp import __version__
    wasp_loaded = True
except:
    msg = "Cannot import Wasp. Is the wasp folder available in " + ghcompfolder + "?"
    ghenv.Component.AddRuntimeMessage(gh.Kernel.GH_RuntimeMessageLevel.Error, msg)

## if Wasp is installed correctly, load the classes required by the component
if wasp_loaded:
    from wasp.core import Rule


def main(parts, self_part, self_connection, use_types, grammar):
    
    check_data = True
    
    ##check inputs
    if len(parts) == 0 or parts is None:
        check_data = False
        msg = "No part provided"
        ghenv.Component.AddRuntimeMessage(gh.Kernel.GH_RuntimeMessageLevel.Warning, msg)
    
    if self_part == None:
        self_part = True
    
    if self_connection == None:
        self_connection = True
    
    if use_types is None:
        use_types = False
    
    if check_data:
        rules = []
        
        if len(grammar) == 0:
            for part in parts:
                for conn in part.connections:
                    for other_part in parts:
                        skip_part = False
                        if self_part == False:
                            if part.name == other_part.name:
                                skip_part = True
                            
                        if skip_part == False:
                            for other_conn in other_part.connections:
                                skip_conn = False
                                if self_connection == False:
                                    if conn.id == other_conn.id:
                                        skip_conn = True
                                
                                if skip_conn == False:
                                    if use_types:
                                        if conn.type == other_conn.type:
                                            r = Rule(part.name, conn.id, other_part.name, other_conn.id)
                                            rules.append(r)
                                    else:
                                        r = Rule(part.name, conn.id, other_part.name, other_conn.id)
                                        rules.append(r)
        else:
            for gr_rule in grammar:
                start_type = gr_rule.split(">")[0]
                end_type = gr_rule.split(">")[1]
                
                for part in parts:
                    for conn in part.connections:
                        if conn.type == start_type:
                            for other_part in parts:
                                skip_part = False
                                if self_part == False:
                                    if part.name == other_part.name:
                                        skip_part = True
                                    
                                if skip_part == False:
                                    for other_conn in other_part.connections:
                                        if other_conn.type == end_type:
                                            skip_conn = False
                                            if self_connection == False:
                                                if conn.id == other_conn.id:
                                                    skip_conn = True
                                            
                                            if skip_conn == False:
                                                r = Rule(part.name, conn.id, other_part.name, other_conn.id)
                                                rules.append(r)
        return [rules]
    else:
        return -1


result = main(PART, SELF_P, SELF_C, TYP, GR)

if result != -1:
    R = result[0]
# ---------- end rulegen ----------
derule = Wasp_DeconstructRule(R=rulegen)  # -> P1, C1, P2, C2, TXT
# ---------- derule: Python ----------
# Wasp: Discrete Design with Grasshopper plug-in (GPL) initiated by Andrea Rossi
# 
# This file is part of Wasp.
# 
# Copyright (c) 2017, Andrea Rossi <a.rossi.andrea@gmail.com>
# Wasp is free software; you can redistribute it and/or modify 
# it under the terms of the GNU General Public License as published 
# by the Free Software Foundation; either version 3 of the License, 
# or (at your option) any later version. 
# 
# Wasp is distributed in the hope that it will be useful,
# but WITHOUT ANY WARRANTY; without even the implied warranty of 
# MERCHANTABILITY or FITNESS FOR A PARTICULAR PURPOSE. See the 
# GNU General Public License for more details.
# 
# You should have received a copy of the GNU General Public License
# along with Wasp; If not, see <http://www.gnu.org/licenses/>.
# 
# @license GPL-3.0 <https://www.gnu.org/licenses/gpl.html>
#
# Significant parts of Wasp have been developed by Andrea Rossi
# as part of research on digital materials and discrete design at:
# DDU Digital Design Unit - Prof. Oliver Tessmann
# Technische Universität Darmstadt


#########################################################################
##                            COMPONENT INFO                           ##
#########################################################################

"""
Extract information from a rule instance.
-
Provided by Wasp 0.4
    Args:
        R: Rule
    Returns:
        P1: Name of base part
        C1: Id of base connection
        P2: Name of new part to be aggregated
        C2: Id of new connection
        TXT: Text representation of rule
"""

ghenv.Component.Name = "Wasp_Deconstruct Rule"
ghenv.Component.NickName = 'DeRule'
ghenv.Component.Message = 'VER 0.4.013'
ghenv.Component.IconDisplayMode = ghenv.Component.IconDisplayMode.application
ghenv.Component.Category = "Wasp"
ghenv.Component.SubCategory = "3 | Rules"
try: ghenv.Component.AdditionalHelpFromDocStrings = "1"
except: pass

import sys
import Grasshopper as gh


## add Wasp install directory to system path
wasp_loaded = False
ghcompfolder = gh.Folders.DefaultAssemblyFolder
if ghcompfolder not in sys.path:
    sys.path.append(ghcompfolder)
try:
    from wasp import __version__
    wasp_loaded = True
except:
    msg = "Cannot import Wasp. Is the wasp folder available in " + ghcompfolder + "?"
    ghenv.Component.AddRuntimeMessage(gh.Kernel.GH_RuntimeMessageLevel.Error, msg)

## if Wasp is installed correctly, load the classes required by the component
if wasp_loaded:
    from wasp.core import Rule


def main(rule):
    
    check_data = True
    
    ##check inputs
    if rule is None:
        check_data = False
        msg = "No rule provided"
        ghenv.Component.AddRuntimeMessage(gh.Kernel.GH_RuntimeMessageLevel.Warning, msg)
    
    if check_data:
        p1 = rule.part1
        c1 = rule.conn1
        p2 = rule.part2
        c2 = rule.conn2
        rule_txt = "%s|%s_%s|%s"%(p1,c1,p2,c2)
        
        return p1, c1, p2, c2, rule_txt
    else:
        return -1


result = main(R)

if result != -1:
    P1 = result[0]
    C1 = result[1]
    P2 = result[2]
    C2 = result[3]
    TXT = result[4]
# ---------- end derule ----------
cull_2 = CullPattern(List=gradient_3, CullPattern=defield.VAL)
ruleviz = Wasp_RulesVisualizer(PART=merge_4, R=rulegen, SF=Slider(2, range=0..10), PLN=xy_3, SI=Toggle(True), ST=Toggle(True))  # -> BP, NP, RTL, RT; inputs PART: list, R: list, PLN: Plane, SI: Boolean, ST: Boolean
# ---------- ruleviz: Python ----------
# Wasp: Discrete Design with Grasshopper plug-in (GPL) initiated by Andrea Rossi
# 
# This file is part of Wasp.
# 
# Copyright (c) 2017, Andrea Rossi <a.rossi.andrea@gmail.com>
# Wasp is free software; you can redistribute it and/or modify 
# it under the terms of the GNU General Public License as published 
# by the Free Software Foundation; either version 3 of the License, 
# or (at your option) any later version. 
# 
# Wasp is distributed in the hope that it will be useful,
# but WITHOUT ANY WARRANTY; without even the implied warranty of 
# MERCHANTABILITY or FITNESS FOR A PARTICULAR PURPOSE. See the 
# GNU General Public License for more details.
# 
# You should have received a copy of the GNU General Public License
# along with Wasp; If not, see <http://www.gnu.org/licenses/>.
# 
# @license GPL-3.0 <https://www.gnu.org/licenses/gpl.html>
#
# Significant parts of Wasp have been developed by Andrea Rossi
# as part of research on digital materials and discrete design at:
# DDU Digital Design Unit - Prof. Oliver Tessmann
# Technische Universität Darmstadt


#########################################################################
##                            COMPONENT INFO                           ##
#########################################################################

"""
Visualize the provided rules.
-
Provided by Wasp 0.4
    Args:
        PART: Parts from which to visualize the rules
        R: Rules to visualize
        SF: OPTIONAL // Spacing factor between rules visualizations (2.0 by default)
        PLN: OPTIONAL // If the rules should be visualized in a different location than the worldXY, base plane of the desired coordinate system
        SI: OPTIONAL // True to show rule index in the list, False to hide it (True by default)
        ST: OPTIONAL // True to show connection types, False to hide them (True by default)
    Returns:
        BP: Base part for the rule
        NP: Added part for the rule
        RTL: Rule text location
        RT: Rule text
"""

ghenv.Component.Name = "Wasp_Rules Visualizer"
ghenv.Component.NickName = 'RuleViz'
ghenv.Component.Message = 'VER 0.4.013'
ghenv.Component.IconDisplayMode = ghenv.Component.IconDisplayMode.application
ghenv.Component.Category = "Wasp"
ghenv.Component.SubCategory = "3 | Rules"
try: ghenv.Component.AdditionalHelpFromDocStrings = "2"
except: pass

import sys
import Grasshopper as gh
import Rhino.Geometry as rg
import math


## add Wasp install directory to system path
wasp_loaded = False
ghcompfolder = gh.Folders.DefaultAssemblyFolder
if ghcompfolder not in sys.path:
    sys.path.append(ghcompfolder)
try:
    from wasp import __version__
    wasp_loaded = True
except:
    msg = "Cannot import Wasp. Is the wasp folder available in " + ghcompfolder + "?"
    ghenv.Component.AddRuntimeMessage(gh.Kernel.GH_RuntimeMessageLevel.Error, msg)

## if Wasp is installed correctly, load the classes required by the component
if wasp_loaded:
    pass


def main(parts, rules, spacing_factor, base_plane, show_index, show_types):
    
    check_data = True
    
    ##check inputs
    if len(parts) == 0 or parts is None:
        check_data = False
        msg = "No part provided"
        ghenv.Component.AddRuntimeMessage(gh.Kernel.GH_RuntimeMessageLevel.Warning, msg)
    
    if len(rules) == 0 or rules is None:
        check_data = False
        msg = "No rules provided"
        ghenv.Component.AddRuntimeMessage(gh.Kernel.GH_RuntimeMessageLevel.Warning, msg)
    
    if spacing_factor == None:
        spacing_factor = 2.0
    
    if show_index is None:
        show_index = True
    
    if show_types is None:
        show_types = True
    
    if check_data:
        
        spacing = 0
        for part in parts:
            if part.dim > spacing:
                spacing = part.dim
        spacing *= 2.0
        spacing *= spacing_factor
        
        rows_count = int(math.ceil(math.sqrt(len(rules))))
        
        base_parts = []
        next_parts = []
        rule_texts = []
        rule_text_locs = []
        
        if base_plane != None:
            global_transform = rg.Transform.PlaneToPlane(rg.Plane.WorldXY, base_plane)
        
        for x in range(rows_count):
            for y in range(rows_count):
                
                rule_id = y + (x*rows_count)
                if rule_id >= len(rules):
                    break
                
                rule = rules[rule_id]
                
                first_part = None
                for part in parts:
                    if part.name == rule.part1:
                        first_part = part
                        break
                
                next_part = None
                for part in parts:
                    if part.name == rule.part2:
                        next_part = part
                        break
                
                grid_point = rg.Vector3d(x*spacing, y*spacing, 0)
                move_vec = rg.Vector3d.Subtract(grid_point, rg.Vector3d(first_part.center))
                move_trans = rg.Transform.Translation(move_vec)
                first_part = first_part.transform(move_trans)
                
                if base_plane != None:
                    first_part = first_part.transform(global_transform)
                
                orientTransform = rg.Transform.PlaneToPlane(next_part.connections[rule.conn2].flip_pln, first_part.connections[rule.conn1].pln)
                next_part = next_part.transform(orientTransform)
                
                base_parts.append(first_part)
                next_parts.append(next_part)
                
                text_loc = rg.Point3d(grid_point)
                text_loc.X -= spacing*0.5
                text_loc.Y -= spacing*0.5
                
                text_pln = rg.Plane(text_loc, rg.Vector3d.XAxis, rg.Vector3d.YAxis)
                
                if base_plane != None:
                    text_pln.Transform(global_transform)
                
                text = rule.ToString()
                text = text.replace("WaspRule [", "")
                text = text.replace("]", "")
                
                if show_index:
                    text = str(rule_id) + ": " + text
                
                if show_types:
                    text +="\n"
                    text += "%s>%s"%(first_part.connections[rule.conn1].type, next_part.connections[rule.conn2].type)
                
                rule_texts.append(text)
                rule_text_locs.append(text_pln)
                
            if rule_id >= len(rules):
                break
        return base_parts, next_parts, rule_texts, rule_text_locs
    else:
        return -1

result = main(PART, R, SF, PLN, SI, ST)

if result != -1:
    BP = result[0]
    NP = result[1]
    RT = result[2]
    RTL = result[3]
# ---------- end ruleviz ----------
cull_3 = CullPattern(List=defield.PTS, CullPattern=defield.VAL)
panel_10 = Panel(derule.TXT)
xz = XZPlane(Origin=Point(0, 0, 0))
preview_3 = CustomPreview(Geometry=cull_3, Shader=cull_2)
geo_2 = Geometry(defield.BB)
pln = Plane(defield.PLN)
tag_2 = TextTag3D(Location=ruleviz.RTL, Text=ruleviz.RT, Size=Slider(8, range=0..10), Justification=7)
wires = BrepWireframe(Brep=defield.BB, Density=-1)
partgeo_2 = Wasp_GetPartGeometry(PART=ruleviz.NP)  # -> GEO; same code as partgeo
partgeo_3 = Wasp_GetPartGeometry(PART=ruleviz.BP)  # -> GEO; same code as partgeo
range = Range(Domain=Domain(0, 1), Steps=Slider(45, range=0..100))
prot_2 = RotatePlane(Plane=xz, Angle=degrees(Slider(35, range=0..100)))
merge_5 = Merge(Data1=field, Data2=field_2)
orient = Orient(Source=defield.PLN, Target=prot_2)  # -> Geometry, Transform
preview_4 = CustomPreview(Geometry=partgeo_2, Material=ColourSwatch(SwatchColor=RGB(255, 0, 0)))
preview_5 = CustomPreview(Geometry=partgeo_3, Material=ColourSwatch(SwatchColor=RGB(255, 255, 255)))
fieldorient = Wasp_OrientField(FIELD=field, PLN=prot_2)  # -> F_TR; inputs PLN: Plane
# ---------- fieldorient: Python ----------
# Wasp: Discrete Design with Grasshopper plug-in (GPL) initiated by Andrea Rossi
# 
# This file is part of Wasp.
# 
# Copyright (c) 2017, Andrea Rossi <a.rossi.andrea@gmail.com>
# Wasp is free software; you can redistribute it and/or modify 
# it under the terms of the GNU General Public License as published 
# by the Free Software Foundation; either version 3 of the License, 
# or (at your option) any later version. 
# 
# Wasp is distributed in the hope that it will be useful,
# but WITHOUT ANY WARRANTY; without even the implied warranty of 
# MERCHANTABILITY or FITNESS FOR A PARTICULAR PURPOSE. See the 
# GNU General Public License for more details.
# 
# You should have received a copy of the GNU General Public License
# along with Wasp; If not, see <http://www.gnu.org/licenses/>.
# 
# @license GPL-3.0 <https://www.gnu.org/licenses/gpl.html>
#
# Significant parts of Wasp have been developed by Andrea Rossi
# as part of research on digital materials and discrete design at:
# DDU Digital Design Unit - Prof. Oliver Tessmann
# Technische Universität Darmstadt


#########################################################################
##                            COMPONENT INFO                           ##
#########################################################################

"""
Changes the base plane of the field, with the effect of creating a transformed copy.
-
Provided by Wasp 0.4
    Args:
        FIELD: Field to be transformed
        PLN: Target plane
    Returns:
        F_TR: Transformed field
"""

ghenv.Component.Name = "Wasp_Orient Field"
ghenv.Component.NickName = 'FieldOrient'
ghenv.Component.Message = 'VER 0.4.013'
ghenv.Component.IconDisplayMode = ghenv.Component.IconDisplayMode.application
ghenv.Component.Category = "Wasp"
ghenv.Component.SubCategory = "5 | Fields"
try: ghenv.Component.AdditionalHelpFromDocStrings = "1"
except: pass

import sys
import Grasshopper as gh
import Rhino.Geometry as rg
import math


## add Wasp install directory to system path
wasp_loaded = False
ghcompfolder = gh.Folders.DefaultAssemblyFolder
if ghcompfolder not in sys.path:
    sys.path.append(ghcompfolder)
try:
    from wasp import __version__
    wasp_loaded = True
except:
    msg = "Cannot import Wasp. Is the wasp folder available in " + ghcompfolder + "?"
    ghenv.Component.AddRuntimeMessage(gh.Kernel.GH_RuntimeMessageLevel.Error, msg)

## if Wasp is installed correctly, load the classes required by the component
if wasp_loaded:
    from wasp.core import Part


def main(field, target_plane):
    
    check_data = True
    
    ##check inputs
    if field is None:
        check_data = False
        msg = "Please provide a valid field to be transformed"
        ghenv.Component.AddRuntimeMessage(gh.Kernel.GH_RuntimeMessageLevel.Warning, msg)
    
    if target_plane is None:
        check_data = False
        msg = "Please provide a valid transformation"
        ghenv.Component.AddRuntimeMessage(gh.Kernel.GH_RuntimeMessageLevel.Warning, msg)
    
    if check_data:
        ## create a plane-to-plane transformation
        orient_transform = rg.Transform.PlaneToPlane(field.plane, target_plane)
        ## transform part
        field_trans = field.transform(orient_transform)
        
        ## flip part if negative scaling occurs
        if orient_transform.M00 * orient_transform.M11 * orient_transform.M22 < 0:
            ## geometry
            for bou in field_trans.boundaries:
                bou.Flip(True, True, True)
        
        return field_trans
    else:
        return -1


result = main(FIELD, PLN)

if result != -1:
    F_TR = result
# ---------- end fieldorient ----------
dom_2 = ConstructDomain(DomainStart=Slider(0.1, range=0..1), DomainEnd=Slider(0.9, range=0..1))
brep_2 = Brep(<brep referenced from the Rhino model>)
brep_3 = Brep(<brep referenced from the Rhino model>)
number_slider_13 = Slider(0.282, range=0..1)
brep_4 = Brep(<brep referenced from the Rhino model>)
panel_11 = Panel("""50
100""")
range_2 = Range(Domain=dom_2, Steps=10)
mesh_3 = MeshBrep(
    Brep=brep_2,
    Settings={GridMaxCount=0, GridMinCount=16, JaggedSeams=False, MaxEdgeLength=0, MinEdgeLength=0.0001, MinTolerance=0, Refine=True, RefineAngle=0, RelativeTolerance=0.65, SimplePlanes=True, Tolerance=0})
mesh_4 = MeshBrep(
    Brep=brep_3,
    Settings={GridMaxCount=0, GridMinCount=16, JaggedSeams=False, MaxEdgeLength=0, MinEdgeLength=0.0001, MinTolerance=0, Refine=True, RefineAngle=0, RelativeTolerance=0.65, SimplePlanes=True, Tolerance=0})
mesh_5 = MeshBrep(
    Brep=brep_4,
    Settings={GridMaxCount=0, GridMinCount=16, JaggedSeams=False, MaxEdgeLength=0, MinEdgeLength=0.0001, MinTolerance=0, Refine=True, RefineAngle=0, RelativeTolerance=0.65, SimplePlanes=True, Tolerance=0})
xz_2 = XZPlane(Origin=Point(0, 0, 0))
yz = YZPlane(Origin=Point(0, 0, 0))

# ---- group: OK
fieldaggregation = Wsp_FieldDrivenAggregation(
    PART=flatten(merge_4),
    N=fieldn,
    RULES=ruletxt,
    FIELD=field,
    THRES=number_slider_11,
    MODE=wasp_aggregation_mode,
    ID=panel_3,
    RESET=button)  # -> PART_OUT; inputs PART: list, PREV: list, N: Int32, RULES: list, COLL: Boolean, MODE: Int32, RESET: Boolean; disabled
# ---------- fieldaggregation: Python ----------
# Wasp: Discrete Design with Grasshopper plug-in (GPL) initiated by Andrea Rossi
# 
# This file is part of Wasp.
# 
# Copyright (c) 2017, Andrea Rossi <a.rossi.andrea@gmail.com>
# Wasp is free software; you can redistribute it and/or modify 
# it under the terms of the GNU General Public License as published 
# by the Free Software Foundation; either version 3 of the License, 
# or (at your option) any later version. 
# 
# Wasp is distributed in the hope that it will be useful,
# but WITHOUT ANY WARRANTY; without even the implied warranty of 
# MERCHANTABILITY or FITNESS FOR A PARTICULAR PURPOSE. See the 
# GNU General Public License for more details.
# 
# You should have received a copy of the GNU General Public License
# along with Wasp; If not, see <http://www.gnu.org/licenses/>.
# 
# @license GPL-3.0 <https://www.gnu.org/licenses/gpl.html>
#
# Significant parts of Wasp have been developed by Andrea Rossi
# as part of research on digital materials and discrete design at:
# DDU Digital Design Unit - Prof. Oliver Tessmann
# Technische Universität Darmstadt


#########################################################################
##                            COMPONENT INFO                           ##
#########################################################################

"""
Aggregate the given parts according to a given scalar field. New parts are added following higher values in the field.
The component works additively, hence increasing the number of parts in an aggregation just adds new parts on the existing ones, without triggering recomputing of the previous element
-
Provided by Wasp 0.1.0
    Args:
        PART: Parts to be aggregated (can be more than one)
        PREV: Previous aggregated parts. It is possible to input the results of a previous aggregation, or parts transformed with the TransformPart component
        N: Number of parts to be aggregated (does not count parts provided in PREV)
        RULES: Rules for the aggregation
        FIELD: Scalar field to drive the aggregation (parts will be added following higher values in the field)
        THRES: OPTIONAL // If set, used to define a threshold value above which the placement of next part is accepted. If not set, aggregation will look for part with highest value in the whole field. Setting a low threshold helds less accurate results, but highly speeds up calculations
        COLL: OPTIONAL // Collision detection. By default is active and checks for collisions between the aggregated parts
        MODE: OPTIONAL // Switches between aggregation modes: 0 = Basic (Default: only parts collision check), 1 = Constrained (checks all constraints set on the part)
        ID: OPTIONAL // Aggregation ID (to avoid overwriting when having different aggregation components in the same file)
        RESET: Recompute the whole aggregation
    Returns:
        PART_OUT: Aggregated parts (includes both PREV input and newly aggregated parts)
"""

ghenv.Component.Name = "Wsp_Field-driven Aggregation"
ghenv.Component.NickName = 'FieldAggregation'
ghenv.Component.Message = 'VER 0.1.0\nDEC_22_2017'
ghenv.Component.IconDisplayMode = ghenv.Component.IconDisplayMode.application
ghenv.Component.Category = "Wasp"
ghenv.Component.SubCategory = "4 | Aggregation"
try: ghenv.Component.AdditionalHelpFromDocStrings = "2"
except: pass


import scriptcontext as sc
import Rhino.Geometry as rg
import Grasshopper.Kernel as gh
import random as rnd
import math
import copy


## find the rule that creates a component as closest as possible to the target surface
def findBestRule(aggr_id, aggr_parts, aggr_field, thres, aggr_coll, aggr_mode):
    max_val = None
    best_rule = None
    best_conn = None
    best_conn_id = -1
    
    for i in range(len(sc.sticky[aggr_id])):
        part_01 = sc.sticky[aggr_id][i]
        for i2 in range(len(part_01.active_connections)-1, -1, -1):
            conn_01_id = part_01.active_connections[i2]
            conn_01 = part_01.connections[conn_01_id]
            for i3 in range(len(conn_01.active_rules)-1, -1, -1):
                rule_id = conn_01.active_rules[i3]
                rule = conn_01.rules_table[rule_id]
                
                next_part = None
                for part in aggr_parts:
                    if part.name == rule.part2:
                        next_part = part
                        break
                
                next_center = rg.Point3d(next_part.center)
                orientTransform = rg.Transform.PlaneToPlane(next_part.connections[rule.conn2].flip_pln, conn_01.pln)
                next_center.Transform(orientTransform)
                    
                if aggr_field.bbox.Contains(next_center) == True:
                    current_target_val = aggr_field.return_pt_val(next_center)
                
                    if current_target_val > max_val or max_val == None:
                        
                        if next_center is None:
                            next_center = rg.Point3d(next_part.center)
                            orientTransform = rg.Transform.PlaneToPlane(next_part.connections[rule.conn2].flip_pln, conn_01.pln)
                            next_center.Transform(orientTransform)
                        
                        ## overlap check
                        close_neighbour_check = False
                        for ex_part in sc.sticky[aggr_id]:
                            dist = ex_part.center.DistanceTo(next_center)
                            if dist < sc.sticky['model_tolerance']:
                                close_neighbour_check = True
                                break
                        
                        ## collision check
                        collision_check = False
                        if aggr_coll == True and close_neighbour_check == False:
                            next_part_collider = next_part.transform_collider(orientTransform)
                            for ex_part in sc.sticky[aggr_id]:
                                if len(rg.Intersect.Intersection.MeshMeshFast(ex_part.collider, next_part_collider)) > 0:
                                    collision_check = True
                                    break
                        
                        ## constraints check
                        add_collision_check = False
                        missing_supports_check = False
                        if aggr_mode == 1:
                            if close_neighbour_check == False and collision_check == False:
                                if next_part.is_constrained:
                                    
                                    ## additional collider check
                                    if next_part.add_collider != None:
                                        add_collider = next_part.add_collider.Duplicate()
                                        add_collider.Transform(orientTransform)
                                        for ex_part in sc.sticky[aggr_id]:
                                            intersections = rg.Intersect.Intersection.MeshMeshFast(ex_part.collider, add_collider)
                                            if len(intersections) > 0:
                                                add_collision_check = True
                                                break
                                    
                                    ## supports check
                                    if add_collision_check == False:
                                        if len(next_part.supports) > 0:
                                            for sup in next_part.supports:
                                                missing_supports_check = True
                                                supports_count = 0
                                                for dir in sup.sup_dir:
                                                    dir_trans = dir.Duplicate()
                                                    dir_trans.Transform(orientTransform)
                                                    
                                                    for ex_part in sc.sticky[aggr_id]:
                                                        if len(rg.Intersect.Intersection.MeshPolyline(ex_part.collider, dir_trans)[0]) > 0:
                                                            supports_count += 1
                                                            break
                                                if supports_count == len(sup.sup_dir):
                                                    missing_supports_check = False
                                                    break
                        
                        
                        if close_neighbour_check == False and collision_check == False and add_collision_check == False and missing_supports_check == False:
                            max_val = current_target_val
                            best_rule = rule
                            best_conn = conn_01
                            best_part_id = i
                            best_conn_id = conn_01_id
                            
                            if thres is not None and max_val > thres:
                                break
                            
                        elif missing_supports_check == False:
                            ## remove rules if they cause collisions or overlappings
                            for i4 in range(len(sc.sticky[aggr_id][i].connections[conn_01_id].active_rules)):
                               if sc.sticky[aggr_id][i].connections[conn_01_id].active_rules[i4] == rule_id:
                                   sc.sticky[aggr_id][i].connections[conn_01_id].active_rules.pop(i4)
                                   break
                            ## check if the connection is still active (still active rules available)
                            if len(sc.sticky[aggr_id][i].connections[conn_01_id].active_rules) == 0:
                               for i4 in range(len(sc.sticky[aggr_id][i].active_connections)):
                                if sc.sticky[aggr_id][i].active_connections[i4] == conn_01_id:
                                    sc.sticky[aggr_id][i].active_connections.pop(i4)
                                    break
            if thres is not None and max_val > thres:
                break
        if thres is not None and max_val > thres:
            break
    
    if best_rule is not None:
        return best_conn, best_part_id, best_conn_id, best_rule.part2, best_rule.conn2, best_rule
    else:
        return -1, -1, -1, -1, -1, -1



def aggregate_field(aggr_id, aggr_parts, aggr_rules, aggr_field, aggr_threshold, iter, aggr_coll, aggr_mode):
    count = 0
    loops = 0
    while count < iter:
        ## avoid endless loops
        loops += 1
        if loops > iter*100:
            break
        
        ## if no part is present in the aggregation, add first random part
        if len(sc.sticky[aggr_id]) == 0:
            count += 1
            first_part = aggr_parts[rnd.randint(0, len(aggr_parts)-1)]
            
            start_point = aggr_field.highest_pt
            mov_vec = rg.Vector3d.Subtract(rg.Vector3d(start_point), rg.Vector3d(first_part.center))
            move_transform = rg.Transform.Translation(mov_vec.X, mov_vec.Y, mov_vec.Z)
            first_part_trans = first_part.transform(move_transform)
            
            for conn in first_part_trans.connections:
                conn.generate_rules_table(aggr_rules)
            
            sc.sticky[aggr_id].append(first_part_trans)
        
        else:
            ## select part-rule couple creating next part in the highest point of field
            conn_01, part_01_id, conn_01_id, next_part_name, next_conn_id, next_rule = findBestRule(aggr_id, aggr_parts, aggr_field, aggr_threshold, aggr_coll, aggr_mode)
            
            if conn_01_id == -1:
                msg = "aborted after " + str(count) + " iterations"
                ghenv.Component.AddRuntimeMessage(gh.GH_RuntimeMessageLevel.Warning, msg)
                break
            
            next_part = None
            for part in aggr_parts:
                if part.name == next_part_name:
                    next_part = part
            
            orientTransform = rg.Transform.PlaneToPlane(next_part.connections[next_conn_id].flip_pln, conn_01.pln)
            next_part_center = next_part.transform_center(orientTransform)
            
            next_part_trans = next_part.transform(orientTransform)
            next_part_trans.reset_part(aggr_rules)
            for i in range(len(next_part_trans.active_connections)):
                if next_part_trans.active_connections[i] == next_rule.conn2:
                    next_part_trans.active_connections.pop(i)
                    break
            sc.sticky[aggr_id].append(next_part_trans)
            
            count += 1


## Main code execution
def main(parts, previous_parts, num_parts, rules, field, threshold, collision, aggregation_mode, aggregation_id, reset):
    
    ## check if Wasp is setup
    if sc.sticky.has_key('WaspSetup'):
        
        check_data = True
        ##check inputs
        if len(parts) == 0:
            check_data = False
            msg = "No parts provided"
            ghenv.Component.AddRuntimeMessage(gh.GH_RuntimeMessageLevel.Warning, msg)
        
        if num_parts is None:
            check_data = False
            msg = "Provide number of aggregation iterations"
            ghenv.Component.AddRuntimeMessage(gh.GH_RuntimeMessageLevel.Warning, msg)
        else:
            if len(previous_parts) != 0:
                num_parts += len(previous_parts)
        
        if len(rules) == 0:
            check_data = False
            msg = "No rules provided"
            ghenv.Component.AddRuntimeMessage(gh.GH_RuntimeMessageLevel.Warning, msg)
        
        if field is None:
            check_data = False
            msg = "Provide a valid scalar field"
            ghenv.Component.AddRuntimeMessage(gh.GH_RuntimeMessageLevel.Warning, msg)
        
        if collision is None:
            collision = True
        
        if aggregation_id is None:
            aggregation_id = 'Aggregation'
            msg = "Default name 'Aggregation' assigned"
            ghenv.Component.AddRuntimeMessage(gh.GH_RuntimeMessageLevel.Remark, msg)
        
        if reset is None:
            reset = False
        
        if check_data:
            if sc.sticky.has_key(aggregation_id) == False:
                sc.sticky[aggregation_id] = []
            
            if reset:
                sc.sticky[aggregation_id] = []
                
                for part in parts:
                    part.reset_part(rules)
                
                if len(previous_parts) > 0:
                    for part in previous_parts:
                        part.reset_part(rules)
                        sc.sticky[aggregation_id].append(part)
            
            if num_parts > len(sc.sticky[aggregation_id]):
                aggregate_field(aggregation_id, parts, rules, field, threshold, num_parts - len(sc.sticky[aggregation_id]), collision, aggregation_mode)
                if len(sc.sticky[aggregation_id]) < num_parts:
                    msg = "Could not place " + str(num_parts - len(sc.sticky[aggregation_id])) + " parts"
                    ghenv.Component.AddRuntimeMessage(gh.GH_RuntimeMessageLevel.Warning, msg)
            
            elif num_parts < len(sc.sticky[aggregation_id]):
                sc.sticky[aggregation_id] = sc.sticky[aggregation_id][:num_parts]
                for part in sc.sticky[aggregation_id]:
                    part.reset_part(rules)
                
                for part in parts:
                    part.reset_part(rules)
            
            return sc.sticky[aggregation_id]
            
        else:
            return -1
    
    else:
        ## throw warining
        msg = "You must run the SetupWasp component before starting to build!"
        ghenv.Component.AddRuntimeMessage(gh.GH_RuntimeMessageLevel.Warning, msg)
        return -1


result = main(PART, PREV, N, RULES, FIELD, THRES, COLL, MODE, ID, RESET)

if result != -1:
    PART_OUT = result
# ---------- end fieldaggregation ----------

# ----
number_slider_14 = Slider(300, range=0..1000)  # disabled
number_slider_15 = Slider(40, range=0..100)  # disabled
dom_3 = ConstructDomain(DomainStart=expr("-x", number_slider_14), DomainEnd=number_slider_14)  # disabled
range_3 = Range(Domain=Domain(0, 1), Steps=number_slider_15)  # disabled
pt_3 = ConstructPoint(XCoordinate=range_3, YCoordinate=range_3, ZCoordinate=range_3)  # disabled
planesrf = PlaneSurface(Plane=xz_2, XSize=dom_3, YSize=dom_3)  # disabled
planesrf_2 = PlaneSurface(Plane=yz, XSize=dom_3, YSize=dom_3)  # disabled
iso = IsoCurve(Surface=reparameterize(planesrf), UVPoint=pt_3)  # -> UIsocurve, VIsocurve; disabled
iso_2 = IsoCurve(Surface=reparameterize(planesrf_2), UVPoint=pt_3)  # -> UIsocurve, VIsocurve; disabled

partcat = Wasp_PartsCatalog()  # -> CAT; inputs PART: list, NUM: list of Int32, LIM: Boolean
# ---------- partcat: Python ----------
# Wasp: Discrete Design with Grasshopper plug-in (GPL) initiated by Andrea Rossi
# 
# This file is part of Wasp.
# 
# Copyright (c) 2017, Andrea Rossi <a.rossi.andrea@gmail.com>
# Wasp is free software; you can redistribute it and/or modify 
# it under the terms of the GNU General Public License as published 
# by the Free Software Foundation; either version 3 of the License, 
# or (at your option) any later version. 
# 
# Wasp is distributed in the hope that it will be useful,
# but WITHOUT ANY WARRANTY; without even the implied warranty of 
# MERCHANTABILITY or FITNESS FOR A PARTICULAR PURPOSE. See the 
# GNU General Public License for more details.
# 
# You should have received a copy of the GNU General Public License
# along with Wasp; If not, see <http://www.gnu.org/licenses/>.
# 
# @license GPL-3.0 <https://www.gnu.org/licenses/gpl.html>
#
# Significant parts of Wasp have been developed by Andrea Rossi
# as part of research on digital materials and discrete design at:
# DDU Digital Design Unit - Prof. Oliver Tessmann
# Technische Universität Darmstadt


#########################################################################
##                            COMPONENT INFO                           ##
#########################################################################

"""
Part Catalog. It allows to define a fixed number of each type of part to be used in a stochastic aggregation.
-
Provided by Wasp 0.4
    Args:
        PART: Parts from which to generate a parts catalog
        NUM: Amounts of each part in the catalog
        LIM: OPTIONAL // If True, the catalog will be limited, and aggregation will stop after using the given parts numbers. If False, the given numbers will be used as proportional (False by default)
    Returns:
        CAT: Parts catalog
"""

ghenv.Component.Name = "Wasp_Parts Catalog"
ghenv.Component.NickName = 'PartCat'
ghenv.Component.Message = 'VER 0.4.013'
ghenv.Component.IconDisplayMode = ghenv.Component.IconDisplayMode.application
ghenv.Component.Category = "Wasp"
ghenv.Component.SubCategory = "2 | Parts"
try: ghenv.Component.AdditionalHelpFromDocStrings = "4"
except: pass

import sys
import scriptcontext as sc
import Grasshopper as gh

## add Wasp install directory to system path
wasp_loaded = False
ghcompfolder = gh.Folders.DefaultAssemblyFolder
if ghcompfolder not in sys.path:
    sys.path.append(ghcompfolder)
try:
    from wasp import __version__
    wasp_loaded = True
except:
    msg = "Cannot import Wasp. Is the wasp folder available in " + ghcompfolder + "?"
    ghenv.Component.AddRuntimeMessage(gh.Kernel.GH_RuntimeMessageLevel.Error, msg)

## if Wasp is installed correctly, load the classes required by the component
if wasp_loaded:
    from wasp.core import PartCatalog

def main(parts, amounts, limited):
    
    check_data = True
    
    ##check inputs
    if len(parts) == 0:
        check_data = False
        msg = "No part provided"
        ghenv.Component.AddRuntimeMessage(gh.Kernel.GH_RuntimeMessageLevel.Warning, msg)
    
    if len(amounts) == 0:
        check_data = False
        msg = "No part amounts provided"
        ghenv.Component.AddRuntimeMessage(gh.Kernel.GH_RuntimeMessageLevel.Warning, msg)
    
    elif len(amounts) == 1:
        amount = amounts[0]
        amounts = []
        for part in parts:
            amounts.append(amount)
    
    elif len(amounts) != len(parts):
        check_data = False
        msg = "Different amount of parts and part amounts"
        ghenv.Component.AddRuntimeMessage(gh.Kernel.GH_RuntimeMessageLevel.Error, msg)
    
    if limited is None:
        limited = True
    
    if check_data:
        part_names = [part.name for part in parts]
        parts_catalog = PartCatalog(part_names, amounts, _is_limited = limited)
        return parts_catalog
    else:
        return -1


result = main(PART, NUM, LIM)

if result != -1:
    CAT = result
# ---------- end partcat ----------
partcat_2 = Wasp_PartsCatalog(PART=flatten(merge_4), NUM=panel_11, LIM=Toggle(False), AD=Toggle(True))  # -> CAT; inputs PART: list, NUM: list, LIM: Boolean, AD: Boolean
# ---------- partcat_2: Python ----------
# Wasp: Discrete Design with Grasshopper plug-in (GPL) initiated by Andrea Rossi
# 
# This file is part of Wasp.
# 
# Copyright (c) 2017, Andrea Rossi <a.rossi.andrea@gmail.com>
# Wasp is free software; you can redistribute it and/or modify 
# it under the terms of the GNU General Public License as published 
# by the Free Software Foundation; either version 3 of the License, 
# or (at your option) any later version. 
# 
# Wasp is distributed in the hope that it will be useful,
# but WITHOUT ANY WARRANTY; without even the implied warranty of 
# MERCHANTABILITY or FITNESS FOR A PARTICULAR PURPOSE. See the 
# GNU General Public License for more details.
# 
# You should have received a copy of the GNU General Public License
# along with Wasp; If not, see <http://www.gnu.org/licenses/>.
# 
# @license GPL-3.0 <https://www.gnu.org/licenses/gpl.html>
#
# Significant parts of Wasp have been developed by Andrea Rossi
# as part of research on digital materials and discrete design at:
# DDU Digital Design Unit - Prof. Oliver Tessmann
# Technische Universität Darmstadt


#########################################################################
##                            COMPONENT INFO                           ##
#########################################################################

"""
Part Catalog. It allows to define a fixed number of each type of part to be used in a stochastic aggregation.
-
Provided by Wasp 0.4
    Args:
        PART: Parts from which to generate a parts catalog
        NUM: Amounts of each part in the catalog
        LIM: OPTIONAL // If True, the catalog will be limited, and aggregation will stop after using the given parts numbers. If False, the given numbers will be used as proportional (False by default)
        AD: OPTIONAL // If True, catalog will be adaptive, and change its internal probabilities according to the aggregation state (False by default). Works only if LIM is set to False.
    Returns:
        CAT: Parts catalog
"""

ghenv.Component.Name = "Wasp_Parts Catalog"
ghenv.Component.NickName = 'PartCat'
ghenv.Component.Message = 'VER 0.4.014'
ghenv.Component.IconDisplayMode = ghenv.Component.IconDisplayMode.application
ghenv.Component.Category = "Wasp"
ghenv.Component.SubCategory = "2 | Parts"
try: ghenv.Component.AdditionalHelpFromDocStrings = "4"
except: pass

import sys
import scriptcontext as sc
import Grasshopper as gh

## add Wasp install directory to system path
wasp_loaded = False
ghcompfolder = gh.Folders.DefaultAssemblyFolder
if ghcompfolder not in sys.path:
    sys.path.append(ghcompfolder)
try:
    from wasp import __version__
    wasp_loaded = True
except:
    msg = "Cannot import Wasp. Is the wasp folder available in " + ghcompfolder + "?"
    ghenv.Component.AddRuntimeMessage(gh.Kernel.GH_RuntimeMessageLevel.Error, msg)

## if Wasp is installed correctly, load the classes required by the component
if wasp_loaded:
    from wasp.core import PartCatalog

def main(parts, amounts, limited, adaptive):
    
    check_data = True
    
    ##check inputs
    if len(parts) == 0:
        check_data = False
        msg = "No part provided"
        ghenv.Component.AddRuntimeMessage(gh.Kernel.GH_RuntimeMessageLevel.Warning, msg)
    
    if len(amounts) == 0:
        check_data = False
        msg = "No part amounts provided"
        ghenv.Component.AddRuntimeMessage(gh.Kernel.GH_RuntimeMessageLevel.Warning, msg)
    
    elif len(amounts) == 1:
        amount = amounts[0]
        amounts = []
        for part in parts:
            amounts.append(amount)
    
    elif len(amounts) != len(parts):
        check_data = False
        msg = "Different amount of parts and part amounts"
        ghenv.Component.AddRuntimeMessage(gh.Kernel.GH_RuntimeMessageLevel.Error, msg)
    
    if limited is None:
        limited = True
    
    if adaptive is None:
        adaptive = False
    
    if check_data:
        part_names = [part.name for part in parts]
        parts_catalog = PartCatalog(part_names, amounts, _is_limited = limited, _is_adaptive = adaptive)
        return parts_catalog
    else:
        return -1


result = main(PART, NUM, LIM, AD)

if result != -1:
    CAT = result
# ---------- end partcat_2 ----------
planeconst = Wasp_PlaneConstraint(PLN=xz_2, POS=Toggle(False), SOFT=Toggle(False), REQ=Toggle(True))  # -> PC; inputs PLN: Plane, POS: Boolean, SOFT: Boolean, REQ: Boolean, PART: list
# ---------- planeconst: Python ----------
# Wasp: Discrete Design with Grasshopper plug-in (GPL) initiated by Andrea Rossi
# 
# This file is part of Wasp.
# 
# Copyright (c) 2017, Andrea Rossi <a.rossi.andrea@gmail.com>
# Wasp is free software; you can redistribute it and/or modify 
# it under the terms of the GNU General Public License as published 
# by the Free Software Foundation; either version 3 of the License, 
# or (at your option) any later version. 
# 
# Wasp is distributed in the hope that it will be useful,
# but WITHOUT ANY WARRANTY; without even the implied warranty of 
# MERCHANTABILITY or FITNESS FOR A PARTICULAR PURPOSE. See the 
# GNU General Public License for more details.
# 
# You should have received a copy of the GNU General Public License
# along with Wasp; If not, see <http://www.gnu.org/licenses/>.
# 
# @license GPL-3.0 <https://www.gnu.org/licenses/gpl.html>
#
# Significant parts of Wasp have been developed by Andrea Rossi
# as part of research on digital materials and discrete design at:
# DDU Digital Design Unit - Prof. Oliver Tessmann
# Technische Universität Darmstadt


#########################################################################
##                            COMPONENT INFO                           ##
#########################################################################

"""
Plane global constraint
-
Provided by Wasp 0.4
    Args:
        PLN: Plane to use as constraints
        POS: OPTIONAL // True to place parts on the positive direction of the Z axis, False for the negative direction (True by default)
        SOFT: OPTIONAL // True to check only the part center point, False to check also for geometry intersection (True by default)
        REQ: OPTIONAL // True to make the constrains necessary for the aggregation to happen, False to make it optional (True by default)
        PART: OPTIONAL // Name of the parts to which the constraint is supposed to be applied on. If not specified, the constraint is applied to all parts
    Returns:
        PC: Plane constraint
"""

ghenv.Component.Name = "Wasp_Plane Constraint"
ghenv.Component.NickName = 'PlaneConst'
ghenv.Component.Message = "VER 0.4.013"
ghenv.Component.IconDisplayMode = ghenv.Component.IconDisplayMode.application
ghenv.Component.Category = "Wasp"
ghenv.Component.SubCategory = "4 | Constraints"
try: ghenv.Component.AdditionalHelpFromDocStrings = "2"
except: pass

import sys
import Rhino.Geometry as rg
import Grasshopper as gh

## add Wasp install directory to system path
wasp_loaded = False
ghcompfolder = gh.Folders.DefaultAssemblyFolder
if ghcompfolder not in sys.path:
    sys.path.append(ghcompfolder)
try:
    from wasp import __version__
    wasp_loaded = True
except:
    msg = "Cannot import Wasp. Is the wasp folder available in " + ghcompfolder + "?"
    ghenv.Component.AddRuntimeMessage(gh.Kernel.GH_RuntimeMessageLevel.Error, msg)

## if Wasp is installed correctly, load the classes required by the component
if wasp_loaded:
    from wasp.core import Plane_Constraint


## Main code execution
def main(plane, positive, soft_constraint, is_required, parts):
    
    check_data = True
    ##check inputs
    if plane is None:
        check_data = False
        msg = "Provide a valid plane"
        ghenv.Component.AddRuntimeMessage(gh.Kernel.GH_RuntimeMessageLevel.Warning, msg)
    
    if positive is None:
        positive = True
    
    if soft_constraint is None:
        soft_constraint = True
    
    if is_required is None:
        is_required = True
    
    if check_data:
        plane_constraint = Plane_Constraint(plane, _positive = positive, _soft = soft_constraint, _required = is_required, _parts=parts)
        return plane_constraint
        
    else:
        return -1


result = main(PLN, POS, SOFT, REQ, PART)

if result != -1:
    PC = result
# ---------- end planeconst ----------
planeconst_2 = Wasp_PlaneConstraint(PLN=yz, POS=Toggle(True), SOFT=Toggle(False), REQ=Toggle(False))  # -> PC; inputs PLN: Plane, POS: Boolean, SOFT: Boolean, REQ: Boolean, PART: list; same code as planeconst
meshconst = Wasp_MeshConstraint(GEO=mesh_3, IN=Toggle(True), SOFT=Toggle(False), REQ=Toggle(False), PART="L2")  # -> GC; inputs GEO: Mesh, IN: Boolean, SOFT: Boolean, REQ: Boolean, PART: list
#   port GEO: Plane to use as constraints
# ---------- meshconst: Python ----------
# Wasp: Discrete Design with Grasshopper plug-in (GPL) initiated by Andrea Rossi
# 
# This file is part of Wasp.
# 
# Copyright (c) 2017, Andrea Rossi <a.rossi.andrea@gmail.com>
# Wasp is free software; you can redistribute it and/or modify 
# it under the terms of the GNU General Public License as published 
# by the Free Software Foundation; either version 3 of the License, 
# or (at your option) any later version. 
# 
# Wasp is distributed in the hope that it will be useful,
# but WITHOUT ANY WARRANTY; without even the implied warranty of 
# MERCHANTABILITY or FITNESS FOR A PARTICULAR PURPOSE. See the 
# GNU General Public License for more details.
# 
# You should have received a copy of the GNU General Public License
# along with Wasp; If not, see <http://www.gnu.org/licenses/>.
# 
# @license GPL-3.0 <https://www.gnu.org/licenses/gpl.html>
#
# Significant parts of Wasp have been developed by Andrea Rossi
# as part of research on digital materials and discrete design at:
# DDU Digital Design Unit - Prof. Oliver Tessmann
# Technische Universität Darmstadt


#########################################################################
##                            COMPONENT INFO                           ##
#########################################################################

"""
Mesh collision global constraint
-
Provided by Wasp 0.4
    Args:
        GEOMETRY: Geometry of the collision shape
        IN: OPTIONAL // False to allow only parts outside the constraint geometry, True to allow parts only inside (True by default)
        SOFT: OPTIONAL // True to check only the part center point, False to check also for geometry intersection (True by default)
        REQ: OPTIONAL // True to make the constrains necessary for the aggregation to happen, False to make it optional (True by default)
        PART: OPTIONAL // Name of the parts to which the constraint is supposed to be applied on. If not specified, the constraint is applied to all parts
    Returns:
        GC: Mesh constraint
"""

ghenv.Component.Name = "Wasp_Mesh Constraint"
ghenv.Component.NickName = 'MeshConst'
ghenv.Component.Message = "VER 0.4.013"
ghenv.Component.IconDisplayMode = ghenv.Component.IconDisplayMode.application
ghenv.Component.Category = "Wasp"
ghenv.Component.SubCategory = "4 | Constraints"
try: ghenv.Component.AdditionalHelpFromDocStrings = "2"
except: pass

import sys
import Rhino.Geometry as rg
import Grasshopper as gh


## add Wasp install directory to system path
wasp_loaded = False
ghcompfolder = gh.Folders.DefaultAssemblyFolder
if ghcompfolder not in sys.path:
    sys.path.append(ghcompfolder)
try:
    from wasp import __version__
    wasp_loaded = True
except:
    msg = "Cannot import Wasp. Is the wasp folder available in " + ghcompfolder + "?"
    ghenv.Component.AddRuntimeMessage(gh.Kernel.GH_RuntimeMessageLevel.Error, msg)

## if Wasp is installed correctly, load the classes required by the component
if wasp_loaded:
    from wasp.core import Mesh_Constraint


## Main code execution
def main(geometry, inside, soft_constraint, is_required, parts):
    
    check_data = True
    ##check inputs
    if geometry is None:
        check_data = False
        msg = "Provide a valid geometry"
        ghenv.Component.AddRuntimeMessage(gh.Kernel.GH_RuntimeMessageLevel.Warning, msg)
    
    if inside is None:
        inside = True
    
    if soft_constraint is None:
        soft_constraint = True
    
    if is_required is None:
        is_required = True
    
    if inside == True and check_data == True:
        naked_edges = geometry.GetNakedEdges()
        if naked_edges is not None:
            check_data = False
            msg = "The provided geometry is not closed!"
            ghenv.Component.AddRuntimeMessage(gh.Kernel.GH_RuntimeMessageLevel.Warning, msg)
    
    
    if check_data:
        geo_constraint = Mesh_Constraint(geometry, _inside = inside, _soft = soft_constraint, _required = is_required, _parts=parts)
        return geo_constraint
    else:
        return -1


result = main(GEO, IN, SOFT, REQ, PART)

if result != -1:
    GC = result
# ---------- end meshconst ----------
meshconst_2 = Wasp_MeshConstraint(GEO=mesh_4, IN=Toggle(True), SOFT=Toggle(True), REQ=Toggle(False))  # -> GC; inputs GEO: Mesh, IN: Boolean, SOFT: Boolean, REQ: Boolean, PART: list; same code as meshconst
meshconst_3 = Wasp_MeshConstraint(GEO=mesh_5, IN=Toggle(True), SOFT=Toggle(False), REQ=Toggle(False))  # -> GC; inputs GEO: Mesh, IN: Boolean, SOFT: Boolean, REQ: Boolean, PART: list; same code as meshconst
savefield = Wasp_SaveFieldToFile(FIELD=field, PATH="D:\Github\Wasp\devFiles\data", NAME="myField_01", SAVE=Button())  # -> FILE
# ---------- savefield: Python ----------
# Wasp: Discrete Design with Grasshopper plug-in (GPL) initiated by Andrea Rossi
# 
# This file is part of Wasp.
# 
# Copyright (c) 2017, Andrea Rossi <a.rossi.andrea@gmail.com>
# Wasp is free software; you can redistribute it and/or modify 
# it under the terms of the GNU General Public License as published 
# by the Free Software Foundation; either version 3 of the License, 
# or (at your option) any later version. 
# 
# Wasp is distributed in the hope that it will be useful,
# but WITHOUT ANY WARRANTY; without even the implied warranty of 
# MERCHANTABILITY or FITNESS FOR A PARTICULAR PURPOSE. See the 
# GNU General Public License for more details.
# 
# You should have received a copy of the GNU General Public License
# along with Wasp; If not, see <http://www.gnu.org/licenses/>.
# 
# @license GPL-3.0 <https://www.gnu.org/licenses/gpl.html>
#
# Significant parts of Wasp have been developed by Andrea Rossi
# as part of research on digital materials and discrete design at:
# DDU Digital Design Unit - Prof. Oliver Tessmann
# Technische Universität Darmstadt


#########################################################################
##                            COMPONENT INFO                           ##
#########################################################################

"""
Saves current status of an aggregation to a .json file.
-
Provided by Wasp 0.4
    Args:
        FIELD: Field to save
        PATH: Path where to save the field
        NAME: Name of the exported file
        SAVE: True to export
    Returns:
        FILE: Path to the saved file
"""

ghenv.Component.Name = "Wasp_Save Field to File"
ghenv.Component.NickName = 'SaveField'
ghenv.Component.Message = 'VER 0.4.013'
ghenv.Component.IconDisplayMode = ghenv.Component.IconDisplayMode.application
ghenv.Component.Category = "Wasp"
ghenv.Component.SubCategory = "5 | Fields"
try: ghenv.Component.AdditionalHelpFromDocStrings = "3"
except: pass


import sys
import os
import Rhino.Geometry as rg
import Grasshopper as gh
import json


## add Wasp install directory to system path
wasp_loaded = False
ghcompfolder = gh.Folders.DefaultAssemblyFolder
if ghcompfolder not in sys.path:
    sys.path.append(ghcompfolder)
try:
    from wasp import __version__
    wasp_loaded = True
except:
    msg = "Cannot import Wasp. Is the wasp folder available in " + ghcompfolder + "?"
    ghenv.Component.AddRuntimeMessage(gh.Kernel.GH_RuntimeMessageLevel.Error, msg)

## if Wasp is installed correctly, load the classes required by the component
if wasp_loaded:
    from wasp.field import Field


def main(field, path, filename, save):
        
    check_data = True
    
    ## check inputs
    if field is None:
        check_data = False
        msg = "No field provided"
        ghenv.Component.AddRuntimeMessage(gh.Kernel.GH_RuntimeMessageLevel.Warning, msg)
    
    if path is None:
        check_data = False
        msg = "No path provided"
        ghenv.Component.AddRuntimeMessage(gh.Kernel.GH_RuntimeMessageLevel.Warning, msg)
    
    if filename is None:
        check_data = False
        msg = "No filename provided"
        ghenv.Component.AddRuntimeMessage(gh.Kernel.GH_RuntimeMessageLevel.Warning, msg)
    
    if save is None:
        save = False
    
    ## execute main code if all needed inputs are available
    if check_data:
        
        field_dict = field.to_data()
        full_path = os.path.join(path, filename + ".json")
        
        if save:
            with open(full_path, "w") as outF:
                json.dump(field_dict, outF)
        
        return json.dumps(field_dict), full_path
    else:
        return -1

result = main(FIELD, PATH, NAME, SAVE)

if result != -1:
    TXT = result[0]
    FILE = result[1]
# ---------- end savefield ----------
fieldiso = Wasp_FieldIsolines(FIELD=field, PLN=Slider(0, range=0..2), T=graft(range), ISO=Slider(0.5, range=0..1))  # -> CRV
# ---------- fieldiso: Python ----------
# Wasp: Discrete Design with Grasshopper plug-in (GPL) initiated by Andrea Rossi
# 
# This file is part of Wasp.
# 
# Copyright (c) 2017, Andrea Rossi <a.rossi.andrea@gmail.com>
# Wasp is free software; you can redistribute it and/or modify 
# it under the terms of the GNU General Public License as published 
# by the Free Software Foundation; either version 3 of the License, 
# or (at your option) any later version. 
# 
# Wasp is distributed in the hope that it will be useful,
# but WITHOUT ANY WARRANTY; without even the implied warranty of 
# MERCHANTABILITY or FITNESS FOR A PARTICULAR PURPOSE. See the 
# GNU General Public License for more details.
# 
# You should have received a copy of the GNU General Public License
# along with Wasp; If not, see <http://www.gnu.org/licenses/>.
# 
# @license GPL-3.0 <https://www.gnu.org/licenses/gpl.html>
#
# Significant parts of Wasp have been developed by Andrea Rossi
# as part of research on digital materials and discrete design at:
# DDU Digital Design Unit - Prof. Oliver Tessmann
# Technische Universität Darmstadt


#########################################################################
##                            COMPONENT INFO                           ##
#########################################################################

"""
Draws isolines across a field object
--> WIP Component: might be incomplete or contain bugs! <--
-
Provided by Wasp 0.4
    Args:
        FIELD: Field object to extract isolines from
        PLN: Plane for isolines extraction (0: XY Plane, 1: YZ Plane, 2: XZ Plane)
        T: Z parameter where to extract isolines
        ISO: Isolevel of the curves
    Returns:
        CRV: Isocurves
"""

ghenv.Component.Name = "Wasp_Field Isolines"
ghenv.Component.NickName = 'FieldIso'
ghenv.Component.Message = 'VER 0.4.013'
ghenv.Component.IconDisplayMode = ghenv.Component.IconDisplayMode.application
ghenv.Component.Category = "Wasp"
ghenv.Component.SubCategory =  "5 | Fields"
try: ghenv.Component.AdditionalHelpFromDocStrings = "2"
except: pass


import sys
import Rhino.Geometry as rg
import Grasshopper as gh
import math


## add Wasp install directory to system path
wasp_loaded = False
ghcompfolder = gh.Folders.DefaultAssemblyFolder
if ghcompfolder not in sys.path:
    sys.path.append(ghcompfolder)
try:
    from wasp import __version__
    wasp_loaded = True
except:
    msg = "Cannot import Wasp. Is the wasp folder available in " + ghcompfolder + "?"
    ghenv.Component.AddRuntimeMessage(gh.Kernel.GH_RuntimeMessageLevel.Error, msg)

## if Wasp is installed correctly, load the classes required by the component
if wasp_loaded:
    pass



def main(field, plane, t, iso):
    contour_lookup = {"0000":-1, "0001":[[(0,0.5),(0.5,1)]], "0010":[[(0.5,1),(1,0.5)]], "0011":[[(0,0.5),(1,0.5)]],
                      "0100":[[(0.5,0),(1,0.5)]], "0101":[[(0,0.5),(0.5,0)], [(0.5,1),(1,0.5)]], "0110":[[(0.5,0),(0.5,1)]], "0111":[[(0,0.5),(0.5,0)]],
                      "1000":[[(0,0.5),(0.5,0)]], "1001":[[(0.5,0),(0.5,1)]], "1010":[[(0,0.5),(0.5,1)], [(0.5,0),(1,0.5)]], "1011":[[(0.5,0),(1,0.5)]],
                      "1100":[[(0,0.5),(1,0.5)]], "1101":[[(0.5,1),(1,0.5)]], "1110":[[(0,0.5),(0.5,1)]], "1111":-1}
    
    check_data = True
    
    ##check inputs
    if field is None:
        check_data = False
        msg = "No field provided"
        ghenv.Component.AddRuntimeMessage(gh.Kernel.GH_RuntimeMessageLevel.Warning, msg)
    
    if plane is None:
        plane = 0
    
    if t is None:
        check_data = False
        msg = "No parameter provided"
        ghenv.Component.AddRuntimeMessage(gh.Kernel.GH_RuntimeMessageLevel.Warning, msg)
    
    if iso is None:
        check_data = False
        msg = "No isolevel provided"
        ghenv.Component.AddRuntimeMessage(gh.Kernel.GH_RuntimeMessageLevel.Warning, msg)
    
    if check_data:
        binary_matrix = []
        contour_cases = []
        contours = []
        base_plane = None
        target_pt = field.bbox.PointAt(0,0,0)
        target_plane = None
        
        #XY Plane contouring
        if plane == 0:
            ## THRESHOLDING
            z = int(math.floor(field.z_count*t))
            if z == field.z_count:
                z -= 1
            
            for y in range(field.y_count):
                binary_matrix.append([])
                for x in range(field.x_count):
                    if field.vals[z][y][x] < iso:
                        binary_matrix[y].append("0")
                    else:
                        binary_matrix[y].append("1")
            
            ## CASES DEFINITION
            for y in range(0, field.y_count-1):
                contour_cases.append([])
                for x in range(0, field.x_count-1):
                    c_case = ""
                    c_case += binary_matrix[y][x]
                    c_case += binary_matrix[y][x+1]
                    c_case += binary_matrix[y+1][x+1]
                    c_case += binary_matrix[y+1][x]
                    contour_cases[y].append(c_case)
            
            ## CONTOURS GENERATION
            base_plane = rg.Plane.WorldXY
            target_pt += field.plane.ZAxis*(z*field.resolution)
            target_plane = rg.Plane(target_pt, field.plane.XAxis, field.plane.YAxis)
            
            for y in range(0, field.y_count-1):
                for x in range(0, field.x_count-1):
                    c_case = contour_cases[y][x]
                    c_shape = contour_lookup[c_case]
                    if c_shape != -1:
                        for shape in c_shape:
                            c_start = rg.Point3d(x + shape[0][0], y + shape[0][1], 0)
                            c_end = rg.Point3d(x + shape[1][0], y + shape[1][1], 0)
                            contour = rg.Line(c_start, c_end).ToNurbsCurve()
                            contours.append(contour)
        
        #YZ Plane contouring
        elif plane == 1:
            ## THRESHOLDING
            x = int(math.floor(field.x_count*t))
            if x == field.x_count:
                x -= 1
            
            for z in range(field.z_count):
                binary_matrix.append([])
                for y in range(field.y_count):
                    if field.vals[z][y][x] < iso:
                        binary_matrix[z].append("0")
                    else:
                        binary_matrix[z].append("1")
            
            ## CASES DEFINITION
            for z in range(0, field.z_count-1):
                contour_cases.append([])
                for y in range(0, field.y_count-1):
                    c_case = ""
                    c_case += binary_matrix[z][y]
                    c_case += binary_matrix[z][y+1]
                    c_case += binary_matrix[z+1][y+1]
                    c_case += binary_matrix[z+1][y]
                    contour_cases[z].append(c_case)
            
            ## CONTOURS GENERATION
            base_plane = rg.Plane.WorldYZ
            target_pt += field.plane.XAxis*(x*field.resolution)
            target_plane = rg.Plane(target_pt, field.plane.YAxis, field.plane.ZAxis)
            
            for z in range(0, field.z_count-1):
                for y in range(0, field.y_count-1):
                    c_case = contour_cases[z][y]
                    c_shape = contour_lookup[c_case]
                    if c_shape != -1:
                        for shape in c_shape:
                            c_start = rg.Point3d(0, y + shape[0][0], z + shape[0][1])
                            c_end = rg.Point3d(0, y + shape[1][0], z + shape[1][1])
                            contour = rg.Line(c_start, c_end).ToNurbsCurve()
                            contours.append(contour)
        
        #XZ Plane contouring
        elif plane == 2:
            ## THRESHOLDING
            y = int(math.floor(field.y_count*t))
            if y == field.y_count:
                y -= 1
            
            for z in range(field.z_count):
                binary_matrix.append([])
                for x in range(field.x_count):
                    if field.vals[z][y][x] < iso:
                        binary_matrix[z].append("0")
                    else:
                        binary_matrix[z].append("1")
            
            ## CASES DEFINITION
            for z in range(0, field.z_count-1):
                contour_cases.append([])
                for x in range(0, field.x_count-1):
                    c_case = ""
                    c_case += binary_matrix[z][x]
                    c_case += binary_matrix[z][x+1]
                    c_case += binary_matrix[z+1][x+1]
                    c_case += binary_matrix[z+1][x]
                    contour_cases[z].append(c_case)
            
            ## CONTOURS GENERATION
            base_plane = rg.Plane.WorldZX
            target_pt += field.plane.YAxis*(y*field.resolution)
            target_plane = rg.Plane(target_pt, field.plane.ZAxis, field.plane.XAxis)
            
            for z in range(0, field.z_count-1):
                for x in range(0, field.x_count-1):
                    c_case = contour_cases[z][x]
                    c_shape = contour_lookup[c_case]
                    if c_shape != -1:
                        for shape in c_shape:
                            c_start = rg.Point3d(x + shape[0][0], 0, z + shape[0][1])
                            c_end = rg.Point3d(x + shape[1][0], 0, z + shape[1][1])
                            contour = rg.Line(c_start, c_end).ToNurbsCurve()
                            contours.append(contour)
        
        contour_curves = rg.Curve.JoinCurves(contours)
        scale_transform = rg.Transform.Scale(rg.Point3d(0,0,0), field.resolution)
        
        orient_transform = rg.Transform.PlaneToPlane(base_plane, target_plane)
        for curve in contour_curves:
            curve.Transform(scale_transform)
            curve.Transform(orient_transform)
        
        return contour_curves
    else:
        return -1

result = main(FIELD, PLN, T, ISO)

if result != -1:
    CRV = result
# ---------- end fieldiso ----------
faceb = FaceBoundaries(Mesh=mesh_3)
faceb_2 = FaceBoundaries(Mesh=mesh_4)
fieldvox = Wasp_FieldIsoVoxels(FIELD=fieldorient, ISO=Slider(0.48, range=0..1))  # -> VM
# ---------- fieldvox: Python ----------
# Wasp: Discrete Design with Grasshopper plug-in (GPL) initiated by Andrea Rossi
# 
# This file is part of Wasp.
# 
# Copyright (c) 2017, Andrea Rossi <a.rossi.andrea@gmail.com>
# Wasp is free software; you can redistribute it and/or modify 
# it under the terms of the GNU General Public License as published 
# by the Free Software Foundation; either version 3 of the License, 
# or (at your option) any later version. 
# 
# Wasp is distributed in the hope that it will be useful,
# but WITHOUT ANY WARRANTY; without even the implied warranty of 
# MERCHANTABILITY or FITNESS FOR A PARTICULAR PURPOSE. See the 
# GNU General Public License for more details.
# 
# You should have received a copy of the GNU General Public License
# along with Wasp; If not, see <http://www.gnu.org/licenses/>.
# 
# @license GPL-3.0 <https://www.gnu.org/licenses/gpl.html>
#
# Significant parts of Wasp have been developed by Andrea Rossi
# as part of research on digital materials and discrete design at:
# DDU Digital Design Unit - Prof. Oliver Tessmann
# Technische Universität Darmstadt


#########################################################################
##                            COMPONENT INFO                           ##
#########################################################################

"""
Compute a voxel-mesh of the given field at the chosen iso-level.
-
Provided by Wasp 0.4
    Args:
        FIELD: Field object to extract iso-voxels from
        ISO: Isolevel of the voxel mesh
    Returns:
        VM: Voxel mesh at the chosen iso-level
"""

ghenv.Component.Name = "Wasp_Field Iso Voxels"
ghenv.Component.NickName = 'FieldVox'
ghenv.Component.Message = 'VER 0.4.013'
ghenv.Component.IconDisplayMode = ghenv.Component.IconDisplayMode.application
ghenv.Component.Category = "Wasp"
ghenv.Component.SubCategory =  "5 | Fields"
try: ghenv.Component.AdditionalHelpFromDocStrings = "2"
except: pass


import sys
import Rhino.Geometry as rg
import Grasshopper as gh
import math


## add Wasp install directory to system path
wasp_loaded = False
ghcompfolder = gh.Folders.DefaultAssemblyFolder
if ghcompfolder not in sys.path:
    sys.path.append(ghcompfolder)
try:
    from wasp import __version__
    wasp_loaded = True
except:
    msg = "Cannot import Wasp. Is the wasp folder available in " + ghcompfolder + "?"
    ghenv.Component.AddRuntimeMessage(gh.Kernel.GH_RuntimeMessageLevel.Error, msg)

## if Wasp is installed correctly, load the classes required by the component
if wasp_loaded:
    pass



def main(field, iso):
    check_data = True
    
    ##check inputs
    if field is None:
        check_data = False
        msg = "No field provided"
        ghenv.Component.AddRuntimeMessage(gh.Kernel.GH_RuntimeMessageLevel.Warning, msg)
    
    if iso is None:
        check_data = False
        msg = "No isolevel provided"
        ghenv.Component.AddRuntimeMessage(gh.Kernel.GH_RuntimeMessageLevel.Warning, msg)
    
    if check_data:
        
        return field.compute_voxel_mesh(iso)
    else:
        return -1

result = main(FIELD, ISO)

if result != -1:
    VM = result
# ---------- end fieldvox ----------
panel_12 = Panel(partcat_2)
gradient_4 = Gradient(
    LowerLimit=0,
    UpperLimit=1,
    Parameter=range_2,
    stops=[0: RGB(243, 57, 0), 0.1: RGB(236, 27, 60), 0.2: RGB(210, 0, 118), 0.3: RGB(103, 0, 120), 0.4: RGB(39, 72, 161), 0.5: RGB(1, 192, 229), 0.6: RGB(18, 178, 90), 0.7: RGB(79, 186, 8), 0.8: RGB(220, 237, 32), 0.9: RGB(247, 159, 20), 1: RGB(243, 57, 0)])
panel_13 = Panel("""name
connections
transform""")
reduce = RandomReduce(List=rulegen, Reduction=Slider(0, range=0..1000), Seed=1)
merge_6 = Merge(Data1=meshconst, Data2=planeconst_2)
constraints = ValueList({"NONE": 0, "LOCAL": 1, "GLOBAL": 2, "LOCAL + GLOBAL": 3}, selected="NONE")
preview_6 = CustomPreview(Geometry=fieldvox, Shader=ColourSwatch(SwatchColor=RGBA(255, 0, 0, 108)))
preview_7 = CustomPreview(Geometry=fieldiso, Shader=graft(ColourSwatch(SwatchColor=RGB(255, 0, 0))))
loadfield = Wasp_LoadFieldFromFile(FILE=savefield, LOAD=Toggle(True))  # -> FIELD; inputs LOAD: Boolean
#   port LOAD: True to reload the saved file
# ---------- loadfield: Python ----------
# Wasp: Discrete Design with Grasshopper plug-in (GPL) initiated by Andrea Rossi
# 
# This file is part of Wasp.
# 
# Copyright (c) 2017, Andrea Rossi <a.rossi.andrea@gmail.com>
# Wasp is free software; you can redistribute it and/or modify 
# it under the terms of the GNU General Public License as published 
# by the Free Software Foundation; either version 3 of the License, 
# or (at your option) any later version. 
# 
# Wasp is distributed in the hope that it will be useful,
# but WITHOUT ANY WARRANTY; without even the implied warranty of 
# MERCHANTABILITY or FITNESS FOR A PARTICULAR PURPOSE. See the 
# GNU General Public License for more details.
# 
# You should have received a copy of the GNU General Public License
# along with Wasp; If not, see <http://www.gnu.org/licenses/>.
# 
# @license GPL-3.0 <https://www.gnu.org/licenses/gpl.html>
#
# Significant parts of Wasp have been developed by Andrea Rossi
# as part of research on digital materials and discrete design at:
# DDU Digital Design Unit - Prof. Oliver Tessmann
# Technische Universität Darmstadt


#########################################################################
##                            COMPONENT INFO                           ##
#########################################################################

"""
Loads an aggregation from a previously saved .txt file
-
Provided by Wasp 0.4
    Args:
        FILE: File where the field is saved (.json)
        UPDATE: True to load the saved file
    Returns:
        FIELD: Imported field
"""

ghenv.Component.Name = "Wasp_Load Field from File"
ghenv.Component.NickName = 'LoadField'
ghenv.Component.Message = 'VER 0.4.013'
ghenv.Component.IconDisplayMode = ghenv.Component.IconDisplayMode.application
ghenv.Component.Category = "Wasp"
ghenv.Component.SubCategory = "5 | Fields"
try: ghenv.Component.AdditionalHelpFromDocStrings = "3"
except: pass


import sys
import Grasshopper as gh
import json


## add Wasp install directory to system path
wasp_loaded = False
ghcompfolder = gh.Folders.DefaultAssemblyFolder
if ghcompfolder not in sys.path:
    sys.path.append(ghcompfolder)
try:
    from wasp import __version__
    wasp_loaded = True
except:
    msg = "Cannot import Wasp. Is the wasp folder available in " + ghcompfolder + "?"
    ghenv.Component.AddRuntimeMessage(gh.Kernel.GH_RuntimeMessageLevel.Error, msg)

## if Wasp is installed correctly, load the classes required by the component
if wasp_loaded:
    from wasp.field import Field


def main(file_path, load_file):
        
    check_data = True
    
    ## check inputs
    if file_path is None:
        check_data = False
        msg = "No path provided for the file to load"
        ghenv.Component.AddRuntimeMessage(gh.Kernel.GH_RuntimeMessageLevel.Warning, msg)
    
    if load_file is None:
        lad_file = False
    
    ## execute main code if all needed inputs are available
    if check_data:
        
        if load_file:
            field_dict = {}
            
            ## load json data
            with open(file_path, "r") as inF:
                txt_data = inF.read()
                field_dict = json.loads(txt_data)
            
            field = Field.from_data(field_dict)
            return field
        else:
            return -1
        
    else:
        return -1


result = main(FILE, LOAD)

if result != -1:
    FIELD = result
# ---------- end loadfield ----------
fieldn_2 = Slider(250, range=0..10000)
serializer = Wasp_SerializeObjectToFile(OBJ=part, FILTER=panel_13, PATH="D:\Github\Wasp\devFiles\data", NAME="serialized_data_01", SAVE=Button())  # -> KEY, TXT, FILE; inputs FILTER: list
# ---------- serializer: Python ----------
# Wasp: Discrete Design with Grasshopper plug-in (GPL) initiated by Andrea Rossi
# 
# This file is part of Wasp.
# 
# Copyright (c) 2017, Andrea Rossi <a.rossi.andrea@gmail.com>
# Wasp is free software; you can redistribute it and/or modify 
# it under the terms of the GNU General Public License as published 
# by the Free Software Foundation; either version 3 of the License, 
# or (at your option) any later version. 
# 
# Wasp is distributed in the hope that it will be useful,
# but WITHOUT ANY WARRANTY; without even the implied warranty of 
# MERCHANTABILITY or FITNESS FOR A PARTICULAR PURPOSE. See the 
# GNU General Public License for more details.
# 
# You should have received a copy of the GNU General Public License
# along with Wasp; If not, see <http://www.gnu.org/licenses/>.
# 
# @license GPL-3.0 <https://www.gnu.org/licenses/gpl.html>
#
# Significant parts of Wasp have been developed by Andrea Rossi
# as part of research on digital materials and discrete design at:
# DDU Digital Design Unit - Prof. Oliver Tessmann
# Technische Universität Darmstadt


#########################################################################
##                            COMPONENT INFO                           ##
#########################################################################

"""
Saves current status of an aggregation to a .json file.
-
Provided by Wasp 0.4
    Args:
        OBJ: Object to serialize and save to file
        FILTER: OPTIONAL // keys of the elements to serialize (by default, all object's parameters will be serialized)
        PATH: Path where to save the object
        NAME: Name of the exported file
        SAVE: True to export
    Returns:
        KEY: list of the keys available in the object's dictionary (for filtering)
        TXT: Text representation of the object. NB!!! files can become very large, and attempting to visualize them in a panel might cause Grasshopper to crash!!!
        FILE: Path to the saved file
"""

ghenv.Component.Name = "Wasp_Serialize Object to File"
ghenv.Component.NickName = 'Serializer'
ghenv.Component.Message = 'VER 0.4.013'
ghenv.Component.IconDisplayMode = ghenv.Component.IconDisplayMode.application
ghenv.Component.Category = "Wasp"
ghenv.Component.SubCategory = "X | Experimental"
try: ghenv.Component.AdditionalHelpFromDocStrings = "5"
except: pass


import sys
import os
import Rhino.Geometry as rg
import Grasshopper as gh
import json


## add Wasp install directory to system path
wasp_loaded = False
ghcompfolder = gh.Folders.DefaultAssemblyFolder
if ghcompfolder not in sys.path:
    sys.path.append(ghcompfolder)
try:
    from wasp import __version__
    wasp_loaded = True
except:
    msg = "Cannot import Wasp. Is the wasp folder available in " + ghcompfolder + "?"
    ghenv.Component.AddRuntimeMessage(gh.Kernel.GH_RuntimeMessageLevel.Error, msg)

## if Wasp is installed correctly, load the classes required by the component
if wasp_loaded:
    pass


def main(object, filter, path, filename, save):
        
    check_data = True
    check_save_data = True
    
    ## check inputs
    if object is None:
        check_data = False
        msg = "No object provided"
        ghenv.Component.AddRuntimeMessage(gh.Kernel.GH_RuntimeMessageLevel.Warning, msg)
    
    if path is None:
        check_save_data = False
    
    if filename is None:
        check_save_data = False
    
    if save is None:
        save = False
    
    ## execute main code if all needed inputs are available
    if check_data:
        data = object.to_data()
        keys = data.keys()
        
        filtered_data = {}
        if len(filter) > 0:
            for f_key in filter:
                if data.has_key(f_key):
                    filtered_data[f_key] = data[f_key]
        else:
            filtered_data = data
        
        full_path = None
        if check_save_data:
            full_path = os.path.join(path, filename + ".json")
        
        if save:
            if full_path is not None:
                with open(full_path, "w") as outF:
                    json.dump(filtered_data, outF)
            else:
                msg = "Cannot save the file. Either the path or the filename are missing."
                ghenv.Component.AddRuntimeMessage(gh.Kernel.GH_RuntimeMessageLevel.Error, msg)
        
        return keys, json.dumps(filtered_data, indent = 2), full_path
    else:
        return -1

result = main(OBJ, FILTER, PATH, NAME, SAVE)

if result != -1:
    KEY = result[0]
    TXT = result[1]
    FILE = result[2]
# ---------- end serializer ----------
wasp_constraints = ValueList({"NONE": 0, "LOCAL": 1, "GLOBAL": 2, "LOCAL + GLOBAL": 3}, selected="LOCAL")
panel_14 = Panel("""L|1_L|6>a_b
a|4_L|10>a_c
a|3_L|4>c_d
d|2_L|7>d_e
e|4_L|7>e_f
a|9_L2|3>a_g""")
panel_15 = Panel(loadfield)
number_slider_16 = Slider(8, range=0..10)
fieldaggregation_2 = Wasp_FieldDrivenAggregation(
    PART=flatten(merge_4),
    N=fieldn_2,
    RULES=reduce,
    FIELD=fieldorient,
    CAT=partcat_2,
    MODE=constraints,
    GC=merge_6,
    ID="myFieldAggregation2",
    RESET=Button())  # -> AGGR, PART_OUT; inputs PART: list, PREV: list, N: Int32, RULES: list, FIELD: list, MODE: Int32, GC: list, RESET: Boolean
# ---------- fieldaggregation_2: Python ----------
# Wasp: Discrete Design with Grasshopper plug-in (GPL) initiated by Andrea Rossi
# 
# This file is part of Wasp.
# 
# Copyright (c) 2017, Andrea Rossi <a.rossi.andrea@gmail.com>
# Wasp is free software; you can redistribute it and/or modify 
# it under the terms of the GNU General Public License as published 
# by the Free Software Foundation; either version 3 of the License, 
# or (at your option) any later version. 
# 
# Wasp is distributed in the hope that it will be useful,
# but WITHOUT ANY WARRANTY; without even the implied warranty of 
# MERCHANTABILITY or FITNESS FOR A PARTICULAR PURPOSE. See the 
# GNU General Public License for more details.
# 
# You should have received a copy of the GNU General Public License
# along with Wasp; If not, see <http://www.gnu.org/licenses/>.
# 
# @license GPL-3.0 <https://www.gnu.org/licenses/gpl.html>
#
# Significant parts of Wasp have been developed by Andrea Rossi
# as part of research on digital materials and discrete design at:
# DDU Digital Design Unit - Prof. Oliver Tessmann
# Technische Universität Darmstadt


#########################################################################
##                            COMPONENT INFO                           ##
#########################################################################

"""
Aggregate the given parts according to a given scalar field. New parts are added following higher values in the field.
The component works additively, hence increasing the number of parts in an aggregation just adds new parts on the existing ones, without triggering recomputing of the previous element
-
Provided by Wasp 0.4
    Args:
        PART: Parts to be aggregated (can be more than one)
        PREV: OPTIONAL // Previous aggregated parts. It is possible to input the results of a previous aggregation, or parts transformed with the TransformPart component
        N: Number of parts to be aggregated (does not count parts provided in PREV)
        RULES: Rules for the aggregation
        FIELD: Scalar field to drive the aggregation (parts will be added following higher values in the field)
        THRES: OPTIONAL // If set, used to define a threshold value above which the placement of next part is accepted. If not set, aggregation will look for part with highest value in the whole field. Setting a low threshold helds less accurate results, but highly speeds up calculations
        COLL: OPTIONAL // Collision detection. By default is active and checks for collisions between the aggregated parts
        CAT: OPTIONAL // Part Catalog (to specify fixed numbers or proportions between part types
        MODE: OPTIONAL // Switches between aggregation modes: 0 = no constraints, 1 = local constraints, 2 = global constraints, 3 = local + global constraints
        GC: OPTIONAL // Global constraints to apply to aggregation
        ID: OPTIONAL // Aggregation ID
        RESET: Recompute the whole aggregation
    Returns:
        AGGR: Aggregation object
        PART_OUT: Aggregated parts (includes both PREV input and newly aggregated parts)
"""

ghenv.Component.Name = "Wasp_Field-driven Aggregation"
ghenv.Component.NickName = 'FieldAggregation'
ghenv.Component.Message = "VER 0.4.013"
ghenv.Component.IconDisplayMode = ghenv.Component.IconDisplayMode.application
ghenv.Component.Category = "Wasp"
ghenv.Component.SubCategory = "6 | Aggregation"
try: ghenv.Component.AdditionalHelpFromDocStrings = "1"
except: pass


import sys
import Rhino.Geometry as rg
import Grasshopper as gh


## add Wasp install directory to system path
wasp_loaded = False
ghcompfolder = gh.Folders.DefaultAssemblyFolder
if ghcompfolder not in sys.path:
    sys.path.append(ghcompfolder)
try:
    from wasp import __version__
    wasp_loaded = True
except:
    msg = "Cannot import Wasp. Is the wasp folder available in " + ghcompfolder + "?"
    ghenv.Component.AddRuntimeMessage(gh.Kernel.GH_RuntimeMessageLevel.Error, msg)

## if Wasp is installed correctly, load the classes required by the component
if wasp_loaded:
    from wasp.core import Aggregation


## Main code execution
def main(parts, previous_parts, num_parts, rules, catalog, aggregation_mode, global_constraints, aggregation_id, reset, fields, aggregation):
    
    check_data = True
    ##check inputs
    if len(parts) == 0:
        check_data = False
        msg = "No parts provided"
        ghenv.Component.AddRuntimeMessage(gh.Kernel.GH_RuntimeMessageLevel.Warning, msg)
    
    if num_parts is None:
        check_data = False
        msg = "Provide number of aggregation iterations"
        ghenv.Component.AddRuntimeMessage(gh.Kernel.GH_RuntimeMessageLevel.Warning, msg)
    else:
        if len(previous_parts) != 0:
            num_parts += len(previous_parts)
    
    if len(rules) == 0:
        check_data = False
        msg = "No rules provided"
        ghenv.Component.AddRuntimeMessage(gh.Kernel.GH_RuntimeMessageLevel.Warning, msg)
    
    use_catalog = False
    if catalog is not None:
        use_catalog = True
    
    if aggregation_mode is None:
        aggregation_mode = 0
    
    if aggregation_id is None:
        aggregation_id = 'myFieldAggregation'
    
    if reset is None:
        reset = False
    
    if len(fields) == 0:
        check_data = False
        msg = "Provide a valid scalar field"
        ghenv.Component.AddRuntimeMessage(gh.Kernel.GH_RuntimeMessageLevel.Warning, msg)
    elif len(fields) > 1:
        field_names = [f.name for f in fields]
        for part in parts:
            if part.field is None:
                part.field = fields[0].name
                
            elif part.field not in field_names:
                check_data = False
                msg = "Part " + part.name + " does not have a vaild field name assigned."
                ghenv.Component.AddRuntimeMessage(gh.Kernel.GH_RuntimeMessageLevel.Warning, msg)
    
    if check_data:
        
        ## create aggregation in sticky dict
        if aggregation is None or aggregation == -1 or reset:
            
            ## copy parts to avoid editing the original parts
            parts_copy = []
            for part in parts:
                parts_copy.append(part.copy())
            
            if use_catalog:
                aggregation = Aggregation(aggregation_id, parts_copy, rules, aggregation_mode, _prev = previous_parts, _global_constraints = global_constraints, _field = fields, _catalog = catalog.copy())
            else:
                aggregation = Aggregation(aggregation_id, parts_copy, rules, aggregation_mode, _prev = previous_parts, _global_constraints = global_constraints, _field = fields)
        
        ## handle parameters changes
        part_rules_change = False
        #### parts
        if parts != aggregation.parts.values():
            
            ## copy parts to avoid editing the original parts
            parts_copy = []
            for part in parts:
                parts_copy.append(part.copy())
            
            aggregation.reset_base_parts(new_parts = parts_copy)
            aggregation.reset_rules(aggregation.rules)
            part_rules_change = True
        
        #### rules
        if rules != aggregation.rules:
            aggregation.rules = rules
            aggregation.reset_base_parts()
            aggregation.reset_rules(aggregation.rules)
            part_rules_change = True
        
        if part_rules_change:
            aggregation.recompute_aggregation_queue()
        
        #### mode
        if aggregation_mode != aggregation.mode:
            aggregation.mode = aggregation_mode
            aggregation.reset_rules(aggregation.rules)
            aggregation.recompute_aggregation_queue()
        
        #### constraints
        if global_constraints != aggregation.global_constraints:
            aggregation.global_constraints = global_constraints
            aggregation.reset_rules(aggregation.rules)
            aggregation.recompute_aggregation_queue()
        
        ## field (TO DO)
        ##################################
        
        ## add parts to aggregation
        if num_parts > len(aggregation.aggregated_parts):
            #sc.sticky[aggregation_id].aggregate_field(num_parts-sc.sticky[aggregation_id].p_count, field, threshold)
            error_msg = aggregation.aggregate_field(num_parts-len(aggregation.aggregated_parts), use_catalog)
            if error_msg is not None:
                ghenv.Component.AddRuntimeMessage(gh.Kernel.GH_RuntimeMessageLevel.Warning, error_msg)
        
        ## remove parts from aggregation
        elif num_parts < len(aggregation.aggregated_parts):
            aggregation.remove_elements(num_parts)
        
        ## return result
        return aggregation
        
    else:
        return -1

## create aggregation container in global variables dict
if 'aggregation_container' not in globals():
    aggregation_container = None

result = main(PART, PREV, N, RULES, CAT, MODE, GC, ID, RESET, FIELD, aggregation_container)

if result != -1:
    aggregation_container = result
    
    AGGR = aggregation_container
    PART_OUT = aggregation_container.aggregated_parts
# ---------- end fieldaggregation_2 ----------
graphaggr = Wasp_GraphGrammarAggregation(PART=flatten(merge_4), RULES=panel_14, ID="mySequence", RESET=Button())  # -> AGGR, PART_OUT; inputs PART: list, PREV: list, RULES: list, RESET: Boolean
# ---------- graphaggr: Python ----------
# Wasp: Discrete Design with Grasshopper plug-in (GPL) initiated by Andrea Rossi
# 
# This file is part of Wasp.
# 
# Copyright (c) 2017, Andrea Rossi <a.rossi.andrea@gmail.com>
# Wasp is free software; you can redistribute it and/or modify 
# it under the terms of the GNU General Public License as published 
# by the Free Software Foundation; either version 3 of the License, 
# or (at your option) any later version. 
# 
# Wasp is distributed in the hope that it will be useful,
# but WITHOUT ANY WARRANTY; without even the implied warranty of 
# MERCHANTABILITY or FITNESS FOR A PARTICULAR PURPOSE. See the 
# GNU General Public License for more details.
# 
# You should have received a copy of the GNU General Public License
# along with Wasp; If not, see <http://www.gnu.org/licenses/>.
# 
# @license GPL-3.0 <https://www.gnu.org/licenses/gpl.html>
#
# Significant parts of Wasp have been developed by Andrea Rossi
# as part of research on digital materials and discrete design at:
# DDU Digital Design Unit - Prof. Oliver Tessmann
# Technische Universität Darmstadt
        
        
#########################################################################
##                            COMPONENT INFO                           ##
#########################################################################
        
"""
Sequential aggregation based on graph-grammars.
--> WIP Component: might be incomplete or contain bugs <--
-
Provided by Wasp 0.4
    Args:
        PART: Parts to be aggregated (can be more than one)
        PREV: Previous aggregated parts. It is possible to input the results of a previous aggregation, or parts transformed with the TransformPart component
        RULES: Rules sequence in text form (WIP)
        ID: OPTIONAL // Aggregation ID (to avoid overwriting when having different aggregation components in the same file)
        RESET: Recompute the whole aggregation
    Returns:
        AGGR: Aggregation object
        PART_OUT: Aggregated parts (includes both PREV input and newly aggregated parts)
"""
        
ghenv.Component.Name = "Wasp_Graph-Grammar Aggregation"
ghenv.Component.NickName = 'GraphAggr'
ghenv.Component.Message = 'VER 0.4.013'
ghenv.Component.IconDisplayMode = ghenv.Component.IconDisplayMode.application
ghenv.Component.Category = "Wasp"
ghenv.Component.SubCategory = "X | Experimental"
try: ghenv.Component.AdditionalHelpFromDocStrings = "4"
except: pass


import sys
import Rhino.Geometry as rg
import Grasshopper as gh


## add Wasp install directory to system path
wasp_loaded = False
ghcompfolder = gh.Folders.DefaultAssemblyFolder
if ghcompfolder not in sys.path:
    sys.path.append(ghcompfolder)
try:
    from wasp import __version__
    wasp_loaded = True
except:
    msg = "Cannot import Wasp. Is the wasp folder available in " + ghcompfolder + "?"
    ghenv.Component.AddRuntimeMessage(gh.Kernel.GH_RuntimeMessageLevel.Error, msg)

## if Wasp is installed correctly, load the classes required by the component
if wasp_loaded:
    from wasp.core import Aggregation


def main(parts, rules_sequence, aggregation_id, reset, aggregation):
    
    check_data = True
    ##check inputs
    if len(parts) == 0:
        check_data = False
        msg = "No parts provided"
        ghenv.Component.AddRuntimeMessage(gh.Kernel.GH_RuntimeMessageLevel.Warning, msg)
            
    if len(rules_sequence) == 0:
        check_data = False
        msg = "No rules sequence provided"
        ghenv.Component.AddRuntimeMessage(gh.Kernel.GH_RuntimeMessageLevel.Warning, msg)
            
    if aggregation_id is None:
        aggregation_id = 'mySequence'
            
    if check_data:
        if aggregation is None or aggregation == -1 or reset:
            
            ## copy parts to avoid editing the original parts
            parts_copy = []
            for part in parts:
                parts_copy.append(part.copy())
            
            aggregation = Aggregation(aggregation_id, parts_copy, [], 0)
        
        aggregation.aggregate_sequence(rules_sequence)
        return aggregation
            
    else:
        return -1

## create aggregation container in global variables dict
if 'aggregation_container' not in globals():
    aggregation_container = None

result = main(PART, RULES, ID, RESET, aggregation_container)

if result != -1:
    aggregation_container = result
    
    AGGR = aggregation_container
    PART_OUT = aggregation_container.aggregated_parts
# ---------- end graphaggr ----------
panel_16 = Panel(serializer.KEY)
panel_17 = Panel(serializer.TXT)
stochasticaggregation = Wasp_StochasticAggregation(
    PART=flatten(merge_4),
    PREV=parttr,
    N=Slider(75, range=0..10000),
    RULES=rulegen,
    MODE=wasp_constraints,
    GC=[meshconst, meshconst_2],
    ID="myAggr",
    RESET=Button())  # -> AGGR, PART_OUT; inputs PART: list, PREV: list, N: Int32, RULES: list, SEED: Int32, MODE: Int32, GC: list, RESET: Boolean
# ---------- stochasticaggregation: Python ----------
# Wasp: Discrete Design with Grasshopper plug-in (GPL) initiated by Andrea Rossi
# 
# This file is part of Wasp.
# 
# Copyright (c) 2017, Andrea Rossi <a.rossi.andrea@gmail.com>
# Wasp is free software; you can redistribute it and/or modify 
# it under the terms of the GNU General Public License as published 
# by the Free Software Foundation; either version 3 of the License, 
# or (at your option) any later version. 
# 
# Wasp is distributed in the hope that it will be useful,
# but WITHOUT ANY WARRANTY; without even the implied warranty of 
# MERCHANTABILITY or FITNESS FOR A PARTICULAR PURPOSE. See the 
# GNU General Public License for more details.
# 
# You should have received a copy of the GNU General Public License
# along with Wasp; If not, see <http://www.gnu.org/licenses/>.
# 
# @license GPL-3.0 <https://www.gnu.org/licenses/gpl.html>
#
# Significant parts of Wasp have been developed by Andrea Rossi
# as part of research on digital materials and discrete design at:
# DDU Digital Design Unit - Prof. Oliver Tessmann
# Technische Universität Darmstadt


#########################################################################
##                            COMPONENT INFO                           ##
#########################################################################

"""
Aggregate the given parts in a stochastic process, selecting parts and rules randomly at every step.
The component works additively, hence increasing the number of parts in an aggregation just adds new parts on the existing ones, without triggering recomputing of the previous element.
-
Provided by Wasp 0.4
    Args:
        PART: Parts to be aggregated (can be more than one)
        PREV: OPTIONAL // Previous aggregated parts. It is possible to input the results of a previous aggregation, or parts transformed with the TransformPart component
        N: Number of parts to be aggregated (does not count parts provided in PREV)
        RULES: Rules for the aggregation
        SEED: OPTIONAL // Random seed. Set this to a fixed number to allow recreating the same aggregation every time you reset.
        COLL: OPTIONAL // Collision detection. By default is active and checks for collisions between the aggregated parts
        CAT: OPTIONAL // Part Catalog (to specify fixed numbers or proportions between part types
        MODE: OPTIONAL // Switches between aggregation modes: 0 = no constraints, 1 = local constraints, 2 = global constraints, 3 = local + global constraints
        GC: OPTIONAL // Global constraints to apply to aggregation
        ID: OPTIONAL // Aggregation ID
        RESET: Recompute the whole aggregation
    Returns:
        PART_OUT: Aggregated parts (includes both PREV input and newly aggregated parts)
"""

ghenv.Component.Name = "Wasp_Stochastic Aggregation"
ghenv.Component.NickName = 'StochasticAggregation'
ghenv.Component.Message = 'VER 0.4.013'
ghenv.Component.IconDisplayMode = ghenv.Component.IconDisplayMode.application
ghenv.Component.Category = "Wasp"
ghenv.Component.SubCategory = "6 | Aggregation"
try: ghenv.Component.AdditionalHelpFromDocStrings = "1"
except: pass

import sys
import Rhino.Geometry as rg
import Grasshopper as gh


## add Wasp install directory to system path
wasp_loaded = False
ghcompfolder = gh.Folders.DefaultAssemblyFolder
if ghcompfolder not in sys.path:
    sys.path.append(ghcompfolder)
try:
    from wasp import __version__
    wasp_loaded = True
except:
    msg = "Cannot import Wasp. Is the wasp folder available in " + ghcompfolder + "?"
    ghenv.Component.AddRuntimeMessage(gh.Kernel.GH_RuntimeMessageLevel.Error, msg)

## if Wasp is installed correctly, load the classes required by the component
if wasp_loaded:
    from wasp.core import Aggregation


def main(parts, previous_parts, num_parts, rules, seed, catalog, aggregation_mode, global_constraints, aggregation_id, reset, aggregation):
    
    check_data = True
    
    ##check inputs
    if len(parts) == 0:
        check_data = False
        msg = "No parts provided"
        ghenv.Component.AddRuntimeMessage(gh.Kernel.GH_RuntimeMessageLevel.Warning, msg)
    
    if num_parts is None:
        check_data = False
        msg = "Provide number of aggregation iterations"
        ghenv.Component.AddRuntimeMessage(gh.Kernel.GH_RuntimeMessageLevel.Warning, msg)
    else:
        if len(previous_parts) != 0:
            num_parts += len(previous_parts)
    
    if len(rules) == 0:
        check_data = False
        msg = "No rules provided"
        ghenv.Component.AddRuntimeMessage(gh.Kernel.GH_RuntimeMessageLevel.Warning, msg)
    
    use_catalog = False
    if catalog is not None:
        use_catalog = True
    
    if aggregation_mode is None:
        aggregation_mode = 0
    
    if aggregation_id is None:
        aggregation_id = 'myAggregation'
    
    if reset is None:
        reset = False
    
    if check_data:
        ## create aggregation in sticky dict
        if aggregation is None or aggregation == -1 or reset:
            
            ## copy parts to avoid editing the original parts
            parts_copy = []
            for part in parts:
                parts_copy.append(part.copy())
            if use_catalog:
                aggregation = Aggregation(aggregation_id, parts_copy, rules, aggregation_mode, _prev = previous_parts, _global_constraints = global_constraints, _rnd_seed = seed, _catalog = catalog.copy())
            else:
                aggregation = Aggregation(aggregation_id, parts_copy, rules, aggregation_mode, _prev = previous_parts, _global_constraints = global_constraints, _rnd_seed = seed)
        ## handle parameters changes
        #### parts
        if parts != aggregation.parts.values():
            
            ## copy parts to avoid editing the original parts
            parts_copy = []
            for part in parts:
                parts_copy.append(part.copy())
            
            aggregation.reset_base_parts(new_parts = parts_copy)
            aggregation.reset_rules(aggregation.rules)
        
        #### rules
        if rules != aggregation.rules:
            aggregation.rules = rules
            aggregation.reset_base_parts()
            aggregation.reset_rules(aggregation.rules)
        
        #### mode
        if aggregation_mode != aggregation.mode:
            aggregation.mode = aggregation_mode
            aggregation.reset_rules(aggregation.rules)
        
        #### constraints
        if global_constraints != aggregation.global_constraints:
            aggregation.global_constraints = global_constraints
            aggregation.reset_rules(aggregation.rules)
        
        ## add parts to aggregation
        if num_parts > len(aggregation.aggregated_parts):
            error_msg = aggregation.aggregate_rnd(num_parts-len(aggregation.aggregated_parts), use_catalog)
            if error_msg is not None:
                ghenv.Component.AddRuntimeMessage(gh.Kernel.GH_RuntimeMessageLevel.Warning, error_msg)
        
        ## remove parts from aggregation
        elif num_parts < len(aggregation.aggregated_parts):
            aggregation.remove_elements(num_parts)
        
        ## return result
        return aggregation
        
    else:
        return -1


## create aggregation container in global variables dict
if 'aggregation_container' not in globals():
    aggregation_container = None

result = main(PART, PREV, N, RULES, SEED, CAT, MODE, GC, ID, RESET, aggregation_container)

if result != -1:
    aggregation_container = result
    
    AGGR = aggregation_container
    PART_OUT = aggregation_container.aggregated_parts
# ---------- end stochasticaggregation ----------

saveaggr = Wasp_SaveAggregationToFile(AGGR=stochasticaggregation.AGGR, PATH="D:\Github\Wasp\devFiles\data", NAME="myAggr_01", SAVE=Button())  # -> TXT, FILE
# ---------- saveaggr: Python ----------
# Wasp: Discrete Design with Grasshopper plug-in (GPL) initiated by Andrea Rossi
# 
# This file is part of Wasp.
# 
# Copyright (c) 2017, Andrea Rossi <a.rossi.andrea@gmail.com>
# Wasp is free software; you can redistribute it and/or modify 
# it under the terms of the GNU General Public License as published 
# by the Free Software Foundation; either version 3 of the License, 
# or (at your option) any later version. 
# 
# Wasp is distributed in the hope that it will be useful,
# but WITHOUT ANY WARRANTY; without even the implied warranty of 
# MERCHANTABILITY or FITNESS FOR A PARTICULAR PURPOSE. See the 
# GNU General Public License for more details.
# 
# You should have received a copy of the GNU General Public License
# along with Wasp; If not, see <http://www.gnu.org/licenses/>.
# 
# @license GPL-3.0 <https://www.gnu.org/licenses/gpl.html>
#
# Significant parts of Wasp have been developed by Andrea Rossi
# as part of research on digital materials and discrete design at:
# DDU Digital Design Unit - Prof. Oliver Tessmann
# Technische Universität Darmstadt


#########################################################################
##                            COMPONENT INFO                           ##
#########################################################################

"""
Saves current status of an aggregation to a .json file.
-
Provided by Wasp 0.4
    Args:
        AGGR: Aggregation to save
        PATH: Path where to save the aggregation
        NAME: Name of the exported file
        SAVE: True to export
    Returns:
        TXT: Text representation of the aggregation
        FILE: Path to the saved file
"""

ghenv.Component.Name = "Wasp_Save Aggregation to File"
ghenv.Component.NickName = 'SaveAggr'
ghenv.Component.Message = 'VER 0.4.013'
ghenv.Component.IconDisplayMode = ghenv.Component.IconDisplayMode.application
ghenv.Component.Category = "Wasp"
ghenv.Component.SubCategory = "6 | Aggregation"
try: ghenv.Component.AdditionalHelpFromDocStrings = "2"
except: pass


import sys
import os
import Rhino.Geometry as rg
import Grasshopper as gh
import json


## add Wasp install directory to system path
wasp_loaded = False
ghcompfolder = gh.Folders.DefaultAssemblyFolder
if ghcompfolder not in sys.path:
    sys.path.append(ghcompfolder)
try:
    from wasp import __version__
    wasp_loaded = True
except:
    msg = "Cannot import Wasp. Is the wasp folder available in " + ghcompfolder + "?"
    ghenv.Component.AddRuntimeMessage(gh.Kernel.GH_RuntimeMessageLevel.Error, msg)

## if Wasp is installed correctly, load the classes required by the component
if wasp_loaded:
    pass


def main(aggregation, path, filename, save):
        
    check_data = True
    
    ## check inputs
    if aggregation is None:
        check_data = False
        msg = "No aggregation provided"
        ghenv.Component.AddRuntimeMessage(gh.Kernel.GH_RuntimeMessageLevel.Warning, msg)
    
    if path is None:
        check_data = False
        msg = "No path provided"
        ghenv.Component.AddRuntimeMessage(gh.Kernel.GH_RuntimeMessageLevel.Warning, msg)
    
    if filename is None:
        check_data = False
        msg = "No filename provided"
        ghenv.Component.AddRuntimeMessage(gh.Kernel.GH_RuntimeMessageLevel.Warning, msg)
    
    if save is None:
        save = False
    
    ## execute main code if all needed inputs are available
    if check_data:
        
        aggr_dict = {}
        aggr_dict['aggregation_name'] = aggregation.name
        aggr_dict['parts'] = {}
        for part in aggregation.aggregated_parts:
            
            part_dict = {}
            
            part_dict['name'] = part.name
            part_dict['active_connections'] = part.active_connections
            part_dict['parent'] = part.parent
            part_dict['children'] = part.children
            
            
            part_dict['transform'] = {}
            part_dict['transform']['M00'] = part.transformation.M00
            part_dict['transform']['M01'] = part.transformation.M01
            part_dict['transform']['M02'] = part.transformation.M02
            part_dict['transform']['M03'] = part.transformation.M03
            
            part_dict['transform']['M10'] = part.transformation.M10
            part_dict['transform']['M11'] = part.transformation.M11
            part_dict['transform']['M12'] = part.transformation.M12
            part_dict['transform']['M13'] = part.transformation.M13
            
            part_dict['transform']['M20'] = part.transformation.M20
            part_dict['transform']['M21'] = part.transformation.M21
            part_dict['transform']['M22'] = part.transformation.M22
            part_dict['transform']['M23'] = part.transformation.M23
            
            part_dict['transform']['M30'] = part.transformation.M30
            part_dict['transform']['M31'] = part.transformation.M31
            part_dict['transform']['M32'] = part.transformation.M32
            part_dict['transform']['M33'] = part.transformation.M33
            
            part_dict['is_constrained'] = part.is_constrained
            
            aggr_dict['parts'][part.id] = part_dict
        
        full_path = os.path.join(path, filename + ".json")
        
        if save:
            with open(full_path, "w") as outF:
                json.dump(aggr_dict, outF)
        
        return json.dumps(aggr_dict), full_path
    else:
        return -1

result = main(AGGR, PATH, NAME, SAVE)

if result != -1:
    TXT = result[0]
    FILE = result[1]
# ---------- end saveaggr ----------
loadaggr = Wasp_LoadAggregationFromFile(PART=merge_4, FILE=saveaggr.FILE)  # -> PART_OUT; inputs PART: list
# ---------- loadaggr: Python ----------
# Wasp: Discrete Design with Grasshopper plug-in (GPL) initiated by Andrea Rossi
# 
# This file is part of Wasp.
# 
# Copyright (c) 2017, Andrea Rossi <a.rossi.andrea@gmail.com>
# Wasp is free software; you can redistribute it and/or modify 
# it under the terms of the GNU General Public License as published 
# by the Free Software Foundation; either version 3 of the License, 
# or (at your option) any later version. 
# 
# Wasp is distributed in the hope that it will be useful,
# but WITHOUT ANY WARRANTY; without even the implied warranty of 
# MERCHANTABILITY or FITNESS FOR A PARTICULAR PURPOSE. See the 
# GNU General Public License for more details.
# 
# You should have received a copy of the GNU General Public License
# along with Wasp; If not, see <http://www.gnu.org/licenses/>.
# 
# @license GPL-3.0 <https://www.gnu.org/licenses/gpl.html>
#
# Significant parts of Wasp have been developed by Andrea Rossi
# as part of research on digital materials and discrete design at:
# DDU Digital Design Unit - Prof. Oliver Tessmann
# Technische Universität Darmstadt


#########################################################################
##                            COMPONENT INFO                           ##
#########################################################################

"""
Loads an aggregation from a previously saved .txt file
-
Provided by Wasp 0.4
    Args:
        PART: Parts definition for the aggregation
        FILE: File where the aggregation is saved (.json)
    Returns:
        PART_OUT: Imported aggregation parts
"""

ghenv.Component.Name = "Wasp_Load Aggregation from File"
ghenv.Component.NickName = 'LoadAggr'
ghenv.Component.Message = 'VER 0.4.013'
ghenv.Component.IconDisplayMode = ghenv.Component.IconDisplayMode.application
ghenv.Component.Category = "Wasp"
ghenv.Component.SubCategory = "6 | Aggregation"
try: ghenv.Component.AdditionalHelpFromDocStrings = "2"
except: pass


import sys
import Rhino.Geometry as rg
import Grasshopper as gh
import math
import json


## add Wasp install directory to system path
wasp_loaded = False
ghcompfolder = gh.Folders.DefaultAssemblyFolder
if ghcompfolder not in sys.path:
    sys.path.append(ghcompfolder)
try:
    from wasp import __version__
    wasp_loaded = True
except:
    msg = "Cannot import Wasp. Is the wasp folder available in " + ghcompfolder + "?"
    ghenv.Component.AddRuntimeMessage(gh.Kernel.GH_RuntimeMessageLevel.Error, msg)

## if Wasp is installed correctly, load the classes required by the component
if wasp_loaded:
    pass


def main(parts, file_path):
        
    check_data = True
    
    ## check inputs
    if len(parts) == 0:
        check_data = False
        msg = "No parts provided"
        ghenv.Component.AddRuntimeMessage(gh.Kernel.GH_RuntimeMessageLevel.Warning, msg)
    
    if file_path is None:
        check_data = False
        msg = "No path provided for the file to load"
        ghenv.Component.AddRuntimeMessage(gh.Kernel.GH_RuntimeMessageLevel.Warning, msg)
    
    ## execute main code if all needed inputs are available
    if check_data:
        
        loaded_parts = []
        aggr_dict = {}
        
        ## load json data
        with open(file_path, "r") as inF:
            txt_data = inF.read()
            aggr_dict = json.loads(txt_data)
        
        ## sort part ids
        part_ids = [int(id) for id in aggr_dict['parts'].keys()]
        part_ids.sort()
        
        ## load parts
        for id in part_ids:
            part_data = aggr_dict['parts'][str(id)]
                    
            ## part name
            name = part_data['name']
            
            ## part active connections
            active_conn = part_data['active_connections']
            parent = part_data['parent']
            children = part_data['children']
            
            ## part transform
            trans = rg.Transform(0)
            trans.M00 = part_data['transform']['M00']
            trans.M01 = part_data['transform']['M01']
            trans.M02 = part_data['transform']['M02']
            trans.M03 = part_data['transform']['M03']
            
            trans.M10 = part_data['transform']['M10']
            trans.M11 = part_data['transform']['M11']
            trans.M12 = part_data['transform']['M12']
            trans.M13 = part_data['transform']['M13']
            
            trans.M20 = part_data['transform']['M20']
            trans.M21 = part_data['transform']['M21']
            trans.M22 = part_data['transform']['M22']
            trans.M23 = part_data['transform']['M23']
            
            trans.M30 = part_data['transform']['M30']
            trans.M31 = part_data['transform']['M31']
            trans.M32 = part_data['transform']['M32']
            trans.M33 = part_data['transform']['M33']
            
            constrained = part_data['is_constrained']
            
            new_part = None
            for part in PART:
                if part.name == name:
                    new_part = part.transform(trans)
                    
                    ## flip part if negative scaling occurs
                    if trans.M00 * trans.M11 * trans.M22 < 0:
                        ## geometry
                        new_part.geo.Flip(True, True, True)
                        ## connections
                        for conn in new_part.connections:
                            pass
                            conn.pln.Flip()
                            conn.pln.Rotate(math.pi/2, conn.pln.ZAxis)
                        ## collider
                        for geo in new_part.collider.geometry:
                            geo.Flip(True, True, True)
                    
                    break
            
            if new_part is not None:
                new_part.id = id
                new_part.active_connections = active_conn
                new_part.parent = parent
                new_part.children = children
                new_part.is_constrained = constrained
                
                loaded_parts.append(new_part)
            
        return loaded_parts
    else:
        return -1

result = main(PART, FILE)

if result != -1:
    PART_OUT = result
# ---------- end loadaggr ----------

partgeo_4 = Wasp_GetPartGeometry(PART=loadaggr)  # -> GEO; same code as partgeo
partgeo_5 = Wasp_GetPartGeometry(PART=fieldaggregation_2.PART_OUT)  # -> GEO; same code as partgeo
partgeo_6 = Wasp_GetPartGeometry(PART=graphaggr.PART_OUT)  # -> GEO; same code as partgeo
panel_18 = Panel("""L
L2""")
panel_19 = Panel("""BYPIR
PIP""")
namefilter = Wasp_FilterPartsByName(PART=stochasticaggregation.PART_OUT, NAME="L2")  # -> PART_OUT, MASK; inputs PART: list, NAME: list
# ---------- namefilter: Python ----------
# Wasp: Discrete Design with Grasshopper plug-in (GPL) initiated by Andrea Rossi
# 
# This file is part of Wasp.
# 
# Copyright (c) 2017, Andrea Rossi <a.rossi.andrea@gmail.com>
# Wasp is free software; you can redistribute it and/or modify 
# it under the terms of the GNU General Public License as published 
# by the Free Software Foundation; either version 3 of the License, 
# or (at your option) any later version. 
# 
# Wasp is distributed in the hope that it will be useful,
# but WITHOUT ANY WARRANTY; without even the implied warranty of 
# MERCHANTABILITY or FITNESS FOR A PARTICULAR PURPOSE. See the 
# GNU General Public License for more details.
# 
# You should have received a copy of the GNU General Public License
# along with Wasp; If not, see <http://www.gnu.org/licenses/>.
# 
# @license GPL-3.0 <https://www.gnu.org/licenses/gpl.html>
#
# Significant parts of Wasp have been developed by Andrea Rossi
# as part of research on digital materials and discrete design at:
# DDU Digital Design Unit - Prof. Oliver Tessmann
# Technische Universität Darmstadt


#########################################################################
##                            COMPONENT INFO                           ##
#########################################################################

"""
Filter a list of parts according to part names
-
Provided by Wasp 0.4
    Args:
        PART: Parts to filter
        NAME: Name of the parts to extract
    Returns:
        PART_OUT: Filtered parts
        MASK: Boolean mask for the filtered parts
"""

ghenv.Component.Name = "Wasp_Filter Parts by Name"
ghenv.Component.NickName = 'NameFilter'
ghenv.Component.Message = 'VER 0.4.013'
ghenv.Component.IconDisplayMode = ghenv.Component.IconDisplayMode.application
ghenv.Component.Category = "Wasp"
ghenv.Component.SubCategory = "2 | Parts"
try: ghenv.Component.AdditionalHelpFromDocStrings = "3"
except: pass


import sys
import Rhino.Geometry as rg
import Grasshopper as gh


## add Wasp install directory to system path
wasp_loaded = False
ghcompfolder = gh.Folders.DefaultAssemblyFolder
if ghcompfolder not in sys.path:
    sys.path.append(ghcompfolder)
try:
    from wasp import __version__
    wasp_loaded = True
except:
    msg = "Cannot import Wasp. Is the wasp folder available in " + ghcompfolder + "?"
    ghenv.Component.AddRuntimeMessage(gh.Kernel.GH_RuntimeMessageLevel.Error, msg)

## if Wasp is installed correctly, load the classes required by the component
if wasp_loaded:
    from wasp.core import Part


## from http://www.chenjingcheng.com/grasshopper-python-datatree-list-conversion/
def listToDataTree(list):
    rl = list
    result = gh.DataTree[object]()
    for i in range(len(rl)):
        temp = []
        for j in range(len(rl[i])):
            temp.append(rl[i][j])
        path = gh.Kernel.Data.GH_Path(i)
        result.AddRange(temp, path)
    return result


def main(parts, names):
        
    check_data = True
    
    ## check inputs
    if len(parts) == 0:
        check_data = False
        msg = "No part provided"
        ghenv.Component.AddRuntimeMessage(gh.Kernel.GH_RuntimeMessageLevel.Warning, msg)
    
    if len(names) == 0:
        check_data = False
        msg = "No part name provided"
        ghenv.Component.AddRuntimeMessage(gh.Kernel.GH_RuntimeMessageLevel.Warning, msg)
    
    ## execute main code if all needed inputs are available
    if check_data:
        
        filtered_parts = []
        cull_patterns = []
        for i in xrange(len(names)):
            filtered_parts.append([])
            cull_patterns.append([])
            for part in parts:
                if part.name == names[i]:
                    filtered_parts[i].append(part)
                    cull_patterns[i].append(True)
                else:
                    cull_patterns[i].append(False)
        return filtered_parts, cull_patterns
        
    else:
        return -1

result = main(PART, NAME)

if result != -1:
    for i in range(len(result[0])):
        if len(result[0][i]) == 0:
            msg = "No part found with name %s" % (NAME[i])
            ghenv.Component.AddRuntimeMessage(gh.Kernel.GH_RuntimeMessageLevel.Warning, msg)
    
    PART_OUT = listToDataTree(result[0])
    MASK = listToDataTree(result[1])
# ---------- end namefilter ----------
namefilter_2 = Wasp_FilterPartsByName(PART=stochasticaggregation.PART_OUT, NAME="L")  # -> PART_OUT, MASK; inputs PART: list, NAME: list; same code as namefilter
gethierarchy = Wasp_GetPartsHierarchy(AGGR=stochasticaggregation.AGGR, LEVEL=Slider(1, range=0..10))  # -> SUB_P; inputs LEVEL: Int32
# ---------- gethierarchy: Python ----------
# Wasp: Discrete Design with Grasshopper plug-in (GPL) initiated by Andrea Rossi
# 
# This file is part of Wasp.
# 
# Copyright (c) 2017, Andrea Rossi <a.rossi.andrea@gmail.com>
# Wasp is free software; you can redistribute it and/or modify 
# it under the terms of the GNU General Public License as published 
# by the Free Software Foundation; either version 3 of the License, 
# or (at your option) any later version. 
# 
# Wasp is distributed in the hope that it will be useful,
# but WITHOUT ANY WARRANTY; without even the implied warranty of 
# MERCHANTABILITY or FITNESS FOR A PARTICULAR PURPOSE. See the 
# GNU General Public License for more details.
# 
# You should have received a copy of the GNU General Public License
# along with Wasp; If not, see <http://www.gnu.org/licenses/>.
# 
# @license GPL-3.0 <https://www.gnu.org/licenses/gpl.html>
#
# Significant parts of Wasp have been developed by Andrea Rossi
# as part of research on digital materials and discrete design at:
# DDU Digital Design Unit - Prof. Oliver Tessmann
# Technische Universität Darmstadt


#########################################################################
##                            COMPONENT INFO                           ##
#########################################################################

"""
Access sub-parts stored at different aggregation hierarchy levels
--> WIP Component: might be incomplete or contain bugs <--
-
Provided by Wasp 0.4
    Args:
        AGGR: Aggregation from which to extract hierarchical parts
        LEVEL: Hierarchy level (0 to return the same parts in input)
    Returns:
        SUB_P: Parts at the selected hierarchy level
"""

ghenv.Component.Name = "Wasp_Get Parts Hierarchy"
ghenv.Component.NickName = 'GetHierarchy'
ghenv.Component.Message = 'VER 0.4.013'
ghenv.Component.IconDisplayMode = ghenv.Component.IconDisplayMode.application
ghenv.Component.Category = "Wasp"
ghenv.Component.SubCategory = "X | Experimental"
try: ghenv.Component.AdditionalHelpFromDocStrings = "3"
except: pass


import sys
import Rhino.Geometry as rg
import Grasshopper as gh
import ghpythonlib.treehelpers as th


## add Wasp install directory to system path
wasp_loaded = False
ghcompfolder = gh.Folders.DefaultAssemblyFolder
if ghcompfolder not in sys.path:
    sys.path.append(ghcompfolder)
try:
    from wasp import __version__
    wasp_loaded = True
except:
    msg = "Cannot import Wasp. Is the wasp folder available in " + ghcompfolder + "?"
    ghenv.Component.AddRuntimeMessage(gh.Kernel.GH_RuntimeMessageLevel.Error, msg)

## if Wasp is installed correctly, load the classes required by the component
if wasp_loaded:
    from wasp.core import Part

## recursive function to access sub-parts stored at different hierarchy levels
def get_subparts_recursive(parts, level):
    sub_parts = []
    for part in parts:
        try:
            if level > 0:
                sub_parts.append(get_subparts_recursive(part.sub_parts, level-1))
            else:
                sub_parts.append(part.sub_parts)
        except:
            sub_parts.append([part])
            msg = "Part " + str(part.id) + " does not have any hierarchy level."
            ghenv.Component.AddRuntimeMessage(gh.Kernel.GH_RuntimeMessageLevel.Warning, msg)
    return sub_parts


def main(aggregation, hierarchy_level):
    
    check_data = True
    
    ##check inputs
    if aggregation is None:
        check_data = False
        msg = "No aggregation provided"
        ghenv.Component.AddRuntimeMessage(gh.Kernel.GH_RuntimeMessageLevel.Warning, msg)
    
    if check_data:
        
        if hierarchy_level == 0:
            return aggregation.aggregated_parts
        else:
            
            ## re-transform each part, while transorming also the sub-parts
            transformed_parts = []
            for part in aggregation.aggregated_parts:
                base_part = aggregation.parts[part.name]
                try:
                    part_trans = base_part.transform(part.transformation, transform_sub_parts = True, sub_level = hierarchy_level+1)
                    transformed_parts.append(part_trans)
                except:
                    transformed_parts.append(part)
            
            sub_parts = get_subparts_recursive(transformed_parts, hierarchy_level-1)
            
            return th.list_to_tree(sub_parts)
    else:
        return -1


result = main(AGGR, LEVEL)

if result != -1:
    SUB_P = result
# ---------- end gethierarchy ----------

# ----
# TO FIX FOR 0.4.006
python = GhPythonScript(AGGR=stochasticaggregation.AGGR)  # -> G_RULES; inputs ON: list, NN: list
# ---------- python: Python ----------
def main(aggregation, old_names, new_names):
    g_rules = []
    
    replace_names = False
    n_dict = {}
    if len(old_names) > 0 and len(old_names) == len(new_names):
        replace_names = True
        for i in range(len(old_names)):
            n_dict[old_names[i]] = new_names[i]
    
    for i in range(len(aggregation.aggregated_parts)):
        p = aggregation.aggregated_parts[i]
        
        if len(p.children) > 0:
            for child_id in p.children:
                child = aggregation.aggregated_parts[int(child_id)]
                conn_id = None
                child_conn_id = None
                
                for conn in p.connections:
                    for child_conn in child.connections:
                        conn_dist = conn.pln.Origin.DistanceTo(child_conn.pln.Origin)
                        if conn_dist < 0.001:
                            conn_id = conn.id
                            child_conn_id = child_conn.id
                            break
                    if conn_id is not None:
                        break
                
                new_p = p.name
                new_child = child.name
                
                if replace_names:
                    new_p = n_dict[p.name]
                    new_child = n_dict[child.name]
                
                if len(g_rules) == 0:
                    rule = "{}|{}_{}|{}>{}_{}".format(new_p, conn_id, new_child, child_conn_id, p.id, child.id)
                else:
                    rule = "{}|{}_{}|{}>{}_{}".format(p.id, conn_id, new_child, child_conn_id, p.id, child.id)
                
                
                g_rules.append(rule)
                
    return g_rules

G_RULES = main(AGGR, ON, NN)
# ---------- end python ----------

removepart = Wasp_RemoveParts(AGGR=fieldaggregation_2.AGGR, ID=Slider(15, range=0..100), CHILD=Toggle(True), REM=Button(), RESET=Button())  # -> AGGR_OUT, PART_OUT, C_PART, C_CHILD; inputs ID: Int32, CHILD: Boolean, REM: Boolean, RESET: Boolean
# ---------- removepart: Python ----------
# Wasp: Discrete Design with Grasshopper plug-in (GPL) initiated by Andrea Rossi
# 
# This file is part of Wasp.
# 
# Copyright (c) 2017, Andrea Rossi <a.rossi.andrea@gmail.com>
# Wasp is free software; you can redistribute it and/or modify 
# it under the terms of the GNU General Public License as published 
# by the Free Software Foundation; either version 3 of the License, 
# or (at your option) any later version. 
# 
# Wasp is distributed in the hope that it will be useful,
# but WITHOUT ANY WARRANTY; without even the implied warranty of 
# MERCHANTABILITY or FITNESS FOR A PARTICULAR PURPOSE. See the 
# GNU General Public License for more details.
# 
# You should have received a copy of the GNU General Public License
# along with Wasp; If not, see <http://www.gnu.org/licenses/>.
# 
# @license GPL-3.0 <https://www.gnu.org/licenses/gpl.html>
#
# Significant parts of Wasp have been developed by Andrea Rossi
# as part of research on digital materials and discrete design at:
# DDU Digital Design Unit - Prof. Oliver Tessmann
# Technische Universität Darmstadt


#########################################################################
##                            COMPONENT INFO                           ##
#########################################################################

"""
Remove specific parts from an aggregation.
--> WIP Component: might be incomplete or contain bugs <--
-
Provided by Wasp 0.4
    Args:
        AGGR: Aggregation to edit
        ID: ID of the part to remove
        CHILD: OPTIONAL // Remove also all children of the part (False by default)
        REM: True to remove the part from the aggregation
        RESET: Reset the aggregation to the initial state
    Returns:
        AGGR_OUT: Edited aggregation object
        PART_OUT: Edited parts
        C_PART: Currently selected part (for visualization).
        C_CHILD: Children of the selected part (for visualization).
"""

ghenv.Component.Name = "Wasp_Remove Parts"
ghenv.Component.NickName = 'RemovePart'
ghenv.Component.Message = 'VER 0.4.013'
ghenv.Component.IconDisplayMode = ghenv.Component.IconDisplayMode.application
ghenv.Component.Category = "Wasp"
ghenv.Component.SubCategory = "X | Experimental"
try: ghenv.Component.AdditionalHelpFromDocStrings = "2"
except: pass


import sys
import copy
import Rhino.Geometry as rg
import Grasshopper as gh


## add Wasp install directory to system path
wasp_loaded = False
ghcompfolder = gh.Folders.DefaultAssemblyFolder
if ghcompfolder not in sys.path:
    sys.path.append(ghcompfolder)
try:
    from wasp import __version__
    wasp_loaded = True
except:
    msg = "Cannot import Wasp. Is the wasp folder available in " + ghcompfolder + "?"
    ghenv.Component.AddRuntimeMessage(gh.Kernel.GH_RuntimeMessageLevel.Error, msg)

## if Wasp is installed correctly, load the classes required by the component
if wasp_loaded:
    pass


def main(base_aggregation, id, remove_children, remove, reset, aggregation):
    
    def returnChildren(base_aggregation, part, list):
        if len(part.children) > 0:
            for child in part.children:
                list.append(child)
                returnChildren(base_aggregation, base_aggregation.aggregated_parts[child], list)
        return list
    
    
    check_data = True
    
    ##check inputs
    if base_aggregation is None:
        check_data = False
        msg = "No aggregation provided"
        ghenv.Component.AddRuntimeMessage(gh.Kernel.GH_RuntimeMessageLevel.Warning, msg)
    
    if remove_children is None:
        remove_children = False
    
    if remove is None:
        remove = False
    
    if reset is None:
        reset = False
    
    if check_data:
        
        new_name = base_aggregation.name + "_edit"
        remove_ids = []
        current_part = None
        current_children = []
        
        if reset or aggregation is None:
            parts_list = [base_aggregation.parts[key] for key in base_aggregation.parts]
            aggregation = copy.deepcopy(base_aggregation)
            aggregation.name = new_name
        
        for i in range(len(aggregation.aggregated_parts)):
            if aggregation.aggregated_parts[i].id == id:
                current_part = aggregation.aggregated_parts[i]
                break
        
        if current_part is not None:
            remove_ids.append(id)
            if remove_children:
                remove_ids = returnChildren(aggregation, current_part, remove_ids)
            remove_ids.sort()
            
            if remove:
                for i in range(len(aggregation.aggregated_parts)-1, -1, -1):
                    if aggregation.aggregated_parts[i].id in remove_ids:
                        aggregation.aggregated_parts.pop(i)
            
            else:
                for i in range(len(aggregation.aggregated_parts)-1, -1, -1):
                    if aggregation.aggregated_parts[i].id in remove_ids:
                        if aggregation.aggregated_parts[i].id == id:
                            current_part = aggregation.aggregated_parts[i]
                        else:
                            current_children.append(aggregation.aggregated_parts[i])
        
        else:
            msg = "The provided id does not exist in the current aggregation. Might be out of range or already removed."
            ghenv.Component.AddRuntimeMessage(gh.Kernel.GH_RuntimeMessageLevel.Warning, msg)
        
        return aggregation, current_part, current_children
    else:
        return -1

## create aggregation container in global variables dict
if 'aggregation_container' not in globals():
    aggregation_container = None

result = main(AGGR, ID, CHILD, REM, RESET, aggregation_container)

if result != -1:
    aggregation_container = result[0]
    
    AGGR_OUT = aggregation_container
    PART_OUT = aggregation_container.aggregated_parts
    C_PART = result[1]
    C_CHILD = result[2]
# ---------- end removepart ----------
panel_20 = Panel(python)
partgeo_7 = Wasp_GetPartGeometry(PART=namefilter.PART_OUT)  # -> GEO; same code as partgeo
partgeo_8 = Wasp_GetPartGeometry(PART=namefilter_2.PART_OUT)  # -> GEO; same code as partgeo
partgeo_9 = Wasp_GetPartGeometry(PART=gethierarchy)  # -> GEO; same code as partgeo
swatch = ColourSwatch(SwatchColor=RGB(255, 255, 255))
partgeo_10 = Wasp_GetPartGeometry(PART=merge_4)  # -> GEO; same code as partgeo
connection_grammar_04 = Panel("TOP>BOTTOM")
partgeo_11 = Wasp_GetPartGeometry(PART=removepart.C_PART)  # -> GEO; same code as partgeo
partgeo_12 = Wasp_GetPartGeometry(PART=removepart.C_CHILD)  # -> GEO; same code as partgeo
partgeo_13 = Wasp_GetPartGeometry(PART=removepart.PART_OUT)  # -> GEO; same code as partgeo
depart = Wasp_DeconstructPart(PART=stochasticaggregation.PART_OUT)  # -> NAME, ID, GEO, CENTER, CONN, COLL, TR, PARENT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
# ---------- depart: Python ----------
# Wasp: Discrete Design with Grasshopper plug-in (GPL) initiated by Andrea Rossi
# 
# This file is part of Wasp.
# 
# Copyright (c) 2017, Andrea Rossi <a.rossi.andrea@gmail.com>
# Wasp is free software; you can redistribute it and/or modify 
# it under the terms of the GNU General Public License as published 
# by the Free Software Foundation; either version 3 of the License, 
# or (at your option) any later version. 
# 
# Wasp is distributed in the hope that it will be useful,
# but WITHOUT ANY WARRANTY; without even the implied warranty of 
# MERCHANTABILITY or FITNESS FOR A PARTICULAR PURPOSE. See the 
# GNU General Public License for more details.
# 
# You should have received a copy of the GNU General Public License
# along with Wasp; If not, see <http://www.gnu.org/licenses/>.
# 
# @license GPL-3.0 <https://www.gnu.org/licenses/gpl.html>
#
# Significant parts of Wasp have been developed by Andrea Rossi
# as part of research on digital materials and discrete design at:
# DDU Digital Design Unit - Prof. Oliver Tessmann
# Technische Universität Darmstadt


#########################################################################
##                            COMPONENT INFO                           ##
#########################################################################

"""
Extract all information stored in a part. Useful for visualization or for further geometry processing
-
Provided by Wasp 0.4
    Args:
        PART: Parts to deconstruct
    Returns:
        NAME: Name of the part
        ID: Pard ID
        GEO: Geometry of the part (as mesh). If Brep geometry is needed, can be stored in the component as attribute, or obtained by transforming the original geometry with the TR output.
        CONN: Part connections
        COLL: Part collider
        TR: Transformation applied to the part. Can be used to transform other geometries in a similar way (eg. replace a low poly component with a more detailed one)
        PARENT: Parent of the part
        CHILD: Children parts attached to the part
        ADD_COLL: Additional collider applied to the part
        ATTR: Part attributes
"""

ghenv.Component.Name = "Wasp_Deconstruct Part"
ghenv.Component.NickName = 'DePart'
ghenv.Component.Message = 'VER 0.4.013'
ghenv.Component.IconDisplayMode = ghenv.Component.IconDisplayMode.application
ghenv.Component.Category = "Wasp"
ghenv.Component.SubCategory = "2 | Parts"
try: ghenv.Component.AdditionalHelpFromDocStrings = "3"
except: pass

import sys
import Grasshopper as gh
import ghpythonlib.treehelpers as th


## add Wasp install directory to system path
wasp_loaded = False
ghcompfolder = gh.Folders.DefaultAssemblyFolder
if ghcompfolder not in sys.path:
    sys.path.append(ghcompfolder)
try:
    from wasp import __version__
    wasp_loaded = True
except:
    msg = "Cannot import Wasp. Is the wasp folder available in " + ghcompfolder + "?"
    ghenv.Component.AddRuntimeMessage(gh.Kernel.GH_RuntimeMessageLevel.Error, msg)

## if Wasp is installed correctly, load the classes required by the component
if wasp_loaded:
    from wasp.core import Aggregation


def main(part):
    
    check_data = True
    
    ##check inputs
    if part is None:
        check_data = False
        msg = "No or null part provided"
        ghenv.Component.AddRuntimeMessage(gh.Kernel.GH_RuntimeMessageLevel.Warning, msg)
    
    if check_data:
        
        data_dict = part.return_part_data()
        
        name = data_dict['name']
        id = data_dict['id']
        geometry = data_dict['geo']
        connections = data_dict['connections']
        collider = data_dict['collider']
        center = data_dict['center']
        
        transform = None
        if "transform" in data_dict.keys():
            transform = data_dict['transform']
        
        add_collider = None
        if "add_collider" in data_dict.keys():
            add_collider = data_dict['add_collider']
        
        parent = None
        if "parent" in data_dict.keys():
            parents = data_dict['parent']
        
        children = None
        if "children" in data_dict.keys():
            children = data_dict['children']
        
        attributes = None
        if "attributes" in data_dict.keys():
            attributes = data_dict['attributes']
        
        return name, id, geometry, connections, collider, center, transform, parents, children, add_collider, attributes
    else:
        return -1


result = main(PART)

if result != -1:
    NAME = result[0]
    ID = result[1]
    GEO = result[2]
    CONN = result[3]
    COLL = result[4]
    CENTER = result[5]
    TR = result[6]
    PARENT = result[7]
    CHILD = result[8]
    ADD_COLL = result[9]
    ATTR = result[10]
# ---------- end depart ----------
preview_8 = CustomPreview(Geometry=partgeo_8, Material=swatch)
preview_9 = CustomPreview(Geometry=partgeo_7, Material=ColourSwatch(SwatchColor=RGB(255, 0, 0)))
aggregationgraph = Wasp_AggregationGraph(AGGR=stochasticaggregation.AGGR, FG=Toggle(False), F=Toggle(False))  # -> G, N, E, ES_ID, EE_ID, CS_ID, CE_ID; inputs FG: Boolean, HE: Boolean, F: Boolean
# ---------- aggregationgraph: Python ----------
# Wasp: Discrete Design with Grasshopper plug-in (GPL) initiated by Andrea Rossi
# 
# This file is part of Wasp.
# 
# Copyright (c) 2017, Andrea Rossi <a.rossi.andrea@gmail.com>
# Wasp is free software; you can redistribute it and/or modify 
# it under the terms of the GNU General Public License as published 
# by the Free Software Foundation; either version 3 of the License, 
# or (at your option) any later version. 
# 
# Wasp is distributed in the hope that it will be useful,
# but WITHOUT ANY WARRANTY; without even the implied warranty of 
# MERCHANTABILITY or FITNESS FOR A PARTICULAR PURPOSE. See the 
# GNU General Public License for more details.
# 
# You should have received a copy of the GNU General Public License
# along with Wasp; If not, see <http://www.gnu.org/licenses/>.
# 
# @license GPL-3.0 <https://www.gnu.org/licenses/gpl.html>
#
# Significant parts of Wasp have been developed by Andrea Rossi
# as part of research on digital materials and discrete design at:
# DDU Digital Design Unit - Prof. Oliver Tessmann
# Technische Universität Darmstadt


#########################################################################
##                            COMPONENT INFO                           ##
#########################################################################

"""
Extract the aggregation graph.
-
Provided by Wasp 0.4
    Args:
        AGGR: Aggregation from which to extract the graph
        FG: OPTIONAL // True to compute the full graph (including edges on overlapping connections), False to create only the aggregation sequence graph (True by default)
        HE: [NOT WORKING] OPTIONAL // True to calculate an half-edge graph (each connection represented twice), False to create only edges from earlier parts to further ones (True by default)
        F: OPTIONAL // True to flatten the edges list, False to maintain edges grouped by node (True by default).
    Returns:
        G: Aggregation graph
        N: Graph nodes (each placed at a part's center)
        E: Graph edges as lines
        ES_ID: part ID at edge start
        EE_ID: part ID at edge end
        CS_ID: connection ID at edge start
        CE_ID: connection ID at edge end
"""

ghenv.Component.Name = "Wasp_Aggregation Graph"
ghenv.Component.NickName = 'AggregationGraph'
ghenv.Component.Message = 'VER 0.4.013'
ghenv.Component.IconDisplayMode = ghenv.Component.IconDisplayMode.application
ghenv.Component.Category = "Wasp"
ghenv.Component.SubCategory = "X | Experimental"
try: ghenv.Component.AdditionalHelpFromDocStrings = "4"
except: pass

import sys
import Rhino.Geometry as rg
import Grasshopper as gh
import ghpythonlib.treehelpers as th


## add Wasp install directory to system path
wasp_loaded = False
ghcompfolder = gh.Folders.DefaultAssemblyFolder
if ghcompfolder not in sys.path:
    sys.path.append(ghcompfolder)
try:
    from wasp import __version__
    wasp_loaded = True
except:
    msg = "Cannot import Wasp. Is the wasp folder available in " + ghcompfolder + "?"
    ghenv.Component.AddRuntimeMessage(gh.Kernel.GH_RuntimeMessageLevel.Error, msg)

## if Wasp is installed correctly, load the classes required by the component
if wasp_loaded:
    from wasp.core import Aggregation, Graph


def main(aggregation, full_graph, half_edge, flatten_edges):
    
    check_data = True
    
    ##check inputs
    if aggregation is None:
        check_data = False
        msg = "No aggregation provided"
        ghenv.Component.AddRuntimeMessage(gh.Kernel.GH_RuntimeMessageLevel.Warning, msg)
    
    if full_graph is None:
        full_graph = True
    
    if half_edge is None:
        half_edge = True
    
    if flatten_edges is None:
        flatten_edges = True
    
    if check_data:
        
        ## compute aggregation graph
        g = None
        if full_graph:
            g = Graph.from_aggregation(aggregation, full_graph)
        else:
            g = aggregation.graph
        
        ## extract graph data
        nodes = [int(n) for n in g.get_nodes()]
        edges = g.get_edges(flatten = flatten_edges)
        edges_attributes = g.get_edges_attributes(flatten = flatten_edges)
        
        ## generate geometric representation
        nodes_pts = [aggregation.aggregated_parts[int(i)].center for i in sorted(nodes)]
        
        edges_lines = []
        if flatten_edges:
            for edge in edges:
                start = aggregation.aggregated_parts[int(edge[0])].center
                end = aggregation.aggregated_parts[int(edge[1])].center
                edges_lines.append(rg.Line(start, end))
        else:
            for i in range(len(edges)):
                edges_lines.append([])
                for edge in edges[i]:
                    start = aggregation.aggregated_parts[int(edge[0])].center
                    end = aggregation.aggregated_parts[int(edge[1])].center
                    edges_lines[i].append(rg.Line(start, end))
                
        
        ## format data for GH outputs
        edge_start_ids = []
        edge_end_ids =[]
        conn_start_ids =[]
        conn_end_ids =[]
        
        if flatten_edges:
            for edge_attr in edges_attributes:
                edge_start_ids.append(edge_attr['start'])
                edge_end_ids.append(edge_attr['end'])
                conn_start_ids.append(edge_attr['conn_start'])
                conn_end_ids.append(edge_attr['conn_end'])
        else:
            for i in range(len(edges_attributes)):
                edge_start_ids.append([])
                edge_end_ids.append([])
                conn_start_ids.append([])
                conn_end_ids.append([])
                for edge_attr in edges_attributes[i]:
                    edge_start_ids[i].append(edge_attr['start'])
                    edge_end_ids[i].append(edge_attr['end'])
                    conn_start_ids[i].append(edge_attr['conn_start'])
                    conn_end_ids[i].append(edge_attr['conn_end'])
        
        
        """
        for i in range(len(aggregation.aggregated_parts)):
            p = aggregation.aggregated_parts[i]
            
            nodes.append(aggregation.aggregated_parts[i].center)
            edges.append([])
            
            edge_start_ids.append([])
            edge_end_ids.append([])
            
            conn_start_ids.append([])
            conn_end_ids.append([])
            
            neighbours = []
            for i2 in range(len(aggregation.aggregated_parts)):
                if aggregation.aggregated_parts[i].id != aggregation.aggregated_parts[i2].id:
                    p_dist = aggregation.aggregated_parts[i].center.DistanceTo(aggregation.aggregated_parts[i2].center)
                    if p_dist < (aggregation.aggregated_parts[i].dim + aggregation.aggregated_parts[i2].dim)*1.5:
                        neighbours.append(i2)
            for i2 in range(len(p.connections)):
                for i3 in neighbours:
                    other_p = aggregation.aggregated_parts[i3]
                    if aggregation.aggregated_parts[i3].id != p.id:
                        for i4 in range(len(aggregation.aggregated_parts[i3].connections)):
                            c_dist = p.connections[i2].pln.Origin.DistanceTo(aggregation.aggregated_parts[i3].connections[i4].pln.Origin)
                            if c_dist < 0.01:
                                
                                edge = rg.Line(p.center, aggregation.aggregated_parts[i3].center)
                                edges[i].append(edge)
                                
                                edge_start_ids[i].append(i)
                                edge_end_ids[i].append(i3)
                                
                                conn_start_ids[i].append(i2)
                                conn_end_ids[i].append(i4)
        """
        
        if flatten_edges:
            return g, nodes_pts, edges_lines, edge_start_ids, edge_end_ids, conn_start_ids, conn_end_ids
        else:
            
            edges_lines_dt = th.list_to_tree(edges_lines)
            
            edge_start_ids_dt = th.list_to_tree(edge_start_ids)
            edge_end_ids_dt = th.list_to_tree(edge_end_ids)
            conn_start_ids_dt = th.list_to_tree(conn_start_ids)
            conn_end_ids_dt = th.list_to_tree(conn_end_ids)
            
            return g, nodes_pts, edges_lines_dt, edge_start_ids_dt, edge_end_ids_dt, conn_start_ids_dt, conn_end_ids_dt
        
    else:
        return -1


result = main(AGGR, FG, HE, F)

if result != -1:
    G = result[0]
    N = result[1]
    E = result[2]
    
    ES_ID = result[3]
    EE_ID = result[4]
    CS_ID = result[5]
    CE_ID = result[6]
# ---------- end aggregationgraph ----------
volume_3 = Volume(Geometry=partgeo_10)  # -> Volume, Centroid
ruleg = Wasp_DisCoRuleGroup(NAME="UP", GR=connection_grammar_04)  # -> RULE_G; inputs GR: list
# ---------- ruleg: Python ----------
# Wasp: Discrete Design with Grasshopper plug-in (GPL) initiated by Andrea Rossi
# 
# This file is part of Wasp.
# 
# Copyright (c) 2017, Andrea Rossi <a.rossi.andrea@gmail.com>
# Wasp is free software; you can redistribute it and/or modify 
# it under the terms of the GNU General Public License as published 
# by the Free Software Foundation; either version 3 of the License, 
# or (at your option) any later version. 
# 
# Wasp is distributed in the hope that it will be useful,
# but WITHOUT ANY WARRANTY; without even the implied warranty of 
# MERCHANTABILITY or FITNESS FOR A PARTICULAR PURPOSE. See the 
# GNU General Public License for more details.
# 
# You should have received a copy of the GNU General Public License
# along with Wasp; If not, see <http://www.gnu.org/licenses/>.
# 
# @license GPL-3.0 <https://www.gnu.org/licenses/gpl.html>
#
# Significant parts of Wasp have been developed by Andrea Rossi
# as part of research on digital materials and discrete design at:
# DDU Digital Design Unit - Prof. Oliver Tessmann
# Technische Universität Darmstadt


#########################################################################
##                            COMPONENT INFO                           ##
#########################################################################

"""
Export Wasp information for DisCo VR software.
DisCo (Discrete Choreography) is developed by Jan Philipp Drude at dMA Hannover - Prof. Mirco Becker.
Project DisCo is available at: http://www.project-disco.com/
--> WIP Component: might be incomplete or contain bugs <--
-
Provided by Wasp 0.4
    Args:
        PART: Parts to be aggregated in DisCo
        RULES: Aggregation rules
        COLL: OPTIONAL // Part collider. If not provided, part geometry will be used.
        PROB: OPTIONAL // Probability distribution for each part
        ADD_GEO: OPTIONAL // Additional geometry to import in DisCo (e.g., environment geometry)
        PATH: Path where to save the DisCo .json file
        NAME: Export file name
        SAVE: True to export
    Returns:
        TXT: ...
        FILE: ...
"""

ghenv.Component.Name = "Wasp_DisCo Rule Group"
ghenv.Component.NickName = 'RuleG'
ghenv.Component.Message = 'VER 0.4.013'
ghenv.Component.IconDisplayMode = ghenv.Component.IconDisplayMode.application
ghenv.Component.Category = "Wasp"
ghenv.Component.SubCategory = "7 | DisCo VR"
try: ghenv.Component.AdditionalHelpFromDocStrings = "3"
except: pass

import sys
import json
import Rhino.Geometry as rg
import Grasshopper as gh


## add Wasp install directory to system path
wasp_loaded = False
ghcompfolder = gh.Folders.DefaultAssemblyFolder
if ghcompfolder not in sys.path:
    sys.path.append(ghcompfolder)
try:
    from wasp import __version__
    wasp_loaded = True
except:
    msg = "Cannot import Wasp. Is the wasp folder available in " + ghcompfolder + "?"
    ghenv.Component.AddRuntimeMessage(gh.Kernel.GH_RuntimeMessageLevel.Error, msg)

## if Wasp is installed correctly, load the classes required by the component
if wasp_loaded:
    pass


def main(group_name, rule_grammar):
    
    check_data = True
    
    ## check inputs
    if group_name is None:
        check_data = False
        msg = "No group name provided"
        ghenv.Component.AddRuntimeMessage(gh.Kernel.GH_RuntimeMessageLevel.Warning, msg)
    
    if len(rule_grammar) == 0:
        check_data = False
        msg = "No rules grammar provided"
        ghenv.Component.AddRuntimeMessage(gh.Kernel.GH_RuntimeMessageLevel.Warning, msg)
    
    
    if check_data:
        group_dict = {}
        group_dict['RuleGroupName'] = group_name
        group_dict["RuleGrammar"] = rule_grammar
        
        return json.dumps(group_dict)
    else:
        return -1


result = main(NAME, GR)

if result != -1:
    RULE_G = result
# ---------- end ruleg ----------
button_2 = Button()
scale = Scale(Geometry=partgeo_10, Center=volume_3.Centroid, Factor=Slider(0.001, range=0..0.001))  # -> Geometry, Transform
medges = MeshEdges(Mesh=partgeo_13)  # -> NakedEdges, InteriorEdges, NonManifoldEdges
graphaggr_2 = Wasp_GraphGrammarAggregation(PART=flatten(merge_4), RULES=python, RESET=Toggle(True))  # -> AGGR, PART_OUT; inputs PART: list, PREV: list, RULES: list, RESET: Boolean; same code as graphaggr
graphaggr_3 = Wasp_GraphGrammarAggregation(PART=flatten(merge_4), RULES=python, RESET=Button())  # -> AGGR, PART_OUT; inputs PART: list, PREV: list, RULES: list, RESET: Boolean; same code as graphaggr
preview_10 = CustomPreview(Geometry=partgeo_12, Material=ColourSwatch(SwatchColor=RGB(255, 145, 145)))
preview_11 = CustomPreview(Geometry=partgeo_11, Material=ColourSwatch(SwatchColor=RGB(255, 0, 0)))
parttr_2 = Wasp_TransformPart(PART=merge_4, TR=scale.Transform)  # -> PART_OUT; same code as parttr
panel_21 = Panel("""0.2
0.7""")
mesh_6 = Mesh(depart.GEO)
item_5 = ListItem(List=stochasticaggregation.PART_OUT, Index=depart.CHILD, Wrap=True)
pt_4 = Point(aggregationgraph.N)
merge_7 = Merge(Data1=Slider(50, range=0..100), Data2=Slider(10, range=0..100))
crv_2 = Curve(aggregationgraph.E)
savegraph = Wasp_SaveGraphToFile(G=aggregationgraph.G, PATH="D:\Github\Wasp\devFiles\", NAME="myGraph", SAVE=Button())  # -> TXT, FILE
# ---------- savegraph: Python ----------
# Wasp: Discrete Design with Grasshopper plug-in (GPL) initiated by Andrea Rossi
# 
# This file is part of Wasp.
# 
# Copyright (c) 2017, Andrea Rossi <a.rossi.andrea@gmail.com>
# Wasp is free software; you can redistribute it and/or modify 
# it under the terms of the GNU General Public License as published 
# by the Free Software Foundation; either version 3 of the License, 
# or (at your option) any later version. 
# 
# Wasp is distributed in the hope that it will be useful,
# but WITHOUT ANY WARRANTY; without even the implied warranty of 
# MERCHANTABILITY or FITNESS FOR A PARTICULAR PURPOSE. See the 
# GNU General Public License for more details.
# 
# You should have received a copy of the GNU General Public License
# along with Wasp; If not, see <http://www.gnu.org/licenses/>.
# 
# @license GPL-3.0 <https://www.gnu.org/licenses/gpl.html>
#
# Significant parts of Wasp have been developed by Andrea Rossi
# as part of research on digital materials and discrete design at:
# DDU Digital Design Unit - Prof. Oliver Tessmann
# Technische Universität Darmstadt


#########################################################################
##                            COMPONENT INFO                           ##
#########################################################################

"""
Saves current status of an aggregation to a .json file.
-
Provided by Wasp 0.4
    Args:
        G: Graph to save
        PATH: Path where to save the file
        NAME: Name of the exported file
        SAVE: True to export
    Returns:
        TXT: Text representation of the graph
        FILE: Path to the saved file
"""

ghenv.Component.Name = "Wasp_Save Graph to File"
ghenv.Component.NickName = 'SaveGraph'
ghenv.Component.Message = 'VER 0.4.013'
ghenv.Component.IconDisplayMode = ghenv.Component.IconDisplayMode.application
ghenv.Component.Category = "Wasp"
ghenv.Component.SubCategory = "X | Experimental"
try: ghenv.Component.AdditionalHelpFromDocStrings = "4"
except: pass


import sys
import os
import Rhino.Geometry as rg
import Grasshopper as gh
import json


## add Wasp install directory to system path
wasp_loaded = False
ghcompfolder = gh.Folders.DefaultAssemblyFolder
if ghcompfolder not in sys.path:
    sys.path.append(ghcompfolder)
try:
    from wasp import __version__
    wasp_loaded = True
except:
    msg = "Cannot import Wasp. Is the wasp folder available in " + ghcompfolder + "?"
    ghenv.Component.AddRuntimeMessage(gh.Kernel.GH_RuntimeMessageLevel.Error, msg)

## if Wasp is installed correctly, load the classes required by the component
if wasp_loaded:
    from wasp.core import Graph


def main(graph, path, filename, save):
        
    check_data = True
    
    ## check inputs
    if graph is None:
        check_data = False
        msg = "No graph provided"
        ghenv.Component.AddRuntimeMessage(gh.Kernel.GH_RuntimeMessageLevel.Warning, msg)
    
    if path is None:
        check_data = False
        msg = "No path provided"
        ghenv.Component.AddRuntimeMessage(gh.Kernel.GH_RuntimeMessageLevel.Warning, msg)
    
    if filename is None:
        check_data = False
        msg = "No filename provided"
        ghenv.Component.AddRuntimeMessage(gh.Kernel.GH_RuntimeMessageLevel.Warning, msg)
    
    if save is None:
        save = False
    
    ## execute main code if all needed inputs are available
    if check_data:
        
        graph_dict = graph.to_data()
        full_path = os.path.join(path, filename + ".json")
        
        if save:
            with open(full_path, "w") as outF:
                json.dump(graph_dict, outF)
        
        return json.dumps(graph_dict), full_path
    else:
        return -1

result = main(G, PATH, NAME, SAVE)

if result != -1:
    TXT = result[0]
    FILE = result[1]
# ---------- end savegraph ----------
partgeo_14 = Wasp_GetPartGeometry(PART=graphaggr_2.PART_OUT)  # -> GEO; same code as partgeo
discoload = Wasp_LoadFromDisCo(PART=parttr_2, FILE="D:\GitHub\Wasp\devFiles\data\Save_190527_15-32.json")  # -> PART_OUT; inputs PART: list
# ---------- discoload: Python ----------
# Wasp: Discrete Design with Grasshopper plug-in (GPL) initiated by Andrea Rossi
# 
# This file is part of Wasp.
# 
# Copyright (c) 2017, Andrea Rossi <a.rossi.andrea@gmail.com>
# Wasp is free software; you can redistribute it and/or modify 
# it under the terms of the GNU General Public License as published 
# by the Free Software Foundation; either version 3 of the License, 
# or (at your option) any later version. 
# 
# Wasp is distributed in the hope that it will be useful,
# but WITHOUT ANY WARRANTY; without even the implied warranty of 
# MERCHANTABILITY or FITNESS FOR A PARTICULAR PURPOSE. See the 
# GNU General Public License for more details.
# 
# You should have received a copy of the GNU General Public License
# along with Wasp; If not, see <http://www.gnu.org/licenses/>.
# 
# @license GPL-3.0 <https://www.gnu.org/licenses/gpl.html>
#
# Significant parts of Wasp have been developed by Andrea Rossi
# as part of research on digital materials and discrete design at:
# DDU Digital Design Unit - Prof. Oliver Tessmann
# Technische Universität Darmstadt


#########################################################################
##                            COMPONENT INFO                           ##
#########################################################################

"""
Loads an aggregation from a DisCo-generated .json file (e.g., a saved game session).
--> WIP Component: might be incomplete or contain bugs <--
-
Provided by Wasp 0.4
    Args:
        PART: Parts definition for the aggregation
        FILE: File where the DisCo aggregation is saved (.json)
    Returns:
        PART_OUT: Imported aggregation parts
"""

ghenv.Component.Name = "Wasp_Load From DisCo"
ghenv.Component.NickName = 'DisCoLoad'
ghenv.Component.Message = 'VER 0.4.013'
ghenv.Component.IconDisplayMode = ghenv.Component.IconDisplayMode.application
ghenv.Component.Category = "Wasp"
ghenv.Component.SubCategory = "7 | DisCo VR"
try: ghenv.Component.AdditionalHelpFromDocStrings = "2"
except: pass


import sys
import Rhino.Geometry as rg
import Grasshopper as gh
import json
import math


## add Wasp install directory to system path
wasp_loaded = False
ghcompfolder = gh.Folders.DefaultAssemblyFolder
if ghcompfolder not in sys.path:
    sys.path.append(ghcompfolder)
try:
    from wasp import __version__
    wasp_loaded = True
except:
    msg = "Cannot import Wasp. Is the wasp folder available in " + ghcompfolder + "?"
    ghenv.Component.AddRuntimeMessage(gh.Kernel.GH_RuntimeMessageLevel.Error, msg)

## if Wasp is installed correctly, load the classes required by the component
if wasp_loaded:
    pass


def main(parts, file_path):
        
    check_data = True
    
    ## check inputs
    if len(parts) == 0:
        check_data = False
        msg = "No parts provided"
        ghenv.Component.AddRuntimeMessage(gh.Kernel.GH_RuntimeMessageLevel.Warning, msg)
    
    if file_path is None:
        check_data = False
        msg = "No path provided for the file to load"
        ghenv.Component.AddRuntimeMessage(gh.Kernel.GH_RuntimeMessageLevel.Warning, msg)
    
    ## execute main code if all needed inputs are available
    if check_data:
        
        loaded_parts = []
        aggr_dict = {}
        
        ## load json data
        with open(FILE, "r") as inF:
            txt_data = inF.read()
            aggr_dict = json.loads(txt_data)
        
        ## sort part ids
        part_ids = [int(id) for id in aggr_dict['parts'].keys()]
        part_ids.sort()
        
        ## load parts
        for id in part_ids:
            part_data = aggr_dict['parts'][str(id)]
                    
            ## part name
            name = part_data['name']
            
            ## part active connections
            active_conn = part_data['active_connections']
            parent = part_data['parent']
            children = part_data['children']
            
            ## part transform
            trans = rg.Transform(0)
            trans.M00 = part_data['transform']['M00']
            trans.M01 = part_data['transform']['M01']
            trans.M02 = part_data['transform']['M02']
            trans.M03 = part_data['transform']['M03']
            
            trans.M10 = part_data['transform']['M10']
            trans.M11 = part_data['transform']['M11']
            trans.M12 = part_data['transform']['M12']
            trans.M13 = part_data['transform']['M13']
            
            trans.M20 = part_data['transform']['M20']
            trans.M21 = part_data['transform']['M21']
            trans.M22 = part_data['transform']['M22']
            trans.M23 = part_data['transform']['M23']
            
            trans.M30 = part_data['transform']['M30']
            trans.M31 = part_data['transform']['M31']
            trans.M32 = part_data['transform']['M32']
            trans.M33 = part_data['transform']['M33']
            
            constrained = part_data['is_constrained']
            
            new_part = None
            for part in PART:
                if part.name == name:
                    
                    center_vector = rg.Vector3d.Subtract(rg.Vector3d(0,0,0), rg.Vector3d(part.center))
                    center_transform = rg.Transform.Translation(center_vector)
                    
                    full_trans = rg.Transform.Multiply(trans, center_transform)
                    
                    new_part = part.transform(full_trans)
                    
                    ## flip part if negative scaling occurs
                    if full_trans.M00 * full_trans.M11 * full_trans.M22 < 0:
                        ## geometry
                        new_part.geo.Flip(True, True, True)
                        ## connections
                        for conn in new_part.connections:
                            pass
                            conn.pln.Flip()
                            conn.pln.Rotate(math.pi/2, conn.pln.ZAxis)
                        ## collider
                        for geo in new_part.collider.geometry:
                            geo.Flip(True, True, True)
                    
                    new_part.id = id
                    break
            
            if new_part is not None:
                new_part.active_connections = active_conn
                new_part.parent = parent
                new_part.children = children
                new_part.is_constrained = constrained
                
                loaded_parts.append(new_part)
            
        return loaded_parts
    else:
        return -1

result = main(PART, FILE)

if result != -1:
    PART_OUT = result
# ---------- end discoload ----------
getattr = Wasp_GetAttributeByName(PART=stochasticaggregation.PART_OUT, ID="connectors")  # -> VAL
# ---------- getattr: Python ----------
# Wasp: Discrete Design with Grasshopper plug-in (GPL) initiated by Andrea Rossi
# 
# This file is part of Wasp.
# 
# Copyright (c) 2017, Andrea Rossi <a.rossi.andrea@gmail.com>
# Wasp is free software; you can redistribute it and/or modify 
# it under the terms of the GNU General Public License as published 
# by the Free Software Foundation; either version 3 of the License, 
# or (at your option) any later version. 
# 
# Wasp is distributed in the hope that it will be useful,
# but WITHOUT ANY WARRANTY; without even the implied warranty of 
# MERCHANTABILITY or FITNESS FOR A PARTICULAR PURPOSE. See the 
# GNU General Public License for more details.
# 
# You should have received a copy of the GNU General Public License
# along with Wasp; If not, see <http://www.gnu.org/licenses/>.
# 
# @license GPL-3.0 <https://www.gnu.org/licenses/gpl.html>
#
# Significant parts of Wasp have been developed by Andrea Rossi
# as part of research on digital materials and discrete design at:
# DDU Digital Design Unit - Prof. Oliver Tessmann
# Technische Universität Darmstadt


#########################################################################
##                            COMPONENT INFO                           ##
#########################################################################

"""
Extract values stored in an atrribute with the given name.
-
Provided by Wasp 0.4
    Args:
        PART: Part from which to extract the attribute
        ID: Name of the attribute to extract
    Returns:
        VAL: Value stored in the requested attribute
"""

ghenv.Component.Name = "Wasp_Get Attribute by Name"
ghenv.Component.NickName = 'GetAttr'
ghenv.Component.Message = 'VER 0.4.013'
ghenv.Component.IconDisplayMode = ghenv.Component.IconDisplayMode.application
ghenv.Component.Category = "Wasp"
ghenv.Component.SubCategory = "1 | Elements"
try: ghenv.Component.AdditionalHelpFromDocStrings = "2"
except: pass


import sys
import Grasshopper as gh


## add Wasp install directory to system path
wasp_loaded = False
ghcompfolder = gh.Folders.DefaultAssemblyFolder
if ghcompfolder not in sys.path:
    sys.path.append(ghcompfolder)
try:
    from wasp import __version__
    wasp_loaded = True
except:
    msg = "Cannot import Wasp. Is the wasp folder available in " + ghcompfolder + "?"
    ghenv.Component.AddRuntimeMessage(gh.Kernel.GH_RuntimeMessageLevel.Error, msg)

## if Wasp is installed correctly, load the classes required by the component
if wasp_loaded:
    pass


def main(part, id):
        
    check_data = True
    
    ## check inputs
    if part is None:
        check_data = False
        msg = "No part provided"
        ghenv.Component.AddRuntimeMessage(gh.Kernel.GH_RuntimeMessageLevel.Warning, msg)
    
    if id is None:
        check_data = False
        msg = "No attribute id provided"
        ghenv.Component.AddRuntimeMessage(gh.Kernel.GH_RuntimeMessageLevel.Warning, msg)
    
    ## execute main code if all needed inputs are available
    if check_data:
        values = []
        for attr in part.attributes:
            if attr.name == id:
                values = attr.values
        return values
    else:
        return -1

result = main(PART, ID)

if result != -1:
    if len(result) == 0:
        msg = "No attribute found matching the provided id"
        ghenv.Component.AddRuntimeMessage(gh.Kernel.GH_RuntimeMessageLevel.Warning, msg)
    else:
        VAL = result
# ---------- end getattr ----------
deattr = Wasp_DeconstructAttribute(ATTR=depart.ATTR)  # -> ID, VAL
# ---------- deattr: Python ----------
# Wasp: Discrete Design with Grasshopper plug-in (GPL) initiated by Andrea Rossi
# 
# This file is part of Wasp.
# 
# Copyright (c) 2017, Andrea Rossi <a.rossi.andrea@gmail.com>
# Wasp is free software; you can redistribute it and/or modify 
# it under the terms of the GNU General Public License as published 
# by the Free Software Foundation; either version 3 of the License, 
# or (at your option) any later version. 
# 
# Wasp is distributed in the hope that it will be useful,
# but WITHOUT ANY WARRANTY; without even the implied warranty of 
# MERCHANTABILITY or FITNESS FOR A PARTICULAR PURPOSE. See the 
# GNU General Public License for more details.
# 
# You should have received a copy of the GNU General Public License
# along with Wasp; If not, see <http://www.gnu.org/licenses/>.
# 
# @license GPL-3.0 <https://www.gnu.org/licenses/gpl.html>
#
# Significant parts of Wasp have been developed by Andrea Rossi
# as part of research on digital materials and discrete design at:
# DDU Digital Design Unit - Prof. Oliver Tessmann
# Technische Universität Darmstadt


#########################################################################
##                            COMPONENT INFO                           ##
#########################################################################

"""
Extract values stored in an atrribute
-
Provided by Wasp 0.4
    Args:
        ATTR: Attribute to deconstruct
    Returns:
        ID: Name of the attribute
        VAL: Value stored in the attribute
"""

ghenv.Component.Name = "Wasp_Deconstruct Attribute"
ghenv.Component.NickName = 'DeAttr'
ghenv.Component.Message = 'VER 0.4.013'
ghenv.Component.IconDisplayMode = ghenv.Component.IconDisplayMode.application
ghenv.Component.Category = "Wasp"
ghenv.Component.SubCategory = "1 | Elements"
try: ghenv.Component.AdditionalHelpFromDocStrings = "2"
except: pass


import sys
import Grasshopper as gh


## add Wasp install directory to system path
wasp_loaded = False
ghcompfolder = gh.Folders.DefaultAssemblyFolder
if ghcompfolder not in sys.path:
    sys.path.append(ghcompfolder)
try:
    from wasp import __version__
    wasp_loaded = True
except:
    msg = "Cannot import Wasp. Is the wasp folder available in " + ghcompfolder + "?"
    ghenv.Component.AddRuntimeMessage(gh.Kernel.GH_RuntimeMessageLevel.Error, msg)

## if Wasp is installed correctly, load the classes required by the component
if wasp_loaded:
    pass


def main(attribute):
        
    check_data = True
    
    ## check inputs
    if attribute is None:
        check_data = False
        msg = "No attribute provided"
        ghenv.Component.AddRuntimeMessage(gh.Kernel.GH_RuntimeMessageLevel.Warning, msg)
    
    ## execute main code if all needed inputs are available
    if check_data:
        return attribute.name, attribute.values
    else:
        return -1

result = main(ATTR)

if result != -1:
    ID = result[0]
    VAL = result[1]
# ---------- end deattr ----------
decoll = Wasp_DeconstructCollider(COLL=depart.COLL)  # -> GEO, CONN, VC
# ---------- decoll: Python ----------
# Wasp: Discrete Design with Grasshopper plug-in (GPL) initiated by Andrea Rossi
# 
# This file is part of Wasp.
# 
# Copyright (c) 2017, Andrea Rossi <a.rossi.andrea@gmail.com>
# Wasp is free software; you can redistribute it and/or modify 
# it under the terms of the GNU General Public License as published 
# by the Free Software Foundation; either version 3 of the License, 
# or (at your option) any later version. 
# 
# Wasp is distributed in the hope that it will be useful,
# but WITHOUT ANY WARRANTY; without even the implied warranty of 
# MERCHANTABILITY or FITNESS FOR A PARTICULAR PURPOSE. See the 
# GNU General Public License for more details.
# 
# You should have received a copy of the GNU General Public License
# along with Wasp; If not, see <http://www.gnu.org/licenses/>.
# 
# @license GPL-3.0 <https://www.gnu.org/licenses/gpl.html>
#
# Significant parts of Wasp have been developed by Andrea Rossi
# as part of research on digital materials and discrete design at:
# DDU Digital Design Unit - Prof. Oliver Tessmann
# Technische Universität Darmstadt


#########################################################################
##                            COMPONENT INFO                           ##
#########################################################################

"""
Deconstruct a collider object.
-
Provided by Wasp 0.4
    Args:
        COLL: Collider object
    Returns:
        GEO: Collider geometry
        CONN: If collider is Multiple, connections associated with the collider
        VC: If collider is Multiple, valid connections not causing collisions
"""

ghenv.Component.Name = "Wasp_Deconstruct Collider"
ghenv.Component.NickName = 'DeColl'
ghenv.Component.Message = 'VER 0.4.013'
ghenv.Component.IconDisplayMode = ghenv.Component.IconDisplayMode.application
ghenv.Component.Category = "Wasp"
ghenv.Component.SubCategory = "1 | Elements"
try: ghenv.Component.AdditionalHelpFromDocStrings = "4"
except: pass


import sys
import Grasshopper as gh


## add Wasp install directory to system path
wasp_loaded = False
ghcompfolder = gh.Folders.DefaultAssemblyFolder
if ghcompfolder not in sys.path:
    sys.path.append(ghcompfolder)
try:
    from wasp import __version__
    wasp_loaded = True
except:
    msg = "Cannot import Wasp. Is the wasp folder available in " + ghcompfolder + "?"
    ghenv.Component.AddRuntimeMessage(gh.Kernel.GH_RuntimeMessageLevel.Error, msg)

## if Wasp is installed correctly, load the classes required by the component
if wasp_loaded:
    pass


def main(collider):
        
    check_data = True
    
    ## check inputs
    if collider is None:
        check_data = False
        msg = "No collider provided"
        ghenv.Component.AddRuntimeMessage(gh.Kernel.GH_RuntimeMessageLevel.Warning, msg)
    
    ## execute main code if all needed inputs are available
    if check_data:
        return collider.geometry, collider.connections, collider.valid_connections
    else:
        return -1

result = main(COLL)

if result != -1:
    GEO = result[0]
    CONN = result[1]
    VC = result[2]
# ---------- end decoll ----------
getsmartattr = Wasp_GetValidSmartAttributes(AGGR=stochasticaggregation.AGGR, ID="smartBlocks")  # -> VAL; inputs ID: list
# ---------- getsmartattr: Python ----------
# Wasp: Discrete Design with Grasshopper plug-in (GPL) initiated by Andrea Rossi
# 
# This file is part of Wasp.
# 
# Copyright (c) 2017, Andrea Rossi <a.rossi.andrea@gmail.com>
# Wasp is free software; you can redistribute it and/or modify 
# it under the terms of the GNU General Public License as published 
# by the Free Software Foundation; either version 3 of the License, 
# or (at your option) any later version. 
# 
# Wasp is distributed in the hope that it will be useful,
# but WITHOUT ANY WARRANTY; without even the implied warranty of 
# MERCHANTABILITY or FITNESS FOR A PARTICULAR PURPOSE. See the 
# GNU General Public License for more details.
# 
# You should have received a copy of the GNU General Public License
# along with Wasp; If not, see <http://www.gnu.org/licenses/>.
# 
# @license GPL-3.0 <https://www.gnu.org/licenses/gpl.html>
#
# Significant parts of Wasp have been developed by Andrea Rossi
# as part of research on digital materials and discrete design at:
# DDU Digital Design Unit - Prof. Oliver Tessmann
# Technische Universität Darmstadt


#########################################################################
##                            COMPONENT INFO                           ##
#########################################################################

"""
Get the valid smart attributes from a given aggregation.
-
Provided by Wasp 0.4
    Args:
        AGGR: Aggregation from which to extract the smart attributes
        ID: Name of the smart attribute to extract
    Returns:
        VAL: Value stored in the valid smart attributes
"""

ghenv.Component.Name = "Wasp_Get Valid Smart Attributes"
ghenv.Component.NickName = 'GetSmartAttr'
ghenv.Component.Message = 'VER 0.4.013'
ghenv.Component.IconDisplayMode = ghenv.Component.IconDisplayMode.application
ghenv.Component.Category = "Wasp"
ghenv.Component.SubCategory = "1 | Elements"
try: ghenv.Component.AdditionalHelpFromDocStrings = "2"
except: pass


import sys
import Grasshopper as gh
import ghpythonlib.treehelpers as th


## add Wasp install directory to system path
wasp_loaded = False
ghcompfolder = gh.Folders.DefaultAssemblyFolder
if ghcompfolder not in sys.path:
    sys.path.append(ghcompfolder)
try:
    from wasp import __version__
    wasp_loaded = True
except:
    msg = "Cannot import Wasp. Is the wasp folder available in " + ghcompfolder + "?"
    ghenv.Component.AddRuntimeMessage(gh.Kernel.GH_RuntimeMessageLevel.Error, msg)

## if Wasp is installed correctly, load the classes required by the component
if wasp_loaded:
    from wasp.core import SmartAttribute


def main(aggregation, ids):
        
    check_data = True
    
    ## check inputs
    if aggregation is None:
        check_data = False
        msg = "No aggregation provided"
        ghenv.Component.AddRuntimeMessage(gh.Kernel.GH_RuntimeMessageLevel.Warning, msg)
    
    if len(ids) == 0:
        check_data = False
        msg = "No attribute ids provided"
        ghenv.Component.AddRuntimeMessage(gh.Kernel.GH_RuntimeMessageLevel.Warning, msg)
    
    ## execute main code if all needed inputs are available
    if check_data:
        
        values = []
        
        for i in range(len(aggregation.aggregated_parts)):
            part = aggregation.aggregated_parts[i]
            p_matrix = aggregation.check_blocked_connections(part)
            values.append([])
            for attr_id in ids:
                for attr in part.attributes:
                    if type(attr) == SmartAttribute:
                        if attr.name == attr_id:
                            is_valid = True
                            for i2 in range(len(attr.conn_mask)):
                                if attr.conn_mask[i2] == 1:
                                    if i2 not in p_matrix:
                                        is_valid = False
                                        break
                                elif attr.conn_mask[i2] == -1:
                                    if i2 in p_matrix:
                                        is_valid = False
                                        break
                            if is_valid:
                                values[i].append(attr.values)
                            break
        
        return th.list_to_tree(values)
    else:
        return -1

result = main(AGGR, ID)

if result != -1:
        VAL = result
# ---------- end getsmartattr ----------
wasp2disco = Wasp_WaspToDisCo(
    PART=parttr_2,
    RULES=rulegen,
    RULE_G=ruleg,
    COLL=scale.Geometry,
    PROB=panel_21,
    SPAWN_N=merge_7,
    PATH="D:\Github\Wasp\devFiles\",
    NAME="wasp2DisCo",
    SAVE=Button())  # -> TXT, FILE; inputs PART: list, RULES: list, RULE_G: list, COLL: list, PROB: list, SPAWN_N: list of Int32, ADD_GEO: list of Mesh, SAVE: Boolean
# ---------- wasp2disco: Python ----------
# Wasp: Discrete Design with Grasshopper plug-in (GPL) initiated by Andrea Rossi
# 
# This file is part of Wasp.
# 
# Copyright (c) 2017, Andrea Rossi <a.rossi.andrea@gmail.com>
# Wasp is free software; you can redistribute it and/or modify 
# it under the terms of the GNU General Public License as published 
# by the Free Software Foundation; either version 3 of the License, 
# or (at your option) any later version. 
# 
# Wasp is distributed in the hope that it will be useful,
# but WITHOUT ANY WARRANTY; without even the implied warranty of 
# MERCHANTABILITY or FITNESS FOR A PARTICULAR PURPOSE. See the 
# GNU General Public License for more details.
# 
# You should have received a copy of the GNU General Public License
# along with Wasp; If not, see <http://www.gnu.org/licenses/>.
# 
# @license GPL-3.0 <https://www.gnu.org/licenses/gpl.html>
#
# Significant parts of Wasp have been developed by Andrea Rossi
# as part of research on digital materials and discrete design at:
# DDU Digital Design Unit - Prof. Oliver Tessmann
# Technische Universität Darmstadt


#########################################################################
##                            COMPONENT INFO                           ##
#########################################################################

"""
Export Wasp information for DisCo VR software.
DisCo (Discrete Choreography) is developed by Jan Philipp Drude at dMA Hannover - Prof. Mirco Becker.
Project DisCo is available at: http://www.project-disco.com/
--> WIP Component: might be incomplete or contain bugs <--
-
Provided by Wasp 0.4
    Args:
        PART: Parts to be aggregated in DisCo
        RULES: Aggregation rules
        COLL: OPTIONAL // Part collider. If not provided, part geometry will be used.
        PROB: OPTIONAL // Probability distribution for each part
        ADD_GEO: OPTIONAL // Additional geometry to import in DisCo (e.g., environment geometry)
        PATH: Path where to save the DisCo .json file
        NAME: Export file name
        SAVE: True to export
    Returns:
        TXT: ...
        FILE: ...
"""

ghenv.Component.Name = "Wasp_Wasp To DisCo"
ghenv.Component.NickName = 'Wasp2DisCo'
ghenv.Component.Message = 'VER 0.4.013'
ghenv.Component.IconDisplayMode = ghenv.Component.IconDisplayMode.application
ghenv.Component.Category = "Wasp"
ghenv.Component.SubCategory = "7 | DisCo VR"
try: ghenv.Component.AdditionalHelpFromDocStrings = "1"
except: pass

import sys
import json
import Rhino.Geometry as rg
import Grasshopper as gh


## add Wasp install directory to system path
wasp_loaded = False
ghcompfolder = gh.Folders.DefaultAssemblyFolder
if ghcompfolder not in sys.path:
    sys.path.append(ghcompfolder)
try:
    from wasp import __version__
    wasp_loaded = True
except:
    msg = "Cannot import Wasp. Is the wasp folder available in " + ghcompfolder + "?"
    ghenv.Component.AddRuntimeMessage(gh.Kernel.GH_RuntimeMessageLevel.Error, msg)

## if Wasp is installed correctly, load the classes required by the component
if wasp_loaded:
    from wasp.core import Collider


def MeshToString(mesh, name):
    mesh_text = []
    mesh_text.append(str("\no " + name + "\n"))
    
    for v in mesh.Vertices:
        line = "v "
        line += str(v.X) + " "
        line += str(v.Y) + " "
        line += str(v.Z) + "\n"
        mesh_text.append(line)
        
        
    for f in mesh.Faces:
        line = "f "
        t = f.A + 1
        line += str(t) + " "
        t = f.B + 1
        line += str(t) + " "
        t = f.C + 1
        line += str(t) + "\n"
        mesh_text.append(line)

        if (f.D != f.C):
            line = "f "
            t = f.A + 1
            line += str(t) + " "
            t = f.C + 1
            line += str(t) + " "
            t = f.D + 1
            line += str(t) + "\n"
            mesh_text.append(line)
    
    return ''.join(mesh_text)


def main(parts, rules, rule_groups, colliders, probabilities, spawn_number, additional_geometry, filepath, filename, save):
    
    check_data = True
    
    ## check inputs
    if len(parts) == 0:
        check_data = False
        msg = "No parts provided"
        ghenv.Component.AddRuntimeMessage(gh.Kernel.GH_RuntimeMessageLevel.Warning, msg)
    
    if len(rules) == 0:
        check_data = False
        msg = "No parts provided"
        ghenv.Component.AddRuntimeMessage(gh.Kernel.GH_RuntimeMessageLevel.Warning, msg)
    
    if len(colliders) == 0:
        msg = "No collider provided. Using the part collider. Be aware that DisCo does not support concave mesh colliders."
        ghenv.Component.AddRuntimeMessage(gh.Kernel.GH_RuntimeMessageLevel.Warning, msg)
    
    if len(colliders) != 0 and len(colliders) != len(parts):
        check_data = False
        msg = "Different count of parts and colliders. Please provide one collider for each part"
        ghenv.Component.AddRuntimeMessage(gh.Kernel.GH_RuntimeMessageLevel.Warning, msg)
    
    if len(probabilities) != 0 and len(probabilities) != len(parts):
        msg = "Different count of parts and probabilities. Will assign equal probability to all parts."
        ghenv.Component.AddRuntimeMessage(gh.Kernel.GH_RuntimeMessageLevel.Warning, msg)
        probabilities = []
    
    if len(spawn_number) != 0 and len(spawn_number) != len(parts):
        msg = "Different count of parts and spawn numbers. Spawn numbers will be ignored"
        ghenv.Component.AddRuntimeMessage(gh.Kernel.GH_RuntimeMessageLevel.Warning, msg)
        spawn_number = []
    
    
    if filepath is None:
        check_data = False
        msg = "No path provided"
        ghenv.Component.AddRuntimeMessage(gh.Kernel.GH_RuntimeMessageLevel.Warning, msg)
    
    if filename is None:
        check_data = False
        msg = "No filename provided"
        ghenv.Component.AddRuntimeMessage(gh.Kernel.GH_RuntimeMessageLevel.Warning, msg)
    
    if save is None:
        save = False
    
    if check_data:
        
        full_path = filepath + "\\" + filename + ".json"
        
        if save:
            data_dict = {}
            
            probability_total = 0
            for prob in probabilities:
                probability_total += prob
            
            
            parts_data = []
            part_count = 0
            for part in parts:
                part_dict = {}
                
                center_vector = rg.Vector3d.Subtract(rg.Vector3d(0,0,0), rg.Vector3d(part.center))
                center_transform = rg.Transform.Translation(center_vector)
                
                part = part.transform(center_transform)
                
                part_dict["Name"] = part.name
                part_dict["Geometry"] = MeshToString(part.geo, "Geo_" + part.name)
                
                connections_data = []
                for conn in part.connections:
                    conn_dict = {}
                    
                    conn_dict["ConID"] = conn.id
                    conn_dict["Part"] = part.name
                    conn_dict["ConType"] = conn.type
                    
                    conn_dict["PlaneOriginX"] = conn.pln.Origin.X
                    conn_dict["PlaneOriginY"] = conn.pln.Origin.Y
                    conn_dict["PlaneOriginZ"] = conn.pln.Origin.Z
                    conn_dict["PlaneXVecX"] = conn.pln.XAxis.X
                    conn_dict["PlaneXVecY"] = conn.pln.XAxis.Y
                    conn_dict["PlaneXVecZ"] = conn.pln.XAxis.Z
                    conn_dict["PlaneYVecX"] = conn.pln.YAxis.X
                    conn_dict["PlaneYVecY"] = conn.pln.YAxis.Y
                    conn_dict["PlaneYVecZ"] = conn.pln.YAxis.Z
                    
                    connections_data.append(conn_dict)
                
                part_dict["Connections"] = connections_data
                
                ## probabilities
                part_dict["Probability"] = 0
                if probability_total == 1:
                    part_dict["Probability"] = probabilities[part_count]
                elif probability_total == 0:
                    part_dict["Probability"] = 1.0/len(parts)
                else:
                    part_dict["Probability"] = probabilities[part_count]/probability_total
                
                if len(spawn_number) == 0:
                    part_dict["SpawnNumber"] = 0
                else:
                    part_dict["SpawnNumber"] = int(spawn_number[part_count])
                
                
                ## collider
                ## if no collider is provided, generate the collider from the collider geometry
                if len(colliders) == 0:
                    collider_data = ""
                    coll_count = 0
                    for coll_geo in part.collider.geometry:
                        collider_data += MeshToString(coll_geo, "Col_" + part.name + "_" + str(coll_count))
                        coll_count += 1
                    part_dict["Collider"] = collider_data
                    
                else:
                    current_collider = colliders[part_count]
                    if type(current_collider) == Collider:
                        current_collider = current_collider.transform(center_transform)
                        if len(current_collider.geometry) == 1:
                            part_dict["Collider"] = MeshToString(current_collider.geometry[0], "Col_" + part.name + "_0")
                        else:
                            collider_data = ""
                            coll_count = 0
                            for coll_geo in current_collider.geometry:
                                collider_data += MeshToString(current_collider.geometry[coll_count], "Col_" + part.name + "_" + str(coll_count))
                                coll_count += 1
                            part_dict["Collider"] = collider_data
                    else:
                        current_collider.Transform(center_transform)
                        part_dict["Collider"] = MeshToString(current_collider, "Col_" + part.name + "_0")
                
                part_dict["TemplateID"] = part_count
                part_count += 1
                
                parts_data.append(part_dict)
            
            data_dict["PartData"] = parts_data
            
            rules_data = []
            for rule in rules:
                rule_dict = {}
                
                rule_dict["Part1"] = rule.part1
                rule_dict["Conn1"] = rule.conn1
                rule_dict["Part2"] = rule.part2
                rule_dict["Conn2"] = rule.conn2
                
                rules_data.append(rule_dict)
            
            data_dict["RuleData"] = rules_data
            
            groups_data = []
            for group in rule_groups:
                group_dict = json.loads(group)
                groups_data.append(group_dict)
                
            data_dict["RuleGroupsData"] = groups_data
            
            
            add_geo_data = []
            add_geo_count = 0
            for add_geo in additional_geometry:
                add_geo_dict = {}
                
                add_geo_dict["Geometry"] = MeshToString(add_geo, "Additional_" + str(add_geo_count))
                add_geo_count += 1
                
                add_geo_data.append(add_geo_dict)
            
            data_dict["AdditionalGeometry"] = add_geo_data
            
            with open(full_path, "w") as outF:
                json.dump(data_dict, outF)
        
            return json.dumps(data_dict), full_path
        else:
            return "Set SAVE to True to generate the json file and save it to the choosen location", full_path
    else:
        return -1


result = main(PART, RULES, RULE_G, COLL, PROB, SPAWN_N, ADD_GEO, PATH, NAME, SAVE)

if result != -1:
    TXT = result[0]
    FILE = result[1]
# ---------- end wasp2disco ----------
lng_3 = ListLength(List=mesh_6)
brep_5 = Brep(getattr)
panel_22 = Panel(pt_4)
mesh_7 = Mesh(mesh_6)
preview_12 = CustomPreview(Geometry=deattr.VAL, Shader=ColourSwatch(SwatchColor=RGB(128, 128, 128)))
partgeo_15 = Wasp_GetPartGeometry(PART=discoload)  # -> GEO; same code as partgeo
random = Random(Range=Domain(0, 1), Number=lng_3, Seed=2)
gradient_5 = Gradient(
    LowerLimit=0,
    UpperLimit=1,
    Parameter=random,
    stops=[0: RGB(0, 98, 0), 0.25: RGB(81, 175, 17), 0.5: RGB(159, 198, 146), 0.75: RGB(170, 235, 41), 1: RGB(221, 255, 53)])
panel_23 = Panel(wasp2disco.TXT)
panel_24 = Panel(wasp2disco.FILE)
scale_2 = Scale(Geometry=partgeo_15, Center=volume_3.Centroid, Factor=Slider(1000, range=0..1000))  # -> Geometry, Transform
addpart = Wasp_AddParts(
    AGGR=fieldaggregation_2.AGGR,
    PID=Slider(152, range=0..200),
    CID=Slider(7, range=0..20),
    NEXT=Slider(0, range=0..10),
    CHECK=Toggle(False),
    ADD=Button(),
    RESET=Button())  # -> AGGR_OUT, PART_OUT, C_PART, C_CONN, NEXT_P; inputs PID: Int32, CID: Int32, NEXT: Int32, CHECK: Boolean, ADD: Boolean, RESET: Boolean
# ---------- addpart: Python ----------
# Wasp: Discrete Design with Grasshopper plug-in (GPL) initiated by Andrea Rossi
# 
# This file is part of Wasp.
# 
# Copyright (c) 2017, Andrea Rossi <a.rossi.andrea@gmail.com>
# Wasp is free software; you can redistribute it and/or modify 
# it under the terms of the GNU General Public License as published 
# by the Free Software Foundation; either version 3 of the License, 
# or (at your option) any later version. 
# 
# Wasp is distributed in the hope that it will be useful,
# but WITHOUT ANY WARRANTY; without even the implied warranty of 
# MERCHANTABILITY or FITNESS FOR A PARTICULAR PURPOSE. See the 
# GNU General Public License for more details.
# 
# You should have received a copy of the GNU General Public License
# along with Wasp; If not, see <http://www.gnu.org/licenses/>.
# 
# @license GPL-3.0 <https://www.gnu.org/licenses/gpl.html>
#
# Significant parts of Wasp have been developed by Andrea Rossi
# as part of research on digital materials and discrete design at:
# DDU Digital Design Unit - Prof. Oliver Tessmann
# Technische Universität Darmstadt


#########################################################################
##                            COMPONENT INFO                           ##
#########################################################################

"""
Add specific parts to an aggregation.
--> WIP Component: might be incomplete or contain bugs <--
-
Provided by Wasp 0.4
    Args:
        AGGR: Aggregation to edit
        PID: ID of the parent part
        CID: ID of the parent connection
        NEXT: Index of the next part among the available ones
        CHECK: OPTIONAL // True to check for the constraints set in the aggregation, False to return all possibilities ignoring constraints (True by default)
        ADD: Add the part to the aggregation
        RESET: Reset the aggregation to the initial state
    Returns:
        AGGR_OUT: Edited aggregation object
        PART_OUT: Edited parts
        C_PART: Parent part
        C_CONN: Parent connection
        NEXT_P: Part to be added
"""

ghenv.Component.Name = "Wasp_Add Parts"
ghenv.Component.NickName = 'AddPart'
ghenv.Component.Message = 'VER 0.4.013'
ghenv.Component.IconDisplayMode = ghenv.Component.IconDisplayMode.application
ghenv.Component.Category = "Wasp"
ghenv.Component.SubCategory = "X | Experimental"
try: ghenv.Component.AdditionalHelpFromDocStrings = "2"
except: pass


import sys
import copy
import Rhino.Geometry as rg
import Grasshopper as gh


## add Wasp install directory to system path
wasp_loaded = False
ghcompfolder = gh.Folders.DefaultAssemblyFolder
if ghcompfolder not in sys.path:
    sys.path.append(ghcompfolder)
try:
    from wasp import __version__
    wasp_loaded = True
except:
    msg = "Cannot import Wasp. Is the wasp folder available in " + ghcompfolder + "?"
    ghenv.Component.AddRuntimeMessage(gh.Kernel.GH_RuntimeMessageLevel.Error, msg)

## if Wasp is installed correctly, load the classes required by the component
if wasp_loaded:
    pass


def main(base_aggregation, part_id, connection_id, next_part, check_constraints, add, reset, aggregation):
    
    check_data = True
    
    ##check inputs
    if base_aggregation is None:
        check_data = False
        msg = "No aggregation provided"
        ghenv.Component.AddRuntimeMessage(gh.Kernel.GH_RuntimeMessageLevel.Warning, msg)
    
    if part_id is None:
        check_data = False
        msg = "No part id provided"
        ghenv.Component.AddRuntimeMessage(gh.Kernel.GH_RuntimeMessageLevel.Warning, msg)
    
    if connection_id is None:
        check_data = False
        msg = "No connection id provided"
        ghenv.Component.AddRuntimeMessage(gh.Kernel.GH_RuntimeMessageLevel.Warning, msg)
    
    if next_part is None:
        check_data = False
        msg = "No index for next part provided"
        ghenv.Component.AddRuntimeMessage(gh.Kernel.GH_RuntimeMessageLevel.Warning, msg)
    
    if add is None:
        add = False
    
    if reset is None:
        reset = False
    
    if check_data:
        
        new_name = base_aggregation.name + "_edit"
        remove_ids = []
        current_part = None
        current_connection = None
        
        if reset or aggregation is None:
            parts_list = [base_aggregation.parts[key] for key in base_aggregation.parts]
            aggregation = copy.deepcopy(base_aggregation)
            aggregation.name = new_name
        
        for i in range(len(aggregation.aggregated_parts)):
            if aggregation.aggregated_parts[i].id == part_id:
                current_part = aggregation.aggregated_parts[i]
                break
        
        if current_part is not None:
            
            for i in range(len(current_part.connections)):
                if current_part.connections[i].id == connection_id:
                    current_connection = current_part.connections[i]
                    break
            
            if current_connection is not None:
                possible_next_parts = aggregation.compute_possible_children(part_id, connection_id, check_constraints)
                
                if possible_next_parts != -1:
                    if len(possible_next_parts) > next_part:
                        
                        if add:
                            aggregation.add_custom_part(part_id, connection_id, possible_next_parts[next_part])
                        
                        return aggregation, current_part, current_connection, possible_next_parts[next_part]
                    else:
                        msg = "The provided index for the next part exceeds the number of available possible parts."
                        ghenv.Component.AddRuntimeMessage(gh.Kernel.GH_RuntimeMessageLevel.Warning, msg)
                        return aggregation, current_part, current_connection, None
                else:
                    msg = "The chosen connection does not provide any valid part to be placed."
                    ghenv.Component.AddRuntimeMessage(gh.Kernel.GH_RuntimeMessageLevel.Warning, msg)
                    return aggregation, current_part, current_connection, None
        
            else:
                msg = "The provided id does not exist in the current part connections. Might be out of range."
                ghenv.Component.AddRuntimeMessage(gh.Kernel.GH_RuntimeMessageLevel.Warning, msg)
                return aggregation, current_part, None, None
        
        else:
            msg = "The provided id does not exist in the current aggregation. Might be out of range."
            ghenv.Component.AddRuntimeMessage(gh.Kernel.GH_RuntimeMessageLevel.Warning, msg)
            return aggregation, None, None, None
    else:
        return -1

## create aggregation container in global variables dict
if 'aggregation_container' not in globals():
    aggregation_container = None

result = main(AGGR, PID, CID, NEXT, CHECK, ADD, RESET, aggregation_container)

if result != -1:
    aggregation_container = result[0]
    
    AGGR_OUT = aggregation_container
    PART_OUT = aggregation_container.aggregated_parts
    C_PART = result[1]
    C_CONN = result[2]
    NEXT_P = result[3]
# ---------- end addpart ----------
stochasticaggregation_2 = Wasp_StochasticAggregation(PART=flatten(parttr_2), PREV=parttr_2, N=Slider(100, range=0..10000), RULES=rulegen, GC=meshconst, RESET=Button())  # -> AGGR, PART_OUT; inputs PART: list, PREV: list, N: Int32, RULES: list, SEED: Int32, MODE: Int32, GC: list, RESET: Boolean; same code as stochasticaggregation
preview_13 = CustomPreview(Geometry=mesh_7, Shader=flatten(gradient_5))
partgeo_16 = Wasp_GetPartGeometry(PART=addpart.NEXT_P)  # -> GEO; same code as partgeo
deconn_2 = Wasp_DeconstructConnection(CONN=addpart.C_CONN)  # -> PLN, ID, PART, T; same code as deconn
partgeo_17 = Wasp_GetPartGeometry(PART=addpart.C_PART)  # -> GEO; same code as partgeo
partgeo_18 = Wasp_GetPartGeometry(PART=addpart.PART_OUT)  # -> GEO; same code as partgeo
pt_5 = Point(deconn_2.PLN)
discosave = Wasp_SaveToDisCo(AGGR=stochasticaggregation_2.AGGR, PATH="D:\Github\Wasp\devFiles\data", NAME="aggregationForDisCo", SAVE=Button())  # -> TXT, FILE
# ---------- discosave: Python ----------
# Wasp: Discrete Design with Grasshopper plug-in (GPL) initiated by Andrea Rossi
# 
# This file is part of Wasp.
# 
# Copyright (c) 2017, Andrea Rossi <a.rossi.andrea@gmail.com>
# Wasp is free software; you can redistribute it and/or modify 
# it under the terms of the GNU General Public License as published 
# by the Free Software Foundation; either version 3 of the License, 
# or (at your option) any later version. 
# 
# Wasp is distributed in the hope that it will be useful,
# but WITHOUT ANY WARRANTY; without even the implied warranty of 
# MERCHANTABILITY or FITNESS FOR A PARTICULAR PURPOSE. See the 
# GNU General Public License for more details.
# 
# You should have received a copy of the GNU General Public License
# along with Wasp; If not, see <http://www.gnu.org/licenses/>.
# 
# @license GPL-3.0 <https://www.gnu.org/licenses/gpl.html>
#
# Significant parts of Wasp have been developed by Andrea Rossi
# as part of research on digital materials and discrete design at:
# DDU Digital Design Unit - Prof. Oliver Tessmann
# Technische Universität Darmstadt


#########################################################################
##                            COMPONENT INFO                           ##
#########################################################################

"""
Saves current status of an aggregation to a .json file, to be imported into DisCo for further aggregation.
--> WIP Component: might be incomplete or contain bugs <--
-
Provided by Wasp 0.4
    Args:
        AGGR: Aggregation to save
        PATH: Path where to save the aggregation
        NAME: Name of the exported file
        SAVE: True to export
    Returns:
        TXT: Text representation of the aggregation
"""

ghenv.Component.Name = "Wasp_Save to DisCo"
ghenv.Component.NickName = 'DisCoSave'
ghenv.Component.Message = 'VER 0.4.013'
ghenv.Component.IconDisplayMode = ghenv.Component.IconDisplayMode.application
ghenv.Component.Category = "Wasp"
ghenv.Component.SubCategory = "7 | DisCo VR"
try: ghenv.Component.AdditionalHelpFromDocStrings = "2"
except: pass


import sys
import Rhino.Geometry as rg
import Grasshopper as gh
import json


## add Wasp install directory to system path
wasp_loaded = False
ghcompfolder = gh.Folders.DefaultAssemblyFolder
if ghcompfolder not in sys.path:
    sys.path.append(ghcompfolder)
try:
    from wasp import __version__
    wasp_loaded = True
except:
    msg = "Cannot import Wasp. Is the wasp folder available in " + ghcompfolder + "?"
    ghenv.Component.AddRuntimeMessage(gh.Kernel.GH_RuntimeMessageLevel.Error, msg)

## if Wasp is installed correctly, load the classes required by the component
if wasp_loaded:
    pass


def main(aggregation, path, filename, save):
        
    check_data = True
    
    ## check inputs
    if aggregation is None:
        check_data = False
        msg = "No aggregation provided"
        ghenv.Component.AddRuntimeMessage(gh.Kernel.GH_RuntimeMessageLevel.Warning, msg)
    
    if path is None:
        check_data = False
        msg = "No path provided"
        ghenv.Component.AddRuntimeMessage(gh.Kernel.GH_RuntimeMessageLevel.Warning, msg)
    
    if filename is None:
        check_data = False
        msg = "No filename provided"
        ghenv.Component.AddRuntimeMessage(gh.Kernel.GH_RuntimeMessageLevel.Warning, msg)
    
    if save is None:
        save = False
    
    ## execute main code if all needed inputs are available
    if check_data:
        
        aggr_dict = {}
        aggr_dict['aggregation_name'] = aggregation.name
        aggr_dict['parts'] = {}
        for part in aggregation.aggregated_parts:
            
            part_dict = {}
            
            part_dict['name'] = part.name
            part_dict['active_connections'] = part.active_connections
            part_dict['parent'] = part.parent
            part_dict['children'] = part.children
            
            
            part_dict['transform'] = {}
            
            base_part = None
            for b_part in aggregation.parts.values():
                if b_part.name == part.name:
                    base_part = b_part
                    break
            
            center_vector = rg.Vector3d.Subtract(rg.Vector3d(base_part.center), rg.Vector3d(0,0,0))
            center_transform = rg.Transform.Translation(center_vector)
            full_trans = rg.Transform.Multiply(part.transformation, center_transform)
            
            part_dict['transform']['M00'] = full_trans.M00
            part_dict['transform']['M01'] = full_trans.M01
            part_dict['transform']['M02'] = full_trans.M02
            part_dict['transform']['M03'] = full_trans.M03
            
            part_dict['transform']['M10'] = full_trans.M10
            part_dict['transform']['M11'] = full_trans.M11
            part_dict['transform']['M12'] = full_trans.M12
            part_dict['transform']['M13'] = full_trans.M13
            
            part_dict['transform']['M20'] = full_trans.M20
            part_dict['transform']['M21'] = full_trans.M21
            part_dict['transform']['M22'] = full_trans.M22
            part_dict['transform']['M23'] = full_trans.M23
            
            part_dict['transform']['M30'] = full_trans.M30
            part_dict['transform']['M31'] = full_trans.M31
            part_dict['transform']['M32'] = full_trans.M32
            part_dict['transform']['M33'] = full_trans.M33
            
            part_dict['is_constrained'] = part.is_constrained
            
            aggr_dict['parts'][part.id] = part_dict
        
        
        full_path = path + "\\" + filename + ".json"
        
        if save:
            with open(full_path, "w") as outF:
                json.dump(aggr_dict, outF)
        
        return json.dumps(aggr_dict), full_path
    else:
        return -1

result = main(AGGR, PATH, NAME, SAVE)

if result != -1:
    TXT = result[0]
    FILE = result[1]
# ---------- end discosave ----------
preview_14 = CustomPreview(Geometry=partgeo_18, Material=swatch)
preview_15 = CustomPreview(Geometry=partgeo_17, Material=ColourSwatch(SwatchColor=RGB(255, 0, 0)))
preview_16 = CustomPreview(Geometry=partgeo_16, Material=ColourSwatch(SwatchColor=RGB(255, 153, 153)))
