# Grasshopper definition 210209_WASP_PartReplacement.gh (Grasshopper 1.0.7)

geo = Geometry(<brep referenced from the Rhino model>)
geo_2 = Geometry(<brep referenced from the Rhino model>)
geo_3 = Geometry(<brep referenced from the Rhino model>)
crv = Curve([<curve referenced from the Rhino model> x3])
pt = Point([<point referenced from the Rhino model> x3])
crv_2 = Curve([<curve referenced from the Rhino model> x2])
crv_3 = Curve([<curve referenced from the Rhino model> x3])
pt_2 = Point([<point referenced from the Rhino model> x3])
pt_3 = Point([<point referenced from the Rhino model> x2])
conndir = Wasp_ConnectionFromDirection(GEO=geo, CEN=pt, UP=crv, T="HEXA")  # -> CONN, PLN_OUT; inputs CEN: list of Point3d, UP: list of Curve, T: list
# ---------- conndir: Python ----------
# Wasp: Discrete Design with Grasshopper plug-in (GPL) initiated by Andrea Rossi
# 
# This file is part of Wasp.
# 
# Copyright (c) 2017, Andrea Rossi <a.rossi.andrea@gmail.com>
# Wasp is free software; you can redistribute it and/or modify 
# it under the terms of the GNU General Public License as published 
# by the Free Software Foundation; either version 3 of the License, 
# or (at your option) any later version. 
# 
# Wasp is distributed in the hope that it will be useful,
# but WITHOUT ANY WARRANTY; without even the implied warranty of 
# MERCHANTABILITY or FITNESS FOR A PARTICULAR PURPOSE. See the 
# GNU General Public License for more details.
# 
# You should have received a copy of the GNU General Public License
# along with Wasp; If not, see <http://www.gnu.org/licenses/>.
# 
# @license GPL-3.0 <https://www.gnu.org/licenses/gpl.html>
#
# Significant parts of Wasp have been developed by Andrea Rossi
# as part of research on digital materials and discrete design at:
# DDU Digital Design Unit - Prof. Oliver Tessmann
# Technische Universität Darmstadt


#########################################################################
##                            COMPONENT INFO                           ##
#########################################################################

"""
Create a connection on a given part geometry from center and X-asix direction
(Z direction is determined based on the normals of the component geometry)
-
Provided by Wasp 0.4
    Args:
        GEO: Geometry of the part to which the connection belongs
        CEN: Origin of the connection plane
        UP: Line idetifying the X-axis of the connection plane - determines the plane orientation to mantain when transforming
        T: OPTIONAL // Connection type (to be used with Rule Generator component)
    Returns:
        CONN: Connection object
        PLN_OUT: Plane for each connection object (for debugging)
"""

ghenv.Component.Name = "Wasp_Connection From Direction"
ghenv.Component.NickName = 'ConnDir'
ghenv.Component.Message = 'VER 0.4.013'
ghenv.Component.IconDisplayMode = ghenv.Component.IconDisplayMode.application
ghenv.Component.Category = "Wasp"
ghenv.Component.SubCategory = "1 | Elements"
try: ghenv.Component.AdditionalHelpFromDocStrings = "1"
except: pass


import sys
import Rhino.Geometry as rg
import Grasshopper as gh

## add Wasp install directory to system path
wasp_loaded = False
ghcompfolder = gh.Folders.DefaultAssemblyFolder
if ghcompfolder not in sys.path:
    sys.path.append(ghcompfolder)
try:
    from wasp import __version__
    wasp_loaded = True
except:
    msg = "Cannot import Wasp. Is the wasp folder available in " + ghcompfolder + "?"
    ghenv.Component.AddRuntimeMessage(gh.Kernel.GH_RuntimeMessageLevel.Error, msg)

## if Wasp is installed correctly, load the classes required by the component
if wasp_loaded:
    from wasp.core import Connection
    from wasp import global_tolerance


def main(part_geo, conn_centers, conn_ups, conn_type):
        
    check_data = True
    
    ## check inputs
    if part_geo is None:
        check_data = False
        msg = "No part geometry provided"
        ghenv.Component.AddRuntimeMessage(gh.Kernel.GH_RuntimeMessageLevel.Warning, msg)
    
    if len(conn_centers) != len(conn_ups):
        check_data = False
        msg = "Different amount of centers and up vectors provided"
        ghenv.Component.AddRuntimeMessage(gh.Kernel.GH_RuntimeMessageLevel.Error, msg)
    
    types = []
    if len(conn_type) == 0:
        for i in range(len(conn_centers)):
            types.append("0")
    elif len(conn_type) == 1:
        for i in range(len(conn_centers)):
            types.append(conn_type[0])
    elif len(conn_centers) != len(conn_type):
        check_data = False
        msg = "Different amount of centers and types provided"
        ghenv.Component.AddRuntimeMessage(gh.Kernel.GH_RuntimeMessageLevel.Error, msg)
    else:
        for i in range(len(conn_centers)):
            types.append(conn_type[i])
    
    ## execute main code if all needed inputs are available
    if check_data:
        connections = []
        out_planes = []
        for i in range(len(conn_centers)):
            
            center = conn_centers[i]
            up = conn_ups[i]
            plane = None
            
            up_start = rg.Vector3d(up.PointAtStart)
            up_end = rg.Vector3d(up.PointAtEnd)
            up_vec = rg.Vector3d.Subtract(up_end, up_start)
            
            if type(part_geo) == rg.Brep:
                for face in part_geo.Faces:
                    pt_uv = face.ClosestPoint(center)
                    pt = face.PointAt(pt_uv[1], pt_uv[2])
                    dist = rg.Point3d.DistanceTo(center, pt)
                    if(dist < global_tolerance):
                        normal = face.NormalAt(pt_uv[1], pt_uv[2])
                        plane = rg.Plane(center, normal)
                        x_axis = plane.XAxis
                        angle = rg.Vector3d.VectorAngle(x_axis, up_vec, plane)
                        plane.Rotate(angle, normal)
                        break
            
            elif type(part_geo) == rg.Mesh:
                part_geo.Normals.ComputeNormals()
                mesh_pt = part_geo.ClosestMeshPoint(center, global_tolerance)
                if mesh_pt is not None:
                    normal = part_geo.NormalAt(mesh_pt)
                    plane = rg.Plane(center, normal)
                    x_axis = plane.XAxis
                    angle = rg.Vector3d.VectorAngle(x_axis, up_vec, plane)
                    plane.Rotate(angle, normal)
            
            if plane is None:
                msg = "No valid plane provided for connection %d"%(i)
                ghenv.Component.AddRuntimeMessage(gh.Kernel.GH_RuntimeMessageLevel.Error, msg)
            else:
                conn = Connection(plane, types[i], "", -1)
                connections.append(conn)
                out_planes.append(plane)
        
        return connections, out_planes
    
    else:
        return -1

result = main(GEO, CEN, UP, T)

if result != -1:
    CONN = result[0]
    PLN_OUT = result[1]
# ---------- end conndir ----------
conndir_2 = Wasp_ConnectionFromDirection(GEO=geo_2, CEN=pt_3, UP=crv_2, T="BOX")  # -> CONN, PLN_OUT; inputs CEN: list of Point3d, UP: list of Curve, T: list; same code as conndir
conndir_3 = Wasp_ConnectionFromDirection(GEO=geo_3, CEN=pt_2, UP=crv_3, T="TRI")  # -> CONN, PLN_OUT; inputs CEN: list of Point3d, UP: list of Curve, T: list; same code as conndir
# Wasp - Discrete Design with Grasshopper
# Wasp DevLog #006 - Field-Driven Aggregation with Parts Catalog
panel = Panel("HEXA")
part = Wasp_BasicPart(NAME=panel, GEO=geo, CONN=flatten(conndir.CONN))  # -> PART; inputs GEO: Mesh, CONN: list, ATTR: list
# ---------- part: Python ----------
# Wasp: Discrete Design with Grasshopper plug-in (GPL) initiated by Andrea Rossi
# 
# This file is part of Wasp.
# 
# Copyright (c) 2017, Andrea Rossi <a.rossi.andrea@gmail.com>
# Wasp is free software; you can redistribute it and/or modify 
# it under the terms of the GNU General Public License as published 
# by the Free Software Foundation; either version 3 of the License, 
# or (at your option) any later version. 
# 
# Wasp is distributed in the hope that it will be useful,
# but WITHOUT ANY WARRANTY; without even the implied warranty of 
# MERCHANTABILITY or FITNESS FOR A PARTICULAR PURPOSE. See the 
# GNU General Public License for more details.
# 
# You should have received a copy of the GNU General Public License
# along with Wasp; If not, see <http://www.gnu.org/licenses/>.
# 
# @license GPL-3.0 <https://www.gnu.org/licenses/gpl.html>
#
# Significant parts of Wasp have been developed by Andrea Rossi
# as part of research on digital materials and discrete design at:
# DDU Digital Design Unit - Prof. Oliver Tessmann
# Technische Universität Darmstadt


#########################################################################
##                            COMPONENT INFO                           ##
#########################################################################

"""
Create a basic Wasp Part to be used for aggregation
-
Provided by Wasp 0.4
    Args:
        NAME: Part name
        GEO: Part geometry. It will be converted to mesh - to improve performance, perform the conversion before adding to the part and user a low-poly count
        CONN: Connections list
        COLL: OPTIONAL // Collider geometry (for collision detection). A collider will be automatically generated. For complex parts, automatic generation might not work, and you can add a custom collider geometry here.
        ATTR: OPTIONAL // Part attributes
    Returns:
        PART: Part instance
"""

ghenv.Component.Name = "Wasp_Basic Part"
ghenv.Component.NickName = 'Part'
ghenv.Component.Message = 'VER 0.4.013'
ghenv.Component.IconDisplayMode = ghenv.Component.IconDisplayMode.application
ghenv.Component.Category = "Wasp"
ghenv.Component.SubCategory = "2 | Parts"
try: ghenv.Component.AdditionalHelpFromDocStrings = "1"
except: pass

import sys
import Rhino.Geometry as rg
import Grasshopper as gh


## add Wasp install directory to system path
wasp_loaded = False
ghcompfolder = gh.Folders.DefaultAssemblyFolder
if ghcompfolder not in sys.path:
    sys.path.append(ghcompfolder)
try:
    from wasp import __version__
    wasp_loaded = True
except:
    msg = "Cannot import Wasp. Is the wasp folder available in " + ghcompfolder + "?"
    ghenv.Component.AddRuntimeMessage(gh.Kernel.GH_RuntimeMessageLevel.Error, msg)

## if Wasp is installed correctly, load the classes required by the component
if wasp_loaded:
    from wasp.core import Part
    from wasp.core import Collider
    from wasp import global_tolerance


def main(part_name, part_geo, connections, collider, attributes):
    
    check_data = True
    
    ## check inputs
    if part_name is None:
        check_data = False
        msg = "No part name provided"
        ghenv.Component.AddRuntimeMessage(gh.Kernel.GH_RuntimeMessageLevel.Warning, msg)
    
    if part_geo is None:
        check_data = False
        msg = "No part geometry provided"
        ghenv.Component.AddRuntimeMessage(gh.Kernel.GH_RuntimeMessageLevel.Warning, msg)
        check_data = False
    
    if collider is None:
        if part_geo is not None:
            collider_geo = part_geo.Duplicate().Offset(global_tolerance)
            collider_intersection = rg.Intersect.Intersection.MeshMeshFast(collider_geo, part_geo)
            if len(collider_intersection) > 0:
                collider_geo = None
                collider_geo = part_geo.Duplicate()
                center = part_geo.GetBoundingBox(True).Center
                scale_plane = rg.Plane(center, rg.Vector3d(1,0,0), rg.Vector3d(0,1,0))
                scale_transform = rg.Transform.Scale(scale_plane, 1-global_tolerance, 1-global_tolerance, 1-global_tolerance)
                collider_geo.Transform(scale_transform)
                collider_intersection = rg.Intersect.Intersection.MeshMeshFast(collider_geo, part_geo)
                if len(collider_intersection) > 0:
                    collider_geo = None
                    msg = "Could not compute a valid collider geometry. Please provide a valid collider in the COLL input."
                    ghenv.Component.AddRuntimeMessage(gh.Kernel.GH_RuntimeMessageLevel.Error, msg)
                    check_data = False
            
            if collider_geo is not None:
                collider = Collider([collider_geo])
            
    else:
        if type(collider) != Collider:
            if type(collider) == rg.Mesh:
                collider = Collider([collider])
            else:
                msg = "Collider geometry must be of type Mesh or WaspCollider."
                ghenv.Component.AddRuntimeMessage(gh.Kernel.GH_RuntimeMessageLevel.Error, msg)
                check_data = False
        
    if collider is not None and collider.faces_count > 1000:
        msg = "The collider has a high faces count. Consider providing a low poly collider to improve performance"
        ghenv.Component.AddRuntimeMessage(gh.Kernel.GH_RuntimeMessageLevel.Warning, msg)
    
    
    if check_data:
        new_part = Part(part_name, part_geo, connections, collider, attributes)
        
        if new_part.dim < global_tolerance*10:
            msg = "The parts you created are very small. You might consider scaling them or decreasing the tolerance of your Rhino file."
            ghenv.Component.AddRuntimeMessage(gh.Kernel.GH_RuntimeMessageLevel.Warning, msg)
        
        return new_part
    else:
        return -1


result = main(NAME, GEO, CONN, COLL, ATTR)

if result != -1:
    PART = result
# ---------- end part ----------
part_2 = Wasp_BasicPart(NAME="BOX", GEO=geo_2, CONN=flatten(conndir_2.CONN))  # -> PART; inputs GEO: Mesh, CONN: list, ATTR: list; same code as part
part_3 = Wasp_BasicPart(NAME="TRI", GEO=geo_3, CONN=flatten(conndir_3.CONN))  # -> PART; inputs GEO: Mesh, CONN: list, ATTR: list; same code as part
merge = Merge(Data1=part, Data2=part_3, Data3=part_2)

points = PointList(Points=pt_2)
number_slider = Slider(1, range=0..1)
pi = Pi(Factor=Slider(0.06, range=-1..1))
pi_2 = Pi(Factor=Slider(0.06, range=-1..1))
rulegen = Wasp_RulesGenerator(PART=part)  # -> R; inputs PART: list, SELF_P: Boolean, SELF_C: Boolean, TYP: Boolean, GR: list
# ---------- rulegen: Python ----------
# Wasp: Discrete Design with Grasshopper plug-in (GPL) initiated by Andrea Rossi
# 
# This file is part of Wasp.
# 
# Copyright (c) 2017, Andrea Rossi <a.rossi.andrea@gmail.com>
# Wasp is free software; you can redistribute it and/or modify 
# it under the terms of the GNU General Public License as published 
# by the Free Software Foundation; either version 3 of the License, 
# or (at your option) any later version. 
# 
# Wasp is distributed in the hope that it will be useful,
# but WITHOUT ANY WARRANTY; without even the implied warranty of 
# MERCHANTABILITY or FITNESS FOR A PARTICULAR PURPOSE. See the 
# GNU General Public License for more details.
# 
# You should have received a copy of the GNU General Public License
# along with Wasp; If not, see <http://www.gnu.org/licenses/>.
# 
# @license GPL-3.0 <https://www.gnu.org/licenses/gpl.html>
#
# Significant parts of Wasp have been developed by Andrea Rossi
# as part of research on digital materials and discrete design at:
# DDU Digital Design Unit - Prof. Oliver Tessmann
# Technische Universität Darmstadt


#########################################################################
##                            COMPONENT INFO                           ##
#########################################################################

"""
Automated rules generator given a list of parts. It has two separate modes:
- If no grammar is provided in the GR input, the component generates rules between connections of the same type.
- If a grammar is provided, rules are created between connections of different types, according to the specified grammar rules.
-
Provided by Wasp 0.4
    Args:
        PART: Parts from which to generate aggregation rules
        SELF_P: OPTIONAL // Create rules between connections belonging to the same part (True by default)
        SELF_C: OPTIONAL // Create rules between connection with same id (True by default)
        TYP: OPTIONAL // Create rules only between connections of the same type (False by default). Make sure this component is set to False when using Rule Grammars.
        GR: OPTIONAL // Custom connection grammar with format "ConnType">"ConnType"
    Returns:
        R: Generated aggregation rules
"""

ghenv.Component.Name = "Wasp_Rules Generator"
ghenv.Component.NickName = 'RuleGen'
ghenv.Component.Message = 'VER 0.4.013'
ghenv.Component.IconDisplayMode = ghenv.Component.IconDisplayMode.application
ghenv.Component.Category = "Wasp"
ghenv.Component.SubCategory = "3 | Rules"
try: ghenv.Component.AdditionalHelpFromDocStrings = "2"
except: pass

import sys
import Grasshopper as gh


## add Wasp install directory to system path
wasp_loaded = False
ghcompfolder = gh.Folders.DefaultAssemblyFolder
if ghcompfolder not in sys.path:
    sys.path.append(ghcompfolder)
try:
    from wasp import __version__
    wasp_loaded = True
except:
    msg = "Cannot import Wasp. Is the wasp folder available in " + ghcompfolder + "?"
    ghenv.Component.AddRuntimeMessage(gh.Kernel.GH_RuntimeMessageLevel.Error, msg)

## if Wasp is installed correctly, load the classes required by the component
if wasp_loaded:
    from wasp.core import Rule


def main(parts, self_part, self_connection, use_types, grammar):
    
    check_data = True
    
    ##check inputs
    if len(parts) == 0 or parts is None:
        check_data = False
        msg = "No part provided"
        ghenv.Component.AddRuntimeMessage(gh.Kernel.GH_RuntimeMessageLevel.Warning, msg)
    
    if self_part == None:
        self_part = True
    
    if self_connection == None:
        self_connection = True
    
    if use_types is None:
        use_types = False
    
    if check_data:
        rules = []
        
        if len(grammar) == 0:
            for part in parts:
                for conn in part.connections:
                    for other_part in parts:
                        skip_part = False
                        if self_part == False:
                            if part.name == other_part.name:
                                skip_part = True
                            
                        if skip_part == False:
                            for other_conn in other_part.connections:
                                skip_conn = False
                                if self_connection == False:
                                    if conn.id == other_conn.id:
                                        skip_conn = True
                                
                                if skip_conn == False:
                                    if use_types:
                                        if conn.type == other_conn.type:
                                            r = Rule(part.name, conn.id, other_part.name, other_conn.id)
                                            rules.append(r)
                                    else:
                                        r = Rule(part.name, conn.id, other_part.name, other_conn.id)
                                        rules.append(r)
        else:
            for gr_rule in grammar:
                start_type = gr_rule.split(">")[0]
                end_type = gr_rule.split(">")[1]
                
                for part in parts:
                    for conn in part.connections:
                        if conn.type == start_type:
                            for other_part in parts:
                                skip_part = False
                                if self_part == False:
                                    if part.name == other_part.name:
                                        skip_part = True
                                    
                                if skip_part == False:
                                    for other_conn in other_part.connections:
                                        if other_conn.type == end_type:
                                            skip_conn = False
                                            if self_connection == False:
                                                if conn.id == other_conn.id:
                                                    skip_conn = True
                                            
                                            if skip_conn == False:
                                                r = Rule(part.name, conn.id, other_part.name, other_conn.id)
                                                rules.append(r)
        return [rules]
    else:
        return -1


result = main(PART, SELF_P, SELF_C, TYP, GR)

if result != -1:
    R = result[0]
# ---------- end rulegen ----------
series = Series(Start=0, Step=Slider(66, range=0..100), Count=10)
shear = ShearAngle(Base=PlaneXY(0, 0, 0), AngleX=pi, AngleY=pi_2)  # -> Geometry, Transform
pt_4 = ConstructPoint(XCoordinate=number_slider, YCoordinate=number_slider, ZCoordinate=number_slider)
pt_5 = ConstructPoint(XCoordinate=Slider(1, range=0..10), YCoordinate=Slider(1.179, range=0..10), ZCoordinate=Slider(0.578, range=0..10))
X = UnitX(Factor=series)
scale_nu = ScaleNU(
    Plane=PlaneXY(0, 0, 0),
    ScaleX=Slider(1.34, range=0..10),
    ScaleY=Slider(0.59, range=0..10),
    ScaleZ=Slider(0.1, range=0..10))  # -> Geometry, Transform
move = Move(Motion=X)  # -> Geometry, Transform
shear_2 = Shear(Base=PlaneXY(0, 0, 0), Grip=pt_4, Target=pt_5)  # -> Geometry, Transform
parttr = Wasp_TransformPart(PART=part, TR=scale_nu.Transform)  # -> PART_OUT
# ---------- parttr: Python ----------
# Wasp: Discrete Design with Grasshopper plug-in (GPL) initiated by Andrea Rossi
# 
# This file is part of Wasp.
# 
# Copyright (c) 2017, Andrea Rossi <a.rossi.andrea@gmail.com>
# Wasp is free software; you can redistribute it and/or modify 
# it under the terms of the GNU General Public License as published 
# by the Free Software Foundation; either version 3 of the License, 
# or (at your option) any later version. 
# 
# Wasp is distributed in the hope that it will be useful,
# but WITHOUT ANY WARRANTY; without even the implied warranty of 
# MERCHANTABILITY or FITNESS FOR A PARTICULAR PURPOSE. See the 
# GNU General Public License for more details.
# 
# You should have received a copy of the GNU General Public License
# along with Wasp; If not, see <http://www.gnu.org/licenses/>.
# 
# @license GPL-3.0 <https://www.gnu.org/licenses/gpl.html>
#
# Significant parts of Wasp have been developed by Andrea Rossi
# as part of research on digital materials and discrete design at:
# DDU Digital Design Unit - Prof. Oliver Tessmann
# Technische Universität Darmstadt


#########################################################################
##                            COMPONENT INFO                           ##
#########################################################################

"""
Applies a geometric transformation to an existing part, returning a transformed copy.
Can be used with any Transform component from Grasshopper.
Create a Transform component without inputting any geometry and plug the X output to the TR input.
-
Provided by Wasp 0.4
    Args:
        PART: Part to be transformed
        TR: Transformation
    Returns:
        PART_OUT: Transformed part
"""

ghenv.Component.Name = "Wasp_Transform Part"
ghenv.Component.NickName = 'PartTr'
ghenv.Component.Message = 'VER 0.4.013'
ghenv.Component.IconDisplayMode = ghenv.Component.IconDisplayMode.application
ghenv.Component.Category = "Wasp"
ghenv.Component.SubCategory = "2 | Parts"
try: ghenv.Component.AdditionalHelpFromDocStrings = "2"
except: pass

import sys
import Grasshopper as gh
import math


## add Wasp install directory to system path
wasp_loaded = False
ghcompfolder = gh.Folders.DefaultAssemblyFolder
if ghcompfolder not in sys.path:
    sys.path.append(ghcompfolder)
try:
    from wasp import __version__
    wasp_loaded = True
except:
    msg = "Cannot import Wasp. Is the wasp folder available in " + ghcompfolder + "?"
    ghenv.Component.AddRuntimeMessage(gh.Kernel.GH_RuntimeMessageLevel.Error, msg)

## if Wasp is installed correctly, load the classes required by the component
if wasp_loaded:
    from wasp.core import Part


def main(part, transform):
    
    check_data = True
    
    ##check inputs
    if part is None:
        check_data = False
        msg = "Please provide a valid part to be transformed"
        ghenv.Component.AddRuntimeMessage(gh.Kernel.GH_RuntimeMessageLevel.Warning, msg)
    
    if transform is None:
        check_data = False
        msg = "Please provide a valid transformation"
        ghenv.Component.AddRuntimeMessage(gh.Kernel.GH_RuntimeMessageLevel.Warning, msg)
    
    if check_data:
        ## transform part
        part_trans = part.transform(transform)
        
        ## flip part if negative scaling occurs
        if transform.M00 * transform.M11 * transform.M22 < 0:
            ## geometry
            part_trans.geo.Flip(True, True, True)
            ## connections
            for conn in part_trans.connections:
                pass
                conn.pln.Flip()
                conn.pln.Rotate(math.pi/2, conn.pln.ZAxis)
            ## collider
            for geo in part_trans.collider.geometry:
                geo.Flip(True, True, True)
        
        return part_trans
    else:
        return -1


result = main(PART, TR)

if result != -1:
    PART_OUT = result
# ---------- end parttr ----------
parttr_2 = Wasp_TransformPart(PART=part, TR=move.Transform)  # -> PART_OUT; same code as parttr
panel_2 = Panel("""HEXA
TRI
BOX""")
panel_3 = Panel("""CORNER
PIPE3
PIPE""")
stochasticaggregation = Wasp_StochasticAggregation(PART=flatten(part), PREV=parttr_2, N=Slider(250, range=0..1000), RULES=rulegen, RESET=Button())  # -> AGGR, PART_OUT; inputs PART: list, PREV: list, N: Int32, RULES: list, SEED: Int32, MODE: Int32, GC: list, RESET: Boolean
# ---------- stochasticaggregation: Python ----------
# Wasp: Discrete Design with Grasshopper plug-in (GPL) initiated by Andrea Rossi
# 
# This file is part of Wasp.
# 
# Copyright (c) 2017, Andrea Rossi <a.rossi.andrea@gmail.com>
# Wasp is free software; you can redistribute it and/or modify 
# it under the terms of the GNU General Public License as published 
# by the Free Software Foundation; either version 3 of the License, 
# or (at your option) any later version. 
# 
# Wasp is distributed in the hope that it will be useful,
# but WITHOUT ANY WARRANTY; without even the implied warranty of 
# MERCHANTABILITY or FITNESS FOR A PARTICULAR PURPOSE. See the 
# GNU General Public License for more details.
# 
# You should have received a copy of the GNU General Public License
# along with Wasp; If not, see <http://www.gnu.org/licenses/>.
# 
# @license GPL-3.0 <https://www.gnu.org/licenses/gpl.html>
#
# Significant parts of Wasp have been developed by Andrea Rossi
# as part of research on digital materials and discrete design at:
# DDU Digital Design Unit - Prof. Oliver Tessmann
# Technische Universität Darmstadt


#########################################################################
##                            COMPONENT INFO                           ##
#########################################################################

"""
Aggregate the given parts in a stochastic process, selecting parts and rules randomly at every step.
The component works additively, hence increasing the number of parts in an aggregation just adds new parts on the existing ones, without triggering recomputing of the previous element.
-
Provided by Wasp 0.4
    Args:
        PART: Parts to be aggregated (can be more than one)
        PREV: OPTIONAL // Previous aggregated parts. It is possible to input the results of a previous aggregation, or parts transformed with the TransformPart component
        N: Number of parts to be aggregated (does not count parts provided in PREV)
        RULES: Rules for the aggregation
        SEED: OPTIONAL // Random seed. Set this to a fixed number to allow recreating the same aggregation every time you reset.
        COLL: OPTIONAL // Collision detection. By default is active and checks for collisions between the aggregated parts
        CAT: OPTIONAL // Part Catalog (to specify fixed numbers or proportions between part types
        MODE: OPTIONAL // Switches between aggregation modes: 0 = no constraints, 1 = local constraints, 2 = global constraints, 3 = local + global constraints
        GC: OPTIONAL // Global constraints to apply to aggregation
        ID: OPTIONAL // Aggregation ID
        RESET: Recompute the whole aggregation
    Returns:
        PART_OUT: Aggregated parts (includes both PREV input and newly aggregated parts)
"""

ghenv.Component.Name = "Wasp_Stochastic Aggregation"
ghenv.Component.NickName = 'StochasticAggregation'
ghenv.Component.Message = 'VER 0.4.013'
ghenv.Component.IconDisplayMode = ghenv.Component.IconDisplayMode.application
ghenv.Component.Category = "Wasp"
ghenv.Component.SubCategory = "6 | Aggregation"
try: ghenv.Component.AdditionalHelpFromDocStrings = "1"
except: pass

import sys
import Rhino.Geometry as rg
import Grasshopper as gh


## add Wasp install directory to system path
wasp_loaded = False
ghcompfolder = gh.Folders.DefaultAssemblyFolder
if ghcompfolder not in sys.path:
    sys.path.append(ghcompfolder)
try:
    from wasp import __version__
    wasp_loaded = True
except:
    msg = "Cannot import Wasp. Is the wasp folder available in " + ghcompfolder + "?"
    ghenv.Component.AddRuntimeMessage(gh.Kernel.GH_RuntimeMessageLevel.Error, msg)

## if Wasp is installed correctly, load the classes required by the component
if wasp_loaded:
    from wasp.core import Aggregation


def main(parts, previous_parts, num_parts, rules, seed, catalog, aggregation_mode, global_constraints, aggregation_id, reset, aggregation):
    
    check_data = True
    
    ##check inputs
    if len(parts) == 0:
        check_data = False
        msg = "No parts provided"
        ghenv.Component.AddRuntimeMessage(gh.Kernel.GH_RuntimeMessageLevel.Warning, msg)
    
    if num_parts is None:
        check_data = False
        msg = "Provide number of aggregation iterations"
        ghenv.Component.AddRuntimeMessage(gh.Kernel.GH_RuntimeMessageLevel.Warning, msg)
    else:
        if len(previous_parts) != 0:
            num_parts += len(previous_parts)
    
    if len(rules) == 0:
        check_data = False
        msg = "No rules provided"
        ghenv.Component.AddRuntimeMessage(gh.Kernel.GH_RuntimeMessageLevel.Warning, msg)
    
    use_catalog = False
    if catalog is not None:
        use_catalog = True
    
    if aggregation_mode is None:
        aggregation_mode = 0
    
    if aggregation_id is None:
        aggregation_id = 'myAggregation'
    
    if reset is None:
        reset = False
    
    if check_data:
        ## create aggregation in sticky dict
        if aggregation is None or aggregation == -1 or reset:
            
            ## copy parts to avoid editing the original parts
            parts_copy = []
            for part in parts:
                parts_copy.append(part.copy())
            if use_catalog:
                aggregation = Aggregation(aggregation_id, parts_copy, rules, aggregation_mode, _prev = previous_parts, _global_constraints = global_constraints, _rnd_seed = seed, _catalog = catalog.copy())
            else:
                aggregation = Aggregation(aggregation_id, parts_copy, rules, aggregation_mode, _prev = previous_parts, _global_constraints = global_constraints, _rnd_seed = seed)
        ## handle parameters changes
        #### parts
        if parts != aggregation.parts.values():
            
            ## copy parts to avoid editing the original parts
            parts_copy = []
            for part in parts:
                parts_copy.append(part.copy())
            
            aggregation.reset_base_parts(new_parts = parts_copy)
            aggregation.reset_rules(aggregation.rules)
        
        #### rules
        if rules != aggregation.rules:
            aggregation.rules = rules
            aggregation.reset_base_parts()
            aggregation.reset_rules(aggregation.rules)
        
        #### mode
        if aggregation_mode != aggregation.mode:
            aggregation.mode = aggregation_mode
            aggregation.reset_rules(aggregation.rules)
        
        #### constraints
        if global_constraints != aggregation.global_constraints:
            aggregation.global_constraints = global_constraints
            aggregation.reset_rules(aggregation.rules)
        
        ## add parts to aggregation
        if num_parts > len(aggregation.aggregated_parts):
            error_msg = aggregation.aggregate_rnd(num_parts-len(aggregation.aggregated_parts), use_catalog)
            if error_msg is not None:
                ghenv.Component.AddRuntimeMessage(gh.Kernel.GH_RuntimeMessageLevel.Warning, error_msg)
        
        ## remove parts from aggregation
        elif num_parts < len(aggregation.aggregated_parts):
            aggregation.remove_elements(num_parts)
        
        ## return result
        return aggregation
        
    else:
        return -1


## create aggregation container in global variables dict
if 'aggregation_container' not in globals():
    aggregation_container = None

result = main(PART, PREV, N, RULES, SEED, CAT, MODE, GC, ID, RESET, aggregation_container)

if result != -1:
    aggregation_container = result
    
    AGGR = aggregation_container
    PART_OUT = aggregation_container.aggregated_parts
# ---------- end stochasticaggregation ----------
partgeo = Wasp_GetPartGeometry(PART=parttr_2)  # -> GEO
# ---------- partgeo: Python ----------
# Wasp: Discrete Design with Grasshopper plug-in (GPL) initiated by Andrea Rossi
# 
# This file is part of Wasp.
# 
# Copyright (c) 2017, Andrea Rossi <a.rossi.andrea@gmail.com>
# Wasp is free software; you can redistribute it and/or modify 
# it under the terms of the GNU General Public License as published 
# by the Free Software Foundation; either version 3 of the License, 
# or (at your option) any later version. 
# 
# Wasp is distributed in the hope that it will be useful,
# but WITHOUT ANY WARRANTY; without even the implied warranty of 
# MERCHANTABILITY or FITNESS FOR A PARTICULAR PURPOSE. See the 
# GNU General Public License for more details.
# 
# You should have received a copy of the GNU General Public License
# along with Wasp; If not, see <http://www.gnu.org/licenses/>.
# 
# @license GPL-3.0 <https://www.gnu.org/licenses/gpl.html>
#
# Significant parts of Wasp have been developed by Andrea Rossi
# as part of research on digital materials and discrete design at:
# DDU Digital Design Unit - Prof. Oliver Tessmann
# Technische Universität Darmstadt


#########################################################################
##                            COMPONENT INFO                           ##
#########################################################################

"""
Extract the geometry of one part (for visualization or further processing).
-
Provided by Wasp 0.4
    Args:
        PART: Part from where to extract the geometry
    Returns:
        GEO: Part geometry
"""

ghenv.Component.Name = "Wasp_Get Part Geometry"
ghenv.Component.NickName = 'PartGeo'
ghenv.Component.Message = 'VER 0.4.013'
ghenv.Component.IconDisplayMode = ghenv.Component.IconDisplayMode.application
ghenv.Component.Category = "Wasp"
ghenv.Component.SubCategory = "2 | Parts"
try: ghenv.Component.AdditionalHelpFromDocStrings = "3"
except: pass


import sys
import Rhino.Geometry as rg
import Grasshopper as gh


## add Wasp install directory to system path
wasp_loaded = False
ghcompfolder = gh.Folders.DefaultAssemblyFolder
if ghcompfolder not in sys.path:
    sys.path.append(ghcompfolder)
try:
    from wasp import __version__
    wasp_loaded = True
except:
    msg = "Cannot import Wasp. Is the wasp folder available in " + ghcompfolder + "?"
    ghenv.Component.AddRuntimeMessage(gh.Kernel.GH_RuntimeMessageLevel.Error, msg)

## if Wasp is installed correctly, load the classes required by the component
if wasp_loaded:
    pass


def main(part):
        
    check_data = True
    
    ## check inputs
    if part is None:
        check_data = False
        msg = "No or null part provided"
        ghenv.Component.AddRuntimeMessage(gh.Kernel.GH_RuntimeMessageLevel.Warning, msg)
    
    ## execute main code if all needed inputs are available
    if check_data:
        return part.geo
    else:
        return -1

result = main(PART)

if result != -1:
    GEO = result
# ---------- end partgeo ----------
graphrules = Wasp_RulesFromAggregation(AGGR=stochasticaggregation.AGGR, ON=panel_2, NN=panel_3)  # -> GR, PREV; inputs ON: list, NN: list
# ---------- graphrules: Python ----------
# Wasp: Discrete Design with Grasshopper plug-in (GPL) initiated by Andrea Rossi
# 
# This file is part of Wasp.
# 
# Copyright (c) 2017, Andrea Rossi <a.rossi.andrea@gmail.com>
# Wasp is free software; you can redistribute it and/or modify 
# it under the terms of the GNU General Public License as published 
# by the Free Software Foundation; either version 3 of the License, 
# or (at your option) any later version. 
# 
# Wasp is distributed in the hope that it will be useful,
# but WITHOUT ANY WARRANTY; without even the implied warranty of 
# MERCHANTABILITY or FITNESS FOR A PARTICULAR PURPOSE. See the 
# GNU General Public License for more details.
# 
# You should have received a copy of the GNU General Public License
# along with Wasp; If not, see <http://www.gnu.org/licenses/>.
# 
# @license GPL-3.0 <https://www.gnu.org/licenses/gpl.html>
#
# Significant parts of Wasp have been developed by Andrea Rossi
# as part of research on digital materials and discrete design at:
# DDU Digital Design Unit - Prof. Oliver Tessmann
# Technische Universität Darmstadt


#########################################################################
##                            COMPONENT INFO                           ##
#########################################################################

"""
Extract aggregation rules from an aggregation. These can be used to recreate the aggregation using the Graph-Grammar Aggregation component, as well as to replace parts in an aggregation.
-
Provided by Wasp 0.4
    Args:
        AGGR: Aggregation from which to extract the rules
        ON: OPTIONAL // If replacing parts, old names of the existing parts in the aggregation
        NN: OPTIONAL // If replacing parts, new names of the parts to replace with. Order should match the order provided in ON
    Returns:
        GR: Graph rules to recreate the aggregation
        PREV: If the provided aggregation contained parts assigned before the aggregation algorithm (in the PREV input), those parts are returned here. WARNING: when using a Graph Grammar Aggregation to replace parts, these parts will not be replaced.
"""

ghenv.Component.Name = "Wasp_Rules from Aggregation"
ghenv.Component.NickName = 'GraphRules'
ghenv.Component.Message = 'VER 0.4.014'
ghenv.Component.IconDisplayMode = ghenv.Component.IconDisplayMode.application
ghenv.Component.Category = "Wasp"
ghenv.Component.SubCategory = "3 | Rules"
try: ghenv.Component.AdditionalHelpFromDocStrings = "2"
except: pass

import sys
import Rhino.Geometry as rg
import Grasshopper as gh
import ghpythonlib.treehelpers as th


## add Wasp install directory to system path
wasp_loaded = False
ghcompfolder = gh.Folders.DefaultAssemblyFolder
if ghcompfolder not in sys.path:
    sys.path.append(ghcompfolder)
try:
    from wasp import __version__
    wasp_loaded = True
except:
    msg = "Cannot import Wasp. Is the wasp folder available in " + ghcompfolder + "?"
    ghenv.Component.AddRuntimeMessage(gh.Kernel.GH_RuntimeMessageLevel.Error, msg)

## if Wasp is installed correctly, load the classes required by the component
if wasp_loaded:
    from wasp.core import Aggregation, Graph


def main(aggregation, old_names, new_names):
    
    check_data = True
    
    ##check inputs
    if aggregation is None:
        check_data = False
        msg = "No aggregation provided"
        ghenv.Component.AddRuntimeMessage(gh.Kernel.GH_RuntimeMessageLevel.Warning, msg)
    
    if len(old_names) > 0:
        if len(old_names) != len(new_names):
            check_data = False
            msg = "Different number of old and new names provided"
            ghenv.Component.AddRuntimeMessage(gh.Kernel.GH_RuntimeMessageLevel.Error, msg)
    
    if check_data:
        graph_rules = []
        
        replace_names = False
        n_dict = {}
        if len(old_names) > 0 and len(old_names) == len(new_names):
            replace_names = True
            for i in range(len(old_names)):
                n_dict[old_names[i]] = new_names[i]
        
        ################################### if replacing parts, PREV input is currently not working
        prev_parts = []
        if aggregation.prev_num > 0:
            prev_parts = aggregation.aggregated_parts[:aggregation.prev_num]
        
        graph_edges = aggregation.graph.get_edges_attributes()
        
        for edge in graph_edges:
            start_p = aggregation.aggregated_parts[int(edge['start'])].name
            end_p = aggregation.aggregated_parts[int(edge['end'])].name
            start_conn = edge['conn_start']
            end_conn = edge['conn_end']
            
            if replace_names:
                start_p = n_dict[start_p]
                end_p = n_dict[end_p]
            
            if len(graph_rules) == 0 and aggregation.prev_num == 0:
                rule = "{}|{}_{}|{}>{}_{}".format(start_p, start_conn, end_p, end_conn, edge['start'], edge['end'])
            else:
                rule = "{}|{}_{}|{}>{}_{}".format(edge['start'], start_conn, end_p, end_conn, edge['start'], edge['end'])
            
            graph_rules.append(rule)
            
        return graph_rules, prev_parts
        
    else:
        return -1


result = main(AGGR, ON, NN)

if result != -1:
    GR = result[0]
    PREV = result[1]
# ---------- end graphrules ----------
partgeo_2 = Wasp_GetPartGeometry(PART=parttr)  # -> GEO; same code as partgeo
button = Button()
panel_4 = Panel(graphrules.GR)
stochasticaggregation_2 = Wasp_StochasticAggregation()  # -> AGGR, PART_OUT; inputs PART: list, PREV: list, N: Int32, RULES: list, SEED: Int32, MODE: Int32, GC: list, RESET: Boolean; same code as stochasticaggregation
number_slider_2 = Slider(173, range=0..1000)
partgeo_3 = Wasp_GetPartGeometry(PART=stochasticaggregation.PART_OUT)  # -> GEO; same code as partgeo
preview = CustomPreview(Geometry=partgeo_3, Material=ColourSwatch(SwatchColor=RGB(8, 161, 13)))
Y = UnitY(Factor=number_slider_2)
X_2 = UnitX(Factor=number_slider_2)

geo_4 = Geometry(<brep referenced from the Rhino model>)
geo_5 = Geometry(<brep referenced from the Rhino model>)
geo_6 = Geometry(<brep referenced from the Rhino model>)
crv_4 = Curve([<curve referenced from the Rhino model> x3])
pt_6 = Point([<point referenced from the Rhino model> x3])
crv_5 = Curve([<curve referenced from the Rhino model> x2])
crv_6 = Curve([<curve referenced from the Rhino model> x3])
pt_7 = Point([<point referenced from the Rhino model> x3])
pt_8 = Point([<point referenced from the Rhino model> x2])
conndir_4 = Wasp_ConnectionFromDirection(GEO=geo_4, CEN=pt_6, UP=crv_4, T="HEXA")  # -> CONN, PLN_OUT; inputs CEN: list of Point3d, UP: list of Curve, T: list; same code as conndir
conndir_5 = Wasp_ConnectionFromDirection(GEO=geo_5, CEN=pt_8, UP=crv_5, T="BOX")  # -> CONN, PLN_OUT; inputs CEN: list of Point3d, UP: list of Curve, T: list; same code as conndir
conndir_6 = Wasp_ConnectionFromDirection(GEO=geo_6, CEN=pt_7, UP=crv_6, T="TRI")  # -> CONN, PLN_OUT; inputs CEN: list of Point3d, UP: list of Curve, T: list; same code as conndir

mesh = MeshBrep(
    Brep=geo_5,
    Settings={GridMaxCount=0, GridMinCount=16, JaggedSeams=False, MaxEdgeLength=0, MinEdgeLength=2, MinTolerance=0, Refine=True, RefineAngle=0, RelativeTolerance=0.65, SimplePlanes=True, Tolerance=0})
mesh_2 = MeshBrep(
    Brep=geo_4,
    Settings={GridMaxCount=0, GridMinCount=16, JaggedSeams=False, MaxEdgeLength=0, MinEdgeLength=0.0001, MinTolerance=0, Refine=True, RefineAngle=0, RelativeTolerance=0.65, SimplePlanes=True, Tolerance=0})
mesh_3 = MeshBrep(
    Brep=geo_6,
    Settings={GridMaxCount=0, GridMinCount=16, JaggedSeams=False, MaxEdgeLength=0, MinEdgeLength=0.0001, MinTolerance=0, Refine=True, RefineAngle=0, RelativeTolerance=0.65, SimplePlanes=True, Tolerance=0})

part_4 = Wasp_BasicPart(NAME="CORNER", GEO=mesh_2, CONN=flatten(conndir_4.CONN))  # -> PART; inputs GEO: Mesh, CONN: list, ATTR: list; same code as part
part_5 = Wasp_BasicPart(NAME="PIPE3", GEO=mesh_3, CONN=flatten(conndir_6.CONN))  # -> PART; inputs GEO: Mesh, CONN: list, ATTR: list; same code as part
part_6 = Wasp_BasicPart(NAME="PIPE", GEO=mesh, CONN=flatten(conndir_5.CONN))  # -> PART; inputs GEO: Mesh, CONN: list, ATTR: list; same code as part
merge_2 = Merge(Data1=part_4, Data2=part_5, Data3=part_6)

graphaggr = Wasp_GraphGrammarAggregation(PART=flatten(merge_2), PREV=graphrules.PREV, RULES=graphrules.GR, RESET=Toggle(True))  # -> AGGR, PART_OUT; inputs PART: list, PREV: list, RULES: list, RESET: Boolean
# ---------- graphaggr: Python ----------
# Wasp: Discrete Design with Grasshopper plug-in (GPL) initiated by Andrea Rossi
# 
# This file is part of Wasp.
# 
# Copyright (c) 2017, Andrea Rossi <a.rossi.andrea@gmail.com>
# Wasp is free software; you can redistribute it and/or modify 
# it under the terms of the GNU General Public License as published 
# by the Free Software Foundation; either version 3 of the License, 
# or (at your option) any later version. 
# 
# Wasp is distributed in the hope that it will be useful,
# but WITHOUT ANY WARRANTY; without even the implied warranty of 
# MERCHANTABILITY or FITNESS FOR A PARTICULAR PURPOSE. See the 
# GNU General Public License for more details.
# 
# You should have received a copy of the GNU General Public License
# along with Wasp; If not, see <http://www.gnu.org/licenses/>.
# 
# @license GPL-3.0 <https://www.gnu.org/licenses/gpl.html>
#
# Significant parts of Wasp have been developed by Andrea Rossi
# as part of research on digital materials and discrete design at:
# DDU Digital Design Unit - Prof. Oliver Tessmann
# Technische Universität Darmstadt
        
        
#########################################################################
##                            COMPONENT INFO                           ##
#########################################################################
        
"""
Sequential aggregation based on graph-grammars.
--> WIP Component: might be incomplete or contain bugs <--
-
Provided by Wasp 0.4
    Args:
        PART: Parts to be aggregated (can be more than one)
        PREV: Previous aggregated parts. It is possible to input the results of a previous aggregation, or parts transformed with the TransformPart component
        RULES: Rules sequence in text form (WIP)
        ID: OPTIONAL // Aggregation ID (to avoid overwriting when having different aggregation components in the same file)
        RESET: Recompute the whole aggregation
    Returns:
        AGGR: Aggregation object
        PART_OUT: Aggregated parts (includes both PREV input and newly aggregated parts)
"""
        
ghenv.Component.Name = "Wasp_Graph-Grammar Aggregation"
ghenv.Component.NickName = 'GraphAggr'
ghenv.Component.Message = 'VER 0.4.014'
ghenv.Component.IconDisplayMode = ghenv.Component.IconDisplayMode.application
ghenv.Component.Category = "Wasp"
ghenv.Component.SubCategory = "X | Experimental"
try: ghenv.Component.AdditionalHelpFromDocStrings = "4"
except: pass


import sys
import Rhino.Geometry as rg
import Grasshopper as gh


## add Wasp install directory to system path
wasp_loaded = False
ghcompfolder = gh.Folders.DefaultAssemblyFolder
if ghcompfolder not in sys.path:
    sys.path.append(ghcompfolder)
try:
    from wasp import __version__
    wasp_loaded = True
except:
    msg = "Cannot import Wasp. Is the wasp folder available in " + ghcompfolder + "?"
    ghenv.Component.AddRuntimeMessage(gh.Kernel.GH_RuntimeMessageLevel.Error, msg)

## if Wasp is installed correctly, load the classes required by the component
if wasp_loaded:
    from wasp.core import Aggregation


def main(parts, previous_parts, rules_sequence, aggregation_id, reset, aggregation):
    
    check_data = True
    ##check inputs
    if len(parts) == 0:
        check_data = False
        msg = "No parts provided"
        ghenv.Component.AddRuntimeMessage(gh.Kernel.GH_RuntimeMessageLevel.Warning, msg)
            
    if len(rules_sequence) == 0:
        check_data = False
        msg = "No rules sequence provided"
        ghenv.Component.AddRuntimeMessage(gh.Kernel.GH_RuntimeMessageLevel.Warning, msg)
            
    if aggregation_id is None:
        aggregation_id = 'mySequence'
            
    if check_data:
        if aggregation is None or aggregation == -1 or reset:
            
            ## copy parts to avoid editing the original parts
            parts_copy = []
            for part in parts:
                parts_copy.append(part.copy())
            
            aggregation = Aggregation(aggregation_id, parts_copy, [], 0, _prev = previous_parts)
            
            error_msg = aggregation.aggregate_sequence(rules_sequence)
            if error_msg is not None:
                ghenv.Component.AddRuntimeMessage(gh.Kernel.GH_RuntimeMessageLevel.Warning, error_msg)
        
        return aggregation
    else:
        return -1

## create aggregation container in global variables dict
if 'aggregation_container' not in globals():
    aggregation_container = None

result = main(PART, PREV, RULES, ID, RESET, aggregation_container)

if result != -1:
    aggregation_container = result
    
    AGGR = aggregation_container
    PART_OUT = aggregation_container.aggregated_parts
# ---------- end graphaggr ----------
partgeo_4 = Wasp_GetPartGeometry(PART=graphaggr.PART_OUT)  # -> GEO; same code as partgeo
move_2 = Move(Geometry=partgeo_4, Motion=Y)  # -> Geometry, Transform
preview_2 = CustomPreview(Geometry=move_2.Geometry, Material=ColourSwatch(SwatchColor=RGB(110, 255, 0)))
