# Grasshopper definition 180603_LibraryImport_test.gh (Grasshopper 1.0.5)

python = GhPythonScript()  # -> out, a
# ---------- python: Python ----------
__author__ = "Andreas Rossi"
__version__ = "2018.06.02"

import rhinoscriptsyntax as rs

import sys

full_path = sys.path[0] + "\\test"
print full_path

if not full_path in sys.path:
    sys.path.append(full_path)

import myLib
import myOtherLib

bob = myLib.myClass("bob")
bob.hello()
myOtherLib.banana()
# ---------- end python ----------
