# Grasshopper definition 210519_FieldFixes_0_5_004.gh (Grasshopper 1.0.7)

geo = Geometry(<brep referenced from the Rhino model>)
panel = Panel("1.5")
fieldpts = Wasp_FieldPoints(BOU=geo, RES=Slider(0.5, range=0..10))  # -> E_FIELD, PTS; inputs BOU: list of Mesh, PLN: Plane
# ---------- fieldpts: Python ----------
# Wasp: Discrete Design with Grasshopper plug-in (GPL) initiated by Andrea Rossi
# 
# This file is part of Wasp.
# 
# Copyright (c) 2017, Andrea Rossi <a.rossi.andrea@gmail.com>
# Wasp is free software; you can redistribute it and/or modify 
# it under the terms of the GNU General Public License as published 
# by the Free Software Foundation; either version 3 of the License, 
# or (at your option) any later version. 
# 
# Wasp is distributed in the hope that it will be useful,
# but WITHOUT ANY WARRANTY; without even the implied warranty of 
# MERCHANTABILITY or FITNESS FOR A PARTICULAR PURPOSE. See the 
# GNU General Public License for more details.
# 
# You should have received a copy of the GNU General Public License
# along with Wasp; If not, see <http://www.gnu.org/licenses/>.
# 
# @license GPL-3.0 <https://www.gnu.org/licenses/gpl.html>
#
# Significant parts of Wasp have been developed by Andrea Rossi
# as part of research on digital materials and discrete design at:
# DDU Digital Design Unit - Prof. Oliver Tessmann
# Technische Universität Darmstadt


#########################################################################
##                            COMPONENT INFO                           ##
#########################################################################

"""
Generate a 3d point grid to be fed to the field component
-
Provided by Wasp 0.5
    Args:
        BOU: List of geometries defining the boundaries of the field. Geometries must be closed breps or meshes.
        RES: Resolution (Dimension of each cell)
        PLN: OPTIONAL // Field base plane (WorldXY by default)
    Returns:
        E_FIELD: Empty field. Assign values with the "Wasp_Field" component
        PTS: Field points
"""

ghenv.Component.Name = "Wasp_Field Points"
ghenv.Component.NickName = 'FieldPts'
ghenv.Component.Message = 'v0.5.004'
ghenv.Component.IconDisplayMode = ghenv.Component.IconDisplayMode.application
ghenv.Component.Category = "Wasp"
ghenv.Component.SubCategory = "5 | Fields"
try: ghenv.Component.AdditionalHelpFromDocStrings = "1"
except: pass


import sys
import Rhino.Geometry as rg
import Grasshopper as gh
import math


## add Wasp install directory to system path
wasp_loaded = False
ghcompfolder = gh.Folders.DefaultAssemblyFolder
if ghcompfolder not in sys.path:
    sys.path.append(ghcompfolder)
try:
    from wasp import __version__
    wasp_loaded = True
except:
    msg = "Cannot import Wasp. Is the wasp folder available in " + ghcompfolder + "?"
    ghenv.Component.AddRuntimeMessage(gh.Kernel.GH_RuntimeMessageLevel.Error, msg)

## if Wasp is installed correctly, load the classes required by the component
if wasp_loaded:
    from wasp.field import Field


def main(boundaries, resolution, base_plane):
    
    check_data = True
    
    ##check inputs
    if len(boundaries) == 0:
        check_data = False
        msg = "No boundary geometry provided"
        ghenv.Component.AddRuntimeMessage(gh.Kernel.GH_RuntimeMessageLevel.Warning, msg)
    
    if base_plane is None:
        base_plane = rg.Plane.WorldXY
    
    if resolution is None and len(boundaries) != 0:
        global_bbox = None
        for geo in boundaries:
            if global_bbox is None:
                global_bbox = rg.Box(base_plane, geo)
            else:
                new_box = rg.Box(base_plane, geo)
                for corner in new_box.GetCorners():
                    global_bbox.Union(corner)
        
        x_size = global_bbox.X.Max - global_bbox.X.Min
        
        resolution = x_size / 10
        
        msg = "No resolution provided. Default resolution set to %f units"%(resolution)
        ghenv.Component.AddRuntimeMessage(gh.Kernel.GH_RuntimeMessageLevel.Warning, msg)
        
    if check_data:
        global_bbox = None
        for geo in boundaries:
            bbox = geo.GetBoundingBox(True)
            
            if global_bbox is None:
                global_bbox = bbox
            else:
                global_bbox.Union(bbox)
        
        x_size = global_bbox.Max.X - global_bbox.Min.X
        x_count = int(math.ceil(x_size / resolution)) + 1
        y_size = global_bbox.Max.Y - global_bbox.Min.Y
        y_count = int(math.ceil(y_size / resolution)) + 1
        z_size = global_bbox.Max.Z - global_bbox.Min.Z
        z_count = int(math.ceil(z_size / resolution)) + 1
        
        count = [x_count, y_count, z_count]
        
        pts = []
        s_pt = global_bbox.Min
        
        for z in range(z_count):
            for y in range(y_count):
                for x in range(x_count):
                    pt = rg.Point3d(s_pt.X + x*resolution, s_pt.Y + y*resolution, s_pt.Z + z*resolution)
                    pts.append(pt)
        
        #empty_field = Field(None, pts, count, resolution, boundaries = boundaries)
        empty_field = Field.from_boundaries(boundaries, resolution, _plane = base_plane)
        return empty_field.pts, empty_field
        
    else:
        return -1


result = main(BOU, RES, PLN)

if result != -1:
    PTS = result[0]
    E_FIELD = result[1]
# ---------- end fieldpts ----------
crv = Curve(<curve referenced from the Rhino model>)
pull = PullPoint(Point=fieldpts.PTS, Geometry=crv, ClosestOnly=True)  # -> ClosestPoint, Distance
bnd = Bounds(Numbers=pull.Distance)
remap = RemapNumbers(Value=pull.Distance, Source=bnd, Target="1 To 0")  # -> Mapped, Clipped
field = Wasp_Field(E_FIELD=fieldpts.E_FIELD, VAL=remap.Mapped)  # -> FIELD; inputs VAL: list
#   port NAME: OPTIONAL // Field name (needed for multi-field aggregation)
#   port E_FIELD: Empty field where to store values. Created with "Wasp_Field Points" component
# ---------- field: Python ----------
# Wasp: Discrete Design with Grasshopper plug-in (GPL) initiated by Andrea Rossi
# 
# This file is part of Wasp.
# 
# Copyright (c) 2017, Andrea Rossi <a.rossi.andrea@gmail.com>
# Wasp is free software; you can redistribute it and/or modify 
# it under the terms of the GNU General Public License as published 
# by the Free Software Foundation; either version 3 of the License, 
# or (at your option) any later version. 
# 
# Wasp is distributed in the hope that it will be useful,
# but WITHOUT ANY WARRANTY; without even the implied warranty of 
# MERCHANTABILITY or FITNESS FOR A PARTICULAR PURPOSE. See the 
# GNU General Public License for more details.
# 
# You should have received a copy of the GNU General Public License
# along with Wasp; If not, see <http://www.gnu.org/licenses/>.
# 
# @license GPL-3.0 <https://www.gnu.org/licenses/gpl.html>
#
# Significant parts of Wasp have been developed by Andrea Rossi
# as part of research on digital materials and discrete design at:
# DDU Digital Design Unit - Prof. Oliver Tessmann
# Technische Universität Darmstadt


#########################################################################
##                            COMPONENT INFO                           ##
#########################################################################

"""
Generates a scalar field given a grid of points and their relative scalar values
-
Provided by Wasp 0.5
    Args:
        BOU: List of geometries defining the boundaries of the field. Geometries must be closed breps or meshes. All points of the field outside the geometries will be assigned a 0 value
        PTS: 3d point grid (from FieldPts component)
        COUNT: Vector storing cell counts for each axis (from FieldPts component)
        RES: Resolution of cell grid
        VAL: Values to assign to each cell
    Returns:
        FIELD: Field object (to be used to drive the FieldAggr component)
"""

ghenv.Component.Name = "Wasp_Field"
ghenv.Component.NickName = 'Field'
ghenv.Component.Message = 'v0.5.003'
ghenv.Component.IconDisplayMode = ghenv.Component.IconDisplayMode.application
ghenv.Component.Category = "Wasp"
ghenv.Component.SubCategory = "5 | Fields"
try: ghenv.Component.AdditionalHelpFromDocStrings = "1"
except: pass


import sys
import Rhino.Geometry as rg
import Grasshopper as gh


## add Wasp install directory to system path
wasp_loaded = False
ghcompfolder = gh.Folders.DefaultAssemblyFolder
if ghcompfolder not in sys.path:
    sys.path.append(ghcompfolder)
try:
    from wasp import __version__
    wasp_loaded = True
except:
    msg = "Cannot import Wasp. Is the wasp folder available in " + ghcompfolder + "?"
    ghenv.Component.AddRuntimeMessage(gh.Kernel.GH_RuntimeMessageLevel.Error, msg)

## if Wasp is installed correctly, load the classes required by the component
if wasp_loaded:
    from wasp.field import Field


def main(name, empty_field, values):
    
    check_data = True
    
    ##check inputs
    if name is None:
        name = "field"
    
    if empty_field is None:
        check_data = False
        msg = "No base empty field provided"
        ghenv.Component.AddRuntimeMessage(gh.Kernel.GH_RuntimeMessageLevel.Warning, msg)
    else:
        
        values_count = empty_field.x_count*empty_field.y_count*empty_field.z_count
        
        if len(values) == 0:
            check_data = False
            msg = "No field values provided"
            ghenv.Component.AddRuntimeMessage(gh.Kernel.GH_RuntimeMessageLevel.Warning, msg)
            
        elif values_count != len(values):
            check_data = False
            msg = "Field points and Values lists are not matching. Please provide a number of values matching the number of points in the base field."
            ghenv.Component.AddRuntimeMessage(gh.Kernel.GH_RuntimeMessageLevel.Error, msg)
    
    if check_data:
        #count = empty_field.return_count_vec()
        points = [rg.Point3d(v[0], v[1], v[2]) for v in empty_field.return_pts_list()]
        field = Field(name, points, empty_field.return_count_vec(), empty_field.resolution, boundaries = empty_field.boundaries, plane = empty_field.plane)
        field.set_values(values, use_boundaries = True)
        return field
    else:
        return -1


result = main(NAME, E_FIELD, VAL)

if result != -1:
    FIELD = result
# ---------- end field ----------
range = Range(Domain=Domain(0, 1), Steps=Slider(50, range=0..100))
loadfield = Wasp_LoadFieldFromFile(FILE="D:\Github\Wasp\devFiles\data\fieldFixes.json", LOAD=Button())  # -> FIELD; inputs LOAD: Boolean
# ---------- loadfield: Python ----------
# Wasp: Discrete Design with Grasshopper plug-in (GPL) initiated by Andrea Rossi
# 
# This file is part of Wasp.
# 
# Copyright (c) 2017, Andrea Rossi <a.rossi.andrea@gmail.com>
# Wasp is free software; you can redistribute it and/or modify 
# it under the terms of the GNU General Public License as published 
# by the Free Software Foundation; either version 3 of the License, 
# or (at your option) any later version. 
# 
# Wasp is distributed in the hope that it will be useful,
# but WITHOUT ANY WARRANTY; without even the implied warranty of 
# MERCHANTABILITY or FITNESS FOR A PARTICULAR PURPOSE. See the 
# GNU General Public License for more details.
# 
# You should have received a copy of the GNU General Public License
# along with Wasp; If not, see <http://www.gnu.org/licenses/>.
# 
# @license GPL-3.0 <https://www.gnu.org/licenses/gpl.html>
#
# Significant parts of Wasp have been developed by Andrea Rossi
# as part of research on digital materials and discrete design at:
# DDU Digital Design Unit - Prof. Oliver Tessmann
# Technische Universität Darmstadt


#########################################################################
##                            COMPONENT INFO                           ##
#########################################################################

"""
Loads an aggregation from a previously saved .txt file
-
Provided by Wasp 0.5
    Args:
        FILE: File where the field is saved (.json)
        LOAD: True to reload the saved file
    Returns:
        FIELD: Imported field
"""

ghenv.Component.Name = "Wasp_Load Field from File"
ghenv.Component.NickName = 'LoadField'
ghenv.Component.Message = 'v0.5.004'
ghenv.Component.IconDisplayMode = ghenv.Component.IconDisplayMode.application
ghenv.Component.Category = "Wasp"
ghenv.Component.SubCategory = "5 | Fields"
try: ghenv.Component.AdditionalHelpFromDocStrings = "3"
except: pass


import sys
import Grasshopper as gh
import json


## add Wasp install directory to system path
wasp_loaded = False
ghcompfolder = gh.Folders.DefaultAssemblyFolder
if ghcompfolder not in sys.path:
    sys.path.append(ghcompfolder)
try:
    from wasp import __version__
    wasp_loaded = True
except:
    msg = "Cannot import Wasp. Is the wasp folder available in " + ghcompfolder + "?"
    ghenv.Component.AddRuntimeMessage(gh.Kernel.GH_RuntimeMessageLevel.Error, msg)

## if Wasp is installed correctly, load the classes required by the component
if wasp_loaded:
    from wasp.field import Field


def main(file_path, load_file, field):
        
    check_data = True
    
    ## check inputs
    if file_path is None:
        check_data = False
        msg = "No path provided for the file to load"
        ghenv.Component.AddRuntimeMessage(gh.Kernel.GH_RuntimeMessageLevel.Warning, msg)
    
    if load_file is None:
        load_file = False
    
    ## execute main code if all needed inputs are available
    if check_data:
        
        if field is None or load_file:
            field_dict = {}
            
            ## load json data
            with open(file_path, "r") as inF:
                txt_data = inF.read()
                field_dict = json.loads(txt_data)
            
            field = Field.from_data(field_dict)
        
        return field
        
    else:
        return -1


## create aggregation container in global variables dict
if 'field_container' not in globals():
    field_container = None

result = main(FILE, LOAD, field_container)

if result != -1:
    FIELD = result
# ---------- end loadfield ----------
panel_2 = Panel("0.9")
savefield = Wasp_SaveFieldToFile(FIELD=field, PATH="D:\Github\Wasp\devFiles\data", NAME="fieldFixes", SAVE=Button())  # -> FILE
# ---------- savefield: Python ----------
# Wasp: Discrete Design with Grasshopper plug-in (GPL) initiated by Andrea Rossi
# 
# This file is part of Wasp.
# 
# Copyright (c) 2017, Andrea Rossi <a.rossi.andrea@gmail.com>
# Wasp is free software; you can redistribute it and/or modify 
# it under the terms of the GNU General Public License as published 
# by the Free Software Foundation; either version 3 of the License, 
# or (at your option) any later version. 
# 
# Wasp is distributed in the hope that it will be useful,
# but WITHOUT ANY WARRANTY; without even the implied warranty of 
# MERCHANTABILITY or FITNESS FOR A PARTICULAR PURPOSE. See the 
# GNU General Public License for more details.
# 
# You should have received a copy of the GNU General Public License
# along with Wasp; If not, see <http://www.gnu.org/licenses/>.
# 
# @license GPL-3.0 <https://www.gnu.org/licenses/gpl.html>
#
# Significant parts of Wasp have been developed by Andrea Rossi
# as part of research on digital materials and discrete design at:
# DDU Digital Design Unit - Prof. Oliver Tessmann
# Technische Universität Darmstadt


#########################################################################
##                            COMPONENT INFO                           ##
#########################################################################

"""
Saves current status of an aggregation to a .json file.
-
Provided by Wasp 0.5
    Args:
        FIELD: Field to save
        PATH: Path where to save the field
        NAME: Name of the exported file
        SAVE: True to export
    Returns:
        FILE: Path to the saved file
"""

ghenv.Component.Name = "Wasp_Save Field to File"
ghenv.Component.NickName = 'SaveField'
ghenv.Component.Message = 'v0.5.004'
ghenv.Component.IconDisplayMode = ghenv.Component.IconDisplayMode.application
ghenv.Component.Category = "Wasp"
ghenv.Component.SubCategory = "5 | Fields"
try: ghenv.Component.AdditionalHelpFromDocStrings = "3"
except: pass


import sys
import os
import Rhino.Geometry as rg
import Grasshopper as gh
import json


## add Wasp install directory to system path
wasp_loaded = False
ghcompfolder = gh.Folders.DefaultAssemblyFolder
if ghcompfolder not in sys.path:
    sys.path.append(ghcompfolder)
try:
    from wasp import __version__
    wasp_loaded = True
except:
    msg = "Cannot import Wasp. Is the wasp folder available in " + ghcompfolder + "?"
    ghenv.Component.AddRuntimeMessage(gh.Kernel.GH_RuntimeMessageLevel.Error, msg)

## if Wasp is installed correctly, load the classes required by the component
if wasp_loaded:
    from wasp.field import Field


def main(field, path, filename, save):
        
    check_data = True
    
    ## check inputs
    if field is None:
        check_data = False
        msg = "No field provided"
        ghenv.Component.AddRuntimeMessage(gh.Kernel.GH_RuntimeMessageLevel.Warning, msg)
    
    if path is None:
        check_data = False
        msg = "No path provided"
        ghenv.Component.AddRuntimeMessage(gh.Kernel.GH_RuntimeMessageLevel.Warning, msg)
    
    if filename is None:
        check_data = False
        msg = "No filename provided"
        ghenv.Component.AddRuntimeMessage(gh.Kernel.GH_RuntimeMessageLevel.Warning, msg)
    
    if save is None:
        save = False
    
    ## execute main code if all needed inputs are available
    if check_data:
        
        full_path = os.path.join(path, filename + ".json")
        
        if save:
            field_dict = field.to_data()
            
            with open(full_path, "w") as outF:
                json.dump(field_dict, outF)
        
        return full_path
    else:
        return -1

result = main(FIELD, PATH, NAME, SAVE)

if result != -1:
    FILE = result
# ---------- end savefield ----------
fieldvox = Wasp_FieldIsoVoxels(FIELD=loadfield, ISO=Slider(0.745, range=0..1))  # -> VM
# ---------- fieldvox: Python ----------
# Wasp: Discrete Design with Grasshopper plug-in (GPL) initiated by Andrea Rossi
# 
# This file is part of Wasp.
# 
# Copyright (c) 2017, Andrea Rossi <a.rossi.andrea@gmail.com>
# Wasp is free software; you can redistribute it and/or modify 
# it under the terms of the GNU General Public License as published 
# by the Free Software Foundation; either version 3 of the License, 
# or (at your option) any later version. 
# 
# Wasp is distributed in the hope that it will be useful,
# but WITHOUT ANY WARRANTY; without even the implied warranty of 
# MERCHANTABILITY or FITNESS FOR A PARTICULAR PURPOSE. See the 
# GNU General Public License for more details.
# 
# You should have received a copy of the GNU General Public License
# along with Wasp; If not, see <http://www.gnu.org/licenses/>.
# 
# @license GPL-3.0 <https://www.gnu.org/licenses/gpl.html>
#
# Significant parts of Wasp have been developed by Andrea Rossi
# as part of research on digital materials and discrete design at:
# DDU Digital Design Unit - Prof. Oliver Tessmann
# Technische Universität Darmstadt


#########################################################################
##                            COMPONENT INFO                           ##
#########################################################################

"""
Compute a voxel-mesh of the given field at the chosen iso-level.
-
Provided by Wasp 0.5
    Args:
        FIELD: Field object to extract iso-voxels from
        ISO: Isolevel of the voxel mesh
    Returns:
        VM: Voxel mesh at the chosen iso-level
"""

ghenv.Component.Name = "Wasp_Field Iso Voxels"
ghenv.Component.NickName = 'FieldVox'
ghenv.Component.Message = 'v0.5.004'
ghenv.Component.IconDisplayMode = ghenv.Component.IconDisplayMode.application
ghenv.Component.Category = "Wasp"
ghenv.Component.SubCategory =  "5 | Fields"
try: ghenv.Component.AdditionalHelpFromDocStrings = "2"
except: pass


import sys
import Rhino.Geometry as rg
import Grasshopper as gh
import math


## add Wasp install directory to system path
wasp_loaded = False
ghcompfolder = gh.Folders.DefaultAssemblyFolder
if ghcompfolder not in sys.path:
    sys.path.append(ghcompfolder)
try:
    from wasp import __version__
    wasp_loaded = True
except:
    msg = "Cannot import Wasp. Is the wasp folder available in " + ghcompfolder + "?"
    ghenv.Component.AddRuntimeMessage(gh.Kernel.GH_RuntimeMessageLevel.Error, msg)

## if Wasp is installed correctly, load the classes required by the component
if wasp_loaded:
    pass


def main(field, iso):
    check_data = True
    
    ##check inputs
    if field is None:
        check_data = False
        msg = "No field provided"
        ghenv.Component.AddRuntimeMessage(gh.Kernel.GH_RuntimeMessageLevel.Warning, msg)
    
    if iso is None:
        check_data = False
        msg = "No isolevel provided"
        ghenv.Component.AddRuntimeMessage(gh.Kernel.GH_RuntimeMessageLevel.Warning, msg)
    
    if check_data:
        
        return field.compute_voxel_mesh(iso)
    else:
        return -1

result = main(FIELD, ISO)

if result != -1:
    VM = result
# ---------- end fieldvox ----------
fieldiso = Wasp_FieldIsolines(FIELD=loadfield, T=range, ISO=Slider(0.66, range=0..1))  # -> CRV; inputs PLN: Plane
# ---------- fieldiso: Python ----------
# Wasp: Discrete Design with Grasshopper plug-in (GPL) initiated by Andrea Rossi
# 
# This file is part of Wasp.
# 
# Copyright (c) 2017, Andrea Rossi <a.rossi.andrea@gmail.com>
# Wasp is free software; you can redistribute it and/or modify 
# it under the terms of the GNU General Public License as published 
# by the Free Software Foundation; either version 3 of the License, 
# or (at your option) any later version. 
# 
# Wasp is distributed in the hope that it will be useful,
# but WITHOUT ANY WARRANTY; without even the implied warranty of 
# MERCHANTABILITY or FITNESS FOR A PARTICULAR PURPOSE. See the 
# GNU General Public License for more details.
# 
# You should have received a copy of the GNU General Public License
# along with Wasp; If not, see <http://www.gnu.org/licenses/>.
# 
# @license GPL-3.0 <https://www.gnu.org/licenses/gpl.html>
#
# Significant parts of Wasp have been developed by Andrea Rossi
# as part of research on digital materials and discrete design at:
# DDU Digital Design Unit - Prof. Oliver Tessmann
# Technische Universität Darmstadt


#########################################################################
##                            COMPONENT INFO                           ##
#########################################################################

"""
Draws isolines across a field object
--> WIP Component: might be incomplete or contain bugs! <--
-
Provided by Wasp 0.5
    Args:
        FIELD: Field object to extract isolines from
        PLN: Plane for isolines extraction (0: XY Plane, 1: YZ Plane, 2: XZ Plane)
        T: Z parameter where to extract isolines
        ISO: Isolevel of the curves
    Returns:
        CRV: Isocurves
"""

ghenv.Component.Name = "Wasp_Field Isolines"
ghenv.Component.NickName = 'FieldIso'
ghenv.Component.Message = 'v0.5.004'
ghenv.Component.IconDisplayMode = ghenv.Component.IconDisplayMode.application
ghenv.Component.Category = "Wasp"
ghenv.Component.SubCategory =  "5 | Fields"
try: ghenv.Component.AdditionalHelpFromDocStrings = "2"
except: pass


import sys
import Rhino.Geometry as rg
import Grasshopper as gh
import math


## add Wasp install directory to system path
wasp_loaded = False
ghcompfolder = gh.Folders.DefaultAssemblyFolder
if ghcompfolder not in sys.path:
    sys.path.append(ghcompfolder)
try:
    from wasp import __version__
    wasp_loaded = True
except:
    msg = "Cannot import Wasp. Is the wasp folder available in " + ghcompfolder + "?"
    ghenv.Component.AddRuntimeMessage(gh.Kernel.GH_RuntimeMessageLevel.Error, msg)

## if Wasp is installed correctly, load the classes required by the component
if wasp_loaded:
    pass



def main(field, plane, t, iso):
    contour_lookup = {"0000":-1, "0001":[[(0,0.5),(0.5,1)]], "0010":[[(0.5,1),(1,0.5)]], "0011":[[(0,0.5),(1,0.5)]],
                      "0100":[[(0.5,0),(1,0.5)]], "0101":[[(0,0.5),(0.5,0)], [(0.5,1),(1,0.5)]], "0110":[[(0.5,0),(0.5,1)]], "0111":[[(0,0.5),(0.5,0)]],
                      "1000":[[(0,0.5),(0.5,0)]], "1001":[[(0.5,0),(0.5,1)]], "1010":[[(0,0.5),(0.5,1)], [(0.5,0),(1,0.5)]], "1011":[[(0.5,0),(1,0.5)]],
                      "1100":[[(0,0.5),(1,0.5)]], "1101":[[(0.5,1),(1,0.5)]], "1110":[[(0,0.5),(0.5,1)]], "1111":-1}
    
    check_data = True
    
    ##check inputs
    if field is None:
        check_data = False
        msg = "No field provided"
        ghenv.Component.AddRuntimeMessage(gh.Kernel.GH_RuntimeMessageLevel.Warning, msg)
    
    if plane is None:
        plane = 0
    
    if t is None:
        check_data = False
        msg = "No parameter provided"
        ghenv.Component.AddRuntimeMessage(gh.Kernel.GH_RuntimeMessageLevel.Warning, msg)
    
    if iso is None:
        check_data = False
        msg = "No isolevel provided"
        ghenv.Component.AddRuntimeMessage(gh.Kernel.GH_RuntimeMessageLevel.Warning, msg)
    
    if check_data:
        binary_matrix = []
        contour_cases = []
        contours = []
        base_plane = None
        target_pt = field.bbox.PointAt(0,0,0)
        target_plane = None
        
        #XY Plane contouring
        if plane == 0:
            ## THRESHOLDING
            z = int(math.floor(field.z_count*t))
            if z == field.z_count:
                z -= 1
            
            for y in range(field.y_count):
                binary_matrix.append([])
                for x in range(field.x_count):
                    if field.vals[z][y][x] < iso:
                        binary_matrix[y].append("0")
                    else:
                        binary_matrix[y].append("1")
            
            ## CASES DEFINITION
            for y in range(0, field.y_count-1):
                contour_cases.append([])
                for x in range(0, field.x_count-1):
                    c_case = ""
                    c_case += binary_matrix[y][x]
                    c_case += binary_matrix[y][x+1]
                    c_case += binary_matrix[y+1][x+1]
                    c_case += binary_matrix[y+1][x]
                    contour_cases[y].append(c_case)
            
            ## CONTOURS GENERATION
            base_plane = rg.Plane.WorldXY
            target_pt += field.plane.ZAxis*(z*field.resolution)
            target_plane = rg.Plane(target_pt, field.plane.XAxis, field.plane.YAxis)
            
            for y in range(0, field.y_count-1):
                for x in range(0, field.x_count-1):
                    c_case = contour_cases[y][x]
                    c_shape = contour_lookup[c_case]
                    if c_shape != -1:
                        for shape in c_shape:
                            c_start = rg.Point3d(x + shape[0][0], y + shape[0][1], 0)
                            c_end = rg.Point3d(x + shape[1][0], y + shape[1][1], 0)
                            contour = rg.Line(c_start, c_end).ToNurbsCurve()
                            contours.append(contour)
        
        #YZ Plane contouring
        elif plane == 1:
            ## THRESHOLDING
            x = int(math.floor(field.x_count*t))
            if x == field.x_count:
                x -= 1
            
            for z in range(field.z_count):
                binary_matrix.append([])
                for y in range(field.y_count):
                    if field.vals[z][y][x] < iso:
                        binary_matrix[z].append("0")
                    else:
                        binary_matrix[z].append("1")
            
            ## CASES DEFINITION
            for z in range(0, field.z_count-1):
                contour_cases.append([])
                for y in range(0, field.y_count-1):
                    c_case = ""
                    c_case += binary_matrix[z][y]
                    c_case += binary_matrix[z][y+1]
                    c_case += binary_matrix[z+1][y+1]
                    c_case += binary_matrix[z+1][y]
                    contour_cases[z].append(c_case)
            
            ## CONTOURS GENERATION
            base_plane = rg.Plane.WorldYZ
            target_pt += field.plane.XAxis*(x*field.resolution)
            target_plane = rg.Plane(target_pt, field.plane.YAxis, field.plane.ZAxis)
            
            for z in range(0, field.z_count-1):
                for y in range(0, field.y_count-1):
                    c_case = contour_cases[z][y]
                    c_shape = contour_lookup[c_case]
                    if c_shape != -1:
                        for shape in c_shape:
                            c_start = rg.Point3d(0, y + shape[0][0], z + shape[0][1])
                            c_end = rg.Point3d(0, y + shape[1][0], z + shape[1][1])
                            contour = rg.Line(c_start, c_end).ToNurbsCurve()
                            contours.append(contour)
        
        #XZ Plane contouring
        elif plane == 2:
            ## THRESHOLDING
            y = int(math.floor(field.y_count*t))
            if y == field.y_count:
                y -= 1
            
            for z in range(field.z_count):
                binary_matrix.append([])
                for x in range(field.x_count):
                    if field.vals[z][y][x] < iso:
                        binary_matrix[z].append("0")
                    else:
                        binary_matrix[z].append("1")
            
            ## CASES DEFINITION
            for z in range(0, field.z_count-1):
                contour_cases.append([])
                for x in range(0, field.x_count-1):
                    c_case = ""
                    c_case += binary_matrix[z][x]
                    c_case += binary_matrix[z][x+1]
                    c_case += binary_matrix[z+1][x+1]
                    c_case += binary_matrix[z+1][x]
                    contour_cases[z].append(c_case)
            
            ## CONTOURS GENERATION
            base_plane = rg.Plane.WorldZX
            target_pt += field.plane.YAxis*(y*field.resolution)
            target_plane = rg.Plane(target_pt, field.plane.ZAxis, field.plane.XAxis)
            
            for z in range(0, field.z_count-1):
                for x in range(0, field.x_count-1):
                    c_case = contour_cases[z][x]
                    c_shape = contour_lookup[c_case]
                    if c_shape != -1:
                        for shape in c_shape:
                            c_start = rg.Point3d(x + shape[0][0], 0, z + shape[0][1])
                            c_end = rg.Point3d(x + shape[1][0], 0, z + shape[1][1])
                            contour = rg.Line(c_start, c_end).ToNurbsCurve()
                            contours.append(contour)
        
        contour_curves = rg.Curve.JoinCurves(contours)
        scale_transform = rg.Transform.Scale(rg.Point3d(0,0,0), field.resolution)
        
        orient_transform = rg.Transform.PlaneToPlane(base_plane, target_plane)
        for curve in contour_curves:
            curve.Transform(scale_transform)
            curve.Transform(orient_transform)
        
        return contour_curves
    else:
        return -1

result = main(FIELD, PLN, T, ISO)

if result != -1:
    CRV = result
# ---------- end fieldiso ----------
