# Grasshopper definition meshCollisions.gh (Grasshopper 1.0.7)

number_slider = Slider(100, range=0..100)
number_slider_2 = Slider(100, range=0..100)
box = CenterBox(Base=PlaneXY(0, 0, 0), X=number_slider, Y=number_slider, Z=number_slider)
pop3d = Populate3D(Region=box, Count=Slider(1000, range=0..1000), Seed=1)
msphere = MeshSphere(Base=pop3d, Radius=Slider(25, range=0..100), UCount=number_slider_2, VCount=number_slider_2)
cull_i = CullIndex(List=msphere, Indices="0", Wrap=True)
item = ListItem(List=msphere, Index="0", Wrap=True)

# ---- group: this is the issue
other_geos = GhPythonScript(test_geo=item, other_geos=cull_i)  # -> out, a; inputs test_geo: Mesh, other_geos: list of Mesh
# ---------- other_geos: Python ----------
from Rhino.Geometry.Intersect import Intersection


def main(test, geometries):
    for geo in geometries:
        #if len(Intersect.MeshClash.Search(test, geo, 0.001, 1)) > 0:
        if len(Intersection.MeshMeshFast(test, geo)) > 0:
            valid_coll = False
            break


main(test_geo, other_geos)
# ---------- end other_geos ----------
